# Grasshopper definition #GH_Illustrator.gh (Grasshopper 1.0.7)
# plug-ins: COREToolkitAdobeGh, Kangaroo2 Components, MeshEdit Components, Bifocals

panel = Panel("https://energyplus-weather.s3.amazonaws.com/asia_wmo_region_2/CHN/CHN_Shanghai.Shanghai.583670_IWEC/CHN_Shanghai.Shanghai.583670_IWEC.zip")
run = BooleanToggle(True)
downloadepw = LBDownloadWeather(weather_URL=panel)  # -> epw_file, stat_file, ddy_file; plug-in component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
illustrator_app = IllustratorApp(Activate=run)
epwmap = LBEPWmap(epw_map=Toggle(False))  # -> Output; plug-in component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
file_name = Panel("chart")
importepw = LBImportEPW(epw_file=downloadepw.epw_file)  # -> location, dry_bulb_temperature, dew_point_temperature, relative_humidity, wind_speed, wind_direction, direct_normal_rad, diffuse_horizontal_rad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; plug-in component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
document = Document(App=illustrator_app, Name=file_name)  # -> Doc, App
doc = Data(document.Doc)
基准点 = Point(Point(26.79652231, 123.6948345, 0))
hourlyplot = LBHourlyPlot(data=importepw.dry_bulb_temperature, base_pt=基准点, x_dim="1.5", y_dim="6")  # -> out, mesh, legend, borders, labels, title; plug-in component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

# ----
# 线框曲线分类
边框 = Curve(hourlyplot.borders)
explode = Explode(Curve=边框, Recursive=True)  # -> flatten(Segments), Vertices
removeduplicatelines = RemoveDuplicateLines(Lines=explode.Segments, Tolerance=0.01)
split_list = SplitList(List=hourlyplot.legend, Index="1")  # -> ListA, ListB
join_curves = JoinCurves(Curves=removeduplicatelines, Preserve=False)
closed = Closed(Curve=join_curves)  # -> Closed, Periodic
mesh_edges = MeshEdges(Mesh=split_list.ListA)  # -> NakedEdges, InteriorEdges, NonManifoldEdges
dispatch = Dispatch(List=join_curves, DispatchPattern=closed.Closed)  # -> ListA, ListB
mesh_explode = MeshExplode(Mesh=split_list.ListA, Interpolate=False)
图表说明 = Text(hourlyplot.labels)
图例网格 = Mesh(mesh_explode)
图例说明 = Text(split_list.ListB)
图表内部线条 = Curve(dispatch.ListB)
图例内部线条 = Curve(mesh_edges.InteriorEdges)
图表边框 = Curve(dispatch.ListA)
图例边框 = Curve(mesh_edges.NakedEdges)

边框_2 = Curve(hourlyplot.borders)
unit_x = UnitX(Factor=1)
closed_2 = Closed(Curve=边框_2)  # -> Closed, Periodic
dispatch_2 = Dispatch(List=边框_2, DispatchPattern=closed_2.Closed)  # -> ListA, ListB
unit_x_2 = UnitX(Factor=1)
unit_y = UnitY(Factor=1)
dot_product = DotProduct(VectorA=dispatch_2.ListB, VectorB=unit_x, Unitize=False)
amplitude = Amplitude(Vector=unit_x_2, Amplitude=Slider(12.95, range=10..20))
amplitude_2 = Amplitude(Vector=unit_y, Amplitude=Slider(12.4, range=10..20))
dispatch_3 = Dispatch(List=dispatch_2.ListB, DispatchPattern=dot_product)  # -> ListA, ListB
reverse = Reverse(Vector=amplitude)
end_points = EndPoints(Curve=dispatch_3.ListA)  # -> Start, End
move = Move(Geometry=end_points.Start, Motion=reverse)  # -> Geometry, Transform
move_2 = Move(Geometry=move.Geometry, Motion=amplitude_2)  # -> Geometry, Transform
时刻定位点 = Point(move_2.Geometry)

curve = Curve(dispatch_3.ListB)
unit_y_2 = UnitY(Factor=1)
unit_x_3 = UnitX(Factor=1)
end_points_2 = EndPoints(Curve=curve)  # -> Start, End
amplitude_3 = Amplitude(Vector=unit_y_2, Amplitude=Slider(5.41, range=0..20))
amplitude_4 = Amplitude(Vector=unit_x_3, Amplitude=Slider(22.78, range=20..50))
list_item = ListItem(List=end_points_2.Start, Index=0, Wrap=True)
reverse_2 = Reverse(Vector=amplitude_3)
reverse_3 = Reverse(Vector=amplitude_4)
move_3 = Move(Geometry=list_item, Motion=reverse_3)  # -> Geometry, Transform
multiplication = Multiplication(A=amplitude_4, B="2")
move_4 = Move(Geometry=move_3.Geometry, Motion=reverse_2)  # -> Geometry, Transform
linear_array = LinearArray(Geometry=move_4.Geometry, Direction=multiplication, Count="12")  # -> Geometry, Transform
月份定位点 = Point(linear_array.Geometry)

图例内部线条_2 = Curve(mesh_edges.InteriorEdges)
图例边框_2 = Curve(mesh_edges.NakedEdges)
unit_x_4 = UnitX(Factor=1)
merge = Merge(Data1=图例边框_2, Data2=图例内部线条_2)
explode_2 = Explode(Curve=merge, Recursive=True)  # -> flatten(Segments), Vertices
dot_product_2 = DotProduct(VectorA=explode_2.Segments, VectorB=unit_x_4, Unitize=False)
unit_x_5 = UnitX(Factor=1)
dispatch_4 = Dispatch(List=explode_2.Segments, DispatchPattern=dot_product_2)  # -> ListA, ListB
unit_y_3 = UnitY(Factor=1)
amplitude_5 = Amplitude(Vector=unit_x_5, Amplitude=Slider(5, range=0..10))
list_item_2 = ListItem(List=dispatch_4.ListA, Index=0, Wrap=True)
amplitude_6 = Amplitude(Vector=unit_y_3, Amplitude=Slider(10, range=0..20))
flip_curve = FlipCurve(Curve=dispatch_4.ListA, Guide=list_item_2)  # -> Curve, Flag
end_points_3 = EndPoints(Curve=flip_curve.Curve)  # -> Start, End
move_5 = Move(Geometry=end_points_3.End, Motion=amplitude_5)  # -> Geometry, Transform
move_6 = Move(Geometry=move_5.Geometry, Motion=amplitude_6)  # -> Geometry, Transform
deconstruct = Deconstruct(Point=move_6.Geometry)  # -> XComponent, YComponent, ZComponent
sort_list = SortList(Keys=deconstruct.YComponent, ValuesValuesA=move_6.Geometry)  # -> Keys, ValuesValuesA
图列说明定位点 = Point(sort_list.ValuesValuesA)

# ----
# 文字定位点设置
基准点_2 = Point(Point(26.79652231, 123.6948345, 0))
unit_y_4 = UnitY(Factor="22.5")
reverse_4 = Reverse(Vector=unit_y_4)
move_7 = Move(Geometry=基准点_2, Motion=reverse_4)  # -> Geometry, Transform
标题定位点 = Point(move_7.Geometry)

图表说明_2 = Text(图表说明)
split_list_2 = SplitList(List=图表说明_2, Index="5")  # -> ListA, ListB
时刻 = Text(split_list_2.ListA)
月份 = Text(split_list_2.ListB)

doc_2 = Data(doc)
# 绘制线条
图例内部线条_3 = Curve(图例内部线条)
create_path = CreatePath(GeometryPaths=图例内部线条_3)
图层名称 = Panel("Interior_edges_legend")
线框粗细 = Panel("1")
boolean_toggle = BooleanToggle(True)
modify_illustrator_stroke = ModifyIllustratorStroke(Path=create_path, StrokeColor=ColourSwatch(SwatchColor=RGB(201, 201, 201)), Width=线框粗细)
layer = Layer(Doc=doc_2, Name=图层名称)  # -> Layer, Doc
add_paths = AddPaths(GeometryPath=modify_illustrator_stroke, Layer=layer.Layer, Clear=boolean_toggle, Bake=boolean_toggle)  # -> Path, Layer

# ----
# 绘制网格
图例网格_2 = Mesh(图例网格)
doc_3 = Data(doc)
deconstruct_mesh = DeconstructMesh(Mesh=图例网格_2)  # -> Vertices, Faces, Colours, Normals
face_boundaries = FaceBoundaries(Mesh=图例网格_2)  # -> flatten(Boundaries)
list_item_3 = ListItem(List=deconstruct_mesh.Colours, Index=0, Wrap=True)  # -> flatten(Item)
create_path_2 = CreatePath(GeometryPaths=face_boundaries)
图层名称_2 = Panel("lable_mesh")
boolean_toggle_2 = BooleanToggle(True)
modify_illustrator_fill = ModifyIllustratorFill(Path=create_path_2, FillColor=list_item_3)
layer_2 = Layer(Doc=doc_3, Name=图层名称_2)  # -> Layer, Doc
modify_illustrator_stroke_2 = ModifyIllustratorStroke(Path=modify_illustrator_fill, Width="0")
add_paths_2 = AddPaths(GeometryPath=modify_illustrator_stroke_2, Layer=layer_2.Layer, Clear=boolean_toggle_2, Bake=boolean_toggle_2)  # -> Path, Layer

doc_4 = Data(doc)
图表内部线条_2 = Curve(图表内部线条)
图层名称_3 = Panel("Interior_edges_chart")
create_path_3 = CreatePath(GeometryPaths=图表内部线条_2)
线框粗细_2 = Panel("1")
boolean_toggle_3 = BooleanToggle(True)
modify_illustrator_stroke_3 = ModifyIllustratorStroke(Path=create_path_3, StrokeColor=ColourSwatch(SwatchColor=RGB(201, 201, 201)), Width=线框粗细_2)
layer_3 = Layer(Doc=doc_4, Name=图层名称_3)  # -> Layer, Doc
add_paths_3 = AddPaths(GeometryPath=modify_illustrator_stroke_3, Layer=layer_3.Layer, Clear=boolean_toggle_3, Bake=boolean_toggle_3)  # -> Path, Layer

图例边框_3 = Curve(图例边框)
doc_5 = Data(doc)
join_curves_2 = JoinCurves(Curves=图例边框_3, Preserve=False)
create_path_4 = CreatePath(GeometryPaths=join_curves_2)
图层名称_4 = Panel("Naked_edges_legend")
线框粗细_3 = Panel("2")
boolean_toggle_4 = BooleanToggle(True)
modify_illustrator_stroke_4 = ModifyIllustratorStroke(Path=create_path_4, StrokeColor=ColourSwatch(SwatchColor=RGB(128, 128, 128)), Width=线框粗细_3)
layer_4 = Layer(Doc=doc_5, Name=图层名称_4)  # -> Layer, Doc
add_paths_4 = AddPaths(GeometryPath=modify_illustrator_stroke_4, Layer=layer_4.Layer, Clear=boolean_toggle_4, Bake=boolean_toggle_4)  # -> Path, Layer

图表边框_2 = Curve(图表边框)
doc_6 = Data(doc)
create_path_5 = CreatePath(GeometryPaths=图表边框_2)
图层名称_5 = Panel("Naked_edges_chart")
线框粗细_4 = Panel("2")
boolean_toggle_5 = BooleanToggle(True)
modify_illustrator_stroke_5 = ModifyIllustratorStroke(Path=create_path_5, StrokeColor=ColourSwatch(SwatchColor=RGB(128, 128, 128)), Width=线框粗细_4)
layer_5 = Layer(Doc=doc_6, Name=图层名称_5)  # -> Layer, Doc
add_paths_5 = AddPaths(GeometryPath=modify_illustrator_stroke_5, Layer=layer_5.Layer, Clear=boolean_toggle_5, Bake=boolean_toggle_5)  # -> Path, Layer

标题定位点_2 = Point(标题定位点)
图层名称_6 = Panel("title")
# 绘制文字
表格标题 = Text(hourlyplot.title)
doc_7 = Data(doc)
boolean_toggle_6 = BooleanToggle(True)
layer_6 = Layer(Doc=doc_7, Name=图层名称_6)  # -> Layer, Doc
add_text_point = AddTextPoint(Text=表格标题, Point=标题定位点_2, Layer=layer_6.Layer, Clear=boolean_toggle_6, Bake=boolean_toggle_6)  # -> Text, Layer
字体 = Panel("Dubai-Regular")
文字尺寸 = Panel("8")
modify_text_font = ModifyTextFont(Text=add_text_point.Text, Font=字体, Size=文字尺寸, Justification=0)

图层名称_7 = Panel("label_time")
时刻定位点_2 = Point(时刻定位点)
doc_8 = Data(doc)
时刻_2 = Text(时刻)
boolean_toggle_7 = BooleanToggle(False)
layer_7 = Layer(Doc=doc_8, Name=图层名称_7)  # -> Layer, Doc
文字尺寸_2 = Panel("8")
字体_2 = Panel("Dubai-Regular")
add_text_point_2 = AddTextPoint(Text=时刻_2, Point=时刻定位点_2, Layer=layer_7.Layer, Clear=boolean_toggle_7, Bake=boolean_toggle_7)  # -> Text, Layer
modify_text_font_2 = ModifyTextFont(Text=add_text_point_2.Text, Font=字体_2, Size=文字尺寸_2, Justification=1)

图层名称_8 = Panel("label_month")
月份定位点_2 = Point(月份定位点)
doc_9 = Data(doc)
月份_2 = Text(月份)
boolean_toggle_8 = BooleanToggle(False)
layer_8 = Layer(Doc=doc_9, Name=图层名称_8)  # -> Layer, Doc
文字尺寸_3 = Panel("10")
字体_3 = Panel("Dubai-Regular")
add_text_point_3 = AddTextPoint(Text=月份_2, Point=月份定位点_2, Layer=layer_8.Layer, Clear=boolean_toggle_8, Bake=boolean_toggle_8)  # -> Text, Layer
modify_text_font_3 = ModifyTextFont(Text=add_text_point_3.Text, Font=字体_3, Size=文字尺寸_3, Justification=2)

图层名称_9 = Panel("label_legend")
doc_10 = Data(doc)
图列说明定位点_2 = Point(图列说明定位点)
图例说明_2 = Text(split_list.ListB)
shift_list = ShiftList(List=图例说明_2, Shift=1, Wrap=True)
boolean_toggle_9 = BooleanToggle(True)
layer_9 = Layer(Doc=doc_10, Name=图层名称_9)  # -> Layer, Doc
add_text_point_4 = AddTextPoint(Text=shift_list, Point=图列说明定位点_2, Layer=layer_9.Layer, Clear=boolean_toggle_9, Bake=boolean_toggle_9)  # -> Text, Layer
文字尺寸_4 = Panel("6")
字体_4 = Panel("Dubai-Regular")
modify_text_font_4 = ModifyTextFont(Text=add_text_point_4.Text, Font=字体_4, Size=文字尺寸_4, Justification=0)
