# Grasshopper definition #wind_rose.gh (Grasshopper 1.0.7)
# plug-ins: Bifocals

panel = Panel("https://climate.onebuilding.org/WMO_Region_2_Asia/CHN_China/SH_Shanghai/CHN_SH_Shanghai-Pudong.Intl.AP.583211_TMYx.zip")
epwmap = LBEPWmap(epw_map=Toggle(False))  # -> Output; plug-in component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
downloadepw = LBDownloadWeather(weather_URL=panel)  # -> epw_file, stat_file, ddy_file; plug-in component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
colrange = LBColorRange(index="14")  # -> colors; plug-in component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
importepw = LBImportEPW(epw_file=downloadepw.epw_file)  # -> location, dry_bulb_temperature, dew_point_temperature, relative_humidity, wind_speed, wind_direction, direct_normal_rad, diffuse_horizontal_rad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; plug-in component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
legendpar = LBLegendParameters(min="0", max="12", colors=colrange)  # -> leg_par; plug-in component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
series = Series(Start=0, Step="35", Count="3")
series_2 = Series(Start=0, Step="35", Count="4")
series_3 = Series(Start="1", Step=1, Count="12")
construct_point = ConstructPoint(XCoordinate=series_2, YCoordinate=graft(series), ZCoordinate=0)  # -> flatten(Point)
analysisperiod = LBAnalysisPeriod(start_month=series_3, start_day=1, start_hour=0, end_month=series_3)  # -> period, hoys, dates; plug-in component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
windrose = LBWindRose(
    data=importepw.wind_speed,
    wind_direction=importepw.wind_direction,
    dir_count="18",
    center_pt=construct_point,
    freq_dist="1",
    freq_hours="15",
    max_freq_lines="10",
    legend_par=legendpar,
    period=analysisperiod.period)  # -> out, mesh, compass, orient_line, freq_line, windrose_line, legend, title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; plug-in component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
curve = Curve(windrose.orient_line)
curve_2 = Curve(windrose.freq_line)
mesh = Mesh(windrose.mesh)
data = Data(windrose.compass)
data_2 = Data(windrose.legend)
data_3 = Data(windrose.title)
