# Grasshopper definition #11_Soumaya_museo.gh (Grasshopper 1.0.7)
# plug-ins: Bifocals, LunchBox, Kangaroo2 Components, Human, MeshEdit Components

control_curve = Curve([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])
boundary_curve = Curve([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])
area = Area(Geometry=control_curve)  # -> Area, Centroid

# ----
# 重建曲面
loft = Loft(Curves=boundary_curve, Options={Adjust=False, Closed=False, LoftEnds=0, LoftSimp=0, LoftType=0, Rebuild=10, Refit=0.01})
revsrf = ReverseSurfaceDirection(Surface=loft, ReverseOption=3)
hex = HexagonCells(Surface=revsrf, UDivisions="100", VDivisions="20", TParameter=0.25)  # -> HexagonCells, Centers
explode = Explode(Curve=hex.HexagonCells, Recursive=True)  # -> Segments, Vertices
duppt = RemoveDuplicatePts(Points=explode.Vertices, Tolerance=0.01)
ln = Line(StartPoint=graft(hex.Centers), EndPoint=duppt)
shift = ShiftList(List=ln, Shift=1, Wrap=True)
graft = GraftTree(Tree=explode.Segments, IncludeEmptyLists=True, IncludeNullItems=True)  # -> simplify(Tree)
graft_2 = GraftTree(Tree=ln, IncludeEmptyLists=True, IncludeNullItems=True)  # -> simplify(Tree)
graft_3 = GraftTree(Tree=shift, IncludeEmptyLists=True, IncludeNullItems=True)  # -> simplify(Tree)
join = JoinCurves(Curves=[graft, graft_2, graft_3], Preserve=False)
trim = TrimTree(Tree=join, Depth=2)
boundary = BoundarySurfaces(Edges=trim)
smesh = SimpleMesh(Brep=boundary)  # -> flatten(Mesh)
mjoin = MeshJoin(Meshes=smesh)
weld = WeldMesh(Mesh=mjoin, Angle=3.141592654)

preview = CustomPreview(Geometry=boundary_curve, Material=ColourSwatch(SwatchColor=RGB(255, 0, 0)))
preview_2 = CustomPreview(Geometry=control_curve, Material=ColourSwatch(SwatchColor=RGB(0, 102, 255)))

pdecon = Deconstruct(Point=area.Centroid)  # -> XComponent, YComponent, ZComponent
sort = SortList(Keys=pdecon.ZComponent, ValuesA=control_curve)  # -> Keys, ValuesA
previewlw = CustomPreviewLineweights(Geometry=hex.HexagonCells, Shader=ColourSwatch(SwatchColor=RGB(0, 0, 0)), Thickness="3", Absolute=False)

# ----
# 生形
demesh = DeconstructMesh(Mesh=weld)  # -> Vertices, Faces, Colours, Normals
pdecon_2 = Deconstruct(Point=demesh.Vertices)  # -> XComponent, YComponent, ZComponent
sort_2 = SortList(Keys=pdecon_2.ZComponent, ValuesA=demesh.Vertices)  # -> Keys, ValuesA
cset = CreateSet(List=sort_2.Keys)  # -> Set, Map
mindex = MemberIndex(Set=sort_2.Keys, Member=cset.Set)  # -> Index, Count
tstat = TreeStatistics(Tree=mindex.Index)  # -> Paths, Length, Count
panel = Panel("""0
-1""")
item = ListItem(List=tstat.Paths, Index=panel, Wrap=True)
branch = TreeBranch(Tree=mindex.Index, Path=item, MaintainPaths=True)
item_2 = ListItem(List=sort_2.ValuesA, Index=branch, Wrap=True)  # -> flatten(Item)
anchor = Anchor(Point=item_2, Strength=10000)

crv = Curve(graft(sort.ValuesA))
lng = ListLength(List=sort.ValuesA)
series = Series(Start="10", Step="10", Count=lng)
item_3 = ListItem(List=tstat.Paths, Index=series, Wrap=True)
branch_2 = TreeBranch(Tree=mindex.Index, Path=item_3, MaintainPaths=True)
item_4 = ListItem(List=sort_2.ValuesA, Index=branch_2, Wrap=True)
match = MatchTree(Tree=item_4, Guide=crv)
oncurve = OnCurve(Points=match, Curve=crv, Strength=1)

pt = Point(demesh.Vertices)
show = Show(G=pt)

edgelengths = EdgeLengths(Mesh=weld, LengthFactor=Slider(0.54, range=0..1), Strength="20")

smooth = Smooth(M=weld, Strength="50")

show_2 = Show(G=weld)

entwine = Entwine(
    Branch00=show,
    Branch01=show_2,
    Branch02=edgelengths,
    Branch03=smooth,
    Branch04=anchor,
    Branch05=oncurve,
    FlattenInputs=True)
solver = Solver(GoalObjects=entwine, Reset=Button(), Threshold=1e-15, Tolerance=0.0001, On=Toggle(True))  # -> I, V, O
bang = ExplodeTree(Data=solver.O)  # -> Branch0, Branch1

mesh = Mesh(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)
mesh_2 = Mesh(mesh)
demesh_2 = DeconstructMesh(Mesh=mesh_2)  # -> simplify(Vertices), Faces, Colours, Normals
explode_2 = MeshExplode(Mesh=mesh_2, Interpolate=False)
area_2 = Area(Geometry=explode_2)  # -> Area, simplify(Centroid)
pdecon_3 = Deconstruct(Point=demesh_2.Vertices)  # -> XComponent, YComponent, ZComponent
sort_3 = SortList(Keys=pdecon_3.ZComponent, ValuesA=demesh_2.Vertices, ValuesB=demesh_2.Normals)  # -> Keys, ValuesA, ValuesB
cps = ClosestPoints(Point=graft(sort_3.ValuesA), Cloud=area_2.Centroid, Count="6")  # -> simplify(ClosestPoint), CPIndex, Distance
pl = PlaneNormal(Origin=sort_3.ValuesA, ZAxis=sort_3.ValuesB)  # -> graft(Plane)
hull = ConvexHull(Points=cps.ClosestPoint, Plane=pl)  # -> Hull, HullZ, Indices
crv_2 = Curve(flatten(hull.HullZ))
lng_2 = ListLength(List=crv_2)
subtraction = Subtraction(A=lng_2, B="101")
series_2 = Series(Start=0, Step=1, Count=lng_2)
dom = ConstructDomain(DomainStart="101", DomainEnd=subtraction)
inc = Includes(Value=series_2, Domain=dom)  # -> Includes, Deviation
pln = Plane(flatten(pl))
dispatch = Dispatch(List=crv_2, DispatchPattern=inc.Includes)  # -> ListA, ListB
dispatch_2 = Dispatch(List=pln, DispatchPattern=inc.Includes)  # -> ListA, ListB
crv_3 = Curve(dispatch.ListA)
deplane = DeconstructPlane(Plane=dispatch_2.ListA)  # -> Origin, XAxis, YAxis, ZAxis
project = Project(Geometry=crv_3, Plane=dispatch_2.ListA)  # -> Geometry, Transform
medges = MeshEdges(Mesh=mesh)  # -> NakedEdges, InteriorEdges, NonManifoldEdges
amp = Amplitude(Vector=deplane.ZAxis, Amplitude="0.1")
offset = OffsetCurve(Curve=project.Geometry, Distance="-0.025", Plane=dispatch_2.ListA, Corners=1)  # -> flatten(Curve)
move = Move(Geometry=offset, Motion=amp)  # -> Geometry, Transform

boundary_2 = BoundarySurfaces(Edges=move.Geometry)
crv_4 = Curve(medges.InteriorEdges)
previewlw_2 = CustomPreviewLineweights(Geometry=crv_4, Shader=ColourSwatch(SwatchColor=RGB(0, 0, 0)), Thickness="2", Absolute=False)
rgb = ColourRGB(Alpha=Slider(148, range=0..255), Red="150", Green="150", Blue=0)
preview_3 = CustomPreview(Geometry=boundary_2, Material=rgb)
