# Grasshopper definition #12_Möbius Strip.gh (Grasshopper 1.0.7)
# plug-ins: Bifocals

cir = Circle(Plane=PlaneXY(0, 0, 0), Radius="50")
division = Division(A="360", B="15")
series = Series(Start=0, Step=division, Count="15")
pframes = PerpFrames(Curve=cir, Count="15", Align=True)  # -> Frames, Parameters
rotate = Rotate(Geometry=pframes.Frames, Angle=degrees(series), Plane=pframes.Frames)  # -> Geometry, Transform
polygon = Polygon(Plane=rotate.Geometry, Radius="25", Segments="5", FilletRadius=0)  # -> Polygon, Length
loft = Loft(Curves=polygon.Polygon, Options={Adjust=False, Closed=True, LoftEnds=0, LoftSimp=0, LoftType=0, Rebuild=10, Refit=0.01})
debrep = DeconstructBrep(Brep=loft)  # -> Faces, Edges, Vertices
len = Length(Curve=debrep.Edges)
sort = SortList(Keys=len)  # -> Keys, ValuesA
item = ListItem(List=sort.Keys, Index=0, Wrap=True)
smaller = SmallerThan(FirstNumber=len, SecondNumber=expr("x+1", item))  # -> SmallerThan, OrEqualTo
dispatch = Dispatch(List=debrep.Edges, DispatchPattern=smaller.SmallerThan)  # -> ListA, ListB
crv = Curve(dispatch.ListB)
crv_2 = Curve(dispatch.ListB)
pframes_2 = PerpFrames(Curve=crv, Count="20", Align=True)  # -> Frames, Parameters
divide = DivideCurve(Curve=crv_2, Count="60", Kinks=False)  # -> simplify(Points), simplify(Tangents), Parameters
rectangle = Rectangle(Plane=pframes_2.Frames, XSize=Domain(-1.5, 1.5), YSize=Domain(-1.5, 1.5), Radius=0)  # -> Rectangle, Length
relitem = RelativeItem(Tree=divide.Points, Offset="{+1}[+6]", WrapPaths=invert(False), WrapItems=invert(False))  # -> ItemA, ItemB
relitem_2 = RelativeItem(Tree=divide.Tangents, Offset="{+1}[+6]", WrapPaths=invert(False), WrapItems=invert(False))  # -> ItemA, ItemB
number_slider = Slider(19.683, range=0..50)
loft_2 = Loft(
    Curves=rectangle.Rectangle,
    Options={Adjust=False, Closed=True, LoftEnds=0, LoftSimp=0, LoftType=0, Rebuild=10, Refit=0.01})
amp = Amplitude(Vector=relitem_2.ItemB, Amplitude=number_slider)
amp_2 = Amplitude(Vector=relitem_2.ItemA, Amplitude=number_slider)
rev = Reverse(Vector=amp)
bzspan = BezierSpan(StartPoint=relitem.ItemA, StartTangent=amp_2, EndPoint=relitem.ItemB, EndTangent=rev)  # -> Curve, Length, Domain
pframes_3 = PerpFrames(Curve=bzspan.Curve, Count=10, Align=True)  # -> Frames, Parameters
lng = ListLength(List=pframes_3.Frames)
series_2 = Series(Start=0, Step=1, Count=lng)
neg = Negative(Value="90")
dom = ConstructDomain(DomainStart=neg, DomainEnd="90")
bnd = Bounds(Numbers=series_2)
remap = RemapNumbers(Value=series_2, Source=bnd, Target=dom)  # -> Mapped, Clipped
rotate_2 = Rotate(Geometry=pframes_3.Frames, Angle=degrees(remap.Mapped), Plane=pframes_3.Frames)  # -> Geometry, Transform
rectangle_2 = Rectangle(Plane=rotate_2.Geometry, XSize=Domain(-0.5, 0.5), YSize=Domain(-1.5, 1.5), Radius=0)  # -> Rectangle, Length
loft_3 = Loft(
    Curves=rectangle_2.Rectangle,
    Options={Adjust=False, Closed=False, LoftEnds=0, LoftSimp=0, LoftType=0, Rebuild=10, Refit=0.01})
