# Grasshopper definition #13_Gradianat_facade.gh (Grasshopper 1.0.7)
# plug-ins: Bifocals, Kangaroo2 Components, Weaverbird

sqgrid = Square(Plane=PlaneXY(0, 0, 0), Size="2", ExtentX="25", ExtentY="10")  # -> Cells, Points
graft = GraftTree(Tree=sqgrid.Cells, IncludeEmptyLists=True, IncludeNullItems=True)
panel = Panel("""0
0.1
0.9
1""")
explode = Explode(Curve=graft, Recursive=True)  # -> Segments, Vertices
eval = EvaluateCurve(Curve=reparameterize(graft(explode.Segments)), Parameter=panel)  # -> Point, Tangent, Angle
crv = Curve(<curve referenced from the Rhino model>)
pline = PolyLine(Vertices=eval.Point, Closed=False)
trim = TrimTree(Tree=pline, Depth=1)
join = JoinCurves(Curves=trim, Preserve=False)
explode_2 = Explode(Curve=join, Recursive=True)  # -> Segments, Vertices
duppt = RemoveDuplicatePts(Points=explode_2.Vertices, Tolerance=0.01)  # -> flatten(UniquePoints)
crv_cp = CurveClosestPoint(Point=duppt, Curve=crv)  # -> Point, Parameter, Distance
bnd = Bounds(Numbers=crv_cp.Distance)
subtraction = Subtraction(A=duppt, B=crv_cp.Point)
remap = RemapNumbers(Value=crv_cp.Distance, Source=bnd, Target=Domain(0, 1))  # -> Mapped, Clipped
unit = UnitVector(Vector=subtraction)
graph = GraphMapper(
    remap.Mapped,
    x0=0,
    x1=1,
    y0=0,
    y1=1,
    container_name="Polyline",
    pt=[Point(0, 0.9042216539, 0), Point(0.1867180467, 0.438652575, 0), Point(0.3633856177, 0.1106598377, 0), Point(0.6252105236, 0, 0), Point(1, 0, 0)])
graph_2 = GraphMapper(
    remap.Mapped,
    x0=0,
    x1=1,
    y0=0,
    y1=1,
    container_name="Polyline",
    pt=[Point(0, 0.7293325663, 0), Point(0.4464376569, 0.3644320965, 0), Point(0.7252002954, 0.07451885939, 0), Point(0.8498234153, 0, 0), Point(1, 0, 0)])
multiplication = Multiplication(A=graph_2, B=Slider(2.18, range=0..10))
Z = UnitZ(Factor=1)
multiplication_2 = Multiplication(A=graph, B=Slider(4.71, range=0..10))
amp = Amplitude(Vector=unit, Amplitude=multiplication)
amp_2 = Amplitude(Vector=Z, Amplitude=multiplication_2)
move = Move(Geometry=duppt, Motion=amp)  # -> Geometry, Transform
move_2 = Move(Geometry=move.Geometry, Motion=amp_2)  # -> Geometry, Transform
partition = PartitionList(List=move_2.Geometry, Size="12")
crv_2 = Curve(crv)
del = DelaunayMesh(Points=partition, Plane=PlaneXY(0, 0, 0))
avr = Average(Input=partition)
meshcp = MeshClosestPoint(Point=avr, Mesh=del)  # -> Point, Index, Parameter
flatten = FlattenTree(Tree=avr, Path="{0}")
crv_cp_2 = CurveClosestPoint(Point=flatten, Curve=crv_2)  # -> Point, Parameter, Distance
bnd_2 = Bounds(Numbers=crv_cp_2.Distance)
meval = MeshEval(Mesh=del, Parameter=meshcp.Parameter)  # -> Point, Normal, Colour
remap_2 = RemapNumbers(Value=crv_cp_2.Distance, Source=bnd_2, Target=Domain(0, 1))  # -> Mapped, Clipped
graph_3 = GraphMapper(
    remap_2.Mapped,
    x0=0,
    x1=1,
    y0=0,
    y1=1,
    container_name="Bezier2",
    pt=[Point(0, 1, 0), Point(0.338716805, 0.7880390882, 0), Point(0.08548245285, 0.2914988917, 0), Point(0.2995711565, 0.08134174347, 0), Point(0.4240846336, -0.04088515043, 0), Point(0.6563879848, 0, 0), Point(1, 0, 0)])
graph_4 = GraphMapper(
    remap.Mapped,
    x0=0,
    x1=1,
    y0=0,
    y1=1,
    container_name="Polyline",
    pt=[Point(0, 0.9687513113, 0), Point(0.1662978083, 0.3110143542, 0), Point(0.3633856177, 0.1106598377, 0), Point(0.6252105236, 0, 0), Point(1, 0, 0)])
graph_5 = GraphMapper(
    remap_2.Mapped,
    x0=0,
    x1=1,
    y0=0,
    y1=1,
    container_name="Bezier2",
    pt=[Point(0, 1, 0), Point(0.06170566007, 0.746034503, 0), Point(0.1187496483, 0.5214613676, 0), Point(0.1833407581, 0.3274261951, 0), Point(0.3027688328, -0.0313421734, 0), Point(0.2984548509, 0, 0), Point(1, 0, 0)])
graph_6 = GraphMapper(
    remap_2.Mapped,
    x0=0,
    x1=1,
    y0=0,
    y1=1,
    container_name="Bezier2",
    pt=[Point(0, 1, 0), Point(0, 0.2901337147, 0), Point(0.3067824675, 0.4737126137, 0), Point(0.4547879994, 0.7346615791, 0), Point(0.5825832188, 0.9599776864, 0), Point(0.7718399763, 1, 0), Point(1, 1, 0)])
dom = ConstructDomain(DomainStart="0.01", DomainEnd=1)
dom_2 = ConstructDomain(DomainStart="0.3", DomainEnd="0.9")
dom_3 = ConstructDomain(DomainStart="0.01", DomainEnd=1)
remap_3 = RemapNumbers(Value=graph_3, Source=Domain(0, 1), Target=dom)  # -> Mapped, Clipped
remap_4 = RemapNumbers(Value=graph_6, Source=Domain(0, 1), Target=dom_2)  # -> Mapped, Clipped
remap_5 = RemapNumbers(Value=graph_4, Source=Domain(0, 1), Target=dom_3)  # -> Mapped, Clipped
multiplication_3 = Multiplication(A=remap_3.Mapped, B=Slider(0.59, range=0..10))
amp_3 = Amplitude(Vector=meval.Normal, Amplitude=graft(multiplication_3))
multiplication_4 = Multiplication(A=remap_5.Mapped, B=Slider(0.46, range=0..10))
multiplication_5 = Multiplication(A=graph_5, B=Slider(0.15, range=0..10))
partition_2 = PartitionList(List=multiplication_4, Size="12")
move_3 = Move(Geometry=avr, Motion=amp_3)  # -> Geometry, Transform
neg = Negative(Value=multiplication_5)
subtraction_2 = Subtraction(A=partition, B=move_3.Geometry)
rev = Reverse(Vector=subtraction_2)
amp_4 = Amplitude(Vector=rev, Amplitude=partition_2)
pt = Point(partition)
dom_4 = ConstructDomain(DomainStart="0.2", DomainEnd=1)
move_4 = Move(Geometry=pt, Motion=amp_4)  # -> Geometry, Transform
remap_6 = RemapNumbers(Value=graph_3, Source=Domain(0, 1), Target=dom_4)  # -> Mapped, Clipped
pline_2 = PolyLine(Vertices=partition, Closed=invert(False))
pline_3 = PolyLine(Vertices=move_4.Geometry, Closed=invert(False))
explode_3 = Explode(Curve=pline_3, Recursive=True)  # -> Segments, Vertices
multiplication_6 = Multiplication(A=remap_6.Mapped, B=Slider(0, range=0..10))
multiplication_7 = Multiplication(A=remap_6.Mapped, B=Slider(5.74, range=0..10))
duppt_2 = RemoveDuplicatePts(Points=explode_3.Vertices, Tolerance=0.01)
Z_2 = UnitZ(Factor=multiplication_6)
Z_3 = UnitZ(Factor=multiplication_7)
avr_2 = Average(Input=duppt_2)
move_5 = Move(Geometry=avr_2, Motion=graft(Z_2))  # -> Geometry, Transform
move_6 = Move(Geometry=avr_2, Motion=graft(Z_3))  # -> Geometry, Transform
subtraction_3 = Subtraction(A=duppt_2, B=move_5.Geometry)
subtraction_4 = Subtraction(A=duppt_2, B=move_6.Geometry)
rev_2 = Reverse(Vector=subtraction_3)
rev_3 = Reverse(Vector=subtraction_4)
amp_5 = Amplitude(Vector=rev_3, Amplitude=Slider(0.5, range=0..10))
amp_6 = Amplitude(Vector=rev_2, Amplitude=Slider(0.2, range=0..10))
move_7 = Move(Geometry=duppt_2, Motion=amp_5)  # -> Geometry, Transform
pline_4 = PolyLine(Vertices=move_7.Geometry, Closed=invert(False))
reb = RebuildCurve(Curve=pline_4, Degree="1", Count="12", Tangents=False)
explode_4 = Explode(Curve=reb, Recursive=True)  # -> Segments, Vertices
trim_2 = TrimTree(Tree=reb, Depth=2)
duppt_3 = RemoveDuplicatePts(Points=explode_4.Vertices, Tolerance=0.01)
loft = Loft(
    Curves=[pline_2, pline_3],
    Options={Adjust=False, Closed=False, LoftEnds=0, LoftSimp=0, LoftType=0, Rebuild=10, Refit=0.01})
loft_2 = Loft(
    Curves=[pline_3, trim_2],
    Options={Adjust=False, Closed=False, LoftEnds=0, LoftSimp=0, LoftType=0, Rebuild=10, Refit=0.01})
move_8 = Move(Geometry=duppt_3, Motion=amp_6)  # -> Geometry, Transform
avr_3 = Average(Input=move_8.Geometry)
Z_4 = UnitZ(Factor=1)
pline_5 = PolyLine(Vertices=move_8.Geometry, Closed=invert(False))
scale = Scale(Geometry=pline_5, Center=avr_3, Factor=graft(remap_4.Mapped))  # -> Geometry, Transform
amp_7 = Amplitude(Vector=Z_4, Amplitude=neg)  # -> graft(Vector)
match = MatchTree(Tree=pline_5, Guide=trim_2)
move_9 = Move(Geometry=scale.Geometry, Motion=amp_7)  # -> Geometry, Transform
explode_5 = Explode(Curve=move_9.Geometry, Recursive=True)  # -> Segments, Vertices
loft_3 = Loft(Curves=[match, trim_2], Options={Adjust=False, Closed=False, LoftEnds=0, LoftSimp=0, LoftType=0, Rebuild=10, Refit=0.01})
duppt_4 = RemoveDuplicatePts(Points=explode_5.Vertices, Tolerance=0.01)
match_2 = MatchTree(Tree=move_9.Geometry, Guide=pline_5)
del_2 = DelaunayMesh(Points=duppt_4, Plane=PlaneXY(0, 0, 0))  # -> flatten(Mesh)
loft_4 = Loft(
    Curves=[match_2, pline_5],
    Options={Adjust=False, Closed=False, LoftEnds=0, LoftSimp=0, LoftType=0, Rebuild=10, Refit=0.01})
smesh = SimpleMesh(Brep=loft)  # -> flatten(Mesh)
smesh_2 = SimpleMesh(Brep=loft_4)  # -> flatten(Mesh)
smesh_3 = SimpleMesh(Brep=loft_2)  # -> flatten(Mesh)
smesh_4 = SimpleMesh(Brep=loft_3)  # -> flatten(Mesh)
merge = Merge(Data1=smesh_4, Data2=smesh_2, Data3=del_2, Data4=smesh_3, Data5=smesh)
mjoin = MeshJoin(Meshes=merge)
weld = WeldMesh(Mesh=mjoin, Angle=3.141592654)
demesh = DeconstructMesh(Mesh=weld)  # -> Vertices, Faces, Colours, Normals
pdecon = Deconstruct(Point=demesh.Vertices)  # -> XComponent, YComponent, ZComponent
bnd_3 = Bounds(Numbers=pdecon.ZComponent)
dedomain = DeconstructDomain(Domain=bnd_3)  # -> Start, End
gradient = Gradient(
    LowerLimit=dedomain.Start,
    UpperLimit=dedomain.End,
    Parameter=pdecon.ZComponent,
    stops=[0: RGB(174, 166, 129), 0.522: RGB(159, 65, 29), 1: RGB(80, 55, 25)])
conmesh = ConstructMesh(Vertices=demesh.Vertices, Faces=demesh.Faces, Colours=gradient)
wbcatmullclark = WeaverbirdsCatmullClarkSubdivision(MeshCurves=weld, Level="3", SmoothNakedEdges=1)
