# Grasshopper definition #14_Voronoi_Exoskeleton.gh (Grasshopper 1.0.7)
# plug-ins: Bifocals

sph = Sphere(Base=PlaneXY(0, 0, 0), Radius="20")
area = Area(Geometry=sph)  # -> Area, Centroid
bbox = BoundingBox(Content=sph, Plane=PlaneXY(0, 0, 0), UnionBox=True)  # -> Box, Box_2
pop3d = Populate3D(Region=bbox.Box, Count="50", Seed=1)
scale = Scale(Geometry=bbox.Box, Center=area.Centroid, Factor="1.5")  # -> Geometry, Transform
voronoi³ = Voronoi3D(Points=pop3d, Box=scale.Geometry)  # -> Cells, Boundary
bbx = BrepBrep(BrepA=sph, BrepB=voronoi³.Cells)  # -> flatten(Curves), Points
len = Length(Curve=bbx.Curves)
smaller = SmallerThan(FirstNumber=len, SecondNumber="25")  # -> SmallerThan, OrEqualTo
dispatch = Dispatch(List=bbx.Curves, DispatchPattern=smaller.SmallerThan)  # -> ListA, ListB
crv = Curve(dispatch.ListB)
disc = Discontinuity(Curve=crv, Level=1)  # -> Points, Parameters
divide = DivideCurve(Curve=crv, Count="20", Kinks=False)  # -> Points, Tangents, Parameters
pline = PolyLine(Vertices=disc.Points, Closed=invert(False))
nurbs = NurbsCurve(Vertices=divide.Points, Degree=3, Periodic=invert(False))  # -> Curve, Length, Domain
pcen = PolygonCenter(Polyline=pline)  # -> CenterV, CenterE, CenterA
scale_2 = Scale(Geometry=nurbs.Curve, Center=pcen.CenterV, Factor=Slider(0.8, range=0..1))  # -> flatten(Geometry), Transform
brep = Brep(sph)
srfsplit = SurfaceSplit(Surface=brep, Curves=scale_2.Geometry)
area_2 = Area(Geometry=srfsplit)  # -> Area, Centroid
sort = SortList(Keys=area_2.Area, ValuesA=srfsplit)  # -> Keys, reverse(ValuesA)
item = ListItem(List=sort.ValuesA, Index=0, Wrap=True)
area_3 = Area(Geometry=item)  # -> Area, Centroid
scale_3 = Scale(Geometry=item, Center=area_3.Centroid, Factor=Slider(0.92, range=0..1))  # -> Geometry, Transform
edges = BrepEdges(Brep=item)  # -> Naked, Interior, NonManifold
edges_2 = BrepEdges(Brep=scale_3.Geometry)  # -> Naked, Interior, NonManifold
panel = Panel("""0.25
0.50
0.75""")
join = JoinCurves(Curves=edges.Naked, Preserve=False)
join_2 = JoinCurves(Curves=edges_2.Naked, Preserve=False)
tweencrv = TweenCurve(CurveA=join, CurveB=join_2, Factor=graft(panel), BlendType=0)
entwine = Entwine(Branch0X=join, Branch1X=tweencrv, Branch2X=join_2, FlattenInputs=False)  # -> simplify(Result)
path_mapper = PathMapper(entwine, source="{A;B}", target="{path_index}")
flip = FlipMatrix(Data=path_mapper)
divide_2 = DivideCurve(Curve=flip, Count=10, Kinks=False)  # -> Points, Tangents, Parameters
panel_2 = Panel("""1
0.9
0.8
0.9
1""")
avr = Average(Input=divide_2.Points)
trim = TrimTree(Tree=avr, Depth=1)
scale_4 = Scale(Geometry=flip, Center=trim, Factor=panel_2)  # -> Geometry, Transform
flip_2 = FlipMatrix(Data=scale_4.Geometry)
relitem = RelativeItem(Tree=flip_2, Offset="{+1}", WrapPaths=False, WrapItems=False)  # -> ItemA, ItemB
divide_3 = DivideCurve(Curve=relitem.ItemA, Count=10, Kinks=False)  # -> Points, Tangents, Parameters
avr_2 = Average(Input=divide_3.Points)
brep_2 = Brep(sph)
trim_2 = TrimTree(Tree=avr_2, Depth=1)
divide_4 = DivideCurve(Curve=scale_4.Geometry, Count=10, Kinks=False)  # -> graft(Points), Tangents, Parameters
brep_cp = BrepClosestPoint(Point=trim_2, Brep=brep_2)  # -> Point, Normal, Distance
neg = Negative(Value=Slider(0.37, range=0..1))
amp = Amplitude(Vector=brep_cp.Normal, Amplitude=neg)
relitem_2 = RelativeItem(Tree=divide_4.Points, Offset="{+0;+1;+0}", WrapPaths=False, WrapItems=False)  # -> ItemA, ItemB
move = Move(Geometry=relitem.ItemA, Motion=amp)  # -> Geometry, Transform
ln = Line(StartPoint=relitem_2.ItemA, EndPoint=relitem_2.ItemB)
graft = GraftTree(Tree=relitem.ItemB, IncludeEmptyLists=True, IncludeNullItems=True)
graft_2 = GraftTree(Tree=move.Geometry, IncludeEmptyLists=True, IncludeNullItems=True)
trim_3 = TrimTree(Tree=ln, Depth="2")
loft = Loft(
    Curves=[graft, graft_2],
    Options={Adjust=False, Closed=False, LoftEnds=0, LoftSimp=0, LoftType=0, Rebuild=10, Refit=0.01})
extr = Extrude(Base=relitem.ItemA, Direction=amp)
brep_3 = Brep([item, scale_3.Geometry])
join_3 = JoinCurves(Curves=trim_3, Preserve=False)  # -> simplify(Curves)
divide_5 = DivideCurve(Curve=join_3, Count="4", Kinks=False)  # -> Points, Tangents, Parameters
nurbs_2 = NurbsCurve(Vertices=divide_5.Points, Degree=3, Periodic=False)  # -> Curve, Length, Domain
trim_4 = TrimTree(Tree=nurbs_2.Curve, Depth=1)
crv_2 = Curve(join)
crv_3 = Curve(join_2)
swp2 = Sweep2(Rail1=graft(crv_2), Rail2=graft(crv_3), Sections=trim_4, SameHeight=False)
merge = Merge(Data1=extr, Data2=loft, Data3=brep_3)  # -> flatten(Result)
merge_2 = Merge(Data1=swp2, Data2=brep_3)  # -> flatten(Result)
join_4 = BrepJoin(Breps=merge_2)  # -> Breps, Closed
join_5 = BrepJoin(Breps=merge)  # -> Breps, Closed
brep_4 = Brep(join_5.Breps)
area_4 = Area(Geometry=brep_4)  # -> Area, Centroid
scale_5 = Scale(Geometry=brep_4, Center=area_4.Centroid, Factor="0.88")  # -> Geometry, Transform
vec = VectorXYZ(XComponent=Slider(0.07, range=-1..1), YComponent=Slider(-0.33, range=-1..1), ZComponent=Slider(-1, range=-1..1))  # -> Vector, Length
rot3d = Rotate3D(Geometry=scale_5.Geometry, Angle=degrees(Slider(80, range=-180..180)), Center=area_4.Centroid, Axis=vec.Vector)  # -> Geometry, Transform
