# Grasshopper definition #15_Bio_structure.gh (Grasshopper 1.0.7)
# plug-ins: Bifocals, Noise, DendroGH, Kangaroo2 Components, NGon

series = Series(Start=0, Step=1, Count="15")
series_2 = Series(Start=0, Step=1, Count="45")
pt = ConstructPoint(XCoordinate=series, YCoordinate=graft(series), ZCoordinate=0)  # -> flatten(Point)
Z = UnitZ(Factor=series_2)
number_slider = Slider(4.5, range=0..10)
move = Move(Geometry=pt, Motion=graft(Z))  # -> flatten(Geometry), Transform
pn = PerlinNoise(
    Points=move.Geometry,
    Seed=Slider(9, range=0..50),
    Amplitude=1,
    SmoothStep=0,
    FrequecyX=number_slider,
    FrequecyY=number_slider,
    FrequecyZ=number_slider,
    Jitter=0,
    AlignVector=Vector(1, 0, 0))
graph = GraphMapper(pn, x0=0, x1=1, y0=0, y1=1, container_name="Bezier", cpx=[0, 0.5866814256, 0.5238550305, 1], cpy=[0, 0, 1, 1])

# ----
# 可视化
panel = Panel("255")
dom = ConstructDomain(DomainStart=0, DomainEnd=panel)
remap = RemapNumbers(Value=graph, Source=Domain(0, 1), Target=dom)  # -> Mapped, Clipped
rgb = ColourRGB(Alpha=255, Red=remap.Mapped, Green=remap.Mapped, Blue=remap.Mapped)
preview = CustomPreview(Geometry=move.Geometry, Material=rgb)

smaller = SmallerThan(FirstNumber=graph, SecondNumber=Slider(0.618, range=0..1))  # -> SmallerThan, OrEqualTo
dispatch = Dispatch(List=move.Geometry, DispatchPattern=smaller.SmallerThan)  # -> ListA, ListB

# ----
# Bio结构
number_slider_2 = Slider(2.94, range=0..10)
pt_2 = Point(dispatch.ListA)
pn_2 = PerlinNoise(
    Points=pt_2,
    Seed=Slider(18, range=0..50),
    Amplitude=1,
    SmoothStep=0,
    FrequecyX=number_slider_2,
    FrequecyY=number_slider_2,
    FrequecyZ=number_slider_2,
    Jitter=0,
    AlignVector=Vector(1, 0, 0))
pi = Pi(Factor=1)
multiplication = Multiplication(A=pn_2, B=pi, C=Slider(6, range=1..10))
sin = Sine(Value=multiplication)
graph_2 = GraphMapper(sin, x0=-1, x1=1, y0=0, y1=1, container_name="Bezier", cpx=[0, 0.8518676758, 0.2254597992, 1], cpy=[0, 0, 1, 1])
smaller_2 = SmallerThan(FirstNumber=graph_2, SecondNumber=Slider(0.472, range=0..1))  # -> SmallerThan, OrEqualTo
dispatch_2 = Dispatch(List=pt_2, DispatchPattern=smaller_2.SmallerThan)  # -> ListA, ListB
number_slider_3 = Slider(0.45, range=0..1)
pt_3 = Point(dispatch_2.ListA)
multiplication_2 = Multiplication(A=number_slider_3, B="1.5")
vsettings = CreateSettings(VoxelSize=number_slider_3, Bandwidth=1, Isovalue=0, Adaptivity=0.1)
vpoints = PointsToVolume(Points=pt_3, PointRadius=multiplication_2, Settings=vsettings)
vsmooth = SmoothVolume(Volume=vpoints, Width=1, Type=2, Iterations=Slider(4, range=1..10))
mvolume = VolumeToMesh(Volume=vsmooth, VolumeSettings=vsettings)
demesh = DeconstructMesh(Mesh=mvolume)  # -> Vertices, Faces, Colours, Normals
avr = Average(Input=demesh.Vertices)
pdecon = Deconstruct(Point=avr)  # -> XComponent, YComponent, ZComponent
pt_4 = ConstructPoint(XCoordinate=pdecon.XComponent, YCoordinate=pdecon.YComponent, ZCoordinate=0)
line = LineSDL(Start=pt_4, Direction=Vector(0, 0, 1), Length="100")
crv_cp = CurveClosestPoint(Point=demesh.Vertices, Curve=line)  # -> Point, Parameter, Distance
bnd = Bounds(Numbers=crv_cp.Distance)
dedomain = DeconstructDomain(Domain=bnd)  # -> Start, End
gradient = Gradient(
    LowerLimit=dedomain.Start,
    UpperLimit=dedomain.End,
    Parameter=crv_cp.Distance,
    stops=[0: RGB(75, 107, 169), 0.271: RGB(173, 203, 249), 1: RGB(255, 255, 255)])
conmesh = ConstructMesh(Vertices=demesh.Vertices, Faces=demesh.Faces, Colours=gradient)

# ----
# 楼板
number_slider_4 = Slider(2, range=0..10)
pt_5 = Point(dispatch.ListB)
number_slider_5 = Slider(0.45, range=0..1)
multiplication_3 = Multiplication(A=number_slider_5, B="1.5")
vsettings_2 = CreateSettings(VoxelSize=number_slider_5, Bandwidth=1, Isovalue=0, Adaptivity=0.1)
vpoints_2 = PointsToVolume(Points=pt_5, PointRadius=multiplication_3, Settings=vsettings_2)
vsmooth_2 = SmoothVolume(Volume=vpoints_2, Width=1, Type=2, Iterations=Slider(2, range=1..10))
mvolume_2 = VolumeToMesh(Volume=vsmooth_2, VolumeSettings=vsettings_2)
Z_2 = UnitZ(Factor=1)
contour = Contour(Shape=mvolume_2, Point=Point(0, 0, 0), Direction=Z_2, Distance="1")
smoothpline = SmoothPolyline(Polyline=contour, Strength=1, Times=number_slider_4)
tstat = TreeStatistics(Tree=smoothpline)  # -> Paths, Length, Count
panel_2 = Panel("""0
1
2
3""")
cull_i = CullIndex(List=tstat.Paths, Indices=panel_2, Wrap=True)
branch = TreeBranch(Tree=smoothpline, Path=cull_i, MaintainPaths=True)  # -> flatten(Branch)
offset = OffsetCurve(Curve=branch, Distance="-0.2", Corners=1)
area = Area(Geometry=offset)  # -> Area, Centroid
smaller_3 = SmallerThan(FirstNumber=area.Area, SecondNumber=Slider(1, range=0..1))  # -> SmallerThan, OrEqualTo
dispatch_3 = Dispatch(List=offset, DispatchPattern=smaller_3.SmallerThan)  # -> ListA, ListB
crv = Curve(dispatch_3.ListB)
Z_3 = UnitZ(Factor=".2")
boundary = BoundarySurfaces(Edges=crv)
extr = Extrude(Base=boundary, Direction=Z_3)

# ----
# 幕墙结构
number_slider_6 = Slider(2.69, range=0..5)
bbox = BoundingBox(Content=pt, Plane=PlaneXY(0, 0, 0), UnionBox=True)  # -> Box, Box_2
edges = BrepEdges(Brep=bbox.Box)  # -> Naked, Interior, NonManifold
join = JoinCurves(Curves=edges.Naked, Preserve=False)
offset_2 = OffsetCurve(Curve=join, Distance="0.5", Corners=1)
explode = Explode(Curve=offset_2, Recursive=True)  # -> Segments, Vertices
lng = ListLength(List=explode.Segments)
divide = DivideCurve(Curve=explode.Segments, Count="5", Kinks=False)  # -> flatten(Points), Tangents, Parameters
series_3 = Series(Start=0, Step="5", Count=lng)
duppt = RemoveDuplicatePts(Points=divide.Points, Tolerance=0.01)
shift = ShiftList(List=duppt, Shift=graft(series_3), Wrap=True)
split = SplitList(List=shift, Index=expr("x+1", "5"))  # -> simplify(ListA), ListB
Z_4 = UnitZ(Factor=number_slider_6)
move_2 = Move(Geometry=split.ListA, Motion=Z_4)  # -> Geometry, Transform
Z_5 = UnitZ(Factor=1)
line_2 = LineSDL(Start=move_2.Geometry, Direction=Z_5, Length="44")
divide_2 = DivideCurve(Curve=line_2, Count="15", Kinks=False)  # -> Points, Tangents, Parameters
relitem = RelativeItem(Tree=divide_2.Points, Offset="{+0;+2}[+1]", WrapPaths=False, WrapItems=False)  # -> ItemA, ItemB
ln = Line(StartPoint=relitem.ItemA, EndPoint=relitem.ItemB)
tstat_2 = TreeStatistics(Tree=ln)  # -> Paths, Length, Count
dispatch_4 = Dispatch(List=tstat_2.Paths, DispatchPattern=[True, False, False, True])  # -> ListA, ListB
branch_2 = TreeBranch(Tree=ln, Path=dispatch_4.ListB, MaintainPaths=True)
branch_3 = TreeBranch(Tree=ln, Path=dispatch_4.ListA, MaintainPaths=True)
tstat_3 = TreeStatistics(Tree=branch_2)  # -> Paths, Length, Count
dispatch_5 = Dispatch(List=tstat_3.Paths, DispatchPattern=[True, False])  # -> ListA, ListB
branch_4 = TreeBranch(Tree=branch_2, Path=dispatch_5.ListA, MaintainPaths=True)
branch_5 = TreeBranch(Tree=branch_2, Path=dispatch_5.ListB, MaintainPaths=True)
len = Length(Curve=branch_5)
division = Division(A=len, B=2)
cull_i_2 = CullIndex(List=branch_4, Indices="0", Wrap=True)
item = ListItem(List=branch_4, Index="0", Wrap=True)
cull_i_3 = CullIndex(List=branch_5, Indices="-1", Wrap=True)
item_2 = ListItem(List=branch_5, Index="-1", Wrap=True)
ext = ExtendCurve(Curve=cull_i_2, Type=0, Start=division, End="0")
ext_2 = ExtendCurve(Curve=cull_i_3, Type=0, Start="0", End=division)
ins = InsertItems(List=ext, Item=item, Indices="0", Wrap=True)
ins_2 = InsertItems(List=ext_2, Item=item_2, Indices="-1", Wrap=True)
bbox_2 = BoundingBox(Content=line_2, Plane=PlaneXY(0, 0, 0), UnionBox=True)  # -> Box, Box_2
trim = TrimTree(Tree=ins, Depth="2")
trim_2 = TrimTree(Tree=ins_2, Depth="2")
area_2 = Area(Geometry=bbox_2.Box)  # -> Area, Centroid
crv_2 = Curve(line_2)
brep_cp = BrepClosestPoint(Point=area_2.Centroid, Brep=bbox_2.Box)  # -> Point, Normal, Distance
amp = Amplitude(Vector=brep_cp.Normal, Amplitude="0.02")
merge = Merge(Data1=trim, Data2=trim_2, Data3=branch_3, Data4=crv_2)
extr_2 = Extrude(Base=bbox_2.Box, Direction=amp)
meshpipe = MeshPipe(Curve=merge, Radius=0.1, Sides=10, Tolerance=10, Ending=3)

# ----
# 结构
panel_3 = Panel("7")
series_4 = Series(Start=0, Step=panel_3, Count="3")
pt_6 = ConstructPoint(XCoordinate=series_4, YCoordinate=graft(series_4), ZCoordinate=0)  # -> flatten(Point)
line_3 = LineSDL(Start=pt_6, Direction=Vector(0, 0, 1), Length="45")
bbox_3 = BoundingBox(Content=pt_6, Plane=PlaneXY(0, 0, 0), UnionBox=True)  # -> Box, Box_2
Z_6 = UnitZ(Factor="45")
Z_7 = UnitZ(Factor="0.3")
move_3 = Move(Geometry=bbox_3.Box, Motion=Z_6)  # -> Geometry, Transform
meshpipe_2 = MeshPipe(Curve=line_3, Radius="0.2", Sides=6, Tolerance=10, Ending=0)
extr_3 = Extrude(Base=move_3.Geometry, Direction=Z_7)

# ----
# 可视化
panel_4 = Panel("255")
bnd_2 = Bounds(Numbers=graph_2)
dom_2 = ConstructDomain(DomainStart=0, DomainEnd=panel_4)
remap_2 = RemapNumbers(Value=graph_2, Source=bnd_2, Target=dom_2)  # -> Mapped, Clipped
rgb_2 = ColourRGB(Alpha=255, Red=remap_2.Mapped, Green=remap_2.Mapped, Blue=remap_2.Mapped)
preview_2 = CustomPreview(Geometry=pt_2, Material=rgb_2)
