# Grasshopper definition #16_Bio_ring.gh (Grasshopper 1.0.7)
# plug-ins: Bifocals, Noise, DendroGH, Weaverbird

cir = Circle(Plane=PlaneXY(0, 0, 0), Radius="10")
series = Series(Start=0, Step="1.25", Count="20")
bnd = Bounds(Numbers=series)
Z = UnitZ(Factor=series)
remap = RemapNumbers(Value=series, Source=bnd, Target=Domain(0, 1))  # -> Mapped, Clipped
move = Move(Geometry=cir, Motion=Z)  # -> Geometry, Transform
graph = GraphMapper(
    remap.Mapped,
    x0=0,
    x1=1,
    y0=0,
    y1=1,
    container_name="Bezier2",
    pt=[Point(0, 0.112318933, 0), Point(0.01642698422, 0.5384703875, 0), Point(0.1502414852, 0.6365288318, 0), Point(0.3010657728, 0.7297991514, 0), Point(0.521428287, 0.8660721779, 0), Point(0.7417907715, 0.46083951, 0), Point(1, 0.04843431711, 0)])
dom = ConstructDomain(DomainStart="0.55", DomainEnd="1.2")
dom_2 = ConstructDomain(DomainStart=0, DomainEnd="180")
area = Area(Geometry=move.Geometry)  # -> Area, Centroid
remap_2 = RemapNumbers(Value=graph, Source=Domain(0, 1), Target=dom)  # -> Mapped, Clipped
remap_3 = RemapNumbers(Value=remap.Mapped, Source=Domain(0, 1), Target=dom_2)  # -> Mapped, Clipped
scale = Scale(Geometry=move.Geometry, Center=area.Centroid, Factor=remap_2.Mapped)  # -> Geometry, Transform
area_2 = Area(Geometry=scale.Geometry)  # -> Area, Centroid
scale_2 = Scale(Geometry=scale.Geometry, Center=area_2.Centroid, Factor="0.9")  # -> Geometry, Transform
loft = Loft(
    Curves=scale_2.Geometry,
    Options={Adjust=False, Closed=False, LoftEnds=0, LoftSimp=0, LoftType=0, Rebuild=10, Refit=0.01})
divide = DivideCurve(Curve=scale.Geometry, Count="12", Kinks=False)  # -> Points, Tangents, Parameters
rotate = Rotate(Geometry=divide.Points, Angle=graft(degrees(remap_3.Mapped)), Plane=graft(area.Centroid))  # -> Geometry, Transform
flip = FlipMatrix(Data=rotate.Geometry)
intcrv = Interpolate(Vertices=flip, Degree=3, Periodic=False, KnotStyle=1)  # -> Curve, Length, Domain
divide_2 = DivideCurve(Curve=intcrv.Curve, Count="15", Kinks=False)  # -> Points, Tangents, Parameters
loft_2 = Loft(Curves=scale.Geometry, Options={Adjust=False, Closed=False, LoftEnds=0, LoftSimp=0, LoftType=0, Rebuild=10, Refit=0.01})
brep_cp = BrepClosestPoint(Point=divide_2.Points, Brep=loft_2)  # -> flatten(Point), flatten(Normal), Distance

# ----
# move along surface normal
number_slider = Slider(2.57, range=0..10)
neg = Negative(Value="1")
pn = PerlinNoise(
    Points=brep_cp.Point,
    Seed=0,
    Amplitude=1,
    SmoothStep=0,
    FrequecyX=number_slider,
    FrequecyY=number_slider,
    FrequecyZ=number_slider,
    Jitter=0,
    AlignVector=Vector(1, 0, 0))
dom_3 = ConstructDomain(DomainStart=neg, DomainEnd="1")
remap_4 = RemapNumbers(Value=pn, Source=Domain(0, 1), Target=dom_3)  # -> Mapped, Clipped
devec = DeconstructVector(Vector=brep_cp.Normal)  # -> XComponent, YComponent, ZComponent
multiplication = Multiplication(A=remap_4.Mapped, B=Slider(0.57, range=0..10))
vec = VectorXYZ(XComponent=devec.XComponent, YComponent=devec.YComponent, ZComponent=0)  # -> Vector, Length
lng = ListLength(List=divide_2.Points)  # -> flatten(Length)
amp = Amplitude(Vector=vec.Vector, Amplitude=multiplication)
item = ListItem(List=lng, Index=0, Wrap=True)
move_2 = Move(Geometry=brep_cp.Point, Motion=amp)  # -> Geometry, Transform
partition = PartitionList(List=move_2.Geometry, Size=item)

# ----
# move along tanget of surface
number_slider_2 = Slider(3.32, range=0..10)
pn_2 = PerlinNoise(
    Points=brep_cp.Point,
    Seed="60",
    Amplitude=1,
    SmoothStep=0,
    FrequecyX=number_slider_2,
    FrequecyY=number_slider_2,
    FrequecyZ=number_slider_2,
    Jitter=0,
    AlignVector=Vector(1, 0, 0))
crv_cp = CurveClosestPoint(Point=partition, Curve=intcrv.Curve)  # -> Point, Parameter, Distance
eval = EvaluateCurve(Curve=intcrv.Curve, Parameter=crv_cp.Parameter)  # -> Point, Tangent, Angle
partition_2 = PartitionList(List=brep_cp.Normal, Size=item)
multiplication_2 = Multiplication(A=pn_2, B=Slider(1.18, range=0..10))
xprod = CrossProduct(VectorA=eval.Tangent, VectorB=partition_2, Unitize=False)  # -> Vector, Length
partition_3 = PartitionList(List=multiplication_2, Size=item)
amp_2 = Amplitude(Vector=xprod.Vector, Amplitude=partition_3)
move_3 = Move(Geometry=partition, Motion=amp_2)  # -> Geometry, Transform

# ----
# move randomly for end point
number_slider_3 = Slider(100, range=0..100)
item_2 = ListItem(List=move_3.Geometry, Index=0, Wrap=True)  # -> flatten(Item1), flatten(Item)
lng_2 = ListLength(List=item_2.Item1)
random = Random(Range=Domain(-1, 2), Number=lng_2, Seed=number_slider_3)
Z_2 = UnitZ(Factor=random)
move_4 = Move(Geometry=item_2.Item1, Motion=Z_2)  # -> graft(Geometry), Transform
lng_3 = ListLength(List=move_3.Geometry)  # -> expr("x-1", Length)
replace = ReplaceItems(List=move_3.Geometry, Item=move_4.Geometry, Indices=lng_3, Wrap=False)  # -> simplify(List)

pline = PolyLine(Vertices=item_2.Item, Closed=invert(False))
tstat = TreeStatistics(Tree=replace)  # -> Paths, Length, Count
intcrv_2 = Interpolate(Vertices=replace, Degree=3, Periodic=False, KnotStyle=1)  # -> Curve, Length, Domain
dispatch = Dispatch(List=tstat.Paths, DispatchPattern=[True, False])  # -> ListA, ListB
branch = TreeBranch(Tree=intcrv_2.Curve, Path=dispatch.ListA, MaintainPaths=True)
branch_2 = TreeBranch(Tree=intcrv_2.Curve, Path=dispatch.ListB, MaintainPaths=True)
divide_3 = DivideCurve(Curve=branch, Count="8", Kinks=False)  # -> simplify(Points), Tangents, Parameters
divide_4 = DivideCurve(Curve=branch_2, Count="8", Kinks=False)  # -> simplify(Points), Tangents, Parameters
relitem2 = RelativeItems(TreeA=divide_3.Points, TreeB=divide_4.Points, Offset="{-1}[+0]", WrapPaths=invert(False), WrapItems=False)  # -> ItemA, ItemB
relitem2_2 = RelativeItems(TreeA=divide_3.Points, TreeB=divide_4.Points, Offset="{+1}[+0]", WrapPaths=False, WrapItems=False)  # -> ItemA, ItemB
crv_cp_2 = CurveClosestPoint(Point=relitem2_2.ItemB, Curve=branch_2)  # -> Point, Parameter, Distance
crv_cp_3 = CurveClosestPoint(Point=relitem2_2.ItemA, Curve=branch)  # -> Point, Parameter, Distance
crv_cp_4 = CurveClosestPoint(Point=relitem2.ItemB, Curve=branch_2)  # -> Point, Parameter, Distance
crv_cp_5 = CurveClosestPoint(Point=relitem2.ItemA, Curve=branch)  # -> Point, Parameter, Distance
lng_4 = ListLength(List=crv_cp_3.Parameter)
lng_5 = ListLength(List=flatten(lng_4))
series_2 = Series(Start=0, Step=1, Count=lng_5)  # -> graft(Series)
series_3 = Series(Start=1, Step=3, Count=lng_5)  # -> graft(Series)
random_2 = Random(Range=Domain(-0.5, 0.5), Number=lng_4, Seed=series_2)
addition = Addition(A=crv_cp_5.Parameter, B=random_2)  # -> simplify(Result)
eval_2 = EvaluateCurve(Curve=branch, Parameter=addition)  # -> Point, Tangent, Angle
random_3 = Random(Range=Domain(-0.5, 0.5), Number=lng_4, Seed=series_3)
addition_2 = Addition(A=crv_cp_4.Parameter, B=random_3)  # -> simplify(Result)
eval_3 = EvaluateCurve(Curve=branch_2, Parameter=addition_2)  # -> Point, Tangent, Angle
addition_3 = Addition(A=crv_cp_2.Parameter, B=random_3)  # -> simplify(Result)
addition_4 = Addition(A=crv_cp_3.Parameter, B=random_2)  # -> simplify(Result)
eval_4 = EvaluateCurve(Curve=branch, Parameter=addition_4)  # -> Point, Tangent, Angle
eval_5 = EvaluateCurve(Curve=branch_2, Parameter=addition_3)  # -> Point, Tangent, Angle
amp_3 = Amplitude(Vector=eval_3.Tangent, Amplitude=Slider(4.42, range=0..10))
amp_4 = Amplitude(Vector=eval_2.Tangent, Amplitude=Slider(0, range=0..10))
amp_5 = Amplitude(Vector=eval_2.Tangent, Amplitude=Slider(2.77, range=0..10))
amp_6 = Amplitude(Vector=eval_3.Tangent, Amplitude=Slider(0, range=0..10))
rev = Reverse(Vector=amp_3)
rev_2 = Reverse(Vector=amp_6)
amp_7 = Amplitude(Vector=eval_4.Tangent, Amplitude=Slider(5.92, range=0..10))
amp_8 = Amplitude(Vector=eval_5.Tangent, Amplitude=Slider(3.9, range=0..10))
amp_9 = Amplitude(Vector=eval_4.Tangent, Amplitude=Slider(2.98, range=0..10))
amp_10 = Amplitude(Vector=eval_5.Tangent, Amplitude=Slider(5.95, range=0..10))
rev_3 = Reverse(Vector=amp_8)
rev_4 = Reverse(Vector=amp_10)
bzspan = BezierSpan(StartPoint=eval_4.Point, StartTangent=amp_7, EndPoint=eval_5.Point, EndTangent=rev_3)  # -> Curve, Length, Domain
bzspan_2 = BezierSpan(StartPoint=eval_4.Point, StartTangent=amp_9, EndPoint=eval_5.Point, EndTangent=rev_4)  # -> Curve, Length, Domain
bzspan_3 = BezierSpan(StartPoint=relitem2.ItemA, StartTangent=amp_5, EndPoint=relitem2.ItemB, EndTangent=rev_2)  # -> Curve, Length, Domain
bzspan_4 = BezierSpan(StartPoint=relitem2.ItemA, StartTangent=amp_4, EndPoint=relitem2.ItemB, EndTangent=rev)  # -> Curve, Length, Domain
crv = Curve([intcrv_2.Curve, pline])
number_slider_4 = Slider(0.3, range=0..1)
merge = Merge(Data1=bzspan.Curve, Data2=bzspan_2.Curve, Data3=bzspan_4.Curve, Data4=bzspan_3.Curve, Data5=crv)  # -> flatten(Result)
multiplication_3 = Multiplication(A=number_slider_4, B="1.5")
vsettings = CreateSettings(VoxelSize=number_slider_4, Bandwidth=1, Isovalue=0, Adaptivity=0.1)
vcurve = CurveToVolume(Curves=merge, CurveRadius=multiplication_3, Settings=vsettings)
vsmooth = SmoothVolume(Volume=vcurve, Width=1, Type=2, Iterations=1)
mvolume = VolumeToMesh(Volume=vsmooth, VolumeSettings=vsettings)
wbcatmullclark = WeaverbirdsCatmullClarkSubdivision(MeshCurves=mvolume, Level="1", SmoothNakedEdges=1)
demesh = DeconstructMesh(Mesh=wbcatmullclark)  # -> Vertices, Faces, Colours, Normals
pdecon = Deconstruct(Point=demesh.Vertices)  # -> XComponent, YComponent, ZComponent
bnd_2 = Bounds(Numbers=pdecon.ZComponent)
dedomain = DeconstructDomain(Domain=bnd_2)  # -> Start, End
gradient = Gradient(
    LowerLimit=dedomain.Start,
    UpperLimit=dedomain.End,
    Parameter=pdecon.ZComponent,
    stops=[0: RGB(159, 65, 29), 0: RGB(80, 55, 25), 1: RGB(174, 166, 129)])
conmesh = ConstructMesh(Vertices=demesh.Vertices, Faces=demesh.Faces, Colours=gradient)
