# Grasshopper definition #17_Shanghai_BFC.gh (Grasshopper 1.0.7)
# plug-ins: Bifocals

rectangle = Rectangle(Plane=PlaneXY(0, 0, 0), XSize="20", YSize="12.5", Radius=0)  # -> Rectangle, Length

first_floor_height = Slider(4.43, range=0..10)
fillet = Fillet(Curve=rectangle.Rectangle, Radius=Slider(2.91, range=0..10))
Z = UnitZ(Factor=first_floor_height)
move = Move(Geometry=fillet, Motion=Z)  # -> Geometry, Transform
loft = Loft(
    Curves=[move.Geometry, fillet],
    Options={Adjust=False, Closed=False, LoftEnds=0, LoftSimp=0, LoftType=0, Rebuild=10, Refit=0.01})
sdivide = DivideSurface(Surface=loft, UCount="3", VCount="25")  # -> Points, Normals, Parameters
flip = FlipMatrix(Data=sdivide.Points)

# ----
# 一层楼板
number_slider = Slider(0.38, range=0..1)
series = Series(Start=0, Step=number_slider, Count=10)
Z_2 = UnitZ(Factor=series)
bnd = Bounds(Numbers=series)
move_2 = Move(Geometry=move.Geometry, Motion=Z_2)  # -> Geometry, Transform
remap = RemapNumbers(Value=series, Source=bnd, Target=Domain(0, 1))  # -> Mapped, Clipped
graph = GraphMapper(
    remap.Mapped,
    x0=0,
    x1=1,
    y0=0,
    y1=1,
    container_name="Bezier",
    cpx=[0, 0, 0.6016042829, 1],
    cpy=[0, 0.2360724807, 0.9865514636, 1])
area = Area(Geometry=move_2.Geometry)  # -> Area, Centroid
dom = ConstructDomain(DomainStart="1", DomainEnd="1.5")
remap_2 = RemapNumbers(Value=graph, Source=Domain(0, 1), Target=dom)  # -> Mapped, Clipped
scale = Scale(Geometry=move_2.Geometry, Center=area.Centroid, Factor=remap_2.Mapped)  # -> Geometry, Transform
num = Number(number_slider)
crv = Curve(scale.Geometry)
Z_3 = UnitZ(Factor=num)
cull_i = CullIndex(List=crv, Indices="0", Wrap=True)  # -> graft(List)
cull_i_2 = CullIndex(List=crv, Indices="-1", Wrap=True)  # -> graft(List)
item = ListItem(List=crv, Index=["0", "-1"], Wrap=True)
rev = Reverse(Vector=Z_3)
boundary = BoundarySurfaces(Edges=item)
move_3 = Move(Geometry=cull_i, Motion=rev)  # -> Geometry, Transform
loft_2 = Loft(
    Curves=[move_3.Geometry, cull_i],
    Options={Adjust=False, Closed=False, LoftEnds=0, LoftSimp=0, LoftType=0, Rebuild=10, Refit=0.01})
loft_3 = Loft(
    Curves=[cull_i_2, move_3.Geometry],
    Options={Adjust=False, Closed=False, LoftEnds=0, LoftSimp=0, LoftType=0, Rebuild=10, Refit=0.01})
merge = Merge(Data1=boundary, Data2=loft_2, Data3=loft_3)  # -> flatten(Result)
join = BrepJoin(Breps=merge)  # -> Breps, Closed

# ----
# 二楼围栏
panel = Panel("-1")
item_2 = ListItem(List=scale.Geometry, Index=panel, Wrap=True)
栏杆偏移 = Panel("-0.3")
offset = OffsetCurve(Curve=item_2, Distance=栏杆偏移, Corners=1)

# ----
# 二层幕墙
first_floor_height_2 = Slider(6.65, range=0..10)
area_2 = Area(Geometry=item_2)  # -> Area, Centroid
pdecon = Deconstruct(Point=area_2.Centroid)  # -> XComponent, YComponent, ZComponent
Z_4 = UnitZ(Factor=pdecon.ZComponent)
move_4 = Move(Geometry=fillet, Motion=Z_4)  # -> Geometry, Transform
scale_2 = Scale(Geometry=move_4.Geometry, Center=area_2.Centroid, Factor=Slider(1.25, range=0..10))  # -> Geometry, Transform
Z_5 = UnitZ(Factor=first_floor_height_2)
move_5 = Move(Geometry=scale_2.Geometry, Motion=Z_5)  # -> Geometry, Transform
loft_4 = Loft(
    Curves=[scale_2.Geometry, move_5.Geometry],
    Options={Adjust=False, Closed=False, LoftEnds=0, LoftSimp=0, LoftType=0, Rebuild=10, Refit=0.01})
sdivide_2 = DivideSurface(Surface=loft_4, UCount="3", VCount="25")  # -> Points, Normals, Parameters
flip_2 = FlipMatrix(Data=sdivide_2.Points)
divide = DivideDomain²(Domain=loft_4, UCount="3", VCount="25")
pline = PolyLine(Vertices=flip_2, Closed=False)
intcrv = Interpolate(Vertices=sdivide_2.Points, Degree=3, Periodic=False, KnotStyle=1)  # -> Curve, Length, Domain
neg = Negative(Value="0.15")
neg_2 = Negative(Value="0.05")
pframes = PerpFrames(Curve=pline, Count=10, Align=True)  # -> Frames, Parameters
subsrf = Isotrim(Surface=loft_4, Domain=divide)
dom_2 = ConstructDomain(DomainStart=neg_2, DomainEnd="0.05")
dom_3 = ConstructDomain(DomainStart=neg, DomainEnd="0.15")
pframes_2 = PerpFrames(Curve=intcrv.Curve, Count="100", Align=True)  # -> Frames, Parameters
eval = EvaluateCurve(Curve=pline, Parameter=pframes.Parameters)  # -> simplify(Point), Tangent, Angle
item_3 = ListItem(List=flatten(intcrv.Curve), Index=0, Wrap=True)
sdivide_3 = DivideSurface(Surface=subsrf, UCount="2", VCount="3")  # -> simplify(Points), Normals, Parameters
crv_cp = CurveClosestPoint(Point=eval.Point, Curve=item_3)  # -> Point, Parameter, Distance
rectangle_2 = Rectangle(Plane=pframes_2.Frames, XSize=dom_3, YSize=dom_2, Radius=0)  # -> Rectangle, Length
path_mapper = PathMapper(sdivide_3.Points, source="{A;B}[i]", target="{A;i}[B]")
eval_2 = EvaluateCurve(Curve=item_3, Parameter=crv_cp.Parameter)  # -> Point, Tangent, Angle
Z_6 = UnitZ(Factor=1)
loft_5 = Loft(
    Curves=rectangle_2.Rectangle,
    Options={Adjust=False, Closed=True, LoftEnds=0, LoftSimp=0, LoftType=0, Rebuild=10, Refit=0.01})
pline_2 = PolyLine(Vertices=path_mapper, Closed=False)
intcrv_2 = Interpolate(Vertices=sdivide_3.Points, Degree=3, Periodic=False, KnotStyle=1)  # -> Curve, Length, Domain
xprod = CrossProduct(VectorA=eval_2.Tangent, VectorB=Z_6, Unitize=False)  # -> simplify(Vector), Length
neg_3 = Negative(Value="0.1")
neg_4 = Negative(Value="0.05")
pl = ConstructPlane(Origin=eval.Point, XAxis=xprod.Vector, YAxis=eval_2.Tangent)
split = SplitTree(Data=pline_2, Masks=flatten("{*;(1,2)}"))  # -> Positive, Negative
split_2 = SplitTree(Data=intcrv_2.Curve, Masks=flatten("{*;1}"))  # -> Positive, Negative
dom_4 = ConstructDomain(DomainStart=neg_3, DomainEnd="0.1")
dom_5 = ConstructDomain(DomainStart=neg_4, DomainEnd="0.05")
merge_2 = Merge(Data1=split_2.Positive, Data2=split.Positive)
rectangle_3 = Rectangle(Plane=pl, XSize=dom_4, YSize=dom_5, Radius=0)  # -> Rectangle, Length
pipe = Pipe(Curve=merge_2, Radius="0.025", Caps=0)
loft_6 = Loft(
    Curves=rectangle_3.Rectangle,
    Options={Adjust=False, Closed=False, LoftEnds=0, LoftSimp=0, LoftType=0, Rebuild=10, Refit=0.01})

# ----
# 二层楼板
number_slider_2 = Slider(0.79, range=0..1)
# 一层幕墙
crv_2 = Curve(move_5.Geometry)
series_2 = Series(Start=0, Step=number_slider_2, Count=expr("8", 10))
Z_7 = UnitZ(Factor=series_2)
bnd_2 = Bounds(Numbers=series_2)
move_6 = Move(Geometry=crv_2, Motion=Z_7)  # -> Geometry, Transform
remap_3 = RemapNumbers(Value=series_2, Source=bnd_2, Target=Domain(0, 1))  # -> Mapped, Clipped
graph_2 = GraphMapper(
    remap_3.Mapped,
    x0=0,
    x1=1,
    y0=0,
    y1=1,
    container_name="Bezier2",
    pt=[Point(0, 0, 0), Point(0, 0, 0), Point(-0.001305595288, 0.1857286477, 0), Point(0.348503381, 0.4510020614, 0), Point(0.6492108703, 0.6790399551, 0), Point(1, 1, 0), Point(1, 1, 0)])
area_3 = Area(Geometry=move_6.Geometry)  # -> Area, Centroid
dom_6 = ConstructDomain(DomainStart="1", DomainEnd="1.35")
remap_4 = RemapNumbers(Value=graph_2, Source=Domain(0, 1), Target=dom_6)  # -> Mapped, Clipped
scale_3 = Scale(Geometry=move_6.Geometry, Center=area_3.Centroid, Factor=remap_4.Mapped)  # -> Geometry, Transform
num_2 = Number(number_slider_2)
crv_3 = Curve(scale_3.Geometry)
Z_8 = UnitZ(Factor=num_2)
cull_i_3 = CullIndex(List=crv_3, Indices="0", Wrap=True)  # -> graft(List)
cull_i_4 = CullIndex(List=crv_3, Indices="-1", Wrap=True)  # -> graft(List)
item_4 = ListItem(List=crv_3, Index=["0", "-1"], Wrap=True)
rev_2 = Reverse(Vector=Z_8)
boundary_2 = BoundarySurfaces(Edges=item_4)
move_7 = Move(Geometry=cull_i_3, Motion=rev_2)  # -> Geometry, Transform
loft_7 = Loft(
    Curves=[move_7.Geometry, cull_i_3],
    Options={Adjust=False, Closed=False, LoftEnds=0, LoftSimp=0, LoftType=0, Rebuild=10, Refit=0.01})
loft_8 = Loft(
    Curves=[cull_i_4, move_7.Geometry],
    Options={Adjust=False, Closed=False, LoftEnds=0, LoftSimp=0, LoftType=0, Rebuild=10, Refit=0.01})
merge_3 = Merge(Data1=boundary_2, Data2=loft_7, Data3=loft_8)  # -> flatten(Result)

panel_2 = Panel("""-1
-2
-3""")
item_5 = ListItem(List=flatten(loft_8), Index=panel_2, Wrap=True)
edges = BrepEdges(Brep=item_5)  # -> Naked, Interior, NonManifold
explode = Explode(Curve=edges.Naked, Recursive=True)  # -> Segments, Vertices
join_2 = JoinCurves(Curves=explode.Segments, Preserve=False)  # -> simplify(Curves)
trim = TrimTree(Tree=join_2, Depth=1)
item_6 = ListItem(List=trim, Index=0, Wrap=True)  # -> Item, Item1
flip_3 = FlipCurve(Curve=item_6.Item, Guide=item_6.Item1)  # -> Curve, Flag
tweencrv = TweenCurve(CurveA=flip_3.Curve, CurveB=item_6.Item1, Factor=Slider(0.5, range=0..1), BlendType=0)
divdist = DivideDistance(Curve=tweencrv, Distance=expr("x*2+0.08", "0.2"))  # -> Points, Tangents, Parameters
tstat = TreeStatistics(Tree=divdist.Points)  # -> Paths, Length, Count
series_3 = Series(Start=0, Step=1, Count=tstat.Length)
bnd_3 = Bounds(Numbers=series_3)
remap_5 = RemapNumbers(Value=series_3, Source=bnd_3, Target=Domain(0, 1))  # -> Mapped, Clipped
graph_3 = GraphMapper(remap_5.Mapped, x0=0, x1=1, y0=0, y1=1, container_name="Sine", Equation_px=[0, 0.1249080077], Equation_py=[0, 1])
dom_7 = ConstructDomain(DomainStart="5", DomainEnd="11")
genes = GenePool(Decimals=0, Maximum=100, Minimum=0, Value=[57.82040905, 13.88147264, 97.08149191])
Z_9 = UnitZ(Factor=1)
neg_5 = Negative(Value=Z_9)
remap_6 = RemapNumbers(Value=graph_3, Source=Domain(0, 1), Target=dom_7)  # -> Mapped, Clipped
shift = ShiftList(List=remap_6.Mapped, Shift=graft(genes), Wrap=True)
line = LineSDL(Start=divdist.Points, Direction=neg_5, Length=shift)
pframes_3 = PerpFrames(Curve=line, Count=10, Align=True)  # -> Frames, Parameters
panel_3 = Panel("""5
7
9""")
cir = Circle(Plane=pframes_3.Frames, Radius="0.2")
panel_4 = Panel("""0.05
-0.05""")
item_7 = ListItem(List=cir, Index=panel_3, Wrap=True)
Z_10 = UnitZ(Factor=panel_4)
move_8 = Move(Geometry=graft(item_7), Motion=Z_10)  # -> Geometry, Transform
area_4 = Area(Geometry=move_8.Geometry)  # -> Area, Centroid
loft_9 = Loft(Curves=cir, Options={Adjust=False, Closed=False, LoftEnds=0, LoftSimp=0, LoftType=0, Rebuild=10, Refit=0.01})
scale_4 = Scale(Geometry=move_8.Geometry, Center=area_4.Centroid, Factor="1.2")  # -> Geometry, Transform
loft_10 = Loft(
    Curves=scale_4.Geometry,
    Options={Adjust=False, Closed=False, LoftEnds=0, LoftSimp=0, LoftType=0, Rebuild=10, Refit=0.01})
cap = CapHoles(Brep=loft_10)
mesh = MeshBrep(
    Brep=loft_9,
    Settings={GridMaxCount=0, GridMinCount=16, JaggedSeams=False, MaxEdgeLength=0, MinEdgeLength=0.0001, MinTolerance=0, Refine=True, RefineAngle=0, RelativeTolerance=0.65, SimplePlanes=True, Tolerance=0})
mesh_2 = MeshBrep(
    Brep=cap,
    Settings={GridMaxCount=0, GridMinCount=16, JaggedSeams=False, MaxEdgeLength=0, MinEdgeLength=0.0001, MinTolerance=0, Refine=True, RefineAngle=0, RelativeTolerance=0.65, SimplePlanes=True, Tolerance=0})

栏杆高度 = Panel("1.2")
Z_11 = UnitZ(Factor=栏杆高度)
move_9 = Move(Geometry=offset, Motion=Z_11)  # -> Geometry, Transform
栏杆厚度 = Panel("0.1")
栏杆宽度 = Panel("""0.1
-0.1""")
offset_2 = OffsetCurve(Curve=move_9.Geometry, Distance=栏杆宽度, Corners=1)  # -> flatten(Curve)
rev_3 = Reverse(Vector=Z_11)
Z_12 = UnitZ(Factor=栏杆厚度)
loft_11 = Loft(Curves=offset_2, Options={Adjust=False, Closed=False, LoftEnds=0, LoftSimp=0, LoftType=0, Rebuild=10, Refit=0.01})
extr = Extrude(Base=loft_11, Direction=Z_12)
move_10 = Move(Geometry=extr, Motion=rev_3)  # -> Geometry, Transform
merge_4 = Merge(Data1=extr, Data2=move_10.Geometry)

竖杆数量 = Panel("60")
竖杆半径 = Panel("0.06")
divide_2 = DivideCurve(Curve=offset, Count=竖杆数量, Kinks=False)  # -> Points, Tangents, Parameters
line_2 = LineSDL(Start=divide_2.Points, Direction=Vector(0, 0, 1), Length=栏杆高度)
pipe_2 = Pipe(Curve=line_2, Radius=竖杆半径, Caps=0)

栏杆厚度_2 = Panel("0.05")
栏杆宽度_2 = Panel("""0.05
-0.05""")
offset_3 = OffsetCurve(Curve=move_9.Geometry, Distance=栏杆宽度_2, Corners=1)  # -> flatten(Curve)
Z_13 = UnitZ(Factor=栏杆厚度_2)
loft_12 = Loft(Curves=offset_3, Options={Adjust=False, Closed=False, LoftEnds=0, LoftSimp=0, LoftType=0, Rebuild=10, Refit=0.01})
panel_5 = Panel("""-0.2
-0.5
-0.9""")
Z_14 = UnitZ(Factor=panel_5)
extr_2 = Extrude(Base=loft_12, Direction=Z_13)
move_11 = Move(Geometry=extr_2, Motion=Z_14)  # -> Geometry, Transform

divide_3 = DivideDomain²(Domain=loft, UCount="3", VCount="25")
subsrf_2 = Isotrim(Surface=loft, Domain=divide_3)
sdivide_4 = DivideSurface(Surface=subsrf_2, UCount="2", VCount="3")  # -> simplify(Points), Normals, Parameters
path_mapper_2 = PathMapper(sdivide_4.Points, source="{A;B}[i]", target="{A;i}[B]")
pline_3 = PolyLine(Vertices=path_mapper_2, Closed=False)
intcrv_3 = Interpolate(Vertices=sdivide_4.Points, Degree=3, Periodic=False, KnotStyle=1)  # -> Curve, Length, Domain
split_3 = SplitTree(Data=pline_3, Masks=flatten("{*;(1,2)}"))  # -> Positive, Negative
split_4 = SplitTree(Data=intcrv_3.Curve, Masks=flatten("{*;1}"))  # -> Positive, Negative
merge_5 = Merge(Data1=split_4.Positive, Data2=split_3.Positive)
pipe_3 = Pipe(Curve=merge_5, Radius="0.025", Caps=0)

pline_4 = PolyLine(Vertices=flip, Closed=False)
intcrv_4 = Interpolate(Vertices=sdivide.Points, Degree=3, Periodic=False, KnotStyle=1)  # -> Curve, Length, Domain
pframes_4 = PerpFrames(Curve=pline_4, Count=10, Align=True)  # -> Frames, Parameters
eval_3 = EvaluateCurve(Curve=pline_4, Parameter=pframes_4.Parameters)  # -> simplify(Point), Tangent, Angle
item_8 = ListItem(List=flatten(intcrv_4.Curve), Index=0, Wrap=True)
crv_cp_2 = CurveClosestPoint(Point=eval_3.Point, Curve=item_8)  # -> Point, Parameter, Distance
eval_4 = EvaluateCurve(Curve=item_8, Parameter=crv_cp_2.Parameter)  # -> Point, Tangent, Angle
Z_15 = UnitZ(Factor=1)
xprod_2 = CrossProduct(VectorA=eval_4.Tangent, VectorB=Z_15, Unitize=False)  # -> simplify(Vector), Length
neg_6 = Negative(Value="0.1")
neg_7 = Negative(Value="0.05")
pl_2 = ConstructPlane(Origin=eval_3.Point, XAxis=xprod_2.Vector, YAxis=eval_4.Tangent)
dom_8 = ConstructDomain(DomainStart=neg_6, DomainEnd="0.1")
dom_9 = ConstructDomain(DomainStart=neg_7, DomainEnd="0.05")
rectangle_4 = Rectangle(Plane=pl_2, XSize=dom_8, YSize=dom_9, Radius=0)  # -> Rectangle, Length
loft_13 = Loft(
    Curves=rectangle_4.Rectangle,
    Options={Adjust=False, Closed=False, LoftEnds=0, LoftSimp=0, LoftType=0, Rebuild=10, Refit=0.01})

neg_8 = Negative(Value="0.15")
neg_9 = Negative(Value="0.05")
dom_10 = ConstructDomain(DomainStart=neg_9, DomainEnd="0.05")
dom_11 = ConstructDomain(DomainStart=neg_8, DomainEnd="0.15")
pframes_5 = PerpFrames(Curve=intcrv_4.Curve, Count="100", Align=True)  # -> Frames, Parameters
rectangle_5 = Rectangle(Plane=pframes_5.Frames, XSize=dom_11, YSize=dom_10, Radius=0)  # -> Rectangle, Length
loft_14 = Loft(
    Curves=rectangle_5.Rectangle,
    Options={Adjust=False, Closed=True, LoftEnds=0, LoftSimp=0, LoftType=0, Rebuild=10, Refit=0.01})

merge_6 = Merge(Data1=pipe_2, Data2=merge_4, Data3=move_11.Geometry)
merge_7 = Merge(Data1=join.Breps)
join_3 = BrepJoin(Breps=merge_3)  # -> Breps, Closed
merge_8 = Merge(Data1=loft_13, Data2=loft_14, Data3=pipe_3, Data4=loft)
merge_9 = Merge(Data1=loft_6, Data2=loft_5, Data3=pipe)
