# Grasshopper definition #18_Wooden_pavillion.gh (Grasshopper 1.0.7)
# plug-ins: Bifocals, Noise, DendroGH

rectangle = Rectangle(Plane=PlaneXY(0, 0, 0), XSize="100", YSize="150", Radius=0)  # -> Rectangle, Length
boxrec = BoxRectangle(Rectangle=rectangle.Rectangle, Height="75")
number_slider = Slider(3.37, range=0..10)
number_slider_2 = Slider(0.99, range=0..1)
area = Area(Geometry=boxrec)  # -> Area, Centroid
pop3d = Populate3D(Region=boxrec, Count="5000", Seed=1)
scale_nu = ScaleNU(Geometry=boxrec, Plane=area.Centroid, ScaleX=number_slider_2, ScaleY=number_slider_2, ScaleZ=1)  # -> Geometry, Transform
pn = PerlinNoise(
    Points=pop3d,
    Seed=Slider(45, range=0..100),
    Amplitude=1,
    SmoothStep=0,
    FrequecyX=number_slider,
    FrequecyY=number_slider,
    FrequecyZ=number_slider,
    Jitter=0,
    AlignVector=Vector(1, 0, 0))
number_slider_3 = Slider(4.66, range=0..10)
smaller = SmallerThan(FirstNumber=pn, SecondNumber=Slider(0.46, range=0..1))  # -> SmallerThan, OrEqualTo
dispatch = Dispatch(List=pop3d, DispatchPattern=smaller.SmallerThan)  # -> ListA, ListB
vsettings = CreateSettings(VoxelSize=number_slider_3, Bandwidth=1, Isovalue=0, Adaptivity=0.1)
multiplication = Multiplication(A=number_slider_3, B="1.5")
vpoints = PointsToVolume(Points=dispatch.ListA, PointRadius=multiplication, Settings=vsettings)
preview = CustomPreview(Geometry=dispatch.ListA, Material=ColourSwatch(SwatchColor=RGB(255, 255, 255)))
vsmooth = SmoothVolume(Volume=vpoints, Width=1, Type=2, Iterations=Slider(2, range=0..10))
mvolume = VolumeToMesh(Volume=vsmooth, VolumeSettings=vsettings)
mesh = MeshBrep(
    Brep=scale_nu.Geometry,
    Settings={GridMaxCount=0, GridMinCount=16, JaggedSeams=False, MaxEdgeLength=0, MinEdgeLength=0.0001, MinTolerance=0, Refine=True, RefineAngle=0, RelativeTolerance=0.65, SimplePlanes=True, Tolerance=0})
mint = MeshIntersection(MeshesA=mesh, MeshesB=mvolume)
contour = Contour(Shape=mint, Point=Point(0, 0, 0), Direction=Vector(0, 0, 1), Distance="2")
tstat = TreeStatistics(Tree=contour)  # -> Paths, Length, Count
dispatch_2 = Dispatch(List=tstat.Paths, DispatchPattern=[True, False])  # -> ListA, ListB
branch = TreeBranch(Tree=contour, Path=dispatch_2.ListB, MaintainPaths=True)
branch_2 = TreeBranch(Tree=contour, Path=dispatch_2.ListA, MaintainPaths=True)
boundary = BoundarySurfaces(Edges=branch_2)
boundary_2 = BoundarySurfaces(Edges=branch)
Y = UnitY(Factor=1)
X = UnitX(Factor=1)
contour_2 = Contour(Shape=boundary_2, Point=Point(0, 0, 0), Direction=Y, Distance="6")
contour_3 = Contour(Shape=boundary, Point=Point(0, 0, 0), Direction=X, Distance="10")
len = Length(Curve=contour_2)
len_2 = Length(Curve=contour_3)
smaller_2 = SmallerThan(FirstNumber=len, SecondNumber="5")  # -> SmallerThan, OrEqualTo
smaller_3 = SmallerThan(FirstNumber=len_2, SecondNumber="5")  # -> SmallerThan, OrEqualTo
dispatch_3 = Dispatch(List=contour_2, DispatchPattern=smaller_2.SmallerThan)  # -> ListA, ListB
dispatch_4 = Dispatch(List=contour_3, DispatchPattern=smaller_3.SmallerThan)  # -> ListA, ListB
crv = Curve(dispatch_3.ListB)
crv_2 = Curve(dispatch_4.ListB)
merge = Merge(Data1=crv_2, Data2=crv)
pframes = PerpFrames(Curve=merge, Count="2", Align=True)  # -> Frames, Parameters
num = Number("2")
division = Division(A=num, B=2)
neg = Negative(Value=division)
dom = ConstructDomain(DomainStart=neg, DomainEnd=division)
rectangle_2 = Rectangle(Plane=pframes.Frames, XSize=dom, YSize=dom, Radius=0)  # -> Rectangle, Length
loft = Loft(
    Curves=rectangle_2.Rectangle,
    Options={Adjust=False, Closed=False, LoftEnds=0, LoftSimp=0, LoftType=0, Rebuild=10, Refit=0.01})
cap = CapHoles(Brep=loft)
