# Grasshopper definition #1_Voronoi3D.gh (Grasshopper 1.0.7)
# plug-ins: Bifocals, Weaverbird

division = Division(A="20", B="2")
rectangle = Rectangle(Plane=PlaneXY(0, 0, 0), XSize="20", YSize=division, Radius=0)  # -> Rectangle, Length
boxrec = BoxRectangle(Rectangle=rectangle.Rectangle, Height="50")
pop3d = Populate3D(Region=boxrec, Count=100, Seed=1)
pdecon = Deconstruct(Point=pop3d)  # -> XComponent, YComponent, ZComponent
voronoi³ = Voronoi3D(Points=pop3d)  # -> Cells, Boundary
bnd = Bounds(Numbers=pdecon.ZComponent)
remap = RemapNumbers(Value=pdecon.ZComponent, Source=bnd, Target=Domain(0, 1))  # -> Mapped, Clipped
pi = Pi(Factor=1)
multiplication = Multiplication(A=remap.Mapped, B=pi, C="3", D=Slider(0.034, range=0..1))
sin = Sine(Value=multiplication)
bnd_2 = Bounds(Numbers=sin)
dom = ConstructDomain(DomainStart="0.95", DomainEnd="0.1")
remap_2 = RemapNumbers(Value=sin, Source=bnd_2, Target=dom)  # -> Mapped, Clipped
scale = Scale(Geometry=voronoi³.Cells, Center=pop3d, Factor=remap_2.Mapped)  # -> Geometry, Transform
mesh = MeshBrep(
    Brep=scale.Geometry,
    Settings={GridMaxCount=0, GridMinCount=16, JaggedSeams=False, MaxEdgeLength=0, MinEdgeLength=0.0001, MinTolerance=0, Refine=True, RefineAngle=0, RelativeTolerance=0.65, SimplePlanes=True, Tolerance=0})
gradient = Gradient(LowerLimit="0.95", UpperLimit="0.1", Parameter=remap_2.Mapped, stops=[0: RGB(255, 255, 255), 1: RGB(0, 0, 0)])
wbcatmullclark = WeaverbirdsCatmullClarkSubdivision(MeshCurves=mesh, Level="2", SmoothNakedEdges=1)
mcol = MeshColours(Mesh=wbcatmullclark, Colours=graft(gradient))
