# Grasshopper definition #20_Remesh_by_attribute.gh (Grasshopper 1.0.7)
# plug-ins: Bifocals, Noise, Kangaroo2 Components, NGon, Weaverbird

msphere = MeshSphere(Base=PlaneXY(0, 0, 0), Radius="50", UCount="50", VCount="75")
demesh = DeconstructMesh(Mesh=msphere)  # -> Vertices, Faces, Colours, Normals
vec = VectorXYZ(XComponent=Slider(0.54, range=0..10), YComponent=Slider(0.42, range=0..10), ZComponent=Slider(0.45, range=0..10))  # -> Vector, Length
pn = PerlinNoise(
    Points=demesh.Vertices,
    Seed=0,
    Amplitude=1,
    SmoothStep=0,
    FrequecyX=Slider(0.75, range=0..10),
    FrequecyY=Slider(0.69, range=0..10),
    FrequecyZ=Slider(0.86, range=0..10),
    Jitter=Slider(1, range=0..1),
    AlignVector=vec.Vector)
pi = Pi(Factor=1)
multiplication = Multiplication(A=pn, B=pi, C=Slider(10, range=1..12))
sin = Sine(Value=multiplication)
graph = GraphMapper(
    sin,
    x0=-1,
    x1=1,
    y0=0,
    y1=1,
    container_name="Polyline",
    pt=[Point(0, 0, 0), Point(0.06319527328, 0, 0), Point(0.1473830938, 1, 0), Point(0.6277819872, 1, 0), Point(1, 1, 0)])

bnd = Bounds(Numbers=graph)
dom = ConstructDomain(DomainStart=0, DomainEnd="255")
remap = RemapNumbers(Value=graph, Source=bnd, Target=dom)  # -> Mapped, Clipped
rgb = ColourRGB(Alpha=255, Red=remap.Mapped, Green=remap.Mapped, Blue=remap.Mapped)
preview = CustomPreview(Geometry=demesh.Vertices, Material=rgb)

smaller = SmallerThan(FirstNumber=graph, SecondNumber="0.9")  # -> SmallerThan, OrEqualTo
dispatch = Dispatch(List=demesh.Vertices, DispatchPattern=smaller.SmallerThan)  # -> ListA, ListB
pt = Point(dispatch.ListA)
edgelengths = EdgeLengths(Mesh=msphere, LengthFactor=Slider(0.75, range=0..1), Strength=1)
smooth = Smooth(M=msphere, Strength=1)
anchor = Anchor(Point=pt, Strength=10000)
load = Load(Point=demesh.Vertices, ForceVector=demesh.Normals, Weighting=1)
show = Show(G=msphere)
graph_2 = GraphMapper(
    sin,
    x0=-1,
    x1=1,
    y0=0,
    y1=1,
    container_name="Polyline",
    pt=[Point(0, 0, 0), Point(0.1401234567, 0, 0), Point(0.3365549147, 0.4256507754, 0), Point(0.6611469388, 0.8405929804, 0), Point(1, 1, 0)])
entwine = Entwine(Branch00=show, Branch01=anchor, Branch02=load, Branch03=edgelengths, Branch04=smooth, FlattenInputs=True)
bnd_2 = Bounds(Numbers=graph_2)
dom_2 = ConstructDomain(DomainStart=0, DomainEnd="255")
solver = Solver(GoalObjects=entwine, Reset=Button(), Threshold=1e-15, Tolerance=0.0001, On=Toggle(False))  # -> I, V, O
remap_2 = RemapNumbers(Value=graph_2, Source=bnd_2, Target=dom_2)  # -> Mapped, Clipped
bang = ExplodeTree(Data=solver.O)
rgb_2 = ColourRGB(Alpha=255, Red=remap_2.Mapped, Green=remap_2.Mapped, Blue=remap_2.Mapped)
demesh_2 = DeconstructMesh(Mesh=bang)  # -> Vertices, Faces, Colours, Normals
conmesh = ConstructMesh(Vertices=demesh_2.Vertices, Faces=demesh_2.Faces, Colours=rgb_2)
dom_3 = ConstructDomain(DomainStart="2", DomainEnd="30")
remeshbycolour = RemeshByColour(Mesh=conmesh, LengthInterval=dom_3, Flip=1, Iterations="10", Reset=Toggle(False))
dual = Dual(Mesh=remeshbycolour, Type=0)
wbdual = WeaverbirdsDualGraph(MeshCurves=remeshbycolour, DualMode=0)

dedomain = DeconstructDomain(Domain=bnd_2)  # -> Start, End
wbcarpet = WeaverbirdsSierpinskiCarpet(MeshPolylines=remeshbycolour, Distance=Slider(6, range=0..100), InsetType=0)
gradient = Gradient(
    LowerLimit=dedomain.Start,
    UpperLimit=dedomain.End,
    Parameter=graph_2,
    stops=[0: RGB(75, 107, 169), 0.503: RGB(173, 203, 249), 1: RGB(255, 255, 255)])
wbframe = WeaverbirdsPictureFrame(MeshPolylines=wbdual, Distance=Slider(32, range=0..100), InsetType=0)
demesh_3 = DeconstructMesh(Mesh=wbcarpet)  # -> Vertices, Faces, Colours, Normals
cp = ClosestPoint(Point=graft(demesh_3.Vertices), Cloud=demesh_2.Vertices)  # -> ClosestPoint, CPIndex, Distance
item = ListItem(List=gradient, Index=cp.CPIndex, Wrap=True)  # -> flatten(Item)
conmesh_2 = ConstructMesh(Vertices=demesh_3.Vertices, Faces=demesh_3.Faces, Colours=item)
neg = Negative(Value=Slider(3, range=0..100))
wbthicken = WeaverbirdsMeshThicken(MeshCurves=conmesh_2, Distance=neg, OffsetType=0)
wbcatmullclark = WeaverbirdsCatmullClarkSubdivision(MeshCurves=wbthicken, Level=1, SmoothNakedEdges=1)

len = Length(Curve=wbdual)
explode = Explode(Curve=wbdual, Recursive=True)  # -> Segments, Vertices
bnd_3 = Bounds(Numbers=len)
dom_4 = ConstructDomain(DomainStart="0.9", DomainEnd="0.1")
dom_5 = ConstructDomain(DomainStart="1", DomainEnd="0.1")
duppt = RemoveDuplicatePts(Points=explode.Vertices, Tolerance=0.01)
avr = Average(Input=duppt)
remap_3 = RemapNumbers(Value=len, Source=bnd_3, Target=dom_4)  # -> Mapped, Clipped
remap_4 = RemapNumbers(Value=len, Source=bnd_3, Target=dom_5)  # -> Mapped, Clipped
scale = Scale(Geometry=graft(wbdual), Center=avr, Factor=graft(remap_3.Mapped))  # -> simplify(Geometry), Transform
meshcp = MeshClosestPoint(Point=avr, Mesh=dual)  # -> Point, Index, Parameter
meval = MeshEval(Mesh=dual, Parameter=meshcp.Parameter)  # -> Point, Normal, Colour
rev = Reverse(Vector=meval.Normal)
amp = Amplitude(Vector=rev, Amplitude=graft(remap_4.Mapped))
graft = GraftTree(Tree=wbdual, IncludeEmptyLists=True, IncludeNullItems=True)  # -> simplify(Tree)
move = Move(Geometry=scale.Geometry, Motion=amp)  # -> simplify(Geometry), Transform
loft = Loft(
    Curves=[move.Geometry, graft],
    Options={Adjust=False, Closed=False, LoftEnds=0, LoftSimp=0, LoftType=0, Rebuild=10, Refit=0.01})
smesh = SimpleMesh(Brep=loft)  # -> flatten(Mesh)
offsetmesh = OffsetMesh(Mesh=smesh, Dist=1, Solid=Toggle(True))
