# Grasshopper definition #21_Terrain_analyze.gh (Grasshopper 1.0.7)
# plug-ins: Bifocals, Noise, MeshEdit Components, Weaverbird, Human

series = Series(Start=0, Step="20", Count="50")
series_2 = Series(Start=0, Step="20", Count="100")
pt = ConstructPoint(XCoordinate=series_2, YCoordinate=graft(series), ZCoordinate=0)  # -> flatten(Point)
number_slider = Slider(15, range=0..15)
number_slider_2 = Slider(10, range=0..10)
number_slider_3 = Slider(5.18, range=0..10)
pn = PerlinNoise(
    Points=pt,
    Seed=Slider(56, range=0..100),
    Amplitude=1,
    SmoothStep=0,
    FrequecyX=number_slider,
    FrequecyY=number_slider,
    FrequecyZ=number_slider,
    Jitter=0,
    AlignVector=Vector(1, 0, 0))
pn_2 = PerlinNoise(
    Points=pt,
    Seed=Slider(26, range=0..100),
    Amplitude=1,
    SmoothStep=0,
    FrequecyX=number_slider_2,
    FrequecyY=number_slider_2,
    FrequecyZ=number_slider_2,
    Jitter=0,
    AlignVector=Vector(1, 0, 0))
pn_3 = PerlinNoise(
    Points=pt,
    Seed=Slider(0, range=0..100),
    Amplitude=1,
    SmoothStep=0,
    FrequecyX=number_slider_3,
    FrequecyY=number_slider_3,
    FrequecyZ=number_slider_3,
    Jitter=0,
    AlignVector=Vector(1, 0, 0))
graph = GraphMapper(
    pn_3,
    x0=0,
    x1=1,
    y0=0,
    y1=1,
    container_name="Bezier",
    cpx=[0, 0.6122869849, 0.4129191935, 1],
    cpy=[0, 0.4074947834, 1, 1])

dom = ConstructDomain(DomainStart=0, DomainEnd="255")
remap = RemapNumbers(Value=graph, Source=Domain(0, 1), Target=dom)  # -> Mapped, Clipped
rgb = ColourRGB(Alpha=255, Red=remap.Mapped, Green=remap.Mapped, Blue=remap.Mapped)
preview = CustomPreview(Geometry=pt, Material=rgb)

multiplication = Multiplication(A=pn_2, B="100")
multiplication_2 = Multiplication(A=pn, B="50")
multiplication_3 = Multiplication(A=graph, B="200")
addition = Addition(A=multiplication_3, B=multiplication, C=multiplication_2)
Z = UnitZ(Factor=addition)
move = Move(Geometry=pt, Motion=Z)  # -> Geometry, Transform
frompoints = MeshFromPoints(Points=move.Geometry, UDirection="50", VDirection="100")
wbcatmullclark = WeaverbirdsCatmullClarkSubdivision(MeshCurves=frompoints, Level="2", SmoothNakedEdges="0")
contour = Contour(Shape=frompoints, Point=Point(0, 0, 0), Direction=Vector(0, 0, 1), Distance="10")  # -> graft(Contours)
end = EndPoints(Curve=contour)  # -> Start, End
pdecon = Deconstruct(Point=end.Start)  # -> XComponent, YComponent, flatten(ZComponent)

# ---- group: 视线
mesh = Mesh(frompoints)
medges = MeshEdges(Mesh=frompoints)  # -> NakedEdges, InteriorEdges, NonManifoldEdges
join = JoinCurves(Curves=medges.NakedEdges, Preserve=False)
md_slider = MDSlider(
    SliderMode=0,
    slider_value=Point(0.7337229659, 0.5346575481, 0.5),
    x_domain=Domain(0, 1),
    y_domain=Domain(0, 1),
    z_domain=Domain(0, 1))
project = Project(Geometry=join, Plane=PlaneXY(0, 0, 0))  # -> Geometry, Transform
boundary = BoundarySurfaces(Edges=project.Geometry)
evalsrf = EvaluateSurface(Surface=reparameterize(boundary), Point=md_slider)  # -> Point, Normal, UDirection, VDirection, Frame
demesh = DeconstructMesh(Mesh=frompoints)  # -> Vertices, Faces, Colours, Normals
meshcp = MeshClosestPoint(Point=evalsrf.Point, Mesh=mesh)  # -> Point, Index, Parameter
Z_2 = UnitZ(Factor="20")
move_2 = Move(Geometry=meshcp.Point, Motion=Z_2)  # -> Geometry, Transform
ln = Line(StartPoint=move_2.Geometry, EndPoint=demesh.Vertices)
preview_2 = CustomPreview(Geometry=move_2.Geometry, Material=ColourSwatch(SwatchColor=RGB(217, 255, 0)))
mcx = MeshCurve(Mesh=mesh, Curve=ln)  # -> simplify(Points), Faces
graft = GraftTree(Tree=ln, IncludeEmptyLists=True, IncludeNullItems=True)  # -> simplify(Tree)
tstat = TreeStatistics(Tree=mcx.Points)  # -> Paths, Length, Count
lng = ListLength(List=mcx.Points)  # -> flatten(Length)
smaller = SmallerThan(FirstNumber=lng, SecondNumber="1")  # -> SmallerThan, OrEqualTo
dispatch = Dispatch(List=tstat.Paths, DispatchPattern=smaller.SmallerThan)  # -> ListA, ListB
branch = TreeBranch(Tree=graft, Path=dispatch.ListA, MaintainPaths=True)

# ---- group: 坡度分析
demesh_2 = DeconstructMesh(Mesh=frompoints)  # -> Vertices, Faces, Colours, Normals
Z_3 = UnitZ(Factor=1)
angle = Angle(VectorA=demesh_2.Normals, VectorB=Z_3)  # -> Angle, Reflex
bnd = Bounds(Numbers=angle.Angle)
dedomain = DeconstructDomain(Domain=bnd)  # -> Start, End
gradient = Gradient(
    LowerLimit=dedomain.Start,
    UpperLimit=dedomain.End,
    Parameter=angle.Angle,
    stops=[0: RGB(255, 255, 255), 1: RGB(0, 0, 0)])
conmesh = ConstructMesh(Vertices=demesh_2.Vertices, Faces=demesh_2.Faces, Colours=gradient)

# ---- group: 等高线
bnd_2 = Bounds(Numbers=pdecon.ZComponent)
dedomain_2 = DeconstructDomain(Domain=bnd_2)  # -> Start, End
flatten = FlattenTree(Tree=contour, Path="{0}")
gradient_2 = Gradient(
    LowerLimit=dedomain_2.Start,
    UpperLimit=dedomain_2.End,
    Parameter=pdecon.ZComponent,
    stops=[0: RGB(174, 166, 129), 0.34: RGB(159, 65, 29), 1: RGB(80, 55, 25)])
previewlw = CustomPreviewLineweights(Geometry=flatten, Shader=gradient_2, Thickness="2", Absolute=False)

# ---- group: 洪水分析
panel = Panel("""0.25
0.5
0.75
1""")
panel_2 = Panel("""0
0.25
0.5
0.75""")
remap_2 = RemapNumbers(Value=pdecon.ZComponent, Source=bnd_2, Target=Domain(0, 1))  # -> Mapped, Clipped
dom_2 = ConstructDomain(DomainStart=panel_2, DomainEnd=panel)  # -> graft(Domain)
flatten_2 = FlattenTree(Tree=contour, Path="{0}")
inc = Includes(Value=remap_2.Mapped, Domain=dom_2)  # -> Includes, Deviation
dispatch_2 = Dispatch(List=flatten_2, DispatchPattern=inc.Includes)  # -> ListA, ListB
bang = ExplodeTree(Data=dispatch_2.ListA)  # -> Branch0, Branch1, Branch2, Branch3
merge = Merge(Data1=bang.Branch0, Data2=bang.Branch1, Data3=bang.Branch2)  # -> flatten(Result)
merge_2 = Merge(Data1=bang.Branch0, Data2=bang.Branch1)  # -> flatten(Result)
index = ItemIndex(List=flatten_2, Item=merge)
index_2 = ItemIndex(List=flatten_2, Item=bang.Branch0)
index_3 = ItemIndex(List=flatten_2, Item=merge_2)
panel_3 = Panel("2")
cull_i = CullIndex(List=flatten_2, Indices=index_2, Wrap=True)
cull_i_2 = CullIndex(List=flatten_2, Indices=index, Wrap=True)
cull_i_3 = CullIndex(List=flatten_2, Indices=index_3, Wrap=True)
panel_4 = Panel("1")
swatch = ColourSwatch(SwatchColor=RGB(194, 194, 194))
swatch_2 = ColourSwatch(SwatchColor=RGB(13, 0, 255))
previewlw_2 = CustomPreviewLineweights(Geometry=bang.Branch3, Shader=ColourSwatch(SwatchColor=RGB(0, 255, 157)), Thickness=panel_3, Absolute=False)
previewlw_3 = CustomPreviewLineweights(Geometry=bang.Branch1, Shader=ColourSwatch(SwatchColor=RGB(0, 149, 255)), Thickness=panel_3, Absolute=False)
previewlw_4 = CustomPreviewLineweights(Geometry=cull_i_3, Shader=swatch, Thickness=panel_4, Absolute=False)
previewlw_5 = CustomPreviewLineweights(Geometry=cull_i_2, Shader=swatch, Thickness=panel_4, Absolute=False)
previewlw_6 = CustomPreviewLineweights(Geometry=bang.Branch2, Shader=ColourSwatch(SwatchColor=RGB(0, 225, 255)), Thickness=panel_3, Absolute=False)

previewlw_7 = CustomPreviewLineweights(Geometry=bang.Branch0, Shader=swatch_2, Thickness=panel_3, Absolute=False)
previewlw_8 = CustomPreviewLineweights(Geometry=cull_i, Shader=swatch, Thickness=panel_4, Absolute=False)
