# Grasshopper definition #22_3D_voronoi_membrane.gh (Grasshopper 1.0.7)
# plug-ins: Weaverbird, Kangaroo2 Components, MeshEdit Components

region = Region({Plane=PlaneXY(0.2633668599, -3.424467059, 0), X=Domain(0, 26.54475236), Y=Domain(0, 35.03798147), Z=Domain(0, 26.64699583)})
populate_3d = Populate3D(Region=region, Count="50", Seed=1)
voronoi_3d = Voronoi3D(Points=populate_3d, Box=region)  # -> Cells, Boundary
area = Area(Geometry=voronoi_3d.Cells)  # -> Area, Centroid
deconstruct_brep = DeconstructBrep(Brep=voronoi_3d.Cells)  # -> Faces, Edges, Vertices
area_2 = Area(Geometry=deconstruct_brep.Faces)  # -> Area, Centroid
scale = Scale(Geometry=voronoi_3d.Cells, Center=area.Centroid, Factor=Slider(0.15, range=0..1))  # -> Geometry, Transform
deconstruct_brep_2 = DeconstructBrep(Brep=scale.Geometry)  # -> Faces, Edges, Vertices
scale_2 = Scale(Geometry=deconstruct_brep.Faces, Center=area_2.Centroid, Factor=Slider(0.5, range=0..1))  # -> Geometry, Transform
area_3 = Area(Geometry=deconstruct_brep_2.Faces)  # -> Area, Centroid
smaller_than = SmallerThan(FirstNumber=area_3.Area, SecondNumber="0.5")  # -> SmallerThan, OrEqualTo
dispatch = Dispatch(List=scale_2.Geometry, DispatchPattern=smaller_than.SmallerThan)  # -> ListA, ListB
dispatch_2 = Dispatch(List=deconstruct_brep_2.Faces, DispatchPattern=smaller_than.SmallerThan)  # -> ListA, ListB
brep = Brep(dispatch.ListB)
brep_2 = Brep(dispatch_2.ListA)
brep_3 = Brep(dispatch_2.ListB)
deconstruct_brep_3 = DeconstructBrep(Brep=brep)  # -> Faces, simplify(Edges), Vertices
deconstruct_brep_4 = DeconstructBrep(Brep=brep_3)  # -> Faces, simplify(Edges), Vertices
area_4 = Area(Geometry=brep_2)  # -> Area, Centroid
deconstruct_brep_5 = DeconstructBrep(Brep=brep_2)  # -> Faces, simplify(Edges), Vertices
graft_tree = GraftTree(Tree=deconstruct_brep_3.Edges, IncludeEmptyLists=True, IncludeNullItems=True)
graft_tree_2 = GraftTree(Tree=deconstruct_brep_4.Edges, IncludeEmptyLists=True, IncludeNullItems=True)
brep_closest_point = BrepClosestPoint(Point=area_4.Centroid, Brep=brep_2)  # -> Point, Normal, Distance
loft = Loft(
    Curves=[graft_tree_2, graft_tree],
    Options={Adjust=False, Closed=False, LoftEnds=0, LoftSimp=0, LoftType=0, Rebuild=10, Refit=0.01})  # -> flatten(Loft)
plane_normal = PlaneNormal(Origin=brep_closest_point.Point, ZAxis=brep_closest_point.Normal)  # -> graft(Plane)
simple_mesh = SimpleMesh(Brep=loft)
delaunay_mesh = DelaunayMesh(Points=simplify(deconstruct_brep_5.Vertices), Plane=simplify(plane_normal))  # -> flatten(Mesh)
mesh_flip = MeshFlip(Mesh=simple_mesh)
weaverbird_s_join_meshes_and_weld = WeaverbirdsJoinMeshesAndWeld(Mesh=[mesh_flip, delaunay_mesh], Weld=invert(False))
unify_mesh = UnifyMesh(Mesh=weaverbird_s_join_meshes_and_weld)  # -> Result, Count
weaverbird_s_catmull_clark_subdivision = WeaverbirdsCatmullClarkSubdivision(MeshCurves=unify_mesh.Result, Level="1", SmoothNakedEdges=1)
smooth = Smooth(M=weaverbird_s_catmull_clark_subdivision, Strength=1)
nakedvertices = NakedVertices(Mesh=weaverbird_s_catmull_clark_subdivision)  # -> ClothedIndex, NakedIndex, ClothedPts, NakedPts
edgelengths = EdgeLengths(Mesh=weaverbird_s_catmull_clark_subdivision, LengthFactor=Slider(0.7, range=0..1), Strength=1)
show = Show(G=weaverbird_s_catmull_clark_subdivision)
anchor = Anchor(Point=nakedvertices.NakedPts, Strength=10000)
entwine = Entwine(Branch00=show, Branch01=edgelengths, Branch02=anchor, Branch03=smooth, FlattenInputs=True)
solver = Solver(GoalObjects=entwine, Reset=Button(), Threshold=1e-15, Tolerance=0.0001, On=Toggle(True))  # -> I, V, O
explode_tree = ExplodeTree(Data=solver.O)
weaverbird_s_catmull_clark_subdivision_2 = WeaverbirdsCatmullClarkSubdivision(MeshCurves=explode_tree, Level=1, SmoothNakedEdges=1)
weaverbird_s_mesh_thicken = WeaverbirdsMeshThicken(MeshCurves=weaverbird_s_catmull_clark_subdivision_2, Distance=Slider(0.32, range=0..1), OffsetType=0)
