# Grasshopper definition #23_Voxel_wave_facade.gh (Grasshopper 1.0.7)
# plug-ins: Bifocals, NGon, Noise

rectangle = Rectangle(Plane=PlaneXY(0, 0, 0), XSize="20", YSize="10", Radius=0)  # -> Rectangle, Length
boundary = BoundarySurfaces(Edges=rectangle.Rectangle)
X = UnitX(Factor=1)
rot3d = Rotate3D(Geometry=boundary, Angle=1.570796327, Center=Point(0, 0, 0), Axis=X)  # -> Geometry, Transform
edges = BrepEdges(Brep=rot3d.Geometry)  # -> Naked, Interior, NonManifold
midpt = CurveMiddle(Curve=edges.Naked)
pdecon = Deconstruct(Point=midpt)  # -> XComponent, YComponent, ZComponent
sort = SortList(Keys=pdecon.ZComponent, ValuesA=edges.Naked)  # -> Keys, reverse(ValuesA)
contour = Contour(Shape=rot3d.Geometry, Point=Point(0, 0, 0), Direction=Vector(0, 0, 1), Distance="2")  # -> simplify(flatten(Contours))
item = ListItem(List=sort.ValuesA, Index=0, Wrap=True)
viewer = ParamViewer(item)
flip = FlipCurve(Curve=item)  # -> Curve, Flag
merge = Merge(Data1=flip.Curve, Data2=contour)  # -> flatten(Result)
divide = DivideCurve(Curve=merge, Count="100", Kinks=False)  # -> Points, Tangents, Parameters

crv = Curve(flatten(merge))
midpt_2 = CurveMiddle(Curve=crv)
pdecon_2 = Deconstruct(Point=midpt_2)  # -> XComponent, YComponent, ZComponent
sort_2 = SortList(Keys=pdecon_2.ZComponent, ValuesA=crv)  # -> Keys, ValuesA
midpt_3 = CurveMiddle(Curve=sort_2.ValuesA)
points = PointList(Points=midpt_3, Size="2")

midpt_4 = CurveMiddle(Curve=merge)
points_2 = PointList(Points=midpt_4, Size="2")

pdecon_3 = Deconstruct(Point=divide.Points)  # -> XComponent, YComponent, ZComponent
bnd = Bounds(Numbers=pdecon_3.XComponent)
remap = RemapNumbers(Value=pdecon_3.XComponent, Source=bnd, Target=Domain(0, 1))  # -> simplify(Mapped), Clipped
pi = Pi(Factor=1)
multiplication = Multiplication(A=remap.Mapped, B=pi, C=Slider(6.67, range=1..10))
split = SplitTree(Data=multiplication, Masks=flatten("{0,2,...}"))  # -> Positive, Negative
pi_2 = Pi(Factor=1)
subtraction = Subtraction(A=split.Negative, B=pi_2)
merge_2 = Merge(Data1=split.Positive, Data2=subtraction)
sin = Sine(Value=merge_2)  # -> simplify(Result)
multiplication_2 = Multiplication(A=sin, B=Slider(0.84, range=0..1))
Y = UnitY(Factor=1)
amp = Amplitude(Vector=Y, Amplitude=multiplication_2)
move = Move(Geometry=divide.Points, Motion=amp)  # -> Geometry, Transform
num = Number("20")
num_2 = Number("10")
brep = Brep(rot3d.Geometry)
number_slider = Slider(4.82, range=0..10)
multiplication_3 = Multiplication(A=num, B="3")
multiplication_4 = Multiplication(A=num_2, B="3")
intcrv = Interpolate(Vertices=move.Geometry, Degree=3, Periodic=False, KnotStyle=1)  # -> flatten(Curve), Length, Domain
Y_2 = UnitY(Factor="10")
vec = VectorXYZ(XComponent=Slider(0.7, range=0..1), YComponent=Slider(0.7, range=0..1), ZComponent=Slider(0.7, range=0..1))  # -> Vector, Length
sdivide = DivideSurface(Surface=brep, UCount=multiplication_3, VCount=multiplication_4)  # -> Points, Normals, Parameters
pt = Point(flatten(sdivide.Points))
loft = Loft(Curves=intcrv.Curve, Options={Adjust=False, Closed=False, LoftEnds=0, LoftSimp=0, LoftType=0, Rebuild=10, Refit=0.01})
Y_3 = UnitY(Factor=1)
move_2 = Move(Geometry=sdivide.Points, Motion=Y_2)  # -> Geometry, Transform
pn = PerlinNoise(
    Points=pt,
    Seed=0,
    Amplitude=1,
    SmoothStep=0,
    FrequecyX=number_slider,
    FrequecyY=number_slider,
    FrequecyZ=number_slider,
    Jitter="1",
    AlignVector=vec.Vector)
neg = Negative(Value=Y_3)
multiplication_5 = Multiplication(A="10", B=2)
neg_2 = Negative(Value="1")
line = LineSDL(Start=move_2.Geometry, Direction=neg, Length=multiplication_5)
dom = ConstructDomain(DomainStart=0, DomainEnd="255")
graph = GraphMapper(pn, x0=0, x1=1, y0=0, y1=1, container_name="Bezier", cpx=[0, 0.5434181094, 0.351169765, 1], cpy=[0, 0, 1, 1])
dom_2 = ConstructDomain(DomainStart=neg_2, DomainEnd="1")
remap_2 = RemapNumbers(Value=graph, Source=Domain(0, 1), Target=dom)  # -> Mapped, Clipped
remap_3 = RemapNumbers(Value=graph, Source=Domain(0, 1), Target=dom_2)  # -> Mapped, Clipped
division = Division(A=num, B=multiplication_3)
bcx = BrepCurve(Brep=loft, Curve=line)  # -> Curves, flatten(Points)
rgb = ColourRGB(Alpha=255, Red=remap_2.Mapped, Green=remap_2.Mapped, Blue=remap_2.Mapped)
division_2 = Division(A=division, B="2")
Y_4 = UnitY(Factor=remap_3.Mapped)
neg_3 = Negative(Value=division_2)
xz = XZPlane(Origin=bcx.Points)
preview = CustomPreview(Geometry=pt, Material=rgb)
move_3 = Move(Geometry=pt, Motion=Y_4)  # -> Geometry, Transform
dom_3 = ConstructDomain(DomainStart=neg_3, DomainEnd=division_2)
xz_2 = XZPlane(Origin=move_3.Geometry)
rectangle_2 = Rectangle(Plane=xz, XSize=dom_3, YSize=dom_3, Radius=0)  # -> Rectangle, Length
rectangle_3 = Rectangle(Plane=xz_2, XSize=dom_3, YSize=dom_3, Radius=0)  # -> Rectangle, Length
boundary_2 = BoundarySurfaces(Edges=rectangle_2.Rectangle)
boundary_3 = BoundarySurfaces(Edges=rectangle_3.Rectangle)
smesh = SimpleMesh(Brep=boundary_2)
smesh_2 = SimpleMesh(Brep=boundary_3)
offsetmesh = OffsetMesh(Mesh=smesh, Dist=1, Solid=Toggle(True))
offsetmesh_2 = OffsetMesh(Mesh=smesh_2, Dist=1, Solid=Toggle(True))
