# Grasshopper definition #24_Wavy_wall.gh (Grasshopper 1.0.7)
# plug-ins: Bifocals, Noise

rectangle = Rectangle(Plane=PlaneXY(0, 0, 0), XSize="200", YSize="100", Radius=0)  # -> Rectangle, Length
division = Division(A="200", B="10")
division_2 = Division(A="200", B="20")
yz = YZPlane(Origin=Point(0, 0, 0))
boundary = BoundarySurfaces(Edges=rectangle.Rectangle)
number_slider = Slider(1, range=0..1)
rotate = Rotate(Geometry=boundary, Angle=1.570796327, Plane=yz)  # -> Geometry, Transform
number_slider_2 = Slider(10, range=0..10)
number_slider_3 = Slider(6.38, range=0..10)
sdivide = DivideSurface(Surface=rotate.Geometry, UCount=division_2, VCount=division)  # -> Points, Normals, Parameters
vec = VectorXYZ(XComponent=number_slider, YComponent=0, ZComponent=number_slider)  # -> Vector, Length
flip = FlipMatrix(Data=sdivide.Points)
flatten = FlattenTree(Tree=flip, Path="{0}")
pn = PerlinNoise(
    Points=flatten,
    Seed="50",
    Amplitude=1,
    SmoothStep=0,
    FrequecyX=number_slider_3,
    FrequecyY=number_slider_3,
    FrequecyZ=number_slider_3,
    Jitter=Slider(0.18, range=0..1),
    AlignVector=vec.Vector)
pn_2 = PerlinNoise(
    Points=flatten,
    Seed="5",
    Amplitude=1,
    SmoothStep=0,
    FrequecyX=number_slider_2,
    FrequecyY=number_slider_2,
    FrequecyZ=number_slider_2,
    Jitter=0,
    AlignVector=Vector(1, 0, 0))
lng = ListLength(List=flip)  # -> flatten(Length)
pi = Pi(Factor=1)
multiplication = Multiplication(A=pn, B=pi, C=Slider(10, range=1..10))
cset = CreateSet(List=lng)  # -> Set, Map
sin = Sine(Value=multiplication)

bnd = Bounds(Numbers=sin)
dom = ConstructDomain(DomainStart=0, DomainEnd="255")
remap = RemapNumbers(Value=sin, Source=bnd, Target=dom)  # -> Mapped, Clipped
rgb = ColourRGB(Alpha=255, Red=remap.Mapped, Green=remap.Mapped, Blue=remap.Mapped)
preview = CustomPreview(Geometry=flatten, Material=rgb)

dom_2 = ConstructDomain(DomainStart=0, DomainEnd="255")
remap_2 = RemapNumbers(Value=pn_2, Source=Domain(0, 1), Target=dom_2)  # -> Mapped, Clipped
rgb_2 = ColourRGB(Alpha=255, Red=remap_2.Mapped, Green=remap_2.Mapped, Blue=remap_2.Mapped)
preview_2 = CustomPreview(Geometry=flatten, Material=rgb_2)

# ---- group: XZ向量
neg = Negative(Value="45")
bnd_2 = Bounds(Numbers=sin)
dom_3 = ConstructDomain(DomainStart=neg, DomainEnd="45")
remap_3 = RemapNumbers(Value=sin, Source=bnd_2, Target=dom_3)  # -> Mapped, Clipped
neg_2 = Negative(Value="1")
X = UnitX(Factor=1)
Y = UnitY(Factor=1)
dom_4 = ConstructDomain(DomainStart=neg_2, DomainEnd="1")
vrot = Rotate(Vector=X, Axis=Y, Angle=degrees(remap_3.Mapped))
lng_2 = ListLength(List=vrot)
random = Random(Range=dom_4, Number=lng_2, Seed="53")
random_2 = Random(Range=dom_4, Number=lng_2, Seed="56")
vec_2 = VectorXYZ(XComponent=random, YComponent=0, ZComponent=random_2)  # -> Vector, Length
unit = UnitVector(Vector=vec_2.Vector)
multiplication_2 = Multiplication(A=unit, B=Slider(0.52, range=0..1))
addition = Addition(A=vrot, B=multiplication_2)
multiplication_3 = Multiplication(A=pn, B=Slider(2.9, range=0..10))
amp = Amplitude(Vector=addition, Amplitude=multiplication_3)

# ----
multiplication_4 = Multiplication(A=pn_2, B=Slider(6.18, range=0..10))
Y_2 = UnitY(Factor=1)
amp_2 = Amplitude(Vector=Y_2, Amplitude=multiplication_4)
move = Move(Geometry=flatten, Motion=amp)  # -> Geometry, Transform
move_2 = Move(Geometry=move.Geometry, Motion=amp_2)  # -> Geometry, Transform
partition = PartitionList(List=move_2.Geometry, Size=cset.Set)
number_slider_4 = Slider(7.11, range=0..10)
intcrv = Interpolate(Vertices=partition, Degree=3, Periodic=False, KnotStyle=1)  # -> simplify(Curve), Length, Domain
divide = DivideCurve(Curve=intcrv.Curve, Count="25", Kinks=False)  # -> Points, Tangents, Parameters
flatten_2 = FlattenTree(Tree=divide.Points, Path="{0}")
lng_3 = ListLength(List=divide.Points)  # -> flatten(Length)
pn_3 = PerlinNoise(
    Points=flatten_2,
    Seed="77",
    Amplitude=1,
    SmoothStep=0,
    FrequecyX=number_slider_4,
    FrequecyY=number_slider_4,
    FrequecyZ=number_slider_4,
    Jitter=0,
    AlignVector=Vector(1, 0, 0))
cset_2 = CreateSet(List=lng_3)  # -> Set, Map
partition_2 = PartitionList(List=pn_3, Size=cset_2.Set)
graft = GraftTree(Tree=divide.Points, IncludeEmptyLists=True, IncludeNullItems=True)  # -> simplify(Tree)
graft_2 = GraftTree(Tree=partition_2, IncludeEmptyLists=True, IncludeNullItems=True)  # -> simplify(Tree)
number_slider_5 = Slider(4.21, range=0..10)
relitem = RelativeItem(Tree=graft_2, Offset="{+1;+0}", WrapPaths=False, WrapItems=False)  # -> ItemA, ItemB
relitem_2 = RelativeItem(Tree=graft, Offset="{+1;+0}", WrapPaths=False, WrapItems=False)  # -> ItemA, ItemB
Y_3 = UnitY(Factor=1)
Y_4 = UnitY(Factor=1)
multiplication_5 = Multiplication(A=relitem.ItemB, B=number_slider_5)
multiplication_6 = Multiplication(A=relitem.ItemA, B=number_slider_5)
amp_3 = Amplitude(Vector=Y_3, Amplitude=multiplication_6)
amp_4 = Amplitude(Vector=Y_4, Amplitude=multiplication_5)
bzspan = BezierSpan(StartPoint=relitem_2.ItemA, StartTangent=amp_3, EndPoint=relitem_2.ItemB, EndTangent=amp_4)  # -> Curve, Length, Domain
relitem_3 = RelativeItem(Tree=intcrv.Curve, Offset="{+1}", WrapPaths=False, WrapItems=False)  # -> ItemA, ItemB
trim = TrimTree(Tree=bzspan.Curve, Depth=1)
swp2 = Sweep2(Rail1=relitem_3.ItemA, Rail2=relitem_3.ItemB, Sections=trim, SameHeight=False)  # -> flatten(Brep)
join = BrepJoin(Breps=swp2)  # -> Breps, Closed
