# Grasshopper definition #25_Spatial_grid.gh (Grasshopper 1.0.7)
# plug-ins: Bifocals, Kangaroo2 Components, DendroGH, Weaverbird

rectangle = Rectangle(Plane=PlaneXY(0, 0, 0), XSize="100", YSize="100", Radius=0)  # -> Rectangle, Length
box_rectangle = BoxRectangle(Rectangle=rectangle.Rectangle, Height="400")
area = Area(Geometry=box_rectangle)  # -> Area, Centroid
deconstruct = Deconstruct(Point=area.Centroid)  # -> XComponent, YComponent, ZComponent
construct_point = ConstructPoint(XCoordinate=deconstruct.XComponent, YCoordinate=deconstruct.YComponent, ZCoordinate=0)
construct_point_2 = ConstructPoint(XCoordinate=deconstruct.XComponent, YCoordinate=deconstruct.YComponent, ZCoordinate="400")
number_slider = Slider(1.24, range=0..10)
populate_3d = Populate3D(Region=box_rectangle, Count="120", Seed=1)
scale_nu = ScaleNU(
    Geometry=box_rectangle,
    Plane=construct_point,
    ScaleX=number_slider,
    ScaleY=number_slider,
    ScaleZ=Slider(0.35, range=0..1))  # -> Geometry, Transform
scale_nu_2 = ScaleNU(
    Geometry=box_rectangle,
    Plane=construct_point_2,
    ScaleX=number_slider,
    ScaleY=number_slider,
    ScaleZ=Slider(0.35, range=0..1))  # -> Geometry, Transform
voronoi_3d = Voronoi3D(Points=populate_3d)  # -> Cells, Boundary
unit_z = UnitZ(Factor="8")
offset_curve = OffsetCurve(Curve=rectangle.Rectangle, Distance="6", Corners=1)
deconstruct_brep = DeconstructBrep(Brep=voronoi_3d.Cells)  # -> Faces, flatten(Edges), Vertices
reverse = Reverse(Vector=unit_z)
offset_curve_2 = OffsetCurve(Curve=offset_curve, Distance="20", Corners=1)
move = Move(Geometry=scale_nu_2.Geometry, Motion=unit_z)  # -> Geometry, Transform
move_2 = Move(Geometry=scale_nu.Geometry, Motion=reverse)  # -> Geometry, Transform
removeduplicatelines = RemoveDuplicateLines(Lines=deconstruct_brep.Edges, Tolerance=0.01)
loft = Loft(
    Curves=flatten([offset_curve, offset_curve_2]),
    Options={Adjust=False, Closed=False, LoftEnds=0, LoftSimp=0, LoftType=0, Rebuild=10, Refit=0.01})
divide_length = DivideLength(Curve=removeduplicatelines, Length="8")  # -> flatten(Points), Tangents, Parameters
merge_faces = MergeFaces(Brep=loft)  # -> Breps, Before, After
mesh_brep = MeshBrep(
    Brep=move_2.Geometry,
    Settings={GridMaxCount=0, GridMinCount=16, JaggedSeams=False, MaxEdgeLength=0, MinEdgeLength=0.0001, MinTolerance=0, Refine=True, RefineAngle=0, RelativeTolerance=0.65, SimplePlanes=True, Tolerance=0})
mesh_brep_2 = MeshBrep(
    Brep=move.Geometry,
    Settings={GridMaxCount=0, GridMinCount=16, JaggedSeams=False, MaxEdgeLength=0, MinEdgeLength=0.0001, MinTolerance=0, Refine=True, RefineAngle=0, RelativeTolerance=0.65, SimplePlanes=True, Tolerance=0})
unit_z_2 = UnitZ(Factor="500")
removeduplicatepts = RemoveDuplicatePts(Points=divide_length.Points, Tolerance=0.01)
extrude = Extrude(Base=merge_faces.Breps, Direction=unit_z_2)
unit_z_3 = UnitZ(Factor="50")
reverse_2 = Reverse(Vector=unit_z_3)
create_settings = CreateSettings(VoxelSize="4.5", Bandwidth=1, Isovalue=0, Adaptivity=0.1)
multiplication = Multiplication(A="4.5", B="1.5")
move_3 = Move(Geometry=extrude, Motion=reverse_2)  # -> Geometry, Transform
points_to_volume = PointsToVolume(Points=removeduplicatepts, PointRadius=multiplication, Settings=create_settings)
mesh_to_volume = MeshToVolume(Mesh=mesh_brep, VolumeSettings=create_settings)
mesh_to_volume_2 = MeshToVolume(Mesh=mesh_brep_2, VolumeSettings=create_settings)
smooth_volume = SmoothVolume(Volume=points_to_volume, Width=1, Type=2, Iterations=1)
volume_union = VolumeUnion(Volumes=flatten([smooth_volume, mesh_to_volume, mesh_to_volume_2]))
volume_to_mesh = VolumeToMesh(Volume=volume_union, VolumeSettings=create_settings)
mesh_brep_3 = MeshBrep(
    Brep=move_3.Geometry,
    Settings={GridMaxCount=0, GridMinCount=16, JaggedSeams=False, MaxEdgeLength=0, MinEdgeLength=0.0001, MinTolerance=0, Refine=True, RefineAngle=0, RelativeTolerance=0.65, SimplePlanes=True, Tolerance=0})
mesh_difference = MeshDifference(MeshesA=volume_to_mesh, MeshesB=mesh_brep_3)
quad_remesh_settings = QuadRemeshSettings(TargetCount="8000", AdaptiveSize="50", AdaptiveCount=False, HardEdges=False, SeamEdges=0, Symmetry=0, GuideCurves=0)
quad_remesh = QuadRemesh(Mesh=mesh_difference, Settings=quad_remesh_settings)
weaverbird_s_sierpinski_carpet = WeaverbirdsSierpinskiCarpet(MeshPolylines=quad_remesh, Distance="20", InsetType=0)
weaverbird_s_mesh_thicken = WeaverbirdsMeshThicken(MeshCurves=weaverbird_s_sierpinski_carpet, Distance="1", OffsetType=0)
