# Grasshopper definition #27_Tessellation_facade.gh (Grasshopper 1.0.7)
# plug-ins: Bifocals, Parakeet, LunchBox

rectangle = Rectangle(Plane=PlaneXY(0, 0, 0), XSize="20", YSize="20", Radius=0)  # -> Rectangle, Length
quadrilateral_tiling = QuadrilateralTiling(BasedCurve=rectangle.Rectangle, UCount="3", VCount="10")
construct_domain = ConstructDomain(DomainStart="0", DomainEnd="2")
list_length = ListLength(List=quadrilateral_tiling)
random = Random(Range=construct_domain, Number=list_length, Seed=Slider(50, range=0..1000))
round = Round(Number=random)  # -> Nearest, Floor, Ceiling
panel = Panel("""0
0.5
1""")
list_item = ListItem(List=panel, Index=round.Nearest, Wrap=True)
pi = Pi(Factor=list_item)
area = Area(Geometry=quadrilateral_tiling)  # -> Area, Centroid
rotate = Rotate(Geometry=quadrilateral_tiling, Angle=pi, Plane=area.Centroid)  # -> Geometry, Transform
curve = Curve(rotate.Geometry)
number_slider = Slider(1, range=0..1)

pattern_genotype_o = PatternGenotypeO(
    BasePolylines=curve,
    Orientation=True,
    Prune=True,
    SelfIntersection=True,
    StepNumber=1,
    BulgeFactor=0.25,
    Degree=2,
    Seed=5)  # -> Pattern, LinearPattern
pattern_genotype_n_ta = PatternGenotypeNTA(BasePolylines=curve, Blend=number_slider, StartIndex=0)  # -> simplify(Pattern)
pattern_genotype_i = PatternGenotypeI(BasePolylines=curve, Factor=Slider(0.5, range=0..1))
partition_list = PartitionList(List=pattern_genotype_o.Pattern, Size="2")
stream_filter = StreamFilter(Gate=Slider(1, range=0..2), Stream0=pattern_genotype_n_ta, Stream1=partition_list, Stream2=pattern_genotype_i)  # -> simplify(Stream)

pattern_genotype_o_2 = PatternGenotypeO(
    BasePolylines=curve,
    Orientation=True,
    Prune=True,
    SelfIntersection=True,
    StepNumber=1,
    BulgeFactor=0.25,
    Degree=2,
    Seed=5)  # -> Pattern, LinearPattern
pattern_genotype_n_ta_2 = PatternGenotypeNTA(BasePolylines=curve, Blend=number_slider, StartIndex=0)  # -> simplify(Pattern)
pattern_genotype_i_2 = PatternGenotypeI(BasePolylines=curve, Factor=Slider(0.5, range=0..1))
partition_list_2 = PartitionList(List=pattern_genotype_o_2.Pattern, Size="2")
stream_filter_2 = StreamFilter(Gate=Slider(2, range=0..2), Stream0=pattern_genotype_n_ta_2, Stream1=partition_list_2, Stream2=pattern_genotype_i_2)  # -> simplify(Stream)

panel_2 = Panel("3")
random_split_list = RandomSplitList(MasterList=curve, Seed=50, Split=Slider(0.61, range=0..1))  # -> ListA, ListB
item_index = ItemIndex(List=curve, Item=random_split_list.ListA)
item_index_2 = ItemIndex(List=curve, Item=random_split_list.ListB)
tree_branch = TreeBranch(Tree=stream_filter_2, Path=item_index, MaintainPaths=True)
tree_branch_2 = TreeBranch(Tree=stream_filter, Path=item_index_2, MaintainPaths=True)
horizontal_frames = HorizontalFrames(Curve=tree_branch, Count=10)  # -> Frames, Parameters
horizontal_frames_2 = HorizontalFrames(Curve=tree_branch_2, Count=10)  # -> Frames, Parameters
deconstruct_plane = DeconstructPlane(Plane=horizontal_frames.Frames)  # -> Origin, XAxis, YAxis, ZAxis
series = Series(Start=0, Step=Slider(0.8, range=0..2), Count="12")
deconstruct_plane_2 = DeconstructPlane(Plane=horizontal_frames_2.Frames)  # -> Origin, XAxis, YAxis, ZAxis
graft_tree = GraftTree(Tree=deconstruct_plane.Origin, IncludeEmptyLists=True, IncludeNullItems=True)
graft_tree_2 = GraftTree(Tree=deconstruct_plane.YAxis, IncludeEmptyLists=True, IncludeNullItems=True)
graft_tree_3 = GraftTree(Tree=deconstruct_plane_2.Origin, IncludeEmptyLists=True, IncludeNullItems=True)
graft_tree_4 = GraftTree(Tree=deconstruct_plane_2.YAxis, IncludeEmptyLists=True, IncludeNullItems=True)
list_item_2 = ListItem(List=series, Index=0, Wrap=True)  # -> Item1, Item
amplitude = Amplitude(Vector=graft_tree_2, Amplitude=series)
amplitude_2 = Amplitude(Vector=graft_tree_4, Amplitude=series)
division = Division(A=list_item_2.Item1, B="2")
amplitude_3 = Amplitude(Vector=graft_tree_2, Amplitude=division)
amplitude_4 = Amplitude(Vector=graft_tree_4, Amplitude=division)
move = Move(Geometry=graft_tree, Motion=amplitude)  # -> Geometry, Transform
reverse = Reverse(Vector=amplitude_3)
move_2 = Move(Geometry=graft_tree_3, Motion=amplitude_2)  # -> Geometry, Transform
reverse_2 = Reverse(Vector=amplitude_4)
move_3 = Move(Geometry=move.Geometry, Motion=reverse)  # -> Geometry, Transform
move_4 = Move(Geometry=move_2.Geometry, Motion=reverse_2)  # -> Geometry, Transform
path_mapper = PathMapper(move_3.Geometry, source="{A;B;C}[i]", target="{A;B;i}[C]")
path_mapper_2 = PathMapper(move_4.Geometry, source="{A;B;C}[i]", target="{A;B;i}[C]")
interpolate = Interpolate(Vertices=path_mapper, Degree=3, Periodic=False, KnotStyle=1)  # -> Curve, Length, Domain
interpolate_2 = Interpolate(Vertices=path_mapper_2, Degree=3, Periodic=False, KnotStyle=1)  # -> Curve, Length, Domain
division_2 = Division(A="12", B="2")
trim_tree = TrimTree(Tree=interpolate.Curve, Depth=1)
trim_tree_2 = TrimTree(Tree=interpolate_2.Curve, Depth=1)
reverse_list = ReverseList(List=trim_tree)
reverse_list_2 = ReverseList(List=trim_tree_2)
split_list = SplitList(List=reverse_list, Index=division_2)  # -> ListA, ListB
split_list_2 = SplitList(List=trim_tree, Index=division_2)  # -> ListA, ListB
split_list_3 = SplitList(List=reverse_list_2, Index=division_2)  # -> ListA, ListB
split_list_4 = SplitList(List=trim_tree_2, Index=division_2)  # -> ListA, ListB
graft_tree_5 = GraftTree(Tree=split_list_2.ListA, IncludeEmptyLists=True, IncludeNullItems=True)
graft_tree_6 = GraftTree(Tree=split_list.ListA, IncludeEmptyLists=True, IncludeNullItems=True)
graft_tree_7 = GraftTree(Tree=split_list_4.ListA, IncludeEmptyLists=True, IncludeNullItems=True)
graft_tree_8 = GraftTree(Tree=split_list_3.ListA, IncludeEmptyLists=True, IncludeNullItems=True)
loft = Loft(
    Curves=[graft_tree_6, graft_tree_5],
    Options={Adjust=False, Closed=False, LoftEnds=0, LoftSimp=0, LoftType=0, Rebuild=10, Refit=0.01})
loft_2 = Loft(
    Curves=[graft_tree_8, graft_tree_7],
    Options={Adjust=False, Closed=False, LoftEnds=0, LoftSimp=0, LoftType=0, Rebuild=10, Refit=0.01})
trim_tree_3 = TrimTree(Tree=loft, Depth="2")
trim_tree_4 = TrimTree(Tree=loft_2, Depth="2")
path_mapper_3 = PathMapper(trim_tree_3, source="{A;B}[i]", target="{A;i}[B]")
path_mapper_4 = PathMapper(trim_tree_4, source="{A;B}[i]", target="{A;i}[B]")
merge = Merge(Data1=path_mapper_3, Data2=path_mapper_4)
number_slider_2 = Slider(1.22, range=0..10)
panel_3 = Panel("4")
curve_2 = Curve(quadrilateral_tiling)
integer = Integer(division_2)
series_2 = Series(Start=number_slider_2, Step=number_slider_2, Count=integer)
trim_tree_5 = TrimTree(Tree=merge, Depth=1)
unit_z = UnitZ(Factor=series_2)
tree_statistics = TreeStatistics(Tree=trim_tree_5)  # -> Paths, Length, Count
duplicate_data = DuplicateData(Data=unit_z, Number=tree_statistics.Count, Order=True)
graft_tree_9 = GraftTree(Tree=duplicate_data, IncludeEmptyLists=True, IncludeNullItems=True)  # -> simplify(Tree)
move_5 = Move(Geometry=merge, Motion=graft_tree_9)  # -> Geometry, Transform
curve_3 = Curve(move_5.Geometry)
area_2 = Area(Geometry=curve_3)  # -> Area, Centroid
average = Average(Input=area_2.Centroid)
unit_z_2 = UnitZ(Factor=number_slider_2)
boundary_surfaces = BoundarySurfaces(Edges=curve_2)
xy_plane = XYPlane(Origin=average)
region_union = RegionUnion(Curves=curve_3, Plane=xy_plane)
boundary_surfaces_2 = BoundarySurfaces(Edges=region_union)
unit_z_3 = UnitZ(Factor=number_slider_2)
extrude = Extrude(Base=boundary_surfaces_2, Direction=unit_z_3)
extrude_2 = Extrude(Base=boundary_surfaces, Direction=unit_z_2)
