# Grasshopper definition #28_Quin_MGX.gh (Grasshopper 1.0.7)
# plug-ins: Bifocals, Weaverbird, Kangaroo2 Components

radius = Panel("100")
weaverbird_s_polylines_dodecahedron = WeaverbirdsPolylinesDodecahedron(Plane=PlaneXY(0, 0, 0), Radius=radius)
rotated_angle = Slider(0.34, range=0..1)
distance = Slider(3.86, range=2..15)
scale = Slider(0.28, range=0..1)
area = Area(Geometry=weaverbird_s_polylines_dodecahedron)  # -> Area, Centroid
boundary_surfaces = BoundarySurfaces(Edges=weaverbird_s_polylines_dodecahedron)
scale_2 = Scale(Geometry=weaverbird_s_polylines_dodecahedron, Center=area.Centroid, Factor=scale)  # -> Geometry, Transform
brep_closest_point = BrepClosestPoint(Point=area.Centroid, Brep=boundary_surfaces)  # -> Point, Normal, Distance
plane_normal = PlaneNormal(Origin=brep_closest_point.Point, ZAxis=brep_closest_point.Normal)
pi = Pi(Factor=rotated_angle)
rotate = Rotate(Geometry=scale_2.Geometry, Angle=pi, Plane=plane_normal)  # -> Geometry, Transform
amplitude = Amplitude(Vector=brep_closest_point.Normal, Amplitude=distance)
curve = Curve(weaverbird_s_polylines_dodecahedron)
explode = Explode(Curve=curve, Recursive=True)  # -> simplify(Segments), Vertices
reverse = Reverse(Vector=amplitude)
move = Move(Geometry=rotate.Geometry, Motion=amplitude)  # -> Geometry, Transform
move_2 = Move(Geometry=rotate.Geometry, Motion=reverse)  # -> Geometry, Transform
graft_tree = GraftTree(Tree=explode.Segments, IncludeEmptyLists=True, IncludeNullItems=True)
explode_2 = Explode(Curve=move.Geometry, Recursive=True)  # -> simplify(Segments), simplify(Vertices)
explode_3 = Explode(Curve=move_2.Geometry, Recursive=True)  # -> simplify(Segments), simplify(Vertices)
subtraction = Subtraction(A="1", B="0.35")
subtraction_2 = Subtraction(A="1", B="0.15")
removeduplicatepts = RemoveDuplicatePts(Points=explode_3.Vertices, Tolerance=0.01)
removeduplicatepts_2 = RemoveDuplicatePts(Points=explode_2.Vertices, Tolerance=0.01)
construct_domain = ConstructDomain(DomainStart="0.15", DomainEnd="0.35")
construct_domain_2 = ConstructDomain(DomainStart=subtraction, DomainEnd=subtraction_2)
shift_list = ShiftList(List=explode_2.Segments, Shift="-1", Wrap=True)  # -> simplify(List)
graft_tree_2 = GraftTree(Tree=explode_3.Segments, IncludeEmptyLists=True, IncludeNullItems=True)
sub_curve = SubCurve(BaseCurve=reparameterize(graft_tree), Domain=construct_domain_2)
sub_curve_2 = SubCurve(BaseCurve=reparameterize(graft_tree), Domain=construct_domain)
graft_tree_3 = GraftTree(Tree=shift_list, IncludeEmptyLists=True, IncludeNullItems=True)
loft = Loft(
    Curves=[sub_curve_2, graft_tree_3],
    Options={Adjust=False, Closed=False, LoftEnds=0, LoftSimp=0, LoftType=0, Rebuild=10, Refit=0.01})
loft_2 = Loft(
    Curves=[sub_curve, graft_tree_2],
    Options={Adjust=False, Closed=False, LoftEnds=0, LoftSimp=0, LoftType=0, Rebuild=10, Refit=0.01})
delaunay_mesh = DelaunayMesh(Points=removeduplicatepts_2, Plane=PlaneXY(0, 0, 0))
delaunay_mesh_2 = DelaunayMesh(Points=removeduplicatepts, Plane=PlaneXY(0, 0, 0))
simple_mesh = SimpleMesh(Brep=loft)
simple_mesh_2 = SimpleMesh(Brep=loft_2)
merge = Merge(Data1=simple_mesh, Data2=simple_mesh_2, Data3=delaunay_mesh, Data4=delaunay_mesh_2)  # -> flatten(Result)
weaverbird_s_join_meshes_and_weld = WeaverbirdsJoinMeshesAndWeld(Mesh=merge, Weld=invert(False))
weaverbird_s_mesh_thicken = WeaverbirdsMeshThicken(MeshCurves=weaverbird_s_join_meshes_and_weld, Distance=Slider(8, range=0..10), OffsetType=0)
subd_from_mesh = SubDFromMesh(Mesh=weaverbird_s_mesh_thicken, Creases=1, Corners=1, Interpolate=False)
mesh_from_subd = MeshFromSubD(SubD=subd_from_mesh, Density=2)
weaverbird_s_catmull_clark_subdivision = WeaverbirdsCatmullClarkSubdivision(MeshCurves=mesh_from_subd, Level=1, SmoothNakedEdges=1)
custom_preview = CustomPreview(
    Geometry=weaverbird_s_catmull_clark_subdivision,
    Material={diffuse=RGB(221, 160, 221), emission=RGB(66, 48, 66), shine=0.5, specular=RGB(255, 255, 255), transparency=0})
