# Grasshopper definition #29_Tessellation_texture.gh (Grasshopper 1.0.7)
# plug-ins: Kangaroo2 Components, Weaverbird, Bifocals

unit_x = UnitX(Factor=1)
dimensions = Panel("1000")
unit_y = UnitY(Factor=1)
construct_point = ConstructPoint(XCoordinate=0, YCoordinate=0, ZCoordinate=0)
amplitude = Amplitude(Vector=unit_x, Amplitude=dimensions)
line_sdl = LineSDL(Start=construct_point, Direction=unit_y, Length=dimensions)
move = Move(Geometry=line_sdl, Motion=amplitude)  # -> Geometry, Transform
angle = Slider(0.1, range=0..1)
curve_middle = CurveMiddle(Curve=move.Geometry)
pi = Pi(Factor=angle)
yz_plane = YZPlane(Origin=curve_middle)
rotate = Rotate(Geometry=move.Geometry, Angle=pi, Plane=yz_plane)  # -> Geometry, Transform
merge = Merge(Data1=line_sdl, Data2=rotate.Geometry)

construct_point_2 = ConstructPoint(XCoordinate=0, YCoordinate=0, ZCoordinate=0)  # disabled
unit_y_2 = UnitY(Factor=1)  # disabled
panel = Panel("1000")  # disabled
unit_x_2 = UnitX(Factor=panel)  # disabled
line_sdl_2 = LineSDL(Start=construct_point_2, Direction=unit_y_2, Length=panel)  # disabled
number_slider = Slider(0.35, range=0..1)  # disabled
move_2 = Move(Geometry=line_sdl_2, Motion=unit_x_2)  # -> Geometry, Transform; disabled
curve_middle_2 = CurveMiddle(Curve=move_2.Geometry)  # disabled
pi_2 = Pi(Factor=number_slider)  # disabled
yz_plane_2 = YZPlane(Origin=curve_middle_2)  # disabled
rotate_2 = Rotate(Geometry=move_2.Geometry, Angle=pi_2, Plane=yz_plane_2)  # -> Geometry, Transform; disabled
loft = Loft(
    Curves=[line_sdl_2, rotate_2.Geometry],
    Options={Adjust=False, Closed=False, LoftEnds=0, LoftSimp=0, LoftType=0, Rebuild=10, Refit=0.01})  # disabled
divide_domain² = DivideDomain²(Domain=loft, UCount=10, VCount=10)  # disabled
md_slider = MDSlider(SliderMode=0, slider_value=Point(0.5, 0.5, 0.5), x_domain=Domain(0, 1), y_domain=Domain(0, 1), z_domain=Domain(0, 1))  # disabled
isotrim = Isotrim(Surface=loft, Domain=divide_domain²)  # disabled
curve = Curve(isotrim)  # disabled
evaluate_surface = EvaluateSurface(Surface=reparameterize(isotrim), Point=md_slider)  # -> Point, Normal, UDirection, VDirection, Frame; disabled
explode = Explode(Curve=curve, Recursive=True)  # -> Segments, Vertices; disabled
graft_tree = GraftTree(Tree=evaluate_surface.Point, IncludeEmptyLists=True, IncludeNullItems=True)  # disabled
curve_middle_3 = CurveMiddle(Curve=explode.Segments)  # disabled
removeduplicatepts = RemoveDuplicatePts(Points=explode.Vertices, Tolerance=0.01)  # disabled
circle = Circle(Plane=graft_tree, Radius=1)  # disabled
sort_along_curve = SortAlongCurve(Points=curve_middle_3, Curve=circle)  # -> Points, simplify(Indices); disabled
panel_2 = Panel("0")  # disabled
panel_3 = Panel("3")  # disabled
number_slider_2 = Slider(56, range=0..100)  # disabled
construct_domain = ConstructDomain(DomainStart=panel_2, DomainEnd=panel_3)  # disabled
tree_statistics = TreeStatistics(Tree=sort_along_curve.Points)  # -> Paths, Length, Count; disabled
random = Random(Range=construct_domain, Number=tree_statistics.Count, Seed=number_slider_2)  # disabled
round = Round(Number=random)  # -> Nearest, Floor, Ceiling; disabled
graft_tree_2 = GraftTree(Tree=round.Floor, IncludeEmptyLists=True, IncludeNullItems=True)  # disabled
shift_list = ShiftList(List=sort_along_curve.Points, Shift=graft_tree_2, Wrap=True)  # -> simplify(List); disabled
graft_tree_3 = GraftTree(Tree=isotrim, IncludeEmptyLists=True, IncludeNullItems=True)  # disabled
list_item = ListItem(List=removeduplicatepts, Index=sort_along_curve.Indices, Wrap=True)  # disabled
number_slider_3 = Slider(12.6, range=0..100)  # disabled
graft_tree_4 = GraftTree(Tree=evaluate_surface.Normal, IncludeEmptyLists=True, IncludeNullItems=True)  # disabled
brep_closest_point = BrepClosestPoint(Point=shift_list, Brep=graft_tree_3)  # -> Point, Normal, Distance; disabled
amplitude_2 = Amplitude(Vector=graft_tree_4, Amplitude=number_slider_3)  # disabled
amplitude_3 = Amplitude(Vector=brep_closest_point.Normal, Amplitude=number_slider_3)  # disabled
point = Point(graft_tree)  # disabled
move_3 = Move(Geometry=shift_list, Motion=amplitude_3)  # -> simplify(Geometry), Transform; disabled
move_4 = Move(Geometry=point, Motion=amplitude_2)  # -> simplify(Geometry), Transform; disabled
panel_4 = Panel("2")  # disabled
partition_list = PartitionList(List=move_3.Geometry, Size=panel_4)  # disabled
duplicate_data = DuplicateData(Data=move_4.Geometry, Number=panel_4, Order=True)  # -> simplify(Data); disabled
list_item_2 = ListItem(List=partition_list, Index=0, Wrap=True)  # -> Item, Item1; disabled
graft_tree_5 = GraftTree(Tree=duplicate_data, IncludeEmptyLists=True, IncludeNullItems=True)  # disabled
merge_2 = Merge(Data1=list_item_2.Item, Data2=graft_tree_5, Data3=list_item_2.Item1)  # disabled
shift_list_2 = ShiftList(List=list_item, Shift=graft_tree_2, Wrap=True)  # -> simplify(List); disabled
panel_5 = Panel("2")  # disabled
nurbs_curve = NurbsCurve(Vertices=merge_2, Degree=panel_5, Periodic=False)  # -> Curve, Length, Domain; disabled
list_item_3 = ListItem(List=shift_list_2, Index=0, Wrap=True)  # -> Item, Item1, Item2, Item3; disabled
trim_tree = TrimTree(Tree=nurbs_curve.Curve, Depth=1)  # disabled
line = Line(StartPoint=list_item_3.Item, EndPoint=list_item_3.Item2)  # disabled
panel_6 = Panel("1")  # disabled
panel_7 = Panel("5")  # disabled
divide_curve = DivideCurve(Curve=line, Count=expr("X-1", panel_7), Kinks=False)  # -> Points, Tangents, Parameters; disabled
rebuild_curve = RebuildCurve(Curve=trim_tree, Degree=panel_6, Count=panel_7, Tangents=False)  # disabled
polyline = PolyLine(Vertices=divide_curve.Points, Closed=False)  # -> simplify(Polyline); disabled
list_item_4 = ListItem(List=rebuild_curve, Index=0, Wrap=True)  # -> Item, Item1; disabled
explode_2 = Explode(Curve=list_item_4.Item1, Recursive=True)  # -> Segments, Vertices; disabled
flip_curve = FlipCurve(Curve=list_item_4.Item1)  # -> Curve, Flag; disabled
explode_3 = Explode(Curve=list_item_4.Item, Recursive=True)  # -> Segments, Vertices; disabled
point_2 = Point(list_item_3.Item1)  # disabled
point_3 = Point(list_item_3.Item3)  # disabled
merge_3 = Merge(Data1=list_item_4.Item, Data2=polyline, Data3=flip_curve.Curve)  # disabled
extrude_point = ExtrudePoint(Base=explode_2.Segments, Point=point_3)  # -> simplify(Extrusion); disabled
loft_2 = Loft(Curves=merge_3, Options={Adjust=False, Closed=False, LoftEnds=0, LoftSimp=0, LoftType=3, Rebuild=10, Refit=0.01})  # disabled
extrude_point_2 = ExtrudePoint(Base=explode_3.Segments, Point=point_2)  # -> simplify(Extrusion); disabled
merge_4 = Merge(Data1=loft_2, Data2=extrude_point_2, Data3=extrude_point)  # disabled
number_slider_4 = Slider(0.97, range=0..1)  # disabled
number_slider_5 = Slider(2.52, range=0..10)  # disabled
brep_join = BrepJoin(Breps=merge_4)  # -> Breps, Closed; disabled
graft_tree_6 = GraftTree(Tree=evaluate_surface.Normal, IncludeEmptyLists=True, IncludeNullItems=True)  # disabled
point_4 = Point(simplify(graft_tree))  # disabled
scale = Scale(Geometry=brep_join.Breps, Center=point_4, Factor=number_slider_4)  # -> Geometry, Transform; disabled
amplitude_4 = Amplitude(Vector=graft_tree_6, Amplitude=number_slider_5)  # disabled
move_5 = Move(Geometry=scale.Geometry, Motion=amplitude_4)  # -> Geometry, Transform; disabled
deconstruct_brep = DeconstructBrep(Brep=move_5.Geometry)  # -> Faces, Edges, Vertices; disabled
simple_mesh = SimpleMesh(Brep=deconstruct_brep.Faces)  # -> simplify(Mesh); disabled

loft_3 = Loft(Curves=merge, Options={Adjust=False, Closed=False, LoftEnds=0, LoftSimp=0, LoftType=0, Rebuild=10, Refit=0.01})
uv_count = Panel("8")
divide_domain²_2 = DivideDomain²(Domain=loft_3, UCount=uv_count, VCount=uv_count)
isotrim_2 = Isotrim(Surface=loft_3, Domain=divide_domain²_2)
area = Area(Geometry=isotrim_2)  # -> Area, Centroid
curve_2 = Curve(isotrim_2)
graft_tree_7 = GraftTree(Tree=isotrim_2, IncludeEmptyLists=True, IncludeNullItems=True)
explode_4 = Explode(Curve=curve_2, Recursive=True)  # -> Segments, Vertices
brep = Brep(graft_tree_7)
circle_2 = Circle(Plane=area.Centroid, Radius=1)
construct_domain_2 = ConstructDomain(DomainStart="0", DomainEnd="3")
tree_statistics_2 = TreeStatistics(Tree=explode_4.Segments)  # -> Paths, Length, Count
removeduplicatepts_2 = RemoveDuplicatePts(Points=explode_4.Vertices, Tolerance=0.01)
seed = Panel("20")
curve_middle_4 = CurveMiddle(Curve=explode_4.Segments)
graft_tree_8 = GraftTree(Tree=circle_2, IncludeEmptyLists=True, IncludeNullItems=True)
random_2 = Random(Range=construct_domain_2, Number=tree_statistics_2.Count, Seed=seed)
sort_along_curve_2 = SortAlongCurve(Points=curve_middle_4, Curve=graft_tree_8)  # -> simplify(Points), Indices
round_2 = Round(Number=random_2)  # -> Nearest, Floor, Ceiling
list_item_5 = ListItem(List=removeduplicatepts_2, Index=sort_along_curve_2.Indices, Wrap=True)
graft_tree_9 = GraftTree(Tree=round_2.Floor, IncludeEmptyLists=True, IncludeNullItems=True)
shift_list_3 = ShiftList(List=list_item_5, Shift=graft_tree_9, Wrap=True)  # -> simplify(List)
shift_list_4 = ShiftList(List=sort_along_curve_2.Points, Shift=graft_tree_9, Wrap=True)  # -> simplify(List)
brep_closest_point_2 = BrepClosestPoint(Point=shift_list_4, Brep=brep)  # -> Point, simplify(Normal), Distance
list_item_6 = ListItem(List=shift_list_3, Index=0, Wrap=True)  # -> Item, Item1, Item2, Item3
# 对中点的操作
# 1.对初始中点排序
# 2.对中点的起始位进行随机偏移
# 3.分两组
brep_2 = Brep(brep)
line_2 = Line(StartPoint=list_item_6.Item, EndPoint=list_item_6.Item2)
partition_list_2 = PartitionList(List=shift_list_4, Size="2")
partition_list_3 = PartitionList(List=brep_closest_point_2.Normal, Size="2")
offset_distance = Slider(14.84, range=0..20)
curve_middle_5 = CurveMiddle(Curve=line_2)
offset_distance_2 = Slider(4.81, range=0..10)
amplitude_5 = Amplitude(Vector=partition_list_3, Amplitude=offset_distance)
brep_closest_point_3 = BrepClosestPoint(Point=curve_middle_5, Brep=brep_2)  # -> Point, simplify(Normal), Distance
amplitude_6 = Amplitude(Vector=brep_closest_point_3.Normal, Amplitude=offset_distance_2)
move_6 = Move(Geometry=partition_list_2, Motion=amplitude_5)  # -> Geometry, Transform
move_7 = Move(Geometry=curve_middle_5, Motion=amplitude_6)  # -> Geometry, Transform
merge_5 = Merge(Data1=list_item_6.Item, Data2=list_item_6.Item2)
duplicate_data_2 = DuplicateData(Data=move_7.Geometry, Number="2", Order=True)  # -> simplify(Data)
graft_tree_10 = GraftTree(Tree=duplicate_data_2, IncludeEmptyLists=True, IncludeNullItems=True)
insert_items = InsertItems(List=merge_5, Item=move_7.Geometry, Indices="1", Wrap=True)
insert_items_2 = InsertItems(List=move_6.Geometry, Item=graft_tree_10, Indices="1", Wrap=True)
nurbs_curve_2 = NurbsCurve(Vertices=insert_items_2, Degree="2", Periodic=False)  # -> Curve, Length, Domain
nurbs_curve_3 = NurbsCurve(Vertices=insert_items, Degree="2", Periodic=False)  # -> Curve, Length, Domain
divide_count = Panel("6")
divide_curve_2 = DivideCurve(Curve=nurbs_curve_2.Curve, Count=divide_count, Kinks=False)  # -> Points, Tangents, Parameters
divide_curve_3 = DivideCurve(Curve=nurbs_curve_3.Curve, Count=divide_count, Kinks=False)  # -> Points, Tangents, Parameters
polyline_2 = PolyLine(Vertices=divide_curve_2.Points, Closed=False)  # -> simplify(Polyline)
polyline_3 = PolyLine(Vertices=divide_curve_3.Points, Closed=False)  # -> simplify(Polyline)
trim_tree_2 = TrimTree(Tree=polyline_2, Depth=1)
point_5 = Point(list_item_6.Item1)
point_6 = Point(list_item_6.Item3)
list_item_7 = ListItem(List=trim_tree_2, Index=0, Wrap=True)  # -> Item, Item1
merge_6 = Merge(Data1=point_5, Data2=point_6)
flip_curve_2 = FlipCurve(Curve=list_item_7.Item1)  # -> Curve, Flag
explode_5 = Explode(Curve=polyline_2, Recursive=True)  # -> simplify(Segments), Vertices
graft_tree_11 = GraftTree(Tree=merge_6, IncludeEmptyLists=True, IncludeNullItems=True)
merge_7 = Merge(Data1=list_item_7.Item, Data2=polyline_3, Data3=flip_curve_2.Curve)
extrude_point_3 = ExtrudePoint(Base=explode_5.Segments, Point=graft_tree_11)
loft_4 = Loft(Curves=merge_7, Options={Adjust=False, Closed=False, LoftEnds=0, LoftSimp=0, LoftType=3, Rebuild=10, Refit=0.01})
deconstruct_brep_2 = DeconstructBrep(Brep=extrude_point_3)  # -> Faces, Edges, Vertices
deconstruct_brep_3 = DeconstructBrep(Brep=loft_4)  # -> Faces, Edges, Vertices
simple_mesh_2 = SimpleMesh(Brep=deconstruct_brep_2.Faces)
simple_mesh_3 = SimpleMesh(Brep=deconstruct_brep_3.Faces)  # -> simplify(Mesh)
trim_tree_3 = TrimTree(Tree=simple_mesh_2, Depth="2")
merge_8 = Merge(Data1=simple_mesh_3, Data2=trim_tree_3)
weaverbird_s_join_meshes_and_weld = WeaverbirdsJoinMeshesAndWeld(Mesh=merge_8, Weld=invert(False))
scale_factor = Slider(0.94, range=0..1)
area_2 = Area(Geometry=weaverbird_s_join_meshes_and_weld)  # -> Area, Centroid
thickness = Panel("10")
scale_2 = Scale(Geometry=weaverbird_s_join_meshes_and_weld, Center=area_2.Centroid, Factor=scale_factor)  # -> Geometry, Transform
negative = Negative(Value=thickness)
weaverbird_s_offset_mesh = WeaverbirdsOffsetMesh(MeshCurves=scale_2.Geometry, Distance=negative, OffsetType=0)
weaverbird_s_mesh_thicken = WeaverbirdsMeshThicken(MeshCurves=scale_2.Geometry, Distance=negative, OffsetType=0)
merge_9 = Merge(Data1=list_item_7.Item, Data2=list_item_7.Item1)
mesh_edges = MeshEdges(Mesh=weaverbird_s_offset_mesh)  # -> NakedEdges, InteriorEdges, NonManifoldEdges
mesh_edges_2 = MeshEdges(Mesh=scale_2.Geometry)  # -> NakedEdges, InteriorEdges, NonManifoldEdges

weaverbird_s_join_meshes_and_weld_2 = WeaverbirdsJoinMeshesAndWeld(Mesh=simple_mesh, Weld=invert(False))  # disabled
panel_8 = Panel("20")  # disabled
weaverbird_s_offset_mesh_2 = WeaverbirdsOffsetMesh(MeshCurves=weaverbird_s_join_meshes_and_weld_2, Distance=panel_8, OffsetType=0)  # disabled
curve_3 = Curve(rebuild_curve)  # disabled
explode_6 = Explode(Curve=curve_3, Recursive=True)  # -> simplify(Segments), Vertices; disabled
mesh_edges_3 = MeshEdges(Mesh=weaverbird_s_join_meshes_and_weld_2)  # -> NakedEdges, InteriorEdges, NonManifoldEdges; disabled
mesh_edges_4 = MeshEdges(Mesh=weaverbird_s_offset_mesh_2)  # -> NakedEdges, InteriorEdges, NonManifoldEdges; disabled
weaverbird_s_mesh_thicken_2 = WeaverbirdsMeshThicken(MeshCurves=weaverbird_s_join_meshes_and_weld_2, Distance=panel_8, OffsetType=0)  # disabled
trim_tree_4 = TrimTree(Tree=explode_6.Segments, Depth=1)  # disabled
curve_4 = Curve(simplify(mesh_edges_4.NakedEdges))  # disabled
curve_5 = Curve(simplify(mesh_edges_3.NakedEdges))  # disabled
join_curves = JoinCurves(Curves=curve_4, Preserve=False)  # disabled
join_curves_2 = JoinCurves(Curves=curve_5, Preserve=False)  # disabled
subd_from_mesh = SubDFromMesh(Mesh=weaverbird_s_mesh_thicken_2, Creases=2, Corners=1, Interpolate=False)  # -> flatten(SubD); disabled
discontinuity = Discontinuity(Curve=join_curves, Level=1)  # -> Points, Parameters; disabled
discontinuity_2 = Discontinuity(Curve=join_curves_2, Level=1)  # -> Points, Parameters; disabled
line_3 = Line(StartPoint=discontinuity.Points, EndPoint=discontinuity_2.Points)  # disabled
subd_edges = SubDEdges(SubD=subd_from_mesh, NewFormatting=False)  # -> simplify(Line), Edge, Tag, Id; disabled
dispatch = Dispatch(List=line_3, DispatchPattern=[True, False])  # -> ListA, ListB; disabled
curve_6 = Curve(simplify(dispatch.ListB))  # disabled
merge_10 = Merge(Data1=curve_5, Data2=trim_tree_4, Data3=curve_4, Data4=curve_6)  # disabled
curve_middle_6 = CurveMiddle(Curve=merge_10)  # disabled
list_length = ListLength(List=curve_middle_6)  # disabled
tree_statistics_3 = TreeStatistics(Tree=subd_edges.Line)  # -> Paths, Length, Count; disabled
duplicate_data_3 = DuplicateData(Data=subd_edges.Line, Number=list_length, Order=True)  # disabled
partition_list_4 = PartitionList(List=duplicate_data_3, Size=tree_statistics_3.Length)  # disabled
graft_tree_12 = GraftTree(Tree=curve_middle_6, IncludeEmptyLists=True, IncludeNullItems=True)  # disabled
curve_closest_point = CurveClosestPoint(Point=graft_tree_12, Curve=partition_list_4)  # -> Point, Parameter, Distance; disabled
sort_list = SortList(Keys=curve_closest_point.Distance, ValuesValuesA=subd_edges.Id)  # -> Keys, ValuesValuesA; disabled
list_item_8 = ListItem(List=sort_list.ValuesValuesA, Index=0, Wrap=True)  # disabled
trim_tree_5 = TrimTree(Tree=list_item_8, Depth=1)  # disabled
panel_9 = Panel("crease")  # disabled
subd_edge_tags = SubDEdgeTags(SubD=graft(subd_from_mesh), EdgeTag=panel_9, EdgeIDs=trim_tree_5)  # disabled

explode_7 = Explode(Curve=merge_9, Recursive=True)  # -> Segments, Vertices
curve_7 = Curve(simplify(mesh_edges.NakedEdges))
curve_8 = Curve(simplify(mesh_edges_2.NakedEdges))
join_curves_3 = JoinCurves(Curves=curve_8, Preserve=False)
join_curves_4 = JoinCurves(Curves=curve_7, Preserve=False)
discontinuity_3 = Discontinuity(Curve=join_curves_4, Level=1)  # -> Points, Parameters
discontinuity_4 = Discontinuity(Curve=join_curves_3, Level=1)  # -> Points, Parameters
line_4 = Line(StartPoint=discontinuity_4.Points, EndPoint=discontinuity_3.Points)
dispatch_2 = Dispatch(List=line_4, DispatchPattern=[True, False])  # -> ListA, ListB
trim_tree_6 = TrimTree(Tree=explode_7.Segments, Depth=1)  # -> simplify(Tree)
curve_9 = Curve(simplify(dispatch_2.ListB))
subd_from_mesh_2 = SubDFromMesh(Mesh=weaverbird_s_mesh_thicken, Creases=1, Corners=1, Interpolate=False)  # -> simplify(SubD)
subd_edges_2 = SubDEdges(SubD=subd_from_mesh_2, NewFormatting=False)  # -> Line, Edge, Tag, Id
merge_11 = Merge(Data1=trim_tree_6, Data2=curve_8, Data3=curve_9, Data4=curve_7)
curve_10 = Curve(subd_edges_2.Line)
curve_middle_7 = CurveMiddle(Curve=merge_11)
curve_middle_8 = CurveMiddle(Curve=curve_10)  # -> simplify(Midpoint)
tree_statistics_4 = TreeStatistics(Tree=curve_middle_7)  # -> Paths, graft(Length), Count
tree_statistics_5 = TreeStatistics(Tree=curve_middle_8)  # -> Paths, graft(Length), Count
graft_tree_13 = GraftTree(Tree=curve_middle_7, IncludeEmptyLists=True, IncludeNullItems=True)
duplicate_data_4 = DuplicateData(Data=curve_middle_8, Number=tree_statistics_4.Length, Order=True)  # -> simplify(Data)
duplicate_data_5 = DuplicateData(Data=subd_edges_2.Id, Number=tree_statistics_4.Length, Order=True)  # -> simplify(Data)
partition_list_5 = PartitionList(List=duplicate_data_4, Size=tree_statistics_5.Length)  # -> simplify(Chunks)
distance = Distance(PointA=graft_tree_13, PointB=partition_list_5)
partition_list_6 = PartitionList(List=duplicate_data_5, Size=tree_statistics_5.Length)  # -> simplify(Chunks)
sort_list_2 = SortList(Keys=distance, ValuesValuesA=partition_list_6)  # -> Keys, ValuesValuesA
list_item_9 = ListItem(List=sort_list_2.ValuesValuesA, Index=0, Wrap=True)
trim_tree_7 = TrimTree(Tree=list_item_9, Depth=1)
subd_edge_tags_2 = SubDEdgeTags(SubD=subd_from_mesh_2, EdgeTag="creases", EdgeIDs=trim_tree_7)
