# Grasshopper definition #2_Weave_pot.gh (Grasshopper 1.0.7)
# plug-ins: Bifocals, NGon

layers = Panel("25")
layer_height = Panel("2")
radius = Panel("25")
cir = Circle(Plane=PlaneXY(0, 0, 0), Radius=radius)
series = Series(Start=0, Step=layer_height, Count=layers)
Z = UnitZ(Factor=series)
move = Move(Geometry=cir, Motion=Z)  # -> Geometry, Transform
graph = GraphMapper(
    series,
    x0=0,
    x1=48,
    y0=0.5,
    y1=1.2,
    container_name="Bezier2",
    pt=[Point(0, 0.5293322206, 0), Point(0.3759726584, 0.2691847086, 0), Point(0.3413035274, 0.3148247004, 0), Point(0.5854701996, 0.6583322287, 0), Point(0.7592775266, 0.902854238, 0), Point(0.908616066, 0.901297152, 0), Point(1, 0.5110760331, 0)])
area = Area(Geometry=move.Geometry)  # -> Area, Centroid
scale = Scale(Geometry=move.Geometry, Center=area.Centroid, Factor=graph)  # -> Geometry, Transform
number_slider = Slider(35, range=10..60)
divide = DivideCurve(Curve=scale.Geometry, Count=number_slider, Kinks=False)  # -> Points, Tangents, Parameters
flip = FlipMatrix(Data=divide.Points)
tstat = TreeStatistics(Tree=flip)  # -> Paths, Length, Count
tstat_2 = TreeStatistics(Tree=divide.Points)  # -> Paths, Length, Count
dispatch = Dispatch(List=tstat.Paths, DispatchPattern=[True, False])  # -> ListA, ListB
dispatch_2 = Dispatch(List=tstat_2.Paths, DispatchPattern=[True, False])  # -> ListA, ListB
loft = Loft(Curves=scale.Geometry, Options={Adjust=False, Closed=False, LoftEnds=0, LoftSimp=0, LoftType=0, Rebuild=10, Refit=0.01})
division = Division(A=number_slider, B=2)
branch = TreeBranch(Tree=divide.Points, Path=dispatch_2.ListB, MaintainPaths=True)
branch_2 = TreeBranch(Tree=divide.Points, Path=dispatch_2.ListA, MaintainPaths=True)
panel = Panel("""1
-1""")
branch_3 = TreeBranch(Tree=flip, Path=dispatch.ListA, MaintainPaths=True)
branch_4 = TreeBranch(Tree=flip, Path=dispatch.ListB, MaintainPaths=True)
dup = DuplicateData(Data=panel, Number=division, Order=True)
brep_cp = BrepClosestPoint(Point=branch_2, Brep=loft)  # -> Point, Normal, Distance
brep_cp_2 = BrepClosestPoint(Point=branch, Brep=loft)  # -> Point, Normal, Distance
devec = DeconstructVector(Vector=brep_cp.Normal)  # -> XComponent, YComponent, ZComponent
devec_2 = DeconstructVector(Vector=brep_cp_2.Normal)  # -> XComponent, YComponent, ZComponent
number_slider_2 = Slider(1.118, range=0.1..2)
vec = VectorXYZ(XComponent=devec.XComponent, YComponent=devec.YComponent, ZComponent=0)  # -> Vector, Length
vec_2 = VectorXYZ(XComponent=devec_2.XComponent, YComponent=devec_2.YComponent, ZComponent=0)  # -> Vector, Length
multiplication = Multiplication(A=dup, B=number_slider_2)
multiplication_2 = Multiplication(A=dup, B=number_slider_2, C="-1")
amp = Amplitude(Vector=vec.Vector, Amplitude=multiplication)
amp_2 = Amplitude(Vector=vec_2.Vector, Amplitude=multiplication_2)
toggle = BooleanToggle(True)
move_2 = Move(Geometry=brep_cp.Point, Motion=amp)  # -> Geometry, Transform
move_3 = Move(Geometry=brep_cp_2.Point, Motion=amp_2)  # -> Geometry, Transform
intcrv = Interpolate(Vertices=move_2.Geometry, Degree=3, Periodic=toggle, KnotStyle=1)  # -> Curve, Length, Domain
intcrv_2 = Interpolate(Vertices=move_3.Geometry, Degree=3, Periodic=toggle, KnotStyle=1)  # -> Curve, Length, Domain
intcrv_3 = Interpolate(Vertices=branch_4, Degree=3, Periodic=False, KnotStyle=1)  # -> Curve, Length, Domain
intcrv_4 = Interpolate(Vertices=branch_3, Degree=3, Periodic=False, KnotStyle=1)  # -> Curve, Length, Domain
meshpipe = MeshPipe(Curve=[intcrv_4.Curve, intcrv_3.Curve], Radius="0.65", Sides="10", Tolerance="1", Ending=0)  # -> flatten(Mesh)
meshpipe_2 = MeshPipe(Curve=[intcrv.Curve, intcrv_2.Curve], Radius="0.65", Sides="10", Tolerance="1", Ending=0)  # -> flatten(Mesh)
lng = ListLength(List=meshpipe)
lng_2 = ListLength(List=meshpipe_2)
series_2 = Series(Start=0, Step=1, Count=lng)
series_3 = Series(Start=0, Step=1, Count=lng_2)
item = ListItem(List=series_3, Index=0, Wrap=True)  # -> Item1, Item
item_2 = ListItem(List=series_2, Index=0, Wrap=True)  # -> Item1, Item
gradient = Gradient(
    LowerLimit=item_2.Item,
    UpperLimit=item_2.Item1,
    Parameter=series_2,
    stops=[0: RGB(217, 240, 212), 0.162: RGB(169, 220, 223), 0.323: RGB(238, 191, 111), 0.497: RGB(238, 110, 104), 0.663: RGB(238, 191, 111), 0.844: RGB(169, 220, 223), 1: RGB(217, 240, 212)])
gradient_2 = Gradient(
    LowerLimit=item.Item,
    UpperLimit=item.Item1,
    Parameter=series_3,
    stops=[0: RGB(192, 192, 255), 0.502: RGB(255, 192, 192), 1: RGB(192, 192, 255)])
gradient_3 = Gradient(
    LowerLimit=item_2.Item,
    UpperLimit=item_2.Item1,
    Parameter=series_2,
    stops=[0: RGB(192, 192, 255), 0.502: RGB(255, 192, 192), 1: RGB(192, 192, 255)])
gradient_4 = Gradient(
    LowerLimit=item.Item,
    UpperLimit=item.Item1,
    Parameter=series_3,
    stops=[0: RGB(217, 240, 212), 0.162: RGB(169, 220, 223), 0.323: RGB(238, 191, 111), 0.497: RGB(238, 110, 104), 0.663: RGB(238, 191, 111), 0.844: RGB(169, 220, 223), 1: RGB(217, 240, 212)])
mcol = MeshColours(Mesh=graft(meshpipe), Colours=graft(gradient))
mcol_2 = MeshColours(Mesh=graft(meshpipe_2), Colours=graft(gradient_4))
merge = Merge(Data1=mcol_2, Data2=mcol)
