# Grasshopper definition #30_Heat_method_wave.gh (Grasshopper 1.0.7)
# plug-ins: Weaverbird

panel = Panel("300")  # disabled
panel_2 = Panel("100")  # disabled
panel_3 = Panel("200")  # disabled
panel_4 = Panel("-8")  # disabled
rectangle = Rectangle(Plane=PlaneXY(0, 0, 0), XSize=panel_3, YSize=panel_2, Radius=0)  # -> Rectangle, Length; disabled
unit_z = UnitZ(Factor=panel_4)  # disabled
offset_curve = OffsetCurve(Curve=rectangle.Rectangle, Distance=panel_4, Corners=1)  # disabled
reverse = Reverse(Vector=unit_z)  # disabled
move = Move(Geometry=offset_curve, Motion=reverse)  # -> Geometry, Transform; disabled
box_rectangle = BoxRectangle(Rectangle=rectangle.Rectangle, Height=panel)  # disabled
box_rectangle_2 = BoxRectangle(Rectangle=move.Geometry, Height=panel)  # disabled
panel_5 = Panel("20")  # disabled
panel_6 = Panel("40")  # disabled
panel_7 = Panel("60")  # disabled
mesh_box = MeshBox(Base=box_rectangle, XCount=panel_6, YCount=panel_5, ZCount=panel_7)  # disabled
mesh_box_2 = MeshBox(Base=box_rectangle_2, XCount=panel_6, YCount=panel_5, ZCount=panel_7)  # disabled
weaverbird_s_join_meshes_and_weld = WeaverbirdsJoinMeshesAndWeld(Mesh=mesh_box, Weld=invert(False))  # disabled
weaverbird_s_join_meshes_and_weld_2 = WeaverbirdsJoinMeshesAndWeld(Mesh=mesh_box_2, Weld=invert(False))  # disabled
mesh_difference = MeshDifference(MeshesA=weaverbird_s_join_meshes_and_weld, MeshesB=weaverbird_s_join_meshes_and_weld_2)  # disabled
weaverbird_s_join_meshes_and_weld_3 = WeaverbirdsJoinMeshesAndWeld(Mesh=mesh_difference, Weld=invert(False))  # disabled
unify_mesh = UnifyMesh(Mesh=weaverbird_s_join_meshes_and_weld_3)  # -> Result, Count; disabled
area = Area(Geometry=unify_mesh.Result)  # -> Area, Centroid; disabled
deconstruct_mesh = DeconstructMesh(Mesh=unify_mesh.Result)  # -> Vertices, Faces, Colours, Normals; disabled
point = Point([Point(235.1108876, 121.0207842, 195.8577667), Point(2.725631739, 120.9425019, 48.09833933)])  # disabled
line = Line(StartPoint=deconstruct_mesh.Vertices, EndPoint=area.Centroid)  # disabled
closest_point = ClosestPoint(Point=point, Cloud=deconstruct_mesh.Vertices)  # -> ClosestPoint, simplify(CPIndex), Distance; disabled
dot_product = DotProduct(VectorA=line, VectorB=deconstruct_mesh.Normals, Unitize=invert(False))  # disabled
panel_8 = Panel("0")  # disabled
smaller_than = SmallerThan(FirstNumber=dot_product, SecondNumber=panel_8)  # -> SmallerThan, OrEqualTo; disabled
panel_9 = Panel("10")  # disabled
panel_10 = Panel("80")  # disabled
bounds = Bounds()  # disabled
construct_domain = ConstructDomain(DomainStart=panel_10, DomainEnd=panel_9)  # disabled
bounds_2 = Bounds()  # disabled
dispatch = Dispatch(List=deconstruct_mesh.Vertices, DispatchPattern=smaller_than.OrEqualTo)  # -> ListA, ListB; disabled
number_slider = Slider(1, range=0..1)  # disabled
remap_numbers = RemapNumbers(Source=bounds, Target=Domain(0, 1))  # -> Mapped, Clipped; disabled
remap_numbers_2 = RemapNumbers(Source=bounds_2, Target=construct_domain)  # -> Mapped, Clipped; disabled
panel_11 = Panel("8")  # disabled
graph_mapper = GraphMapper(
    remap_numbers_2.Mapped,
    x0=10,
    x1=80,
    y0=10,
    y1=80,
    container_name="Bezier",
    cpx=[0, 0.2143312097, 0.796158731, 1],
    cpy=[0, 0.1188109517, 0.7628030777, 1])  # disabled
pi = Pi(Factor=1)  # disabled
flip_matrix = FlipMatrix(Data=remap_numbers.Mapped)  # disabled
multiplication = Multiplication(A=number_slider, B=panel_11)  # disabled
flip_matrix_2 = FlipMatrix(Data=graph_mapper)  # disabled
pi_2 = Pi(Factor=multiplication)  # disabled
sine = Sine(Value=pi_2)  # disabled
multiplication_2 = Multiplication(A=flip_matrix_2, B=flip_matrix, C=pi)  # disabled
addition = Addition(A=multiplication_2, B=sine)  # disabled
sine_2 = Sine(Value=addition)  # disabled
point_2 = Point(dispatch.ListA)  # disabled
deconstruct = Deconstruct(Point=point_2)  # -> XComponent, YComponent, ZComponent; disabled
create_set = CreateSet(List=deconstruct.ZComponent)  # -> Set, Map; disabled
mass_addition = MassAddition(Input=sine_2)  # -> flatten(Result), PartialResults; disabled
mass_addition_2 = MassAddition(Input=flip_matrix_2)  # -> flatten(Result), PartialResults; disabled
sort_list = SortList(Keys=create_set.Set)  # -> Keys, ValuesValuesA; disabled
member_index = MemberIndex(Set=deconstruct.ZComponent, Member=sort_list.Keys)  # -> simplify(Index), Count; disabled
tree_statistics = TreeStatistics(Tree=member_index.Index)  # -> Paths, Length, Count; disabled
multiplication_3 = Multiplication(A=mass_addition_2.Result, B=mass_addition.Result)  # disabled
panel_12 = Panel("""0
-1""")  # disabled
cull_index = CullIndex(List=tree_statistics.Paths, Indices=panel_12, Wrap=True)  # disabled
point_3 = Point(deconstruct_mesh.Vertices)  # disabled
tree_branch = TreeBranch(Tree=member_index.Index, Path=cull_index, MaintainPaths=True)  # -> flatten(Branch); disabled
list_length = ListLength(List=point_3)  # disabled
list_item = ListItem(List=point_2, Index=tree_branch, Wrap=True)  # disabled
panel_13 = Panel("0")  # disabled
bounds_3 = Bounds(Numbers=multiplication_3)  # disabled
duplicate_data = DuplicateData(Data=panel_13, Number=list_length, Order=True)  # disabled
item_index = ItemIndex(List=point_3, Item=list_item)  # disabled
panel_14 = Panel("1")  # disabled
panel_15 = Panel("2")  # disabled
number_slider_2 = Slider(10, range=0..10)  # disabled
construct_domain_2 = ConstructDomain(DomainStart=0, DomainEnd=panel_15)  # disabled
replace_items = ReplaceItems(List=duplicate_data, Item=panel_14, Indices=item_index, Wrap=False)  # disabled
remap_numbers_3 = RemapNumbers(Value=multiplication_3, Source=bounds_3, Target=construct_domain_2)  # -> Mapped, Clipped; disabled
multiplication_4 = Multiplication(A=remap_numbers_3.Mapped, B=sine)  # disabled
multiplication_5 = Multiplication(A=remap_numbers_3.Mapped, B=replace_items, C=number_slider_2)  # disabled
amplitude = Amplitude(Vector=deconstruct_mesh.Normals, Amplitude=multiplication_5)  # disabled
move_2 = Move(Geometry=point_3, Motion=amplitude)  # -> Geometry, Transform; disabled
construct_mesh = ConstructMesh(Vertices=move_2.Geometry, Faces=deconstruct_mesh.Faces)  # disabled
panel_16 = Panel("2")  # disabled
weaverbird_s_catmull_clark_subdivision = WeaverbirdsCatmullClarkSubdivision(MeshCurves=construct_mesh, Level=panel_16, SmoothNakedEdges=1)  # disabled
colour_swatch = ColourSwatch(SwatchColor=RGB(183, 255, 220))  # disabled
custom_preview = CustomPreview(Geometry=weaverbird_s_catmull_clark_subdivision, Material=colour_swatch)  # disabled

rectangle_2 = Rectangle(Plane=PlaneXY(0, 0, 0), XSize="200", YSize="100", Radius=0)  # -> Rectangle, Length
unit_z_2 = UnitZ(Factor="-8")
offset_curve_2 = OffsetCurve(Curve=rectangle_2.Rectangle, Distance="-8", Corners=1)
reverse_2 = Reverse(Vector=unit_z_2)
move_3 = Move(Geometry=offset_curve_2, Motion=reverse_2)  # -> Geometry, Transform
box_rectangle_3 = BoxRectangle(Rectangle=rectangle_2.Rectangle, Height="300")
box_rectangle_4 = BoxRectangle(Rectangle=move_3.Geometry, Height="300")
mesh_box_3 = MeshBox(Base=box_rectangle_3, XCount="40", YCount="20", ZCount="60")
mesh_box_4 = MeshBox(Base=box_rectangle_4, XCount="40", YCount="20", ZCount="60")
weaverbird_s_join_meshes_and_weld_4 = WeaverbirdsJoinMeshesAndWeld(Mesh=mesh_box_3, Weld=invert(False))
weaverbird_s_join_meshes_and_weld_5 = WeaverbirdsJoinMeshesAndWeld(Mesh=mesh_box_4, Weld=invert(False))
mesh_difference_2 = MeshDifference(MeshesA=weaverbird_s_join_meshes_and_weld_4, MeshesB=weaverbird_s_join_meshes_and_weld_5)
weaverbird_s_join_meshes_and_weld_6 = WeaverbirdsJoinMeshesAndWeld(Mesh=mesh_difference_2, Weld=invert(False))

deconstruct_mesh_2 = DeconstructMesh(Mesh=weaverbird_s_join_meshes_and_weld_6)  # -> Vertices, Faces, Colours, Normals
point_4 = Point([Point(118.2848458, 121.0207842, 195.8577667), Point(43.21100661, 120.9425019, 60.17559441)])
closest_point_2 = ClosestPoint(Point=point_4, Cloud=deconstruct_mesh_2.Vertices)  # -> ClosestPoint, simplify(CPIndex), Distance

area_2 = Area(Geometry=weaverbird_s_join_meshes_and_weld_6)  # -> Area, Centroid
line_2 = Line(StartPoint=deconstruct_mesh_2.Vertices, EndPoint=area_2.Centroid)
dot_product_2 = DotProduct(VectorA=line_2, VectorB=deconstruct_mesh_2.Normals, Unitize=invert(False))
smaller_than_2 = SmallerThan(FirstNumber=dot_product_2, SecondNumber="0")  # -> SmallerThan, OrEqualTo
dispatch_2 = Dispatch(List=deconstruct_mesh_2.Vertices, DispatchPattern=smaller_than_2.OrEqualTo)  # -> ListA, ListB
point_5 = Point(dispatch_2.ListA)
deconstruct_2 = Deconstruct(Point=point_5)  # -> XComponent, YComponent, ZComponent
create_set_2 = CreateSet(List=deconstruct_2.ZComponent)  # -> Set, Map
sort_list_2 = SortList(Keys=create_set_2.Set)  # -> Keys, ValuesValuesA
member_index_2 = MemberIndex(Set=deconstruct_2.ZComponent, Member=sort_list_2.Keys)  # -> simplify(Index), Count
tree_statistics_2 = TreeStatistics(Tree=member_index_2.Index)  # -> Paths, Length, Count
panel_17 = Panel("""0
-1""")
cull_index_2 = CullIndex(List=tree_statistics_2.Paths, Indices=panel_17, Wrap=True)
tree_branch_2 = TreeBranch(Tree=member_index_2.Index, Path=cull_index_2, MaintainPaths=True)  # -> flatten(Branch)
list_item_2 = ListItem(List=point_5, Index=tree_branch_2, Wrap=True)
point_6 = Point(deconstruct_mesh_2.Vertices)
item_index_2 = ItemIndex(List=point_6, Item=list_item_2)
list_length_2 = ListLength(List=point_6)
duplicate_data_2 = DuplicateData(Data="0", Number=list_length_2, Order=True)
replace_items_2 = ReplaceItems(List=duplicate_data_2, Item="1", Indices=item_index_2, Wrap=False)

data = Data()
construct_domain_3 = ConstructDomain(DomainStart=0, DomainEnd="8")
bounds_4 = Bounds(Numbers=data)
construct_domain_4 = ConstructDomain(DomainStart="10", DomainEnd="0")
construct_domain_5 = ConstructDomain(DomainStart="1", DomainEnd="0")
bounds_5 = Bounds(Numbers=data)
bounds_6 = Bounds(Numbers=data)
remap_numbers_4 = RemapNumbers(Value=data, Source=bounds_4, Target=construct_domain_3)  # -> Mapped, Clipped
remap_numbers_5 = RemapNumbers(Value=data, Source=bounds_5, Target=construct_domain_4)  # -> Mapped, Clipped
remap_numbers_6 = RemapNumbers(Value=data, Source=bounds_6, Target=construct_domain_5)  # -> Mapped, Clipped
pi_3 = Pi(Factor=1)
multiplication_6 = Multiplication(A=remap_numbers_5.Mapped, B=remap_numbers_4.Mapped, C=pi_3)
graph_mapper_2 = GraphMapper(
    remap_numbers_6.Mapped,
    x0=0,
    x1=1,
    y0=0,
    y1=1,
    container_name="Bezier2",
    pt=[Point(0, 0, 0), Point(0.3987913132, 0, 0), Point(0.4175807089, 0.1278417689, 0), Point(0.6444410086, 0.3241435885, 0), Point(0.881444931, 0.5292226672, 0), Point(0.7263236642, 1, 0), Point(1, 1, 0)])
flip_matrix_3 = FlipMatrix(Data=multiplication_6)
flip_matrix_4 = FlipMatrix(Data=graph_mapper_2)
sine_3 = Sine(Value=flip_matrix_3)
multiplication_7 = Multiplication(A=flip_matrix_4, B=sine_3)
mass_addition_3 = MassAddition(Input=multiplication_7)  # -> flatten(Result), PartialResults
multiplication_8 = Multiplication(A=mass_addition_3.Result, B=replace_items_2, C=Slider(9.01, range=0..10))
amplitude_2 = Amplitude(Vector=deconstruct_mesh_2.Normals, Amplitude=multiplication_8)
move_4 = Move(Geometry=point_6, Motion=amplitude_2)  # -> Geometry, Transform
construct_mesh_2 = ConstructMesh(Vertices=move_4.Geometry, Faces=deconstruct_mesh_2.Faces)
weaverbird_s_catmull_clark_subdivision_2 = WeaverbirdsCatmullClarkSubdivision(MeshCurves=construct_mesh_2, Level=1, SmoothNakedEdges=1)
