# Grasshopper definition #31_Origami_texture.gh (Grasshopper 1.0.7)
# plug-ins: Bifocals, Kangaroo2 Components, Noise, Weaverbird

high = Panel("50")
series = Series(Start=0, Step=1, Count="20")
construct_domain = ConstructDomain(DomainStart=0, DomainEnd=high)
bounds = Bounds(Numbers=series)
remap_numbers = RemapNumbers(Value=series, Source=bounds, Target=Domain(0, 1))  # -> Mapped, Clipped
remap_numbers_2 = RemapNumbers(Value=series, Source=bounds, Target=construct_domain)  # -> Mapped, Clipped
graph_mapper = GraphMapper(
    remap_numbers.Mapped,
    x0=0,
    x1=1,
    y0=0,
    y1=1,
    container_name="Polyline",
    pt=[Point(0, 0.6320605278, 0), Point(0.2993447185, 0.6825165749, 0), Point(0.6010587215, 0.8720752001, 0), Point(0.8307424188, 0.9513161778, 0), Point(1, 1, 0)])
unit_z = UnitZ(Factor=remap_numbers_2.Mapped)
geometry_radius = Panel("200")
multiplication = Multiplication(A=graph_mapper, B=geometry_radius)
circle = Circle(Plane=PlaneXY(0, 0, 0), Radius=multiplication)
move = Move(Geometry=circle, Motion=unit_z)  # -> Geometry, Transform
list_item = ListItem(List=circle, Index=0, Wrap=True)
loft = Loft(Curves=move.Geometry, Options={Adjust=False, Closed=False, LoftEnds=0, LoftSimp=0, LoftType=0, Rebuild=10, Refit=0.01})
boundary_surfaces = BoundarySurfaces(Edges=list_item)
brep_join = BrepJoin(Breps=[boundary_surfaces, loft])  # -> Breps, Closed
brep = Brep(brep_join.Breps)
brep_2 = Brep(brep)
settings_custom = SettingsCustom(
    StitchSeams=True,
    SimplePlanes=False,
    Refine=True,
    MinCount=16,
    MaxCount=400,
    AspectRatio=20,
    MaxDistance="1",
    MaxAngle=20,
    MinEdge=0,
    MaxEdge=0)
populate_geometry = PopulateGeometry(Geometry=brep_2, Count=100, Seed=1)
mesh_brep = MeshBrep(Brep=brep_2, Settings=settings_custom)
random_reduce = RandomReduce(List=populate_geometry, Reduction="35", Seed=1)
triremesh = TriRemesh(Geometry=mesh_brep, Length="5", Iterations=25)  # -> Triangulation, Dual, Creases
deconstruct_mesh = DeconstructMesh(Mesh=triremesh.Triangulation)  # -> Vertices, Faces, Colours, Normals
worleynoise = WorleyNoise(Points=deconstruct_mesh.Vertices, Centers=random_reduce, DistanceMetric=0, Seed=0)  # -> F1, F2, F3, F4
deconstruct = Deconstruct(Point=deconstruct_mesh.Vertices)  # -> XComponent, YComponent, ZComponent
subtraction = Subtraction(A=worleynoise.F2, B=worleynoise.F1)
bounds_2 = Bounds(Numbers=deconstruct.ZComponent)
bounds_3 = Bounds(Numbers=subtraction)
remap_numbers_3 = RemapNumbers(Value=deconstruct.ZComponent, Source=bounds_2, Target=Domain(0, 1))  # -> Mapped, Clipped
remap_numbers_4 = RemapNumbers(Value=subtraction, Source=bounds_3, Target=Domain(0, 1))  # -> Mapped, Clipped
vector = Vector(deconstruct_mesh.Normals)
data = Data(deconstruct_mesh.Faces)
point = Point(deconstruct_mesh.Vertices)
number = Number(remap_numbers_4.Mapped)
number_2 = Number(remap_numbers_3.Mapped)
vector_2 = Vector(vector)
number_3 = Number(number)
point_2 = Point(point)
data_2 = Data(data)
number_4 = Number(number_2)
unit_z_2 = UnitZ(Factor=1)
graph_mapper_2 = GraphMapper(
    number_3,
    x0=0,
    x1=1,
    y0=0,
    y1=1,
    container_name="Polyline",
    pt=[Point(0, 1, 0), Point(0.06033489481, 1, 0), Point(0.1651238501, 0.005041122437, 0), Point(0.4831045866, 0, 0), Point(1, 0, 0)])
graph_mapper_3 = GraphMapper(
    number_4,
    x0=0,
    x1=1,
    y0=0,
    y1=1,
    container_name="Polyline",
    pt=[Point(0, 0, 0), Point(0.1231565624, 0, 0), Point(0.3510052264, 0.7176427841, 0), Point(0.6660793424, 0.9721927643, 0), Point(1, 1, 0)])
cross_product = CrossProduct(VectorA=vector_2, VectorB=unit_z_2, Unitize=False)  # -> Vector, Length
perlinnoise = PerlinNoise(
    Points=point_2,
    Seed=0,
    Amplitude=1,
    SmoothStep=0,
    FrequecyX="7.8",
    FrequecyY="7.8",
    FrequecyZ="7.8",
    Jitter=0,
    AlignVector=Vector(1, 0, 0))
multiplication_2 = Multiplication(A=graph_mapper_3, B=graph_mapper_2)
multiplication_3 = Multiplication(A=perlinnoise, B=Slider(2, range=0..10))
rotate = Rotate(Geometry=cross_product.Vector, Angle=multiplication_3, Plane=PlaneXY(0, 0, 0))  # -> Geometry, Transform
multiplication_4 = Multiplication(A=multiplication_2, B=Slider(8.57, range=0..10))
multiplication_5 = Multiplication(A=multiplication_2, B=perlinnoise, C=Slider(3.54, range=0..10))
amplitude = Amplitude(Vector=vector_2, Amplitude=multiplication_5)
amplitude_2 = Amplitude(Vector=rotate.Geometry, Amplitude=multiplication_4)
vector_3 = Vector(amplitude_2)
data_3 = Data(data_2)
vector_4 = Vector(amplitude)
point_3 = Point(point_2)
vector_5 = Vector(vector_3)
point_4 = Point(point_3)
data_4 = Data(data_3)
vector_6 = Vector(vector_4)
move_2 = Move(Geometry=point_4, Motion=vector_5)  # -> Geometry, Transform
move_3 = Move(Geometry=point_4, Motion=vector_6)  # -> Geometry, Transform
graft_tree = GraftTree(Tree=move_2.Transform, IncludeEmptyLists=True, IncludeNullItems=True)  # -> simplify(Tree)
graft_tree_2 = GraftTree(Tree=move_3.Transform, IncludeEmptyLists=True, IncludeNullItems=True)  # -> simplify(Tree)
merge = Merge(Data1=graft_tree_2, Data2=graft_tree)
compound = Compound(Transforms=merge)
transform = Transform(Geometry=graft(point_4), Transform=compound)  # -> flatten(Geometry)
construct_mesh = ConstructMesh(Vertices=transform, Faces=data_4)
weaverbird_s_mesh_thicken = WeaverbirdsMeshThicken(MeshCurves=construct_mesh, Distance="1", OffsetType=0)
