# Grasshopper definition #32_Random_gradient_texture.gh (Grasshopper 1.0.7)
# plug-ins: LunchBox, Weaverbird

rectangle = Rectangle(Plane=PlaneXY(0, 0, 0), XSize="120", YSize="200", Radius=0)  # -> Rectangle, Length
division = Division(A="200", B="8")
multiplication = Multiplication(A=division, B="1.155")
hexagon_cells = HexagonCells(Surface=rectangle.Rectangle, UDivisions=division, VDivisions=multiplication, TParameter=0.25)  # -> HexagonCells, Centers
length = Length(Curve=hexagon_cells.HexagonCells)
create_set = CreateSet(List=length)  # -> Set, Map
range = Slider(0.715, range=0..1)
range_2 = Slider(0.295, range=0..1)
sort_list = SortList(Keys=create_set.Set)  # -> Keys, ValuesValuesA
list_item = ListItem(List=sort_list.Keys, Index="-1", Wrap=True)
member_index = MemberIndex(Set=length, Member=list_item)  # -> Index, Count
negative = Negative(Value=range)
construct_domain = ConstructDomain(DomainStart=negative, DomainEnd=range_2)
list_item_2 = ListItem(List=hexagon_cells.HexagonCells, Index=member_index.Index, Wrap=True)
list_item_3 = ListItem(List=hexagon_cells.Centers, Index=member_index.Index, Wrap=True)
deconstruct = Deconstruct(Point=list_item_3)  # -> XComponent, YComponent, ZComponent
seed = Slider(6, range=0..100)
construct_domain_2 = ConstructDomain(DomainStart="0", DomainEnd="4")
list_length = ListLength(List=deconstruct.YComponent)
bounds = Bounds(Numbers=deconstruct.YComponent)
random = Random(Range=construct_domain, Number=list_length, Seed=seed)
remap_numbers = RemapNumbers(Value=deconstruct.YComponent, Source=bounds, Target=construct_domain_2)  # -> Mapped, Clipped
graph_mapper = GraphMapper(
    remap_numbers.Mapped,
    x0=0,
    x1=4,
    y0=0,
    y1=4,
    container_name="Polyline",
    pt=[Point(0, 0.1565260291, 0), Point(0.2663437724, 0.3028819561, 0), Point(0.5912727118, 0.5933437347, 0), Point(0.75584656, 0.8185074329, 0), Point(1, 0.8545340896, 0)])
addition = Addition(A=random, B=graph_mapper)
number = Number(addition)
point = Point(list_item_3)
domain = Domain(construct_domain_2)
curve = Curve(list_item_2)
domain_2 = Domain(domain)
curve_2 = Curve(curve)
number_2 = Number(number)
point_2 = Point(point)
bounds_2 = Bounds(Numbers=number_2)
graft_tree = GraftTree(Tree=point_2, IncludeEmptyLists=True, IncludeNullItems=True)  # -> simplify(Tree)
offset_curve = OffsetCurve(Curve=curve_2, Distance="-0.4", Plane=point_2, Corners=1)  # -> simplify(Curve)
graft_tree_2 = GraftTree(Tree=curve_2, IncludeEmptyLists=True, IncludeNullItems=True)  # -> simplify(Tree)
merge = Merge(
    Data1=ColourSwatch(SwatchColor=RGB(200, 234, 209)),
    Data2=ColourSwatch(SwatchColor=RGB(168, 224, 183)),
    Data3=ColourSwatch(SwatchColor=RGB(115, 192, 136)),
    Data4=ColourSwatch(SwatchColor=RGB(57, 125, 84)),
    Data5=ColourSwatch(SwatchColor=RGB(35, 93, 58)))
remap_numbers_2 = RemapNumbers(Value=number_2, Source=bounds_2, Target=domain_2)  # -> Mapped, Clipped
panel = Panel("""0.05
0.5
1
1.5
2""")
explode = Explode(Curve=offset_curve, Recursive=True)  # -> Segments, Vertices
loft = Loft(
    Curves=[graft_tree_2, offset_curve],
    Options={Adjust=False, Closed=False, LoftEnds=0, LoftSimp=0, LoftType=0, Rebuild=10, Refit=0.01})
list_item_4 = ListItem(List=panel, Index=remap_numbers_2.Mapped, Wrap=True)
list_item_5 = ListItem(List=merge, Index=remap_numbers_2.Mapped, Wrap=True)
dispatch = Dispatch(List=explode.Vertices, DispatchPattern=[True, False])  # -> ListA, ListB
negative_2 = Negative(Value=list_item_4)
graft_tree_3 = GraftTree(Tree=list_item_4, IncludeEmptyLists=True, IncludeNullItems=True)  # -> simplify(Tree)
line = Line(StartPoint=dispatch.ListB, EndPoint=graft_tree)  # -> simplify(Line)
graft_tree_4 = GraftTree(Tree=negative_2, IncludeEmptyLists=True, IncludeNullItems=True)  # -> simplify(Tree)
offset_curve_2 = OffsetCurve(Curve=line, Distance=graft_tree_4, Corners=1)
offset_curve_3 = OffsetCurve(Curve=line, Distance=graft_tree_3, Corners=1)
trim_tree = TrimTree(Tree=offset_curve_2, Depth=1)
trim_tree_2 = TrimTree(Tree=offset_curve_3, Depth=1)
curve_3 = Curve(offset_curve)
merge_2 = Merge(Data1=trim_tree_2, Data2=trim_tree)
curve_curve = CurveCurve(CurveA=curve_3, CurveB=merge_2)  # -> Points, ParamsA, ParamsB
trim_tree_3 = TrimTree(Tree=curve_curve.ParamsA, Depth=1)
shatter = Shatter(Curve=curve_3, Parameters=trim_tree_3)
colour = Colour(list_item_5)
number_3 = Number(remap_numbers_2.Mapped)
curve_4 = Curve(merge_2)
brep = Brep(loft)
curve_5 = Curve(shatter)
curve_6 = Curve(curve_3)
point_3 = Point(point_2)
brep_2 = Brep(brep)
curve_7 = Curve(curve_6)
curve_8 = Curve(curve_5)
curve_9 = Curve(curve_4)
point_4 = Point(point_3)
colour_2 = Colour(colour)
number_4 = Number(number_3)
tree_statistics = TreeStatistics(Tree=curve_9)  # -> Paths, graft(Length), Count
duplicate_data = DuplicateData(Data=curve_9, Number=tree_statistics.Length, Order=True)  # -> simplify(Data)
dispatch_2 = Dispatch(List=curve_8, DispatchPattern=[True, False])  # -> ListA, ListB
duplicate_data_2 = DuplicateData(Data=curve_7, Number=tree_statistics.Length, Order=True)  # -> simplify(Data)
partition_list = PartitionList(List=duplicate_data, Size=tree_statistics.Length)  # -> simplify(Chunks)
partition_list_2 = PartitionList(List=duplicate_data_2, Size=tree_statistics.Length)  # -> simplify(Chunks)
tree_statistics_2 = TreeStatistics(Tree=partition_list)  # -> Paths, graft(Length), Count
graft_tree_5 = GraftTree(Tree=partition_list_2, IncludeEmptyLists=True, IncludeNullItems=True)
graft_tree_6 = GraftTree(Tree=curve_9, IncludeEmptyLists=True, IncludeNullItems=True)
series = Series(Start="-1", Step=1, Count=tree_statistics_2.Count)  # -> graft(Series)
shift_list = ShiftList(List=partition_list, Shift=series, Wrap=True)  # -> simplify(List)
cull_index = CullIndex(List=shift_list, Indices="1", Wrap=True)
match_tree = MatchTree(Tree=cull_index, Guide=graft_tree_6)
merge_3 = Merge(Data1=graft_tree_5, Data2=match_tree)
curve_curve_2 = CurveCurve(CurveA=graft_tree_6, CurveB=merge_3)  # -> Points, ParamsA, ParamsB
trim_tree_4 = TrimTree(Tree=curve_curve_2.ParamsA, Depth=1)
shatter_2 = Shatter(Curve=graft_tree_6, Parameters=trim_tree_4)
colour_3 = Colour(colour_2)
number_5 = Number(number_4)
curve_10 = Curve(simplify(dispatch_2.ListA))
curve_11 = Curve(simplify(dispatch_2.ListB))
brep_3 = Brep(brep_2)
curve_12 = Curve(shatter_2)
point_5 = Point(point_4)
curve_13 = Curve(simplify(curve_10))
curve_14 = Curve(simplify(curve_11))
point_6 = Point(point_5)
curve_15 = Curve(curve_12)
brep_4 = Brep(brep_3)
colour_4 = Colour(colour_3)
number_6 = Number(number_5)
panel_2 = Panel("""-0.2
-0.3
-0.4
-0.55
-0.8""")
panel_3 = Panel("""-0.02
-0.3
-0.6
-0.8
-1.6""")
list_item_6 = ListItem(List=curve_15, Index="1", Wrap=True)  # -> simplify(Item)
panel_4 = Panel("""0.3
0.6
0.9
1.2
1.5""")
graft_tree_7 = GraftTree(Tree=point_6, IncludeEmptyLists=True, IncludeNullItems=True)  # -> simplify(Tree)
trim_tree_5 = TrimTree(Tree=list_item_6, Depth=1)
list_item_7 = ListItem(List=reverse(panel_2), Index=number_6, Wrap=True)  # -> graft(Item)
circle = Circle(Plane=graft_tree_7, Radius=1)
list_item_8 = ListItem(List=panel_3, Index=number_6, Wrap=True)  # -> simplify(graft(Item))
list_item_9 = ListItem(List=panel_4, Index=number_6, Wrap=True)  # -> graft(Item)
join_curves = JoinCurves(Curves=[curve_14, trim_tree_5], Preserve=False)  # -> simplify(Curves)
join_curves_2 = JoinCurves(Curves=[curve_13, trim_tree_5], Preserve=False)  # -> simplify(Curves)
unit_z = UnitZ(Factor=list_item_9)
offset_curve_4 = OffsetCurve(Curve=join_curves, Distance=list_item_7, Corners=1)  # -> simplify(Curve)
rotate = Rotate(Geometry=circle, Angle=1.567654734, Plane=graft_tree_7)  # -> Geometry, Transform
trim_tree_6 = TrimTree(Tree=offset_curve_4, Depth=1)
move = Move(Geometry=trim_tree_6, Motion=unit_z)  # -> simplify(graft(Geometry)), Transform
discontinuity = Discontinuity(Curve=join_curves_2, Level=1)  # -> simplify(Points), Parameters
sort_along_curve = SortAlongCurve(Points=discontinuity.Points, Curve=rotate.Geometry)  # -> Points, Indices
dispatch_3 = Dispatch(List=sort_along_curve.Points, DispatchPattern=[True, False])  # -> ListA, ListB
offset_curve_5 = OffsetCurve(Curve=join_curves_2, Distance=list_item_8, Corners=1)  # -> simplify(Curve)
line_2 = Line(StartPoint=graft_tree_7, EndPoint=dispatch_3.ListA)
graft_tree_8 = GraftTree(Tree=join_curves, IncludeEmptyLists=True, IncludeNullItems=True)
move_2 = Move(Geometry=offset_curve_5, Motion=unit_z)  # -> simplify(Geometry), Transform
loft_2 = Loft(
    Curves=[move_2.Geometry, join_curves_2],
    Options={Adjust=False, Closed=False, LoftEnds=0, LoftSimp=0, LoftType=0, Rebuild=10, Refit=0.01})
boundary_surfaces = BoundarySurfaces(Edges=move.Geometry)
loft_3 = Loft(
    Curves=[graft_tree_8, move.Geometry],
    Options={Adjust=False, Closed=False, LoftEnds=0, LoftSimp=0, LoftType=3, Rebuild=10, Refit=0.01})
boundary_surfaces_2 = BoundarySurfaces(Edges=move_2.Geometry)
trim_tree_7 = TrimTree(Tree=boundary_surfaces, Depth=1)
surface_split = SurfaceSplit(Surface=boundary_surfaces_2, Curves=line_2)
trim_tree_8 = TrimTree(Tree=loft_3, Depth=1)
brep_5 = Brep(brep_4)
merge_4 = Merge(Data1=simplify(surface_split), Data2=trim_tree_7)
brep_join = BrepJoin(Breps=[loft_2, brep_5, trim_tree_8, merge_4])  # -> flatten(Breps), Closed
mesh_brep = MeshBrep(
    Brep=brep_join.Breps,
    Settings={GridMaxCount=0, GridMinCount=16, JaggedSeams=False, MaxEdgeLength=0, MinEdgeLength=0.0001, MinTolerance=0, Refine=True, RefineAngle=0, RelativeTolerance=0.65, SimplePlanes=True, Tolerance=0})
weaverbird_s_catmull_clark_subdivision = WeaverbirdsCatmullClarkSubdivision(MeshCurves=mesh_brep, Level="2", SmoothNakedEdges="0")  # -> flatten(OutputMeshCurves)
custom_preview = CustomPreview(Geometry=weaverbird_s_catmull_clark_subdivision, Material=colour_4)
