# Grasshopper definition #33_Parametric_Image.gh (Grasshopper 1.0.7)
# plug-ins: Noise

x_res = Panel("1800")
y_res = Panel("2400")
div = Panel("30")
division = Division(A=y_res, B=div)
division_2 = Division(A=x_res, B=div)
series = Series(Start=0, Step=div, Count=division)  # -> graft(Series)
series_2 = Series(Start=0, Step=div, Count=division_2)
construct_point = ConstructPoint(XCoordinate=series_2, YCoordinate=series, ZCoordinate=0)  # -> simplify(Point)
relative_item = RelativeItem(Tree=construct_point, Offset="{+1}[+1]", WrapPaths=False, WrapItems=False)  # -> ItemA, ItemB
line = Line(StartPoint=relative_item.ItemA, EndPoint=relative_item.ItemB)  # -> flatten(Line)
join_curves = JoinCurves(Curves=line, Preserve=False)
explode = Explode(Curve=join_curves, Recursive=True)  # -> Segments, simplify(Vertices)
point = Point(explode.Vertices)
point_2 = Point(point)
flatten_tree = FlattenTree(Tree=point_2, Path="{0}")
image_sampler = ImageSampler(flatten_tree, Filter="Colour", Interpolate=False, Umax=1800, Umin=0, Vmax=2400, Vmin=0, Wrap=1)
negative = Negative(Value="0.5")

# ----
# text
curve = Curve([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])
curve_2 = Curve(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)

series_3 = Series(Start=0, Step="20", Count="75")
graft_tree = GraftTree(Tree=curve_2, IncludeEmptyLists=True, IncludeNullItems=True)  # -> simplify(Tree)
vector_xyz = VectorXYZ(XComponent=negative, YComponent="0.5", ZComponent=0)  # -> Vector, Length
split_argb = SplitARGB(Colour=image_sampler)  # -> Alpha, Red, Green, Blue
offset_curve = OffsetCurve(Curve=graft(curve), Distance=series_3, Corners="1")  # -> simplify(Curve)
path_mapper = PathMapper(graft_tree, source="{0;0}", target="{2}")
graft_tree_2 = GraftTree(Tree=curve, IncludeEmptyLists=True, IncludeNullItems=True)  # -> simplify(Tree)
graph_mapper = GraphMapper(
    split_argb.Red,
    x0=0,
    x1=1,
    y0=0,
    y1=1,
    container_name="Polyline",
    pt=[Point(0, 0, 0), Point(0.0892431289, 0, 0), Point(0.5742903948, 0.3713748455, 0), Point(0.8288936615, 0.999520123, 0), Point(1, 1, 0)])
perlinnoise = PerlinNoise(
    Points=flatten_tree,
    Seed=0,
    Amplitude="10",
    SmoothStep=0,
    FrequecyX="10",
    FrequecyY="10",
    FrequecyZ="10",
    Jitter="0.8",
    AlignVector=vector_xyz.Vector)
boundary_surfaces = BoundarySurfaces(Edges=[graft_tree_2, path_mapper])  # -> flatten(Surfaces)
trim_tree = TrimTree(Tree=offset_curve, Depth=1)
construct_domain = ConstructDomain(DomainStart="10", DomainEnd="2")
construct_domain_2 = ConstructDomain(DomainStart="1", DomainEnd="0")
bounds = Bounds(Numbers=graph_mapper)
cull_index = CullIndex(List=trim_tree, Indices="0", Wrap=True)
flip_matrix = FlipMatrix(Data=cull_index)
remap_numbers = RemapNumbers(Value=graph_mapper, Source=bounds, Target=construct_domain)  # -> Mapped, Clipped
remap_numbers_2 = RemapNumbers(Value=graph_mapper, Source=bounds, Target=construct_domain_2)  # -> Mapped, Clipped
region_union = RegionUnion(Curves=flip_matrix)  # -> simplify(Result)
multiplication = Multiplication(A=perlinnoise, B=remap_numbers_2.Mapped)
addition = Addition(A=remap_numbers.Mapped, B=multiplication)
divide_length = DivideLength(Curve=region_union, Length="5")  # -> Points, Tangents, Parameters
tree_statistics = TreeStatistics(Tree=point_2)  # -> Paths, Length, Count
integer = Integer(tree_statistics.Length)
number = Number(addition)
polyline = PolyLine(Vertices=divide_length.Points, Closed=invert(False))
point_3 = Point(flatten_tree)
number_2 = Number(number)
integer_2 = Integer(integer)
negative_2 = Negative(Value="0.5")
negative_3 = Negative(Value="0.5")
surface = Surface(boundary_surfaces)
curve_3 = Curve(polyline)
point_4 = Point(point_3)
surface_2 = Surface(surface)
vector_xyz_2 = VectorXYZ(XComponent=negative_2, YComponent="0.5", ZComponent=0)  # -> Vector, Length
vector_xyz_3 = VectorXYZ(XComponent=negative_3, YComponent="0.5", ZComponent=0)  # -> Vector, Length
curve_4 = Curve(curve_3)
negative_4 = Negative(Value="-1")
offset_curve_2 = OffsetCurve(Curve=curve_4, Distance="2", Corners="1")  # -> simplify(Curve)
amplitude = Amplitude(Vector=vector_xyz_2.Vector, Amplitude=number_2)
unit_z = UnitZ(Factor="-1")
amplitude_2 = Amplitude(Vector=vector_xyz_3.Vector, Amplitude="2")
unit_z_2 = UnitZ(Factor=negative_4)
reverse = Reverse(Vector=amplitude_2)
loft = Loft(
    Curves=[curve_4, offset_curve_2],
    Options={Adjust=False, Closed=False, LoftEnds=0, LoftSimp=0, LoftType=0, Rebuild=10, Refit=0.01})
move = Move(Geometry=point_4, Motion=amplitude)  # -> Geometry, Transform
move_2 = Move(Geometry=point_4, Motion=reverse)  # -> Geometry, Transform
move_3 = Move(Geometry=loft, Motion=unit_z)  # -> Geometry, Transform
move_4 = Move(Geometry=surface_2, Motion=unit_z_2)  # -> Geometry, Transform
partition_list = PartitionList(List=move_2.Geometry, Size=integer_2)
partition_list_2 = PartitionList(List=move.Geometry, Size=integer_2)
custom_preview = CustomPreview(Geometry=move_4.Geometry, Material=ColourSwatch(SwatchColor=RGB(255, 255, 255)))
custom_preview_2 = CustomPreview(Geometry=move_3.Geometry, Material=ColourSwatch(SwatchColor=RGB(255, 255, 255)))
interpolate = Interpolate(Vertices=partition_list_2, Degree=3, Periodic=False, KnotStyle=1)  # -> simplify(Curve), Length, Domain
interpolate_2 = Interpolate(Vertices=partition_list, Degree=3, Periodic=False, KnotStyle=1)  # -> simplify(Curve), Length, Domain
loft_2 = Loft(
    Curves=[interpolate_2.Curve, interpolate.Curve],
    Options={Adjust=False, Closed=False, LoftEnds=0, LoftSimp=0, LoftType=0, Rebuild=10, Refit=0.01})  # -> simplify(Loft)
custom_preview_3 = CustomPreview(Geometry=loft_2, Material=ColourSwatch(SwatchColor=RGB(0, 0, 0)))
