# Grasshopper definition #34_Voronoi_exoskeleton.gh (Grasshopper 1.0.7)
# plug-ins: Weaverbird, DendroGH, Noise, Bifocals

division = Division(A="100", B="5")
series = Series(Start=0, Step="5", Count=division)
circle = Circle(Plane=PlaneXY(0, 0, 0), Radius="40")
bounds = Bounds(Numbers=series)
unit_z = UnitZ(Factor=series)
move = Move(Geometry=circle, Motion=unit_z)  # -> Geometry, Transform
remap_numbers = RemapNumbers(Value=series, Source=bounds, Target=Domain(0, 1))  # -> Mapped, Clipped
graph_mapper = GraphMapper(
    remap_numbers.Mapped,
    x0=0,
    x1=1,
    y0=0,
    y1=1,
    container_name="Bezier2",
    pt=[Point(0, 0.3777629733, 0), Point(0.005112868268, 0.6207925677, 0), Point(0.1241372286, 0.8674092357, 0), Point(0.2331665009, 0.8691936731, 0), Point(0.3847693801, 0.8716748953, 0), Point(0.7261539102, 0.8753622174, 0), Point(1, 0.6988711357, 0)])
graph_mapper_2 = GraphMapper(
    remap_numbers.Mapped,
    x0=0,
    x1=1,
    y0=0,
    y1=1,
    container_name="Bezier2",
    pt=[Point(0, 0.743994236, 0), Point(0.03363037109, 1, 0), Point(0.1490398943, 0.999255836, 0), Point(0.2356222421, 0.999255836, 0), Point(0.3386955708, 0.999255836, 0), Point(0.5989432931, 0.9076356888, 0), Point(1, 0.7986394763, 0)])
area = Area(Geometry=move.Geometry)  # -> Area, Centroid
scale = Scale(Geometry=move.Geometry, Center=area.Centroid, Factor=graph_mapper_2)  # -> Geometry, Transform
scale_2 = Scale(Geometry=move.Geometry, Center=area.Centroid, Factor=graph_mapper)  # -> Geometry, Transform
loft = Loft(
    Curves=scale_2.Geometry,
    Options={Adjust=False, Closed=False, LoftEnds=0, LoftSimp=0, LoftType=0, Rebuild=10, Refit=0.01})
loft_2 = Loft(Curves=scale.Geometry, Options={Adjust=False, Closed=False, LoftEnds=0, LoftSimp=0, LoftType=0, Rebuild=10, Refit=0.01})
brep = Brep(loft)
brep_2 = Brep(loft_2)
brep_3 = Brep(brep)
brep_4 = Brep(brep_2)
area_2 = Area(Geometry=brep_3)  # -> Area, Centroid
brep_edges = BrepEdges(Brep=brep_4)  # -> Naked, Interior, NonManifold
list_item = ListItem(List=brep_edges.Naked, Index=0, Wrap=True)  # -> Item, Item1
scale_3 = Scale(Geometry=brep_3, Center=area_2.Centroid, Factor="0.93")  # -> Geometry, Transform
brep_edges_2 = BrepEdges(Brep=scale_3.Geometry)  # -> Naked, Interior, NonManifold
list_item_2 = ListItem(List=brep_edges_2.Naked, Index=0, Wrap=True)  # -> Item, Item1
loft_3 = Loft(
    Curves=[list_item.Item, list_item_2.Item],
    Options={Adjust=False, Closed=False, LoftEnds=0, LoftSimp=0, LoftType=0, Rebuild=10, Refit=0.01})
boundary_surfaces = BoundarySurfaces(Edges=[list_item.Item1, list_item_2.Item1])
merge = Merge(Data1=brep_4, Data2=loft_3, Data3=scale_3.Geometry, Data4=boundary_surfaces)  # -> flatten(Result)
brep_join = BrepJoin(Breps=merge)  # -> Breps, Closed
mesh_brep = MeshBrep(
    Brep=brep_join.Breps,
    Settings={GridMaxCount=0, GridMinCount=16, JaggedSeams=False, MaxEdgeLength=0, MinEdgeLength=0.0001, MinTolerance=0, Refine=True, RefineAngle=0, RelativeTolerance=0.65, SimplePlanes=True, Tolerance=0})
mesh = Mesh(mesh_brep)
brep_5 = Brep(brep_4)
brep_6 = Brep(brep_4)
brep_7 = Brep(brep_5)
mesh_2 = Mesh(mesh)
brep_8 = Brep(brep_6)
weaverbird_s_catmull_clark_subdivision = WeaverbirdsCatmullClarkSubdivision(MeshCurves=mesh_2, Level=1, SmoothNakedEdges=1)
populate_geometry = PopulateGeometry(Geometry=brep_7, Count="75", Seed=1)
deconstruct_mesh = DeconstructMesh(Mesh=weaverbird_s_catmull_clark_subdivision)  # -> Vertices, Faces, Colours, Normals
unit_z_2 = UnitZ(Factor=1)
area_3 = Area(Geometry=weaverbird_s_catmull_clark_subdivision)  # -> Area, Centroid
vector_2pt = Vector2Pt(PointA=area_3.Centroid, PointB=deconstruct_mesh.Vertices, Unitize=invert(False))  # -> Vector, Length
dot_product = DotProduct(VectorA=deconstruct_mesh.Normals, VectorB=unit_z_2, Unitize=invert(False))
worleynoise = WorleyNoise(Points=deconstruct_mesh.Vertices, Centers=populate_geometry, DistanceMetric=0, Seed=0)  # -> F1, F2, F3, F4
construct_domain = ConstructDomain(DomainStart="-2.5", DomainEnd="4")
bounds_2 = Bounds(Numbers=worleynoise.F1)
absolute = Absolute(Value=dot_product)
dot_product_2 = DotProduct(VectorA=vector_2pt.Vector, VectorB=deconstruct_mesh.Normals, Unitize=invert(False))
negative = Negative(Value=Slider(0.439, range=0..1))
smaller_than = SmallerThan(FirstNumber=absolute, SecondNumber=Slider(0.19, range=0..1))  # -> SmallerThan, OrEqualTo
remap_numbers_2 = RemapNumbers(Value=worleynoise.F1, Source=bounds_2, Target=construct_domain)  # -> Mapped, Clipped
larger_than = LargerThan(FirstNumber=dot_product_2, SecondNumber=negative)  # -> LargerThan, OrEqualTo
amplitude = Amplitude(Vector=deconstruct_mesh.Normals, Amplitude=remap_numbers_2.Mapped)
gate_and = GateAnd(A=larger_than.LargerThan, B=smaller_than.SmallerThan)
brep_9 = Brep(brep_8)
vector = Vector(amplitude)
point = Point(populate_geometry)
data = Data(deconstruct_mesh.Faces)
point_2 = Point(deconstruct_mesh.Vertices)
boolean = Boolean(gate_and)
point_3 = Point(point)
brep_10 = Brep(brep_9)
vector_2 = Vector(vector)
boolean_2 = Boolean(boolean)
point_4 = Point(point_2)
data_2 = Data(data)
item_index = ItemIndex(List=point_3, Item=point_3)
dispatch = Dispatch(List=point_4, DispatchPattern=boolean_2)  # -> ListA, ListB
point_5 = Point(point_3)
point_6 = Point(dispatch.ListA)
vector_3 = Vector(vector_2)
graft_tree = GraftTree(Tree=point_6, IncludeEmptyLists=True, IncludeNullItems=True)
distance = Distance(PointA=graft_tree, PointB=point_5)  # -> simplify(Distance)
sort_list = SortList(Keys=distance, ValuesValuesA=item_index)  # -> Keys, ValuesValuesA
multiplication = Multiplication(A=boolean_2, B=vector_3)
list_item_3 = ListItem(List=sort_list.ValuesValuesA, Index=0, Wrap=True)  # -> flatten(Item)
create_set = CreateSet(List=list_item_3)  # -> Set, Map
move_2 = Move(Geometry=point_4, Motion=multiplication)  # -> Geometry, Transform
member_index = MemberIndex(Set=list_item_3, Member=create_set.Set)  # -> simplify(Index), Count
list_item_4 = ListItem(List=point_6, Index=member_index.Index, Wrap=True)
brep_11 = Brep(brep_10)
construct_mesh = ConstructMesh(Vertices=move_2.Geometry, Faces=data_2)
average = Average(Input=list_item_4)
brep_closest_point = BrepClosestPoint(Point=average, Brep=brep_11)  # -> Point, Normal, Distance
plane_normal = PlaneNormal(Origin=brep_closest_point.Point, ZAxis=brep_closest_point.Normal)
convex_hull = ConvexHull(Points=list_item_4, Plane=plane_normal)  # -> Hull, HullZ, Indices
curve = Curve(convex_hull.HullZ)
mesh_3 = Mesh(construct_mesh)
mesh_4 = Mesh(mesh_3)
curve_2 = Curve(curve)
flatten_tree = FlattenTree(Tree=curve_2, Path="{0}")
create_settings = CreateSettings(VoxelSize="1", Bandwidth=1, Isovalue=0, Adaptivity=0.1)
create_settings_2 = CreateSettings(VoxelSize="1", Bandwidth=1, Isovalue="0.2", Adaptivity=0.1)
explode = Explode(Curve=flatten_tree, Recursive=True)  # -> flatten(Segments), Vertices
multiplication_2 = Multiplication(A="1", B="1.5")
curve_to_volume = CurveToVolume(Curves=explode.Segments, CurveRadius=multiplication_2, Settings=create_settings)
mesh_to_volume = MeshToVolume(Mesh=mesh_4, Settings=create_settings_2)
smooth_volume = SmoothVolume(Volume=curve_to_volume, Width=1, Type=2, Iterations=1)
volume_union = VolumeUnion(Volumes=flatten([smooth_volume, mesh_to_volume]))
quad_remesh_settings = QuadRemeshSettings(
    TargetCount="20000",
    AdaptiveSize="50",
    AdaptiveCount=False,
    HardEdges=invert(False),
    SeamEdges=0,
    Symmetry=0,
    GuideCurves=0)
volume_to_mesh = VolumeToMesh(Volume=volume_union, VolumeSettings=create_settings_2)
quad_remesh = QuadRemesh(Mesh=volume_to_mesh, Settings=quad_remesh_settings)
