# Grasshopper definition #35_Minimal_Surface_ring.gh (Grasshopper 1.0.7)
# plug-ins: Axolotl Info, Weaverbird, Bifocals

torus = Torus(RadiusAxis=3, RadiusPipe=1, Plane=PlaneXY(0, 0, 0))
tpms = TPMS(Wavelength=Slider(0.9, range=0..10), type=12)
smoothintersection = SmoothIntersection(DistanceObject=torus, DistanceObject_2=tpms, Radius=1)
smoothsubtraction = SmoothSubtraction(DistanceObject=torus, DistanceObject_2=tpms, Radius=1)
box = Box({Plane=PlaneXY(0, 0, 0), X=Domain(-5, 5), Y=Domain(-5, 5), Z=Domain(-5, 5)})
dense_grid = DenseGrid(DistanceObject=smoothintersection, Box=box, NumberX="100", NumberY="100", NumberZ="100", type=0)  # -> Values, Points
dense_grid_2 = DenseGrid(DistanceObject=smoothsubtraction, Box=box, NumberX="100", NumberY="100", NumberZ="100", type=0)  # -> Values, Points
blur = Blur(Values=dense_grid_2.Values, NumberX="100", NumberY="100", NumberZ="100", Radius="1")
blur_2 = Blur(Values=dense_grid.Values, NumberX="100", NumberY="100", NumberZ="100", Radius="3")
isosurface_distancefield = IsosurfaceDistancefield(Values=blur_2, BoundingBox=box, NumberX="100", NumberY="100", NumberZ="100", Isovalue=0)
isosurface_distancefield_2 = IsosurfaceDistancefield(Values=blur, BoundingBox=box, NumberX="100", NumberY="100", NumberZ="100", Isovalue=0)
mesh = Mesh(isosurface_distancefield)
mesh_2 = Mesh(isosurface_distancefield_2)
mesh_3 = Mesh(mesh_2)
mesh_4 = Mesh(mesh)
flip_mesh = FlipMesh(Mesh=mesh_4, VertexNormals=True, FaceNormals=True, FaceOrientation=True)
flip_mesh_2 = FlipMesh(Mesh=mesh_3, VertexNormals=True, FaceNormals=True, FaceOrientation=True)
weaverbird_s_catmull_clark_subdivision = WeaverbirdsCatmullClarkSubdivision(MeshCurves=flip_mesh, Level="2", SmoothNakedEdges=1)
weaverbird_s_picture_frame = WeaverbirdsPictureFrame(MeshPolylines=flip_mesh_2, Distance="10", InsetType=0)
weaverbird_s_catmull_clark_subdivision_2 = WeaverbirdsCatmullClarkSubdivision(MeshCurves=weaverbird_s_picture_frame, Level=1, SmoothNakedEdges=1)
weaverbird_s_mesh_thicken = WeaverbirdsMeshThicken(MeshCurves=weaverbird_s_catmull_clark_subdivision_2, Distance="0.02", OffsetType=0)
