# Grasshopper definition #36_3D_tesllation_pattern.gh (Grasshopper 1.0.7)
# plug-ins: LunchBox, Kangaroo2 Components, Weaverbird, DendroGH, Bifocals

circle = Circle(Plane=PlaneXY(0, 0, 0), Radius="30")
division = Division(A="55", B="100")
series = Series(Start=0, Step=division, Count="100")
bounds = Bounds(Numbers=series)
unit_z = UnitZ(Factor=series)
remap_numbers = RemapNumbers(Value=series, Source=bounds, Target=Domain(0, 1))  # -> Mapped, Clipped
graph_mapper = GraphMapper(
    remap_numbers.Mapped,
    x0=0,
    x1=1,
    y0=0,
    y1=1,
    container_name="Bezier2",
    pt=[Point(0, 0.4299008846, 0), Point(0.1181565449, 0.6378521919, 0), Point(0.5320495019, 0.8897514937, 0), Point(0.6643574834, 0.9071749449, 0), Point(0.7837011218, 0.92289114, 0), Point(0.9292942882, 0.8763085008, 0), Point(1, 0.6500257254, 0)])
move = Move(Geometry=circle, Motion=unit_z)  # -> Geometry, Transform
area = Area(Geometry=move.Geometry)  # -> Area, Centroid
scale = Scale(Geometry=move.Geometry, Center=area.Centroid, Factor=graph_mapper)  # -> Geometry, Transform
loft = Loft(Curves=scale.Geometry, Options={Adjust=False, Closed=False, LoftEnds=0, LoftSimp=0, LoftType=0, Rebuild=10, Refit=0.01})
hexagon_cells = HexagonCells(Surface=loft, UDivisions="25", VDivisions="40", TParameter="0.25")  # -> HexagonCells, Centers
curve = Curve(hexagon_cells.HexagonCells)
discontinuity = Discontinuity(Curve=curve, Level=1)  # -> Points, Parameters
graft_tree = GraftTree(Tree=curve, IncludeEmptyLists=True, IncludeNullItems=True)
tree_statistics = TreeStatistics(Tree=discontinuity.Points)  # -> Paths, Length, Count
equality = Equality(FirstNumber=tree_statistics.Length, SecondNumber="6")  # -> Equality, Inequality
dispatch = Dispatch(List=tree_statistics.Paths, DispatchPattern=equality.Equality)  # -> ListA, ListB
tree_branch = TreeBranch(Tree=graft_tree, Path=dispatch.ListB, MaintainPaths=True)  # -> simplify(flatten(Branch))
tree_branch_2 = TreeBranch(Tree=graft_tree, Path=dispatch.ListA, MaintainPaths=True)
discontinuity_2 = Discontinuity(Curve=tree_branch, Level=1)  # -> Points, Parameters
average = Average(Input=discontinuity_2.Points)  # -> flatten(ArithmeticMean)
deconstruct = Deconstruct(Point=average)  # -> XComponent, YComponent, ZComponent
create_set = CreateSet(List=deconstruct.ZComponent)  # -> Set, Map
member_index = MemberIndex(Set=deconstruct.ZComponent, Member=create_set.Set)  # -> simplify(Index), Count
panel = Panel("""0
1
-1""")
tree_statistics_2 = TreeStatistics(Tree=member_index.Index)  # -> Paths, Length, Count
cull_index = CullIndex(List=tree_statistics_2.Paths, Indices=panel, Wrap=True)
tree_branch_3 = TreeBranch(Tree=member_index.Index, Path=cull_index, MaintainPaths=True)
list_item = ListItem(List=tree_branch, Index=tree_branch_3, Wrap=True)
curve_2 = Curve(tree_branch_2)
explode = Explode(Curve=list_item, Recursive=True)  # -> Segments, Vertices
trim_tree = TrimTree(Tree=explode.Vertices, Depth=1)
removeduplicatepts = RemoveDuplicatePts(Points=trim_tree, Tolerance=0.01)
panel_2 = Panel("""1
2""")
cull_index_2 = CullIndex(List=removeduplicatepts, Indices=panel_2, Wrap=True)
convex_hull = ConvexHull(Points=cull_index_2, Plane=PlaneXY(0, 0, 0))  # -> Hull, HullZ, Indices
merge = Merge(Data1=curve_2, Data2=convex_hull.HullZ)  # -> flatten(Result)
construct_domain = ConstructDomain(DomainStart="0.65", DomainEnd="0.25")
construct_domain_2 = ConstructDomain(DomainStart="1", DomainEnd="0.5")
discontinuity_3 = Discontinuity(Curve=merge, Level=1)  # -> Points, Parameters
negative = Negative(Value="2")
brep = Brep(loft)
series_2 = Series(Start=0, Step=1, Count="30")
offset_surface = OffsetSurface(Surface=brep, Distance="2", Retrim=True)
offset_surface_2 = OffsetSurface(Surface=brep, Distance=negative, Retrim=True)
curve_3 = Curve(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)
average_2 = Average(Input=discontinuity_3.Points)
deconstruct_2 = Deconstruct(Point=average_2)  # -> XComponent, YComponent, flatten(ZComponent)
bounds_2 = Bounds(Numbers=deconstruct_2.ZComponent)
remap_numbers_2 = RemapNumbers(Value=deconstruct_2.ZComponent, Source=bounds_2, Target=construct_domain)  # -> Mapped, Clipped
remap_numbers_3 = RemapNumbers(Value=deconstruct_2.ZComponent, Source=bounds_2, Target=construct_domain_2)  # -> graft(Mapped), Clipped
bounds_3 = Bounds(Numbers=series_2)
unit_z_2 = UnitZ(Factor=1)
pull_curve = PullCurve(Curve=curve_3, Surface=brep)
brep_closest_point = BrepClosestPoint(Point=average_2, Brep=brep)  # -> Point, Normal, Distance
remap_numbers_4 = RemapNumbers(Value=series_2, Source=bounds_3, Target=Domain(0, 1))  # -> Mapped, Clipped
flatten_tree = FlattenTree(Tree=average_2, Path="{0}")
cross_product = CrossProduct(VectorA=brep_closest_point.Normal, VectorB=unit_z_2, Unitize=False)  # -> Vector, Length
number_slider = Slider(10, range=0..100)
graph_mapper_2 = GraphMapper(
    remap_numbers_4.Mapped,
    x0=0,
    x1=1,
    y0=0,
    y1=1,
    container_name="Sine",
    Equation_px=[0, 0.5014542341],
    Equation_py=[0.008310496807, 0.2254983783])
perp_frames = PerpFrames(Curve=pull_curve, Count="30", Align=True)  # -> Frames, Parameters
negative_2 = Negative(Value=number_slider)
multiplication = Multiplication(A=graph_mapper_2, B=Slider(100, range=0..100))
cross_product_2 = CrossProduct(VectorA=brep_closest_point.Normal, VectorB=cross_product.Vector, Unitize=False)  # -> Vector, Length
brep_2 = Brep(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)
construct_domain_3 = ConstructDomain(DomainStart=number_slider, DomainEnd=negative_2)
amplitude = Amplitude(Vector=brep_closest_point.Normal, Amplitude=remap_numbers_3.Mapped)
scale_2 = Scale(Geometry=merge, Center=flatten_tree, Factor=remap_numbers_2.Mapped)  # -> Geometry, Transform
explode_2 = Explode(Curve=merge, Recursive=True)  # -> Segments, Vertices
construct_plane = ConstructPlane(Origin=average_2, XAxis=cross_product.Vector, YAxis=cross_product_2.Vector)
reverse = Reverse(Vector=amplitude)
rectangle = Rectangle(Plane=perp_frames.Frames, XSize=multiplication, YSize=construct_domain_3, Radius=0)  # -> Rectangle, Length
circle_2 = Circle(Plane=construct_plane, Radius="0.5")
move_2 = Move(Geometry=graft(scale_2.Geometry), Motion=amplitude)  # -> Geometry, Transform
move_3 = Move(Geometry=graft(scale_2.Geometry), Motion=reverse)  # -> Geometry, Transform
curve_middle = CurveMiddle(Curve=explode_2.Segments)
loft_2 = Loft(
    Curves=rectangle.Rectangle,
    Options={Adjust=False, Closed=False, LoftEnds=0, LoftSimp=0, LoftType=0, Rebuild=10, Refit=0.01})
explode_3 = Explode(Curve=move_2.Geometry, Recursive=True)  # -> Segments, Vertices
explode_4 = Explode(Curve=move_3.Geometry, Recursive=True)  # -> Segments, Vertices
sort_along_curve = SortAlongCurve(Points=curve_middle, Curve=circle_2)  # -> Points, Indices
cap_holes = CapHoles(Brep=loft_2)
split_list = SplitList(List=explode_4.Segments, Index="3")  # -> simplify(ListA), simplify(ListB)
split_list_2 = SplitList(List=explode_3.Segments, Index="3")  # -> simplify(ListA), simplify(ListB)
list_item_2 = ListItem(List=explode_2.Segments, Index=sort_along_curve.Indices, Wrap=True)
entwine = Entwine(
    Branch0X=split_list_2.ListA,
    Branch1X=split_list_2.ListB,
    Branch2X=split_list.ListA,
    Branch3X=split_list.ListB,
    FlattenInputs=False)
list_item_3 = ListItem(List=explode_4.Segments, Index=sort_along_curve.Indices, Wrap=True)
list_item_4 = ListItem(List=explode_3.Segments, Index=sort_along_curve.Indices, Wrap=True)
dispatch_2 = Dispatch(List=list_item_2, DispatchPattern=[True, False])  # -> ListA, ListB
list_item_5 = ListItem(List=entwine, Index=0, Wrap=True)  # -> Item1, Item
dispatch_3 = Dispatch(List=list_item_4, DispatchPattern=[True, False])  # -> ListA, ListB
dispatch_4 = Dispatch(List=list_item_3, DispatchPattern=[True, False])  # -> ListA, ListB
flip_curve = FlipCurve(Curve=list_item_5.Item)  # -> Curve, Flag
curve_4 = Curve(reparameterize(simplify(dispatch_2.ListB)))
curve_5 = Curve(reparameterize(simplify(dispatch_2.ListA)))
curve_6 = Curve(simplify(dispatch_4.ListB))
curve_7 = Curve(simplify(dispatch_3.ListA))
loft_3 = Loft(
    Curves=[list_item_5.Item1, flip_curve.Curve],
    Options={Adjust=False, Closed=False, LoftEnds=0, LoftSimp=0, LoftType=0, Rebuild=10, Refit=0.01})
construct_domain_4 = ConstructDomain(DomainStart="0.25", DomainEnd="0.75")
graft_tree_2 = GraftTree(Tree=curve_7, IncludeEmptyLists=True, IncludeNullItems=True)
graft_tree_3 = GraftTree(Tree=curve_6, IncludeEmptyLists=True, IncludeNullItems=True)
simple_mesh = SimpleMesh(Brep=loft_3)
sub_curve = SubCurve(BaseCurve=curve_5, Domain=construct_domain_4)
graft_tree_4 = GraftTree(Tree=sub_curve, IncludeEmptyLists=True, IncludeNullItems=True)
sub_curve_2 = SubCurve(BaseCurve=curve_4, Domain=construct_domain_4)
graft_tree_5 = GraftTree(Tree=sub_curve_2, IncludeEmptyLists=True, IncludeNullItems=True)
loft_4 = Loft(
    Curves=[graft_tree_2, graft_tree_4],
    Options={Adjust=False, Closed=False, LoftEnds=0, LoftSimp=0, LoftType=0, Rebuild=10, Refit=0.01})
loft_5 = Loft(
    Curves=[graft_tree_3, graft_tree_5],
    Options={Adjust=False, Closed=False, LoftEnds=0, LoftSimp=0, LoftType=0, Rebuild=10, Refit=0.01})
simple_mesh_2 = SimpleMesh(Brep=loft_4)
simple_mesh_3 = SimpleMesh(Brep=loft_5)
merge_2 = Merge(Data1=simple_mesh_2, Data2=simple_mesh_3, Data3=simple_mesh)  # -> flatten(Result)
weaverbird_s_join_meshes_and_weld = WeaverbirdsJoinMeshesAndWeld(Mesh=merge_2, Weld=invert(False))
create_settings = CreateSettings(VoxelSize="0.1", Bandwidth=1, Isovalue=0, Adaptivity=0.1)
weaverbird_s_mesh_thicken = WeaverbirdsMeshThicken(MeshCurves=weaverbird_s_join_meshes_and_weld, Distance="1", OffsetType=0)
solid_difference = SolidDifference(BrepsA=brep_2, BrepsB=cap_holes)
weaverbird_s_catmull_clark_subdivision = WeaverbirdsCatmullClarkSubdivision(MeshCurves=weaverbird_s_mesh_thicken, Level="2", SmoothNakedEdges=1)
mesh_brep = MeshBrep(
    Brep=solid_difference,
    Settings={GridMaxCount=0, GridMinCount=16, JaggedSeams=False, MaxEdgeLength=0, MinEdgeLength=0.0001, MinTolerance=0, Refine=True, RefineAngle=0, RelativeTolerance=0.65, SimplePlanes=True, Tolerance=0})
mesh_to_volume = MeshToVolume(Mesh=mesh_brep, Settings=create_settings)
mesh_to_volume_2 = MeshToVolume(Mesh=weaverbird_s_catmull_clark_subdivision, Settings=create_settings)
smooth_volume = SmoothVolume(Volume=mesh_to_volume_2, Width=1, Type=2, Iterations=1)
volume_union = VolumeUnion(Volumes=[smooth_volume, mesh_to_volume])
volume_to_mesh = VolumeToMesh(Volume=volume_union, VolumeSettings=create_settings)
