# Grasshopper definition #38_lattice.gh (Grasshopper 1.0.7)
# plug-ins: Noise, DendroGH, Pufferfish, LunchBox, Kangaroo2 Components, Bifocals

circle = Circle(Plane=PlaneXY(0, 0, 0), Radius="75")
division = Division(A="150", B="16")
series = Series(Start=0, Step=division, Count="16")
unit_z = UnitZ(Factor=series)
bounds = Bounds(Numbers=series)
move = Move(Geometry=circle, Motion=unit_z)  # -> Geometry, Transform
remap_numbers = RemapNumbers(Value=series, Source=bounds, Target=Domain(0, 1))  # -> Mapped, Clipped
graph_mapper = GraphMapper(
    remap_numbers.Mapped,
    x0=0,
    x1=1,
    y0=0,
    y1=1,
    container_name="Bezier2",
    pt=[Point(0, 0.3898136616, 0), Point(0.1792226583, 0.6257197857, 0), Point(0.2532291114, 0.6290803552, 0), Point(0.3934874535, 0.6277048588, 0), Point(0.5309684852, 0.6263565991, 0), Point(0.6624114513, 0.5363948345, 0), Point(1, 0.3954600096, 0)])
area = Area(Geometry=move.Geometry)  # -> Area, Centroid
scale = Scale(Geometry=move.Geometry, Center=area.Centroid, Factor=graph_mapper)  # -> Geometry, Transform
divide_curve = DivideCurve(Curve=scale.Geometry, Count="200", Kinks=False)  # -> simplify(Points), Tangents, Parameters
point = Point(divide_curve.Points)
point_2 = Point(point)
number_slider = Slider(1.9, range=0..10)
average = Average(Input=point_2)  # -> flatten(ArithmeticMean)
flatten_tree = FlattenTree(Tree=point_2, Path="{0}")
negative = Negative(Value="11.5")
construct_domain = ConstructDomain(DomainStart=negative, DomainEnd="11.5")
perlinnoise = PerlinNoise(
    Points=flatten_tree,
    Seed=0,
    Amplitude=1,
    SmoothStep=0,
    FrequecyX=number_slider,
    FrequecyY=number_slider,
    FrequecyZ=number_slider,
    Jitter=0,
    AlignVector=Vector(1, 0, 0))
deconstruct = Deconstruct(Point=average)  # -> XComponent, YComponent, ZComponent
bounds_2 = Bounds(Numbers=deconstruct.ZComponent)
remap_numbers_2 = RemapNumbers(Value=perlinnoise, Source=Domain(0, 1), Target=construct_domain)  # -> Mapped, Clipped
tree_statistics = TreeStatistics(Tree=point_2)  # -> Paths, Length, Count
remap_numbers_3 = RemapNumbers(Value=deconstruct.ZComponent, Source=bounds_2, Target=Domain(0, 1))  # -> Mapped, Clipped
partition_list = PartitionList(List=remap_numbers_2.Mapped, Size=tree_statistics.Length)
graph_mapper_2 = GraphMapper(
    remap_numbers_3.Mapped,
    x0=0,
    x1=1,
    y0=0,
    y1=1,
    container_name="Bezier",
    cpx=[0, 0.1040003672, 0.2136478126, 1],
    cpy=[0, 1, 1, 1])
unit_z_2 = UnitZ(Factor=partition_list)  # -> simplify(UnitVector)
multiplication = Multiplication(A=graft(graph_mapper_2), B=unit_z_2)
move_2 = Move(Geometry=point_2, Motion=multiplication)  # -> Geometry, Transform
move_point = Point(move_2.Geometry)
move_point_2 = Point(move_point)
negative_2 = Negative(Value="2.60")
interpolate = Interpolate(Vertices=move_point_2, Degree=3, Periodic=invert(False), KnotStyle=1)  # -> flatten(Curve), Length, Domain
construct_domain_2 = ConstructDomain(DomainStart=negative_2, DomainEnd="2.60")
list_length = ListLength(List=interpolate.Curve)
random = Random(Range=construct_domain_2, Number=list_length, Seed=2)
unit_z_3 = UnitZ(Factor=random)
move_3 = Move(Geometry=interpolate.Curve, Motion=unit_z_3)  # -> Geometry, Transform
shift_list = ShiftList(List=move_3.Geometry, Shift=1, Wrap=invert(True))
shortest_list = ShortestList(ListListA=move_3.Geometry, ListListB=shift_list, TrimMode=2)  # -> ListListA, ListListB
tween_curve = TweenCurve(CurveA=shortest_list.ListListA, CurveB=shortest_list.ListListB, Factor=0.5, BlendType=0)
graft_tree = GraftTree(Tree=shortest_list.ListListB, IncludeEmptyLists=True, IncludeNullItems=True)
graft_tree_2 = GraftTree(Tree=shortest_list.ListListA, IncludeEmptyLists=True, IncludeNullItems=True)
tweencurve = Curve(tween_curve)
curve_a = Curve(graft_tree_2)
curve_b = Curve(graft_tree)
curve_a_2 = Curve(curve_a)
curve_b_2 = Curve(curve_b)
tweencurve_2 = Curve(tweencurve)
divide_curve_2 = DivideCurve(Curve=tweencurve_2, Count="100", Kinks=False)  # -> Points, Tangents, Parameters
average_2 = Average(Input=divide_curve_2.Points)  # -> flatten(ArithmeticMean)
scale_2 = Scale(Geometry=tweencurve_2, Center=average_2, Factor=Slider(0.95, range=0..1))  # -> Geometry, Transform
graft_tree_3 = GraftTree(Tree=scale_2.Geometry, IncludeEmptyLists=True, IncludeNullItems=True)
merge = Merge(Data1=curve_a_2, Data2=graft_tree_3, Data3=curve_b_2)
loft = Loft(Curves=merge, Options={Adjust=False, Closed=False, LoftEnds=0, LoftSimp=0, LoftType=0, Rebuild=10, Refit=0.01})  # -> flatten(Loft)
offset_surface = OffsetSurface(Surface=loft, Distance="4", Retrim=True)
dispatch = Dispatch(List=loft, DispatchPattern=[True, False])  # -> ListA, ListB
dispatch_2 = Dispatch(List=offset_surface, DispatchPattern=[True, False])  # -> ListA, ListB
brep_a = Brep(dispatch.ListA)
brep_b = Brep(dispatch_2.ListA)
brep_a_2 = Brep(brep_a)
brep_b_2 = Brep(brep_b)
brep_edges = BrepEdges(Brep=brep_a_2)  # -> Naked, Interior, NonManifold
brep_edges_2 = BrepEdges(Brep=brep_b_2)  # -> Naked, Interior, NonManifold
list_item = ListItem(List=brep_edges_2.Naked, Index=0, Wrap=True)  # -> Item, Item1
list_item_2 = ListItem(List=brep_edges.Naked, Index=0, Wrap=True)  # -> Item, Item1
loft_2 = Loft(
    Curves=[list_item_2.Item1, list_item.Item1],
    Options={Adjust=False, Closed=False, LoftEnds=0, LoftSimp=0, LoftType=0, Rebuild=10, Refit=0.01})
loft_3 = Loft(
    Curves=[list_item_2.Item, list_item.Item],
    Options={Adjust=False, Closed=False, LoftEnds=0, LoftSimp=0, LoftType=0, Rebuild=10, Refit=0.01})
brep_edges_3 = BrepEdges(Brep=loft_2)  # -> Naked, Interior, NonManifold
merge_2 = Merge(Data1=graft(brep_a_2), Data2=graft(brep_b_2), Data3=loft_3, Data4=loft_2)
list_item_3 = ListItem(List=brep_edges_3.Naked, Index=0, Wrap=True)  # -> Item, Item1
brep_join = BrepJoin(Breps=merge_2)  # -> Breps, Closed
flip_curve = FlipCurve(Curve=brep_edges_3.Naked, Guide=list_item_3.Item1)  # -> Curve, Flag
mesh_brep = MeshBrep(
    Brep=brep_join.Breps,
    Settings={GridMaxCount=0, GridMinCount=16, JaggedSeams=False, MaxEdgeLength=0, MinEdgeLength=0.0001, MinTolerance=0, Refine=True, RefineAngle=0, RelativeTolerance=0.65, SimplePlanes=True, Tolerance=0})  # -> flatten(Mesh)
loft_4 = Loft(
    Curves=flip_curve.Curve,
    Options={Adjust=False, Closed=False, LoftEnds=0, LoftSimp=0, LoftType=0, Rebuild=10, Refit=0.01})
bottom_surface = Brep(loft_4)
top_surface = Brep(loft_3)
solid_part = Mesh(mesh_brep)
top_surface_2 = Brep(top_surface)
bottom_surface_2 = Brep(bottom_surface)
solid_part_2 = Mesh(solid_part)
reverse_surface_direction = ReverseSurfaceDirection(Surface=bottom_surface_2, ReverseOption="1")
construct_domain² = ConstructDomain²(UMin=Slider(0.2, range=0..1), UMax=Slider(0.8, range=0..1), VMin=0, VMax=1)
isotrim = Isotrim(Surface=reparameterize(reverse_surface_direction), Domain=construct_domain²)
brep_edges_4 = BrepEdges(Brep=isotrim)  # -> Naked, Interior, NonManifold
list_item_4 = ListItem(List=brep_edges_4.Naked, Index=0, Wrap=True)  # -> Item, Item1
flip_curve_2 = FlipCurve(Curve=list_item_4.Item1)  # -> Curve, Flag
unit_z_4 = UnitZ(Factor="-2")
tween_curve_2 = TweenCurve(CurveA=list_item_4.Item, CurveB=flip_curve_2.Curve, Factor=0.5, BlendType=0)
construct_domain²_2 = ConstructDomain²(UMin=Slider(0.2, range=0..1), UMax=Slider(0.8, range=0..1), VMin=0, VMax=1)
move_4 = Move(Geometry=tween_curve_2, Motion=unit_z_4)  # -> Geometry, Transform
merge_3 = Merge(Data1=list_item_4.Item, Data2=move_4.Geometry, Data3=flip_curve_2.Curve)
isotrim_2 = Isotrim(Surface=reparameterize(top_surface_2), Domain=construct_domain²_2)
loft_5 = Loft(Curves=merge_3, Options={Adjust=False, Closed=False, LoftEnds=0, LoftSimp=0, LoftType=2, Rebuild=10, Refit=0.01})
bottom_surface_3 = Brep(loft_5)
top_surface_3 = Brep(isotrim_2)
solid_part_3 = Mesh(solid_part_2)
bottom_surface_4 = Brep(bottom_surface_3)
solid_part_4 = Mesh(solid_part_3)
top_surface_4 = Brep(top_surface_3)
division_2 = Division(A="1", B="1")
division_3 = Division(A="1", B="30")
relative_items = RelativeItems(TreeA=simplify(top_surface_4), TreeB=simplify(bottom_surface_4), Offset="{+1}", WrapPaths=False, WrapItems=False)  # -> ItemA, ItemB
series_2 = Series(Start=0, Step=division_2, Count=expr("X+1", "1"))
series_3 = Series(Start=0, Step=division_3, Count=expr("X+1", "30"))
twisted_box_two_surfaces = TwistedBoxTwoSurfaces(
    SurfaceA=relative_items.ItemA,
    SurfaceB=relative_items.ItemB,
    ParametersU=series_2,
    ParametersV=series_3,
    ParametersW=[0, 0.5, 1],
    Refit=0,
    PointSample=0)
deconstruct_twisted_box = DeconstructTwistedBox(TwistedBox=twisted_box_two_surfaces, DeconstructType=0)
evaluate_twisted_box = EvaluateTwistedBox(TwistedBox=twisted_box_two_surfaces, ParameterU=0.5, ParameterV=0.5, ParameterW="0.25")  # -> graft(Evaluation), ResultBoolean
evaluate_twisted_box_2 = EvaluateTwistedBox(TwistedBox=twisted_box_two_surfaces, ParameterU=0.5, ParameterV=0.5, ParameterW="0.75")  # -> graft(Evaluation), ResultBoolean
partition_list_2 = PartitionList(List=deconstruct_twisted_box, Size="4")  # -> simplify(Chunks)
split_tree = SplitTree(Data=partition_list_2, Masks=flatten("{*;*;0}"))  # -> Positive, Negative
line = Line(StartPoint=evaluate_twisted_box.Evaluation, EndPoint=split_tree.Positive)
line_2 = Line(StartPoint=evaluate_twisted_box_2.Evaluation, EndPoint=split_tree.Negative)
line_3 = Line(StartPoint=evaluate_twisted_box.Evaluation, EndPoint=evaluate_twisted_box_2.Evaluation)
line_middle = Curve(line_3)
line_bottom = Curve(line)
solid_part_5 = Mesh(solid_part_4)
line_top = Curve(line_2)
line_middle_2 = Curve(line_middle)
line_bottom_2 = Curve(line_bottom)
solid_part_6 = Mesh(solid_part_5)
linetop = Curve(line_top)
create_settings = CreateSettings(VoxelSize="0.1", Bandwidth=1, Isovalue=0, Adaptivity=0.1)
merge_4 = Merge(Data1=line_middle_2, Data2=line_bottom_2, Data3=linetop)  # -> simplify(Result)
trim_tree = TrimTree(Tree=merge_4, Depth=1)
multipipe = MultiPipe(Curves=trim_tree, NodeSize=0.5, EndOffset=1, StrutSize=1, Segment=0, KinkAngle=0.6, CubeFit=0, Caps=0)  # -> flatten(Pipe)
mesh_from_subd = MeshFromSubD(SubD=multipipe, Density=2)
mesh_to_volume = MeshToVolume(Mesh=mesh_from_subd, Settings=create_settings)
mesh_to_volume_2 = MeshToVolume(Mesh=solid_part_6, Settings=create_settings)
merge_5 = Merge(Data1=mesh_to_volume_2, Data2=mesh_to_volume)  # -> flatten(Result)
volume_union = VolumeUnion(Volumes=merge_5)
volume_to_mesh = VolumeToMesh(Volume=volume_union, VolumeSettings=create_settings)
