# Grasshopper definition #39_shell_lantern.gh (Grasshopper 1.0.7)
# plug-ins: Pufferfish, Kangaroo2 Components, DendroGH, NGon, Nautilus, Weaverbird

U = Panel("25")
V = Panel("20")
brep = Brep(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)
brep_2 = Brep(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)
brep_3 = Brep(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)
thickness = Panel("-15")
division = Division(A="1", B=U)
addition = Addition(A=U, B="1")
division_2 = Division(A="1", B=V)
addition_2 = Addition(A=V, B="1")
mesh_brep = MeshBrep(
    Brep=brep,
    Settings={GridMaxCount=0, GridMinCount=16, JaggedSeams=False, MaxEdgeLength=0, MinEdgeLength=0.0001, MinTolerance=0, Refine=True, RefineAngle=0, RelativeTolerance=0.65, SimplePlanes=True, Tolerance=0})
divide_surface = DivideSurface(Surface=brep_2, UCount="20", VCount="75")  # -> simplify(Points), Normals, Parameters
offset_surface = OffsetSurface(Surface=brep_3, Distance=thickness, Retrim=True)
series = Series(Start=0, Step=division, Count=addition)
series_2 = Series(Start=0, Step=division_2, Count=addition_2)
remesh = Remesh(Mesh=mesh_brep, FixEdges=True, EdgeLength="35", Iterations=10, Project=True)
W = Panel("""0
1""")
list = ValueList({"First Edges": 0, "Last Edges": 1, "Random Edges": 2, "Shortest Edges": 3, "Farthest Edges": 4, "Lowest Edges": 5}, selected="First Edges")
flip_matrix = FlipMatrix(Data=divide_surface.Points)
twisted_box_two_surfaces = TwistedBoxTwoSurfaces(
    SurfaceA=offset_surface,
    SurfaceB=brep_3,
    ParametersU=series,
    ParametersV=series_2,
    ParametersW=W,
    Refit=0,
    PointSample=0)
average = Average(Input=flip_matrix)
tsp_from_mesh = TSPFromMesh(Mesh=remesh, FirstEdge=0, Algorithm=list, Seed=0)  # -> TSPCurve, Points, Indexes, Indexes_2, Errors
deconstruct = Deconstruct(Point=average)  # -> XComponent, YComponent, flatten(ZComponent)
data = Data(twisted_box_two_surfaces)
weaverbird_s_catmull_clark_subdivision = WeaverbirdsCatmullClarkSubdivision(MeshCurves=remesh, Level="3", SmoothNakedEdges=1)
bounds = Bounds(Numbers=deconstruct.ZComponent)
panel = Panel("""0.5
0.75
0.5
0.25""")
panel_2 = Panel("""0.25
0.5
0.75
0.5""")
panel_3 = Panel("""0
0.25
0.75
1
1
0.75
0.25
0""")
panel_4 = Panel("""0.25
0
0
0.25
0.75
1
1
0.75""")
panel_5 = Panel("""0
0.4
0.6
1
1
0.6
0.4
0""")
panel_6 = Panel("""0.4
0
0
0.4
0.6
1
1
0.6""")
remap_numbers = RemapNumbers(Value=deconstruct.ZComponent, Source=bounds, Target=Domain(0, 1))  # -> Mapped, Clipped
deconstruct_mesh = DeconstructMesh(Mesh=weaverbird_s_catmull_clark_subdivision)  # -> Vertices, Faces, Colours, Normals
evaluate_twisted_box = EvaluateTwistedBox(TwistedBox=data, ParameterU=graft(panel), ParameterV=graft(panel_2), ParameterW="0.5")  # -> simplify(Evaluation), ResultBoolean
graph_mapper = GraphMapper(
    remap_numbers.Mapped,
    x0=0,
    x1=1,
    y0=0,
    y1=1,
    container_name="Bezier",
    cpx=[0, 0.5472465158, 0.5176815987, 1],
    cpy=[0, 0.1200000048, 0.8591303825, 1])
evaluate_twisted_box_2 = EvaluateTwistedBox(TwistedBox=data, ParameterU=graft(panel_3), ParameterV=graft(panel_4), ParameterW="0")  # -> simplify(Evaluation), ResultBoolean
evaluate_twisted_box_3 = EvaluateTwistedBox(TwistedBox=data, ParameterU=graft(panel_5), ParameterV=graft(panel_6), ParameterW="1")  # -> simplify(Evaluation), ResultBoolean
curve_closest_point = CurveClosestPoint(Point=deconstruct_mesh.Vertices, Curve=tsp_from_mesh.TSPCurve)  # -> Point, Parameter, Distance
graft_tree = GraftTree(Tree=graph_mapper, IncludeEmptyLists=True, IncludeNullItems=True)
flip_matrix_2 = FlipMatrix(Data=evaluate_twisted_box_3.Evaluation)
flip_matrix_3 = FlipMatrix(Data=evaluate_twisted_box.Evaluation)
rotate = Rotate(Geometry=flip_matrix, Angle=graft_tree, Plane=average)  # -> simplify(Geometry), Transform
flip_matrix_4 = FlipMatrix(Data=evaluate_twisted_box_2.Evaluation)
bounds_2 = Bounds(Numbers=curve_closest_point.Distance)
polyline = PolyLine(Vertices=flip_matrix_4, Closed=invert(False))
polyline_2 = PolyLine(Vertices=flip_matrix_3, Closed=invert(False))
polyline_3 = PolyLine(Vertices=flip_matrix_2, Closed=invert(False))
flip_matrix_5 = FlipMatrix(Data=rotate.Geometry)
remap_numbers_2 = RemapNumbers(Value=curve_closest_point.Distance, Source=bounds_2, Target=Domain(0, 1))  # -> Mapped, Clipped
list_item = ListItem(List=flip_matrix_5, Index=0, Wrap=True)  # -> Item1, Item
explode = Explode(Curve=polyline_2, Recursive=True)  # -> Segments, Vertices
explode_2 = Explode(Curve=polyline, Recursive=True)  # -> Segments, Vertices
explode_3 = Explode(Curve=polyline_3, Recursive=True)  # -> Segments, Vertices
interpolate = Interpolate(Vertices=flip_matrix_5, Degree=3, Periodic=False, KnotStyle=1)  # -> Curve, Length, Domain
line = Line(StartPoint=list_item.Item, EndPoint=list_item.Item1)
graph_mapper_2 = GraphMapper(
    remap_numbers_2.Mapped,
    x0=0,
    x1=1,
    y0=0,
    y1=1,
    container_name="Bezier",
    cpx=[0, 0.25, 0.2608695626, 1],
    cpy=[1, 0.25, 0.08874189854, 0])
curve_middle = CurveMiddle(Curve=explode_3.Segments)  # -> simplify(Midpoint)
removeduplicatelines = RemoveDuplicateLines(Lines=explode.Segments, Tolerance=0.01)  # -> flatten(UniqueLines)
curve_middle_2 = CurveMiddle(Curve=explode.Segments)
removeduplicatepts = RemoveDuplicatePts(Points=explode.Vertices, Tolerance=0.01)  # -> simplify(UniquePoints)
curve_middle_3 = CurveMiddle(Curve=explode_2.Segments)  # -> simplify(Midpoint)
loft = Loft(
    Curves=[interpolate.Curve, line],
    Options={Adjust=False, Closed=False, LoftEnds=0, LoftSimp=0, LoftType=0, Rebuild=10, Refit=0.01})
multiplication = Multiplication(A=graph_mapper_2, B=Slider(10, range=0..10))
amplitude = Amplitude(Vector=deconstruct_mesh.Normals, Amplitude=multiplication)
dispatch = Dispatch(List=curve_middle, DispatchPattern=[True, False])  # -> ListA, ListB
brep_edges = BrepEdges(Brep=loft)  # -> Naked, Interior, NonManifold
dispatch_2 = Dispatch(List=curve_middle_3, DispatchPattern=[True, False])  # -> ListA, ListB
offset_surface_2 = OffsetSurface(Surface=loft, Distance="5", Retrim=True)
move = Move(Geometry=deconstruct_mesh.Vertices, Motion=amplitude)  # -> Geometry, Transform
brep_edges_2 = BrepEdges(Brep=offset_surface_2)  # -> Naked, Interior, NonManifold
graft_tree_2 = GraftTree(Tree=brep_edges.Naked, IncludeEmptyLists=True, IncludeNullItems=True)
line_2 = Line(StartPoint=dispatch_2.ListB, EndPoint=removeduplicatepts)
line_3 = Line(StartPoint=dispatch.ListA, EndPoint=curve_middle_2)
graft_tree_3 = GraftTree(Tree=brep_edges_2.Naked, IncludeEmptyLists=True, IncludeNullItems=True)
construct_mesh = ConstructMesh(Vertices=move.Geometry, Faces=deconstruct_mesh.Faces)
loft_2 = Loft(
    Curves=[graft_tree_3, graft_tree_2],
    Options={Adjust=False, Closed=False, LoftEnds=0, LoftSimp=0, LoftType=0, Rebuild=10, Refit=0.01})  # -> simplify(Loft)
merge = Merge(Data1=explode_2.Segments, Data2=line_2, Data3=removeduplicatelines, Data4=line_3, Data5=explode_3.Segments)  # -> flatten(Result)
create_settings = CreateSettings(VoxelSize="1.5", Bandwidth=1, Isovalue=0, Adaptivity=0.1)
merge_2 = Merge(Data1=loft, Data2=loft_2, Data3=offset_surface_2)
multiplication_2 = Multiplication(A="1.5", B="1.5")
curve_to_volume = CurveToVolume(Curves=merge, CurveRadius=multiplication_2, Settings=create_settings)
smooth_volume = SmoothVolume(Volume=curve_to_volume, Width=1, Type=2, Iterations=1)
volume_to_mesh = VolumeToMesh(Volume=smooth_volume, VolumeSettings=create_settings)
