# Grasshopper definition #3_Surface_tesselation.gh (Grasshopper 1.0.7)
# plug-ins: Bifocals, Kangaroo2 Components, Exoskeleton2, Weaverbird

hexgrid = Hexagonal(Plane=PlaneXY(0, 0, 0), Size=1, ExtentX="12", ExtentY="18")  # -> Cells, Points
explode = Explode(Curve=hexgrid.Cells, Recursive=True)  # -> Segments, Vertices
panel = Panel("""0
2
4""")
duppt = RemoveDuplicatePts(Points=explode.Vertices, Tolerance=0.01)
avr = Average(Input=duppt)
item = ListItem(List=duppt, Index=panel, Wrap=True)
Z = UnitZ(Factor=Slider(0.26, range=0..1))
bbox = BoundingBox(Content=flatten(hexgrid.Cells), Plane=PlaneXY(0, 0, 0), UnionBox=True)  # -> Box, Box_2
move = Move(Geometry=avr, Motion=Z)  # -> Geometry, Transform
ln = Line(StartPoint=move.Geometry, EndPoint=item)
srf = Surface(bbox.Box)
Z_2 = UnitZ(Factor="-0.4")
orient = Orient(Geometry=ln, Source=avr, Target=graft(item))  # -> Geometry, Transform
move_2 = Move(Geometry=ln, Motion=Z_2)  # -> Geometry, Transform

cir = Circle(Plane=PlaneXY(0, 0, 0), Radius="25")
series = Series(Start=0, Step="7.5", Count=10)
bnd = Bounds(Numbers=series)
Z_3 = UnitZ(Factor=series)
remap = RemapNumbers(Value=series, Source=bnd, Target=Domain(0, 1))  # -> Mapped, Clipped
move_3 = Move(Geometry=cir, Motion=Z_3)  # -> Geometry, Transform
graph = GraphMapper(
    remap.Mapped,
    x0=0,
    x1=1,
    y0=0,
    y1=1,
    container_name="Bezier2",
    pt=[Point(0, 0.5189788342, 0), Point(0.2578629255, 0.8843025565, 0), Point(0.3659355396, 0.8300486012, 0), Point(0.5165898204, 0.5720365047, 0), Point(0.6993203759, 0.2590902448, 0), Point(0.7462764978, 0.2145797014, 0), Point(1, 0.2065907121, 0)])
panel_2 = Panel("1.2")
dom = ConstructDomain(DomainStart="0.3", DomainEnd=1)
area = Area(Geometry=move_3.Geometry)  # -> Area, Centroid
remap_2 = RemapNumbers(Value=graph, Source=Domain(0, 1), Target=dom)  # -> Mapped, Clipped
scale = Scale(Geometry=move_3.Geometry, Center=area.Centroid, Factor=remap_2.Mapped)  # -> Geometry, Transform
loft = Loft(Curves=scale.Geometry, Options={Adjust=False, Closed=False, LoftEnds=0, LoftSimp=0, LoftType=0, Rebuild=10, Refit=0.01})

map_srf = MapToSurface(Curve=orient.Geometry, Source=srf, Target=loft)
map_srf_2 = MapToSurface(Curve=move_2.Geometry, Source=srf, Target=loft)
end = EndPoints(Curve=map_srf)  # -> Start, End
end_2 = EndPoints(Curve=map_srf_2)  # -> Start, End
avr_2 = Average(Input=[end.Start, end.End])
avr_3 = Average(Input=[end_2.Start, end_2.End])
pdecon = Deconstruct(Point=avr_2)  # -> XComponent, YComponent, flatten(ZComponent)
pdecon_2 = Deconstruct(Point=avr_3)  # -> XComponent, YComponent, flatten(ZComponent)

dom_2 = ConstructDomain(DomainStart="0.2", DomainEnd="0.05")
bnd_2 = Bounds(Numbers=pdecon.ZComponent)
remap_3 = RemapNumbers(Value=pdecon.ZComponent, Source=bnd_2, Target=dom_2)  # -> Mapped, Clipped

dom_3 = ConstructDomain(DomainStart="0.8", DomainEnd="0.2")
bnd_3 = Bounds(Numbers=pdecon.ZComponent)
remap_4 = RemapNumbers(Value=pdecon.ZComponent, Source=bnd_3, Target=dom_3)  # -> Mapped, Clipped

dom_4 = ConstructDomain(DomainStart="1.3", DomainEnd="0.4")
bnd_4 = Bounds(Numbers=pdecon.ZComponent)
remap_5 = RemapNumbers(Value=pdecon.ZComponent, Source=bnd_4, Target=dom_4)  # -> Mapped, Clipped

dom_5 = ConstructDomain(DomainStart="0.2", DomainEnd="0.05")
bnd_5 = Bounds(Numbers=pdecon_2.ZComponent)
remap_6 = RemapNumbers(Value=pdecon_2.ZComponent, Source=bnd_5, Target=dom_5)  # -> Mapped, Clipped

dom_6 = ConstructDomain(DomainStart="0.8", DomainEnd="0.4")
bnd_6 = Bounds(Numbers=pdecon_2.ZComponent)
remap_7 = RemapNumbers(Value=pdecon_2.ZComponent, Source=bnd_6, Target=dom_6)  # -> Mapped, Clipped

dom_7 = ConstructDomain(DomainStart="1.3", DomainEnd="0.4")
bnd_7 = Bounds(Numbers=pdecon_2.ZComponent)
remap_8 = RemapNumbers(Value=pdecon_2.ZComponent, Source=bnd_7, Target=dom_7)  # -> Mapped, Clipped

exow = ExoWireframe(
    Lines=map_srf,
    Sides=6,
    StartRadius=graft(remap_4.Mapped),
    EndRadius=graft(remap_3.Mapped),
    NodeDepth=graft(remap_5.Mapped),
    Division="4",
    Open=False)
exow_2 = ExoWireframe(
    Lines=map_srf_2,
    Sides=6,
    StartRadius=graft(remap_7.Mapped),
    EndRadius=graft(remap_6.Mapped),
    NodeDepth=graft(remap_8.Mapped),
    Division="4",
    Open=False)
mjoin = MeshJoin(Meshes=exow_2)
mjoin_2 = MeshJoin(Meshes=exow)
weld = WeldMesh(Mesh=mjoin, Angle=3.141592654)
weld_2 = WeldMesh(Mesh=mjoin_2, Angle=3.141592654)
wbcatmullclark = WeaverbirdsCatmullClarkSubdivision(MeshCurves=weld, Level="2", SmoothNakedEdges=1)  # -> flatten(OutputMeshCurves)
wbcatmullclark_2 = WeaverbirdsCatmullClarkSubdivision(MeshCurves=weld_2, Level="2", SmoothNakedEdges=1)  # -> flatten(OutputMeshCurves)
lng = ListLength(List=wbcatmullclark)
lng_2 = ListLength(List=wbcatmullclark_2)
series_2 = Series(Start=0, Step=1, Count=lng)
series_3 = Series(Start=0, Step=1, Count=lng_2)
bnd_8 = Bounds(Numbers=series_2)
bnd_9 = Bounds(Numbers=series_3)
dedomain = DeconstructDomain(Domain=bnd_8)  # -> Start, End
dedomain_2 = DeconstructDomain(Domain=bnd_9)  # -> Start, End
gradient = Gradient(LowerLimit=dedomain.Start, UpperLimit=dedomain.End, Parameter=series_2, stops=[0: RGB(0, 0, 0), 1: RGB(240, 230, 140)])
gradient_2 = Gradient(
    LowerLimit=dedomain_2.Start,
    UpperLimit=dedomain_2.End,
    Parameter=series_3,
    stops=[0: RGB(0, 0, 0), 1: RGB(240, 230, 140)])
mcol = MeshColours(Mesh=graft(wbcatmullclark), Colours=graft(gradient))
mcol_2 = MeshColours(Mesh=graft(wbcatmullclark_2), Colours=graft(gradient_2))
