# Grasshopper definition #40_Temple_Galaxia.gh (Grasshopper 1.0.7)
# plug-ins: Bifocals

scaler = Slider(52.53, range=0..100)
fibonacci = Fibonacci(SeedA="0.01", SeedB="0.02", Number="8")
sine = Sine(Value=fibonacci)
list_length = ListLength(List=fibonacci)
series = Series(Start=0, Step="1", Count=list_length)
multiplication = Multiplication(A=sine, B=scaler)
pi = Pi(Factor="2")
construct_point = ConstructPoint(XCoordinate=series, YCoordinate=multiplication, ZCoordinate=0)
division = Division(A=pi, B="22")
interpolate = Interpolate(Vertices=construct_point, Degree=3, Periodic=False, KnotStyle=1)  # -> Curve, Length, Domain
series_2 = Series(Start=0, Step=division, Count="22")
rotate = Rotate(Geometry=interpolate.Curve, Angle=series_2, Plane=PlaneXY(0, 0, 0))  # -> Geometry, Transform
curve = Curve(rotate.Geometry)
curve_2 = Curve(curve)
circle = Circle(Plane=PlaneXY(0, 0, 0), Radius="20")
circle_2 = Circle(Plane=PlaneXY(0, 0, 0), Radius="1")
graft_tree = GraftTree(Tree=curve_2, IncludeEmptyLists=True, IncludeNullItems=True)
merge = Merge(Data1=circle_2, Data2=circle)
curve_curve = CurveCurve(CurveA=graft_tree, CurveB=merge)  # -> Points, simplify(ParamsA), ParamsB
unit_z = UnitZ(Factor=1)
loft = Loft(Curves=merge, Options={Adjust=False, Closed=False, LoftEnds=0, LoftSimp=0, LoftType=0, Rebuild=10, Refit=0.01})
trim_tree = TrimTree(Tree=curve_curve.ParamsA, Depth=1)
extrude = Extrude(Base=loft, Direction=unit_z)
shatter = Shatter(Curve=graft_tree, Parameters=trim_tree)
curve_middle = CurveMiddle(Curve=shatter)
point_in_brep = PointInBrep(Brep=extrude, Point=curve_middle, Strict=False)
dispatch = Dispatch(List=shatter, DispatchPattern=point_in_brep)  # -> flatten(ListA), ListB
curve_3 = Curve(dispatch.ListA)
curve_4 = Curve(curve_3)
divide_curve = DivideCurve(Curve=curve_4, Count=10, Kinks=False)  # -> Points, Tangents, Parameters
list_length_2 = ListLength(List=divide_curve.Points)
series_3 = Series(Start=0, Step=1, Count=list_length_2)
bounds = Bounds(Numbers=series_3)
remap_numbers = RemapNumbers(Value=series_3, Source=bounds, Target=Domain(0, 1))  # -> Mapped, Clipped
graph_mapper = GraphMapper(
    remap_numbers.Mapped,
    x0=0,
    x1=1,
    y0=0,
    y1=1,
    container_name="Bezier",
    cpx=[0, 0.03357641399, 0.4916779995, 1],
    cpy=[1, 0.2872044444, 0.2003235817, 0.1241906285])
multiplication_2 = Multiplication(A=graph_mapper, B=Slider(13.68, range=0..100))
unit_z_2 = UnitZ(Factor=multiplication_2)
move = Move(Geometry=divide_curve.Points, Motion=unit_z_2)  # -> Geometry, Transform
point = Point(move.Geometry)
point_2 = Point(point)
interpolate_2 = Interpolate(Vertices=point_2, Degree=3, Periodic=False, KnotStyle=1)  # -> simplify(Curve), Length, Domain
relative_item = RelativeItem(Tree=interpolate_2.Curve, Offset="{+1}", WrapPaths=invert(False), WrapItems=False)  # -> ItemA, ItemB
number_slider = Slider(20, range=10..40)
relative_item_2 = RelativeItem(Tree=interpolate_2.Curve, Offset="{-1}", WrapPaths=invert(False), WrapItems=False)  # -> ItemA, ItemB
tween_curve = TweenCurve(CurveA=relative_item.ItemA, CurveB=relative_item.ItemB, Factor=0.5, BlendType=0)
divide_curve_2 = DivideCurve(Curve=relative_item_2.ItemA, Count=number_slider, Kinks=False)  # -> simplify(Points), Tangents, Parameters
divide_curve_3 = DivideCurve(Curve=relative_item_2.ItemB, Count=number_slider, Kinks=False)  # -> simplify(Points), Tangents, Parameters
divide_curve_4 = DivideCurve(Curve=tween_curve, Count="20", Kinks=False)  # -> Points, Tangents, Parameters
deconstruct = Deconstruct(Point=divide_curve_4.Points)  # -> XComponent, YComponent, ZComponent
relative_items = RelativeItems(TreeA=divide_curve_2.Points, TreeB=divide_curve_3.Points, Offset="{+0}[+1]", WrapPaths=False, WrapItems=False)  # -> ItemA, ItemB
relative_items_2 = RelativeItems(TreeA=divide_curve_2.Points, TreeB=divide_curve_3.Points, Offset="{+0}[+2]", WrapPaths=False, WrapItems=False)  # -> ItemA, ItemB
list_length_3 = ListLength(List=deconstruct.ZComponent)
line = Line(StartPoint=relative_items_2.ItemA, EndPoint=relative_items_2.ItemB)
line_2 = Line(StartPoint=relative_items.ItemA, EndPoint=relative_items.ItemB)
series_4 = Series(Start=0, Step=1, Count=list_length_3)
merge_2 = Merge(Data1=line, Data2=line_2)
X = Number(deconstruct.XComponent)
Y = Number(deconstruct.YComponent)
number = Number(series_4)
curve_a = Curve(relative_item.ItemA)
curve_b = Curve(relative_item.ItemB)
curve_5 = Curve(merge_2)
point_3 = Point(divide_curve_2.Points)
X_2 = Number(X)
Y_2 = Number(Y)
number_2 = Number(number)
curve_a_2 = Curve(curve_a)
curve_b_2 = Curve(curve_b)
curve_6 = Curve(curve_5)
point_4 = Point(point_3)
bounds_2 = Bounds(Numbers=number_2)
remap_numbers_2 = RemapNumbers(Value=number_2, Source=bounds_2, Target=Domain(0, 1))  # -> Mapped, Clipped
graph_mapper_2 = GraphMapper(
    remap_numbers_2.Mapped,
    x0=0,
    x1=1,
    y0=0,
    y1=1,
    container_name="Bezier2",
    pt=[Point(0, 0.593742013, 0), Point(0.2279811502, 0.101987958, 0), Point(0.2248865068, 0.1019092798, 0), Point(0.556442678, 0.02774399519, 0), Point(0.6801836274, 6.457452722e-05, 0), Point(0.8391080499, 0, 0), Point(1, 0, 0)])
multiplication_3 = Multiplication(A=graph_mapper_2, B=Slider(20, range=0..100))
construct_point_2 = ConstructPoint(XCoordinate=X_2, YCoordinate=Y_2, ZCoordinate=multiplication_3)
interpolate_3 = Interpolate(Vertices=construct_point_2, Degree=3, Periodic=False, KnotStyle=1)  # -> simplify(Curve), Length, Domain
divide_curve_5 = DivideCurve(Curve=interpolate_3.Curve, Count=Slider(20, range=10..40), Kinks=False)  # -> simplify(Points), Tangents, Parameters
merge_3 = Merge(Data1=curve_a_2, Data2=interpolate_3.Curve, Data3=curve_b_2)
main_branch = Curve(merge_3)
point_5 = Point(point_4)
curve_7 = Curve(curve_6)
point_6 = Point(divide_curve_5.Points)
point_7 = Point(point_5)
curve_8 = Curve(curve_7)
point_8 = Point(point_6)
main_branch_2 = Curve(main_branch)
relative_items_3 = RelativeItems(TreeA=point_7, TreeB=point_8, Offset="{-1}[+1]", WrapPaths=False, WrapItems=False)  # -> ItemA, ItemB
line_3 = Line(StartPoint=point_7, EndPoint=point_8)
relative_items_4 = RelativeItems(TreeA=point_7, TreeB=point_8, Offset="{-1}[+2]", WrapPaths=False, WrapItems=False)  # -> ItemA, ItemB
relative_items_5 = RelativeItems(TreeA=point_7, TreeB=point_8, Offset="{+0}[+1]", WrapPaths=False, WrapItems=False)  # -> ItemA, ItemB
line_4 = Line(StartPoint=relative_items_3.ItemA, EndPoint=relative_items_3.ItemB)
line_5 = Line(StartPoint=relative_items_5.ItemA, EndPoint=relative_items_5.ItemB)
line_6 = Line(StartPoint=relative_items_4.ItemA, EndPoint=relative_items_4.ItemB)
merge_4 = Merge(Data1=line_5, Data2=line_6)
merge_5 = Merge(Data1=curve_8, Data2=line_3, Data3=line_4)
sub_branch_a = Curve(merge_5)
sub_branch_b = Curve(merge_4)
main_branch_3 = Curve(main_branch_2)
sub_branch_a_2 = Curve(graft(sub_branch_a))
sub_branch_b_2 = Curve(graft(sub_branch_b))
main_branch_4 = Curve(graft(main_branch_3))
panel = Panel("""0
1""")
series_5 = Series(Start=0, Step="0.1", Count="11")
panel_2 = Panel("""0
1""")
unit_z_3 = UnitZ(Factor=1)
evaluate_curve = EvaluateCurve(Curve=reparameterize(sub_branch_b_2), Parameter=panel)  # -> Point, Tangent, Angle
unit_z_4 = UnitZ(Factor=1)
evaluate_curve_2 = EvaluateCurve(Curve=reparameterize(sub_branch_a_2), Parameter=panel_2)  # -> Point, Tangent, Angle
evaluate_curve_3 = EvaluateCurve(Curve=reparameterize(main_branch_4), Parameter=series_5)  # -> Point, Tangent, Angle
unit_z_5 = UnitZ(Factor=1)
cross_product = CrossProduct(VectorA=evaluate_curve.Tangent, VectorB=unit_z_4, Unitize=False)  # -> Vector, Length
cross_product_2 = CrossProduct(VectorA=evaluate_curve_2.Tangent, VectorB=unit_z_5, Unitize=False)  # -> Vector, Length
cross_product_3 = CrossProduct(VectorA=evaluate_curve_3.Tangent, VectorB=unit_z_3, Unitize=False)  # -> Vector, Length
cross_product_4 = CrossProduct(VectorA=evaluate_curve.Tangent, VectorB=cross_product.Vector, Unitize=False)  # -> Vector, Length
negative = Negative(Value="0.05")
negative_2 = Negative(Value="0.025")
negative_3 = Negative(Value="0.2")
cross_product_5 = CrossProduct(VectorA=evaluate_curve_2.Tangent, VectorB=cross_product_2.Vector, Unitize=False)  # -> Vector, Length
negative_4 = Negative(Value="0.1")
cross_product_6 = CrossProduct(VectorA=evaluate_curve_3.Tangent, VectorB=cross_product_3.Vector, Unitize=False)  # -> Vector, Length
negative_5 = Negative(Value="0.1")
negative_6 = Negative(Value="0.05")
construct_domain = ConstructDomain(DomainStart=negative_2, DomainEnd="0.025")
construct_domain_2 = ConstructDomain(DomainStart=negative, DomainEnd="0.05")
construct_domain_3 = ConstructDomain(DomainStart=negative_4, DomainEnd="0.1")
construct_plane = ConstructPlane(Origin=evaluate_curve.Point, XAxis=cross_product_4.Vector, YAxis=cross_product.Vector)
construct_domain_4 = ConstructDomain(DomainStart=negative_3, DomainEnd="0.2")
construct_domain_5 = ConstructDomain(DomainStart=negative_6, DomainEnd="0.05")
construct_domain_6 = ConstructDomain(DomainStart=negative_5, DomainEnd="0.1")
construct_plane_2 = ConstructPlane(Origin=evaluate_curve_2.Point, XAxis=cross_product_5.Vector, YAxis=cross_product_2.Vector)
construct_plane_3 = ConstructPlane(Origin=evaluate_curve_3.Point, XAxis=cross_product_6.Vector, YAxis=cross_product_3.Vector)
rectangle = Rectangle(Plane=construct_plane, XSize=construct_domain_2, YSize=construct_domain, Radius=0)  # -> Rectangle, Length
rectangle_2 = Rectangle(Plane=construct_plane_2, XSize=construct_domain_6, YSize=construct_domain_5, Radius=0)  # -> Rectangle, Length
rectangle_3 = Rectangle(Plane=construct_plane_3, XSize=construct_domain_4, YSize=construct_domain_3, Radius=0)  # -> Rectangle, Length
loft_2 = Loft(
    Curves=rectangle.Rectangle,
    Options={Adjust=False, Closed=False, LoftEnds=0, LoftSimp=0, LoftType=0, Rebuild=10, Refit=0.01})
loft_3 = Loft(
    Curves=rectangle_2.Rectangle,
    Options={Adjust=False, Closed=False, LoftEnds=0, LoftSimp=0, LoftType=0, Rebuild=10, Refit=0.01})
loft_4 = Loft(
    Curves=rectangle_3.Rectangle,
    Options={Adjust=False, Closed=False, LoftEnds=0, LoftSimp=0, LoftType=0, Rebuild=10, Refit=0.01})
cap_holes = CapHoles(Brep=loft_2)
cap_holes_2 = CapHoles(Brep=loft_3)
cap_holes_3 = CapHoles(Brep=loft_4)
