# Grasshopper definition #41_Fibonacci_sequence.gh (Grasshopper 1.0.7)
# plug-ins: Bifocals

secquence_step = Slider(0.474, range=0..1)
number_pre_branch = Slider(37, range=0..200)
# Blade
height = Slider(0.284, range=0..1)

# ----
# point
number_slider = Slider(10, range=0..10)
construct_point = ConstructPoint(XCoordinate=0, YCoordinate=0, ZCoordinate=number_slider)
construct_point_2 = ConstructPoint(XCoordinate=0, YCoordinate=0, ZCoordinate=0)

# ----
# vector
number_slider_2 = Slider(5.039, range=0..10)
number_slider_3 = Slider(8.409, range=0..10)
number_slider_4 = Slider(0.503, range=0..10)
number_slider_5 = Slider(0.538, range=0..10)
negative = Negative(Value=number_slider_2)
negative_2 = Negative(Value=number_slider_4)
negative_3 = Negative(Value=Slider(2.847, range=0..10))
negative_4 = Negative(Value=Slider(2.18, range=0..10))
negative_5 = Negative(Value=number_slider_3)
vector_xyz = VectorXYZ(XComponent=0, YComponent=number_slider_4, ZComponent=negative)  # -> Vector, Length
vector_xyz_2 = VectorXYZ(XComponent=0, YComponent=number_slider_3, ZComponent=number_slider_5)  # -> Vector, Length
vector_xyz_3 = VectorXYZ(XComponent=0, YComponent=negative_5, ZComponent=number_slider_5)  # -> Vector, Length
vector_xyz_4 = VectorXYZ(XComponent=0, YComponent=negative_2, ZComponent=negative)  # -> Vector, Length
vector_xyz_5 = VectorXYZ(XComponent=Slider(0.884, range=0..10), YComponent=0, ZComponent=0)  # -> Vector, Length
vector_xyz_6 = VectorXYZ(XComponent=Slider(1.18, range=0..10), YComponent=0, ZComponent=negative_3)  # -> Vector, Length
vector_xyz_7 = VectorXYZ(XComponent=Slider(4.628, range=0..10), YComponent=0, ZComponent=0)  # -> Vector, Length
vector_xyz_8 = VectorXYZ(XComponent=Slider(1.428, range=0..10), YComponent=0, ZComponent=negative_4)  # -> Vector, Length

series = Series(Start="0.15", Step=secquence_step, Count=number_pre_branch)
series_2 = Series(Start="0.15", Step=secquence_step, Count=number_pre_branch)
series_3 = Series(Start=0, Step=height, Count=number_pre_branch)
sine = Sine(Value=series)
cosine = Cosine(Value=series_2)
reverse_list = ReverseList(List=series_3)
end_point = Point(construct_point)
start_point = Point(construct_point_2)
multiplication = Multiplication(A=sine, B=series)
multiplication_2 = Multiplication(A=cosine, B=series_2)
bezier_span = BezierSpan(StartPoint=start_point, StartTangent=vector_xyz_3.Vector, EndPoint=end_point, EndTangent=vector_xyz_4.Vector)  # -> Curve, Length, Domain
construct_point_3 = ConstructPoint(XCoordinate=multiplication, YCoordinate=multiplication_2, ZCoordinate=reverse_list)
bezier_span_2 = BezierSpan(StartPoint=start_point, StartTangent=vector_xyz_7.Vector, EndPoint=end_point, EndTangent=vector_xyz_8.Vector)  # -> Curve, Length, Domain
bezier_span_3 = BezierSpan(StartPoint=start_point, StartTangent=vector_xyz_5.Vector, EndPoint=end_point, EndTangent=vector_xyz_6.Vector)  # -> Curve, Length, Domain
bezier_span_4 = BezierSpan(StartPoint=start_point, StartTangent=vector_xyz_2.Vector, EndPoint=end_point, EndTangent=vector_xyz.Vector)  # -> Curve, Length, Domain
interpolate = Interpolate(Vertices=construct_point_3, Degree=3, Periodic=False, KnotStyle=1)  # -> Curve, Length, Domain
branch = Panel("5")
merge = Merge(Data1=bezier_span_4.Curve, Data2=bezier_span_2.Curve, Data3=bezier_span.Curve)
merge_2 = Merge(Data1=bezier_span_4.Curve, Data2=bezier_span_3.Curve, Data3=bezier_span.Curve)
polar_array = PolarArray(Geometry=construct_point_3, Plane=PlaneXY(0, 0, 0), Count=branch, Angle=6.283185307)  # -> simplify(Geometry), Transform
polar_array_2 = PolarArray(Geometry=interpolate.Curve, Plane=PlaneXY(0, 0, 0), Count=branch, Angle=6.283185307)  # -> Geometry, Transform
loft = Loft(Curves=merge, Options={Adjust=False, Closed=False, LoftEnds=0, LoftSimp=0, LoftType=0, Rebuild=10, Refit=0.01})
loft_2 = Loft(Curves=merge_2, Options={Adjust=False, Closed=False, LoftEnds=0, LoftSimp=0, LoftType=1, Rebuild=10, Refit=0.01})
brep = Brep(loft_2)
brep_2 = Brep(loft)
curve = Curve(polar_array_2.Geometry)
point = Point(polar_array.Geometry)
point_2 = Point(point)
brep_3 = Brep(brep_2)
curve_2 = Curve(curve)
brep_4 = Brep(brep)
graft_tree = GraftTree(Tree=curve_2, IncludeEmptyLists=True, IncludeNullItems=True)
brep_join = BrepJoin(Breps=[brep_4, brep_3])  # -> Breps, Closed
flip_matrix = FlipMatrix(Data=point_2)

# ----
# align plane
number_slider_6 = Slider(0.42, range=0..1)
construct_domain = ConstructDomain(DomainStart=number_slider_6, DomainEnd=Slider(0.16, range=0..1))

# ----
# scale
number_slider_7 = Slider(0.6, range=0..1)
construct_domain_2 = ConstructDomain(DomainStart=number_slider_7, DomainEnd=Slider(2, range=0..2))

curve_closest_point = CurveClosestPoint(Point=flip_matrix, Curve=graft_tree)  # -> Point, Parameter, Distance
mesh_brep = MeshBrep(
    Brep=brep_join.Breps,
    Settings={GridMaxCount=0, GridMinCount=16, JaggedSeams=False, MaxEdgeLength=0, MinEdgeLength=0.0001, MinTolerance=0, Refine=True, RefineAngle=0, RelativeTolerance=0.65, SimplePlanes=True, Tolerance=0})
deconstruct_mesh = DeconstructMesh(Mesh=mesh_brep)  # -> Vertices, Faces, Colours, Normals
evaluate_curve = EvaluateCurve(Curve=graft_tree, Parameter=curve_closest_point.Parameter)  # -> Point, Tangent, Angle
deconstruct = Deconstruct(Point=deconstruct_mesh.Vertices)  # -> XComponent, YComponent, ZComponent
unit_z = UnitZ(Factor=1)
negative_6 = Negative(Value=construct_domain)
number = Number(curve_closest_point.Parameter)
bounds = Bounds(Numbers=deconstruct.ZComponent)
cross_product = CrossProduct(VectorA=evaluate_curve.Tangent, VectorB=unit_z, Unitize=False)  # -> Vector, Length
bounds_2 = Bounds(Numbers=number)
deconstruct_domain = DeconstructDomain(Domain=bounds)  # -> Start, End
construct_plane = ConstructPlane(Origin=evaluate_curve.Point, XAxis=cross_product.Vector, YAxis=evaluate_curve.Tangent)
pi = Pi(Factor=1)
line_sdl = LineSDL(Start=evaluate_curve.Point, Direction=evaluate_curve.Tangent, Length=1)
remap_numbers = RemapNumbers(Value=number, Source=bounds_2, Target=negative_6)  # -> Mapped, Clipped
remap_numbers_2 = RemapNumbers(Value=number, Source=bounds_2, Target=construct_domain_2)  # -> Mapped, Clipped
gradient = Gradient(
    LowerLimit=deconstruct_domain.Start,
    UpperLimit=deconstruct_domain.End,
    Parameter=deconstruct.ZComponent,
    stops=[0: RGB(0, 98, 0), 0.25: RGB(81, 175, 17), 0.5: RGB(159, 198, 146), 0.75: RGB(170, 235, 41), 1: RGB(221, 255, 53)])
rotate_plane = RotatePlane(Plane=construct_plane, Angle=pi)
pi_2 = Pi(Factor=remap_numbers.Mapped)
construct_mesh = ConstructMesh(Vertices=deconstruct_mesh.Vertices, Faces=deconstruct_mesh.Faces, Colours=gradient)
rotate_axis = RotateAxis(Geometry=rotate_plane, Angle=pi_2, Axis=line_sdl)  # -> Geometry, Transform
mesh = Mesh(construct_mesh)
number_2 = Number(remap_numbers_2.Mapped)
plane = Plane(rotate_axis.Geometry)
mesh_2 = Mesh(mesh)
plane_2 = Plane(plane)
number_3 = Number(number_2)
orient = Orient(Geometry=mesh_2, Source=PlaneXY(0, 0, 0), Target=plane_2)  # -> Geometry, Transform
scale = Scale(Geometry=orient.Geometry, Center=plane_2, Factor=number_3)  # -> Geometry, Transform
