# Grasshopper definition #42_Gradient_mesh_modeling.gh (Grasshopper 1.0.7)
# plug-ins: Kangaroo2 Components, Weaverbird

attractor_point = Point(Point(7.484440052, 4.166516151, 0))
x = Panel("15")
y = Panel("30")
mesh_count = Panel("15")
rectangle = Rectangle(Plane=PlaneXY(0, 0, 0), XSize=x, YSize=y, Radius=0)  # -> Rectangle, Length
mesh_plane = MeshPlane(Boundary=rectangle.Rectangle, WidthCount=mesh_count, HeightCount=mesh_count)  # -> Mesh, Area
deconstruct_mesh = DeconstructMesh(Mesh=mesh_plane.Mesh)  # -> Vertices, Faces, Colours, Normals
addition = Addition(A=mesh_count, B="1")
distance = Distance(PointA=attractor_point, PointB=deconstruct_mesh.Vertices)
bounds = Bounds(Numbers=distance)
remap_numbers = RemapNumbers(Value=distance, Source=bounds, Target=Domain(0, 1))  # -> Mapped, Clipped
graph_mapper = GraphMapper(
    remap_numbers.Mapped,
    x0=0,
    x1=1,
    y0=0,
    y1=1,
    container_name="Polyline",
    pt=[Point(0, 1, 0), Point(0.09756867588, 1, 0), Point(0.2519365251, 0, 0), Point(0.6968932152, 0, 0), Point(1, 0, 0)])
partition_list = PartitionList(List=graph_mapper, Size=addition)
partition_list_2 = PartitionList(List=deconstruct_mesh.Vertices, Size=addition)
number = Number(partition_list)
point = Point(partition_list_2)
number_2 = Number(number)
point_2 = Point(point)
flip_matrix = FlipMatrix(Data=number_2)  # -> simplify(Data)
flip_matrix_2 = FlipMatrix(Data=point_2)  # -> simplify(Data)
split_tree = SplitTree(Data=flip_matrix_2, Masks=flatten("{0,2,...}"))  # -> Positive, Negative
split_tree_2 = SplitTree(Data=flip_matrix, Masks=flatten("{0,2,...}"))  # -> Positive, Negative
polyline = PolyLine(Vertices=split_tree.Negative, Closed=False)
polyline_2 = PolyLine(Vertices=split_tree.Positive, Closed=False)
explode = Explode(Curve=polyline_2, Recursive=True)  # -> Segments, Vertices
explode_2 = Explode(Curve=polyline, Recursive=True)  # -> Segments, Vertices
curve_middle = CurveMiddle(Curve=explode_2.Segments)  # -> simplify(Midpoint)
curve_middle_2 = CurveMiddle(Curve=explode.Segments)  # -> simplify(Midpoint)
list_length = ListLength(List=curve_middle_2)
list_length_2 = ListLength(List=curve_middle)
series = Series(Start=0, Step=1, Count=list_length)
series_2 = Series(Start=0, Step=1, Count=list_length_2)
scaler = Slider(0.222, range=0..1)
power = Power(A="-1", B=series)
power_2 = Power(A="-1", B=series_2)
multiplication = Multiplication(A=power, B=scaler, C=split_tree_2.Positive)
number_3 = Number(power_2)
point_3 = Point(explode_2.Vertices)
point_4 = Point(explode.Vertices)
point_5 = Point(curve_middle)
number_4 = Number(split_tree_2.Negative)
number_5 = Number(multiplication)
point_6 = Point(curve_middle_2)
number_6 = Number(number_3)
point_7 = Point(point_3)
point_8 = Point(point_4)
point_9 = Point(point_5)
scaler_2 = Slider(0.222, range=0..1)
number_7 = Number(number_4)
number_8 = Number(number_5)
point_10 = Point(point_6)
negative = Negative(Value=number_6)
unit_x = UnitX(Factor=number_8)
multiplication_2 = Multiplication(A=number_7, B=negative, C=scaler_2)
unit_x_2 = UnitX(Factor=multiplication_2)
move = Move(Geometry=point_9, Motion=unit_x_2)  # -> simplify(Geometry), Transform
move_2 = Move(Geometry=point_10, Motion=unit_x)  # -> simplify(Geometry), Transform
point_11 = Point(simplify(point_8))
point_12 = Point(simplify(point_7))
relative_items = RelativeItems(TreeA=point_11, TreeB=move_2.Geometry, Offset="{+0}[+0]", WrapPaths=False, WrapItems=False)  # -> ItemA, ItemB
relative_items_2 = RelativeItems(TreeA=move.Geometry, TreeB=point_12, Offset="{+0}[+1]", WrapPaths=False, WrapItems=False)  # -> ItemA, ItemB
relative_items_3 = RelativeItems(TreeA=point_12, TreeB=move.Geometry, Offset="{+0}[+0]", WrapPaths=False, WrapItems=False)  # -> ItemA, ItemB
relative_items_4 = RelativeItems(TreeA=move_2.Geometry, TreeB=point_11, Offset="{+0}[+1]", WrapPaths=False, WrapItems=False)  # -> ItemA, ItemB
shortest_list = ShortestList(ListListA=relative_items.ItemA, ListListB=relative_items.ItemB, ListA=relative_items_4.ItemB, TrimMode=2)  # -> ListListA, ListListB, ListA
shortest_list_2 = ShortestList(ListListA=relative_items_3.ItemA, ListListB=relative_items_3.ItemB, ListA=relative_items_2.ItemB, TrimMode=2)  # -> ListListA, ListListB, ListA
panel = Panel("""0
1
2""")
panel_2 = Panel("""0
1
2""")
weave = Weave(
    Pattern=panel,
    Stream0=shortest_list_2.ListListA,
    Stream1=shortest_list_2.ListListB,
    Stream2=shortest_list_2.ListA,
    NullGaps=False)
weave_2 = Weave(
    Pattern=panel_2,
    Stream0=shortest_list.ListListA,
    Stream1=shortest_list.ListListB,
    Stream2=shortest_list.ListA,
    NullGaps=False)
partition_list_3 = PartitionList(List=weave_2, Size="3")
partition_list_4 = PartitionList(List=weave, Size="3")
point_13 = Point(partition_list_4)
point_14 = Point(partition_list_3)
point_15 = Point(point_13)
point_16 = Point(point_14)
polyline_3 = PolyLine(Vertices=point_15, Closed=False)
polyline_4 = PolyLine(Vertices=point_16, Closed=False)
relative_items_5 = RelativeItems(TreeA=polyline_4, TreeB=polyline_3, Offset="{+1;+0}", WrapPaths=False, WrapItems=False)  # -> ItemA, ItemB
relative_items_6 = RelativeItems(TreeA=polyline_3, TreeB=polyline_4, Offset="{+1;+0}", WrapPaths=False, WrapItems=False)  # -> ItemA, ItemB
loft = Loft(
    Curves=[relative_items_5.ItemA, relative_items_5.ItemB],
    Options={Adjust=False, Closed=False, LoftEnds=0, LoftSimp=0, LoftType=0, Rebuild=10, Refit=0.01})  # -> flatten(Loft)
loft_2 = Loft(
    Curves=[relative_items_6.ItemA, relative_items_6.ItemB],
    Options={Adjust=False, Closed=False, LoftEnds=0, LoftSimp=0, LoftType=0, Rebuild=10, Refit=0.01})  # -> flatten(Loft)
simple_mesh = SimpleMesh(Brep=loft)
simple_mesh_2 = SimpleMesh(Brep=loft_2)
unit_y = UnitY(Factor=1)
merge = Merge(Data1=simple_mesh, Data2=simple_mesh_2)
mesh_edges = MeshEdges(Mesh=merge)  # -> simplify(NakedEdges), InteriorEdges, NonManifoldEdges
dot_product = DotProduct(VectorA=mesh_edges.NakedEdges, VectorB=unit_y, Unitize=invert(False))
equality = Equality(FirstNumber=dot_product, SecondNumber="0")  # -> Equality, Inequality
dispatch = Dispatch(List=mesh_edges.NakedEdges, DispatchPattern=equality.Inequality)  # -> ListA, ListB
join_curves = JoinCurves(Curves=mesh_edges.NakedEdges, Preserve=False)
mesh = Mesh(merge)
curve = Curve(join_curves)
curve_2 = Curve(dispatch.ListA)
mesh_2 = Mesh(mesh)
curve_3 = Curve(curve)
curve_4 = Curve(curve_2)
join_curves_2 = JoinCurves(Curves=curve_4, Preserve=False)
negative_2 = Negative(Value="0.05")
offset_curve = OffsetCurve(Curve=join_curves_2, Distance=negative_2, Corners=1)
offset_curve_2 = OffsetCurve(Curve=join_curves_2, Distance="0.05", Corners=1)
merge_2 = Merge(Data1=offset_curve_2, Data2=offset_curve)
trim_tree = TrimTree(Tree=merge_2, Depth=1)
curve_middle_3 = CurveMiddle(Curve=trim_tree)
point_in_curve = PointInCurve(Point=curve_middle_3, Curve=curve_3)  # -> Relationship, Point
dispatch_2 = Dispatch(List=trim_tree, DispatchPattern=point_in_curve.Relationship)  # -> ListA, ListB
explode_3 = Explode(Curve=simplify(graft(dispatch_2.ListA)), Recursive=True)  # -> Segments, simplify(Vertices)
mesh_3 = Mesh(mesh_2)
curve_5 = Curve(join_curves_2)
point_17 = Point(explode_3.Vertices)
curve_6 = Curve(curve_5)
mesh_4 = Mesh(mesh_3)
point_18 = Point(point_17)
deconstruct = Deconstruct(Point=point_18)  # -> XComponent, YComponent, ZComponent
rebuild_curve = RebuildCurve(Curve=simplify(curve_6), Degree="1", Count="3", Tangents=False)
sort_list = SortList(Keys=deconstruct.YComponent, ValuesValuesA=point_18)  # -> Keys, ValuesValuesA
list_length_3 = ListLength(List=sort_list.ValuesValuesA)
tree_statistics = TreeStatistics(Tree=sort_list.ValuesValuesA)  # -> Paths, Length, Count
equality_2 = Equality(FirstNumber=list_length_3, SecondNumber="3")  # -> flatten(Equality), Inequality
dispatch_3 = Dispatch(List=tree_statistics.Paths, DispatchPattern=equality_2.Equality)  # -> ListA, ListB
end_points = EndPoints(Curve=curve_6)  # -> simplify(graft(Start)), simplify(graft(End))
mesh_5 = Mesh(mesh_4)
point_19 = Point(end_points.End)
curve_7 = Curve(rebuild_curve)
point_20 = Point(sort_list.ValuesValuesA)
point_21 = Point(end_points.Start)
data = Data(dispatch_3.ListB)
data_2 = Data(dispatch_3.ListA)
mesh_6 = Mesh(mesh_5)
point_22 = Point(point_19)
point_23 = Point(point_21)
curve_8 = Curve(curve_7)
data_3 = Data(data_2)
data_4 = Data(data)
point_24 = Point(point_20)
tree_branch = TreeBranch(Tree=point_24, Path=data_4, MaintainPaths=True)
tree_branch_2 = TreeBranch(Tree=point_24, Path=data_3, MaintainPaths=True)
tree_branch_3 = TreeBranch(Tree=point_23, Path=data_4, MaintainPaths=True)
tree_branch_4 = TreeBranch(Tree=point_22, Path=data_4, MaintainPaths=True)
list_item = ListItem(List=tree_branch, Index=0, Wrap=True)  # -> Item1, Item
tree_branch_5 = TreeBranch(Tree=point_23, Path=data_3, MaintainPaths=True)
tree_branch_6 = TreeBranch(Tree=point_22, Path=data_3, MaintainPaths=True)
list_item_2 = ListItem(List=tree_branch_2, Index=0, Wrap=True)  # -> Item1, Item
list_item_3 = ListItem(List=tree_branch_2, Index="1", Wrap=True)
deconstruct_2 = Deconstruct(Point=tree_branch_6)  # -> XComponent, YComponent, ZComponent
average = Average(Input=[list_item.Item1, list_item.Item])
deconstruct_3 = Deconstruct(Point=tree_branch_4)  # -> XComponent, YComponent, ZComponent
deconstruct_4 = Deconstruct(Point=tree_branch_5)  # -> XComponent, YComponent, ZComponent
deconstruct_5 = Deconstruct(Point=list_item.Item)  # -> XComponent, YComponent, ZComponent
deconstruct_6 = Deconstruct(Point=tree_branch_3)  # -> XComponent, YComponent, ZComponent
deconstruct_7 = Deconstruct(Point=list_item.Item1)  # -> XComponent, YComponent, ZComponent
deconstruct_8 = Deconstruct(Point=list_item_2.Item1)  # -> XComponent, YComponent, ZComponent
deconstruct_9 = Deconstruct(Point=list_item_2.Item)  # -> XComponent, YComponent, ZComponent
construct_point = ConstructPoint(XCoordinate=deconstruct_5.XComponent, YCoordinate=deconstruct_3.YComponent, ZCoordinate=deconstruct_5.ZComponent)
construct_point_2 = ConstructPoint(XCoordinate=deconstruct_7.XComponent, YCoordinate=deconstruct_6.YComponent, ZCoordinate=deconstruct_7.ZComponent)
construct_point_3 = ConstructPoint(XCoordinate=deconstruct_9.XComponent, YCoordinate=deconstruct_4.YComponent, ZCoordinate=deconstruct_9.ZComponent)
construct_point_4 = ConstructPoint(XCoordinate=deconstruct_8.XComponent, YCoordinate=deconstruct_2.YComponent, ZCoordinate=deconstruct_8.ZComponent)
merge_3 = Merge(Data1=construct_point_3, Data2=list_item_3, Data3=construct_point_4)
merge_4 = Merge(Data1=construct_point_2, Data2=average, Data3=construct_point)
merge_5 = Merge(Data1=merge_3, Data2=merge_4)
polyline_5 = PolyLine(Vertices=merge_5, Closed=False)  # -> simplify(Polyline)
curve_9 = Curve(polyline_5)
mesh_7 = Mesh(mesh_6)
curve_10 = Curve(curve_8)
curve_11 = Curve(curve_9)
curve_12 = Curve(curve_10)
mesh_8 = Mesh(mesh_7)
trim_tree_2 = TrimTree(Tree=curve_11, Depth=1)
area = Area(Geometry=mesh_8)  # -> Area, Centroid
panel_3 = Panel("""0.05
0.5
0.95""")
list_item_4 = ListItem(List=trim_tree_2, Index=0, Wrap=True)  # -> Item, Item1
larger_than = LargerThan(FirstNumber=area.Area, SecondNumber="2")  # -> LargerThan, OrEqualTo
unit_z = UnitZ(Factor=Slider(0.153, range=0..1))
merge_6 = Merge(Data1=trim_tree_2, Data2=curve_12)
tween_curve = TweenCurve(CurveA=list_item_4.Item, CurveB=list_item_4.Item1, Factor=panel_3, BlendType=0)
tree_statistics_2 = TreeStatistics(Tree=tween_curve)  # -> Paths, Length, Count
move_3 = Move(Geometry=merge_6, Motion=unit_z)  # -> Geometry, Transform
dispatch_4 = Dispatch(List=mesh_8, DispatchPattern=larger_than.LargerThan)  # -> ListA, ListB
dispatch_5 = Dispatch(List=tree_statistics_2.Paths, DispatchPattern=larger_than.LargerThan)  # -> ListA, ListB
merge_7 = Merge(Data1=move_3.Geometry, Data2=tween_curve)
tree_branch_7 = TreeBranch(Tree=tween_curve, Path=dispatch_5.ListA, MaintainPaths=True)
curve_middle_4 = CurveMiddle(Curve=merge_7)
face_boundaries = FaceBoundaries(Mesh=dispatch_4.ListA)  # -> flatten(Boundaries)
list_item_5 = ListItem(List=tree_branch_7, Index=0, Wrap=True)  # -> Item, Item1, Item2
deconstruct_10 = Deconstruct(Point=curve_middle_4)  # -> XComponent, YComponent, ZComponent
end_points_2 = EndPoints(Curve=list_item_5.Item)  # -> Start, End
end_points_3 = EndPoints(Curve=list_item_5.Item2)  # -> Start, End
sort_list_2 = SortList(Keys=deconstruct_10.XComponent, ValuesValuesA=merge_7)  # -> Keys, ValuesValuesA
region_union = RegionUnion(Curves=face_boundaries)
merge_8 = Merge(Data1=end_points_2.Start, Data2=end_points_2.End, Data3=end_points_3.Start, Data4=end_points_3.End)
point_25 = Point(merge_8)
data_5 = Data(dispatch_5.ListB)
data_6 = Data(dispatch_5.ListA)
curve_13 = Curve(sort_list_2.ValuesValuesA)
curve_14 = Curve(region_union)
point_26 = Point(point_25)
data_7 = Data(data_5)
data_8 = Data(data_6)
curve_15 = Curve(curve_13)
curve_16 = Curve(curve_14)
list_item_6 = ListItem(List=flatten(curve_15), Index=0, Wrap=True)
area_2 = Area(Geometry=curve_16)  # -> Area, Centroid
attractor_point_2 = Point(Point(7.484440052, 4.166516151, 0))
flip_curve = FlipCurve(Curve=curve_15, Guide=list_item_6)  # -> Curve, Flag
distance_2 = Distance(PointA=area_2.Centroid, PointB=attractor_point_2)
explode_4 = Explode(Curve=flip_curve.Curve, Recursive=True)  # -> Segments, Vertices
bounds_2 = Bounds(Numbers=distance_2)
path_mapper = PathMapper(explode_4.Segments, source="{A;B}[C]", target="{A;C}[B]")
remap_numbers_2 = RemapNumbers(Value=distance_2, Source=bounds_2, Target=Domain(0, 1))  # -> Mapped, Clipped
loft_3 = Loft(Curves=path_mapper, Options={Adjust=False, Closed=False, LoftEnds=0, LoftSimp=0, LoftType=3, Rebuild=10, Refit=0.01})
graph_mapper_2 = GraphMapper(
    remap_numbers_2.Mapped,
    x0=0,
    x1=1,
    y0=0,
    y1=1,
    container_name="Bezier",
    cpx=[0, 0.5165803432, 0.5088598132, 1],
    cpy=[0.7031285763, 0.6928400993, 0.2015486956, 0.2041209936])
graph_mapper_3 = GraphMapper(
    remap_numbers_2.Mapped,
    x0=0,
    x1=1,
    y0=0,
    y1=1,
    container_name="Bezier",
    cpx=[0, 0.4805536568, 0.6040322185, 1],
    cpy=[0.4026887417, 0.398971796, 0.1072705984, 0.1046983004])
trim_tree_3 = TrimTree(Tree=loft_3, Depth=1)
tree_branch_8 = TreeBranch(Tree=trim_tree_3, Path=data_8, MaintainPaths=True)
tree_branch_9 = TreeBranch(Tree=trim_tree_3, Path=data_7, MaintainPaths=True)
scale_nu = ScaleNU(Geometry=curve_16, Plane=area_2.Centroid, ScaleX=graph_mapper_3, ScaleY=graph_mapper_2, ScaleZ=1)  # -> simplify(graft(Geometry)), Transform
brep_join = BrepJoin(Breps=tree_branch_9)  # -> Breps, Closed
brep = Brep(brep_join.Breps)
brep_2 = Brep(tree_branch_8)
point_27 = Point(point_26)
curve_17 = Curve(scale_nu.Geometry)
brep_3 = Brep(brep)
brep_4 = Brep(brep_2)
curve_18 = Curve(curve_17)
point_28 = Point(point_27)
explode_5 = Explode(Curve=curve_18, Recursive=True)  # -> Segments, Vertices
match_tree = MatchTree(Tree=curve_18, Guide=point_28)
unit_z_2 = UnitZ(Factor=1)
removeduplicatepts = RemoveDuplicatePts(Points=explode_5.Vertices, Tolerance=0.01)
boundary_surfaces = BoundarySurfaces(Edges=match_tree)
extrude = Extrude(Base=boundary_surfaces, Direction=unit_z_2)
deconstruct_11 = Deconstruct(Point=removeduplicatepts)  # -> XComponent, YComponent, ZComponent
multiplication_3 = Multiplication(A=unit_z_2, B="0.5")
sort_list_3 = SortList(Keys=deconstruct_11.YComponent, ValuesValuesA=removeduplicatepts)  # -> Keys, ValuesValuesA
reverse = Reverse(Vector=multiplication_3)
panel_4 = Panel("""0
1
-1
-2""")
move_4 = Move(Geometry=extrude, Motion=reverse)  # -> Geometry, Transform
list_item_7 = ListItem(List=sort_list_3.ValuesValuesA, Index=panel_4, Wrap=True)
average_2 = Average(Input=list_item_7)
trim_solid = TrimSolid(Shape=brep_3, Cutters=move_4.Geometry)
circle = Circle(Plane=average_2, Radius="0.1")
deconstruct_brep = DeconstructBrep(Brep=trim_solid)  # -> simplify(Faces), Edges, Vertices
sort_along_curve = SortAlongCurve(Points=point_28, Curve=circle)  # -> simplify(Points), Indices
sort_along_curve_2 = SortAlongCurve(Points=list_item_7, Curve=circle)  # -> simplify(Points), Indices
line = Line(StartPoint=sort_along_curve.Points, EndPoint=sort_along_curve_2.Points)
surface_split = SurfaceSplit(Surface=deconstruct_brep.Faces, Curves=line)
merge_9 = Merge(Data1=brep_4, Data2=surface_split)
brep_5 = Brep(merge_9)
brep_6 = Brep(brep_5)
deconstruct_brep_2 = DeconstructBrep(Brep=brep_6)  # -> flatten(Faces), Edges, Vertices
brep_join_2 = BrepJoin(Breps=deconstruct_brep_2.Faces)  # -> Breps, Closed
deconstruct_brep_3 = DeconstructBrep(Brep=brep_join_2.Breps)  # -> Faces, Edges, Vertices
brep_join_3 = BrepJoin(Breps=deconstruct_brep_2.Faces)  # -> Breps, Closed
simple_mesh_3 = SimpleMesh(Brep=deconstruct_brep_3.Faces)
brep_edges = BrepEdges(Brep=brep_join_3.Breps)  # -> Naked, Interior, NonManifold
construct_point_5 = ConstructPoint(XCoordinate=0, YCoordinate=0, ZCoordinate="-0.1")
xy_plane = XYPlane(Origin=construct_point_5)
curve_19 = Curve(brep_edges.Naked)
project = Project(Geometry=curve_19, Plane=xy_plane)  # -> Geometry, Transform
graft_tree = GraftTree(Tree=project.Geometry, IncludeEmptyLists=True, IncludeNullItems=True)
graft_tree_2 = GraftTree(Tree=curve_19, IncludeEmptyLists=True, IncludeNullItems=True)
loft_4 = Loft(
    Curves=[graft_tree_2, graft_tree],
    Options={Adjust=False, Closed=False, LoftEnds=0, LoftSimp=0, LoftType=0, Rebuild=10, Refit=0.01})
simple_mesh_4 = SimpleMesh(Brep=loft_4)
merge_10 = Merge(Data1=simple_mesh_4, Data2=simple_mesh_3)  # -> flatten(Result)
weaverbird_s_join_meshes_and_weld = WeaverbirdsJoinMeshesAndWeld(Mesh=merge_10, Weld=invert(False))
subd_from_mesh = SubDFromMesh(Mesh=weaverbird_s_join_meshes_and_weld, Creases=1, Corners=1, Interpolate=False)
