# Grasshopper definition #43_Fractal_vase.gh (Grasshopper 1.0.7)
# plug-ins: Weaverbird

layer_count = Panel("100")
height = Panel("55")
division = Division(A=height, B=layer_count)
circle = Circle(Plane=PlaneXY(0, 0, 0), Radius="30")
circle_2 = Circle(Plane=PlaneXY(0, 0, 0), Radius="45")
division_2 = Division(A="1", B=layer_count)
ghpython_script = GhPythonScript(curve=circle, division="6", count="2")  # -> out, curve; inputs curve: Curve, division: Int32, count: Int32
# ---------- ghpython_script: Python ----------
"""
__author__ = "Liang Mayuqi"
__version__ = "2022.01.05"
"""

import Rhino.Geometry as rg
import math as m
import clr
from System import Array
from Rhino.Geometry import Point3d

def interpolation(pt1, pt2, tval):
    ptlist = [pt1 + t * (pt2-pt1) for t in tval]
    ptlist.insert(0, pt1)
    ptlist.append(pt2)
    return ptlist

def initVex(curve, division):
    ptArray = clr.StrongBox[Array[Point3d]]()
    curve.DivideByCount(division, True,ptArray)
    
    pts = ptArray.Value
    return pts

def initSegs(pts):
    initSeg = []
    for i in range(len(pts)):
        try:
            line = rg.Line(pts[i],pts[i+1])
        except:
            line = rg.Line(pts[-1],pts[0])
        initSeg.append(line)
    return initSeg

def recursion(segs,count,out):
    newSegs = []
    curve = [line.ToNurbsCurve() for line in segs]
    joinedPoly = rg.Curve.JoinCurves(curve)[0]
    for seg in segs:
        startPt = seg.From
        endPt = seg.To
        ptlist = interpolation(startPt, endPt,[0.33,0.5,0.66])
        dir = endPt - startPt
        length = dir.Length
        dir.Unitize()
        vector = rg.Vector3d.CrossProduct(dir,rg.Vector3d.ZAxis)
        ptlist[2] += vector * length * 0.5 / m.sqrt(3)
        poly = rg.Polyline(ptlist)
        polysegs = poly.GetSegments()
        for seg in polysegs:
            newSegs.append(seg)
    if count == 0:
        out.append(joinedPoly)
        return 
    else:
        recursion(newSegs,count-1,out)

if __name__ == "__main__":
    vertice = initVex(curve,division)
    hex = initSegs(vertice)
    output = []
    recursion(hex,count,output)
    curve = output
# ---------- end ghpython_script ----------
ghpython_script_2 = GhPythonScript(curve=circle_2, division="6", count="3")  # -> out, curve; inputs curve: Curve, division: Int32, count: Int32; same code as ghpython_script
series = Series(Start=0, Step=division, Count=layer_count)
series_2 = Series(Start=0, Step=division_2, Count=layer_count)
bounds = Bounds(Numbers=series)
tween_curve = TweenCurve(CurveA=ghpython_script_2.curve, CurveB=ghpython_script.curve, Factor=series_2, BlendType=0)  # -> reverse(Tween)
unit_z = UnitZ(Factor=series)
remap_numbers = RemapNumbers(Value=series, Source=bounds, Target=Domain(0, 1))  # -> Mapped, Clipped
rotate = Panel("0.5")
move = Move(Geometry=tween_curve, Motion=unit_z)  # -> Geometry, Transform
pi = Pi(Factor=rotate)
area = Area(Geometry=move.Geometry)  # -> Area, Centroid
graph_mapper = GraphMapper(
    remap_numbers.Mapped,
    x0=0,
    x1=1,
    y0=0,
    y1=1,
    container_name="Bezier2",
    pt=[Point(0, 0.502397418, 0), Point(0.2078387588, 0.709174335, 0), Point(0.2984815765, 0.8058491945, 0), Point(0.4997760653, 0.8058491945, 0), Point(0.7210618854, 0.8058491945, 0), Point(0.80237782, 0.7011181116, 0), Point(1, 0.5077682734, 0)])
multiplication = Multiplication(A=remap_numbers.Mapped, B=pi)
scale = Scale(Geometry=move.Geometry, Center=area.Centroid, Factor=graph_mapper)  # -> Geometry, Transform
rotate_2 = Rotate(Geometry=scale.Geometry, Angle=multiplication, Plane=area.Centroid)  # -> Geometry, Transform
list_item = ListItem(List=scale.Geometry, Index=0, Wrap=True)
loft = Loft(
    Curves=rotate_2.Geometry,
    Options={Adjust=False, Closed=False, LoftEnds=0, LoftSimp=0, LoftType=0, Rebuild=10, Refit=0.01})
boundary_surfaces = BoundarySurfaces(Edges=list_item)
brep_join = BrepJoin(Breps=[loft, boundary_surfaces])  # -> Breps, Closed
mesh_brep = MeshBrep(
    Brep=brep_join.Breps,
    Settings={GridMaxCount=0, GridMinCount=16, JaggedSeams=False, MaxEdgeLength=0, MinEdgeLength=0.0001, MinTolerance=0, Refine=True, RefineAngle=0, RelativeTolerance=0.65, SimplePlanes=True, Tolerance=0})
weaverbird_s_mesh_thicken = WeaverbirdsMeshThicken(MeshCurves=mesh_brep, Distance="1", OffsetType=0)
