# Grasshopper definition #44_Corrosion_texture.gh (Grasshopper 1.0.7)
# plug-ins: Noise, DendroGH, Weaverbird

size = Panel("500")
seed = Slider(15, range=0..100)
seed_2 = Slider(12, range=0..100)
rectangle = Rectangle(Plane=PlaneXY(0, 0, 0), XSize=size, YSize=size, Radius=0)  # -> Rectangle, Length
count = Panel("20")
random = Random(Range=Domain(0, 1), Number=1, Seed=seed_2)
box_rectangle = BoxRectangle(Rectangle=rectangle.Rectangle, Height=size)
populate_3d = Populate3D(Region=box_rectangle, Count=count, Seed=seed)
multiplication = Multiplication(A=count, B=random)
round = Round(Number=multiplication)  # -> Nearest, Floor, Ceiling
voronoi_3d = Voronoi3D(Points=populate_3d, Box=box_rectangle)  # -> Cells, Boundary
list_item = ListItem(List=voronoi_3d.Cells, Index=round.Nearest, Wrap=True)
area = Area(Geometry=list_item)  # -> Area, Centroid
orient = Orient(Geometry=list_item, Source=area.Centroid, Target=PlaneXY(0, 0, 0))  # -> Geometry, Transform
brep = Brep(orient.Geometry)
brep_2 = Brep(brep)
settings_custom = SettingsCustom(
    StitchSeams=True,
    SimplePlanes=False,
    Refine=True,
    MinCount=16,
    MaxCount=400,
    AspectRatio=20,
    MaxDistance=0,
    MaxAngle=20,
    MinEdge=0,
    MaxEdge="5")
mesh_brep = MeshBrep(Brep=brep_2, Settings=settings_custom)
z = Slider(0.54, range=0..1)
x = Slider(0.82, range=0..1)
y = Slider(0.81, range=0..1)
bounding_box = BoundingBox(Content=mesh_brep, Plane=PlaneXY(0, 0, 0), UnionBox=True)  # -> Box, Box_2
deconstruct_box = DeconstructBox(Box=bounding_box.Box)  # -> Plane, X, Y, Z
vector_xyz = VectorXYZ(XComponent=x, YComponent=y, ZComponent=z)  # -> Vector, Length
deconstruct_domain = DeconstructDomain(Domain=deconstruct_box.X)  # -> Start, End
deconstruct_domain_2 = DeconstructDomain(Domain=deconstruct_box.Y)  # -> Start, End
deconstruct_domain_3 = DeconstructDomain(Domain=deconstruct_box.Z)  # -> Start, End
seed_3 = Slider(2, range=0..100)
count_2 = Slider(36, range=0..100)
construct_point = ConstructPoint(XCoordinate=deconstruct_domain.Start, YCoordinate=deconstruct_domain_2.Start, ZCoordinate=deconstruct_domain_3.Start)
construct_point_2 = ConstructPoint(XCoordinate=deconstruct_domain.End, YCoordinate=deconstruct_domain_2.End, ZCoordinate=deconstruct_domain_3.End)
random_2 = Random(Range=Domain(0, 1), Number=count_2, Seed=seed_3)
plane_normal = PlaneNormal(Origin=construct_point, ZAxis=vector_xyz.Vector)
vector_2pt = Vector2Pt(PointA=construct_point, PointB=construct_point_2, Unitize=False)  # -> Vector, Length
vector_length = VectorLength(Vector=vector_2pt.Vector)
multiplication_2 = Multiplication(A=vector_length, B=random_2)
contour_ex = ContourEx(Shape=mesh_brep, Plane=plane_normal, Offsets=multiplication_2)  # -> flatten(Contours)
brep_3 = Brep(brep_2)
mesh = Mesh(mesh_brep)
curve = Curve(contour_ex)
curve_2 = Curve(curve)
brep_4 = Brep(brep_3)
mesh_2 = Mesh(mesh)
list_length = ListLength(List=curve_2)
unit_z = UnitZ(Factor=1)
divide_curve = DivideCurve(Curve=curve_2, Count="100", Kinks=False)  # -> Points, Tangents, Parameters
random_3 = Random(Range=Domain(0, 100), Number=list_length, Seed=2)  # -> graft(Random)
scaler = Slider(55, range=0..100)
perlinnoise = PerlinNoise(
    Points=divide_curve.Points,
    Seed=random_3,
    Amplitude=1,
    SmoothStep=0,
    FrequecyX="3.65",
    FrequecyY="3.65",
    FrequecyZ="3.65",
    Jitter=0,
    AlignVector=Vector(1, 0, 0))  # -> simplify(Values)
cross_product = CrossProduct(VectorA=divide_curve.Tangents, VectorB=unit_z, Unitize=False)  # -> Vector, Length
multiplication_3 = Multiplication(A=perlinnoise, B=scaler)
amplitude = Amplitude(Vector=cross_product.Vector, Amplitude=multiplication_3)
move = Move(Geometry=divide_curve.Points, Motion=amplitude)  # -> Geometry, Transform
brep_closest_point = BrepClosestPoint(Point=move.Geometry, Brep=brep_4)  # -> Point, Normal, Distance
polyline = PolyLine(Vertices=brep_closest_point.Point, Closed=False)
curve_3 = Curve(polyline)
mesh_3 = Mesh(mesh_2)
brep_5 = Brep(brep_4)
curve_4 = Curve(curve_3)
mesh_4 = Mesh(mesh_3)
brep_6 = Brep(brep_5)
construct_domain = ConstructDomain(DomainStart="0.7                          ", DomainEnd=1)
construct_domain_2 = ConstructDomain(DomainStart="0.4", DomainEnd="0.5")
tree_statistics = TreeStatistics(Tree=curve_4)  # -> Paths, Length, Count
seed_4 = Slider(16, range=0..100)
series = Series(Start=0, Step=1, Count=tree_statistics.Count)
random_4 = Random(Range=construct_domain_2, Number=tree_statistics.Count, Seed=2)
random_5 = Random(Range=construct_domain, Number=tree_statistics.Count, Seed=2)
count_3 = Slider(50, range=0..100)
addition = Addition(A=series, B=seed_4)  # -> graft(Result)
construct_domain_3 = ConstructDomain(DomainStart=random_4, DomainEnd=random_5)  # -> graft(Domain)
scaler_2 = Slider(17.089, range=0..100)
random_6 = Random(Range=Domain(0, 1), Number=count_3, Seed=addition)
sub_curve = SubCurve(BaseCurve=reparameterize(curve_4), Domain=construct_domain_3)  # -> simplify(Curve)
multiplication_4 = Multiplication(A=random_6, B=scaler_2)
evaluate_curve = EvaluateCurve(Curve=reparameterize(sub_curve), Parameter=random_6)  # -> Point, Tangent, Angle
mesh_sphere = MeshSphere(Base=evaluate_curve.Point, Radius=multiplication_4, UCount="10", VCount="10")  # -> flatten(Mesh)
mesh_5 = Mesh(mesh_sphere)
mesh_6 = Mesh(mesh_4)
brep_7 = Brep(brep_6)
mesh_7 = Mesh(mesh_6)
brep_8 = Brep(brep_7)
mesh_8 = Mesh(mesh_5)
volume = Volume(Geometry=mesh_8)  # -> Volume, Centroid
create_settings = CreateSettings(VoxelSize=1, Bandwidth=1, Isovalue=0, Adaptivity=0.1)
smaller_than = SmallerThan(FirstNumber=volume.Volume, SecondNumber="100")  # -> SmallerThan, OrEqualTo
dispatch = Dispatch(List=mesh_8, DispatchPattern=smaller_than.SmallerThan)  # -> ListA, ListB
mesh_to_volume = MeshToVolume(Mesh=mesh_7, Settings=create_settings)
mesh_to_volume_2 = MeshToVolume(Mesh=dispatch.ListB, Settings=create_settings)
volume_union = VolumeUnion(Volumes=mesh_to_volume_2)
volume_difference = VolumeDifference(VolumeA=mesh_to_volume, VolumesB=volume_union)
smooth_volume = SmoothVolume(Volume=volume_difference, Width=1, Type=2, Iterations="3")
volume_to_mesh = VolumeToMesh(Volume=smooth_volume, VolumeSettings=create_settings)
brep_9 = Brep(brep_8)
mesh_9 = Mesh(volume_to_mesh)
mesh_10 = Mesh(mesh_9)
brep_10 = Brep(brep_9)
quad_remesh_settings = QuadRemeshSettings(
    TargetCount="30000",
    AdaptiveSize=0,
    AdaptiveCount=invert(False),
    HardEdges=False,
    SeamEdges=0,
    Symmetry=0,
    GuideCurves=0)
quad_remesh = QuadRemesh(Mesh=mesh_10, Settings=quad_remesh_settings)
deconstruct_mesh = DeconstructMesh(Mesh=quad_remesh)  # -> Vertices, Faces, Colours, Normals
brep_closest_point_2 = BrepClosestPoint(Point=deconstruct_mesh.Vertices, Brep=brep_10)  # -> Point, Normal, Distance
bounds = Bounds(Numbers=brep_closest_point_2.Distance)
deconstruct_domain_4 = DeconstructDomain(Domain=bounds)  # -> Start, End
gradient = Gradient(
    LowerLimit=deconstruct_domain_4.Start,
    UpperLimit=deconstruct_domain_4.End,
    Parameter=brep_closest_point_2.Distance,
    stops=[0.036: RGB(255, 255, 255), 0.199: RGB(0, 0, 0), 0.395: RGB(255, 255, 255), 0.6: RGB(0, 0, 0), 0.798: RGB(255, 255, 255), 0.854: RGB(0, 0, 0), 0.904: RGB(255, 255, 255), 0.949: RGB(0, 0, 0), 1: RGB(255, 255, 255), 1: RGB(255, 255, 255), 1: RGB(0, 0, 0)])
construct_mesh = ConstructMesh(Vertices=deconstruct_mesh.Vertices, Faces=deconstruct_mesh.Faces, Colours=gradient)
weaverbird_s_catmull_clark_subdivision = WeaverbirdsCatmullClarkSubdivision(MeshCurves=construct_mesh, Level=1, SmoothNakedEdges=1)
