# Grasshopper definition #45_Strange Attractor.gh (Grasshopper 1.0.7)
# plug-ins: MeshEdit Components

number_slider = Slider(0.75093, range=0..1)
t = Slider(0.0183, range=0..1)
t_2 = Slider(1, range=0..1)
type = ValueList({"Thomas": 0, "Langford": 1, "Lorenz": 2, "Dadras": 3, "Chen": 4, "Lorenz83": 5, "Rossler": 6, "Halvorsen": 7, "Four-Wing": 8, "Arenodo": 9}, selected="Arenodo")
construct_point = ConstructPoint(XCoordinate=number_slider, YCoordinate=number_slider, ZCoordinate=number_slider)
c_script = CSharpScript(point=construct_point, iter="1000", type=type, t=t_2, x=t)  # -> out, Pts; inputs point: Point3d, iter: Int32, type: Int32, t: Double, x: Double
# ---------- c_script: C# ----------
    switch(type)
    {
      case 0:
        Point3d pt = new Point3d(0.71826, 0.71826, 0.71826);
        Pts = Thomas(pt, iter, t, 0.54);
        break;
      case 1:
        Point3d pt1 = new Point3d(0.68210, 0.68210, 0.68210);
        Pts = Langford(pt1, iter, t, 0.019);
        break;
      case 2:
        Point3d pt2 = new Point3d(0.809848, 0.809848, 0.809848);
        Pts = Lorenz(pt2, iter, t, 0.037);
        break;
      case 3:
        Pts = Dadras(point, iter, t, 0.1480);
        break;
      case 4:
        Pts = Chen(point, iter, t, 0.02891);
        break;
      case 5:
        Pts = Lorenz83(point, iter, t, 0.0556);
        break;
      case 6:
        Pts = Rossler(point, iter, t, 0.1313);
        break;
      case 7:
        Pts = Halvorsen(point, iter, t, 0.0688);
        break;
      case 8:
        Pts = Four_Wind(point, iter, t, 0.5376);
        break;
      case 9:
        Pts = Arneodo(point, iter, t, x);
        break;
    }
# ---------- c_script: C# additional code ----------
  public static List<double> PtPos(Point3d Pt)
  {
    List<double> Vals = new List<double>();
    double x = Pt.X;
    double y = Pt.Y;
    double z = Pt.Z;

    Vals.Add(x);
    Vals.Add(y);
    Vals.Add(z);

    return Vals;
  }

  public static List<Point3d> Thomas(Point3d Pt, int iter, double t, double step)
  {
    List<Point3d> Pts = new List<Point3d>();

    List<double> Vals = PtPos(Pt);
    double x = Vals[0];
    double y = Vals[1];
    double z = Vals[2];

    double iteration = iter * t;
    iter = (int) iteration;

    double b = 0.208186;

    for(int i = 0; i < iter; i++)
    {
      x += (Math.Sin(y) - b * x) * step;
      y += (Math.Sin(z) - b * y) * step;
      z += (Math.Sin(x) - b * z) * step;
      Point3d P = new Point3d(x, y, z);
      Pts.Add(P);
    }

    return Pts;
  }

  public static List<Point3d> Langford(Point3d Pt, int iter, double t, double step)
  {
    List<Point3d> Pts = new List<Point3d>();

    List<double> Vals = PtPos(Pt);
    double x = Vals[0];
    double y = Vals[1];
    double z = Vals[2];

    double iteration = iter * t;
    iter = (int) iteration;

    double a = 0.95;
    double b = 0.7;
    double c = 0.6;
    double d = 3.5;
    double e = 0.25;
    double f = 0.1;


    for(int i = 0; i < iter; i++)
    {
      x += ((z - b) * x - d * y) * step;
      y += (d * x + (z - b) * y) * step;
      z += (c + a * z - Math.Pow(z, 3) / 3 - (Math.Pow(x, 2) + Math.Pow(y, 2)) * (1 + e * z) - f * z * Math.Pow(x, 3)) * step;
      Point3d P = new Point3d(x, y, z);
      Pts.Add(P);
    }

    return Pts;
  }

  public static List<Point3d> Lorenz(Point3d Pt, int iter, double t, double step)
  {
    List<Point3d> Pts = new List<Point3d>();

    List<double> Vals = PtPos(Pt);
    double x = Vals[0];
    double y = Vals[1];
    double z = Vals[2];

    double iteration = iter * t;
    iter = (int) iteration;

    double sigma = 10;
    double rho = 28;
    double beta = 8 / 3;

    for(int i = 0; i < iter; i++)
    {
      x += (sigma * (-x + y)) * step;
      y += (-x * z + rho * x - y) * step;
      z += (x * y - beta * z) * step;
      Point3d P = new Point3d(x, y, z);
      Pts.Add(P);
    }

    return Pts;
  }

  public static List<Point3d> Dadras(Point3d Pt, int iter, double t, double step)
  {
    List<Point3d> Pts = new List<Point3d>();

    List<double> Vals = PtPos(Pt);
    double x = Vals[0];
    double y = Vals[1];
    double z = Vals[2];

    double iteration = iter * t;
    iter = (int) iteration;

    double a = 3;
    double b = 2.7;
    double c = 1.7;
    double d = 2;
    double e = 9;

    for(int i = 0; i < iter; i++)
    {
      x += (y - a * x + b * y * z) * step;
      y += (c * y - x * z + z) * step;
      z += (d * x * y - e * z) * step;
      Point3d P = new Point3d(x, y, z);
      Pts.Add(P);
    }

    return Pts;
  }

  public static List<Point3d> Chen(Point3d Pt, int iter, double t, double step)
  {
    List<Point3d> Pts = new List<Point3d>();

    List<double> Vals = PtPos(Pt);
    double x = Vals[0];
    double y = Vals[1];
    double z = Vals[2];

    double iteration = iter * t;
    iter = (int) iteration;

    double alpha = 5;
    double beta = -10;
    double detal = -0.38;

    for(int i = 0; i < iter; i++)
    {
      x += (alpha * x - y * z) * step;
      y += (beta * y + x * z) * step;
      z += (detal * z + x * y / 3) * step;
      Point3d P = new Point3d(x, y, z);
      Pts.Add(P);
    }

    return Pts;
  }

  public static List<Point3d> Lorenz83(Point3d Pt, int iter, double t, double step)
  {
    List<Point3d> Pts = new List<Point3d>();

    List<double> Vals = PtPos(Pt);
    double x = Vals[0];
    double y = Vals[1];
    double z = Vals[2];

    double iteration = iter * t;
    iter = (int) iteration;

    double a = 0.95;
    double b = 7.91;
    double f = 4.83;
    double g = 4.66;

    for(int i = 0; i < iter; i++)
    {
      x += (-a * x - Math.Pow(y, 2) - Math.Pow(z, 2) + a * f) * step;
      y += (-y + x * y - b * x * z + g) * step;
      z += (-x + b * x * y + x * z) * step;
      Point3d P = new Point3d(x, y, z);
      Pts.Add(P);
    }

    return Pts;
  }

  public static List<Point3d> Rossler(Point3d Pt, int iter, double t, double step)
  {
    List<Point3d> Pts = new List<Point3d>();

    List<double> Vals = PtPos(Pt);
    double x = Vals[0];
    double y = Vals[1];
    double z = Vals[2];

    double iteration = iter * t;
    iter = (int) iteration;

    double a = 0.2;
    double b = 0.2;
    double c = 5.7;

    for(int i = 0; i < iter; i++)
    {
      x += (-y - z) * step;
      y += (x + a * y) * step;
      z += (b + z * (x - c)) * step;
      Point3d P = new Point3d(x, y, z);
      Pts.Add(P);
    }

    return Pts;
  }

  public static List<Point3d> Halvorsen(Point3d Pt, int iter, double t, double step)
  {
    List<Point3d> Pts = new List<Point3d>();

    List<double> Vals = PtPos(Pt);
    double x = Vals[0];
    double y = Vals[1];
    double z = Vals[2];

    double iteration = iter * t;
    iter = (int) iteration;

    double a = 1.89;

    for(int i = 0; i < iter; i++)
    {
      x += (-a * x - 4 * y - 4 * z - Math.Pow(y, 2)) * step;
      y += (-a * y - 4 * z - 4 * x - Math.Pow(z, 2)) * step;
      z += (-a * z - 4 * x - 4 * y - Math.Pow(x, 2)) * step;
      Point3d P = new Point3d(x, y, z);
      Pts.Add(P);
    }

    return Pts;
  }

  public static List<Point3d> Four_Wind(Point3d Pt, int iter, double t, double step)
  {
    List<Point3d> Pts = new List<Point3d>();

    List<double> Vals = PtPos(Pt);
    double x = Vals[0];
    double y = Vals[1];
    double z = Vals[2];

    double iteration = iter * t;
    iter = (int) iteration;

    double a = 0.2;
    double b = 0.01;
    double c = -0.4;

    for(int i = 0; i < iter; i++)
    {
      x += (a * x + y * z) * step;
      y += (b * x + c * y - x * z) * step;
      z += (-z - x * y) * step;
      Point3d P = new Point3d(x, y, z);
      Pts.Add(P);
    }

    return Pts;
  }

  public static List<Point3d> Arneodo(Point3d Pt, int iter, double t, double step)
  {
    List<Point3d> Pts = new List<Point3d>();

    List<double> Vals = PtPos(Pt);
    double x = Vals[0];
    double y = Vals[1];
    double z = Vals[2];

    double iteration = iter * t;
    iter = (int) iteration;

    double alpha = -5.5;
    double beta = 3.5;
    double detal = -1;

    for(int i = 0; i < iter; i++)
    {
      x += y * step;
      y += z * step;
      z += (-alpha * x - beta * y + detal * Math.Pow(x, 3)) * step;
      Point3d P = new Point3d(x, y, z);
      Pts.Add(P);
    }

    return Pts;
  }


  /// <summary>
  /// This method will be called once every solution, before any calls to RunScript.
  /// </summary>
  public override void BeforeRunScript()
  { }
  /// <summary>
  /// This method will be called once every solution, after any calls to RunScript.
  /// </summary>
  public override void AfterRunScript()
  { }
# ---------- end c_script ----------
nurbs_curve = NurbsCurve(Vertices=c_script.Pts, Degree=3, Periodic=False)  # -> Curve, Length, Domain
perp_frames = PerpFrames(Curve=nurbs_curve.Curve, Count="5000", Align=True)  # -> Frames, Parameters
plane = Plane(perp_frames.Frames)
plane_2 = Plane(plane)
list_length = ListLength(List=plane_2)
polygon = Polygon(Plane=plane_2, Radius="0.05", Segments="4", FilletRadius=0)  # -> Polygon, Length
series = Series(Start=0, Step=1, Count=list_length)
explode = Explode(Curve=polygon.Polygon, Recursive=True)  # -> Segments, Vertices
list_length_2 = ListLength(List=polygon.Polygon)
bounds = Bounds(Numbers=series)
deconstruct_domain = DeconstructDomain(Domain=bounds)  # -> Start, End
flatten_tree = FlattenTree(Tree=explode.Vertices, Path="{0}")
gradient = Gradient(
    LowerLimit=deconstruct_domain.Start,
    UpperLimit=deconstruct_domain.End,
    Parameter=series,
    stops=[0: RGB(203, 212, 229), 0.252: RGB(167, 149, 191), 0.495: RGB(254, 233, 161), 0.747: RGB(108, 93, 171), 1: RGB(204, 162, 167)])
panel = Panel("4")
graft_tree = GraftTree(Tree=gradient, IncludeEmptyLists=True, IncludeNullItems=True)
duplicate_data = DuplicateData(Data=graft_tree, Number=expr("x+1", panel), Order=True)  # -> flatten(Data)
mesh_frompoints = MeshFromPoints(Points=flatten_tree, UDirection=list_length_2, VDirection=expr("x+1", panel), Colour=duplicate_data)
