# Grasshopper definition #46_Grandient geometry facade.gh (Grasshopper 1.0.7)
# plug-ins: Kangaroo2 Components, Bifocals

grid_size = Slider(5.31, range=0..10)
x_count = Slider(15, range=10..30)
curve = Curve([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])
graft_tree = GraftTree(Tree=curve, IncludeEmptyLists=True, IncludeNullItems=True)
multiplication = Multiplication(A=x_count, B="1.5")
square = Square(Plane=PlaneXY(0, 0, 0), Size=grid_size, ExtentX=x_count, ExtentY=multiplication)  # -> Cells, Points
area = Area(Geometry=square.Cells)  # -> Area, flatten(Centroid)
curve_closest_point = CurveClosestPoint(Point=area.Centroid, Curve=graft_tree)  # -> Point, Parameter, Distance
flip_matrix = FlipMatrix(Data=curve_closest_point.Distance)
sort_list = SortList(Keys=flip_matrix)  # -> Keys, ValuesValuesA
list_item = ListItem(List=sort_list.Keys, Index=0, Wrap=True)  # -> flatten(Item)
negative = Negative(Value="1")
bounds = Bounds(Numbers=list_item)
construct_domain = ConstructDomain(DomainStart=negative, DomainEnd="1")
remap_numbers = RemapNumbers(Value=list_item, Source=bounds, Target=Domain(0, 1))  # -> Mapped, Clipped
graph_mapper = GraphMapper(
    remap_numbers.Mapped,
    x0=0,
    x1=1,
    y0=0,
    y1=1,
    container_name="Bezier",
    cpx=[0, 0.228035301, 0.5179487467, 1],
    cpy=[0, 0.6793121099, 1, 1])
remap_numbers_2 = RemapNumbers(Value=graph_mapper, Source=Domain(0, 1), Target=construct_domain)  # -> Mapped, Clipped
point = Point(area.Centroid)
curve_2 = Curve(square.Cells)
number = Number(remap_numbers_2.Mapped)
thickness = Panel("0.25")
height = Slider(10, range=0..10)
number_2 = Number(number)
curve_3 = Curve(curve_2)
point_2 = Point(point)
construct_point = ConstructPoint(XCoordinate="1", YCoordinate="1", ZCoordinate=0)
multiplication_2 = Multiplication(A=number_2, B=Slider(2.56, range=0..10))
negative_2 = Negative(Value=thickness)
amplitude = Amplitude(Vector=construct_point, Amplitude=multiplication_2)
thickness_2 = Number(negative_2)
multiplication_3 = Multiplication(A=multiplication_2, B="0.75")
absolute = Absolute(Value=multiplication_3)
addition = Addition(A=multiplication_2, B=absolute)
multiplication_4 = Multiplication(A=addition, B=Slider(0.64, range=0..2))
absolute_2 = Absolute(Value=multiplication_4)
amplitude_2 = Amplitude(Vector=construct_point, Amplitude=absolute_2)
number_3 = Number(thickness_2)

# ----
# 红色
curve_4 = Curve(curve_2)
amplitude_3 = Amplitude(Vector=construct_point, Amplitude=addition)
number_4 = Number(number_3)
height_2 = Number(height)
point_3 = Point(point_2)
unit_z = UnitZ(Factor=thickness)
move = Move(Geometry=point_3, Motion=amplitude_2)  # -> Geometry, Transform
multiplication_5 = Multiplication(A=number_4, B="1.6")
unit_z_2 = UnitZ(Factor=height_2)
move_2 = Move(Geometry=point_3, Motion=amplitude_3)  # -> Geometry, Transform
graft_tree_2 = GraftTree(Tree=move.Geometry, IncludeEmptyLists=True, IncludeNullItems=True)
unit_z_3 = UnitZ(Factor=multiplication_5)
move_3 = Move(Geometry=curve_4, Motion=unit_z)  # -> Geometry, Transform
move_4 = Move(Geometry=graft_tree_2, Motion=unit_z)  # -> Geometry, Transform
multiplication_6 = Multiplication(A=number_4, B="1.5")
move_5 = Move(Geometry=move_2.Geometry, Motion=unit_z_2)  # -> Geometry, Transform
move_6 = Move(Geometry=move_5.Geometry, Motion=unit_z_3)  # -> Geometry, Transform
offset_curve = OffsetCurve(Curve=move_3.Geometry, Distance=multiplication_6, Corners=1)  # -> simplify(Curve)
offset_curve_2 = OffsetCurve(Curve=offset_curve, Distance=number_4, Corners=1)  # -> simplify(Curve)
explode = Explode(Curve=offset_curve, Recursive=True)  # -> Segments, Vertices
explode_2 = Explode(Curve=offset_curve_2, Recursive=True)  # -> Segments, Vertices
graft_tree_3 = GraftTree(Tree=move_6.Geometry, IncludeEmptyLists=True, IncludeNullItems=True)  # -> simplify(Tree)
graft_tree_4 = GraftTree(Tree=move_5.Geometry, IncludeEmptyLists=True, IncludeNullItems=True)  # -> simplify(Tree)
removeduplicatepts = RemoveDuplicatePts(Points=explode.Vertices, Tolerance=0.01)  # -> simplify(UniquePoints)
removeduplicatepts_2 = RemoveDuplicatePts(Points=explode_2.Vertices, Tolerance=0.01)  # -> simplify(UniquePoints)
list_item_2 = ListItem(List=removeduplicatepts, Index=0, Wrap=True)  # -> Item, Item1, Item2, Item3
match_tree = MatchTree(Tree=move_4.Geometry, Guide=list_item_2.Item)
list_item_3 = ListItem(List=removeduplicatepts_2, Index=0, Wrap=True)  # -> Item, Item1, Item2, Item3
_4point_surface = _4PointSurface(CornerA=graft_tree_4, CornerB=list_item_2.Item3, CornerC=list_item_2.Item)
merge = Merge(Data1=list_item_2.Item, Data2=list_item_2.Item1, Data3=match_tree, Data4=list_item_2.Item3)
_4point_surface_2 = _4PointSurface(CornerA=graft_tree_3, CornerB=list_item_3.Item3, CornerC=list_item_3.Item)
_4point_surface_3 = _4PointSurface(CornerA=graft_tree_4, CornerB=list_item_2.Item, CornerC=list_item_2.Item1)
_4point_surface_4 = _4PointSurface(CornerA=graft_tree_3, CornerB=list_item_3.Item, CornerC=list_item_3.Item1)
point_4 = Point(merge)
brep = Brep(_4point_surface)
brep_2 = Brep(_4point_surface_3)
brep_3 = Brep(_4point_surface_2)
brep_4 = Brep(_4point_surface_4)
point_5 = Point(point_4)
brep_5 = Brep(brep)
brep_6 = Brep(brep_4)
brep_7 = Brep(brep_3)
brep_8 = Brep(brep_2)
polyline = PolyLine(Vertices=point_5, Closed=invert(False))
brep_join = BrepJoin(Breps=[brep_5, brep_8])  # -> simplify(Breps), Closed
brep_join_2 = BrepJoin(Breps=[brep_7, brep_6])  # -> simplify(Breps), Closed
unit_z_4 = UnitZ(Factor=number_4)
boundary_surfaces = BoundarySurfaces(Edges=polyline)
curve_5 = Curve(brep_join.Breps)
curve_6 = Curve(brep_join_2.Breps)
extrude = Extrude(Base=boundary_surfaces, Direction=unit_z_4)
loft = Loft(
    Curves=[curve_5, curve_6],
    Options={Adjust=False, Closed=False, LoftEnds=0, LoftSimp=0, LoftType=0, Rebuild=10, Refit=0.01})
brep_join_3 = BrepJoin(Breps=[brep_join.Breps, brep_join_2.Breps, loft])  # -> Breps, Closed
solid_union = SolidUnion(Breps=[brep_join_3.Breps, extrude])
custom_preview = CustomPreview(Geometry=solid_union, Material=ColourSwatch(SwatchColor=RGB(255, 0, 0)))

# ----
# 黑色
thickness_3 = Number(thickness_2)
move_7 = Move(Geometry=point_2, Motion=amplitude)  # -> Geometry, Transform
offset_curve_3 = OffsetCurve(Curve=curve_3, Distance=thickness_3, Corners=1)
unit_z_5 = UnitZ(Factor=height)
explode_3 = Explode(Curve=curve_3, Recursive=True)  # -> Segments, Vertices
multiplication_7 = Multiplication(A=thickness_3, B="1.6")
explode_4 = Explode(Curve=offset_curve_3, Recursive=True)  # -> Segments, Vertices
unit_z_6 = UnitZ(Factor=multiplication_7)
move_8 = Move(Geometry=move_7.Geometry, Motion=unit_z_5)  # -> Geometry, Transform
removeduplicatepts_3 = RemoveDuplicatePts(Points=explode_3.Vertices, Tolerance=0.01)  # -> simplify(UniquePoints)
removeduplicatepts_4 = RemoveDuplicatePts(Points=explode_4.Vertices, Tolerance=0.01)  # -> simplify(UniquePoints)
move_9 = Move(Geometry=move_8.Geometry, Motion=unit_z_6)  # -> Geometry, Transform
graft_tree_5 = GraftTree(Tree=move_8.Geometry, IncludeEmptyLists=True, IncludeNullItems=True)  # -> simplify(Tree)
list_item_4 = ListItem(List=removeduplicatepts_3, Index=0, Wrap=True)  # -> Item, Item1, Item2, Item3
thickness_4 = Number(thickness_2)
graft_tree_6 = GraftTree(Tree=curve_3, IncludeEmptyLists=True, IncludeNullItems=True)
graft_tree_7 = GraftTree(Tree=move_9.Geometry, IncludeEmptyLists=True, IncludeNullItems=True)  # -> simplify(Tree)
boundary_surfaces_2 = BoundarySurfaces(Edges=graft_tree_6)
unit_z_7 = UnitZ(Factor=thickness_4)
_4point_surface_5 = _4PointSurface(CornerA=graft_tree_5, CornerB=list_item_4.Item3, CornerC=list_item_4.Item)
_4point_surface_6 = _4PointSurface(CornerA=graft_tree_5, CornerB=list_item_4.Item, CornerC=list_item_4.Item1)
extrude_2 = Extrude(Base=boundary_surfaces_2, Direction=unit_z_7)  # -> simplify(Extrusion)
brep_join_4 = BrepJoin(Breps=[_4point_surface_5, _4point_surface_6])  # -> simplify(Breps), Closed
brep_9 = Brep(brep_join_4.Breps)
brep_10 = Brep(extrude_2)
brep_11 = Brep(brep_9)
brep_12 = Brep(brep_10)
curve_7 = Curve(brep_11)

list_item_5 = ListItem(List=removeduplicatepts_4, Index=0, Wrap=True)  # -> Item, Item1, Item2, Item3
_4point_surface_7 = _4PointSurface(CornerA=graft_tree_7, CornerB=list_item_5.Item, CornerC=list_item_5.Item1)

_4point_surface_8 = _4PointSurface(CornerA=graft_tree_7, CornerB=list_item_5.Item3, CornerC=list_item_5.Item)
brep_join_5 = BrepJoin(Breps=[_4point_surface_8, _4point_surface_7])  # -> simplify(Breps), Closed
brep_13 = Brep(brep_join_5.Breps)
brep_14 = Brep(brep_13)
curve_8 = Curve(brep_14)
loft_2 = Loft(
    Curves=[curve_7, curve_8],
    Options={Adjust=False, Closed=False, LoftEnds=0, LoftSimp=0, LoftType=0, Rebuild=10, Refit=0.01})
brep_join_6 = BrepJoin(Breps=[loft_2, brep_11, brep_14])  # -> Breps, Closed
solid_union_2 = SolidUnion(Breps=[brep_join_6.Breps, brep_12])

custom_preview_2 = CustomPreview(Geometry=solid_union_2, Material=ColourSwatch(SwatchColor=RGB(0, 0, 0)))
