# Grasshopper definition #47_Mesh_Cluster.gh (Grasshopper 1.0.7)
# plug-ins: Kangaroo2 Components, MeshEdit Components, Weaverbird

circle = Circle(Plane=PlaneXY(0, 0, 0), Radius="120")
rebuild_curve = RebuildCurve(Curve=circle, Degree="3", Count=10, Tangents=False)
boundary_surfaces = BoundarySurfaces(Edges=rebuild_curve)
c_script = CSharpScript(Source=boundary_surfaces)  # -> Target; inputs Source: Brep
# ---------- c_script: C# ----------
    Source.Faces.ShrinkFaces();
    Target = Source;
# ---------- end c_script ----------
area = Area(Geometry=c_script)  # -> Area, Centroid
triremesh = TriRemesh(Geometry=c_script, Length=1.5, Iterations=25)  # -> Triangulation, Dual, Creases
scale = Scale(Geometry=c_script, Center=area.Centroid, Factor="0.95")  # -> Geometry, Transform
mesh_explode = MeshExplode(Mesh=triremesh.Triangulation, Interpolate=False)
populate_geometry = PopulateGeometry(Geometry=scale.Geometry, Count="150", Seed=1)
face_normals = FaceNormals(Mesh=mesh_explode)  # -> Centers, Normals
list_length = ListLength(List=populate_geometry)
construct_domain = ConstructDomain(DomainStart=-0.5, DomainEnd=0.5)
random = Random(Range=Domain(0, 1), Number=list_length, Seed="257")
random_2 = Random(Range=construct_domain, Number=list_length, Seed="50")
random_3 = Random(Range=construct_domain, Number=list_length, Seed="11")
vector_xyz = VectorXYZ(XComponent=random_2, YComponent=random_3, ZComponent=0)  # -> Vector, Length
multiplication = Multiplication(A=random, B="15")
line_sdl = LineSDL(Start=populate_geometry, Direction=vector_xyz.Vector, Length=multiplication)
curve_closest_point = CurveClosestPoint(Point=face_normals.Centers, Curve=line_sdl)  # -> Point, Parameter, Distance
mesh = Mesh(mesh_explode)
point = Point(curve_closest_point.Point)
number = Number(curve_closest_point.Distance)
mesh_2 = Mesh(mesh)
point_2 = Point(point)
number_2 = Number(number)
sort_list = SortList(Keys=number_2, ValuesValuesA=point_2)  # -> Keys, ValuesValuesA
list_item = ListItem(List=sort_list.ValuesValuesA, Index=0, Wrap=True)
item_index = ItemIndex(List=point_2, Item=list_item)  # -> flatten(Index)
sort_list_2 = SortList(Keys=item_index, ValuesValuesA=mesh_2)  # -> Keys, ValuesValuesA
create_set = CreateSet(List=sort_list_2.Keys)  # -> Set, Map
member_index = MemberIndex(Set=sort_list_2.Keys, Member=create_set.Set)  # -> Index, Count
list_item_2 = ListItem(List=sort_list_2.ValuesValuesA, Index=member_index.Index, Wrap=True)
weaverbird_s_join_meshes_and_weld = WeaverbirdsJoinMeshesAndWeld(Mesh=list_item_2, Weld=invert(False))
mesh_edges = MeshEdges(Mesh=weaverbird_s_join_meshes_and_weld)  # -> NakedEdges, InteriorEdges, NonManifoldEdges
join_curves = JoinCurves(Curves=mesh_edges.NakedEdges, Preserve=False)
smooth_polyline = SmoothPolyline(Polyline=join_curves, Strength=0.5, Times=5)
offset_curve = OffsetCurve(Curve=smooth_polyline, Distance="-0.8", Corners="2")  # -> flatten(Curve)
curve = Curve(offset_curve)
curve_2 = Curve(curve)
length = Length(Curve=curve_2)
smaller_than = SmallerThan(FirstNumber=length, SecondNumber=Slider(4.4, range=0..10))  # -> SmallerThan, OrEqualTo
dispatch = Dispatch(List=curve_2, DispatchPattern=smaller_than.SmallerThan)  # -> ListA, ListB
list_item_3 = ListItem(List=dispatch.ListB, Index=0, Wrap=True)
flip_curve = FlipCurve(Curve=dispatch.ListB, Guide=list_item_3)  # -> Curve, Flag
boundary_surfaces_2 = BoundarySurfaces(Edges=flip_curve.Curve)
merge = Merge(
    Data1=ColourSwatch(SwatchColor=RGB(51, 83, 158)),
    Data2=ColourSwatch(SwatchColor=RGB(127, 172, 214)),
    Data3=ColourSwatch(SwatchColor=RGB(191, 184, 218)),
    Data4=ColourSwatch(SwatchColor=RGB(232, 183, 212)),
    Data5=ColourSwatch(SwatchColor=RGB(165, 103, 142)))
list_length_2 = ListLength(List=boundary_surfaces_2)
list_length_3 = ListLength(List=merge)
division = Division(A=list_length_2, B=list_length_3)
duplicate_data = DuplicateData(Data=merge, Number=division, Order=True)
longest_list = LongestList(ListListA=boundary_surfaces_2, ListListB=duplicate_data, PaddingMode=1)  # -> ListListA, ListListB
data_dam = DataDam(DataA=longest_list.ListListA, BufferDelay=10000000, BufferMode=0)
mesh_brep = MeshBrep(
    Brep=data_dam,
    Settings={GridMaxCount=0, GridMinCount=16, JaggedSeams=False, MaxEdgeLength=0, MinEdgeLength=0.0001, MinTolerance=0, Refine=True, RefineAngle=0, RelativeTolerance=0.65, SimplePlanes=True, Tolerance=0})
triremesh_2 = TriRemesh(Geometry=mesh_brep, Length="3", Iterations=25)  # -> Triangulation, Dual, Creases
graft_tree = GraftTree(Tree=longest_list.ListListB, IncludeEmptyLists=True, IncludeNullItems=True)
graft_tree_2 = GraftTree(Tree=triremesh_2.Triangulation, IncludeEmptyLists=True, IncludeNullItems=True)
mesh_colours = MeshColours(Mesh=graft_tree_2, Colours=graft_tree)  # -> flatten(Mesh)
mesh_3 = Mesh(mesh_colours)
mesh_4 = Mesh(mesh_3)
weaverbird_s_join_meshes_and_weld_2 = WeaverbirdsJoinMeshesAndWeld(Mesh=mesh_4, Weld=invert(False))
nakedvertices = NakedVertices(Mesh=weaverbird_s_join_meshes_and_weld_2)  # -> ClothedIndex, NakedIndex, ClothedPts, NakedPts
unit_z = UnitZ(Factor=1)
load = Load(Point=nakedvertices.ClothedPts, ForceVector=unit_z, Weighting=1)
edgelengths = EdgeLengths(Mesh=weaverbird_s_join_meshes_and_weld_2, LengthFactor="0.75", Strength=1)
anchor = Anchor(Point=nakedvertices.NakedPts, Strength=10000)
show = Show(G=weaverbird_s_join_meshes_and_weld_2)
entwine = Entwine(Branch00=show, Branch01=edgelengths, Branch02=load, Branch03=anchor, FlattenInputs=True)
bouncysolver = BouncySolver(GoalObjects=entwine, Reset=Button(), Threshold=1e-15, Tolerance=0.0001, Damping=0.99, Iterations=10, On=Toggle(False))  # -> I, V, O
list_item_4 = ListItem(List=bouncysolver.O, Index=0, Wrap=True)
weaverbird_s_catmull_clark_subdivision = WeaverbirdsCatmullClarkSubdivision(MeshCurves=list_item_4, Level="2", SmoothNakedEdges=1)
