# Grasshopper definition #48_spiral.gh (Grasshopper 1.0.7)
# plug-ins: MeshEdit Components, Weaverbird, Kangaroo2 Components

freq = Slider(42.16, range=0..100)
pi = Pi(Factor=freq)
division = Division(A=pi, B="500")
series = Series(Start=0, Step=division, Count="500")
bounds = Bounds(Numbers=series)
bounds_2 = Bounds(Numbers=series)
cosine = Cosine(Value=series)
sine = Sine(Value=series)
remap_numbers = RemapNumbers(Value=series, Source=bounds, Target=Domain(0, 1))  # -> Mapped, Clipped
remap_numbers_2 = RemapNumbers(Value=series, Source=bounds_2, Target=Domain(0, 1))  # -> Mapped, Clipped
length = Panel("100")
radius = Slider(14, range=0..20)
multiplication = Multiplication(A=remap_numbers.Mapped, B=length)
graph_mapper = GraphMapper(
    remap_numbers_2.Mapped,
    x0=0,
    x1=1,
    y0=0,
    y1=1,
    container_name="Bezier2",
    pt=[Point(0, 0.2047829032, 0), Point(0.1026306152, 0.3996465206, 0), Point(0.1965878622, 0.6487881456, 0), Point(0.4965741932, 0.6516519189, 0), Point(0.7956917584, 0.6545073986, 0), Point(0.8983032107, 0.4027386308, 0), Point(1, 0.1984757185, 0)])
graph_mapper_2 = GraphMapper(
    remap_numbers_2.Mapped,
    x0=0,
    x1=1,
    y0=0,
    y1=1,
    container_name="Bezier2",
    pt=[Point(0, 0.1922066212, 0), Point(0.1497253478, 0.3686378002, 0), Point(0.3580972747, 0.6055641899, 0), Point(0.6058607101, 0.6487448812, 0), Point(0.8057177067, 0.6835763454, 0), Point(0.9062874913, 0.4286607504, 0), Point(1, 0.2244008183, 0)])
multiplication_2 = Multiplication(A=graph_mapper_2, B=radius)
multiplication_3 = Multiplication(A=sine, B=multiplication_2)
multiplication_4 = Multiplication(A=cosine, B=multiplication_2)
construct_point = ConstructPoint(XCoordinate=multiplication_3, YCoordinate=multiplication_4, ZCoordinate=multiplication)
number_slider = Slider(0.0126, range=0..0.02)
pi_2 = Pi(Factor="0.0073")
multiplication_5 = Multiplication(A=series, B=pi_2)
multiplication_6 = Multiplication(A=series, B=pi_2)
deconstruct = Deconstruct(Point=construct_point)  # -> XComponent, YComponent, ZComponent
cosine_2 = Cosine(Value=multiplication_6)
sine_2 = Sine(Value=multiplication_5)
vector_xyz = VectorXYZ(XComponent=sine_2, YComponent=cosine_2, ZComponent=0)  # -> Vector, Length
construct_point_2 = ConstructPoint(XCoordinate=0, YCoordinate=0, ZCoordinate=deconstruct.ZComponent)
number_slider_2 = Slider(5, range=0..100)
panel = Panel("0.203")
panel_2 = Panel("17")
plane_normal = PlaneNormal(Origin=construct_point_2, ZAxis=vector_xyz.Vector)
panel_3 = Panel("0.21")
pi_3 = Pi(Factor=Slider(0.269, range=0..1))
rotate = Rotate(Geometry=construct_point, Angle=pi_3, Plane=plane_normal)  # -> Geometry, Transform
shift_list = ShiftList(List=rotate.Geometry, Shift=number_slider_2, Wrap=invert(True))
unit_z = UnitZ(Factor=Slider(2.29, range=0..10))
negative = Negative(Value=unit_z)
move = Move(Geometry=shift_list, Motion=negative)  # -> Geometry, Transform
longest_list = LongestList(ListListA=rotate.Geometry, ListListB=move.Geometry, PaddingMode=2)  # -> ListListA, ListListB
removeduplicatepts = RemoveDuplicatePts(Points=longest_list.ListListB, Tolerance=0.01)
interpolate = Interpolate(Vertices=longest_list.ListListA, Degree=3, Periodic=False, KnotStyle=1)  # -> Curve, Length, Domain
interpolate_2 = Interpolate(Vertices=removeduplicatepts, Degree=3, Periodic=False, KnotStyle=1)  # -> Curve, Length, Domain
curve_closest_point = CurveClosestPoint(Point=longest_list.ListListB, Curve=interpolate_2.Curve)  # -> Point, Parameter, Distance
curve_closest_point_2 = CurveClosestPoint(Point=longest_list.ListListA, Curve=interpolate.Curve)  # -> Point, Parameter, Distance
evaluate_curve = EvaluateCurve(Curve=interpolate.Curve, Parameter=curve_closest_point_2.Parameter)  # -> Point, Tangent, Angle
evaluate_curve_2 = EvaluateCurve(Curve=interpolate_2.Curve, Parameter=curve_closest_point.Parameter)  # -> Point, Tangent, Angle
unit_z_2 = UnitZ(Factor=1)
distance = Distance(PointA=longest_list.ListListA, PointB=longest_list.ListListB)
construct_domain = ConstructDomain(DomainStart="0.5", DomainEnd="1.5")
bounds_3 = Bounds(Numbers=distance)
cross_product = CrossProduct(VectorA=evaluate_curve_2.Tangent, VectorB=unit_z_2, Unitize=False)  # -> Vector, Length
cross_product_2 = CrossProduct(VectorA=evaluate_curve.Tangent, VectorB=unit_z_2, Unitize=False)  # -> Vector, Length
remap_numbers_3 = RemapNumbers(Value=distance, Source=bounds_3, Target=construct_domain)  # -> Mapped, Clipped
amplitude = Amplitude(Vector=cross_product_2.Vector, Amplitude=remap_numbers_3.Mapped)
amplitude_2 = Amplitude(Vector=cross_product.Vector, Amplitude=remap_numbers_3.Mapped)
bezier_span = BezierSpan(StartPoint=longest_list.ListListA, StartTangent=amplitude, EndPoint=longest_list.ListListB, EndTangent=amplitude_2)  # -> Curve, Length, Domain
end_points = EndPoints(Curve=bezier_span.Curve)  # -> Start, End
integer = Integer(number_slider_2)
divide_curve = DivideCurve(Curve=bezier_span.Curve, Count=10, Kinks=False)  # -> simplify(Points), Tangents, Parameters
shift_list_2 = ShiftList(List=end_points.Start, Shift=integer, Wrap=invert(True))
tree_statistics = TreeStatistics(Tree=divide_curve.Points)  # -> Paths, Length, Count
shortest_list = ShortestList(ListListA=shift_list_2, ListListB=end_points.End, TrimMode=2)  # -> ListListA, ListListB
create_set = CreateSet(List=tree_statistics.Length)  # -> Set, Map
list_length = ListLength(List=shift_list_2)
merge = Merge(Data1=shortest_list.ListListA, Data2=shortest_list.ListListB)
mesh_frompoints = MeshFromPoints(Points=flatten(divide_curve.Points), UDirection=tree_statistics.Count, VDirection=create_set.Set)
mesh_frompoints_2 = MeshFromPoints(Points=flatten(merge), UDirection="2", VDirection=list_length)
merge_2 = Merge(Data1=mesh_frompoints, Data2=mesh_frompoints_2)  # -> flatten(Result)
weaverbird_s_join_meshes_and_weld = WeaverbirdsJoinMeshesAndWeld(Mesh=merge_2, Weld=invert(False))
mesh_edges = MeshEdges(Mesh=weaverbird_s_join_meshes_and_weld)  # -> NakedEdges, InteriorEdges, NonManifoldEdges
join_curves = JoinCurves(Curves=mesh_edges.NakedEdges, Preserve=False)
boundary_surfaces = BoundarySurfaces(Edges=join_curves)
mesh_brep = MeshBrep(
    Brep=boundary_surfaces,
    Settings={GridMaxCount=0, GridMinCount=16, JaggedSeams=False, MaxEdgeLength=0, MinEdgeLength=0.0001, MinTolerance=0, Refine=True, RefineAngle=0, RelativeTolerance=0.65, SimplePlanes=True, Tolerance=0})
quad_remesh_settings = QuadRemeshSettings(TargetCount="10000", AdaptiveSize=0, AdaptiveCount=False, HardEdges=False, SeamEdges=0, Symmetry=0, GuideCurves=0)
weaverbird_s_join_meshes_and_weld_2 = WeaverbirdsJoinMeshesAndWeld(Mesh=flatten([merge_2, mesh_brep]), Weld=invert(False))
quad_remesh = QuadRemesh(Mesh=weaverbird_s_join_meshes_and_weld_2, Settings=quad_remesh_settings)
custom_preview = CustomPreview(
    Geometry=weaverbird_s_join_meshes_and_weld_2,
    Material={diffuse=RGB(221, 160, 221), emission=RGB(66, 48, 66), shine=0.5, specular=RGB(255, 255, 255), transparency=0})
weaverbird_s_mesh_thicken = WeaverbirdsMeshThicken(MeshCurves=quad_remesh, Distance="-0.5", OffsetType=0)
weaverbird_s_catmull_clark_subdivision = WeaverbirdsCatmullClarkSubdivision(MeshCurves=quad_remesh, Level="2", SmoothNakedEdges=1)
bounding_box = BoundingBox(Content=weaverbird_s_catmull_clark_subdivision, Plane=PlaneXY(0, 0, 0), UnionBox=True)  # -> Box, Box_2
deconstruct_brep = DeconstructBrep(Brep=bounding_box.Box)  # -> Faces, Edges, Vertices
area = Area(Geometry=deconstruct_brep.Faces)  # -> Area, Centroid
deconstruct_2 = Deconstruct(Point=area.Centroid)  # -> XComponent, YComponent, ZComponent
sort_list = SortList(Keys=deconstruct_2.ZComponent, ValuesValuesA=area.Centroid)  # -> Keys, ValuesValuesA
xz_plane = XZPlane(Origin=Point(0, 0, 0))
construct_domain_2 = ConstructDomain(DomainStart=Slider(0.4, range=0..1), DomainEnd=Slider(0.92, range=0..1))
circle = Circle(Plane=xz_plane, Radius="50")
list_item = ListItem(List=sort_list.ValuesValuesA, Index=0, Wrap=True)  # -> Item1, Item
sub_curve = SubCurve(BaseCurve=reparameterize(circle), Domain=construct_domain_2)
line = Line(StartPoint=list_item.Item, EndPoint=list_item.Item1)
length_2 = Length(Curve=sub_curve)
length_3 = Length(Curve=line)
division_2 = Division(A=length_3, B=length_2)
multiplication_7 = Multiplication(A=division_2, B=Slider(0.938, range=0..2))
scale = Scale(Geometry=sub_curve, Center=Point(0, 0, 0), Factor=multiplication_7)  # -> Geometry, Transform
flow = Flow(
    Geometry=weaverbird_s_catmull_clark_subdivision,
    Base=line,
    Target=scale.Geometry,
    ReverseBase=False,
    ReverseTarget=False,
    Stretch=True,
    Rigid=False)
custom_preview_2 = CustomPreview(
    Geometry=flow,
    Material={diffuse=RGB(221, 160, 221), emission=RGB(66, 48, 66), shine=0.5, specular=RGB(255, 255, 255), transparency=0})
