# Grasshopper definition #49_circle_construction.gh (Grasshopper 1.0.7)
# plug-ins: Bifocals

count = Panel("30")
radius = Panel("250")
pi = Pi(Factor="4")
circle = Circle(Plane=PlaneXY(0, 0, 0), Radius=radius)
negative = Negative(Value="70")
negative_2 = Negative(Value="15")
pi_2 = Pi(Factor=Slider(1, range=0..1))
division = Division(A=pi, B=count)
perp_frames = PerpFrames(Curve=circle, Count=count, Align=True)  # -> Frames, Parameters
construct_domain = ConstructDomain(DomainStart=negative_2, DomainEnd="15")
construct_domain_2 = ConstructDomain(DomainStart=negative, DomainEnd="70")
series = Series(Start=0, Step=division, Count=count)
rectangle = Rectangle(Plane=perp_frames.Frames, XSize=construct_domain, YSize=construct_domain_2, Radius=0)  # -> Rectangle, Length
addition = Addition(A=pi_2, B=series)
sine = Sine(Value=addition)
explode = Explode(Curve=rectangle.Rectangle, Recursive=True)  # -> Segments, Vertices
unit_z = UnitZ(Factor=1)
construct_domain_3 = ConstructDomain(DomainStart="0.2", DomainEnd="1")
bounds = Bounds(Numbers=sine)
dot_product = DotProduct(VectorA=explode.Segments, VectorB=unit_z, Unitize=False)
remap_numbers = RemapNumbers(Value=sine, Source=bounds, Target=construct_domain_3)  # -> graft(Mapped), Clipped
equality = Equality(FirstNumber=dot_product, SecondNumber="0")  # -> Equality, Inequality
multiplication = Multiplication(A=remap_numbers.Mapped, B="10")
dispatch = Dispatch(List=explode.Segments, DispatchPattern=equality.Equality)  # -> ListA, ListB
round = Round(Number=multiplication)  # -> Nearest, Floor, Ceiling
division_2 = Division(A=round.Nearest, B="10")
list_item = ListItem(List=dispatch.ListB, Index=0, Wrap=True)  # -> Item, Item1
evaluate_curve = EvaluateCurve(Curve=reparameterize(list_item.Item1), Parameter="0.2")  # -> Point, Tangent, Angle
evaluate_curve_2 = EvaluateCurve(Curve=reparameterize(list_item.Item1), Parameter="0")  # -> Point, Tangent, Angle
evaluate_curve_3 = EvaluateCurve(Curve=reparameterize(list_item.Item1), Parameter=division_2)  # -> Point, Tangent, Angle
distance = Distance(PointA=evaluate_curve_2.Point, PointB=evaluate_curve.Point)
curve = Curve(dispatch.ListA)
curve_2 = Curve(list_item.Item1)
number = Number(distance)
curve_3 = Curve(list_item.Item)
vector = Vector(evaluate_curve_3.Tangent)
plane = Plane(perp_frames.Frames)
point = Point(evaluate_curve_3.Point)
point_2 = Point(point)
number_2 = Number(number)
plane_2 = Plane(plane)
curve_4 = Curve(curve_3)
curve_5 = Curve(curve_2)
vector_2 = Vector(vector)
curve_6 = Curve(curve)
unit_z_2 = UnitZ(Factor=number_2)
unit_z_3 = UnitZ(Factor=number_2)
deconstruct_plane = DeconstructPlane(Plane=plane_2)  # -> Origin, XAxis, YAxis, graft(ZAxis)
evaluate_curve_4 = EvaluateCurve(Curve=reparameterize(curve_4), Parameter="0.7")  # -> Point, Tangent, Angle
end_points = EndPoints(Curve=curve_5)  # -> Start, End
end_points_2 = EndPoints(Curve=curve_4)  # -> Start, End
list_item_2 = ListItem(List=curve_6, Index=0, Wrap=True)
cross_product = CrossProduct(VectorA=vector_2, VectorB=deconstruct_plane.ZAxis, Unitize=False)  # -> Vector, Length
amplitude = Amplitude(Vector=cross_product.Vector, Amplitude="25")
amplitude_2 = Amplitude(Vector=cross_product.Vector, Amplitude="50")
move = Move(Geometry=point_2, Motion=amplitude_2)  # -> Geometry, Transform
reverse = Reverse(Vector=amplitude)
move_2 = Move(Geometry=point_2, Motion=unit_z_2)  # -> Geometry, Transform
move_3 = Move(Geometry=evaluate_curve_4.Point, Motion=reverse)  # -> Geometry, Transform
move_4 = Move(Geometry=move.Geometry, Motion=unit_z_2)  # -> Geometry, Transform
move_5 = Move(Geometry=evaluate_curve_4.Point, Motion=unit_z_3)  # -> Geometry, Transform
move_6 = Move(Geometry=move_5.Geometry, Motion=reverse)  # -> Geometry, Transform
merge = Merge(Data1=end_points.Start, Data2=move_2.Geometry, Data3=move_4.Geometry)
merge_2 = Merge(Data1=end_points.End, Data2=point_2, Data3=move.Geometry)
merge_3 = Merge(Data1=end_points_2.Start, Data2=evaluate_curve_4.Point, Data3=move_3.Geometry)
line = Line(StartPoint=move_6.Geometry, EndPoint=move_3.Geometry)
nurbs_curve = NurbsCurve(Vertices=merge_3, Degree=2, Periodic=False)  # -> Curve, Length, Domain
line_2 = Line(StartPoint=move.Geometry, EndPoint=move_4.Geometry)
nurbs_curve_2 = NurbsCurve(Vertices=merge_2, Degree=2, Periodic=False)  # -> Curve, Length, Domain
nurbs_curve_3 = NurbsCurve(Vertices=merge, Degree=2, Periodic=False)  # -> Curve, Length, Domain
merge_4 = Merge(Data1=list_item_2, Data2=nurbs_curve.Curve, Data3=line)  # -> simplify(Result)
merge_5 = Merge(Data1=nurbs_curve_2.Curve, Data2=nurbs_curve_3.Curve, Data3=line_2)  # -> simplify(Result)
join_curves = JoinCurves(Curves=[merge_5, merge_4], Preserve=False)  # -> simplify(Curves)
curve_7 = Curve(list_item_2)
curve_8 = Curve(join_curves)
number_3 = Number(number_2)
curve_9 = Curve(curve_7)
number_4 = Number(number_3)
curve_10 = Curve(curve_8)
end_points_3 = EndPoints(Curve=curve_10)  # -> Start, End
end_points_4 = EndPoints(Curve=curve_9)  # -> Start, End
unit_z_4 = UnitZ(Factor="-15")
interpolate = Interpolate(Vertices=flatten(end_points_3.Start), Degree=3, Periodic=invert(False), KnotStyle=1)  # -> Curve, Length, Domain
average = Average(Input=[end_points_3.Start, end_points_3.End])
interpolate_2 = Interpolate(Vertices=flatten(end_points_4.End), Degree=3, Periodic=invert(False), KnotStyle=1)  # -> Curve, Length, Domain
point_3 = Point(end_points_3.Start)
average_2 = Average(Input=flatten(point_3))
unit_z_5 = UnitZ(Factor=number_4)
move_7 = Move(Geometry=average, Motion=unit_z_4)  # -> Geometry, Transform
offset_curve = OffsetCurve(Curve=interpolate.Curve, Distance="-25", Corners=1)
area = Area(Geometry=interpolate_2.Curve)  # -> Area, Centroid
vector_2pt = Vector2Pt(PointA=point_3, PointB=average_2, Unitize=False)  # -> Vector, Length
absolute = Absolute(Value="-25")
merge_6 = Merge(Data1=end_points_3.Start, Data2=move_7.Geometry, Data3=end_points_3.End)  # -> simplify(Result)
project = Project(Geometry=offset_curve, Plane=area.Centroid)  # -> Geometry, Transform
loft = Loft(
    Curves=flatten([interpolate.Curve, offset_curve]),
    Options={Adjust=False, Closed=False, LoftEnds=0, LoftSimp=0, LoftType=0, Rebuild=10, Refit=0.01})
average_3 = Average(Input=flatten(number_4))
addition_2 = Addition(A=absolute, B="3")
nurbs_curve_4 = NurbsCurve(Vertices=merge_6, Degree="2", Periodic=False)  # -> Curve, Length, Domain
multiplication_2 = Multiplication(A="6", B=2)
loft_2 = Loft(
    Curves=flatten([project.Geometry, interpolate_2.Curve]),
    Options={Adjust=False, Closed=False, LoftEnds=0, LoftSimp=0, LoftType=0, Rebuild=10, Refit=0.01})
line_sdl = LineSDL(Start=point_3, Direction=vector_2pt.Vector, Length=addition_2)
reverse_2 = Reverse(Vector=unit_z_5)
unit_z_6 = UnitZ(Factor="20")
unit_z_7 = UnitZ(Factor="6")
unit_z_8 = UnitZ(Factor="6")
subtraction = Subtraction(A=average_3, B=multiplication_2)
merge_7 = Merge(Data1=curve_10, Data2=nurbs_curve_4.Curve)
extrude = Extrude(Base=line_sdl, Direction=reverse_2)
addition_3 = Addition(A=multiplication_2, B=subtraction)
join_curves_2 = JoinCurves(Curves=merge_7, Preserve=False)  # -> flatten(Curves)
extrude_2 = Extrude(Base=loft_2, Direction=unit_z_6)
md_slider = MDSlider(SliderMode=0, slider_value=Point(0.5, 0.5, 0.5), x_domain=Domain(0, 1), y_domain=Domain(0, 1), z_domain=Domain(0, 1))
md_slider_2 = MDSlider(SliderMode=0, slider_value=Point(0.5, 0.5, 0.5), x_domain=Domain(0, 1), y_domain=Domain(0, 1), z_domain=Domain(0, 1))
extrude_3 = Extrude(Base=loft, Direction=unit_z_8)
reverse_3 = Reverse(Vector=unit_z_7)
unit_z_9 = UnitZ(Factor=addition_3)
boundary_surfaces = BoundarySurfaces(Edges=join_curves_2)
bounding_box = BoundingBox(Content=extrude_2, Plane=PlaneXY(0, 0, 0), UnionBox=True)  # -> Box, Box_2
evaluate_surface = EvaluateSurface(Surface=boundary_surfaces, Point=md_slider)  # -> Point, Normal, UDirection, VDirection, Frame
evaluate_surface_2 = EvaluateSurface(Surface=boundary_surfaces, Point=md_slider_2)  # -> Point, Normal, UDirection, VDirection, Frame
evaluate_box = EvaluateBox(Box=bounding_box.Box, UParameter="1", VParameter="1", WParameter="1")  # -> Plane, Point, Include
move_8 = Move(Geometry=extrude_3, Motion=reverse_3)  # -> Geometry, Transform
unit_z_10 = UnitZ(Factor="-3")
reverse_4 = Reverse(Vector=unit_z_9)
amplitude_3 = Amplitude(Vector=evaluate_surface.Normal, Amplitude="3")
amplitude_4 = Amplitude(Vector=evaluate_surface_2.Normal, Amplitude="3")
move_9 = Move(Geometry=extrude_3, Motion=reverse_4)  # -> Geometry, Transform
move_10 = Move(Geometry=move_8.Geometry, Motion=unit_z_10)  # -> Geometry, Transform
extrude_4 = Extrude(Base=extrude, Direction=graft(amplitude_4))

scale_nu = ScaleNU(Geometry=extrude_2, Plane=evaluate_box.Point, ScaleX=1, ScaleY=1, ScaleZ=Slider(0.5, range=0..1))  # -> Geometry, Transform

extrude_5 = Extrude(Base=boundary_surfaces, Direction=amplitude_3)
curve_11 = Curve(join_curves_2)
curve_12 = Curve(curve_11)
bounding_box_2 = BoundingBox(Content=curve_12, Plane=PlaneXY(0, 0, 0), UnionBox=True)  # -> Box, Box_2
unit_z_11 = UnitZ(Factor=1)
evaluate_box_2 = EvaluateBox(Box=bounding_box_2.Box, UParameter="0", VParameter="0", WParameter="0")  # -> Plane, Point, Include
contour = Contour(Shape=curve_12, Point=evaluate_box_2.Point, Direction=unit_z_11, Distance="20")
panel = Panel("""-1
0""")
trim_tree = TrimTree(Tree=contour, Depth=1)
cull_index = CullIndex(List=trim_tree, Indices=panel, Wrap=True)  # -> simplify(List)
relative_item = RelativeItem(Tree=graft(cull_index), Offset="{+1;+0}", WrapPaths=invert(False), WrapItems=False)  # -> ItemA, ItemB
merge_8 = Merge(Data1=relative_item.ItemA, Data2=relative_item.ItemB)
length = Length(Curve=merge_8)
sort_list = SortList(Keys=length, ValuesValuesA=merge_8)  # -> Keys, ValuesValuesA
number_5 = Number(sort_list.Keys)
curve_13 = Curve(sort_list.ValuesValuesA)
number_6 = Number(number_5)
curve_14 = Curve(curve_13)
list_item_3 = ListItem(List=curve_14, Index=0, Wrap=True)  # -> Item, Item1
list_item_4 = ListItem(List=number_6, Index=0, Wrap=True)  # -> Item, Item1
end_points_5 = EndPoints(Curve=list_item_3.Item1)  # -> Start, End
length_2 = Length(Curve=list_item_3.Item)
end_points_6 = EndPoints(Curve=list_item_3.Item)  # -> Start, End
end_points_7 = EndPoints(Curve=list_item_3.Item1)  # -> Start, End
division_3 = Division(A=list_item_4.Item, B=list_item_4.Item1)
vector_3 = Vector(list_item_3.Item1)
vector_4 = Vector(list_item_3.Item)
vector_5 = Vector(list_item_3.Item1)
smaller_than = SmallerThan(FirstNumber=division_3, SecondNumber="0.9")  # -> SmallerThan, OrEqualTo
subtraction_2 = Subtraction(A=length_2, B="20")
line_sdl_2 = LineSDL(Start=end_points_5.Start, Direction=vector_3, Length=subtraction_2)
line_sdl_3 = LineSDL(Start=end_points_7.Start, Direction=vector_5, Length=subtraction_2)
merge_9 = Merge(Data1=line_sdl_3, Data2=line_sdl_2)
line_sdl_4 = LineSDL(Start=end_points_6.Start, Direction=vector_4, Length=subtraction_2)
list_item_5 = ListItem(List=merge_9, Index=smaller_than.SmallerThan, Wrap=True)
unit_z_12 = UnitZ(Factor=1)
end_points_8 = EndPoints(Curve=list_item_5)  # -> Start, End
end_points_9 = EndPoints(Curve=line_sdl_4)  # -> Start, End
line_sdl_5 = LineSDL(Start=end_points_8.End, Direction=unit_z_12, Length="4")
line_sdl_6 = LineSDL(Start=end_points_9.End, Direction=unit_z_12, Length="4")
join_curves_3 = JoinCurves(Curves=[list_item_5, line_sdl_5], Preserve=False)
join_curves_4 = JoinCurves(Curves=[line_sdl_4, line_sdl_6], Preserve=False)
fillet = Fillet(Curve=join_curves_4, Radius="2")
fillet_2 = Fillet(Curve=join_curves_3, Radius="2")
merge_10 = Merge(Data1=fillet, Data2=fillet_2)  # -> simplify(Result)
curve_15 = Curve(merge_10)
curve_16 = Curve(curve_15)
divide_curve = DivideCurve(Curve=curve_16, Count="50", Kinks=False)  # -> Points, Tangents, Parameters
interpolate_3 = Interpolate(Vertices=divide_curve.Points, Degree=3, Periodic=False, KnotStyle=1)  # -> Curve, Length, Domain
trim_tree_2 = TrimTree(Tree=interpolate_3.Curve, Depth=1)
loft_3 = Loft(Curves=trim_tree_2, Options={Adjust=False, Closed=False, LoftEnds=0, LoftSimp=0, LoftType=0, Rebuild=10, Refit=0.01})
trim_tree_3 = TrimTree(Tree=loft_3, Depth=1)
list_length = ListLength(List=trim_tree_3)  # -> flatten(Length)
create_set = CreateSet(List=list_length)  # -> Set, Map
subtraction_3 = Subtraction(A=create_set.Set, B="1")
brep_edges = BrepEdges(Brep=loft_3)  # -> simplify(Naked), Interior, NonManifold
concatenate = Concatenate(Fragment_A="{*;", Fragment_B=subtraction_3, A="}")
offset_surface = OffsetSurface(Surface=loft_3, Distance="0.5", Retrim=True)
brep_edges_2 = BrepEdges(Brep=loft_3)  # -> graft(Naked), Interior, NonManifold
brep_edges_3 = BrepEdges(Brep=offset_surface)  # -> graft(Naked), Interior, NonManifold
split_tree = SplitTree(Data=brep_edges.Naked, Masks=flatten(concatenate))  # -> Positive, Negative
curve_middle = CurveMiddle(Curve=brep_edges.Naked)
construct_point = ConstructPoint(XCoordinate=0, YCoordinate=0, ZCoordinate=0)
loft_4 = Loft(
    Curves=[brep_edges_2.Naked, brep_edges_3.Naked],
    Options={Adjust=False, Closed=False, LoftEnds=0, LoftSimp=0, LoftType=0, Rebuild=10, Refit=0.01})  # -> simplify(Loft)
distance_2 = Distance(PointA=construct_point, PointB=curve_middle)
trim_tree_4 = TrimTree(Tree=loft_4, Depth=1)
split_tree_2 = SplitTree(Data=distance_2, Masks=flatten(concatenate))  # -> Positive, Negative
merge_11 = Merge(Data1=trim_tree_4, Data2=offset_surface, Data3=loft_3)
sort_list_2 = SortList(Keys=split_tree_2.Negative, ValuesValuesA=split_tree.Negative)  # -> Keys, ValuesValuesA
list_item_6 = ListItem(List=sort_list_2.ValuesValuesA, Index=0, Wrap=True)
brep_join = BrepJoin(Breps=merge_11)  # -> Breps, Closed
curve_17 = Curve(list_item_6)
point_4 = Point(construct_point)
curve_18 = Curve(curve_17)
point_5 = Point(point_4)
unit_z_13 = UnitZ(Factor="9")
extrude_6 = Extrude(Base=curve_18, Direction=unit_z_13)
md_slider_3 = MDSlider(SliderMode=0, slider_value=Point(0.5, 0.5, 0.5), x_domain=Domain(0, 1), y_domain=Domain(0, 1), z_domain=Domain(0, 1))
xy_plane = XYPlane(Origin=Point(0, 0, 0))
panel_2 = Panel("""5
-5""")
evaluate_surface_3 = EvaluateSurface(Surface=extrude_6, Point=md_slider_3)  # -> Point, Normal, UDirection, VDirection, Frame
offset_curve_2 = OffsetCurve(Curve=curve_18, Distance=panel_2, Plane=xy_plane, Corners=1)
amplitude_5 = Amplitude(Vector=evaluate_surface_3.Normal, Amplitude="10")
vector_2pt_2 = Vector2Pt(PointA=point_5, PointB=evaluate_surface_3.Point, Unitize=False)  # -> Vector, Length
subtraction_4 = Subtraction(A="20", B="9")
trim_tree_5 = TrimTree(Tree=offset_curve_2, Depth=1)
dot_product_2 = DotProduct(VectorA=vector_2pt_2.Vector, VectorB=amplitude_5, Unitize=invert(False))
curve_middle_2 = CurveMiddle(Curve=trim_tree_5)
subtraction_5 = Subtraction(A="20", B="9")
multiplication_3 = Multiplication(A=dot_product_2, B=amplitude_5)
unit_z_14 = UnitZ(Factor=subtraction_5)
distance_3 = Distance(PointA=point_5, PointB=curve_middle_2)
unit_z_15 = UnitZ(Factor=subtraction_4)
extrude_7 = Extrude(Base=extrude_6, Direction=multiplication_3)
sort_list_3 = SortList(Keys=distance_3, ValuesValuesA=trim_tree_5)  # -> Keys, reverse(ValuesValuesA)
unit_z_16 = UnitZ(Factor=1)
list_item_7 = ListItem(List=sort_list_3.ValuesValuesA, Index=0, Wrap=True)
divide_curve_2 = DivideCurve(Curve=list_item_7, Count="4", Kinks=False)  # -> Points, Tangents, Parameters
line_sdl_7 = LineSDL(Start=divide_curve_2.Points, Direction=unit_z_16, Length=subtraction_5)
move_11 = Move(Geometry=extrude_7, Motion=unit_z_15)  # -> Geometry, Transform
extrude_8 = Extrude(Base=list_item_7, Direction=unit_z_14)
pipe = Pipe(Curve=line_sdl_7, Radius="0.1", Caps=0)
