# Grasshopper definition #4_Multiple_attractors.gh (Grasshopper 1.0.7)
# plug-ins: Bifocals

md_slider = MDSlider(
    SliderMode=0,
    slider_value=Point(0.6022340728, 0.3964572069, 0.5),
    x_domain=Domain(0, 1),
    y_domain=Domain(0, 1),
    z_domain=Domain(0, 1))
md_slider_2 = MDSlider(
    SliderMode=0,
    slider_value=Point(0.1578049078, 0.2975828589, 0.5),
    x_domain=Domain(0, 1),
    y_domain=Domain(0, 1),
    z_domain=Domain(0, 1))
md_slider_3 = MDSlider(
    SliderMode=0,
    slider_value=Point(1, 0.383902573, 0.5),
    x_domain=Domain(0, 1),
    y_domain=Domain(0, 1),
    z_domain=Domain(0, 1))
hexgrid = Hexagonal(Plane=PlaneXY(0, 0, 0), Size=1, ExtentX="20", ExtentY="20")  # -> flatten(Cells), Points
bbox = BoundingBox(Content=hexgrid.Cells, Plane=PlaneXY(0, 0, 0), UnionBox=True)  # -> Box, Box_2
area = Area(Geometry=hexgrid.Cells)  # -> Area, Centroid
evalsrf = EvaluateSurface(Surface=reparameterize(bbox.Box), Point=[md_slider, md_slider_3, md_slider_2])  # -> Point, Normal, UDirection, VDirection, Frame
dist = Distance(PointA=area.Centroid, PointB=graft(evalsrf.Point))
smaller = SmallerThan(FirstNumber=dist, SecondNumber=Slider(9.582, range=0..10))  # -> SmallerThan, OrEqualTo
dispatch = Dispatch(List=hexgrid.Cells, DispatchPattern=smaller.SmallerThan)  # -> ListA, ListB
crv = Curve(dispatch.ListA)
index = ItemIndex(List=hexgrid.Cells, Item=crv)
cset = CreateSet(List=flatten(index))  # -> Set, Map
sort = SortList(Keys=cset.Map, ValuesA=flatten(index))  # -> Keys, ValuesA
shift = ShiftList(List=sort.Keys, Shift=1, Wrap=True)
subtraction = Subtraction(A=sort.Keys, B=shift)
equals = Equality(FirstNumber=subtraction, SecondNumber="0")  # -> Equality, Inequality
dispatch_2 = Dispatch(List=sort.ValuesA, DispatchPattern=equals.Equality)  # -> ListA, ListB
hex = Curve(hexgrid.Cells)
intersection = SetIntersection(SetA=index, SetB=dispatch_2.ListA)
index_2 = ItemIndex(List=hexgrid.Cells, Item=hexgrid.Cells)
exdiff = SetDifferenceS(SetA=intersection, SetB=index)
merge = Merge(Data1=exdiff, Data2=dispatch_2.ListA)  # -> flatten(Result)
exdiff_2 = SetDifferenceS(SetA=index_2, SetB=merge)
item = ListItem(List=hex, Index=exdiff_2, Wrap=True)
item_2 = ListItem(List=hex, Index=dispatch_2.ListA, Wrap=True)
item_3 = ListItem(List=hex, Index=exdiff, Wrap=True)

pt = Point(graft(evalsrf.Point))
area_2 = Area(Geometry=item_2)  # -> Area, Centroid
dist_2 = Distance(PointA=area_2.Centroid, PointB=pt)
flip = FlipMatrix(Data=dist_2)
lng = ListLength(List=evalsrf.Point)
ma = MassAddition(Input=flip)  # -> Result, PartialResults
division = Division(A=ma.Result, B=lng)  # -> flatten(Result)
bnd = Bounds(Numbers=division)
remap = RemapNumbers(Value=division, Source=bnd, Target=Domain(0, 1))  # -> Mapped, Clipped
bnd_2 = Bounds(Numbers=remap.Mapped)
graph = GraphMapper(
    remap.Mapped,
    x0=0,
    x1=1,
    y0=0,
    y1=1,
    container_name="Bezier",
    cpx=[0, 0.4648734331, 0.9229686856, 1],
    cpy=[0, 0.1748772264, 0.6095802188, 1])
dedomain = DeconstructDomain(Domain=bnd_2)  # -> Start, End
graph_2 = GraphMapper(
    remap.Mapped,
    x0=0,
    x1=1,
    y0=0,
    y1=1,
    container_name="Bezier",
    cpx=[0, 0.3166388571, 0.6751560569, 1],
    cpy=[0, 0.4438445568, 0.7749381661, 1])
dom = ConstructDomain(DomainStart="-0.2", DomainEnd="-0.85")
crv_2 = Curve(item_2)
dom_2 = ConstructDomain(DomainStart="-0.5", DomainEnd="-0.05")
remap_2 = RemapNumbers(Value=graph, Source=Domain(0, 1), Target=dom_2)  # -> Mapped, Clipped
remap_3 = RemapNumbers(Value=graph_2, Source=Domain(0, 1), Target=dom)  # -> Mapped, Clipped
Z = UnitZ(Factor=remap_2.Mapped)
offset = OffsetCurve(Curve=crv_2, Distance=remap_3.Mapped, Corners=1)
gradient = Gradient(
    LowerLimit=dedomain.Start,
    UpperLimit=dedomain.End,
    Parameter=remap.Mapped,
    stops=[0: RGB(255, 255, 255), 0.328: RGB(173, 203, 249), 0.657: RGB(3, 150, 249), 1: RGB(75, 107, 169)])
trim = TrimTree(Tree=offset, Depth=1)
move = Move(Geometry=trim, Motion=Z)  # -> Geometry, Transform
graft = GraftTree(Tree=crv_2, IncludeEmptyLists=True, IncludeNullItems=True)
graft_2 = GraftTree(Tree=move.Geometry, IncludeEmptyLists=True, IncludeNullItems=True)
loft = Loft(
    Curves=[graft, graft_2],
    Options={Adjust=False, Closed=False, LoftEnds=0, LoftSimp=0, LoftType=0, Rebuild=10, Refit=0.01})
trim_2 = TrimTree(Tree=loft, Depth=1)
preview = CustomPreview(Geometry=trim_2, Material=gradient)

preview_2 = CustomPreview(Geometry=item, Material=ColourSwatch(SwatchColor=RGB(0, 115, 255)))
preview_3 = CustomPreview(Geometry=item_2, Material=ColourSwatch(SwatchColor=RGB(255, 0, 0)))
preview_4 = CustomPreview(Geometry=item_3, Material=ColourSwatch(SwatchColor=RGB(93, 255, 0)))

boundary = BoundarySurfaces(Edges=item)
preview_5 = CustomPreview(Geometry=boundary, Material=ColourSwatch(SwatchColor=RGB(75, 107, 169)))

Z_2 = UnitZ(Factor="-0.2")

pt_2 = Point(graft(evalsrf.Point))
area_3 = Area(Geometry=item_3)  # -> Area, Centroid
dist_3 = Distance(PointA=area_3.Centroid, PointB=pt_2)
bnd_3 = Bounds(Numbers=dist_3)
remap_4 = RemapNumbers(Value=dist_3, Source=bnd_3, Target=Domain(0, 1))  # -> Mapped, Clipped
bnd_4 = Bounds(Numbers=remap_4.Mapped)
dedomain_2 = DeconstructDomain(Domain=bnd_4)  # -> Start, End
gradient_2 = Gradient(
    LowerLimit=dedomain_2.Start,
    UpperLimit=dedomain_2.End,
    Parameter=remap_4.Mapped,
    stops=[0: RGB(255, 255, 255), 0.328: RGB(173, 203, 249), 0.657: RGB(3, 150, 249), 1: RGB(75, 107, 169)])
graft_3 = GraftTree(Tree=item_3, IncludeEmptyLists=True, IncludeNullItems=True)

graph_3 = GraphMapper(
    remap_4.Mapped,
    x0=0,
    x1=1,
    y0=0,
    y1=1,
    container_name="Bezier",
    cpx=[0, 0.4648734331, 0.9229686856, 1],
    cpy=[0, 0.1748772264, 0.6095802188, 1])
dom_3 = ConstructDomain(DomainStart="-0.5", DomainEnd="-0.05")
remap_5 = RemapNumbers(Value=graph_3, Source=Domain(0, 1), Target=dom_3)  # -> Mapped, Clipped

# ---- group: Offset
graph_4 = GraphMapper(
    remap_4.Mapped,
    x0=0,
    x1=1,
    y0=0,
    y1=1,
    container_name="Bezier",
    cpx=[0, 0.3166388571, 0.6751560569, 1],
    cpy=[0, 0.4438445568, 0.7749381661, 1])
dom_4 = ConstructDomain(DomainStart="-0.2", DomainEnd="-0.85")
remap_6 = RemapNumbers(Value=graph_4, Source=Domain(0, 1), Target=dom_4)  # -> Mapped, Clipped

# ----
Z_3 = UnitZ(Factor=remap_5.Mapped)
offset_2 = OffsetCurve(Curve=item_3, Distance=remap_6.Mapped, Corners=1)
trim_3 = TrimTree(Tree=offset_2, Depth=1)
move_2 = Move(Geometry=trim_3, Motion=Z_3)  # -> Geometry, Transform
graft_4 = GraftTree(Tree=move_2.Geometry, IncludeEmptyLists=True, IncludeNullItems=True)
loft_2 = Loft(
    Curves=[graft_3, graft_4],
    Options={Adjust=False, Closed=False, LoftEnds=0, LoftSimp=0, LoftType=0, Rebuild=10, Refit=0.01})
trim_4 = TrimTree(Tree=loft_2, Depth=1)
preview_6 = CustomPreview(Geometry=trim_4, Material=gradient_2)

merge_2 = Merge(Data1=boundary, Data2=trim_4, Data3=trim_2)
extr = Extrude(Base=merge_2, Direction=Z_2)
