# Grasshopper definition #50_space.gh (Grasshopper 1.0.7)
# plug-ins: LunchBox, NGon, Pufferfish, Weaverbird, Kangaroo2 Components

unit_count = Panel("20")
radius = Panel("1500")
plane = Plane(PlaneXY(0, 0, 0))
column_count = Panel("8")
column_dimension = Panel("120")
height = Panel("10000")
circle = Circle(Plane=plane, Radius=radius)
division = Division(A="2", B=column_count)
division_2 = Division(A=height, B=unit_count)
horizontal_frames = HorizontalFrames(Curve=circle, Count=column_count)  # -> Frames, Parameters
negative = Negative(Value=column_dimension)
series = Series(Start=0, Step=division, Count=unit_count)
series_2 = Series(Start=0, Step=division, Count=unit_count)
series_3 = Series(Start=0, Step=division_2, Count=unit_count)
curve = Curve(circle)
pi = Pi(Factor=series)
pi_2 = Pi(Factor=series_2)
construct_domain = ConstructDomain(DomainStart=negative, DomainEnd=column_dimension)
sine = Sine(Value=pi_2)
cosine = Cosine(Value=pi)
unit_z = UnitZ(Factor=height)
rectangle = Rectangle(Plane=horizontal_frames.Frames, XSize=construct_domain, YSize=construct_domain, Radius=0)  # -> Rectangle, Length
multiplication = Multiplication(A=cosine, B=radius)
multiplication_2 = Multiplication(A=sine, B=radius)
construct_point = ConstructPoint(XCoordinate=multiplication, YCoordinate=multiplication_2, ZCoordinate=series_3)
extrude = Extrude(Base=rectangle.Rectangle, Direction=unit_z)
shift_list = ShiftList(List=construct_point, Shift=1, Wrap=invert(True))
deconstruct_brep = DeconstructBrep(Brep=extrude)  # -> Faces, Edges, Vertices
shortest_list = ShortestList(ListListA=construct_point, ListListB=shift_list, TrimMode=2)  # -> ListListA, ListListB
curve_closest_point = CurveClosestPoint(Point=shortest_list.ListListA, Curve=curve)  # -> Point, Parameter, Distance
deconstruct = Deconstruct(Point=shortest_list.ListListB)  # -> XComponent, YComponent, ZComponent
deconstruct_2 = Deconstruct(Point=shortest_list.ListListA)  # -> XComponent, YComponent, ZComponent
evaluate_curve = EvaluateCurve(Curve=curve, Parameter=curve_closest_point.Parameter)  # -> Point, Tangent, Angle
construct_point_2 = ConstructPoint(XCoordinate=deconstruct.XComponent, YCoordinate=deconstruct.YComponent, ZCoordinate=deconstruct_2.ZComponent)
arc_sed = ArcSED(Start=shortest_list.ListListA, End=construct_point_2, Direction=evaluate_curve.Tangent)  # -> Arc, Plane, Radius

number = Number(division_2)
construct_domain_2 = ConstructDomain(DomainStart="0.02", DomainEnd="0.98")
curve_2 = Curve(arc_sed.Arc)
sub_curve = SubCurve(BaseCurve=reparameterize(curve_2), Domain=construct_domain_2)
list_length = ListLength(List=sub_curve)
curve_3 = Curve(sub_curve)
division_3 = Division(A="1", B=list_length)
series_4 = Series(Start=0, Step=division_3, Count=list_length)
graph_mapper = GraphMapper(
    series_4,
    x0=0,
    x1=1,
    y0=0,
    y1=1,
    container_name="Bezier",
    cpx=[0, 0.2603193521, 0.644764781, 1],
    cpy=[1, 0.4496539831, 0.3256402612, 0.310773313])
multiplication_3 = Multiplication(A=graph_mapper, B="2000")
multiplication_4 = Multiplication(A=graph_mapper, B="3000")
offset_curve = OffsetCurve(Curve=sub_curve, Distance=multiplication_4, Corners=1)  # -> simplify(Curve)
offset_curve_2 = OffsetCurve(Curve=sub_curve, Distance=multiplication_3, Corners=1)  # -> simplify(Curve)
unit_z_2 = UnitZ(Factor=number)
unit_z_3 = UnitZ(Factor="-150")
move = Move(Geometry=offset_curve_2, Motion=unit_z_3)  # -> Geometry, Transform
move_2 = Move(Geometry=offset_curve, Motion=unit_z_2)  # -> Geometry, Transform
offset_curve_3 = OffsetCurve(Curve=move_2.Geometry, Distance=number, Corners=1)  # -> simplify(Curve)
curve_4 = Curve(offset_curve_3)
curve_5 = Curve(move.Geometry)
curve_6 = Curve(offset_curve)
loft = Loft(
    Curves=[curve_6, curve_4],
    Options={Adjust=False, Closed=False, LoftEnds=0, LoftSimp=0, LoftType=0, Rebuild=10, Refit=0.01})
divide_domain² = DivideDomain²(Domain=loft, UCount="6", VCount="1")
panel = Panel("""-1
0""")

braced_grid_2_d_structure = BracedGrid2DStructure(Surface=deconstruct_brep.Faces, UDivisions="80", VDivisions="1")  # -> PrimaryLines, BraceLines, StructureNodes
unit_z_4 = UnitZ(Factor=1)
curve_7 = Curve(braced_grid_2_d_structure.PrimaryLines)
dot_product = DotProduct(VectorA=curve_7, VectorB=unit_z_4, Unitize=False)
equality = Equality(FirstNumber=dot_product, SecondNumber="0")  # -> Equality, Inequality
dispatch = Dispatch(List=curve_7, DispatchPattern=equality.Equality)  # -> simplify(ListA), simplify(ListB)
trim_tree = TrimTree(Tree=dispatch.ListB, Depth=1)
trim_tree_2 = TrimTree(Tree=dispatch.ListA, Depth=1)
removeduplicatelines = RemoveDuplicateLines(Lines=trim_tree, Tolerance=0.01)
curve_8 = Curve(trim_tree_2)
join_curves = JoinCurves(Curves=removeduplicatelines, Preserve=False)
curve_middle = CurveMiddle(Curve=join_curves)
join_curves_2 = JoinCurves(Curves=curve_8, Preserve=False)  # -> simplify(graft(Curves))
average = Average(Input=curve_middle)
negative_2 = Negative(Value="5")
circle_2 = Circle(Plane=average, Radius=1)
merge = Merge(Data1="5", Data2=negative_2)
sort_along_curve = SortAlongCurve(Points=curve_middle, Curve=circle_2)  # -> Points, Indices
unit_z_5 = UnitZ(Factor=merge)
list_item = ListItem(List=curve_middle, Index=sort_along_curve.Indices, Wrap=True)  # -> simplify(Item)
list_item_2 = ListItem(List=join_curves, Index=sort_along_curve.Indices, Wrap=True)  # -> simplify(Item)
negative_3 = Negative(Value="1")
extrude_2 = Extrude(Base=join_curves_2, Direction=unit_z_5)
shift_list_2 = ShiftList(List=list_item, Shift="1", Wrap=True)
shift_list_3 = ShiftList(List=list_item, Shift=negative_3, Wrap=True)
deconstruct_brep_2 = DeconstructBrep(Brep=extrude_2)  # -> Faces, Edges, Vertices
vector_2pt = Vector2Pt(PointA=list_item, PointB=shift_list_3, Unitize=invert(False))  # -> Vector, Length
vector_2pt_2 = Vector2Pt(PointA=list_item, PointB=shift_list_2, Unitize=invert(False))  # -> Vector, Length
simple_mesh = SimpleMesh(Brep=deconstruct_brep_2.Faces)  # -> simplify(flatten(Mesh))
amplitude = Amplitude(Vector=vector_2pt.Vector, Amplitude="20")
amplitude_2 = Amplitude(Vector=vector_2pt_2.Vector, Amplitude="20")
extrude_3 = Extrude(Base=list_item_2, Direction=amplitude)
extrude_4 = Extrude(Base=list_item_2, Direction=amplitude_2)
curve_9 = Curve(braced_grid_2_d_structure.BraceLines)
simple_mesh_2 = SimpleMesh(Brep=extrude_3)  # -> simplify(Mesh)
simple_mesh_3 = SimpleMesh(Brep=extrude_4)  # -> simplify(Mesh)
merge_2 = Merge(Data1=simple_mesh_3, Data2=simple_mesh_2)
meshpipe = MeshPipe(Curve=curve_9, Radius="2.5", Sides="4", Tolerance=10, Ending="3")
weaverbird_s_join_meshes_and_weld = WeaverbirdsJoinMeshesAndWeld(Mesh=simple_mesh, Weld=invert(False))
weaverbird_s_join_meshes_and_weld_2 = WeaverbirdsJoinMeshesAndWeld(Mesh=merge_2, Weld=invert(False))

division_4 = Division(A=height, B="80")
length = Length(Curve=arc_sed.Arc)
multiplication_5 = Multiplication(A=column_dimension, B="2")
division_5 = Division(A=division_4, B="2")
division_6 = Division(A=length, B=multiplication_5)
unit_z_6 = UnitZ(Factor=division_5)
negative_4 = Negative(Value=division_5)
panel_2 = Panel("""False
False
False
True""")
round = Round(Number=division_6)  # -> Nearest, Floor, Ceiling
construct_domain_3 = ConstructDomain(DomainStart=negative_4, DomainEnd=division_5)
move_3 = Move(Geometry=arc_sed.Arc, Motion=unit_z_6)  # -> Geometry, Transform
construct_domain_4 = ConstructDomain(DomainStart="0.08", DomainEnd="0.92")
gate_not = GateNot(A=panel_2)
cull_pattern = CullPattern(List=move_3.Geometry, CullPattern=gate_not)
cull_pattern_2 = CullPattern(List=move_3.Geometry, CullPattern=panel_2)
pi_3 = Pi(Factor="2")
sub_curve_2 = SubCurve(BaseCurve=reparameterize(cull_pattern), Domain=construct_domain_4)
modified_arc = ModifiedArc(Arc=cull_pattern_2, Angle=pi_3)
rotate = Rotate(Geometry=modified_arc, Angle="0.85", Plane=PlaneXY(0, 0, 0))  # -> Geometry, Transform
perp_frames = PerpFrames(Curve=sub_curve_2, Count=10, Align=True)  # -> Frames, Parameters
perp_frames_2 = PerpFrames(Curve=rotate.Geometry, Count="50", Align=True)  # -> Frames, Parameters
rectangle_2 = Rectangle(Plane=perp_frames_2.Frames, XSize=construct_domain, YSize=construct_domain_3, Radius=0)  # -> Rectangle, Length
length_2 = Length(Curve=modified_arc)
rectangle_3 = Rectangle(Plane=perp_frames.Frames, XSize=construct_domain, YSize=construct_domain_3, Radius=0)  # -> Rectangle, Length
area = Area(Geometry=rectangle_2.Rectangle)  # -> Area, Centroid
loft_2 = Loft(
    Curves=rectangle_2.Rectangle,
    Options={Adjust=False, Closed=True, LoftEnds=0, LoftSimp=0, LoftType=0, Rebuild=10, Refit=0.01})
division_7 = Division(A=length_2, B=multiplication_5)
loft_3 = Loft(
    Curves=rectangle_3.Rectangle,
    Options={Adjust=False, Closed=False, LoftEnds=0, LoftSimp=0, LoftType=0, Rebuild=10, Refit=0.01})
deconstruct_brep_3 = DeconstructBrep(Brep=loft_2)  # -> Faces, Edges, Vertices
deconstruct_brep_4 = DeconstructBrep(Brep=loft_3)  # -> Faces, Edges, Vertices
round_2 = Round(Number=division_7)  # -> Nearest, Floor, Ceiling
scale = Scale(Geometry=rectangle_2.Rectangle, Center=area.Centroid, Factor="0.75")  # -> Geometry, Transform
multiplication_6 = Multiplication(A=division_4, B="2")
unit_z_7 = UnitZ(Factor=multiplication_6)
loft_4 = Loft(Curves=scale.Geometry, Options={Adjust=False, Closed=True, LoftEnds=0, LoftSimp=0, LoftType=0, Rebuild=10, Refit=0.01})
move_4 = Move(Geometry=loft_4, Motion=unit_z_7)  # -> Geometry, Transform

area_2 = Area(Geometry=modified_arc)  # -> Area, Centroid
scale_2 = Scale(Geometry=modified_arc, Center=area_2.Centroid, Factor="0.918")  # -> Geometry, Transform
boundary_surfaces = BoundarySurfaces(Edges=scale_2.Geometry)
unit_z_8 = UnitZ(Factor="-50")
move_5 = Move(Geometry=boundary_surfaces, Motion=unit_z_8)  # -> graft(Geometry), Transform
area_3 = Area(Geometry=move_5.Geometry)  # -> Area, Centroid
curve_10 = Curve(move_5.Geometry)
scale_3 = Scale(Geometry=curve_10, Center=area_3.Centroid, Factor="0.25")  # -> Geometry, Transform
pi_4 = Pi(Factor=Slider(-0.928, range=-1..1))
merge_3 = Merge(Data1=curve_10, Data2=scale_3.Geometry)  # -> simplify(Result)
rotate_2 = Rotate(Geometry=merge_3, Angle=pi_4, Plane=PlaneXY(0, 0, 0))  # -> Geometry, Transform
number_2 = Number(round_2.Ceiling)
divide_curve = DivideCurve(Curve=rotate_2.Geometry, Count=graft(number_2), Kinks=False)  # -> simplify(Points), Tangents, Parameters
relative_item = RelativeItem(Tree=divide_curve.Points, Offset="{+0;+1}[+0]", WrapPaths=False, WrapItems=False)  # -> ItemA, ItemB
line = Line(StartPoint=relative_item.ItemA, EndPoint=relative_item.ItemB)
shift_list_4 = ShiftList(List=line, Shift=1, Wrap=True)
graft_tree = GraftTree(Tree=shift_list_4, IncludeEmptyLists=True, IncludeNullItems=True)  # -> simplify(Tree)
graft_tree_2 = GraftTree(Tree=line, IncludeEmptyLists=True, IncludeNullItems=True)  # -> simplify(Tree)
tween_curve = TweenCurve(CurveA=graft_tree_2, CurveB=graft_tree, Factor=0.5, BlendType=0)
end_points = EndPoints(Curve=tween_curve)  # -> Start, End
unit_z_9 = UnitZ(Factor="-15")
length_3 = Length(Curve=tween_curve)
move_6 = Move(Geometry=end_points.End, Motion=unit_z_9)  # -> Geometry, Transform
multiplication_7 = Multiplication(A=length_3, B="1.03")
catenary = Catenary(PointA=end_points.Start, PointB=move_6.Geometry, Length=multiplication_7, Gravity=Vector(0, 0, -1))
unit_z_10 = UnitZ(Factor="20")
merge_4 = Merge(Data1=graft_tree_2, Data2=graft_tree)
reverse = Reverse(Vector=unit_z_10)
move_7 = Move(Geometry=catenary, Motion=reverse)  # -> Geometry, Transform
divide_curve_2 = DivideCurve(Curve=merge_4, Count=10, Kinks=False)  # -> Points, Tangents, Parameters
divide_curve_3 = DivideCurve(Curve=move_7.Geometry, Count=10, Kinks=False)  # -> Points, Tangents, Parameters
split_tree = SplitTree(Data=divide_curve_2.Points, Masks=flatten("{*;*;0}"))  # -> Positive, Negative
path_mapper = PathMapper(divide_curve_3.Points, source="{A;B;0}", target="{A;B;1}")
path_mapper_2 = PathMapper(split_tree.Negative, source="{A;B;1}", target="{A;B;2}")
loft_5 = Loft(
    Curves=rotate_2.Geometry,
    Options={Adjust=False, Closed=False, LoftEnds=0, LoftSimp=0, LoftType=0, Rebuild=10, Refit=0.01})
path_mapper_3 = PathMapper(divide_curve_2.Points, source="{A;B;C}[D]", target="{A;D}[path_index]")
merge_5 = Merge(Data1=split_tree.Positive, Data2=path_mapper_2, Data3=path_mapper)
merge_6 = Merge(Data1=split_tree.Positive, Data2=path_mapper)
merge_7 = Merge(Data1=path_mapper, Data2=path_mapper_2)
divide_domain²_2 = DivideDomain²(Domain=loft_5, UCount="1", VCount=graft(number_2))
path_mapper_4 = PathMapper(merge_5, source="{A;B;C}[D]", target="{A;B;D}[C]")
relative_item_2 = RelativeItem(Tree=merge_6, Offset="{+0;+0;+1}[+1]", WrapPaths=False, WrapItems=False)  # -> ItemA, ItemB
relative_item_3 = RelativeItem(Tree=merge_7, Offset="{+0;+0;+1}[-1]", WrapPaths=False, WrapItems=False)  # -> ItemA, ItemB
unit_z_11 = UnitZ(Factor="2")
isotrim = Isotrim(Surface=loft_5, Domain=divide_domain²_2)
polyline = PolyLine(Vertices=path_mapper_3, Closed=False)
line_2 = Line(StartPoint=relative_item_2.ItemA, EndPoint=relative_item_2.ItemB)
line_3 = Line(StartPoint=relative_item_3.ItemA, EndPoint=relative_item_3.ItemB)
polyline_2 = PolyLine(Vertices=path_mapper_4, Closed=False)
merge_8 = Merge(Data1=polyline_2, Data2=polyline)
extrude_5 = Extrude(Base=isotrim, Direction=unit_z_11)
merge_9 = Merge(Data1=merge_4, Data2=move_7.Geometry)
merge_10 = Merge(Data1=line_2, Data2=line_3)
area_4 = Area(Geometry=extrude_5)  # -> Area, Centroid
meshpipe_2 = MeshPipe(Curve=merge_10, Radius="1", Sides="6", Tolerance=10, Ending="3")
meshpipe_3 = MeshPipe(Curve=merge_8, Radius="2", Sides="6", Tolerance=10, Ending="3")
meshpipe_4 = MeshPipe(Curve=merge_9, Radius="5", Sides="6", Tolerance=10, Ending="3")
scale_4 = Scale(Geometry=extrude_5, Center=area_4.Centroid, Factor="0.98")  # -> Geometry, Transform
merge_11 = Merge(Data1=meshpipe_4, Data2=meshpipe_3, Data3=meshpipe_2)

move_8 = Move(Geometry=deconstruct_brep_3.Faces, Motion=unit_z_7)  # -> Geometry, Transform
braced_grid_2_d_structure_2 = BracedGrid2DStructure(Surface=deconstruct_brep_3.Faces, UDivisions=round_2.Ceiling, VDivisions="1")  # -> PrimaryLines, BraceLines, StructureNodes
braced_grid_2_d_structure_3 = BracedGrid2DStructure(Surface=move_8.Geometry, UDivisions=round_2.Ceiling, VDivisions="1")  # -> PrimaryLines, BraceLines, StructureNodes
curve_11 = Curve(braced_grid_2_d_structure_3.PrimaryLines)
curve_12 = Curve(braced_grid_2_d_structure_2.PrimaryLines)
curve_13 = Curve(braced_grid_2_d_structure_3.BraceLines)
curve_14 = Curve(braced_grid_2_d_structure_2.BraceLines)
merge_12 = Merge(Data1=curve_13, Data2=curve_14)
merge_13 = Merge(Data1=curve_11, Data2=curve_12)
unit_z_12 = UnitZ(Factor=1)
dot_product_2 = DotProduct(VectorA=merge_13, VectorB=unit_z_12, Unitize=invert(False))
absolute = Absolute(Value=dot_product_2)
boolean = Boolean(absolute)
dispatch_2 = Dispatch(List=merge_13, DispatchPattern=boolean)  # -> ListA, ListB
curve_15 = Curve(flatten(dispatch_2.ListA))
curve_16 = Curve(flatten(dispatch_2.ListB))
removeduplicatelines_2 = RemoveDuplicateLines(Lines=curve_16, Tolerance=0.01)
unit_z_13 = UnitZ(Factor=1)
removeduplicatelines_3 = RemoveDuplicateLines(Lines=curve_15, Tolerance=0.01)
cross_product = CrossProduct(VectorA=removeduplicatelines_2, VectorB=unit_z_13, Unitize=invert(False))  # -> Vector, Length
list_item_3 = ListItem(List=removeduplicatelines_3, Index=0, Wrap=True)
flip_curve = FlipCurve(Curve=removeduplicatelines_3, Guide=list_item_3)  # -> Curve, Flag
amplitude_3 = Amplitude(Vector=cross_product.Vector, Amplitude="10")
end_points_2 = EndPoints(Curve=flip_curve.Curve)  # -> Start, End
reverse_2 = Reverse(Vector=amplitude_3)
deconstruct_3 = Deconstruct(Point=end_points_2.End)  # -> XComponent, YComponent, ZComponent
extrude_6 = Extrude(Base=removeduplicatelines_2, Direction=reverse_2)  # -> graft(Extrusion)
extrude_7 = Extrude(Base=removeduplicatelines_2, Direction=amplitude_3)  # -> graft(Extrusion)
create_set = CreateSet(List=deconstruct_3.ZComponent)  # -> Set, Map
merge_14 = Merge(Data1=extrude_7, Data2=extrude_6)
member_index = MemberIndex(Set=deconstruct_3.ZComponent, Member=create_set.Set)  # -> Index, Count
brep_join = BrepJoin(Breps=merge_14)  # -> Breps, Closed
list_item_4 = ListItem(List=end_points_2.End, Index=member_index.Index, Wrap=True)
average_2 = Average(Input=list_item_4)
vector_2pt_3 = Vector2Pt(PointA=list_item_4, PointB=average_2, Unitize=invert(False))  # -> Vector, Length
list_item_5 = ListItem(List=flip_curve.Curve, Index=member_index.Index, Wrap=True)
cross_product_2 = CrossProduct(VectorA=vector_2pt_3.Vector, VectorB=list_item_5, Unitize=invert(False))  # -> Vector, Length
amplitude_4 = Amplitude(Vector=cross_product_2.Vector, Amplitude="10")
amplitude_5 = Amplitude(Vector=cross_product_2.Vector, Amplitude="10")
reverse_3 = Reverse(Vector=amplitude_4)
extrude_8 = Extrude(Base=list_item_5, Direction=reverse_3)  # -> graft(Extrusion)
extrude_9 = Extrude(Base=list_item_5, Direction=amplitude_5)  # -> graft(Extrusion)
merge_15 = Merge(Data1=extrude_9, Data2=extrude_8)
brep_join_2 = BrepJoin(Breps=merge_15)  # -> Breps, Closed
simple_mesh_4 = SimpleMesh(Brep=brep_join_2.Breps)
meshpipe_5 = MeshPipe(Curve=merge_12, Radius="2.5", Sides="4", Tolerance=10, Ending="3")
merge_16 = Merge(Data1=loft_4, Data2=move_4.Geometry)
simple_mesh_5 = SimpleMesh(Brep=brep_join.Breps)

move_9 = Move(Geometry=deconstruct_brep_4.Faces, Motion=unit_z_7)  # -> Geometry, Transform
braced_grid_2_d_structure_4 = BracedGrid2DStructure(Surface=deconstruct_brep_4.Faces, UDivisions=round.Nearest, VDivisions="1")  # -> PrimaryLines, BraceLines, StructureNodes
braced_grid_2_d_structure_5 = BracedGrid2DStructure(Surface=move_9.Geometry, UDivisions=round.Nearest, VDivisions="1")  # -> PrimaryLines, BraceLines, StructureNodes
curve_17 = Curve(braced_grid_2_d_structure_4.BraceLines)
curve_18 = Curve(braced_grid_2_d_structure_5.BraceLines)
curve_19 = Curve(braced_grid_2_d_structure_4.PrimaryLines)
curve_20 = Curve(braced_grid_2_d_structure_5.PrimaryLines)
merge_17 = Merge(Data1=curve_18, Data2=curve_17)
merge_18 = Merge(Data1=curve_20, Data2=curve_19)
unit_z_14 = UnitZ(Factor=1)
dot_product_3 = DotProduct(VectorA=merge_18, VectorB=unit_z_14, Unitize=invert(False))
absolute_2 = Absolute(Value=dot_product_3)
boolean_2 = Boolean(absolute_2)
dispatch_3 = Dispatch(List=merge_18, DispatchPattern=boolean_2)  # -> ListA, ListB
curve_21 = Curve(flatten(dispatch_3.ListA))
curve_22 = Curve(flatten(dispatch_3.ListB))
removeduplicatelines_4 = RemoveDuplicateLines(Lines=curve_22, Tolerance=0.01)
unit_z_15 = UnitZ(Factor=1)
removeduplicatelines_5 = RemoveDuplicateLines(Lines=curve_21, Tolerance=0.01)
cross_product_3 = CrossProduct(VectorA=removeduplicatelines_4, VectorB=unit_z_15, Unitize=invert(False))  # -> Vector, Length
list_item_6 = ListItem(List=removeduplicatelines_5, Index=0, Wrap=True)
flip_curve_2 = FlipCurve(Curve=removeduplicatelines_5, Guide=list_item_6)  # -> Curve, Flag
amplitude_6 = Amplitude(Vector=cross_product_3.Vector, Amplitude="10")
end_points_3 = EndPoints(Curve=flip_curve_2.Curve)  # -> Start, End
reverse_4 = Reverse(Vector=amplitude_6)
deconstruct_4 = Deconstruct(Point=end_points_3.End)  # -> XComponent, YComponent, ZComponent
extrude_10 = Extrude(Base=removeduplicatelines_4, Direction=reverse_4)  # -> graft(Extrusion)
extrude_11 = Extrude(Base=removeduplicatelines_4, Direction=amplitude_6)  # -> graft(Extrusion)
create_set_2 = CreateSet(List=deconstruct_4.ZComponent)  # -> Set, Map
merge_19 = Merge(Data1=extrude_11, Data2=extrude_10)
member_index_2 = MemberIndex(Set=deconstruct_4.ZComponent, Member=create_set_2.Set)  # -> Index, Count
brep_join_3 = BrepJoin(Breps=merge_19)  # -> Breps, Closed
list_item_7 = ListItem(List=end_points_3.End, Index=member_index_2.Index, Wrap=True)
average_3 = Average(Input=list_item_7)
vector_2pt_4 = Vector2Pt(PointA=list_item_7, PointB=average_3, Unitize=invert(False))  # -> Vector, Length
list_item_8 = ListItem(List=flip_curve_2.Curve, Index=member_index_2.Index, Wrap=True)
cross_product_4 = CrossProduct(VectorA=vector_2pt_4.Vector, VectorB=list_item_8, Unitize=invert(False))  # -> Vector, Length
amplitude_7 = Amplitude(Vector=cross_product_4.Vector, Amplitude="10")
amplitude_8 = Amplitude(Vector=cross_product_4.Vector, Amplitude="10")
reverse_5 = Reverse(Vector=amplitude_7)
extrude_12 = Extrude(Base=list_item_8, Direction=reverse_5)  # -> graft(Extrusion)
extrude_13 = Extrude(Base=list_item_8, Direction=amplitude_8)  # -> graft(Extrusion)
merge_20 = Merge(Data1=extrude_13, Data2=extrude_12)
brep_join_4 = BrepJoin(Breps=merge_20)  # -> Breps, Closed
meshpipe_6 = MeshPipe(Curve=merge_17, Radius="2.5", Sides="4", Tolerance=10, Ending="3")
simple_mesh_6 = SimpleMesh(Brep=brep_join_3.Breps)
simple_mesh_7 = SimpleMesh(Brep=brep_join_4.Breps)

area_5 = Area(Geometry=rectangle.Rectangle)  # -> Area, Centroid
scale_5 = Scale(Geometry=rectangle.Rectangle, Center=area_5.Centroid, Factor="0.8")  # -> Geometry, Transform
extrude_14 = Extrude(Base=scale_5.Geometry, Direction=unit_z)
deconstruct_brep_5 = DeconstructBrep(Brep=extrude_14)  # -> Faces, Edges, Vertices
braced_grid_2_d_structure_6 = BracedGrid2DStructure(Surface=deconstruct_brep_5.Faces, UDivisions="80", VDivisions="1")  # -> PrimaryLines, BraceLines, StructureNodes
unit_z_16 = UnitZ(Factor=1)
dot_product_4 = DotProduct(VectorA=braced_grid_2_d_structure_6.PrimaryLines, VectorB=unit_z_16, Unitize=False)
equality_2 = Equality(FirstNumber=dot_product_4, SecondNumber="0")  # -> Equality, Inequality
dispatch_4 = Dispatch(List=braced_grid_2_d_structure_6.PrimaryLines, DispatchPattern=equality_2.Equality)  # -> simplify(ListA), simplify(ListB)
trim_tree_3 = TrimTree(Tree=dispatch_4.ListA, Depth=1)
join_curves_3 = JoinCurves(Curves=trim_tree_3, Preserve=False)
tree_statistics = TreeStatistics(Tree=join_curves_3)  # -> Paths, Length, Count
series_5 = Series(Start=0, Step=1, Count=tree_statistics.Count)  # -> graft(Series)
random_reduce = RandomReduce(List=join_curves_3, Reduction="50", Seed=series_5)  # -> simplify(List)
area_6 = Area(Geometry=random_reduce)  # -> Area, Centroid
deconstruct_5 = Deconstruct(Point=area_6.Centroid)  # -> XComponent, YComponent, ZComponent
sort_list = SortList(Keys=deconstruct_5.ZComponent, ValuesValuesA=random_reduce)  # -> Keys, ValuesValuesA
offset_curve_4 = OffsetCurve(Curve=sort_list.ValuesValuesA, Distance="10", Corners=1)
graft_tree_3 = GraftTree(Tree=sort_list.ValuesValuesA, IncludeEmptyLists=True, IncludeNullItems=True)
explode = Explode(Curve=offset_curve_4, Recursive=True)  # -> simplify(Segments), Vertices
construct_domain_5 = ConstructDomain(DomainStart="0", DomainEnd="6")
loft_6 = Loft(
    Curves=[graft_tree_3, offset_curve_4],
    Options={Adjust=False, Closed=False, LoftEnds=0, LoftSimp=0, LoftType=0, Rebuild=10, Refit=0.01})
unit_z_17 = UnitZ(Factor="10")
relative_item_4 = RelativeItem(Tree=explode.Segments, Offset="{+0;+1}", WrapPaths=False, WrapItems=False)  # -> ItemA, ItemB
tree_statistics_2 = TreeStatistics(Tree=relative_item_4.ItemA)  # -> Paths, Length, Count
series_6 = Series(Start=0, Step=1, Count=tree_statistics_2.Count)
random = Random(Range=construct_domain_5, Number=1, Seed=graft(series_6))  # -> simplify(Random)
match_tree = MatchTree(Tree=random, Guide=relative_item_4.ItemA)
round_3 = Round(Number=match_tree)  # -> Nearest, Floor, Ceiling
curve_middle_2 = CurveMiddle(Curve=relative_item_4.ItemB)
curve_middle_3 = CurveMiddle(Curve=relative_item_4.ItemA)
series_7 = Series(Start=0, Step=1, Count=round_3.Floor)
distance = Distance(PointA=curve_middle_3, PointB=curve_middle_2)
bounds = Bounds(Numbers=series_7)
remap_numbers = RemapNumbers(Value=series_7, Source=bounds, Target=Domain(0, 1))  # -> simplify(Mapped), Clipped
graft_tree_4 = GraftTree(Tree=distance, IncludeEmptyLists=True, IncludeNullItems=True)
tween_curve_2 = TweenCurve(CurveA=relative_item_4.ItemA, CurveB=relative_item_4.ItemB, Factor=remap_numbers.Mapped, BlendType=0)
extrude_15 = Extrude(Base=loft_6, Direction=unit_z_17)
brep = Brep(extrude_14)

sub_curve_3 = SubCurve(BaseCurve=reparameterize(move_3.Geometry), Domain=construct_domain_4)
perp_frames_3 = PerpFrames(Curve=sub_curve_3, Count="50", Align=True)  # -> Frames, Parameters
rectangle_4 = Rectangle(Plane=perp_frames_3.Frames, XSize=construct_domain, YSize=construct_domain_3, Radius=0)  # -> Rectangle, Length
loft_7 = Loft(
    Curves=rectangle_4.Rectangle,
    Options={Adjust=False, Closed=False, LoftEnds=0, LoftSimp=0, LoftType=0, Rebuild=10, Refit=0.01})
deconstruct_brep_6 = DeconstructBrep(Brep=loft_7)  # -> Faces, Edges, Vertices
area_7 = Area(Geometry=deconstruct_brep_6.Faces)  # -> Area, Centroid
deconstruct_6 = Deconstruct(Point=plane)  # -> XComponent, YComponent, ZComponent
deconstruct_7 = Deconstruct(Point=area_7.Centroid)  # -> XComponent, YComponent, ZComponent
construct_point_3 = ConstructPoint(XCoordinate=deconstruct_6.XComponent, YCoordinate=deconstruct_6.YComponent, ZCoordinate=deconstruct_7.ZComponent)
distance_2 = Distance(PointA=area_7.Centroid, PointB=construct_point_3)
sort_list_2 = SortList(Keys=distance_2, ValuesValuesA=deconstruct_brep_6.Faces)  # -> Keys, reverse(ValuesValuesA)
list_item_9 = ListItem(List=sort_list_2.ValuesValuesA, Index=0, Wrap=True)  # -> reverse(Item)
create_set_3 = CreateSet(List=round.Nearest)  # -> Set, Map
divide_domain²_3 = DivideDomain²(Domain=list_item_9, UCount=create_set_3.Set, VCount="1")
isotrim_2 = Isotrim(Surface=list_item_9, Domain=divide_domain²_3)
panel_3 = Panel("""1
-2""")
list_item_10 = ListItem(List=isotrim_2, Index=panel_3, Wrap=True)  # -> simplify(Item)
area_8 = Area(Geometry=list_item_10)  # -> Area, Centroid
curve_23 = Curve(offset_curve_2)
curve_closest_point_2 = CurveClosestPoint(Point=area_8.Centroid, Curve=curve_23)  # -> Point, Parameter, Distance
average_4 = Average(Input=curve_closest_point_2.Distance)
multiplication_8 = Multiplication(A=average_4, B="-1")
offset_surface = OffsetSurface(Surface=list_item_10, Distance=multiplication_8, BothSides=0, CreateSolid=True)
deconstruct_brep_7 = DeconstructBrep(Brep=offset_surface)  # -> Faces, Edges, Vertices
area_9 = Area(Geometry=deconstruct_brep_7.Faces)  # -> Area, Centroid
deconstruct_8 = Deconstruct(Point=area_9.Centroid)  # -> XComponent, YComponent, ZComponent
panel_4 = Panel("""20
-40""")
sort_list_3 = SortList(Keys=deconstruct_8.ZComponent, ValuesValuesA=deconstruct_brep_7.Faces)  # -> Keys, ValuesValuesA
panel_5 = Panel("""0
-1""")
unit_z_18 = UnitZ(Factor=panel_4)
cull_index = CullIndex(List=sort_list_3.ValuesValuesA, Indices=panel_5, Wrap=True)
list_item_11 = ListItem(List=sort_list_3.ValuesValuesA, Index=panel_5, Wrap=True)
area_10 = Area(Geometry=cull_index)  # -> Area, Centroid
sort_list_4 = SortList(Keys=area_10.Area, ValuesValuesA=cull_index)  # -> Keys, reverse(ValuesValuesA)
panel_6 = Panel("""0
1""")
list_item_12 = ListItem(List=sort_list_4.ValuesValuesA, Index=panel_6, Wrap=True)
offset_surface_2 = OffsetSurface(Surface=list_item_12, Distance="5", Retrim=True)
braced_grid_2_d_structure_7 = BracedGrid2DStructure(Surface=offset_surface_2, UDivisions="1", VDivisions=10)  # -> PrimaryLines, BraceLines, StructureNodes
extrude_16 = Extrude(Base=simplify(list_item_11), Direction=unit_z_18)
meshpipe_7 = MeshPipe(Curve=braced_grid_2_d_structure_7.BraceLines, Radius="2.5", Sides="4", Tolerance=10, Ending="3")
meshpipe_8 = MeshPipe(Curve=braced_grid_2_d_structure_7.PrimaryLines, Radius="5", Sides="4", Tolerance=10, Ending="3")

end_points_4 = EndPoints(Curve=curve_6)  # -> Start, End
end_points_5 = EndPoints(Curve=curve_5)  # -> Start, End
end_points_6 = EndPoints(Curve=curve_4)  # -> Start, End
curve_24 = Curve(curve_6)
deconstruct_9 = Deconstruct(Point=end_points_4.Start)  # -> XComponent, YComponent, ZComponent
deconstruct_10 = Deconstruct(Point=plane)  # -> XComponent, YComponent, ZComponent
vector_2pt_5 = Vector2Pt(PointA=end_points_6.Start, PointB=end_points_4.Start, Unitize=invert(False))  # -> Vector, Length
construct_point_4 = ConstructPoint(XCoordinate=deconstruct_10.XComponent, YCoordinate=deconstruct_10.YComponent, ZCoordinate=deconstruct_9.ZComponent)
multiplication_9 = Multiplication(A=vector_2pt_5.Vector, B="200")
subtraction = Subtraction(A=multiplication_4, B=multiplication_3)
vector_2pt_6 = Vector2Pt(PointA=construct_point_4, PointB=end_points_5.Start, Unitize=invert(False))  # -> Vector, Length
multiplication_10 = Multiplication(A=subtraction, B=0.5)  # -> graft(Result)
multiplication_11 = Multiplication(A=vector_2pt_6.Vector, B=multiplication_10)
bezier_span = BezierSpan(StartPoint=end_points_4.Start, StartTangent=multiplication_9, EndPoint=end_points_5.Start, EndTangent=multiplication_11)  # -> Curve, Length, Domain
sweep2 = Sweep2(Rail1=curve_24, Rail2=curve_5, Sections=bezier_span.Curve, SameHeight=False)

cull_index_2 = CullIndex(List=divide_domain², Indices=panel, Wrap=True)
deconstruct_domain² = DeconstructDomain²(Domain=cull_index_2)  # -> UMin, UMax, VMin, VMax
sort_list_5 = SortList(Keys=deconstruct_domain².UMin)  # -> Keys, ValuesValuesA
sort_list_6 = SortList(Keys=deconstruct_domain².UMax)  # -> reverse(Keys), ValuesValuesA
list_item_13 = ListItem(List=sort_list_5.Keys, Index=0, Wrap=True)
list_item_14 = ListItem(List=sort_list_6.Keys, Index=0, Wrap=True)
list_item_15 = ListItem(List=deconstruct_domain².VMin, Index=0, Wrap=True)
list_item_16 = ListItem(List=deconstruct_domain².VMax, Index=0, Wrap=True)
construct_domain² = ConstructDomain²(UMin=list_item_13, UMax=list_item_14, VMin=list_item_15, VMax=list_item_16)
isotrim_3 = Isotrim(Surface=loft, Domain=construct_domain²)  # -> simplify(Surface)

brep_edges = BrepEdges(Brep=isotrim_3)  # -> Naked, Interior, NonManifold
curve_middle_4 = CurveMiddle(Curve=brep_edges.Naked)
deconstruct_11 = Deconstruct(Point=curve_middle_4)  # -> XComponent, YComponent, ZComponent
sort_list_7 = SortList(Keys=deconstruct_11.ZComponent, ValuesValuesA=brep_edges.Naked)  # -> Keys, ValuesValuesA
multiplication_12 = Multiplication(A=subtraction, B="-0.2")  # -> graft(Result)
list_item_17 = ListItem(List=sort_list_7.ValuesValuesA, Index="0", Wrap=True)
list_item_18 = ListItem(List=sort_list_7.ValuesValuesA, Index="-1", Wrap=True)
offset_curve_5 = OffsetCurve(Curve=list_item_17, Distance=multiplication_12, Corners=1)
curve_middle_5 = CurveMiddle(Curve=list_item_18)
division_8 = Division(A="1", B="3")
project = Project(Geometry=offset_curve_5, Plane=curve_middle_5)  # -> Geometry, Transform
series_8 = Series(Start=0, Step="75", Count="3")
series_9 = Series(Start=0, Step=division_8, Count="3")
curve_middle_6 = CurveMiddle(Curve=project.Geometry)
curve_middle_7 = CurveMiddle(Curve=offset_curve_5)
tween_curve_3 = TweenCurve(CurveA=offset_curve_5, CurveB=project.Geometry, Factor=series_9, BlendType=0)  # -> simplify(Tween)
deconstruct_12 = Deconstruct(Point=curve_middle_7)  # -> XComponent, YComponent, ZComponent
deconstruct_13 = Deconstruct(Point=curve_middle_6)  # -> XComponent, YComponent, ZComponent
tree_statistics_3 = TreeStatistics(Tree=tween_curve_3)  # -> Paths, Length, Count
subtraction_2 = Subtraction(A=deconstruct_13.ZComponent, B=deconstruct_12.ZComponent)
series_10 = Series(Start=0, Step=1, Count=tree_statistics_3.Count)
division_9 = Division(A=subtraction_2, B="3")
power = Power(A="-1", B=series_10)  # -> graft(Result)
multiplication_13 = Multiplication(A=power, B=series_8)
offset_curve_6 = OffsetCurve(Curve=tween_curve_3, Distance=multiplication_13, Corners=1)
trim_tree_4 = TrimTree(Tree=offset_curve_6, Depth=1)  # -> simplify(Tree)
divide_length = DivideLength(Curve=offset_curve_6, Length="150")  # -> simplify(Points), Tangents, Parameters
unit_z_19 = UnitZ(Factor=division_9)
unit_z_20 = UnitZ(Factor=1)
trim_tree_5 = TrimTree(Tree=divide_length.Points, Depth=1)
line_sdl = LineSDL(Start=trim_tree_5, Direction=unit_z_20, Length=division_9)
move_10 = Move(Geometry=trim_tree_4, Motion=unit_z_19)  # -> simplify(graft(Geometry)), Transform
graft_tree_5 = GraftTree(Tree=trim_tree_4, IncludeEmptyLists=True, IncludeNullItems=True)
relative_items = RelativeItems(TreeA=move_10.Geometry, TreeB=graft_tree_5, Offset="{+0;+1}", WrapPaths=False, WrapItems=False)  # -> ItemA, ItemB
extrude_17 = Extrude(Base=trim_tree_4, Direction=unit_z_19)
meshpipe_9 = MeshPipe(Curve=line_sdl, Radius="3", Sides=4, Tolerance=10, Ending=3)
loft_8 = Loft(
    Curves=[relative_items.ItemA, relative_items.ItemB],
    Options={Adjust=False, Closed=False, LoftEnds=0, LoftSimp=0, LoftType=0, Rebuild=10, Refit=0.01})

list_item_19 = ListItem(List=divide_domain², Index=panel, Wrap=True)
isotrim_4 = Isotrim(Surface=loft, Domain=list_item_19)  # -> simplify(Surface)
unit_z_21 = UnitZ(Factor=number)
curve_25 = Curve(move.Geometry)
brep_edges_2 = BrepEdges(Brep=isotrim_4)  # -> Naked, Interior, NonManifold
extrude_18 = Extrude(Base=curve_25, Direction=unit_z_21)
curve_26 = Curve(simplify(list_item_17))
trim_tree_6 = TrimTree(Tree=brep_edges_2.Naked, Depth=1)
pull_curve = PullCurve(Curve=curve_26, Surface=extrude_18)  # -> simplify(Curve)
curve_middle_8 = CurveMiddle(Curve=trim_tree_6)
area_11 = Area(Geometry=isotrim_4)  # -> Area, Centroid
extrude_19 = Extrude(Base=pull_curve, Direction=unit_z_21)
deconstruct_14 = Deconstruct(Point=curve_middle_8)  # -> XComponent, YComponent, ZComponent
deconstruct_15 = Deconstruct(Point=area_11.Centroid)  # -> XComponent, YComponent, ZComponent
curve_27 = Curve(simplify(list_item_18))
merge_21 = Merge(Data1=pull_curve, Data2=curve_25)
sort_list_8 = SortList(Keys=deconstruct_14.ZComponent, ValuesValuesA=trim_tree_6)  # -> Keys, reverse(ValuesValuesA)
sort_list_9 = SortList(Keys=deconstruct_15.ZComponent, ValuesValuesA=isotrim_4)  # -> Keys, reverse(ValuesValuesA)
pull_curve_2 = PullCurve(Curve=curve_27, Surface=extrude_19)  # -> simplify(Curve)
list_item_20 = ListItem(List=merge_21, Index=0, Wrap=True)
list_item_21 = ListItem(List=sort_list_8.ValuesValuesA, Index=0, Wrap=True)
list_item_22 = ListItem(List=sort_list_9.ValuesValuesA, Index=0, Wrap=True)  # -> Item, Item1
flip_curve_3 = FlipCurve(Curve=pull_curve_2)  # -> Curve, Flag
pull_curve_3 = PullCurve(Curve=list_item_21, Surface=extrude_19)  # -> simplify(Curve)
flip_curve_4 = FlipCurve(Curve=merge_21, Guide=list_item_20)  # -> Curve, Flag
loft_9 = Loft(
    Curves=[curve_27, pull_curve_2],
    Options={Adjust=False, Closed=False, LoftEnds=0, LoftSimp=0, LoftType=0, Rebuild=10, Refit=0.01})
loft_10 = Loft(
    Curves=[flip_curve_3.Curve, pull_curve],
    Options={Adjust=False, Closed=False, LoftEnds=0, LoftSimp=0, LoftType=0, Rebuild=10, Refit=0.01})
loft_11 = Loft(
    Curves=[curve_26, pull_curve],
    Options={Adjust=False, Closed=False, LoftEnds=0, LoftSimp=0, LoftType=0, Rebuild=10, Refit=0.01})
loft_12 = Loft(
    Curves=[pull_curve_3, pull_curve_2],
    Options={Adjust=False, Closed=False, LoftEnds=0, LoftSimp=0, LoftType=0, Rebuild=10, Refit=0.01})
loft_13 = Loft(
    Curves=flip_curve_4.Curve,
    Options={Adjust=False, Closed=False, LoftEnds=0, LoftSimp=0, LoftType=0, Rebuild=10, Refit=0.01})
loft_14 = Loft(
    Curves=[pull_curve_3, list_item_21],
    Options={Adjust=False, Closed=False, LoftEnds=0, LoftSimp=0, LoftType=0, Rebuild=10, Refit=0.01})
brep_join_5 = BrepJoin(Breps=[loft_14, list_item_22.Item])  # -> Breps, Closed
brep_topology = BrepTopology(Brep=brep_join_5.Breps, PerspectiveOnly=False)  # -> FaceFaceAdjacency, FaceEdgeAdjacency, EdgeFaceAdjacency
trim_tree_7 = TrimTree(Tree=brep_topology.FaceEdgeAdjacency, Depth=1)
create_set_4 = CreateSet(List=trim_tree_7)  # -> Set, Map
member_index_3 = MemberIndex(Set=trim_tree_7, Member=create_set_4.Set)  # -> simplify(Index), Count
tree_statistics_4 = TreeStatistics(Tree=member_index_3.Index)  # -> Paths, Length, Count
larger_than = LargerThan(FirstNumber=tree_statistics_4.Length, SecondNumber="1")  # -> LargerThan, OrEqualTo
dispatch_5 = Dispatch(List=tree_statistics_4.Paths, DispatchPattern=larger_than.LargerThan)  # -> ListA, ListB
tree_branch = TreeBranch(Tree=member_index_3.Index, Path=dispatch_5.ListA, MaintainPaths=True)  # -> simplify(Branch)
list_item_23 = ListItem(List=tree_branch, Index=0, Wrap=True)
fillet_edge = FilletEdge(Shape=brep_join_5.Breps, Blend=0, Metric=0, Edges=list_item_23, Radii="10")
offset_surface_3 = OffsetSurface(Surface=loft_10, Distance="-50", Retrim=True)
merge_22 = Merge(
    Data1=simplify(loft_9),
    Data2=simplify(loft_11),
    Data3=simplify(sweep2),
    Data4=simplify(loft_12),
    Data5=simplify(loft_13),
    Data6=simplify(fillet_edge),
    Data7=simplify(list_item_22.Item1))
divide_domain²_4 = DivideDomain²(Domain=offset_surface_3, UCount="4", VCount="36")
brep_join_6 = BrepJoin(Breps=merge_22)  # -> Breps, Closed
isotrim_5 = Isotrim(Surface=offset_surface_3, Domain=divide_domain²_4)
offset_surface_4 = OffsetSurface(Surface=loft_10, Distance="-300", Retrim=True)
cap_holes = CapHoles(Brep=brep_join_6.Breps)
curve_28 = Curve(isotrim_5)
meshpipe_10 = MeshPipe(Curve=curve_28, Radius="1", Sides="4", Tolerance=10, Ending="3")

brep_edges_3 = BrepEdges(Brep=isotrim_3)  # -> Naked, Interior, NonManifold
length_4 = Length(Curve=brep_edges_3.Naked)
average_5 = Average(Input=length_4)
division_10 = Division(A=average_5, B="220")
round_4 = Round(Number=division_10)  # -> Nearest, Floor, Ceiling
triangle_panels_b = TrianglePanelsB(Surface=isotrim_3, UDivisions="1", VDivisions=round_4.Nearest)
area_12 = Area(Geometry=triangle_panels_b)  # -> Area, Centroid
scale_6 = Scale(Geometry=triangle_panels_b, Center=area_12.Centroid, Factor="0.9")  # -> Geometry, Transform
curve_29 = Curve(graft(triangle_panels_b))
curve_30 = Curve(graft(scale_6.Geometry))
loft_15 = Loft(
    Curves=[curve_29, curve_30],
    Options={Adjust=False, Closed=False, LoftEnds=0, LoftSimp=0, LoftType=0, Rebuild=10, Refit=0.01})
offset_surface_5 = OffsetSurface(Surface=loft_15, Distance="-10", BothSides=0, CreateSolid=True)

brep_edges_4 = BrepEdges(Brep=brep_join_6.Breps)  # -> Naked, Interior, NonManifold
join_curves_4 = JoinCurves(Curves=brep_edges_4.Naked, Preserve=False)  # -> simplify(Curves)
split_tree_2 = SplitTree(Data=join_curves_4, Masks=flatten("{*;0}"))  # -> Positive, Negative
reverse_list = ReverseList(List=split_tree_2.Negative)
merge_23 = Merge(Data1=split_tree_2.Positive, Data2=reverse_list)
list_item_24 = ListItem(List=merge_23, Index=0, Wrap=True)  # -> Item, Item1
trim_tree_8 = TrimTree(Tree=list_item_24.Item1, Depth=1)
trim_tree_9 = TrimTree(Tree=list_item_24.Item, Depth=1)
entwine = Entwine(Branch0X=trim_tree_9, Branch1X=trim_tree_8, FlattenInputs=False)
explode_2 = Explode(Curve=entwine, Recursive=True)  # -> Segments, Vertices
end_points_7 = EndPoints(Curve=explode_2.Segments)  # -> Start, End
unit_z_22 = UnitZ(Factor=1)
vector_2pt_7 = Vector2Pt(PointA=end_points_7.Start, PointB=end_points_7.End, Unitize=invert(False))  # -> Vector, Length
dot_product_5 = DotProduct(VectorA=vector_2pt_7.Vector, VectorB=unit_z_22, Unitize=invert(False))
boundary_surfaces_2 = BoundarySurfaces(Edges=entwine)
area_13 = Area(Geometry=boundary_surfaces_2)  # -> Area, Centroid
dispatch_6 = Dispatch(List=explode_2.Segments, DispatchPattern=dot_product_5)  # -> ListA, ListB
brep_closest_point = BrepClosestPoint(Point=area_13.Centroid, Brep=boundary_surfaces_2)  # -> Point, Normal, Distance
join_curves_5 = JoinCurves(Curves=dispatch_6.ListA, Preserve=False)  # -> simplify(Curves)
unit_z_23 = UnitZ(Factor=1)
average_6 = Average(Input=brep_closest_point.Point)
list_item_25 = ListItem(List=brep_closest_point.Normal, Index=0, Wrap=True)
trim_tree_10 = TrimTree(Tree=join_curves_5, Depth=1)
cross_product_5 = CrossProduct(VectorA=list_item_25, VectorB=unit_z_23, Unitize=False)  # -> Vector, Length
end_points_8 = EndPoints(Curve=trim_tree_10)  # -> Start, End
construct_plane = ConstructPlane(Origin=average_6, XAxis=cross_product_5.Vector, YAxis=unit_z_23)
circle_3 = Circle(Plane=construct_plane, Radius=100)
merge_24 = Merge(Data1=end_points_8.Start, Data2=end_points_8.End)
sort_along_curve_2 = SortAlongCurve(Points=merge_24, Curve=circle_3)  # -> Points, simplify(Indices)
dispatch_7 = Dispatch(List=sort_along_curve_2.Points, DispatchPattern=[True, False])  # -> ListA, ListB
shift_list_5 = ShiftList(List=dispatch_7.ListB, Shift="-1", Wrap=True)
line_4 = Line(StartPoint=dispatch_7.ListA, EndPoint=shift_list_5)  # -> simplify(Line)
curve_31 = Curve(trim_tree_10)
join_curves_6 = JoinCurves(Curves=[line_4, curve_31], Preserve=False)  # -> simplify(Curves)
boundary_surfaces_3 = BoundarySurfaces(Edges=join_curves_6)
area_14 = Area(Geometry=boundary_surfaces_3)  # -> Area, Centroid
md_slider = MDSlider(SliderMode=0, slider_value=Point(0.5, 0.5, 0.5), x_domain=Domain(0, 1), y_domain=Domain(0, 1), z_domain=Domain(0, 1))
scale_7 = Scale(Geometry=boundary_surfaces_3, Center=area_14.Centroid, Factor="1.2")  # -> Geometry, Transform
evaluate_surface = EvaluateSurface(Surface=reparameterize(scale_7.Geometry), Point=md_slider)  # -> Point, Normal, UDirection, VDirection, Frame
amplitude_9 = Amplitude(Vector=evaluate_surface.Normal, Amplitude="40")
extrude_20 = Extrude(Base=scale_7.Geometry, Direction=amplitude_9)

surface = Surface(scale_6.Geometry)

deconstruct_brep_8 = DeconstructBrep(Brep=fillet_edge)  # -> Faces, Edges, Vertices
area_15 = Area(Geometry=deconstruct_brep_8.Faces)  # -> Area, Centroid
deconstruct_16 = Deconstruct(Point=area_15.Centroid)  # -> XComponent, YComponent, ZComponent
sort_list_10 = SortList(Keys=deconstruct_16.ZComponent, ValuesValuesA=deconstruct_brep_8.Faces)  # -> Keys, reverse(ValuesValuesA)
list_item_26 = ListItem(List=sort_list_10.ValuesValuesA, Index=0, Wrap=True)
divide_domain²_5 = DivideDomain²(Domain=list_item_26, UCount="4", VCount="1")
subtraction_3 = Subtraction(A="4", B="1")
series_11 = Series(Start="15", Step="15", Count=subtraction_3)
isotrim_6 = Isotrim(Surface=list_item_26, Domain=divide_domain²_5)
unit_z_24 = UnitZ(Factor=series_11)
area_16 = Area(Geometry=isotrim_6)  # -> Area, Centroid
sort_list_11 = SortList(Keys=area_16.Area, ValuesValuesA=isotrim_6)  # -> Keys, reverse(ValuesValuesA)
cull_index_3 = CullIndex(List=sort_list_11.ValuesValuesA, Indices="0", Wrap=True)  # -> simplify(List)
extrude_21 = Extrude(Base=cull_index_3, Direction=unit_z_24)
