# Grasshopper definition #51_AI_column.gh (Grasshopper 1.0.7)
# plug-ins: DendroGH, Kangaroo2 Components, MeshEdit Components, Bifocals

height = Panel("280")
count = Panel("20")
division = Division(A=height, B=count)
circle = Circle(Plane=PlaneXY(0, 0, 0), Radius="150")
series = Series(Start=0, Step=division, Count=count)
bounds = Bounds(Numbers=series)
remap_numbers = RemapNumbers(Value=series, Source=bounds, Target=Domain(0, 1))  # -> Mapped, Clipped
graph_mapper = GraphMapper(
    remap_numbers.Mapped,
    x0=0,
    x1=1,
    y0=0,
    y1=1,
    container_name="Bezier",
    cpx=[0, 0.179760471, 0.8841013312, 1],
    cpy=[0, 0, 0.874765873, 1])
graph_mapper_2 = GraphMapper(
    remap_numbers.Mapped,
    x0=0,
    x1=1,
    y0=0,
    y1=1,
    container_name="Bezier2",
    pt=[Point(0, 0.7045952678, 0), Point(0.1271627694, 0.1991055012, 0), Point(0.3710204695, 0.1734374277, 0), Point(0.6406440139, 0.2501192093, 0), Point(0.812826395, 0.2990884185, 0), Point(0.8760128021, 0.5660501719, 0), Point(1, 1, 0)])
remap_numbers_2 = RemapNumbers(Value=graph_mapper, Source=Domain(0, 1), Target=bounds)  # -> Mapped, Clipped
unit_z = UnitZ(Factor=remap_numbers_2.Mapped)
move = Move(Geometry=circle, Motion=unit_z)  # -> Geometry, Transform
area = Area(Geometry=move.Geometry)  # -> Area, Centroid
scale = Scale(Geometry=move.Geometry, Center=area.Centroid, Factor=graph_mapper_2)  # -> Geometry, Transform
divide_curve = DivideCurve(Curve=scale.Geometry, Count="40", Kinks=False)  # -> Points, Tangents, Parameters
flip_matrix = FlipMatrix(Data=divide_curve.Points)  # -> simplify(Data)
split_tree = SplitTree(Data=flip_matrix, Masks=flatten("{0,2,...}"))  # -> Positive, Negative
dispatch = Dispatch(List=split_tree.Positive, DispatchPattern=[True, False])  # -> ListA, ListB
dispatch_2 = Dispatch(List=split_tree.Negative, DispatchPattern=[True, False])  # -> ListA, ListB
curve = Curve(scale.Geometry)
point = Point(dispatch.ListB)
point_2 = Point(dispatch_2.ListA)
integer = Integer("40")
point_3 = Point(point)
point_4 = Point(point_2)
curve_2 = Curve(curve)
integer_2 = Integer(integer)
relative_items = RelativeItems(TreeA=point_3, TreeB=point_4, Offset="{+1}", WrapPaths=invert(False), WrapItems=False)  # -> ItemA, ItemB
relative_items_2 = RelativeItems(TreeA=point_3, TreeB=point_4, Offset="{-1}", WrapPaths=invert(False), WrapItems=False)  # -> ItemA, ItemB
weave = Weave(Pattern=[0, 1], Stream0=relative_items.ItemB, Stream1=relative_items.ItemA, NullGaps=False)
weave_2 = Weave(Pattern=[0, 1], Stream0=relative_items_2.ItemB, Stream1=relative_items_2.ItemA, NullGaps=False)
split_list = SplitList(List=curve_2, Index="9")  # -> ListA, ListB
list_length = ListLength(List=split_list.ListA)
pi = Pi(Factor=Slider(0.915, range=0..2))
pi_2 = Pi(Factor=Slider(1.068, range=0..2))
split_list_2 = SplitList(List=weave, Index="9")  # -> simplify(ListA), simplify(ListB)
split_list_3 = SplitList(List=weave_2, Index="9")  # -> ListA, simplify(ListB)
series_2 = Series(Start=0, Step=1, Count=list_length)
area_2 = Area(Geometry=split_list.ListA)  # -> Area, Centroid
area_3 = Area(Geometry=split_list.ListA)  # -> Area, Centroid
rotate = Rotate(Geometry=split_list.ListA, Angle=pi_2, Plane=PlaneXY(0, 0, 0))  # -> Geometry, Transform
rotate_2 = Rotate(Geometry=split_list.ListA, Angle=pi, Plane=PlaneXY(0, 0, 0))  # -> Geometry, Transform
bounds_2 = Bounds(Numbers=series_2)
remap_numbers_3 = RemapNumbers(Value=series_2, Source=bounds_2, Target=Domain(0, 1))  # -> Mapped, Clipped
graph_mapper_3 = GraphMapper(
    remap_numbers_3.Mapped,
    x0=0,
    x1=1,
    y0=0,
    y1=1,
    container_name="Bezier",
    cpx=[0, 0.2306385934, 0.6842412353, 1],
    cpy=[0.5949295759, 0.7692428827, 0.8725236654, 1])
integer_3 = Integer(integer_2)
list_item = ListItem(List=split_list_2.ListB, Index=0, Wrap=True)
pi_3 = Pi(Factor=graph_mapper_3)
pi_4 = Pi(Factor=graph_mapper_3)
path_mapper = PathMapper(list_item, source="{A}", target="{path_index}")
division_2 = Division(A=integer_3, B="2")
rotate_3 = Rotate(Geometry=rotate_2.Geometry, Angle=pi_4, Plane=area_2.Centroid)  # -> Geometry, Transform
rotate_4 = Rotate(Geometry=rotate.Geometry, Angle=pi_3, Plane=area_3.Centroid)  # -> Geometry, Transform
divide_curve_2 = DivideCurve(Curve=rotate_3.Geometry, Count=division_2, Kinks=False)  # -> Points, Tangents, Parameters
divide_curve_3 = DivideCurve(Curve=rotate_4.Geometry, Count=division_2, Kinks=False)  # -> Points, Tangents, Parameters
flip_matrix_2 = FlipMatrix(Data=divide_curve_2.Points)  # -> simplify(Data)
flip_matrix_3 = FlipMatrix(Data=divide_curve_3.Points)  # -> simplify(Data)
merge = Merge(Data1=flip_matrix_2, Data2=path_mapper)
merge_2 = Merge(Data1=flip_matrix_3, Data2=path_mapper)
integer_4 = Integer(integer_3)
pt_set_1 = Point(merge_2)
pt_set_3 = Point(split_list_3.ListA)
pt_set_5 = Point(split_list_3.ListB)
pt_set_4 = Point(split_list_2.ListB)
pt_set_2 = Point(merge)
curve_3 = Curve(curve_2)
curve_4 = Curve(curve_3)
pt_set_4_2 = Point(pt_set_4)
pt_set_3_2 = Point(pt_set_3)
pt_set_5_2 = Point(pt_set_5)
integer_5 = Integer(integer_4)
pt_set_1_2 = Point(pt_set_1)
pt_set_2_2 = Point(pt_set_2)
list_item_2 = ListItem(PtSet4=pt_set_4_2, Index=0, Wrap=True)
pt_set_3_3 = Point(simplify(pt_set_3_2))
merge_3 = Merge(Data1=pt_set_3_3, Data2=list_item_2)
interpolate = Interpolate(Vertices=pt_set_5_2, Degree=3, Periodic=False, KnotStyle=1)  # -> simplify(CurveSet5), Length, Domain
interpolate_2 = Interpolate(Vertices=pt_set_4_2, Degree=3, Periodic=False, KnotStyle=1)  # -> CurveSet4, Length, Domain
loft = Loft(Curves=curve_4, Options={Adjust=False, Closed=False, LoftEnds=0, LoftSimp=0, LoftType=0, Rebuild=10, Refit=0.01})
flip_matrix_4 = FlipMatrix(Data=merge_3)
interpolate_3 = Interpolate(Vertices=flip_matrix_4, Degree=3, Periodic=invert(False), KnotStyle=1)  # -> Curve, Length, Domain
curve_set_4 = Curve(interpolate_2.CurveSet4)
curve_set_5 = Curve(interpolate.CurveSet5)

brep_closest_point = BrepClosestPoint(PtSet5=pt_set_5_2, Brep=loft)  # -> Point, Normal, Distance
brep_closest_point_2 = BrepClosestPoint(PtSet4=pt_set_4_2, Brep=loft)  # -> Point, Normal, Distance
deconstruct = Deconstruct(Point=brep_closest_point.Point)  # -> XComponent, YComponent, ZComponent
bounds_3 = Bounds(Numbers=deconstruct.ZComponent)
remap_numbers_4 = RemapNumbers(Value=deconstruct.ZComponent, Source=bounds_3, Target=Domain(0, 1))  # -> Mapped, Clipped
graph_mapper_4 = GraphMapper(
    remap_numbers_4.Mapped,
    x0=0,
    x1=1,
    y0=0,
    y1=1,
    container_name="Bezier",
    cpx=[0, 0.1756114066, 0.7003403902, 1],
    cpy=[0.6082130671, 0.3442086577, 0.1977857947, 0.1949192882])
multiplication = Multiplication(A=graph_mapper_4, B="-4")
amplitude = Amplitude(Vector=brep_closest_point.Normal, Amplitude=multiplication)
amplitude_2 = Amplitude(Vector=brep_closest_point_2.Normal, Amplitude=multiplication)
move_2 = Move(Geometry=pt_set_5_2, Motion=amplitude)  # -> Geometry, Transform
move_3 = Move(Geometry=pt_set_4_2, Motion=amplitude_2)  # -> Geometry, Transform
interpolate_4 = Interpolate(Vertices=move_3.Geometry, Degree=3, Periodic=False, KnotStyle=1)  # -> simplify(Curve), Length, Domain
interpolate_5 = Interpolate(Vertices=move_2.Geometry, Degree=3, Periodic=False, KnotStyle=1)  # -> simplify(Curve), Length, Domain

relative_items_3 = RelativeItems(CurveSet4=curve_set_4, CurveSet5=curve_set_5, Offset="{+2}", WrapPaths=False, WrapItems=False)  # -> ItemA, ItemB
number_slider = Slider(3.6, range=0..5)
flip_curve = FlipCurve(Curve=relative_items_3.ItemB)  # -> Curve, Flag
blend_curve = BlendCurve(CurveA=relative_items_3.ItemA, CurveB=flip_curve.Curve, BulgeA=number_slider, BulgeB=number_slider, Continuity=1)
path_mapper_2 = PathMapper(blend_curve, source="{A}", target="{path_index}")
split_tree_2 = SplitTree(Data=path_mapper_2, Masks=flatten("{0,2,...}"))  # -> Positive, Negative

curve_closest_point = CurveClosestPoint(PtSet4=pt_set_4_2, CurveSet4=curve_set_4)  # -> Point, Parameter, Distance
curve_closest_point_2 = CurveClosestPoint(PtSet5=pt_set_5_2, CurveSet5=curve_set_5)  # -> Point, Parameter, Distance
shatter = Shatter(Curve=curve_set_4, Parameters=curve_closest_point.Parameter)
shatter_2 = Shatter(Curve=curve_set_5, Parameters=curve_closest_point_2.Parameter)
curve_set_4_1 = Curve(interpolate_4.Curve)
curve_set_5_1 = Curve(interpolate_5.Curve)
curve_set_4_2 = Curve(curve_set_4)
curve_set_5_2 = Curve(curve_set_5)
curve_set_6 = Curve(split_tree_2.Positive)
curve_5 = Curve(shatter_2)
curve_6 = Curve(shatter)
brep = Brep(loft)
curve_set_5_1_2 = Curve(curve_set_5_1)
curve_set_4_1_2 = Curve(curve_set_4_1)
curve_set_4_3 = Curve(curve_set_4_2)
brep_2 = Brep(brep)
curve_set_5_3 = Curve(curve_set_5_2)
curve_set_6_2 = Curve(curve_set_6)
curve_7 = Curve(curve_5)
curve_8 = Curve(curve_6)
curve_set_5_1_3 = Curve(curve_set_5_1_2)
curve_set_4_1_3 = Curve(curve_set_4_1_2)
curve_set_4_4 = Curve(curve_set_4_3)
curve_set_6_3 = Curve(curve_set_6_2)
curve_set_5_4 = Curve(curve_set_5_3)
curve_set_6_4 = Curve(curve_set_6_2)
curve_9 = Curve(curve_6)
curve_10 = Curve(curve_5)
# infill
curve_set_6_5 = Curve(curve_set_6_4)
curve_11 = Curve(curve_10)
curve_12 = Curve(curve_9)

cull_index = CullIndex(List=curve_11, Indices="0", Wrap=True)
cull_index_2 = CullIndex(List=curve_12, Indices="0", Wrap=True)
partition_list = PartitionList(List=curve_11, Size="2")
partition_list_2 = PartitionList(List=curve_12, Size="2")
partition_list_3 = PartitionList(List=cull_index, Size="2")  # -> simplify(Chunks)
partition_list_4 = PartitionList(List=cull_index_2, Size="2")  # -> simplify(Chunks)
join_curves = JoinCurves(Curves=partition_list, Preserve=False)
join_curves_2 = JoinCurves(Curves=partition_list_2, Preserve=False)
relative_items_4 = RelativeItems(TreeA=partition_list_4, TreeB=partition_list_3, Offset="{+2;+0}", WrapPaths=invert(False), WrapItems=invert(False))  # -> ItemA, ItemB
merge_4 = Merge(Data1=join_curves_2, Data2=join_curves)
loft_2 = Loft(Curves=merge_4, Options={Adjust=False, Closed=False, LoftEnds=0, LoftSimp=0, LoftType=0, Rebuild=10, Refit=0.01})  # -> simplify(Loft)
join_curves_3 = JoinCurves(Curves=relative_items_4.ItemA, Preserve=False)  # -> simplify(Curves)
join_curves_4 = JoinCurves(Curves=relative_items_4.ItemB, Preserve=False)  # -> simplify(Curves)
split_tree_3 = SplitTree(Data=join_curves_3, Masks=flatten("{*;4}"))  # -> flatten(Positive), Negative
split_tree_4 = SplitTree(Data=join_curves_4, Masks=flatten("{*;4}"))  # -> flatten(Positive), Negative
loft_3 = Loft(
    Curves=[split_tree_3.Negative, split_tree_4.Negative],
    Options={Adjust=False, Closed=False, LoftEnds=0, LoftSimp=0, LoftType=0, Rebuild=10, Refit=0.01})
dispatch_3 = Dispatch(List=split_tree_3.Positive, DispatchPattern=[True, False])  # -> ListA, ListB
dispatch_4 = Dispatch(List=split_tree_4.Positive, DispatchPattern=[True, False])  # -> ListA, ListB
split_tree_5 = SplitTree(Data=loft_3, Masks=flatten("{2,6,...;*}"))  # -> Positive, Negative
merge_5 = Merge(Data1=dispatch_3.ListA, Data2=dispatch_4.ListA, Data3=curve_set_6_5)  # -> flatten(Result)
merge_6 = Merge(Data1=split_tree_5.Negative, Data2=loft_2)  # -> graft(Result)
join_curves_5 = JoinCurves(Curves=merge_5, Preserve=False)  # -> graft(Curves)
explode = Explode(Curve=join_curves_5, Recursive=True)  # -> Segments, Vertices

brep_3 = Brep(merge_6)
curve_13 = Curve(explode.Segments)
curve_14 = Curve(curve_13)
brep_4 = Brep(brep_3)

patch = Patch(Curves=curve_14, Spans=20, Flexibility=1, Trim=True)
mesh_brep = MeshBrep(
    Brep=patch,
    Settings={GridMaxCount=0, GridMinCount=16, JaggedSeams=False, MaxEdgeLength=0, MinEdgeLength=0.0001, MinTolerance=0, Refine=True, RefineAngle=0, RelativeTolerance=0.65, SimplePlanes=True, Tolerance=0})
tree_statistics = TreeStatistics(Tree=patch)  # -> Paths, Length, Count
series_3 = Series(Start=0, Step=1, Count=tree_statistics.Count)  # -> graft(Series)
mesh_area = MeshArea(Mesh=mesh_brep)  # -> Area, Centroid
division_3 = Division(A=mesh_area.Area, B="25")
round = Round(Number=division_3)  # -> Nearest, Floor, Ceiling
populate_geometry = PopulateGeometry(Geometry=patch, Count=round.Floor, Seed=series_3)
brep_closest_point_3 = BrepClosestPoint(Point=populate_geometry, Brep=patch)  # -> Point, Normal, Distance
average = Average(Input=brep_closest_point_3.Point)
average_2 = Average(Input=brep_closest_point_3.Normal)
plane_normal = PlaneNormal(Origin=average, ZAxis=average_2)
voronoi = Voronoi(Points=brep_closest_point_3.Point, Plane=plane_normal, BruteForceOverride=False)  # -> simplify(Cells)
explode_2 = Explode(Curve=voronoi, Recursive=True)  # -> Segments, Vertices
trim_tree = TrimTree(Tree=explode_2.Segments, Depth=1)
removeduplicatelines = RemoveDuplicateLines(Lines=trim_tree, Tolerance=0.01)
project = Project(Curve=removeduplicatelines, Brep=patch, Direction=average_2)  # -> flatten(Curve)

area_4 = Area(Geometry=brep_4)  # -> Area, Centroid
md_slider = MDSlider(SliderMode=0, slider_value=Point(0.5, 0.5, 0.5), x_domain=Domain(0, 1), y_domain=Domain(0, 1), z_domain=Domain(0, 1))
division_4 = Division(A=area_4.Area, B="25")
evaluate_surface = EvaluateSurface(Surface=reparameterize(brep_4), Point=md_slider)  # -> Point, Normal, UDirection, VDirection, Frame
round_2 = Round(Number=division_4)  # -> Nearest, Floor, Ceiling
tree_statistics_2 = TreeStatistics(Tree=brep_4)  # -> Paths, Length, Count
plane_normal_2 = PlaneNormal(Origin=evaluate_surface.Point, ZAxis=evaluate_surface.Normal)
series_4 = Series(Start=0, Step=1, Count=tree_statistics_2.Count)  # -> graft(Series)
project_2 = Project(Geometry=brep_4, Plane=plane_normal_2)  # -> Geometry, Transform
populate_geometry_2 = PopulateGeometry(Geometry=brep_4, Count=round_2.Ceiling, Seed=series_4)
curve_15 = Curve(project_2.Geometry)
area_5 = Area(Geometry=curve_15)  # -> Area, Centroid
scale_2 = Scale(Geometry=curve_15, Center=area_5.Centroid, Factor="3")  # -> Geometry, Transform
voronoi_2 = Voronoi(Points=populate_geometry_2, Boundary=scale_2.Geometry, Plane=plane_normal_2, BruteForceOverride=False)
explode_3 = Explode(Curve=voronoi_2, Recursive=True)  # -> Segments, Vertices
trim_tree_2 = TrimTree(Tree=explode_3.Segments, Depth=1)
removeduplicatelines_2 = RemoveDuplicateLines(Lines=trim_tree_2, Tolerance=0.01)
project_3 = Project(Curve=removeduplicatelines_2, Brep=brep_4, Direction=evaluate_surface.Normal)  # -> flatten(Curve)

curve_16 = Curve(project)
curve_17 = Curve(project_3)
curve_18 = Curve(curve_16)
curve_19 = Curve(curve_17)
create_settings = CreateSettings(VoxelSize="1.15", Bandwidth=1, Isovalue=0, Adaptivity=0.1)
multiplication_2 = Multiplication(A="1.15", B="1.5")
merge_7 = Merge(Data1=curve_19, Data2=curve_18)
create_settings_2 = CreateSettings(VoxelSize="0.5", Bandwidth=1, Isovalue=0, Adaptivity=0.1)
multiplication_3 = Multiplication(A="0.5", B="1.5")
curve_to_volume = CurveToVolume(Curves=merge_7, CurveRadius=multiplication_3, Settings=create_settings_2)

# ----
# main_branch
area_6 = Area(Geometry=interpolate_3.Curve)  # -> Area, Centroid
list_item_3 = ListItem(List=flatten(interpolate_3.Curve), Index=0, Wrap=True)
list_length_2 = ListLength(List=flatten(interpolate_3.Curve))
series_5 = Series(Start=0, Step=1, Count=list_length_2)
end_points = EndPoints(Curve=list_item_3)  # -> Start, End
curve_closest_point_3 = CurveClosestPoint(Point=end_points.Start, Curve=interpolate_3.Curve)  # -> Point, Parameter, Distance
bounds_4 = Bounds(Numbers=series_5)
seam = Seam(Curve=interpolate_3.Curve, Seam=curve_closest_point_3.Parameter)
remap_numbers_5 = RemapNumbers(Value=series_5, Source=bounds_4, Target=Domain(0, 1))  # -> Mapped, Clipped
graph_mapper_5 = GraphMapper(
    remap_numbers_5.Mapped,
    x0=0,
    x1=1,
    y0=0,
    y1=1,
    container_name="Bezier2",
    pt=[Point(0, 0.7363051176, 0), Point(0.1392774731, 0.8536235094, 0), Point(0.279223679, 0.9099609285, 0), Point(0.3983011544, 0.9463049769, 0), Point(0.5179617703, 0.9828270078, 0), Point(0.7104872465, 1, 0), Point(1, 1, 0)])
scale_3 = Scale(Geometry=seam, Center=area_6.Centroid, Factor=graft(graph_mapper_5))  # -> Geometry, Transform
construct_domain = ConstructDomain(DomainStart=0, DomainEnd="0.5")
list_length_3 = ListLength(List=flatten(scale_3.Geometry))
series_6 = Series(Start=0, Step=1, Count=list_length_3)
bounds_5 = Bounds(Numbers=series_6)
remap_numbers_6 = RemapNumbers(Value=series_6, Source=bounds_5, Target=construct_domain)  # -> Mapped, Clipped
pi_5 = Pi(Factor=remap_numbers_6.Mapped)  # -> graft(Output)
negative = Negative(Value=pi_5)
rotate_5 = Rotate(Geometry=scale_3.Geometry, Angle=negative, Plane=PlaneXY(0, 0, 0))  # -> Geometry, Transform
divide_curve_4 = DivideCurve(Curve=rotate_5.Geometry, Count=integer_5, Kinks=False)  # -> Points, Tangents, Parameters
pt_set_1_3 = Point(pt_set_1_2)
pt_set_2_3 = Point(pt_set_2_2)
point_5 = Point(divide_curve_4.Points)

pt_set_1_4 = Point(pt_set_1_3)
pt_set_2_4 = Point(pt_set_2_3)
point_6 = Point(point_5)

flip_matrix_5 = FlipMatrix(Data=point_6)  # -> simplify(Data)
nurbs_curve = NurbsCurve(Vertices=pt_set_1_4, Degree=3, Periodic=False)  # -> CurveSet1, Length, Domain
deconstruct_2 = Deconstruct(Point=pt_set_2_4)  # -> XComponent, YComponent, ZComponent
brep_closest_point_4 = BrepClosestPoint(PtSet2=pt_set_2_4, Brep=brep_2)  # -> Point, Normal, Distance
split_tree_6 = SplitTree(Data=flip_matrix_5, Masks=flatten("{0,2,...}"))  # -> Positive, Negative
bounds_6 = Bounds(Numbers=deconstruct_2.ZComponent)
relative_items_5 = RelativeItems(TreeA=split_tree_6.Positive, TreeB=split_tree_6.Negative, Offset="{+1}", WrapPaths=False, WrapItems=False)  # -> ItemA, ItemB
remap_numbers_7 = RemapNumbers(Value=deconstruct_2.ZComponent, Source=bounds_6, Target=Domain(0, 1))  # -> Mapped, Clipped
list_length_4 = ListLength(List=relative_items_5.ItemA)
graph_mapper_6 = GraphMapper(
    remap_numbers_7.Mapped,
    x0=0,
    x1=1,
    y0=0,
    y1=1,
    container_name="Bezier",
    cpx=[0, 0.4250523746, 0.6506276727, 1],
    cpy=[0.8753802776, 0.593411684, 0.5101638436, 0.5033294559])
series_7 = Series(Start=0, Step=1, Count=list_length_4)
vector_2pt = Vector2Pt(PointA=relative_items_5.ItemA, PointB=relative_items_5.ItemB, Unitize=False)  # -> Vector, Length
bounds_7 = Bounds(Numbers=series_7)
remap_numbers_8 = RemapNumbers(Value=series_7, Source=bounds_7, Target=Domain(0, 1))  # -> Mapped, Clipped
multiplication_4 = Multiplication(A=graph_mapper_6, B="-4.5")
graph_mapper_7 = GraphMapper(
    remap_numbers_8.Mapped,
    x0=0,
    x1=1,
    y0=0,
    y1=1,
    container_name="Bezier",
    cpx=[0, 0.9420289993, 1, 1],
    cpy=[0, 0, 0.6172901392, 1])
amplitude_3 = Amplitude(Vector=brep_closest_point_4.Normal, Amplitude=multiplication_4)
multiplication_5 = Multiplication(A=graph_mapper_7, B=vector_2pt.Vector)
move_4 = Move(Geometry=relative_items_5.ItemA, Motion=multiplication_5)  # -> Geometry, Transform
move_5 = Move(Geometry=pt_set_2_4, Motion=amplitude_3)  # -> Geometry, Transform
nurbs_curve_2 = NurbsCurve(Vertices=pt_set_2_4, Degree=3, Periodic=False)  # -> CurveSet2, Length, Domain
interpolate_6 = Interpolate(Vertices=move_4.Geometry, Degree=3, Periodic=False, KnotStyle=1)  # -> Curve, Length, Domain
interpolate_7 = Interpolate(Vertices=split_tree_6.Negative, Degree=3, Periodic=False, KnotStyle=1)  # -> Curve, Length, Domain
nurbs_curve_3 = NurbsCurve(Vertices=move_5.Geometry, Degree=3, Periodic=False)  # -> CurveSet2_1, Length, Domain
merge_8 = Merge(Data1=interpolate_6.Curve, Data2=interpolate_7.Curve)

curve_merge = Curve(merge_8)
curve_set_2_1 = Curve(nurbs_curve_3.CurveSet2_1)
curve_set_1 = Curve(nurbs_curve.CurveSet1)
curve_set_2 = Curve(nurbs_curve_2.CurveSet2)
merge_9 = Merge(
    Data1=curve_set_6_3,
    Data2=curve_set_5_4,
    Data3=curve_set_4_4,
    Data4=curve_set_1,
    Data5=curve_set_2,
    Data6=curve_set_5_1_3,
    Data7=curve_set_4_1_3,
    Data8=curve_set_2_1,
    Data9=curve_merge)  # -> flatten(Result)
curve1 = Curve(merge_9)
curve1_2 = Curve(curve1)
curve1_3 = Curve(curve1_2)
curve1_4 = Curve(curve1_3)
curve1_5 = Curve(curve1_4)
curve1_6 = Curve(curve1_5)
curve_to_volume_2 = CurveToVolume(Curves=curve1_6, CurveRadius=multiplication_2, Settings=create_settings)
volume_union = VolumeUnion(Volumes=[curve_to_volume, curve_to_volume_2])
volume_to_mesh = VolumeToMesh(Volume=volume_union, VolumeSettings=create_settings_2)
