# Grasshopper definition #52_twist.gh (Grasshopper 1.0.7)
# plug-ins: DendroGH, MeshEdit Components, Bifocals, Noise, Kangaroo2 Components

count = Panel("20")
height = Panel("280")
division = Division(A=height, B=count)
circle = Circle(Plane=PlaneXY(0, 0, 0), Radius="150")
series = Series(Start=0, Step=division, Count=count)
unit_z = UnitZ(Factor=division)
bounds = Bounds(Numbers=series)
reverse = Reverse(Vector=unit_z)
remap_numbers = RemapNumbers(Value=series, Source=bounds, Target=Domain(0, 1))  # -> Mapped, Clipped
remap_numbers_2 = RemapNumbers(Value=remap_numbers.Mapped, Source=Domain(0, 1), Target=bounds)  # -> Mapped, Clipped
graph_mapper = GraphMapper(
    remap_numbers.Mapped,
    x0=0,
    x1=1,
    y0=0,
    y1=1,
    container_name="Bezier2",
    pt=[Point(0, 0.0352589488, 0), Point(0.1040700674, 0.03612822294, 0), Point(0.3028515139, 0.3461601193, 0), Point(0.5046955943, 0.3444972634, 0), Point(0.7149027288, 0.3427655101, 0), Point(0.8956878185, 0.03471362591, 0), Point(1, 0.03370851278, 0)])
unit_z_2 = UnitZ(Factor=remap_numbers_2.Mapped)
move = Move(Geometry=circle, Motion=unit_z_2)  # -> Geometry, Transform
area = Area(Geometry=move.Geometry)  # -> Area, Centroid
scale = Scale(Geometry=move.Geometry, Center=area.Centroid, Factor=graph_mapper)  # -> Geometry, Transform
list_item = ListItem(List=scale.Geometry, Index=0, Wrap=True)  # -> Item1, Item
move_2 = Move(Geometry=list_item.Item1, Motion=unit_z)  # -> Geometry, Transform
move_3 = Move(Geometry=list_item.Item, Motion=reverse)  # -> Geometry, Transform
area_2 = Area(Geometry=move_3.Geometry)  # -> Area, Centroid
area_3 = Area(Geometry=move_2.Geometry)  # -> Area, Centroid
scale_2 = Scale(Geometry=move_3.Geometry, Center=area_2.Centroid, Factor=0.5)  # -> Geometry, Transform
scale_3 = Scale(Geometry=move_2.Geometry, Center=area_3.Centroid, Factor=0.5)  # -> Geometry, Transform
merge = Merge(Data1=scale_2.Geometry, Data2=scale.Geometry, Data3=scale_3.Geometry)
curve = Curve(merge)
curve_2 = Curve(curve)
list_length = ListLength(List=curve_2)
series_2 = Series(Start=0, Step=1, Count=list_length)
bounds_2 = Bounds(Numbers=series_2)
remap_numbers_3 = RemapNumbers(Value=series_2, Source=bounds_2, Target=Domain(0, 1))  # -> Mapped, Clipped
pi = Pi(Factor=1)
multiplication = Multiplication(A=remap_numbers_3.Mapped, B=pi, C="2")
rotate = Rotate(Geometry=curve_2, Angle=multiplication, Plane=PlaneXY(0, 0, 0))  # -> Geometry, Transform
divide_curve = DivideCurve(Curve=rotate.Geometry, Count="6", Kinks=False)  # -> Points, Tangents, Parameters
flip_matrix = FlipMatrix(Data=divide_curve.Points)
interpolate = Interpolate(Vertices=flip_matrix, Degree=3, Periodic=False, KnotStyle=1)  # -> simplify(Curve), Length, Domain
split_tree = SplitTree(Data=interpolate.Curve, Masks=flatten("{0,2,...}"))  # -> Positive, Negative
curve_3 = Curve(split_tree.Negative)
relative_items = RelativeItems(TreeA=split_tree.Positive, TreeB=split_tree.Negative, Offset="{-1}", WrapPaths=invert(False), WrapItems=False)  # -> ItemA, ItemB
relative_items_2 = RelativeItems(TreeA=split_tree.Positive, TreeB=split_tree.Negative, Offset="{+1}", WrapPaths=False, WrapItems=False)  # -> ItemA, ItemB
divide_curve_2 = DivideCurve(Curve=relative_items_2.ItemA, Count="50", Kinks=False)  # -> graft(Points), Tangents, Parameters
divide_curve_3 = DivideCurve(Curve=relative_items_2.ItemB, Count="50", Kinks=False)  # -> graft(Points), Tangents, Parameters
divide_curve_4 = DivideCurve(Curve=relative_items.ItemB, Count="50", Kinks=False)  # -> graft(Points), Tangents, Parameters
arc_3pt = Arc3Pt(PointA=divide_curve_3.Points, PointB=divide_curve_2.Points, PointC=divide_curve_4.Points)  # -> Arc, Plane, Radius
curve_4 = Curve(arc_3pt.Arc)
curve_5 = Curve(curve_3)
curve_6 = Curve(curve_4)
curve_7 = Curve(curve_5)
trim_tree = TrimTree(Tree=curve_6, Depth=1)
list_length_2 = ListLength(List=trim_tree)
series_3 = Series(Start=0, Step=1, Count=list_length_2)
construct_domain = ConstructDomain(DomainStart="0.01", DomainEnd="0.99")
bounds_3 = Bounds(Numbers=series_3)
remap_numbers_4 = RemapNumbers(Value=series_3, Source=bounds_3, Target=construct_domain)  # -> simplify(Mapped), Clipped
evaluate_curve = EvaluateCurve(Curve=reparameterize(trim_tree), Parameter=remap_numbers_4.Mapped)  # -> Point, Tangent, Angle
interpolate_2 = Interpolate(Vertices=evaluate_curve.Point, Degree=3, Periodic=False, KnotStyle=1)  # -> simplify(Curve), Length, Domain
merge_2 = Merge(Data1=interpolate_2.Curve, Data2=curve_7)
relative_item = RelativeItem(Tree=merge_2, Offset="{-1}", WrapPaths=invert(False), WrapItems=False)  # -> ItemA, ItemB
relative_item_2 = RelativeItem(Tree=merge_2, Offset="{+1}", WrapPaths=invert(False), WrapItems=False)  # -> ItemA, ItemB
divide_curve_5 = DivideCurve(Curve=relative_item_2.ItemA, Count="100", Kinks=False)  # -> Points, Tangents, Parameters
curve_closest_point = CurveClosestPoint(Point=divide_curve_5.Points, Curve=relative_item_2.ItemB)  # -> Point, Parameter, Distance
curve_closest_point_2 = CurveClosestPoint(Point=divide_curve_5.Points, Curve=relative_item.ItemB)  # -> Point, Parameter, Distance
graft_tree = GraftTree(Tree=divide_curve_5.Points, IncludeEmptyLists=True, IncludeNullItems=True)
graft_tree_2 = GraftTree(Tree=curve_closest_point.Point, IncludeEmptyLists=True, IncludeNullItems=True)
graft_tree_3 = GraftTree(Tree=curve_closest_point_2.Point, IncludeEmptyLists=True, IncludeNullItems=True)
arc_3pt_2 = Arc3Pt(PointA=graft_tree_2, PointB=graft_tree, PointC=graft_tree_3)  # -> Arc, Plane, Radius
curve_closest_point_3 = CurveClosestPoint(Point=graft_tree, Curve=arc_3pt_2.Arc)  # -> Point, Parameter, Distance
number = Number(curve_closest_point_3.Parameter)
vector = Vector(divide_curve_5.Tangents)
curve_8 = Curve(arc_3pt_2.Arc)
number_2 = Number(number)
vector_2 = Vector(vector)
curve_9 = Curve(curve_8)
evaluate_curve_2 = EvaluateCurve(Curve=curve_9, Parameter=number_2)  # -> Point, Tangent, Angle
trim_tree_2 = TrimTree(Tree=evaluate_curve_2.Tangent, Depth=1)
trim_tree_3 = TrimTree(Tree=evaluate_curve_2.Point, Depth=1)
trim_tree_4 = TrimTree(Tree=number_2, Depth=1)
cross_product = CrossProduct(VectorA=trim_tree_2, VectorB=vector_2, Unitize=False)  # -> Vector, Length
sort_list = SortList(Keys=trim_tree_4)  # -> Keys, ValuesValuesA
ellipse = Ellipse(Plane=PlaneXY(0, 0, 0), Radius1="3", Radius2="1.5")  # -> Ellipse, Focus1, Focus2
construct_plane = ConstructPlane(Origin=trim_tree_3, XAxis=trim_tree_2, YAxis=cross_product.Vector)
unit_x = UnitX(Factor="2.5")
bounds_4 = Bounds(Numbers=sort_list.Keys)
rotate_2 = Rotate(Geometry=ellipse.Ellipse, Angle=1.570796327, Plane=PlaneXY(0, 0, 0))  # -> Geometry, Transform
list_length_3 = ListLength(List=construct_plane)
negative = Negative(Value=unit_x)
remap_numbers_5 = RemapNumbers(Value=sort_list.Keys, Source=bounds_4, Target=Domain(0, 1))  # -> Mapped, Clipped
series_4 = Series(Start=0, Step=1, Count=list_length_3)
merge_3 = Merge(Data1=unit_x, Data2=negative)
bounds_5 = Bounds(Numbers=series_4)
graph_mapper_2 = GraphMapper(
    remap_numbers_5.Mapped,
    x0=0,
    x1=1,
    y0=0,
    y1=1,
    container_name="Bezier2",
    pt=[Point(0, 0.2095354199, 0), Point(0.1072495431, 0.7849292159, 0), Point(0.2867729068, 0.8929066658, 0), Point(0.5029296875, 0.8929066658, 0), Point(0.7131439552, 0.8929066658, 0), Point(0.8992868662, 0.7963981628, 0), Point(1, 0.2098742127, 0)])
graph_mapper_3 = GraphMapper(
    remap_numbers_5.Mapped,
    x0=0,
    x1=1,
    y0=0,
    y1=1,
    container_name="Bezier2",
    pt=[Point(0, 0.5508120656, 0), Point(0.1072495431, 0.7849292159, 0), Point(0.2867729068, 0.8929066658, 0), Point(0.5029296875, 0.8929066658, 0), Point(0.7131439552, 0.8929066658, 0), Point(0.8992868662, 0.7963981628, 0), Point(1, 0.5522848964, 0)])
scale_nu = ScaleNU(Geometry=ellipse.Ellipse, Plane=PlaneXY(0, 0, 0), ScaleX="2", ScaleY="0.5", ScaleZ=1)  # -> Geometry, Transform
move_4 = Move(Geometry=rotate_2.Geometry, Motion=merge_3)  # -> Geometry, Transform
remap_numbers_6 = RemapNumbers(Value=series_4, Source=bounds_5, Target=Domain(0, 1))  # -> Mapped, Clipped
multiplication_2 = Multiplication(A=graph_mapper_2, B="4")
pi_2 = Pi(Factor=1)
multiplication_3 = Multiplication(A=graph_mapper_3, B="3")
merge_4 = Merge(Data1=scale_nu.Geometry, Data2=move_4.Geometry)
region_union = RegionUnion(Curves=merge_4)
multiplication_4 = Multiplication(A=remap_numbers_6.Mapped, B=pi_2, C="2")
rotate_plane = RotatePlane(Plane=construct_plane, Angle=multiplication_4)
orient = Orient(Geometry=region_union, Source=PlaneXY(0, 0, 0), Target=rotate_plane)  # -> simplify(Geometry), Transform
scale_nu_2 = ScaleNU(Geometry=orient.Geometry, Plane=rotate_plane, ScaleX=multiplication_3, ScaleY=multiplication_2, ScaleZ=1)  # -> Geometry, Transform
curve_10 = Curve(scale_nu_2.Geometry)
number_3 = Number(multiplication_3)
curve_11 = Curve(curve_10)
number_4 = Number(number_3)
create_settings = CreateSettings(VoxelSize="1.25", Bandwidth=1, Isovalue=0, Adaptivity=0.1)
multiplication_5 = Multiplication(A="1.25", B=number_4)
curve_to_volume = CurveToVolume(Curves=curve_11, CurveRadius=multiplication_5, Settings=create_settings)  # -> flatten(Volume)
volume_union = VolumeUnion(Volumes=curve_to_volume)
smooth_volume = SmoothVolume(Volume=volume_union, Width=1, Type=2, Iterations="2")
quad_remesh_settings = QuadRemeshSettings(
    TargetCount="20000",
    AdaptiveSize="0",
    AdaptiveCount=invert(False),
    HardEdges=False,
    SeamEdges=0,
    Symmetry=0,
    GuideCurves=0)
volume_to_mesh = VolumeToMesh(Volume=smooth_volume, VolumeSettings=create_settings)
quad_remesh = QuadRemesh(Mesh=volume_to_mesh, Settings=quad_remesh_settings)
smooth_mesh = SmoothMesh(Mesh=quad_remesh, Strength="1", SkipNaked=True, Iterations="3")
mesh_explode = MeshExplode(Mesh=smooth_mesh, Interpolate=False)
area_4 = Area(Geometry=mesh_explode)  # -> Area, Centroid
perlinnoise = PerlinNoise(
    Points=area_4.Centroid,
    Seed=0,
    Amplitude=1,
    SmoothStep=0,
    FrequecyX="1.2",
    FrequecyY="1.2",
    FrequecyZ="1.2",
    Jitter=0,
    AlignVector=Vector(1, 0, 0))
pi_3 = Pi(Factor=1)
multiplication_6 = Multiplication(A=perlinnoise, B=pi_3, C="5")
sine = Sine(Value=multiplication_6)
construct_domain_2 = ConstructDomain(DomainStart="0.1", DomainEnd="1")
bounds_6 = Bounds(Numbers=sine)
remap_numbers_7 = RemapNumbers(Value=sine, Source=bounds_6, Target=construct_domain_2)  # -> Mapped, Clipped
mesh = Mesh(mesh_explode)
point = Point(area_4.Centroid)
number_5 = Number(remap_numbers_7.Mapped)
mesh_2 = Mesh(mesh)
number_6 = Number(number_5)
point_2 = Point(point)
scale_4 = Scale(Geometry=mesh_2, Center=point_2, Factor=number_6)  # -> Geometry, Transform
face_boundaries = FaceBoundaries(Mesh=mesh_2)
face_boundaries_2 = FaceBoundaries(Mesh=scale_4.Geometry)
explode = Explode(Curve=face_boundaries, Recursive=True)  # -> Segments, Vertices
explode_2 = Explode(Curve=face_boundaries_2, Recursive=True)  # -> Segments, Vertices
removeduplicatepts = RemoveDuplicatePts(Points=explode.Vertices, Tolerance=0.01)  # -> simplify(UniquePoints)
removeduplicatepts_2 = RemoveDuplicatePts(Points=explode_2.Vertices, Tolerance=0.01)  # -> simplify(UniquePoints)
list_item_2 = ListItem(List=removeduplicatepts_2, Index=0, Wrap=True)  # -> Item, Item1, Item2, Item3
list_item_3 = ListItem(List=removeduplicatepts, Index=0, Wrap=True)  # -> Item, Item1, Item2, Item3
merge_5 = Merge(Data1=list_item_3.Item, Data2=list_item_2.Item, Data3=list_item_2.Item1, Data4=list_item_3.Item1)
merge_6 = Merge(Data1=list_item_3.Item1, Data2=list_item_2.Item1, Data3=list_item_2.Item2, Data4=list_item_3.Item2)
merge_7 = Merge(Data1=list_item_3.Item2, Data2=list_item_2.Item2, Data3=list_item_2.Item3, Data4=list_item_3.Item3)
merge_8 = Merge(Data1=list_item_3.Item3, Data2=list_item_2.Item3, Data3=list_item_2.Item, Data4=list_item_3.Item)
construct_mesh = ConstructMesh(Vertices=merge_8, Faces={A=0, B=1, C=2, D=3})
construct_mesh_2 = ConstructMesh(Vertices=merge_5, Faces={A=0, B=1, C=2, D=3})
construct_mesh_3 = ConstructMesh(Vertices=merge_7, Faces={A=0, B=1, C=2, D=3})
construct_mesh_4 = ConstructMesh(Vertices=merge_6, Faces={A=0, B=1, C=2, D=3})
merge_9 = Merge(Data1=construct_mesh_2, Data2=construct_mesh_4, Data3=construct_mesh_3, Data4=construct_mesh)
