# Grasshopper definition #53_slime_mold.gh (Grasshopper 1.0.7)
# plug-ins: Kangaroo2 Components, Weaverbird, NGon, Pufferfish, Bifocals

circle = Circle(Plane=PlaneXY(0, 0, 0), Radius="100")
division = Division(A="500", B="10")
series = Series(Start=0, Step=division, Count="10")
unit_z = UnitZ(Factor=series)
move = Move(Geometry=circle, Motion=unit_z)  # -> Geometry, Transform
list_length = ListLength(List=move.Geometry)
area = Area(Geometry=move.Geometry)  # -> Area, Centroid
series_2 = Series(Start=0, Step=1, Count=list_length)
bounds = Bounds(Numbers=series_2)
remap_numbers = RemapNumbers(Value=series_2, Source=bounds, Target=Domain(0, 1))  # -> Mapped, Clipped
multiplication = Multiplication(A=remap_numbers.Mapped, B="0.5")
graph_mapper = GraphMapper(
    remap_numbers.Mapped,
    x0=0,
    x1=1,
    y0=0,
    y1=1,
    container_name="Bezier2",
    pt=[Point(0, 1, 0), Point(0.1107865423, 0.8040218353, 0), Point(0.3306934237, 0.5847225189, 0), Point(0.4992029071, 0.5847225189, 0), Point(0.673587501, 0.5847225189, 0), Point(0.8944075704, 0.8134946823, 0), Point(1, 1, 0)])
graph_mapper_2 = GraphMapper(
    remap_numbers.Mapped,
    x0=0,
    x1=1,
    y0=0,
    y1=1,
    container_name="Bezier2",
    pt=[Point(0, 0.6018486619, 0), Point(0.1107865423, 0.8040218353, 0), Point(0.3313129544, 1, 0), Point(0.4998224378, 1, 0), Point(0.6742070317, 1, 0), Point(0.8944075704, 0.8134946823, 0), Point(1, 0.6044210196, 0)])
pi = Pi(Factor=multiplication)
multiplication_2 = Multiplication(A=graph_mapper, B="0.15")
panel = Panel("""0.25
0.75""")
panel_2 = Panel("""0.35
0.85""")
scale = Scale(Geometry=move.Geometry, Center=area.Centroid, Factor=graph_mapper_2)  # -> simplify(graft(Geometry)), Transform
subtraction = Subtraction(A=panel, B=graft(multiplication_2))  # -> simplify(Result)
addition = Addition(A=panel_2, B=graft(multiplication_2))  # -> simplify(Result)
weave = Weave(Pattern=[0, 1], Stream0=subtraction, Stream1=addition, NullGaps=False)
shatter = Shatter(Curve=reparameterize(scale.Geometry), Parameters=weave)
length = Length(Curve=shatter)
sort_list = SortList(Keys=length, ValuesValuesA=shatter)  # -> Keys, reverse(ValuesValuesA)
panel_3 = Panel("""0
1""")
list_item = ListItem(List=sort_list.ValuesValuesA, Index=panel_3, Wrap=True)  # -> simplify(Item)
point = Point(area.Centroid)
number = Number(pi)
curve = Curve(list_item)
number_2 = Number(graft(number))
panel_4 = Panel("""0
1""")
curve_2 = Curve(curve)
point_2 = Point(point)
evaluate_curve = EvaluateCurve(Curve=reparameterize(graft(curve_2)), Parameter=panel_4)  # -> Point, Tangent, Angle
unit_z_2 = UnitZ(Factor=1)
list_item_2 = ListItem(List=evaluate_curve.Tangent, Index=0, Wrap=True)  # -> Item, Item1
list_item_3 = ListItem(List=evaluate_curve.Point, Index=0, Wrap=True)  # -> Item, Item1
cross_product = CrossProduct(VectorA=list_item_2.Item1, VectorB=unit_z_2, Unitize=False)  # -> Vector, Length
amplitude = Amplitude(Vector=list_item_2.Item, Amplitude="60")
unit_z_3 = UnitZ(Factor=1)
pi_2 = Pi(Factor=Slider(0.2981, range=0..1))
amplitude_2 = Amplitude(Vector=cross_product.Vector, Amplitude="60")
rotate = Rotate(Vector=amplitude, Axis=unit_z_3, Angle=pi_2)
reverse = Reverse(Vector=amplitude_2)
bezier_span = BezierSpan(StartPoint=list_item_3.Item, StartTangent=rotate, EndPoint=list_item_3.Item1, EndTangent=reverse)  # -> Curve, Length, Domain
trim_tree = TrimTree(Tree=bezier_span.Curve, Depth=1)
join_curves = JoinCurves(Curves=[trim_tree, curve_2], Preserve=False)  # -> simplify(Curves)
fillet = Fillet(Curve=join_curves, Radius="5")
point_3 = Point(graft(point_2))
rotate_2 = Rotate(Geometry=fillet, Angle=number_2, Plane=point_3)  # -> Geometry, Transform
explode = Explode(Curve=rotate_2.Geometry, Recursive=True)  # -> Segments, Vertices
curve_middle = CurveMiddle(Curve=explode.Segments)  # -> simplify(Midpoint)
trim_tree_2 = TrimTree(Tree=explode.Segments, Depth=1)
trim_tree_3 = TrimTree(Tree=curve_middle, Depth=1)
distance = Distance(PointA=trim_tree_3, PointB=point_3)
sort_list_2 = SortList(Keys=distance, ValuesValuesA=trim_tree_2)  # -> Keys, simplify(ValuesValuesA)
curve_3 = Curve(sort_list_2.ValuesValuesA)
curve_4 = Curve(curve_3)
list_item_4 = ListItem(List=curve_4, Index=0, Wrap=True)  # -> Item, Item1
flip_curve = FlipCurve(Curve=list_item_4.Item1)  # -> Curve, Flag
loft = Loft(
    Curves=flatten(list_item_4.Item),
    Options={Adjust=False, Closed=False, LoftEnds=0, LoftSimp=0, LoftType=0, Rebuild=10, Refit=0.01})
loft_2 = Loft(
    Curves=flatten(flip_curve.Curve),
    Options={Adjust=False, Closed=False, LoftEnds=0, LoftSimp=0, LoftType=0, Rebuild=10, Refit=0.01})
curve_5 = Curve(loft_2)
curve_6 = Curve(loft)
loft_3 = Loft(
    Curves=[curve_6, curve_5],
    Options={Adjust=False, Closed=False, LoftEnds=0, LoftSimp=0, LoftType=0, Rebuild=10, Refit=0.01})
merge = Merge(Data1=loft_3, Data2=loft, Data3=loft_2)
brep_join = BrepJoin(Breps=merge)  # -> Breps, Closed
populate_geometry = PopulateGeometry(Geometry=brep_join.Breps, Count="20", Seed="12")
voronoi_3d = Voronoi3D(Points=populate_geometry)  # -> Cells, Boundary
solid_intersection = SolidIntersection(BrepsA=voronoi_3d.Cells, BrepsB=brep_join.Breps)
deconstruct_brep = DeconstructBrep(Brep=solid_intersection)  # -> Faces, Edges, Vertices
area_2 = Area(Geometry=solid_intersection)  # -> Area, Centroid
is_planar = IsPlanar(Surface=deconstruct_brep.Faces, Interior=True)  # -> Planar, Plane
scale_2 = Scale(Geometry=solid_intersection, Center=area_2.Centroid, Factor="0.25")  # -> Geometry, Transform
dispatch = Dispatch(List=deconstruct_brep.Faces, DispatchPattern=is_planar.Planar)  # -> ListA, ListB
deconstruct_brep_2 = DeconstructBrep(Brep=scale_2.Geometry)  # -> Faces, Edges, Vertices
dispatch_2 = Dispatch(List=deconstruct_brep_2.Faces, DispatchPattern=is_planar.Planar)  # -> ListA, ListB
md_slider = MDSlider(SliderMode=0, slider_value=Point(0.5, 0.5, 0.5), x_domain=Domain(0, 1), y_domain=Domain(0, 1), z_domain=Domain(0, 1))
surface = Surface(dispatch.ListB)
surface_2 = Surface(loft)
evaluate_surface = EvaluateSurface(Surface=reparameterize(surface), Point=md_slider)  # -> Point, Normal, UDirection, VDirection, Frame
brep_closest_point = BrepClosestPoint(Point=evaluate_surface.Point, Brep=surface_2)  # -> Point, Normal, Distance
surface_3 = Surface(dispatch.ListA)
surface_4 = Surface(dispatch_2.ListA)
vector = Vector(evaluate_surface.Normal)
surface_5 = Surface(dispatch_2.ListB)
surface_6 = Surface(surface)
curve_7 = Curve(curve_4)
vector_2 = Vector(brep_closest_point.Normal)
vector_3 = Vector(vector)
vector_4 = Vector(vector_2)
surface_7 = Surface(surface_6)
surface_8 = Surface(surface_3)
surface_9 = Surface(surface_4)
surface_10 = Surface(surface_5)
curve_8 = Curve(curve_7)
dot_product = DotProduct(VectorA=vector_4, VectorB=vector_3, Unitize=invert(False))
absolute = Absolute(Value=dot_product)
brep = Brep(surface_9)
area_3 = Area(Geometry=surface_9)  # -> Area, Centroid
smaller_than = SmallerThan(FirstNumber=absolute, SecondNumber="0.5")  # -> SmallerThan, OrEqualTo
larger_than = LargerThan(FirstNumber=area_3.Area, SecondNumber="150")  # -> LargerThan, OrEqualTo
dispatch_3 = Dispatch(List=surface_7, DispatchPattern=smaller_than.SmallerThan)  # -> ListA, ListB
dispatch_4 = Dispatch(List=surface_10, DispatchPattern=smaller_than.SmallerThan)  # -> ListA, ListB
brep_2 = Brep(dispatch_3.ListB)
area_4 = Area(Geometry=brep_2)  # -> Area, Centroid
dispatch_5 = Dispatch(List=surface_8, DispatchPattern=larger_than.LargerThan)  # -> ListA, ListB
average = Average(Input=flatten(area_4.Area))
dispatch_6 = Dispatch(List=brep, DispatchPattern=larger_than.LargerThan)  # -> ListA, ListB
area_5 = Area(Geometry=dispatch_5.ListA)  # -> Area, Centroid
division_2 = Division(A=average, B=area_4.Area)
brep_3 = Brep(dispatch_4.ListB)
curve_9 = Curve(dispatch_4.ListA)
scale_3 = Scale(Geometry=dispatch_5.ListA, Center=area_5.Centroid, Factor="0.2")  # -> Geometry, Transform
bounds_2 = Bounds(Numbers=flatten(division_2))
tree_statistics = TreeStatistics(Tree=division_2)  # -> Paths, Length, Count
construct_domain = ConstructDomain(DomainStart="0.35", DomainEnd="0.5")
remap_numbers_2 = RemapNumbers(Value=flatten(division_2), Source=bounds_2, Target=construct_domain)  # -> Mapped, Clipped

curve_10 = Curve(dispatch_6.ListB)
merge_2 = Merge(Data1=dispatch_6.ListB, Data2=dispatch_4.ListA)
merge_3 = Merge(Data1=curve_10, Data2=curve_9)
md_slider_2 = MDSlider(SliderMode=0, slider_value=Point(0.5, 0.5, 0.5), x_domain=Domain(0, 1), y_domain=Domain(0, 1), z_domain=Domain(0, 1))
explode_2 = Explode(Curve=merge_3, Recursive=True)  # -> Segments, Vertices
evaluate_surface_2 = EvaluateSurface(Surface=reparameterize(merge_2), Point=md_slider_2)  # -> Point, Normal, UDirection, VDirection, Frame
removeduplicatepts = RemoveDuplicatePts(Points=explode_2.Vertices, Tolerance=0.01)  # -> simplify(UniquePoints)
plane_normal = PlaneNormal(Origin=evaluate_surface_2.Point, ZAxis=evaluate_surface_2.Normal)  # -> graft(Plane)
delaunay_mesh = DelaunayMesh(Points=removeduplicatepts, Plane=plane_normal)

curve_11 = Curve(dispatch_6.ListA)
curve_12 = Curve(scale_3.Geometry)
explode_3 = Explode(Curve=curve_11, Recursive=True)  # -> graft(Segments), Vertices
explode_4 = Explode(Curve=curve_12, Recursive=True)  # -> graft(Segments), Vertices
end_points = EndPoints(Curve=explode_3.Segments)  # -> Start, End
end_points_2 = EndPoints(Curve=explode_4.Segments)  # -> Start, End
line = Line(StartPoint=end_points.Start, EndPoint=end_points.End)
line_2 = Line(StartPoint=end_points_2.Start, EndPoint=end_points_2.End)
loft_4 = Loft(Curves=[line, line_2], Options={Adjust=False, Closed=False, LoftEnds=0, LoftSimp=0, LoftType=0, Rebuild=10, Refit=0.01})
simple_mesh = SimpleMesh(Brep=loft_4)

partition_list = PartitionList(List=remap_numbers_2.Mapped, Size=tree_statistics.Length)
scale_4 = Scale(Geometry=brep_2, Center=area_4.Centroid, Factor=partition_list)  # -> Geometry, Transform

curve_13 = Curve(brep_3)
curve_14 = Curve(scale_4.Geometry)
explode_5 = Explode(Curve=curve_13, Recursive=True)  # -> simplify(graft(Segments)), Vertices
explode_6 = Explode(Curve=curve_14, Recursive=True)  # -> simplify(graft(Segments)), Vertices
end_points_3 = EndPoints(Curve=explode_5.Segments)  # -> Start, End
end_points_4 = EndPoints(Curve=explode_6.Segments)  # -> Start, End
line_3 = Line(StartPoint=end_points_3.Start, EndPoint=end_points_3.End)
line_4 = Line(StartPoint=end_points_4.Start, EndPoint=end_points_4.End)
loft_5 = Loft(
    Curves=[line_4, line_3],
    Options={Adjust=False, Closed=False, LoftEnds=0, LoftSimp=0, LoftType=0, Rebuild=10, Refit=0.01})
simple_mesh_2 = SimpleMesh(Brep=loft_5)

merge_4 = Merge(Data1=simple_mesh, Data2=simple_mesh_2, Data3=delaunay_mesh)  # -> flatten(Result)
curve_15 = Curve(curve_8)
mesh = Mesh(merge_4)
mesh_2 = Mesh(mesh)
curve_16 = Curve(curve_15)
weaverbird_s_join_meshes_and_weld = WeaverbirdsJoinMeshesAndWeld(Mesh=mesh_2, Weld=invert(False))
join_curves_2 = JoinCurves(Curves=curve_16, Preserve=False)  # -> simplify(Curves)
triangulate = Triangulate(Mesh=weaverbird_s_join_meshes_and_weld)  # -> Mesh, Count

dual = Dual(Mesh=triangulate.Mesh, Type=0)
nakedvertices = NakedVertices(Mesh=dual)  # -> ClothedIndex, NakedIndex, ClothedPts, NakedPts
smooth = Smooth(M=dual, Strength=1)
show = Show(G=dual)
edgelengths = EdgeLengths(Mesh=dual, LengthFactor="0.5", Strength=1)
anchor = Anchor(Point=nakedvertices.NakedPts, Strength=10000)
entwine = Entwine(Branch00=show, Branch01=anchor, Branch02=edgelengths, Branch03=smooth, FlattenInputs=True)
bouncysolver = BouncySolver(GoalObjects=entwine, Reset=Button(), Threshold=1e-15, Tolerance=0.0001, Damping=0.99, Iterations=10, On=Toggle(False))  # -> I, V, O
list_item_5 = ListItem(List=bouncysolver.O, Index=0, Wrap=True)

area_6 = Area(Geometry=join_curves_2)  # -> Area, Centroid
deconstruct = Deconstruct(Point=area_6.Centroid)  # -> XComponent, YComponent, ZComponent
sort_list_3 = SortList(Keys=deconstruct.XComponent, ValuesValuesA=join_curves_2)  # -> Keys, ValuesValuesA
flip_matrix = FlipMatrix(Data=sort_list_3.ValuesValuesA)
loft_6 = Loft(Curves=flip_matrix, Options={Adjust=False, Closed=False, LoftEnds=0, LoftSimp=0, LoftType=0, Rebuild=10, Refit=0.01})  # -> flatten(Loft)
brep_join_2 = BrepJoin(Breps=loft_6)  # -> Breps, Closed
ngon_edges = NGonEdges(Mesh=list_item_5)  # -> Edges, ID, NakedID, Normal, Naked, AllE
cap_holes = CapHoles(Brep=brep_join_2.Breps)
dispatch_7 = Dispatch(List=ngon_edges.Edges, DispatchPattern=ngon_edges.NakedID)  # -> ListA, ListB
mesh_brep = MeshBrep(
    Brep=cap_holes,
    Settings={GridMaxCount=0, GridMinCount=16, JaggedSeams=False, MaxEdgeLength=0, MinEdgeLength=0.0001, MinTolerance=0, Refine=True, RefineAngle=0, RelativeTolerance=0.65, SimplePlanes=True, Tolerance=0})
removeduplicatelines = RemoveDuplicateLines(Lines=dispatch_7.ListB, Tolerance=0.01)
multipipe = MultiPipe(Curves=removeduplicatelines, NodeSize="3", EndOffset=1, StrutSize=1, Segment=0, KinkAngle=0.6, CubeFit=0, Caps=0)
mesh_from_subd = MeshFromSubD(SubD=multipipe, Density=1)

weaverbird_s_join_meshes_and_weld_2 = WeaverbirdsJoinMeshesAndWeld(Mesh=mesh_from_subd, Weld=invert(False))
edgelengths_2 = EdgeLengths(Mesh=weaverbird_s_join_meshes_and_weld_2, LengthFactor="0.5", Strength=1)
nakedvertices_2 = NakedVertices(Mesh=weaverbird_s_join_meshes_and_weld_2)  # -> ClothedIndex, NakedIndex, ClothedPts, NakedPts
show_2 = Show(G=weaverbird_s_join_meshes_and_weld_2)
anchor_2 = Anchor(Point=nakedvertices_2.NakedPts, Strength=10000)
entwine_2 = Entwine(Branch00=show_2, Branch01=anchor_2, Branch02=edgelengths_2, FlattenInputs=True)
bouncysolver_2 = BouncySolver(GoalObjects=entwine_2, Reset=Button(), Threshold=1e-15, Tolerance=0.0001, Damping=0.99, Iterations=10, On=Toggle(False))  # -> I, V, O
list_item_6 = ListItem(List=bouncysolver_2.O, Index=0, Wrap=True)

mesh_3 = Mesh(list_item_6)
mesh_4 = Mesh(mesh_brep)
mesh_5 = Mesh(mesh_3)
mesh_6 = Mesh(mesh_4)
mesh_naked_edges = MeshNakedEdges(Mesh=mesh_5)  # -> Naked, ResultBoolean
explode_7 = Explode(Curve=mesh_naked_edges.Naked, Recursive=True)  # -> Segments, simplify(Vertices)
boundary_surfaces = BoundarySurfaces(Edges=mesh_naked_edges.Naked)
md_slider_3 = MDSlider(SliderMode=0, slider_value=Point(0.5, 0.5, 0.5), x_domain=Domain(0, 1), y_domain=Domain(0, 1), z_domain=Domain(0, 1))
removeduplicatepts_2 = RemoveDuplicatePts(Points=explode_7.Vertices, Tolerance=0.01)
evaluate_surface_3 = EvaluateSurface(Surface=reparameterize(boundary_surfaces), Point=md_slider_3)  # -> Point, Normal, UDirection, VDirection, Frame
plane_normal_2 = PlaneNormal(Origin=evaluate_surface_3.Point, ZAxis=evaluate_surface_3.Normal)  # -> graft(Plane)
delaunay_mesh_2 = DelaunayMesh(Points=removeduplicatepts_2, Plane=plane_normal_2)
weaverbird_s_join_meshes_and_weld_3 = WeaverbirdsJoinMeshesAndWeld(Mesh=flatten([mesh_5, delaunay_mesh_2]), Weld=invert(False))
merge_5 = Merge(Data1=weaverbird_s_join_meshes_and_weld_3, Data2=mesh_6)
meshboolean = MeshBoolean(Mesh=merge_5, Type="1", LC=True)
