# Grasshopper definition #54_slime_mold2.gh (Grasshopper 1.0.7)
# plug-ins: Bifocals, Kangaroo2 Components, Weaverbird, NGon, DendroGH

number_pre_branch = Slider(11, range=0..200)
height = Slider(0.15, range=0..1)
secquence_step = Slider(0.9, range=0..10)
series = Series(Start=0, Step=height, Count=number_pre_branch)
series_2 = Series(Start="1", Step=secquence_step, Count=number_pre_branch)
series_3 = Series(Start="1", Step=secquence_step, Count=number_pre_branch)
sine = Sine(Value=series_3)
cosine = Cosine(Value=series_2)
reverse_list = ReverseList(List=series)
multiplication = Multiplication(A=sine, B=series_3)
multiplication_2 = Multiplication(A=cosine, B=series_2)
construct_point = ConstructPoint(XCoordinate=multiplication, YCoordinate=multiplication_2, ZCoordinate=reverse_list)
polar_array = PolarArray(Geometry=construct_point, Plane=PlaneXY(0, 0, 0), Count=10, Angle=6.283185307)  # -> simplify(Geometry), Transform
flip_matrix = FlipMatrix(Data=polar_array.Geometry)
tree_statistics = TreeStatistics(Tree=flip_matrix)  # -> Paths, Length, Count
point = Point(flatten(flip_matrix))
voronoi_3d = Voronoi3D(Points=point)  # -> Cells, Boundary
partition_list = PartitionList(List=voronoi_3d.Cells, Size=tree_statistics.Length)  # -> simplify(Chunks)
brep = Brep(partition_list)
brep_2 = Brep(brep)
panel = Panel("""0
1""")
cull_index = CullIndex(List=brep_2, Indices=panel, Wrap=True)  # -> simplify(List)
flip_matrix_2 = FlipMatrix(Data=cull_index)
split_tree = SplitTree(Data=flip_matrix_2, Masks=flatten("{0,2,...}"))  # -> Positive, Negative
dispatch = Dispatch(List=split_tree.Negative, DispatchPattern=[True, False])  # -> ListA, ListB
dispatch_2 = Dispatch(List=split_tree.Positive, DispatchPattern=[True, False])  # -> ListA, ListB
merge = Merge(Data1=dispatch_2.ListA, Data2=dispatch_2.ListB, Data3=dispatch.ListB)  # -> flatten(Result)
area = Area(Geometry=merge)  # -> Area, Centroid
deconstruct_brep = DeconstructBrep(Brep=merge)  # -> Faces, Edges, Vertices
average = Average(Input=area.Centroid)
list_item = ListItem(List=brep_2, Index=panel, Wrap=True)  # -> flatten(Item)
brep_3 = Brep(dispatch.ListA)
construct_domain = ConstructDomain(DomainStart="0.15", DomainEnd="0.55")
distance = Distance(PointA=area.Centroid, PointB=average)
bounds = Bounds(Numbers=distance)
area_2 = Area(Geometry=deconstruct_brep.Faces)  # -> Area, Centroid
solid_union = SolidUnion(Breps=list_item)
remap_numbers = RemapNumbers(Value=distance, Source=bounds, Target=construct_domain)  # -> Mapped, Clipped
scale = Scale(Geometry=merge, Center=area.Centroid, Factor=remap_numbers.Mapped)  # -> Geometry, Transform
scale_2 = Scale(Geometry=deconstruct_brep.Faces, Center=area_2.Centroid, Factor="0.99")  # -> Geometry, Transform
merge_faces = MergeFaces(Brep=solid_union)  # -> Breps, Before, After
brep_4 = Brep(scale.Geometry)
brep_5 = Brep(deconstruct_brep.Faces)
brep_6 = Brep(scale_2.Geometry)
brep_7 = Brep(merge_faces.Breps)
brep_8 = Brep(brep_3)
brep_9 = Brep(brep_7)
brep_10 = Brep(brep_4)
brep_11 = Brep(brep_5)
brep_12 = Brep(brep_6)
md_slider = MDSlider(SliderMode=0, slider_value=Point(0.5, 0.5, 0.5), x_domain=Domain(0, 1), y_domain=Domain(0, 1), z_domain=Domain(0, 1))
deconstruct_brep_2 = DeconstructBrep(Brep=brep_10)  # -> Faces, Edges, Vertices
evaluate_surface = EvaluateSurface(Surface=brep_11, Point=md_slider)  # -> Point, Normal, UDirection, VDirection, Frame
unit_z = UnitZ(Factor=1)
dot_product = DotProduct(VectorA=evaluate_surface.Normal, VectorB=unit_z, Unitize=invert(False))
absolute = Absolute(Value=dot_product)
larger_than = LargerThan(FirstNumber=absolute, SecondNumber="0.25")  # -> LargerThan, OrEqualTo
dispatch_3 = Dispatch(List=brep_12, DispatchPattern=larger_than.LargerThan)  # -> ListA, ListB
dispatch_4 = Dispatch(List=deconstruct_brep_2.Faces, DispatchPattern=larger_than.LargerThan)  # -> ListA, ListB
area_3 = Area(Geometry=dispatch_3.ListB)  # -> Area, Centroid
smaller = SmallerThan(FirstNumber=area_3.Area, SecondNumber="0.5")  # -> SmallerThan, OrEqualTo
md_slider_2 = MDSlider(SliderMode=0, slider_value=Point(0.5, 0.5, 0.5), x_domain=Domain(0, 1), y_domain=Domain(0, 1), z_domain=Domain(0, 1))
dispatch_5 = Dispatch(List=dispatch_4.ListB, DispatchPattern=smaller.SmallerThan)  # -> ListA, ListB
merge_2 = Merge(Data1=dispatch_5.ListA, Data2=dispatch_4.ListA)
evaluate_surface_2 = EvaluateSurface(Surface=reparameterize(merge_2), Point=md_slider_2)  # -> Point, Normal, UDirection, VDirection, Frame
dispatch_6 = Dispatch(List=dispatch_3.ListB, DispatchPattern=smaller.SmallerThan)  # -> ListA, ListB
curve = Curve(dispatch_6.ListB)
curve_2 = Curve(dispatch_5.ListB)
curve_3 = Curve(merge_2)
point_2 = Point(evaluate_surface_2.Point)
brep_13 = Brep(brep_8)
vector = Vector(evaluate_surface_2.Normal)
brep_14 = Brep(brep_9)
curve_4 = Curve(curve)
curve_5 = Curve(curve_2)
curve_6 = Curve(curve_3)
point_3 = Point(point_2)
vector_2 = Vector(vector)
brep_15 = Brep(brep_13)
brep_16 = Brep(brep_14)
explode = Explode(Curve=curve_4, Recursive=True)  # -> simplify(graft(Segments)), Vertices
explode_2 = Explode(Curve=curve_5, Recursive=True)  # -> simplify(graft(Segments)), Vertices
explode_3 = Explode(Curve=curve_6, Recursive=True)  # -> Segments, Vertices
pl = PlaneNormal(Origin=point_3, ZAxis=vector_2)  # -> simplify(graft(Plane))
merge_3 = Merge(Data1=brep_16, Data2=brep_15)  # -> flatten(Result)
removeduplicatepts = RemoveDuplicatePts(Points=explode_3.Vertices, Tolerance=0.0001)  # -> simplify(UniquePoints)
mesh_brep = MeshBrep(
    Brep=merge_3,
    Settings={GridMaxCount=0, GridMinCount=16, JaggedSeams=False, MaxEdgeLength=0, MinEdgeLength=0.0001, MinTolerance=0, Refine=True, RefineAngle=0, RelativeTolerance=0.65, SimplePlanes=True, Tolerance=0})
loft = Loft(
    Curves=[explode.Segments, explode_2.Segments],
    Options={Adjust=False, Closed=False, LoftEnds=0, LoftSimp=0, LoftType=0, Rebuild=10, Refit=0.01})
simple_mesh = SimpleMesh(Brep=loft)
delaunay_mesh = DelaunayMesh(Points=removeduplicatepts, Plane=pl)
offsetmesh = OffsetMesh(Mesh=mesh_brep, Dist="-0.05", Solid=False)
merge_4 = Merge(Data1=simple_mesh, Data2=delaunay_mesh)  # -> flatten(Result)
weaverbird_s_join_meshes_and_weld = WeaverbirdsJoinMeshesAndWeld(Mesh=offsetmesh, Weld=invert(False))
weaverbird_s_join_meshes_and_weld_2 = WeaverbirdsJoinMeshesAndWeld(Mesh=merge_4, Weld=invert(False))
dual = Dual(Mesh=weaverbird_s_join_meshes_and_weld_2, Type=0)
create_settings = CreateSettings(VoxelSize="0.02", Bandwidth=1, Isovalue=0, Adaptivity=0.1)
ngon_edges = NGonEdges(Mesh=dual)  # -> Edges, ID, NakedID, Normal, Naked, AllE
dispatch_7 = Dispatch(List=ngon_edges.Edges, DispatchPattern=ngon_edges.NakedID)  # -> ListA, ListB
mesh_to_volume = MeshToVolume(Mesh=weaverbird_s_join_meshes_and_weld, Settings=create_settings)
mp = MultiPipe(Curves=dispatch_7.ListB, NodeSize="0.03", EndOffset="50", StrutSize=1, Segment=0, KinkAngle=0.6, CubeFit=0, Caps=0)
mesh_from_subd = MeshFromSubD(SubD=mp, Density=0)
weaverbird_s_join_meshes_and_weld_3 = WeaverbirdsJoinMeshesAndWeld(Mesh=mesh_from_subd, Weld=invert(False))
weaverbird_s_catmull_clark_subdivision = WeaverbirdsCatmullClarkSubdivision(MeshCurves=weaverbird_s_join_meshes_and_weld_3, Level=2, SmoothNakedEdges=1)
mesh_to_volume_2 = MeshToVolume(Mesh=weaverbird_s_catmull_clark_subdivision, Settings=create_settings)
volume_union = VolumeUnion(Volumes=flatten([mesh_to_volume, mesh_to_volume_2]))
volume_to_mesh = VolumeToMesh(Volume=volume_union, VolumeSettings=create_settings)
