# Grasshopper definition #55_chinese_texture1.gh (Grasshopper 1.0.7)
# plug-ins: Nautilus, Kangaroo2 Components, Weaverbird, Bifocals

yz_plane = YZPlane(Origin=Point(0, 0, 0))
curve = Curve(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)
project = Project(Geometry=curve, Plane=yz_plane)  # -> Geometry, Transform
subtraction = Subtraction(A="100", B="1")
division = Division(A="180", B="100")
divide_curve = DivideCurve(Curve=curve, Count=subtraction, Kinks=False)  # -> Points, Tangents, Parameters
divide_curve_2 = DivideCurve(Curve=project.Geometry, Count=subtraction, Kinks=False)  # -> Points, Tangents, Parameters
series = Series(Start=0, Step=division, Count="100")
circle = Circle(Plane=PlaneXY(0, 0, 0), Radius="45")
unit_z = UnitZ(Factor=series)
distance = Distance(PointA=divide_curve.Points, PointB=divide_curve_2.Points)
move = Move(Geometry=circle, Motion=unit_z)  # -> Geometry, Transform
reverse_list = ReverseList(List=distance)
construct_domain = ConstructDomain(DomainStart=Slider(0.2, range=0..1), DomainEnd=Slider(0.76, range=0..2))
bounds = Bounds(Numbers=reverse_list)
area = Area(Geometry=move.Geometry)  # -> Area, Centroid
remap_numbers = RemapNumbers(Value=reverse_list, Source=bounds, Target=construct_domain)  # -> Mapped, Clipped
scale = Scale(Geometry=move.Geometry, Center=area.Centroid, Factor=remap_numbers.Mapped)  # -> Geometry, Transform
loft = Loft(Curves=scale.Geometry, Options={Adjust=False, Closed=False, LoftEnds=0, LoftSimp=0, LoftType=0, Rebuild=10, Refit=0.01})
offset_surface = OffsetSurface(Surface=loft, Distance="-4", Retrim=True)
surface = Surface(offset_surface)
surface_2 = Surface(surface)
panel = Panel("32")
hexagon_on_surface = HexagonOnSurface(Surface=surface_2, Number="22", Orientation=Toggle(True))
partition_list = PartitionList(List=hexagon_on_surface, Size="22")
tree_statistics = TreeStatistics(Tree=partition_list)  # -> Paths, Length, Count
dispatch = Dispatch(List=tree_statistics.Paths, DispatchPattern=[True, False])  # -> ListA, ListB
tree_branch = TreeBranch(Tree=partition_list, Path=dispatch.ListA, MaintainPaths=True)  # -> simplify(Branch)
tree_branch_2 = TreeBranch(Tree=partition_list, Path=dispatch.ListB, MaintainPaths=True)  # -> simplify(Branch)
split_tree = SplitTree(Data=tree_branch, Masks=flatten("{0,4,...}"))  # -> Positive, Negative
tree_statistics_2 = TreeStatistics(Tree=split_tree.Positive)  # -> Paths, Length, Count
dispatch_2 = Dispatch(List=split_tree.Negative, DispatchPattern=[True, False])  # -> ListA, ListB
panel_2 = Panel("""0
-1""")
cull_index = CullIndex(List=tree_statistics_2.Paths, Indices=panel_2, Wrap=True)
list_item = ListItem(List=tree_statistics_2.Paths, Index=panel_2, Wrap=True)
curve_2 = Curve(dispatch_2.ListB)
tree_branch_3 = TreeBranch(Tree=split_tree.Positive, Path=list_item, MaintainPaths=True)
tree_branch_4 = TreeBranch(Tree=split_tree.Positive, Path=cull_index, MaintainPaths=True)
dispatch_3 = Dispatch(List=tree_branch_4, DispatchPattern=[True, False])  # -> ListA, ListB
merge = Merge(Data1=dispatch_3.ListB, Data2=dispatch_2.ListA, Data3=tree_branch_2, Data4=tree_branch_3)  # -> flatten(Result)
merge_2 = Merge(Data1=dispatch_3.ListA, Data2=curve_2)  # -> flatten(Result)
curve_3 = Curve(merge)
surface_3 = Surface(surface_2)
curve_4 = Curve(merge_2)
curve_5 = Curve(curve_3)
curve_6 = Curve(curve_4)
surface_4 = Surface(surface_3)
explode = Explode(Curve=curve_5, Recursive=True)  # -> Segments, Vertices
removeduplicatepts = RemoveDuplicatePts(Points=explode.Vertices, Tolerance=0.01)
flatten_tree = FlattenTree(Tree=removeduplicatepts, Path="{0}")
removeduplicatepts_2 = RemoveDuplicatePts(Points=flatten_tree, Tolerance=0.01)
member_index = MemberIndex(Set=flatten_tree, Member=removeduplicatepts_2)  # -> Index, Count
equality = Equality(FirstNumber=member_index.Count, SecondNumber="3")  # -> Equality, Inequality
dispatch_4 = Dispatch(List=removeduplicatepts_2, DispatchPattern=equality.Equality)  # -> ListA, ListB
point = Point(dispatch_4.ListA)
curve_7 = Curve(curve_5)
surface_5 = Surface(surface_4)
curve_8 = Curve(curve_6)
surface_6 = Surface(surface_5)
curve_9 = Curve(curve_8)
point_2 = Point(point)
curve_10 = Curve(curve_7)

# ----
# 网格2
merge_3 = Merge(Data1=curve_9, Data2=curve_10)  # -> flatten(Result)
explode_2 = Explode(Curve=merge_3, Recursive=True)  # -> Segments, Vertices
point_3 = Point(point_2)
removeduplicatepts_3 = RemoveDuplicatePts(Points=explode_2.Vertices, Tolerance=0.01)  # -> graft(UniquePoints)
distance_2 = Distance(PointA=removeduplicatepts_3, PointB=point_3)
tree_statistics_3 = TreeStatistics(Tree=removeduplicatepts_3)  # -> Paths, Length, Count
smaller_than = SmallerThan(FirstNumber=distance_2, SecondNumber="0.01")  # -> SmallerThan, OrEqualTo
create_set = CreateSet(List=smaller_than.SmallerThan)  # -> Set, Map
list_length = ListLength(List=create_set.Set)
larger_than = LargerThan(FirstNumber=list_length, SecondNumber="1")  # -> flatten(LargerThan), OrEqualTo
dispatch_5 = Dispatch(List=tree_statistics_3.Paths, DispatchPattern=larger_than.LargerThan)  # -> ListA, ListB
tree_branch_5 = TreeBranch(Tree=removeduplicatepts_3, Path=dispatch_5.ListA, MaintainPaths=True)
tree_branch_6 = TreeBranch(Tree=removeduplicatepts_3, Path=dispatch_5.ListB, MaintainPaths=True)
point_4 = Point(tree_branch_6)
surface_7 = Surface(surface_6)
point_5 = Point(tree_branch_5)
point_6 = Point(point_4)
surface_8 = Surface(surface_7)
point_7 = Point(point_5)
brep_closest_point = BrepClosestPoint(Point=point_7, Brep=surface_8)  # -> Point, Normal, Distance
amplitude = Amplitude(Vector=brep_closest_point.Normal, Amplitude="2.25")
move_2 = Move(Geometry=point_7, Motion=amplitude)  # -> Geometry, Transform
merge_4 = Merge(Data1=move_2.Geometry, Data2=point_6)  # -> simplify(Result)
subtraction_2 = Subtraction(A="1", B="0.15")
trim_tree = TrimTree(Tree=merge_4, Depth=1)
polyline = PolyLine(Vertices=trim_tree, Closed=invert(False))
construct_domain_2 = ConstructDomain(DomainStart="0.15", DomainEnd=subtraction_2)
removeduplicatepts_4 = RemoveDuplicatePts(Points=trim_tree, Tolerance=0.01)
explode_3 = Explode(Curve=polyline, Recursive=True)  # -> simplify(Segments), Vertices
sub_curve = SubCurve(BaseCurve=reparameterize(explode_3.Segments), Domain=construct_domain_2)
average = Average(Input=removeduplicatepts_4)
end_points = EndPoints(Curve=sub_curve)  # -> Start, End
weave = Weave(Pattern=[0, 1], Stream0=end_points.Start, Stream1=end_points.End, NullGaps=False)
shift_list = ShiftList(List=end_points.End, Shift="-1", Wrap=True)
line = Line(StartPoint=end_points.Start, EndPoint=shift_list)  # -> flatten(Line)
polyline_2 = PolyLine(Vertices=weave, Closed=invert(False))
surface_9 = Surface(surface_8)
point_8 = Point(average)
curve_11 = Curve(line)
curve_12 = Curve(polyline_2)
curve_13 = Curve(curve_11)
curve_14 = Curve(curve_12)
surface_10 = Surface(surface_9)
point_9 = Point(point_8)
brep_closest_point_2 = BrepClosestPoint(Point=point_9, Brep=surface_10)  # -> Point, Normal, Distance
scale_2 = Scale(Geometry=curve_14, Center=point_9, Factor="0.9")  # -> simplify(Geometry), Transform
join_curves = JoinCurves(Curves=curve_13, Preserve=False)
amplitude_2 = Amplitude(Vector=brep_closest_point_2.Normal, Amplitude="0.25")
move_3 = Move(Geometry=scale_2.Geometry, Motion=amplitude_2)  # -> simplify(Geometry), Transform
scale_3 = Scale(Geometry=move_3.Geometry, Center=point_9, Factor="0.93")  # -> simplify(Geometry), Transform
explode_4 = Explode(Curve=scale_2.Geometry, Recursive=True)  # -> simplify(graft(Segments)), Vertices
explode_5 = Explode(Curve=move_3.Geometry, Recursive=True)  # -> simplify(graft(Segments)), Vertices
explode_6 = Explode(Curve=scale_3.Geometry, Recursive=True)  # -> simplify(graft(Segments)), Vertices
explode_7 = Explode(Curve=curve_14, Recursive=True)  # -> simplify(graft(Segments)), Vertices
explode_8 = Explode(Curve=scale_2.Geometry, Recursive=True)  # -> Segments, Vertices
extrude = Extrude(Base=explode_8.Segments, Direction=amplitude_2)
boundary_surfaces = BoundarySurfaces(Edges=join_curves)
loft_2 = Loft(
    Curves=[explode_7.Segments, explode_4.Segments],
    Options={Adjust=False, Closed=False, LoftEnds=0, LoftSimp=0, LoftType=0, Rebuild=10, Refit=0.01})
loft_3 = Loft(
    Curves=[explode_6.Segments, explode_5.Segments],
    Options={Adjust=False, Closed=False, LoftEnds=0, LoftSimp=0, LoftType=0, Rebuild=10, Refit=0.01})
merge_5 = Merge(Data1=boundary_surfaces, Data2=loft_2, Data3=extrude, Data4=loft_3)  # -> flatten(Result)
brep = Brep(merge_5)
brep_2 = Brep(brep)
simple_mesh = SimpleMesh(Brep=brep_2)
weaverbird_s_join_meshes_and_weld = WeaverbirdsJoinMeshesAndWeld(Mesh=simple_mesh, Weld=invert(False))
weaverbird_s_mesh_thicken = WeaverbirdsMeshThicken(MeshCurves=weaverbird_s_join_meshes_and_weld, Distance="1", OffsetType=0)
weaverbird_s_catmull_clark_subdivision = WeaverbirdsCatmullClarkSubdivision(MeshCurves=weaverbird_s_mesh_thicken, Level=1, SmoothNakedEdges=1)

# ----
# 底面
panel_3 = Panel("3")
offset_surface_2 = OffsetSurface(Surface=surface_6, Distance=panel_3, Retrim=True)
point_10 = Point(point_2)
graft_tree = GraftTree(Tree=point_10, IncludeEmptyLists=True, IncludeNullItems=True)
brep_closest_point_3 = BrepClosestPoint(Point=point_10, Brep=offset_surface_2)  # -> Point, Normal, Distance
negative = Negative(Value="5")
closest_points = ClosestPoints(Point=graft_tree, Cloud=point_10, Count=3)  # -> ClosestPoint, CPIndex, Distance
plane_normal = PlaneNormal(Origin=brep_closest_point_3.Point, ZAxis=brep_closest_point_3.Normal)
merge_6 = Merge(Data1="5", Data2=negative)
average_2 = Average(Input=closest_points.Distance)
amplitude_3 = Amplitude(Vector=graft(brep_closest_point_3.Normal), Amplitude=merge_6)
multiplication = Multiplication(A=average_2, B="0.65")  # -> flatten(Result)
circle_2 = Circle(Plane=plane_normal, Radius=multiplication)
extrude_2 = Extrude(Base=graft(circle_2), Direction=amplitude_3)
brep_join = BrepJoin(Breps=extrude_2)  # -> Breps, Closed
surface_11 = Surface(offset_surface_2)
cap_holes = CapHoles(Brep=brep_join.Breps)
brep_brep = BrepBrep(BrepA=surface_11, BrepB=cap_holes)  # -> simplify(Curves), Points
vector = Vector(brep_closest_point_3.Normal)
brep_3 = Brep(cap_holes)
curve_15 = Curve(brep_brep.Curves)
surface_12 = Surface(surface_11)
curve_16 = Curve(curve_15)
brep_4 = Brep(brep_3)
vector_2 = Vector(vector)
divide_curve_3 = DivideCurve(Curve=curve_16, Count=10, Kinks=False)  # -> Points, Tangents, Parameters
amplitude_4 = Amplitude(Vector=graft(vector_2), Amplitude="0.5")
trim_solid = TrimSolid(Shape=surface_12, Cutters=flatten(brep_4))
average_3 = Average(Input=divide_curve_3.Points)
scale_4 = Scale(Geometry=curve_16, Center=average_3, Factor="0.9")  # -> simplify(Geometry), Transform
move_4 = Move(Geometry=scale_4.Geometry, Motion=amplitude_4)  # -> simplify(Geometry), Transform
scale_5 = Scale(Geometry=move_4.Geometry, Center=average_3, Factor="0.8")  # -> simplify(Geometry), Transform
loft_4 = Loft(
    Curves=[curve_16, scale_4.Geometry],
    Options={Adjust=False, Closed=False, LoftEnds=0, LoftSimp=0, LoftType=0, Rebuild=10, Refit=0.01})
loft_5 = Loft(
    Curves=[scale_4.Geometry, scale_5.Geometry],
    Options={Adjust=False, Closed=False, LoftEnds=0, LoftSimp=0, LoftType=0, Rebuild=10, Refit=0.01})
merge_7 = Merge(Data1=loft_4, Data2=loft_5, Data3=trim_solid)  # -> flatten(Result)
brep_join_2 = BrepJoin(Breps=flatten(merge_7))  # -> Breps, Closed
mesh_brep = MeshBrep(
    Brep=brep_join_2.Breps,
    Settings={GridMaxCount=0, GridMinCount=16, JaggedSeams=False, MaxEdgeLength=0, MinEdgeLength=0.0001, MinTolerance=0, Refine=True, RefineAngle=0, RelativeTolerance=0.65, SimplePlanes=True, Tolerance=0})
weaverbird_s_mesh_thicken_2 = WeaverbirdsMeshThicken(MeshCurves=mesh_brep, Distance="-1", OffsetType=0)

# ----
# 花型纹
curve_17 = Curve(curve_9)
surface_13 = Surface(surface_6)
curve_18 = Curve(curve_17)
surface_14 = Surface(surface_13)
curve_19 = Curve(curve_18)
surface_15 = Surface(surface_14)
curve_20 = Curve(curve_19)
surface_16 = Surface(surface_15)
curve_21 = Curve(curve_20)
surface_17 = Surface(surface_16)
curve_22 = Curve(scale_3.Geometry)
tree_statistics_4 = TreeStatistics(Tree=curve_22)  # -> Paths, Length, Count
list_length_2 = ListLength(List=curve_21)
split_list = SplitList(List=tree_statistics_4.Paths, Index=list_length_2)  # -> ListA, ListB
tree_branch_7 = TreeBranch(Tree=curve_22, Path=split_list.ListA, MaintainPaths=True)
explode_9 = Explode(Curve=tree_branch_7, Recursive=True)  # -> simplify(Segments), Vertices
dispatch_6 = Dispatch(List=explode_9.Segments, DispatchPattern=[True, False])  # -> ListA, ListB
curve_middle = CurveMiddle(Curve=dispatch_6.ListB)
point_on_curve = PointOnCurve(dispatch_6.ListB, parameter=0.75)
point_on_curve_2 = PointOnCurve(dispatch_6.ListB, parameter=0.25)
average_4 = Average(Input=curve_middle)
brep_closest_point_4 = BrepClosestPoint(Point=average_4, Brep=surface_17)  # -> Point, Normal, Distance
distance_3 = Distance(PointA=curve_middle, PointB=average_4)
amplitude_5 = Amplitude(Vector=brep_closest_point_4.Normal, Amplitude="1")
average_5 = Average(Input=distance_3)
plane_normal_2 = PlaneNormal(Origin=brep_closest_point_4.Point, ZAxis=brep_closest_point_4.Normal)
multiplication_2 = Multiplication(A=average_5, B="0.15")
circle_3 = Circle(Plane=plane_normal_2, Radius=multiplication_2)  # -> simplify(Circle)
move_5 = Move(Geometry=circle_3, Motion=amplitude_5)  # -> Geometry, Transform
vector_3 = Vector(brep_closest_point_4.Normal)
curve_23 = Curve(move_5.Geometry)
vector_4 = Vector(vector_3)
curve_24 = Curve(curve_23)
vector_5 = Vector(vector_4)

point_11 = Point(point_on_curve)
point_12 = Point(point_on_curve_2)
point_13 = Point(point_12)
point_14 = Point(point_11)

curve_closest_point = CurveClosestPoint(Point=point_14, Curve=curve_24)  # -> Point, Parameter, Distance
curve_closest_point_2 = CurveClosestPoint(Point=point_13, Curve=curve_24)  # -> Point, Parameter, Distance
merge_8 = Merge(Data1=curve_closest_point_2.Parameter, Data2=curve_closest_point.Parameter)
shatter = Shatter(Curve=curve_24, Parameters=merge_8)
length = Length(Curve=shatter)
dispatch_7 = Dispatch(List=point_13, DispatchPattern=[True, False])  # -> ListA, ListB
sort_list = SortList(Keys=length, ValuesValuesA=shatter)  # -> Keys, ValuesValuesA
dispatch_8 = Dispatch(List=point_14, DispatchPattern=[True, False])  # -> ListA, ListB
dispatch_9 = Dispatch(List=curve_closest_point_2.Point, DispatchPattern=[True, False])  # -> ListA, ListB
dispatch_10 = Dispatch(List=curve_closest_point.Point, DispatchPattern=[True, False])  # -> ListA, ListB
split_list_2 = SplitList(List=sort_list.ValuesValuesA, Index="6")  # -> ListA, ListB
point_15 = Point(dispatch_10.ListB)
point_16 = Point(dispatch_8.ListB)
point_17 = Point(dispatch_9.ListB)
point_18 = Point(dispatch_7.ListB)
point_19 = Point(dispatch_8.ListA)
point_20 = Point(dispatch_10.ListA)
point_21 = Point(dispatch_7.ListA)
point_22 = Point(dispatch_9.ListA)
vector_2pt = Vector2Pt(PointA=point_16, PointB=point_15, Unitize=False)  # -> Vector, Length
vector_2pt_2 = Vector2Pt(PointA=point_19, PointB=point_20, Unitize=False)  # -> Vector, Length
vector_2pt_3 = Vector2Pt(PointA=point_21, PointB=point_22, Unitize=False)  # -> Vector, Length
vector_2pt_4 = Vector2Pt(PointA=point_18, PointB=point_17, Unitize=False)  # -> Vector, Length
multiplication_3 = Multiplication(A=vector_2pt.Vector, B=Slider(0.615, range=0..1))
rotate = Rotate(Vector=vector_2pt_2.Vector, Axis=vector_5, Angle=expr("-x", Slider(0.81, range=0..1)))
rotate_2 = Rotate(Vector=vector_2pt_4.Vector, Axis=vector_5, Angle=expr("-x", Slider(0.81, range=0..1)))
multiplication_4 = Multiplication(A=vector_2pt_2.Vector, B=Slider(0.615, range=0..1))
rotate_3 = Rotate(Vector=vector_2pt_3.Vector, Axis=vector_5, Angle=Slider(0.81, range=0..1))
rotate_4 = Rotate(Vector=vector_2pt.Vector, Axis=vector_5, Angle=Slider(0.81, range=0..1))
multiplication_5 = Multiplication(A=vector_2pt_4.Vector, B=Slider(0.615, range=0..1))
reverse = Reverse(Vector=rotate)
reverse_2 = Reverse(Vector=rotate_3)
multiplication_6 = Multiplication(A=vector_2pt_3.Vector, B=Slider(0.615, range=0..1))
reverse_3 = Reverse(Vector=multiplication_5)
reverse_4 = Reverse(Vector=multiplication_3)
multiplication_7 = Multiplication(A=rotate_2, B=Slider(0.811, range=0..1))
multiplication_8 = Multiplication(A=rotate_4, B=Slider(0.811, range=0..1))
multiplication_9 = Multiplication(A=reverse, B=Slider(0.811, range=0..1))
multiplication_10 = Multiplication(A=reverse_2, B=Slider(0.811, range=0..1))
bezier_span = BezierSpan(StartPoint=point_16, StartTangent=multiplication_8, EndPoint=point_15, EndTangent=reverse_4)  # -> simplify(Curve), Length, Domain
bezier_span_2 = BezierSpan(StartPoint=point_18, StartTangent=multiplication_7, EndPoint=point_17, EndTangent=reverse_3)  # -> simplify(Curve), Length, Domain
bezier_span_3 = BezierSpan(StartPoint=point_19, StartTangent=multiplication_4, EndPoint=point_20, EndTangent=multiplication_9)  # -> simplify(Curve), Length, Domain
bezier_span_4 = BezierSpan(StartPoint=point_21, StartTangent=multiplication_6, EndPoint=point_22, EndTangent=multiplication_10)  # -> simplify(Curve), Length, Domain
curve_25 = Curve(split_list_2.ListB)
merge_9 = Merge(
    Data1=simplify(curve_25),
    Data2=bezier_span_4.Curve,
    Data3=bezier_span_3.Curve,
    Data4=bezier_span_2.Curve,
    Data5=bezier_span.Curve)
curve_26 = Curve(merge_9)
curve_27 = Curve(curve_26)
join_curves_2 = JoinCurves(Curves=curve_27, Preserve=False)
multipipe = MultiPipe(Curves=join_curves_2, NodeSize="0.2", EndOffset=1, StrutSize=1, Segment=0, KinkAngle=0.6, CubeFit=0, Caps=1)
mesh_from_subd = MeshFromSubD(SubD=multipipe, Density=2)

# ----
# 网格1
explode_10 = Explode(Curve=curve_9, Recursive=True)  # -> Segments, Vertices
removeduplicatepts_5 = RemoveDuplicatePts(Points=explode_10.Vertices, Tolerance=0.01)
average_6 = Average(Input=removeduplicatepts_5)
brep_closest_point_5 = BrepClosestPoint(Point=average_6, Brep=surface_6)  # -> Point, Normal, Distance
closest_points_2 = ClosestPoints(Point=average_6, Cloud=point_2, Count="6")  # -> ClosestPoint, CPIndex, Distance
plane_normal_3 = PlaneNormal(Origin=brep_closest_point_5.Point, ZAxis=brep_closest_point_5.Normal)
circle_4 = Circle(Plane=plane_normal_3, Radius=1)
sort_along_curve = SortAlongCurve(Points=closest_points_2.ClosestPoint, Curve=circle_4)  # -> Points, Indices
polyline_3 = PolyLine(Vertices=sort_along_curve.Points, Closed=invert(False))
subtraction_3 = Subtraction(A="1", B="0.15")
explode_11 = Explode(Curve=polyline_3, Recursive=True)  # -> simplify(Segments), Vertices
construct_domain_3 = ConstructDomain(DomainStart="0.15", DomainEnd=subtraction_3)
sub_curve_2 = SubCurve(BaseCurve=reparameterize(explode_11.Segments), Domain=construct_domain_3)
point_23 = Point(sort_along_curve.Points)
vector_6 = Vector(brep_closest_point_5.Normal)
curve_28 = Curve(sub_curve_2)
vector_7 = Vector(vector_6)
curve_29 = Curve(curve_28)
point_24 = Point(point_23)
end_points_2 = EndPoints(Curve=curve_29)  # -> Start, End
average_7 = Average(Input=point_24)
weave_2 = Weave(Pattern=[0, 1], Stream0=end_points_2.Start, Stream1=end_points_2.End, NullGaps=False)
shift_list_2 = ShiftList(List=end_points_2.End, Shift="-1", Wrap=True)
polyline_4 = PolyLine(Vertices=weave_2, Closed=invert(False))
line_2 = Line(StartPoint=end_points_2.Start, EndPoint=shift_list_2)  # -> flatten(Line)
join_curves_3 = JoinCurves(Curves=line_2, Preserve=False)
explode_12 = Explode(Curve=join_curves_3, Recursive=True)  # -> Segments, Vertices
graft_tree_2 = GraftTree(Tree=join_curves_3, IncludeEmptyLists=True, IncludeNullItems=True)  # -> simplify(Tree)
amplitude_6 = Amplitude(Vector=vector_7, Amplitude="0.25")
scale_6 = Scale(Geometry=polyline_4, Center=average_7, Factor="0.9")  # -> simplify(Geometry), Transform
removeduplicatepts_6 = RemoveDuplicatePts(Points=explode_12.Vertices, Tolerance=0.01)
average_8 = Average(Input=removeduplicatepts_6)
move_6 = Move(Geometry=scale_6.Geometry, Motion=amplitude_6)  # -> simplify(Geometry), Transform
scale_7 = Scale(Geometry=graft_tree_2, Center=average_8, Factor="0.75")  # -> simplify(Geometry), Transform
fillet = Fillet(Curve=scale_7.Geometry, Radius="0.75")
curve_30 = Curve(scale_6.Geometry)
curve_31 = Curve(graft_tree_2)
curve_32 = Curve(fillet)
curve_33 = Curve(move_6.Geometry)
point_25 = Point(average_7)
curve_34 = Curve(polyline_4)
point_26 = Point(point_25)
curve_35 = Curve(curve_34)
curve_36 = Curve(curve_32)
curve_37 = Curve(curve_33)
curve_38 = Curve(curve_31)
curve_39 = Curve(curve_30)
merge_10 = Merge(Data1=curve_38, Data2=curve_36)
explode_13 = Explode(Curve=curve_35, Recursive=True)  # -> simplify(graft(Segments)), Vertices
explode_14 = Explode(Curve=curve_37, Recursive=True)  # -> simplify(graft(Segments)), Vertices
explode_15 = Explode(Curve=curve_39, Recursive=True)  # -> simplify(graft(Segments)), Vertices
scale_8 = Scale(Geometry=curve_37, Center=point_26, Factor="0.97")  # -> simplify(Geometry), Transform
explode_16 = Explode(Curve=scale_8.Geometry, Recursive=True)  # -> simplify(graft(Segments)), Vertices
loft_6 = Loft(
    Curves=[explode_15.Segments, explode_13.Segments],
    Options={Adjust=False, Closed=False, LoftEnds=0, LoftSimp=0, LoftType=0, Rebuild=10, Refit=0.01})
loft_7 = Loft(
    Curves=[explode_14.Segments, explode_15.Segments],
    Options={Adjust=False, Closed=False, LoftEnds=0, LoftSimp=0, LoftType=0, Rebuild=10, Refit=0.01})
loft_8 = Loft(
    Curves=[explode_14.Segments, explode_16.Segments],
    Options={Adjust=False, Closed=False, LoftEnds=0, LoftSimp=0, LoftType=0, Rebuild=10, Refit=0.01})
boundary_surfaces_2 = BoundarySurfaces(Edges=merge_10)
merge_11 = Merge(Data1=loft_6, Data2=loft_7, Data3=loft_8)  # -> flatten(Result)
simple_mesh_2 = SimpleMesh(Brep=merge_11)

mesh_brep_2 = MeshBrep(
    Brep=boundary_surfaces_2,
    Settings={GridMaxCount=0, GridMinCount=16, JaggedSeams=False, MaxEdgeLength=0, MinEdgeLength=0.0001, MinTolerance=0, Refine=True, RefineAngle=0, RelativeTolerance=0.65, SimplePlanes=True, Tolerance=0})
merge_12 = Merge(Data1=simple_mesh_2, Data2=mesh_brep_2)  # -> flatten(Result)

weaverbird_s_join_meshes_and_weld_2 = WeaverbirdsJoinMeshesAndWeld(Mesh=merge_12, Weld=invert(False))
weaverbird_s_mesh_thicken_3 = WeaverbirdsMeshThicken(MeshCurves=weaverbird_s_join_meshes_and_weld_2, Distance="-1", OffsetType=0)
weaverbird_s_catmull_clark_subdivision_2 = WeaverbirdsCatmullClarkSubdivision(MeshCurves=weaverbird_s_mesh_thicken_3, Level=1, SmoothNakedEdges=1)
