# Grasshopper definition #56_chinese_texture2.gh (Grasshopper 1.0.7)
# plug-ins: Pufferfish, Weaverbird

yz_plane = YZPlane(Origin=Point(0, 0, 0))
curve = Curve(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)
subtraction = Subtraction(A="100", B="1")
project = Project(Geometry=curve, Plane=yz_plane)  # -> Geometry, Transform
circle = Circle(Plane=PlaneXY(0, 0, 0), Radius="45")
division = Division(A="180", B="100")
series = Series(Start=0, Step=division, Count="100")
unit_z = UnitZ(Factor=series)
divide_curve = DivideCurve(Curve=project.Geometry, Count=subtraction, Kinks=False)  # -> Points, Tangents, Parameters
divide_curve_2 = DivideCurve(Curve=curve, Count=subtraction, Kinks=False)  # -> Points, Tangents, Parameters
distance = Distance(PointA=divide_curve_2.Points, PointB=divide_curve.Points)
move = Move(Geometry=circle, Motion=unit_z)  # -> Geometry, Transform
reverse_list = ReverseList(List=distance)
area = Area(Geometry=move.Geometry)  # -> Area, Centroid
construct_domain = ConstructDomain(DomainStart=Slider(0.2, range=0..1), DomainEnd=Slider(0.76, range=0..2))
bounds = Bounds(Numbers=reverse_list)
remap_numbers = RemapNumbers(Value=reverse_list, Source=bounds, Target=construct_domain)  # -> Mapped, Clipped
scale = Scale(Geometry=move.Geometry, Center=area.Centroid, Factor=remap_numbers.Mapped)  # -> Geometry, Transform
loft = Loft(Curves=scale.Geometry, Options={Adjust=False, Closed=False, LoftEnds=0, LoftSimp=0, LoftType=0, Rebuild=10, Refit=0.01})
division_2 = Division(A="1", B="18")
series_2 = Series(Start=0, Step=division_2, Count="18")
construct_point = ConstructPoint(XCoordinate=0, YCoordinate=series_2, ZCoordinate=0)
iso_curve = IsoCurve(Surface=reparameterize(loft), UVPoint=construct_point)  # -> UIsocurve, VIsocurve
brep = Brep(loft)
curve_2 = Curve(iso_curve.UIsocurve)
number = Number("180")
curve_3 = Curve(curve_2)
brep_2 = Brep(brep)
number_2 = Number(number)
division_3 = Division(A="1", B="22")
list_item = ListItem(List=flatten(curve_3), Index=0, Wrap=True)
series_3 = Series(Start=0, Step=division_3, Count="22")
division_4 = Division(A=number_2, B="22")
curvature = Curvature(Curve=list_item, Parameter=series_3)  # -> Point, Curvature, Curvature_2
brep_edges = BrepEdges(Brep=brep_2)  # -> Naked, Interior, NonManifold
deconstruct_arc = DeconstructArc(Arc=curvature.Curvature_2)  # -> BasePlane, Radius, Angle
duplicate_data = DuplicateData(Data=division_4, Number="22", Order=True)
list_item_2 = ListItem(List=brep_edges.Naked, Index=0, Wrap=True)
bounds_2 = Bounds(Numbers=deconstruct_arc.Radius)
curve_4 = Curve(flatten(curve_3))
remap_numbers_2 = RemapNumbers(Value=deconstruct_arc.Radius, Source=bounds_2, Target=Domain(0, 2))  # -> Mapped, Clipped
mass_subtraction = MassSubtraction(Numbers=remap_numbers_2.Mapped)  # -> Subtracted, Partial
negative = Negative(Value=mass_subtraction.Partial)
addition = Addition(A=negative, B=duplicate_data)
mass_addition = MassAddition(Input=addition)  # -> Result, PartialResults
division_5 = Division(A=number_2, B=mass_addition.Result)
multiplication = Multiplication(A=addition, B=division_5)
merge = Merge(Data1="0", Data2=multiplication)
contour_ex = ContourEx(Shape=brep_2, Plane=PlaneXY(0, 0, 0), Distances=merge)  # -> flatten(Contours)
merge_2 = Merge(Data1=contour_ex, Data2=list_item_2)  # -> flatten(Result)
graft_tree = GraftTree(Tree=merge_2, IncludeEmptyLists=True, IncludeNullItems=True)  # -> simplify(Tree)
curve_curve = CurveCurve(CurveA=graft_tree, CurveB=curve_4)  # -> Points, ParamsA, ParamsB
point = Point(curve_curve.Points)
brep_3 = Brep(brep_2)
point_2 = Point(point)
brep_4 = Brep(brep_3)
trim_tree = TrimTree(Tree=point_2, Depth=1)
construct_domain² = ConstructDomain²(UMin=Slider(0.7237, range=0..1), UMax=1, VMin=0, VMax=1)
construct_domain²_2 = ConstructDomain²(UMin=0, UMax=Slider(0.1858, range=0..1), VMin=0, VMax=1)
split_tree = SplitTree(Data=trim_tree, Masks=flatten("{0,2,...}"))  # -> Positive, Negative
isotrim = Isotrim(Surface=reparameterize(brep_4), Domain=construct_domain²)
isotrim_2 = Isotrim(Surface=reparameterize(brep_4), Domain=construct_domain²_2)
dispatch = Dispatch(List=split_tree.Negative, DispatchPattern=[True, False])  # -> graft(ListA), graft(ListB)
dispatch_2 = Dispatch(List=split_tree.Positive, DispatchPattern=[True, False])  # -> graft(ListA), graft(ListB)
negative_2 = Negative(Value="2.2")
offset_surface = OffsetSurface(Surface=isotrim_2, Distance="2.2", BothSides=negative_2, CreateSolid=True)
offset_surface_2 = OffsetSurface(Surface=isotrim, Distance="2.2", BothSides=negative_2, CreateSolid=True)
brep_closest_point = BrepClosestPoint(Point=dispatch_2.ListB, Brep=brep_4)  # -> Point, Normal, Distance
brep_closest_point_2 = BrepClosestPoint(Point=dispatch.ListB, Brep=brep_4)  # -> Point, Normal, Distance
point_3 = Point(dispatch_2.ListB)
trim_tree_2 = TrimTree(Tree=dispatch_2.ListA, Depth=1)
negative_3 = Negative(Value="2")
tree_statistics = TreeStatistics(Tree=trim_tree_2)  # -> Paths, Length, Count
amplitude = Amplitude(Vector=brep_closest_point.Normal, Amplitude="2")
amplitude_2 = Amplitude(Vector=brep_closest_point_2.Normal, Amplitude=negative_3)
panel = Panel("""0
-1""")
cull_index = CullIndex(List=tree_statistics.Paths, Indices=panel, Wrap=True)
move_2 = Move(Geometry=dispatch.ListA, Motion=amplitude_2)  # -> Geometry, Transform
move_3 = Move(Geometry=dispatch_2.ListB, Motion=amplitude)  # -> Geometry, Transform
tree_branch = TreeBranch(Tree=trim_tree_2, Path=cull_index, MaintainPaths=True)  # -> graft(Branch)
point_4 = Point(dispatch.ListB)
trim_tree_3 = TrimTree(Tree=point_3, Depth=1)
tree_statistics_2 = TreeStatistics(Tree=trim_tree_3)  # -> Paths, Length, Count
point_5 = Point(dispatch.ListA)
point_6 = Point(tree_branch)
panel_2 = Panel("""0
-1""")
cull_index_2 = CullIndex(List=tree_statistics_2.Paths, Indices=panel_2, Wrap=True)
relative_items = RelativeItems(TreeA=point_6, TreeB=point_5, Offset="{-1;+0}", WrapPaths=False, WrapItems=False)  # -> ItemA, ItemB
tree_branch_2 = TreeBranch(Tree=trim_tree_3, Path=cull_index_2, MaintainPaths=True)  # -> graft(Branch)
relative_items_2 = RelativeItems(TreeA=point_6, TreeB=point_3, Offset="{+0;-1}", WrapPaths=invert(False), WrapItems=False)  # -> ItemA, ItemB
relative_items_3 = RelativeItems(TreeA=point_6, TreeB=point_5, Offset="{+1;+0}", WrapPaths=False, WrapItems=False)  # -> ItemA, ItemB
relative_items_4 = RelativeItems(TreeA=point_4, TreeB=move_2.Geometry, Offset="{+0;+1}", WrapPaths=invert(False), WrapItems=False)  # -> ItemA, ItemB
relative_items_5 = RelativeItems(TreeA=point_4, TreeB=move_3.Geometry, Offset="{-1;+0}", WrapPaths=False, WrapItems=False)  # -> ItemA, ItemB
relative_items_6 = RelativeItems(TreeA=point_4, TreeB=move_3.Geometry, Offset="{+1;+0}", WrapPaths=False, WrapItems=False)  # -> ItemA, ItemB
brep_5 = Brep(brep_4)
point_7 = Point(relative_items_6.ItemA)
pt1 = Point(relative_items_6.ItemB)
pt2 = Point(move_2.Geometry)
pt3 = Point(relative_items_5.ItemB)
pt4 = Point(relative_items_4.ItemB)
pt3_2 = Point(relative_items.ItemB)
pt4_2 = Point(tree_branch_2)
pt2_2 = Point(relative_items_2.ItemB)
point_8 = Point(relative_items_3.ItemA)
pt1_2 = Point(relative_items_3.ItemB)
brep_6 = Brep(brep_4)
brep_7 = Brep(brep_5)
pt1_3 = Point(pt1)
pt2_3 = Point(pt2)
point_9 = Point(point_7)
pt4_3 = Point(pt4_2)
pt3_3 = Point(pt3)
pt4_4 = Point(pt4)
pt3_4 = Point(pt3_2)
pt2_4 = Point(pt2_2)
pt1_4 = Point(pt1_2)
brep_8 = Brep(brep_6)
point_10 = Point(point_8)
brep_9 = Brep(brep_7)
merge_3 = Merge(Data1=pt1_4, Data2=pt2_4, Data3=pt3_4, Data4=pt4_3)
merge_4 = Merge(Data1=pt1_3, Data2=pt3_3, Data3=pt2_3, Data4=pt4_4)
vector_2pt = Vector2Pt(PointA=point_10, PointB=merge_3, Unitize=False)  # -> Vector, Length
point_11 = Point(point_9)
cluster = Cluster_2(pt1=pt3_3, brep=brep_7, val="3.5")
cluster_2 = Cluster_2(pt1=pt3_3, brep=brep_7, val="2")
cluster_3 = Cluster_3(pt2=pt4_4, brep=brep_7, val="2")
cluster_4 = Cluster_3(pt2=pt4_4, brep=brep_7, val="1")
cluster_5 = Cluster_2(pt1=pt1_3, brep=brep_7, val="3.5")
cluster_6 = Cluster_3(pt2=pt2_3, brep=brep_7, val="2")
cluster_7 = Cluster_3(pt2=pt2_3, brep=brep_7, val="1")
cluster_8 = Cluster_2(pt1=pt1_3, brep=brep_7, val="2")
vector_2pt_2 = Vector2Pt(PointA=point_11, PointB=merge_4, Unitize=False)  # -> Vector, Length
cluster_9 = Cluster_2(pt1=pt1_4, brep=brep_8, val="3")
cluster_10 = Cluster_2(pt1=pt1_4, brep=brep_8, val="2")
cluster_11 = Cluster_3(pt2=pt2_4, brep=brep_8, val="1")
cluster_12 = Cluster_2(pt1=pt3_4, brep=brep_8, val="3")
cluster_13 = Cluster_3(pt2=pt2_4, brep=brep_8, val="2")
cluster_14 = Cluster_2(pt1=pt3_4, brep=brep_8, val="2")
cluster_15 = Cluster_3(pt2=pt4_3, brep=brep_8, val="2")
cluster_16 = Cluster_3(pt2=pt4_3, brep=brep_8, val="1")
multiplication_2 = Multiplication(A=vector_2pt.Vector, B="0.15")
multiplication_3 = Multiplication(A=vector_2pt.Vector, B="0.6")
pt2_5 = Point(cluster_6)
pt2_6 = Point(cluster_7)
pt4_5 = Point(cluster_3)
pt4_6 = Point(cluster_4)
pt3_5 = Point(cluster_2)
pt3_6 = Point(cluster)
pt1_5 = Point(cluster_8)
pt1_6 = Point(cluster_5)
multiplication_4 = Multiplication(A=vector_2pt_2.Vector, B="0.35")
multiplication_5 = Multiplication(A=vector_2pt_2.Vector, B="0.8")
list_item_3 = ListItem(List=cluster_9, Index=0, Wrap=True)  # -> Item, Item1
list_item_4 = ListItem(List=cluster_10, Index=0, Wrap=True)  # -> Item, Item1
list_item_5 = ListItem(List=cluster_12, Index=0, Wrap=True)  # -> Item, Item1
list_item_6 = ListItem(List=cluster_13, Index=0, Wrap=True)  # -> Item, Item1
list_item_7 = ListItem(List=cluster_16, Index=0, Wrap=True)  # -> Item, Item1
list_item_8 = ListItem(List=cluster_14, Index=0, Wrap=True)  # -> Item, Item1
list_item_9 = ListItem(List=cluster_11, Index=0, Wrap=True)  # -> Item, Item1
list_item_10 = ListItem(List=cluster_15, Index=0, Wrap=True)  # -> Item, Item1
move_4 = Move(Geometry=point_10, Motion=multiplication_2)  # -> Geometry, Transform
move_5 = Move(Geometry=point_10, Motion=multiplication_3)  # -> Geometry, Transform
list_item_11 = ListItem(List=pt4_6, Index=0, Wrap=True)  # -> Item, Item1
list_item_12 = ListItem(List=pt4_5, Index=0, Wrap=True)  # -> Item, Item1
list_item_13 = ListItem(List=pt2_6, Index=0, Wrap=True)  # -> Item, Item1
list_item_14 = ListItem(List=pt2_5, Index=0, Wrap=True)  # -> Item, Item1
list_item_15 = ListItem(List=pt1_5, Index=0, Wrap=True)  # -> Item, Item1
list_item_16 = ListItem(List=pt1_6, Index=0, Wrap=True)  # -> Item, Item1
list_item_17 = ListItem(List=pt3_6, Index=0, Wrap=True)  # -> Item, Item1
list_item_18 = ListItem(List=pt3_5, Index=0, Wrap=True)  # -> Item, Item1
move_6 = Move(Geometry=point_11, Motion=multiplication_5)  # -> Geometry, Transform
move_7 = Move(Geometry=point_11, Motion=multiplication_4)  # -> Geometry, Transform
vector_2pt_3 = Vector2Pt(PointA=list_item_17.Item, PointB=list_item_12.Item, Unitize=False)  # -> Vector, Length
vector_2pt_4 = Vector2Pt(PointA=list_item_16.Item1, PointB=list_item_14.Item1, Unitize=False)  # -> Vector, Length
vector_2pt_5 = Vector2Pt(PointA=list_item_12.Item1, PointB=list_item_16.Item, Unitize=False)  # -> Vector, Length
vector_2pt_6 = Vector2Pt(PointA=list_item_14.Item, PointB=list_item_17.Item1, Unitize=False)  # -> Vector, Length
list_item_19 = ListItem(List=move_5.Geometry, Index=0, Wrap=True)  # -> Item, Item1, Item2, Item3
list_item_20 = ListItem(List=move_4.Geometry, Index=0, Wrap=True)  # -> Item, Item1, Item2, Item3
multiplication_6 = Multiplication(A=vector_2pt_4.Vector, B="0.25")
vector_2pt_7 = Vector2Pt(PointA=list_item_6.Item, PointB=list_item_5.Item1, Unitize=False)  # -> Vector, Length
vector_2pt_8 = Vector2Pt(PointA=list_item_3.Item1, PointB=list_item_6.Item1, Unitize=False)  # -> Vector, Length
multiplication_7 = Multiplication(A=vector_2pt_5.Vector, B="0.25")
list_item_21 = ListItem(List=move_6.Geometry, Index=0, Wrap=True)  # -> Item, Item1, Item2, Item3
list_item_22 = ListItem(List=move_7.Geometry, Index=0, Wrap=True)  # -> Item, Item1, Item2, Item3
multiplication_8 = Multiplication(A=vector_2pt_6.Vector, B="0.25")
multiplication_9 = Multiplication(A=vector_2pt_3.Vector, B="0.25")
vector_2pt_9 = Vector2Pt(PointA=list_item_3.Item, PointB=list_item_10.Item1, Unitize=False)  # -> Vector, Length
vector_2pt_10 = Vector2Pt(PointA=list_item_5.Item, PointB=list_item_10.Item, Unitize=False)  # -> Vector, Length
reverse = Reverse(Vector=multiplication_7)
reverse_2 = Reverse(Vector=multiplication_8)
reverse_3 = Reverse(Vector=multiplication_9)
reverse_4 = Reverse(Vector=multiplication_6)
multiplication_10 = Multiplication(A=vector_2pt_7.Vector, B="0.35")
multiplication_11 = Multiplication(A=vector_2pt_9.Vector, B="0.35")
multiplication_12 = Multiplication(A=vector_2pt_10.Vector, B="0.35")
multiplication_13 = Multiplication(A=vector_2pt_8.Vector, B="0.35")
move_8 = Move(Geometry=list_item_12.Item1, Motion=multiplication_7)  # -> Geometry, Transform
move_9 = Move(Geometry=list_item_16.Item, Motion=reverse)  # -> Geometry, Transform
move_10 = Move(Geometry=list_item_14.Item1, Motion=reverse_4)  # -> Geometry, Transform
move_11 = Move(Geometry=list_item_14.Item, Motion=multiplication_8)  # -> Geometry, Transform
move_12 = Move(Geometry=list_item_17.Item, Motion=multiplication_9)  # -> Geometry, Transform
move_13 = Move(Geometry=list_item_17.Item1, Motion=reverse_2)  # -> Geometry, Transform
move_14 = Move(Geometry=list_item_16.Item1, Motion=multiplication_6)  # -> Geometry, Transform
move_15 = Move(Geometry=list_item_12.Item, Motion=reverse_3)  # -> Geometry, Transform
pt3_7 = Point(list_item_21.Item1)
pt4_7 = Point(list_item_21.Item3)
pt4_8 = Point(list_item_22.Item3)
pt2_7 = Point(list_item_22.Item2)
pt2_8 = Point(list_item_21.Item2)
pt1_7 = Point(list_item_21.Item)
pt1_8 = Point(list_item_22.Item)
pt3_8 = Point(list_item_22.Item1)
reverse_5 = Reverse(Vector=multiplication_10)
reverse_6 = Reverse(Vector=multiplication_11)
reverse_7 = Reverse(Vector=multiplication_12)
reverse_8 = Reverse(Vector=multiplication_13)
move_16 = Move(Geometry=list_item_5.Item1, Motion=reverse_5)  # -> Geometry, Transform
move_17 = Move(Geometry=list_item_3.Item, Motion=multiplication_11)  # -> Geometry, Transform
move_18 = Move(Geometry=list_item_10.Item1, Motion=reverse_6)  # -> Geometry, Transform
move_19 = Move(Geometry=list_item_10.Item, Motion=reverse_7)  # -> Geometry, Transform
move_20 = Move(Geometry=list_item_6.Item, Motion=multiplication_10)  # -> Geometry, Transform
move_21 = Move(Geometry=list_item_6.Item1, Motion=reverse_8)  # -> Geometry, Transform
move_22 = Move(Geometry=list_item_3.Item1, Motion=multiplication_13)  # -> Geometry, Transform
move_23 = Move(Geometry=list_item_5.Item, Motion=multiplication_12)  # -> Geometry, Transform
pt3_9 = Point(list_item_19.Item2)
pt4_9 = Point(list_item_19.Item3)
pt2_9 = Point(list_item_19.Item1)
pt3_10 = Point(list_item_20.Item2)
pt4_10 = Point(list_item_20.Item3)
pt1_9 = Point(list_item_20.Item)
pt2_10 = Point(list_item_20.Item1)
pt1_10 = Point(list_item_19.Item)
merge_5 = Merge(
    Data1=move_14.Geometry,
    Data2=list_item_16.Item1,
    Data3=list_item_15.Item1,
    Data4=pt1_7,
    Data5=pt1_8,
    Data6=pt2_7,
    Data7=pt2_8,
    Data8=list_item_13.Item1,
    Data9=list_item_14.Item1,
    Data10=move_10.Geometry)
merge_6 = Merge(
    Data1=move_12.Geometry,
    Data2=list_item_17.Item,
    Data3=list_item_18.Item,
    Data4=pt3_7,
    Data5=pt3_8,
    Data6=pt4_8,
    Data7=pt4_7,
    Data8=list_item_11.Item,
    Data9=list_item_12.Item,
    Data10=move_15.Geometry)
merge_7 = Merge(
    Data1=move_11.Geometry,
    Data2=list_item_14.Item,
    Data3=list_item_13.Item,
    Data4=pt2_8,
    Data5=pt2_7,
    Data6=pt3_8,
    Data7=pt3_7,
    Data8=list_item_18.Item1,
    Data9=list_item_17.Item1,
    Data10=move_13.Geometry)
merge_8 = Merge(
    Data1=move_8.Geometry,
    Data2=list_item_12.Item1,
    Data3=list_item_11.Item1,
    Data4=pt4_7,
    Data5=pt4_8,
    Data6=pt1_8,
    Data7=pt1_7,
    Data8=list_item_15.Item,
    Data9=list_item_16.Item,
    Data10=move_9.Geometry)
partition_list = PartitionList(List=merge_7, Size="2")
partition_list_2 = PartitionList(List=merge_5, Size="2")
partition_list_3 = PartitionList(List=merge_8, Size="2")
partition_list_4 = PartitionList(List=merge_6, Size="2")
polyline = PolyLine(Vertices=partition_list_2, Closed=False)
polyline_2 = PolyLine(Vertices=partition_list, Closed=False)
polyline_3 = PolyLine(Vertices=partition_list_3, Closed=False)
polyline_4 = PolyLine(Vertices=partition_list_4, Closed=False)
merge_9 = Merge(
    Data1=move_20.Geometry,
    Data2=list_item_6.Item,
    Data3=list_item_9.Item,
    Data4=pt2_9,
    Data5=pt2_10,
    Data6=pt3_10,
    Data7=pt3_9,
    Data8=list_item_8.Item1,
    Data9=list_item_5.Item1,
    Data10=move_16.Geometry)
merge_10 = Merge(
    Data1=move_23.Geometry,
    Data2=list_item_5.Item,
    Data3=list_item_8.Item,
    Data4=pt3_9,
    Data5=pt3_10,
    Data6=pt4_10,
    Data7=pt4_9,
    Data8=list_item_7.Item,
    Data9=list_item_10.Item,
    Data10=move_19.Geometry)
merge_11 = Merge(
    Data1=move_18.Geometry,
    Data2=list_item_10.Item1,
    Data3=list_item_7.Item1,
    Data4=pt4_9,
    Data5=pt4_10,
    Data6=pt1_9,
    Data7=pt1_10,
    Data8=list_item_4.Item,
    Data9=list_item_3.Item,
    Data10=move_17.Geometry)
merge_12 = Merge(
    Data1=move_22.Geometry,
    Data2=list_item_3.Item1,
    Data3=list_item_4.Item1,
    Data4=pt1_10,
    Data5=pt1_9,
    Data6=pt2_10,
    Data7=pt2_9,
    Data8=list_item_9.Item1,
    Data9=list_item_6.Item1,
    Data10=move_21.Geometry)
distance_2 = Slider(0.16, range=0..2)
point_12 = Point(partition_list_2)
curve_5 = Curve(polyline)
point_13 = Point(partition_list)
point_14 = Point(partition_list_3)
curve_6 = Curve(polyline_2)
curve_7 = Curve(polyline_3)
point_15 = Point(partition_list_4)
curve_8 = Curve(polyline_4)
brep_10 = Brep(brep_9)
partition_list_5 = PartitionList(List=merge_9, Size="2")
partition_list_6 = PartitionList(List=merge_12, Size="2")
partition_list_7 = PartitionList(List=merge_10, Size="2")
distance_3 = Slider(0.51, range=0..2)
partition_list_8 = PartitionList(List=merge_11, Size="2")
curve_9 = Curve(curve_7)
curve_10 = Curve(curve_6)
point_16 = Point(point_12)
point_17 = Point(point_13)
point_18 = Point(point_14)
curve_11 = Curve(curve_8)
curve_12 = Curve(curve_5)
point_19 = Point(point_15)
brep_11 = Brep(brep_10)
polyline_5 = PolyLine(Vertices=partition_list_5, Closed=False)
polyline_6 = PolyLine(Vertices=partition_list_6, Closed=False)
polyline_7 = PolyLine(Vertices=partition_list_7, Closed=False)
polyline_8 = PolyLine(Vertices=partition_list_8, Closed=False)
curve_13 = Curve(polyline_5)
curve_14 = Curve(polyline_6)
cluster_17 = Cluster(list=point_17, brep=brep_11, curve=curve_10, B=distance_3)
cluster_18 = Cluster(list=point_19, brep=brep_11, curve=curve_11, B=distance_3)
point_20 = Point(partition_list_5)
curve_15 = Curve(polyline_7)
brep_12 = Brep(brep_8)
point_21 = Point(partition_list_6)
point_22 = Point(partition_list_7)
cluster_19 = Cluster(list=point_18, brep=brep_11, curve=curve_9, B=distance_3)
curve_16 = Curve(polyline_8)
point_23 = Point(partition_list_8)
cluster_20 = Cluster(list=point_16, brep=brep_11, curve=curve_12, B=distance_3)
curve_17 = Curve(curve_13)
point_24 = Point(point_20)
curve_18 = Curve(curve_14)
point_25 = Point(point_21)
curve_19 = Curve(curve_15)
point_26 = Point(point_22)
curve_20 = Curve(curve_16)
point_27 = Point(point_23)
val = Slider(1, range=0..2)
val_2 = Slider(2, range=0..2)
curve_21 = Curve(cluster_20)
curve_22 = Curve(cluster_19)
curve_23 = Curve(cluster_18)
curve_24 = Curve(cluster_17)
cluster_21 = Cluster(list=point_24, brep=brep_12, curve=curve_17, B=distance_2)
cluster_22 = Cluster(list=point_25, brep=brep_12, curve=curve_18, B=distance_2)
cluster_23 = Cluster(list=point_26, brep=brep_12, curve=curve_19, B=distance_2)
cluster_24 = Cluster(list=point_27, brep=brep_12, curve=curve_20, B=distance_2)
cluster_25 = Cluster_4(curve=curve_24, brep=brep_11, B=val_2, B_2=val)
cluster_26 = Cluster_4(curve=curve_23, brep=brep_11, B=val_2, B_2=val)
cluster_27 = Cluster_4(curve=curve_22, brep=brep_11, B=val_2, B_2=val)
val_3 = Slider(1, range=0..2)
val_4 = Slider(3, range=0..4)
cluster_28 = Cluster_4(curve=curve_21, brep=brep_11, B=val_2, B_2=val)
curve_25 = Curve(cluster_22)
curve_26 = Curve(cluster_21)
curve_27 = Curve(cluster_24)
curve_28 = Curve(cluster_23)
simple_mesh = SimpleMesh(Brep=cluster_25)
simple_mesh_2 = SimpleMesh(Brep=cluster_26)
simple_mesh_3 = SimpleMesh(Brep=cluster_27)
simple_mesh_4 = SimpleMesh(Brep=cluster_28)
merge_13 = Merge(Data1=simple_mesh_3, Data2=simple_mesh_4, Data3=simple_mesh_2, Data4=simple_mesh)  # -> flatten(Result)
cluster_29 = Cluster_4(curve=curve_26, brep=brep_12, B=val_4, B_2=val_3)
cluster_30 = Cluster_4(curve=curve_25, brep=brep_12, B=val_4, B_2=val_3)
cluster_31 = Cluster_4(curve=curve_28, brep=brep_12, B=val_4, B_2=val_3)
weaverbird_s_join_meshes_and_weld = WeaverbirdsJoinMeshesAndWeld(Mesh=merge_13, Weld=invert(False))
cluster_32 = Cluster_4(curve=curve_27, brep=brep_12, B=val_4, B_2=val_3)
simple_mesh_5 = SimpleMesh(Brep=cluster_29)
simple_mesh_6 = SimpleMesh(Brep=cluster_31)
simple_mesh_7 = SimpleMesh(Brep=cluster_30)
weaverbird_s_catmull_clark_subdivision = WeaverbirdsCatmullClarkSubdivision(MeshCurves=weaverbird_s_join_meshes_and_weld, Level=1, SmoothNakedEdges="1")
simple_mesh_8 = SimpleMesh(Brep=cluster_32)
weaverbird_s_mesh_thicken = WeaverbirdsMeshThicken(MeshCurves=weaverbird_s_catmull_clark_subdivision, Distance="-0.5", OffsetType=0)
merge_14 = Merge(Data1=simple_mesh_7, Data2=simple_mesh_8, Data3=simple_mesh_6, Data4=simple_mesh_5)  # -> flatten(Result)
weaverbird_s_join_meshes_and_weld_2 = WeaverbirdsJoinMeshesAndWeld(Mesh=merge_14, Weld=invert(False))
weaverbird_s_catmull_clark_subdivision_2 = WeaverbirdsCatmullClarkSubdivision(MeshCurves=weaverbird_s_join_meshes_and_weld_2, Level=1, SmoothNakedEdges="1")
weaverbird_s_mesh_thicken_2 = WeaverbirdsMeshThicken(MeshCurves=weaverbird_s_catmull_clark_subdivision_2, Distance="-0.5", OffsetType=0)
weaverbird_s_catmull_clark_subdivision_3 = WeaverbirdsCatmullClarkSubdivision(MeshCurves=weaverbird_s_mesh_thicken, Level=1, SmoothNakedEdges=1)
weaverbird_s_catmull_clark_subdivision_4 = WeaverbirdsCatmullClarkSubdivision(MeshCurves=weaverbird_s_mesh_thicken_2, Level=1, SmoothNakedEdges=1)
merge_15 = Merge(Data1=weaverbird_s_catmull_clark_subdivision_3, Data2=weaverbird_s_catmull_clark_subdivision_4)

# ==== cluster Cluster
curve = ClusterInput()
curve_2 = Curve(curve)
evaluate_curve = EvaluateCurve(Curve=reparameterize(curve_2), Parameter="0.5")  # -> Point, Tangent, Angle
brep = ClusterInput()
brep_closest_point = BrepClosestPoint(Point=evaluate_curve.Point, Brep=brep)  # -> Point, Normal, Distance
cross_product = CrossProduct(VectorA=brep_closest_point.Normal, VectorB=evaluate_curve.Tangent, Unitize=invert(False))  # -> Vector, Length
trim_tree = TrimTree(Tree=cross_product.Vector, Depth=1)
tree_statistics = TreeStatistics(Tree=trim_tree)  # -> Paths, Length, Count
series = Series(Start=0, Step=1, Count=tree_statistics.Length)
list_length = ListLength(List=series)
subtraction = Subtraction(A=list_length, B="1")
duplicate_data = DuplicateData(Data="1", Number=subtraction, Order=True)
division = Division(A=subtraction, B="2")
negative = Negative(Value="1")
insert_items = InsertItems(List=duplicate_data, Item=negative, Indices=division, Wrap=True)
B = ClusterInput()
multiplication = Multiplication(A=insert_items, B=B)  # -> graft(Result)
amplitude = Amplitude(Vector=cross_product.Vector, Amplitude=multiplication)
reverse = Reverse(Vector=amplitude)
move = Move(Geometry=evaluate_curve.Point, Motion=reverse)  # -> Geometry, Transform
list = ClusterInput()
insert_items_2 = InsertItems(List=list, Item=move.Geometry, Indices="1", Wrap=True)  # -> simplify(List)
trim_tree_2 = TrimTree(Tree=insert_items_2, Depth=1)
polyline = PolyLine(Vertices=trim_tree_2, Closed=False)
polyline_2 = ClusterOutput(polyline)

# ==== cluster Cluster_2
val = ClusterInput()
pt1 = ClusterInput()
brep = ClusterInput()
unit_z = UnitZ(Factor=1)
brep_closest_point = BrepClosestPoint(Point=pt1, Brep=brep)  # -> Point, Normal, Distance
negative = Negative(Value=val)
cross_product = CrossProduct(VectorA=brep_closest_point.Normal, VectorB=unit_z, Unitize=False)  # -> Vector, Length
merge = Merge(Data1=val, Data2=negative)
amplitude = Amplitude(Vector=cross_product.Vector, Amplitude=merge)
move = Move(Geometry=pt1, Motion=amplitude)  # -> Geometry, Transform
geometry = ClusterOutput(move.Geometry)

# ==== cluster Cluster_3
val = ClusterInput()
pt2 = ClusterInput()
brep = ClusterInput()
unit_z = UnitZ(Factor=1)
brep_closest_point = BrepClosestPoint(Point=pt2, Brep=brep)  # -> Point, Normal, Distance
negative = Negative(Value=val)
cross_product = CrossProduct(VectorA=brep_closest_point.Normal, VectorB=unit_z, Unitize=False)  # -> Vector, Length
merge = Merge(Data1=val, Data2=negative)
cross_product_2 = CrossProduct(VectorA=brep_closest_point.Normal, VectorB=cross_product.Vector, Unitize=False)  # -> Vector, Length
amplitude = Amplitude(Vector=cross_product_2.Vector, Amplitude=merge)
move = Move(Geometry=pt2, Motion=amplitude)  # -> Geometry, Transform
geometry = ClusterOutput(move.Geometry)

# ==== cluster Cluster_4
curve = ClusterInput()
explode = Explode(Curve=curve, Recursive=True)  # -> Segments, simplify(Vertices)
brep = ClusterInput()
brep_closest_point = BrepClosestPoint(Point=explode.Vertices, Brep=brep)  # -> Point, Normal, Distance
graft_tree = GraftTree(Tree=explode.Vertices, IncludeEmptyLists=True, IncludeNullItems=True)
average = Average(Input=brep_closest_point.Point)
average_2 = Average(Input=brep_closest_point.Normal)
relative_item = RelativeItem(Tree=graft_tree, Offset="{+0;+1}", WrapPaths=False, WrapItems=False)  # -> ItemA, ItemB
plane_normal = PlaneNormal(Origin=average, ZAxis=average_2)
delaunay_mesh = DelaunayMesh(Points=explode.Vertices, Plane=plane_normal)
line = Line(StartPoint=relative_item.ItemA, EndPoint=relative_item.ItemB)
line_2 = Line(StartPoint=relative_item.ItemB, EndPoint=relative_item.ItemA)
mesh_explode = MeshExplode(Mesh=delaunay_mesh, Interpolate=False)
trim_tree = TrimTree(Tree=line_2, Depth=1)
trim_tree_2 = TrimTree(Tree=line, Depth=1)
area = Area(Geometry=mesh_explode)  # -> Area, Centroid
shift_list = ShiftList(List=trim_tree, Shift=1, Wrap=invert(True))
sort_list = SortList(Keys=area.Area, ValuesValuesA=mesh_explode)  # -> Keys, reverse(ValuesValuesA)
shortest_list = ShortestList(ListListA=trim_tree_2, ListListB=shift_list, TrimMode=2)  # -> graft(ListListA), graft(ListListB)
panel = Panel("""0
-1""")
split_list = SplitList(List=sort_list.ValuesValuesA, Index="4")  # -> ListA, ListB
cull_index = CullIndex(List=explode.Vertices, Indices=panel, Wrap=True)
line_line = LineLine(LineA=shortest_list.ListListA, LineB=shortest_list.ListListB)
face_normals = FaceNormals(Mesh=split_list.ListA)  # -> Centers, simplify(Normals)
average_3 = Average(Input=area.Centroid)
deconstruct_plane = DeconstructPlane(Plane=line_line)  # -> Origin, XAxis, YAxis, ZAxis
graft_tree_2 = GraftTree(Tree=cull_index, IncludeEmptyLists=True, IncludeNullItems=True)
vector = Vector(shortest_list.ListListA)
vector_2 = Vector(shortest_list.ListListB)
trim_tree_3 = TrimTree(Tree=face_normals.Normals, Depth=1)
reverse = Reverse(Vector=vector)
reverse_2 = Reverse(Vector=vector_2)
construct_plane = ConstructPlane(Origin=graft_tree_2, XAxis=deconstruct_plane.XAxis, YAxis=deconstruct_plane.YAxis)
average_4 = Average(Input=trim_tree_3)
angle = Angle(VectorA=reverse, VectorB=reverse_2, Plane=construct_plane)  # -> Angle, Reflex
cross_product = CrossProduct(VectorA=reverse, VectorB=reverse_2, Unitize=False)  # -> Vector, Length
plane_normal_2 = PlaneNormal(Origin=average_3, ZAxis=average_4)  # -> simplify(Plane)
multiplication = Multiplication(A=angle.Angle, B=0.5)
rotate = Rotate(Vector=reverse, Axis=cross_product.Vector, Angle=multiplication)  # -> simplify(Vector)
vector_2pt = Vector2Pt(PointA=cull_index, PointB=average_3, Unitize=False)  # -> Vector, Length
list_length = ListLength(List=vector_2pt.Vector)
series = Series(Start=0, Step=1, Count=list_length)  # -> simplify(Series)
trim_tree_4 = TrimTree(Tree=rotate, Depth=1)
project = Project(Geometry=trim_tree_4, Plane=plane_normal_2)  # -> Geometry, Transform
bounds = Bounds(Numbers=series)
dot_product = DotProduct(VectorA=vector_2pt.Vector, VectorB=project.Geometry, Unitize=invert(False))
remap_numbers = RemapNumbers(Value=series, Source=bounds, Target=Domain(0, 1))  # -> simplify(Mapped), Clipped
graph_mapper = GraphMapper(
    remap_numbers.Mapped,
    x0=0,
    x1=1,
    y0=0,
    y1=1,
    container_name="Interpolated",
    pt=[Point(0, 0.5028403401, 0), Point(0.3011044264, 0.3010581136, 0), Point(0.5025764704, 1, 0), Point(0.7036941051, 0.308819294, 0), Point(1, 0.500900507, 0)])
graph_mapper_2 = GraphMapper(
    remap_numbers.Mapped,
    x0=0,
    x1=1,
    y0=0,
    y1=1,
    container_name="Sine",
    Equation_px=[0, 0.500913322],
    Equation_py=[0.05279272795, 1])
multiplication_2 = Multiplication(A=project.Geometry, B=dot_product)
B = ClusterInput()
B_2 = ClusterInput()
multiplication_3 = Multiplication(A=graph_mapper, B=B)
multiplication_4 = Multiplication(A=graph_mapper_2, B=B_2)
amplitude = Amplitude(Vector=multiplication_2, Amplitude=multiplication_3)
negative = Negative(Value=multiplication_4)
multiplication_5 = Multiplication(A=amplitude, B="0.5")
move = Move(Geometry=cull_index, Motion=amplitude)  # -> simplify(Geometry), Transform
move_2 = Move(Geometry=cull_index, Motion=multiplication_5)  # -> simplify(Geometry), Transform
amplitude_2 = Amplitude(Vector=average_4, Amplitude=negative)
list_item = ListItem(List=explode.Vertices, Index=0, Wrap=True)  # -> Item1, Item
move_3 = Move(Geometry=move_2.Geometry, Motion=amplitude_2)  # -> Geometry, Transform
merge = Merge(Data1=list_item.Item, Data2=move_3.Geometry, Data3=list_item.Item1)
merge_2 = Merge(Data1=list_item.Item, Data2=move.Geometry, Data3=list_item.Item1)
polyline = PolyLine(Vertices=merge_2, Closed=False)
polyline_2 = PolyLine(Vertices=merge, Closed=False)
explode_2 = Explode(Curve=polyline, Recursive=True)  # -> Segments, Vertices
explode_3 = Explode(Curve=polyline_2, Recursive=True)  # -> Segments, Vertices
curve_2 = Curve(explode.Segments)
graft_tree_3 = GraftTree(Tree=explode_2.Segments, IncludeEmptyLists=True, IncludeNullItems=True)
graft_tree_4 = GraftTree(Tree=curve_2, IncludeEmptyLists=True, IncludeNullItems=True)
graft_tree_5 = GraftTree(Tree=explode_3.Segments, IncludeEmptyLists=True, IncludeNullItems=True)
merge_3 = Merge(Data1=graft_tree_4, Data2=graft_tree_5, Data3=graft_tree_3)  # -> simplify(Result)
loft = Loft(Curves=merge_3, Options={Adjust=False, Closed=False, LoftEnds=0, LoftSimp=0, LoftType=3, Rebuild=10, Refit=0.01})
deconstruct_brep = DeconstructBrep(Brep=loft)  # -> Faces, Edges, Vertices
brep_2 = ClusterOutput(deconstruct_brep.Faces)
