# Grasshopper definition #57_chinese_texture3.gh (Grasshopper 1.0.7)
# plug-ins: Weaverbird, Kangaroo2 Components, NGon, Bifocals

yz = YZPlane(Origin=Point(0, 0, 0))
crv = Curve(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)
project = Project(Geometry=crv, Plane=yz)  # -> Geometry, Transform
subtraction = Subtraction(A="100", B="1")
divide = DivideCurve(Curve=crv, Count=subtraction, Kinks=False)  # -> Points, Tangents, Parameters
divide_2 = DivideCurve(Curve=project.Geometry, Count=subtraction, Kinks=False)  # -> Points, Tangents, Parameters
division = Division(A="200", B="100")
series = Series(Start=0, Step=division, Count="100")
dist = Distance(PointA=divide.Points, PointB=divide_2.Points)
cir = Circle(Plane=PlaneXY(0, 0, 0), Radius="45")
Z = UnitZ(Factor=series)
rev = ReverseList(List=dist)
dom = ConstructDomain(DomainStart=Slider(0.2, range=0..1), DomainEnd=Slider(0.76, range=0..2))
bnd = Bounds(Numbers=rev)
move = Move(Geometry=cir, Motion=Z)  # -> Geometry, Transform
area = Area(Geometry=move.Geometry)  # -> Area, Centroid
remap = RemapNumbers(Value=rev, Source=bnd, Target=dom)  # -> Mapped, Clipped
scale = Scale(Geometry=move.Geometry, Center=area.Centroid, Factor=remap.Mapped)  # -> Geometry, Transform
loft = Loft(Curves=scale.Geometry, Options={Adjust=False, Closed=False, LoftEnds=0, LoftSimp=0, LoftType=0, Rebuild=10, Refit=0.01})
brep = Brep(loft)
brep_2 = Brep(brep)
number_slider = Slider(0.65, range=0..1)
number_slider_2 = Slider(0.08, range=0..1)
dom_2 = ConstructDomain(DomainStart=number_slider_2, DomainEnd=number_slider)
dom_3 = ConstructDomain(DomainStart=Slider(0, range=0..1), DomainEnd=number_slider_2)
dom_4 = ConstructDomain(DomainStart=number_slider, DomainEnd=Slider(1, range=0..1))
dom² = ConstructDomain²(DomainU=dom_2, DomainV=Domain(0, 1))
merge = Merge(Data1=dom_4, Data2=dom_3)
subsrf = Isotrim(Surface=reparameterize(brep_2), Domain=dom²)
dom²_2 = ConstructDomain²(DomainU=merge, DomainV=Domain(0, 1))
sdivide = DivideSurface(Surface=subsrf, UCount="10", VCount="16")  # -> simplify(Points), Normals, Parameters
concat = Concatenate(FragmentA="{0,", FragmentB="10", FragmentA_2="}")
split = SplitTree(Data=sdivide.Points, Masks=flatten(concat))  # -> Positive, Negative
subsrf_2 = Isotrim(Surface=reparameterize(brep_2), Domain=dom²_2)
split_2 = SplitTree(Data=split.Negative, Masks=flatten("{0,2,...}"))  # -> Positive, Negative
dispatch = Dispatch(List=split_2.Negative, DispatchPattern=[True, False])  # -> ListA, ListB
dispatch_2 = Dispatch(List=split_2.Positive, DispatchPattern=[True, False])  # -> ListA, ListB
merge_2 = Merge(Data1=dispatch_2.ListB, Data2=dispatch.ListA)
brep_3 = Brep(subsrf)
brep_4 = Brep(brep_2)
pt = Point(merge_2)
pt_2 = Point(pt)
brep_5 = Brep(brep_3)
brep_6 = Brep(brep_4)
tstat = TreeStatistics(Tree=pt_2)  # -> Paths, Length, Count
series_2 = Series(Start=0, Step=1, Count=tstat.Count)
brep_cp = BrepClosestPoint(Point=pt_2, Brep=brep_5)  # -> Point, Normal, Distance
Z_2 = UnitZ(Factor=1)
bnd_2 = Bounds(Numbers=series_2)
xprod = CrossProduct(VectorA=Z_2, VectorB=brep_cp.Normal, Unitize=False)  # -> Vector, Length
xprod_2 = CrossProduct(VectorA=xprod.Vector, VectorB=brep_cp.Normal, Unitize=False)  # -> Vector, Length
remap_2 = RemapNumbers(Value=series_2, Source=bnd_2, Target=Domain(0, 1))  # -> Mapped, Clipped
graph = GraphMapper(
    remap_2.Mapped,
    x0=0,
    x1=1,
    y0=0,
    y1=1,
    container_name="Sine",
    Equation_px=[0.0009571019909, 0.685187757],
    Equation_py=[0.6793416739, 0.8225623965])
pl = ConstructPlane(Origin=brep_cp.Point, XAxis=xprod_2.Vector, YAxis=xprod.Vector)  # -> simplify(Plane)
dup = DuplicateData(Data=simplify(graft(graph)), Number=simplify(graft(tstat.Length)), Order=True)
multiplication = Multiplication(A="5.5", B=dup)
cir_2 = Circle(Plane=pl, Radius=multiplication)
cut_hold = CutHold(C_2=pl, C=cir_2)  # -> R, C_3
brep_7 = Brep(brep_5)
pull = PullCurve(Curve=cut_hold.R, Surface=brep_7)  # -> simplify(flatten(Curve))
pull_2 = PullCurve(Curve=cut_hold.C_3, Surface=brep_7)  # -> simplify(flatten(Curve))
brep_8 = Brep(brep_7)
crv_2 = Curve(pull_2)
crv_3 = Curve(pull)
pt_3 = Point(pt_2)
brep_9 = Brep(brep_6)
crv_4 = Curve(crv_2)
brep_10 = Brep(brep_9)
crv_5 = Curve(crv_3)
pt_4 = Point(pt_3)
brep_11 = Brep(brep_8)

# ----
# chain
panel = Panel("{1,3,...}")
split_3 = SplitTree(Data=pt_4, Masks=flatten(panel))  # -> Positive, Negative
graft = GraftTree(Tree=split_3.Positive, IncludeEmptyLists=True, IncludeNullItems=True)
graft_2 = GraftTree(Tree=split_3.Negative, IncludeEmptyLists=True, IncludeNullItems=True)
radius = Panel("""0.55
0.65
0.55""")
thickness_set1 = Panel("""0.25
-0.25""")
thickness_set2 = Panel("""-0.25
0.25""")
height2 = Panel("0.3")
height1 = Panel("-0.3")
relitem2 = RelativeItems(TreeA=graft_2, TreeB=graft, Offset="{+1;+0}", WrapPaths=False, WrapItems=False)  # -> ItemA, ItemB
relitem2_2 = RelativeItems(TreeA=graft, TreeB=graft_2, Offset="{+1;-1}", WrapPaths=False, WrapItems=False)  # -> ItemA, ItemB
relitem2_3 = RelativeItems(TreeA=graft_2, TreeB=graft, Offset="{+1;+1}", WrapPaths=False, WrapItems=False)  # -> ItemA, ItemB
relitem2_4 = RelativeItems(TreeA=graft, TreeB=graft_2, Offset="{+1;+0}", WrapPaths=False, WrapItems=False)  # -> ItemA, ItemB
brep_12 = Brep(brep_11)
ln = Line(StartPoint=relitem2.ItemA, EndPoint=relitem2.ItemB)
ln_2 = Line(StartPoint=relitem2_2.ItemA, EndPoint=relitem2_2.ItemB)
ln_3 = Line(StartPoint=relitem2_3.ItemA, EndPoint=relitem2_3.ItemB)
ln_4 = Line(StartPoint=relitem2_4.ItemA, EndPoint=relitem2_4.ItemB)
chain_2 = Chain2(relay=ln, relay_3=height2, brep=brep_12, relay_2=thickness_set2, R=radius)
chain_2_2 = Chain2(relay=ln_2, relay_3=height2, brep=brep_12, relay_2=thickness_set2, R=radius)
chain_1 = Chain1(relay=ln_3, brep=brep_12, relay_2=thickness_set1, R=radius, data=height1)
chain_1_2 = Chain1(relay=ln_4, brep=brep_12, relay_2=thickness_set1, R=radius, data=height1)
brep_13 = Brep(chain_1)
brep_14 = Brep(chain_1_2)
brep_15 = Brep(chain_2_2)
brep_16 = Brep(chain_2)
merge_3 = Merge(Data1=brep_14, Data2=brep_13, Data3=brep_15, Data4=brep_16)

# ----
# weave
panel_2 = Panel("{1,3,...}")
split_4 = SplitTree(Data=pt_4, Masks=flatten(panel_2))  # -> Positive, Negative
graft_3 = GraftTree(Tree=split_3.Negative, IncludeEmptyLists=True, IncludeNullItems=True)
graft_4 = GraftTree(Tree=split_4.Negative, IncludeEmptyLists=True, IncludeNullItems=True)
brep_17 = Brep(brep_10)
weave2 = Weave2(
    A="0.5",
    brep=brep_17,
    D="0.2",
    T=graft_3,
    sub_segment1=Slider(0.88, range=0..1),
    relay="2.3",
    sub_segment2=Slider(0.9, range=0..1))
weave1 = Weave1(
    A="0.5",
    relay="2.3",
    B=brep_17,
    relay_4="0.2",
    T=graft_4,
    relay_2=Slider(0.88, range=0..1),
    relay_3=Slider(0.9, range=0..1))
mesh = Mesh(weave2)
mesh_2 = Mesh(weave1)

# ----
# flower
graft_5 = GraftTree(Tree=crv_5, IncludeEmptyLists=True, IncludeNullItems=True)  # -> simplify(Tree)
ccx = CurveCurve(CurveA=graft_5, CurveB=crv_5)  # -> Points, ParamsA, ParamsB
tstat_2 = TreeStatistics(Tree=ccx.Points)  # -> Paths, Length, Count
brep_18 = Brep(brep_11)
equals = Equality(FirstNumber=tstat_2.Length, SecondNumber="1")  # -> Equality, Inequality
dispatch_3 = Dispatch(List=tstat_2.Paths, DispatchPattern=equals.Equality)  # -> ListA, ListB
branch = TreeBranch(Tree=ccx.Points, Path=dispatch_3.ListA, MaintainPaths=True)  # -> simplify(Branch)
flatten = FlattenTree(Tree=branch, Path="{0}")
duppt = RemoveDuplicatePts(Points=flatten, Tolerance=0.01)
Z_3 = UnitZ(Factor=1)
brep_cp_2 = BrepClosestPoint(Point=duppt, Brep=brep_18)  # -> Point, Normal, Distance
xprod_3 = CrossProduct(VectorA=Z_3, VectorB=brep_cp_2.Normal, Unitize=False)  # -> Vector, Length
xprod_4 = CrossProduct(VectorA=xprod_3.Vector, VectorB=brep_cp_2.Normal, Unitize=False)  # -> Vector, Length
pl_2 = ConstructPlane(Origin=brep_cp_2.Point, XAxis=xprod_4.Vector, YAxis=xprod_3.Vector)  # -> simplify(Plane)
brep_19 = Brep(brep_18)
pln = Plane(pl_2)
vec = Vector(brep_cp_2.Normal)
vec_2 = Vector(vec)
brep_20 = Brep(brep_19)
pln_2 = Plane(pln)
cir_3 = Circle(Plane=pln_2, Radius="3")
cir_4 = Circle(Plane=pln_2, Radius="4.5")
cp = ControlPoints(Curve=cir_3)  # -> Points, Weights, Knots
cp_2 = ControlPoints(Curve=cir_4)  # -> Points, Weights, Knots
dispatch_4 = Dispatch(List=cp.Points, DispatchPattern=[True, False])  # -> ListA, ListB
dispatch_5 = Dispatch(List=cp_2.Points, DispatchPattern=[True, False])  # -> ListA, ListB
duppt_2 = RemoveDuplicatePts(Points=dispatch_4.ListA, Tolerance=0.01)
shift = ShiftList(List=dispatch_5.ListB, Shift="3", Wrap=True)  # -> simplify(graft(List))
dup_2 = DuplicateData(Data=duppt_2, Number=2, Order=invert(True))  # -> simplify(Data)
rev_2 = Reverse(Vector=vec_2)
brep_cp_3 = BrepClosestPoint(Point=shift, Brep=brep_20)  # -> Point, Normal, Distance
amp = Amplitude(Vector=rev_2, Amplitude="1")
shift_2 = ShiftList(List=dup_2, Shift="-1", Wrap=True)
move_2 = Move(Geometry=shift_2, Motion=graft(amp))  # -> Geometry, Transform
partition = PartitionList(List=move_2.Geometry, Size="2")
avr = Average(Input=partition)
scale_2 = Scale(Geometry=partition, Center=avr, Factor="0.35")  # -> Geometry, Transform
brep_cp_4 = BrepClosestPoint(Point=scale_2.Geometry, Brep=brep_20)  # -> Point, Normal, Distance
vec2pt = Vector2Pt(PointA=scale_2.Geometry, PointB=brep_cp_4.Point, Unitize=False)  # -> Vector, Length
pt_5 = Point(partition)
pt_6 = Point(scale_2.Geometry)
vec_3 = Vector(vec2pt.Vector)
pln_3 = Plane(pln_2)
pt_7 = Point(brep_cp_3.Point)
pt_8 = Point(pt_6)
pt_9 = Point(pt_5)
vec_4 = Vector(vec_3)
pln_4 = Plane(pln_3)
pt_10 = Point(pt_7)
item = ListItem(List=pt_9, Index=0, Wrap=True)  # -> simplify(Item), simplify(Item1)
multiplication_2 = Multiplication(A=vec_4, B="0.5")
deplane = DeconstructPlane(Plane=pln_4)  # -> Origin, XAxis, YAxis, ZAxis
move_3 = Move(Geometry=pt_8, Motion=multiplication_2)  # -> Geometry, Transform
dup_3 = DuplicateData(Data=graft(pln_4), Number="4", Order=True)  # -> simplify(graft(Data))
item_2 = ListItem(List=move_3.Geometry, Index=0, Wrap=True)  # -> simplify(Item), simplify(Item1)
msphere = MeshSphere(Base=pln_4, Radius="0.85", UCount=10, VCount=20)
pt_11 = Point(dup_3)
merge_4 = Merge(Data1=item_2.Item, Data2=pt_11, Data3=item_2.Item1, Data4=pt_10)
merge_5 = Merge(Data1=item.Item, Data2=pt_11, Data3=item.Item1)
nurbs = NurbsCurve(Vertices=merge_5, Degree=2, Periodic=False)  # -> Curve, Length, Domain
trim = TrimTree(Tree=merge_5, Depth=1)
del = DelaunayMesh(Points=merge_4, Plane=dup_3)  # -> flatten(Mesh)
trim_2 = TrimTree(Tree=nurbs.Curve, Depth=1)
duppt_3 = RemoveDuplicatePts(Points=trim, Tolerance=0.01)
wbcatmullclark = WeaverbirdsCatmullClarkSubdivision(MeshCurves=del, Level=1, SmoothNakedEdges=1)
amp_2 = Amplitude(Vector=deplane.ZAxis, Amplitude=1)
avr_2 = Average(Input=duppt_3)
patch = Patch(Curves=trim_2, Points=avr_2, Spans=20, Flexibility=1, Trim=True)  # -> flatten(Patch)
area_2 = Area(Geometry=patch)  # -> Area, Centroid
item_3 = ListItem(List=patch, Index=0, Wrap=True)
avr_3 = Average(Input=area_2.Centroid)
flip = Flip(Surface=patch, Guide=item_3)  # -> Surface, Result
pt_12 = Point(avr_3)
srf = Surface(flip.Surface)
vec_5 = Vector(amp_2)
mesh_3 = Mesh(msphere)
mesh_4 = Mesh(wbcatmullclark)
pt_13 = Point(pt_12)
srf_2 = Surface(srf)
vec_6 = Vector(vec_5)
mesh_5 = Mesh(mesh_3)
mesh_6 = Mesh(mesh_4)
mesh_7 = MeshBrep(
    Brep=srf_2,
    Settings={GridMaxCount=0, GridMinCount=16, JaggedSeams=False, MaxEdgeLength=0, MinEdgeLength=0.0001, MinTolerance=0, Refine=True, RefineAngle=0, RelativeTolerance=0.65, SimplePlanes=True, Tolerance=0})
move_4 = Move(Geometry=mesh_7, Motion=vec_6)  # -> Geometry, Transform
facen = FaceNormals(Mesh=move_4.Geometry)  # -> Centers, Normals
vec2pt_2 = Vector2Pt(PointA=pt_13, PointB=facen.Centers, Unitize=False)  # -> Vector, Length
avr_4 = Average(Input=facen.Normals)
avr_5 = Average(Input=vec2pt_2.Vector)
dprod = DotProduct(VectorA=avr_5, VectorB=avr_4, Unitize=False)
wbthicken = WeaverbirdsMeshThicken(MeshCurves=mesh_6, Distance="0.75", OffsetType=0)
smaller = SmallerThan(FirstNumber=dprod, SecondNumber="0")  # -> flatten(SmallerThan), OrEqualTo
wbcatmullclark_2 = WeaverbirdsCatmullClarkSubdivision(MeshCurves=wbthicken, Level=1, SmoothNakedEdges=1)
flipm = FlipMesh(
    Mesh=move_4.Geometry,
    VertexNormals=smaller.SmallerThan,
    FaceNormals=smaller.SmallerThan,
    FaceOrientation=smaller.SmallerThan)
offsetmesh = OffsetMesh(Mesh=flipm, Dist="-0.8", Solid=invert(False))
merge_6 = Merge(Data1=offsetmesh, Data2=wbcatmullclark_2, Data3=mesh_5)

# ----
# body
flatten_2 = FlattenTree(Tree=crv_4, Path="{0}")
srfsplit = SurfaceSplit(Surface=brep_11, Curves=flatten_2)
area_3 = Area(Geometry=srfsplit)  # -> Area, Centroid
sort = SortList(Keys=area_3.Area, ValuesA=srfsplit)  # -> Keys, reverse(ValuesA)
item_4 = ListItem(List=sort.ValuesA, Index=0, Wrap=True)
srfsplit_2 = SurfaceSplit(Surface=item_4, Curves=crv_5)
join = BrepJoin(Breps=srfsplit_2)  # -> Breps, Closed
custom_mesh_settings = SettingsCustom(
    StitchSeams=True,
    SimplePlanes=False,
    Refine=True,
    MinCount=16,
    MaxCount=400,
    AspectRatio=20,
    MaxDistance="0.25",
    MaxAngle=20,
    MinEdge=0,
    MaxEdge="1.5")
mesh_8 = MeshBrep(Brep=join.Breps, Settings=custom_mesh_settings)
brep_21 = Brep(brep_11)
mesh_9 = Mesh(mesh_8)
brep_22 = Brep(brep_21)
mesh_10 = Mesh(mesh_9)
nv = NakedVertices(Mesh=mesh_10)  # -> ClothedIndex, NakedIndex, ClothedPts, NakedPts
wbjoin = WeaverbirdsJoinMeshesAndWeld(Mesh=mesh_10, Weld=invert(False))
medges = MeshEdges(Mesh=wbjoin)  # -> NakedEdges, InteriorEdges, NonManifoldEdges
duppt_4 = RemoveDuplicatePts(Points=nv.NakedPts, Tolerance=0.01)
join_2 = JoinCurves(Curves=medges.NakedEdges, Preserve=False)
len = Length(Curve=join_2)
edgelengths = EdgeLengths(Mesh=wbjoin, LengthFactor="0.5", Strength=1)
anchor = Anchor(Point=duppt_4, Strength=10000)
smooth = Smooth(M=wbjoin, Strength="10")
pressure = Pressure(M=wbjoin, Strength="0.2")
show = Show(G=wbjoin)
sort_2 = SortList(Keys=len, ValuesA=join_2)  # -> Keys, reverse(ValuesA)
panel_3 = Panel("""0
1""")
cull_i = CullIndex(List=sort_2.ValuesA, Indices=panel_3, Wrap=True)
entwine = Entwine(Branch00=show, Branch01=anchor, Branch02=edgelengths, Branch03=pressure, Branch04=smooth, FlattenInputs=True)
explode = Explode(Curve=cull_i, Recursive=True)  # -> Segments, Vertices
bouncysolver = BouncySolver(GoalObjects=entwine, Reset=Button(), Threshold=1e-15, Tolerance=0.0001, Damping=0.99, Iterations=10, On=Toggle(False))  # -> I, V, O
duppt_5 = RemoveDuplicatePts(Points=explode.Vertices, Tolerance=0.01)
avr_6 = Average(Input=duppt_5)
item_5 = ListItem(List=bouncysolver.O, Index=0, Wrap=True)
scale_3 = Scale(Geometry=graft(cull_i), Center=avr_6, Factor="0.9")  # -> simplify(Geometry), Transform
scale_4 = Scale(Geometry=graft(cull_i), Center=avr_6, Factor="0.8")  # -> simplify(Geometry), Transform
brep_cp_5 = BrepClosestPoint(Point=avr_6, Brep=brep_22)  # -> Point, Normal, Distance
crv_6 = Curve(graft(cull_i))
crv_7 = Curve(scale_3.Geometry)
vec_7 = Vector(brep_cp_5.Normal)
crv_8 = Curve(scale_4.Geometry)
mesh_11 = Mesh(item_5)
crv_9 = Curve(graft(crv_6))
mesh_12 = Mesh(mesh_11)
crv_10 = Curve(crv_7)
vec_8 = Vector(vec_7)
crv_11 = Curve(crv_8)
rev_3 = Reverse(Vector=vec_8)
rev_4 = Reverse(Vector=vec_8)
amp_3 = Amplitude(Vector=rev_4, Amplitude="0.15")
amp_4 = Amplitude(Vector=rev_3, Amplitude="0.3")
extr = Extrude(Base=crv_9, Direction=amp_3)
extr_2 = Extrude(Base=crv_11, Direction=amp_4)
move_5 = Move(Geometry=crv_11, Motion=amp_4)  # -> simplify(Geometry), Transform
move_6 = Move(Geometry=crv_10, Motion=amp_4)  # -> simplify(Geometry), Transform
move_7 = Move(Geometry=crv_9, Motion=amp_3)  # -> simplify(Geometry), Transform
move_8 = Move(Geometry=crv_10, Motion=amp_3)  # -> simplify(Geometry), Transform
loft_2 = Loft(
    Curves=[move_6.Geometry, move_5.Geometry],
    Options={Adjust=False, Closed=False, LoftEnds=0, LoftSimp=0, LoftType=0, Rebuild=10, Refit=0.01})
loft_3 = Loft(
    Curves=[move_8.Geometry, move_7.Geometry],
    Options={Adjust=False, Closed=False, LoftEnds=0, LoftSimp=0, LoftType=0, Rebuild=10, Refit=0.01})
loft_4 = Loft(
    Curves=[move_8.Geometry, move_6.Geometry],
    Options={Adjust=False, Closed=False, LoftEnds=0, LoftSimp=0, LoftType=0, Rebuild=10, Refit=0.01})
merge_7 = Merge(Data1=extr, Data2=loft_3, Data3=loft_4, Data4=loft_2, Data5=extr_2)
debrep = DeconstructBrep(Brep=merge_7)  # -> Faces, Edges, Vertices
smesh = SimpleMesh(Brep=debrep.Faces)
wbjoin_2 = WeaverbirdsJoinMeshesAndWeld(Mesh=smesh, Weld=invert(False))
merge_8 = Merge(Data1=mesh_12, Data2=wbjoin_2)  # -> flatten(Result)
wbjoin_3 = WeaverbirdsJoinMeshesAndWeld(Mesh=merge_8, Weld=invert(False))

# ==== cluster CutHold
C = ClusterInput()
cp = ControlPoints(Curve=C)  # -> Points, Weights, Knots
C_2 = ClusterInput()
dispatch = Dispatch(List=cp.Points, DispatchPattern=[True, False])  # -> ListA, ListB
scale = Scale(Geometry=dispatch.ListA, Center=graft(C_2), Factor="0.8")  # -> simplify(Geometry), Transform
duppt = RemoveDuplicatePts(Points=scale.Geometry, Tolerance=0.01)  # -> simplify(UniquePoints)
pt = Point(duppt)
dup = DuplicateData(Data=duppt, Number=2, Order=invert(True))
shift = ShiftList(List=dup, Shift=1, Wrap=True)
graft = GraftTree(Tree=pt, IncludeEmptyLists=True, IncludeNullItems=True)
partition = PartitionList(List=shift, Size="2")  # -> simplify(Chunks)
split = SplitTree(Data=graft, Masks=flatten("{*;*;0,2,...}"))  # -> Positive, Negative
point = Point(split.Negative)
graft_2 = GraftTree(Tree=dispatch.ListB, IncludeEmptyLists=True, IncludeNullItems=True)  # -> simplify(Tree)
item = ListItem(List=partition, Index=0, Wrap=True)  # -> Item, Item1
split_2 = SplitTree(Data=split.Negative, Masks=flatten("{0,2,...;*;*}"))  # -> Positive, Negative
arc = Arc3Pt(PointA=item.Item, PointB=graft_2, PointC=item.Item1)  # -> Arc, Plane, Radius
trim = TrimTree(Tree=arc.Arc, Depth=1)
relitem = RelativeItem(Tree=split.Positive, Offset="{+2;+0;-2}", WrapPaths=False, WrapItems=False)  # -> ItemA, ItemB
relitem_2 = RelativeItem(Tree=split_2.Negative, Offset="{+0;-1;+2}", WrapPaths=invert(False), WrapItems=False)  # -> ItemA, ItemB
relitem_3 = RelativeItem(Tree=split_2.Positive, Offset="{+0;-1;+2}", WrapPaths=False, WrapItems=False)  # -> ItemA, ItemB
join = JoinCurves(Curves=trim, Preserve=False)  # -> simplify(Curves)
ln = Line(StartPoint=relitem.ItemA, EndPoint=relitem.ItemB)
ln_2 = Line(StartPoint=relitem_3.ItemA, EndPoint=relitem_3.ItemB)
ln_3 = Line(StartPoint=relitem_2.ItemA, EndPoint=relitem_2.ItemB)
C_3 = ClusterOutput(join)
merge = Merge(Data1=ln, Data2=ln_2, Data3=ln_3)
R = ClusterOutput(merge)

# ==== cluster Chain2
relay = ClusterInput()
brep = ClusterInput()
brep_2 = Brep(brep)
midpt = CurveMiddle(Curve=relay)
brep_cp = BrepClosestPoint(Point=midpt, Brep=brep_2)  # -> Point, Normal, Distance
rev = Reverse(Vector=brep_cp.Normal)
relay_2 = ClusterInput()
amp = Amplitude(Vector=rev, Amplitude="1.2")
brep_3 = Brep(brep_2)
move = Move(Geometry=midpt, Motion=amp)  # -> Geometry, Transform
end = EndPoints(Curve=relay)  # -> Start, End
merge = Merge(Data1=end.Start, Data2=move.Geometry, Data3=end.End)
intcrv = Interpolate(Vertices=merge, Degree=3, Periodic=False, KnotStyle=1)  # -> Curve, Length, Domain
eval = EvaluateCurve(Curve=reparameterize(intcrv.Curve), Parameter="0.5")  # -> Point, Tangent, Angle
neg = Negative(Value=relay_2)
xprod = CrossProduct(VectorA=brep_cp.Normal, VectorB=eval.Tangent, Unitize=False)  # -> Vector, Length
number_slider = Slider(0.7, range=0..1)
amp_2 = Amplitude(Vector=xprod.Vector, Amplitude=neg)
move_2 = Move(Geometry=intcrv.Curve, Motion=amp_2)  # -> Geometry, Transform
subtraction = Subtraction(A="1", B=number_slider)
dom = ConstructDomain(DomainStart=subtraction, DomainEnd=number_slider)
dom_2 = ConstructDomain(DomainStart=number_slider, DomainEnd=1)
dom_3 = ConstructDomain(DomainStart=0, DomainEnd=subtraction)
subcrv = SubCurve(BaseCurve=reparameterize(move_2.Geometry), Domain=dom)
subcrv_2 = SubCurve(BaseCurve=reparameterize(move_2.Geometry), Domain=dom_2)
subcrv_3 = SubCurve(BaseCurve=reparameterize(move_2.Geometry), Domain=dom_3)
item = ListItem(List=subcrv, Index=0, Wrap=True)  # -> Item, Item1
merge_2 = Merge(Data1=subcrv_2, Data2=subcrv_3)
divide = DivideCurve(Curve=item.Item, Count="6", Kinks=False)  # -> Points, Tangents, Parameters
divide_2 = DivideCurve(Curve=item.Item1, Count="6", Kinks=False)  # -> Points, Tangents, Parameters
panel = Panel("""0
0.75
0.25
0.75
0.25
0.75
0""")
amp_3 = Amplitude(Vector=xprod.Vector, Amplitude=panel)
rev_2 = Reverse(Vector=amp_3)
move_3 = Move(Geometry=divide.Points, Motion=amp_3)  # -> Geometry, Transform
move_4 = Move(Geometry=divide_2.Points, Motion=rev_2)  # -> Geometry, Transform
intcrv_2 = Interpolate(Vertices=move_3.Geometry, Degree=3, Periodic=False, KnotStyle=1)  # -> Curve, Length, Domain
intcrv_3 = Interpolate(Vertices=move_4.Geometry, Degree=3, Periodic=False, KnotStyle=1)  # -> Curve, Length, Domain
merge_3 = Merge(Data1=simplify(intcrv_2.Curve), Data2=simplify(intcrv_3.Curve), Data3=simplify(merge_2))
join = JoinCurves(Curves=merge_3, Preserve=False)
divide_3 = DivideCurve(Curve=join, Count="50", Kinks=False)  # -> Points, Tangents, Parameters
intcrv_4 = Interpolate(Vertices=divide_3.Points, Degree=3, Periodic=False, KnotStyle=1)  # -> Curve, Length, Domain
graft = GraftTree(Tree=divide.Points, IncludeEmptyLists=True, IncludeNullItems=True)
graft_2 = GraftTree(Tree=divide_2.Points, IncludeEmptyLists=True, IncludeNullItems=True)
trim = TrimTree(Tree=intcrv_4.Curve, Depth=1)
avr = Average(Input=[graft, graft_2])
trim_2 = TrimTree(Tree=avr, Depth=1)
midpt_2 = CurveMiddle(Curve=trim)
dispatch = Dispatch(List=trim_2, DispatchPattern=[True, False])  # -> ListA, ListB
pdecon = Deconstruct(Point=midpt_2)  # -> XComponent, YComponent, ZComponent
brep_cp_2 = BrepClosestPoint(Point=dispatch.ListB, Brep=brep_3)  # -> Point, Normal, Distance
sort = SortList(Keys=pdecon.ZComponent, ValuesA=trim)  # -> Keys, ValuesA
amp_4 = Amplitude(Vector=xprod.Vector, Amplitude=relay_2)
relay_3 = ClusterInput()
pl = PlaneNormal(Origin=dispatch.ListB, ZAxis=brep_cp_2.Normal)
R = ClusterInput()
move_5 = Move(Geometry=sort.ValuesA, Motion=amp_4)  # -> Geometry, Transform
cir = Circle(Plane=pl, Radius=R)
loft = Loft(Curves=sort.ValuesA, Options={Adjust=False, Closed=False, LoftEnds=0, LoftSimp=0, LoftType=0, Rebuild=10, Refit=0.01})
loft_2 = Loft(Curves=move_5.Geometry, Options={Adjust=False, Closed=False, LoftEnds=0, LoftSimp=0, LoftType=0, Rebuild=10, Refit=0.01})
boundary = BoundarySurfaces(Edges=cir)
multiplication = Multiplication(A=relay_3, B="0.5")
neg_2 = Negative(Value="5")
offsrf = OffsetSurface(Surface=boundary, Distance="5", BothSides=neg_2, CreateSolid=True)
offsrf_2 = OffsetSurface(Surface=loft, Distance=relay_3, BothSides=0, CreateSolid=True)
offsrf_3 = OffsetSurface(Surface=loft_2, Distance=multiplication, BothSides=0, CreateSolid=True)
trim_3 = TrimTree(Tree=offsrf, Depth=1)  # -> simplify(Tree)
sunion = SolidUnion(Breps=[offsrf_2, offsrf_3])
sdiff = SolidDifference(BrepsA=sunion, BrepsB=trim_3)
R_2 = ClusterOutput(sdiff)

# ==== cluster Chain1
relay = ClusterInput()
data = ClusterInput()
brep = ClusterInput()
data_2 = Data(data)
brep_2 = Brep(brep)
midpt = CurveMiddle(Curve=relay)
brep_cp = BrepClosestPoint(Point=midpt, Brep=brep_2)  # -> Point, Normal, Distance
rev = Reverse(Vector=brep_cp.Normal)
relay_2 = ClusterInput()
amp = Amplitude(Vector=rev, Amplitude="1.2")
brep_3 = Brep(brep_2)
move = Move(Geometry=midpt, Motion=amp)  # -> Geometry, Transform
end = EndPoints(Curve=relay)  # -> Start, End
merge = Merge(Data1=end.Start, Data2=move.Geometry, Data3=end.End)
intcrv = Interpolate(Vertices=merge, Degree=3, Periodic=False, KnotStyle=1)  # -> Curve, Length, Domain
eval = EvaluateCurve(Curve=reparameterize(intcrv.Curve), Parameter="0.5")  # -> Point, Tangent, Angle
xprod = CrossProduct(VectorA=brep_cp.Normal, VectorB=eval.Tangent, Unitize=False)  # -> Vector, Length
number_slider = Slider(0.7, range=0..1)
amp_2 = Amplitude(Vector=xprod.Vector, Amplitude=relay_2)
move_2 = Move(Geometry=intcrv.Curve, Motion=amp_2)  # -> Geometry, Transform
subtraction = Subtraction(A="1", B=number_slider)
dom = ConstructDomain(DomainStart=subtraction, DomainEnd=number_slider)
dom_2 = ConstructDomain(DomainStart=number_slider, DomainEnd=1)
dom_3 = ConstructDomain(DomainStart=0, DomainEnd=subtraction)
subcrv = SubCurve(BaseCurve=reparameterize(move_2.Geometry), Domain=dom)
subcrv_2 = SubCurve(BaseCurve=reparameterize(move_2.Geometry), Domain=dom_2)
subcrv_3 = SubCurve(BaseCurve=reparameterize(move_2.Geometry), Domain=dom_3)
item = ListItem(List=subcrv, Index=0, Wrap=True)  # -> Item, Item1
merge_2 = Merge(Data1=subcrv_2, Data2=subcrv_3)
divide = DivideCurve(Curve=item.Item, Count="6", Kinks=False)  # -> Points, Tangents, Parameters
divide_2 = DivideCurve(Curve=item.Item1, Count="6", Kinks=False)  # -> Points, Tangents, Parameters
panel = Panel("""0
0.75
0.25
0.75
0.25
0.75
0""")
amp_3 = Amplitude(Vector=xprod.Vector, Amplitude=panel)
rev_2 = Reverse(Vector=amp_3)
move_3 = Move(Geometry=divide.Points, Motion=amp_3)  # -> Geometry, Transform
move_4 = Move(Geometry=divide_2.Points, Motion=rev_2)  # -> Geometry, Transform
intcrv_2 = Interpolate(Vertices=move_3.Geometry, Degree=3, Periodic=False, KnotStyle=1)  # -> Curve, Length, Domain
intcrv_3 = Interpolate(Vertices=move_4.Geometry, Degree=3, Periodic=False, KnotStyle=1)  # -> Curve, Length, Domain
merge_3 = Merge(Data1=simplify(intcrv_2.Curve), Data2=simplify(intcrv_3.Curve), Data3=simplify(merge_2))
join = JoinCurves(Curves=merge_3, Preserve=False)
divide_3 = DivideCurve(Curve=join, Count="50", Kinks=False)  # -> Points, Tangents, Parameters
intcrv_4 = Interpolate(Vertices=divide_3.Points, Degree=3, Periodic=False, KnotStyle=1)  # -> Curve, Length, Domain
graft = GraftTree(Tree=divide.Points, IncludeEmptyLists=True, IncludeNullItems=True)
graft_2 = GraftTree(Tree=divide_2.Points, IncludeEmptyLists=True, IncludeNullItems=True)
trim = TrimTree(Tree=intcrv_4.Curve, Depth=1)
avr = Average(Input=[graft, graft_2])
trim_2 = TrimTree(Tree=avr, Depth=1)
midpt_2 = CurveMiddle(Curve=trim)
dispatch = Dispatch(List=trim_2, DispatchPattern=[True, False])  # -> ListA, ListB
pdecon = Deconstruct(Point=midpt_2)  # -> XComponent, YComponent, ZComponent
brep_cp_2 = BrepClosestPoint(Point=dispatch.ListB, Brep=brep_3)  # -> Point, Normal, Distance
sort = SortList(Keys=pdecon.ZComponent, ValuesA=trim)  # -> Keys, ValuesA
amp_4 = Amplitude(Vector=xprod.Vector, Amplitude=relay_2)
pl = PlaneNormal(Origin=dispatch.ListB, ZAxis=brep_cp_2.Normal)
R = ClusterInput()
cir = Circle(Plane=pl, Radius=R)
move_5 = Move(Geometry=sort.ValuesA, Motion=amp_4)  # -> Geometry, Transform
loft = Loft(Curves=sort.ValuesA, Options={Adjust=False, Closed=False, LoftEnds=0, LoftSimp=0, LoftType=0, Rebuild=10, Refit=0.01})
boundary = BoundarySurfaces(Edges=cir)
multiplication = Multiplication(A=data_2, B="0.5")
loft_2 = Loft(Curves=move_5.Geometry, Options={Adjust=False, Closed=False, LoftEnds=0, LoftSimp=0, LoftType=0, Rebuild=10, Refit=0.01})
neg = Negative(Value="5")
offsrf = OffsetSurface(Surface=boundary, Distance="5", BothSides=neg, CreateSolid=True)
offsrf_2 = OffsetSurface(Surface=loft, Distance=data_2, BothSides=0, CreateSolid=True)
offsrf_3 = OffsetSurface(Surface=loft_2, Distance=multiplication, BothSides=0, CreateSolid=True)
sunion = SolidUnion(Breps=[offsrf_2, offsrf_3])  # -> simplify(Result)
trim_3 = TrimTree(Tree=offsrf, Depth=1)  # -> simplify(Tree)
sdiff = SolidDifference(BrepsA=sunion, BrepsB=trim_3)
R_2 = ClusterOutput(sdiff)

# ==== cluster Weave1
T = ClusterInput()
relay = ClusterInput()
trim = TrimTree(Tree=T, Depth=1)
B = ClusterInput()
duppt = RemoveDuplicatePts(Points=trim, Tolerance=0.01)
flip = FlipMatrix(Data=duppt)
intcrv = Interpolate(Vertices=duppt, Degree=3, Periodic=invert(False), KnotStyle=1)  # -> Curve, Length, Domain
brep_cp = BrepClosestPoint(Point=duppt, Brep=B)  # -> Point, Normal, Distance
flatten = FlattenTree(Tree=flip, Path="{0}")
avr = Average(Input=flatten)
intcrv_2 = Interpolate(Vertices=flip, Degree=3, Periodic=False, KnotStyle=1)  # -> Curve, Length, Domain
area = Area(Geometry=intcrv.Curve)  # -> Area, Centroid
ext = ExtendCurve(Curve=intcrv_2.Curve, Type=0, Start="20", End="20")
scale = Scale(Geometry=intcrv.Curve, Center=area.Centroid, Factor="0.97")  # -> Geometry, Transform
crv_cp = CurveClosestPoint(Point=duppt, Curve=scale.Geometry)  # -> Point, Parameter, Distance
brep_cp_2 = BrepClosestPoint(Point=flip, Brep=B)  # -> Point, Normal, Distance
Z = UnitZ(Factor=1)
relay_2 = ClusterInput()
relay_3 = ClusterInput()
shatter = Shatter(Curve=scale.Geometry, Parameters=crv_cp.Parameter)
scale_nu = ScaleNU(Geometry=ext, Plane=avr, ScaleX="0.98", ScaleY="0.98", ScaleZ=1)  # -> Geometry, Transform
xprod = CrossProduct(VectorA=graft(brep_cp_2.Normal), VectorB=Z, Unitize=False)  # -> Vector, Length
Z_2 = UnitZ(Factor=1)
rev = Reverse(Vector=brep_cp.Normal)
avr_2 = Average(Input=brep_cp.Point)
amp = Amplitude(Vector=xprod.Vector, Amplitude="0.5")
subtraction = Subtraction(A="1", B=relay_2)
crv_cp_2 = CurveClosestPoint(Point=flip, Curve=scale_nu.Geometry)  # -> Point, Parameter, Distance
xprod_2 = CrossProduct(VectorA=brep_cp.Normal, VectorB=Z_2, Unitize=False)  # -> Vector, Length
subtraction_2 = Subtraction(A="1", B=relay_3)
amp_2 = Amplitude(Vector=rev, Amplitude=relay)
rev_2 = Reverse(Vector=amp)
cir = Circle(Plane=avr_2, Radius=1)
lng = ListLength(List=brep_cp.Point)
dom = ConstructDomain(DomainStart=relay_2, DomainEnd=subtraction)
xprod_3 = CrossProduct(VectorA=xprod_2.Vector, VectorB=brep_cp.Normal, Unitize=False)  # -> graft(Vector), Length
shatter_2 = Shatter(Curve=scale_nu.Geometry, Parameters=crv_cp_2.Parameter)
dom_2 = ConstructDomain(DomainStart=relay_3, DomainEnd=subtraction_2)
A = ClusterInput()
move = Move(Geometry=crv_cp.Point, Motion=amp_2)  # -> Geometry, Transform
merge = Merge(Data1=amp, Data2=rev_2)
subcrv = SubCurve(BaseCurve=reparameterize(shatter), Domain=dom)
dup = DuplicateData(Data=cir, Number=lng, Order=True)  # -> graft(Data)
amp_3 = Amplitude(Vector=xprod_3.Vector, Amplitude=A)
subcrv_2 = SubCurve(BaseCurve=reparameterize(shatter_2), Domain=dom_2)
rev_3 = Reverse(Vector=brep_cp_2.Normal)
multiplication = Multiplication(A=relay, B="0.65")
rev_4 = Reverse(Vector=amp_3)
end = EndPoints(Curve=simplify(subcrv))  # -> Start, End
amp_4 = Amplitude(Vector=rev_3, Amplitude=multiplication)
rotate = Rotate(Geometry=dup, Angle=".1", Plane=PlaneXY(0, 0, 0))  # -> Geometry, Transform
end_2 = EndPoints(Curve=simplify(subcrv_2))  # -> Start, End
merge_2 = Merge(Data1=amp_3, Data2=rev_4)
merge_3 = Merge(Data1=end.Start, Data2=end.End)  # -> flatten(Result)
graft = GraftTree(Tree=move.Geometry, IncludeEmptyLists=True, IncludeNullItems=True)  # -> simplify(Tree)
merge_4 = Merge(Data1=end_2.Start, Data2=end_2.End)  # -> flatten(Result)
move_2 = Move(Geometry=crv_cp_2.Point, Motion=amp_4)  # -> Geometry, Transform
duppt_2 = RemoveDuplicatePts(Points=merge_3, Tolerance=0.01)
duppt_3 = RemoveDuplicatePts(Points=merge_4, Tolerance=0.01)
graft_2 = GraftTree(Tree=move_2.Geometry, IncludeEmptyLists=True, IncludeNullItems=True)  # -> simplify(Tree)
cps = ClosestPoints(Point=graft, Cloud=duppt_2, Count="2")  # -> simplify(ClosestPoint), CPIndex, Distance
cps_2 = ClosestPoints(Point=graft_2, Cloud=duppt_3, Count="2")  # -> simplify(ClosestPoint), CPIndex, Distance
merge_5 = Merge(Data1=graft, Data2=cps.ClosestPoint)
alongcrv = SortAlongCurve(Points=merge_5, Curve=rotate.Geometry)  # -> Points, Indices
merge_6 = Merge(Data1=graft_2, Data2=cps_2.ClosestPoint)
intcrv_3 = Interpolate(Vertices=alongcrv.Points, Degree=3, Periodic=False, KnotStyle=1)  # -> Curve, Length, Domain
pdecon = Deconstruct(Point=merge_6)  # -> XComponent, YComponent, ZComponent
sort = SortList(Keys=pdecon.ZComponent, ValuesA=merge_6)  # -> Keys, ValuesA
merge_7 = Merge(Data1=intcrv_3.Curve, Data2=subcrv)  # -> flatten(Result)
intcrv_4 = Interpolate(Vertices=sort.ValuesA, Degree=3, Periodic=False, KnotStyle=1)  # -> Curve, Length, Domain
move_3 = Move(Geometry=intcrv_3.Curve, Motion=merge_2)  # -> Geometry, Transform
avr_3 = Average(Input=alongcrv.Points)
merge_8 = Merge(Data1=intcrv_4.Curve, Data2=subcrv_2)  # -> flatten(Result)
graft_3 = GraftTree(Tree=flip, IncludeEmptyLists=True, IncludeNullItems=True)
move_4 = Move(Geometry=intcrv_4.Curve, Motion=merge)  # -> Geometry, Transform
scale_2 = Scale(Geometry=move_3.Geometry, Center=avr_3, Factor="1.5")  # -> simplify(Geometry), Transform
scale_3 = Scale(Geometry=move_4.Geometry, Center=graft_3, Factor="1.5")  # -> simplify(Geometry), Transform
item = ListItem(List=scale_2.Geometry, Index=0, Wrap=True)  # -> Item, Item1
join = JoinCurves(Curves=merge_8, Preserve=False)  # -> graft(Curves)
trim_2 = TrimTree(Tree=item.Item, Depth=1)
trim_3 = TrimTree(Tree=item.Item1, Depth=1)
item_2 = ListItem(List=scale_3.Geometry, Index=0, Wrap=True)  # -> Item, Item1
end_3 = EndPoints(Curve=trim_3)  # -> Start, End
end_4 = EndPoints(Curve=trim_2)  # -> Start, End
trim_4 = TrimTree(Tree=item_2.Item1, Depth=1)
trim_5 = TrimTree(Tree=item_2.Item, Depth=1)
weave = Weave(Pattern=[0, 1], Stream0=end_4.Start, Stream1=end_4.End, NullGaps=False)
weave_2 = Weave(Pattern=[0, 1], Stream0=end_3.Start, Stream1=end_3.End, NullGaps=False)
end_5 = EndPoints(Curve=trim_4)  # -> Start, End
end_6 = EndPoints(Curve=trim_5)  # -> Start, End
intcrv_5 = Interpolate(Vertices=weave_2, Degree=3, Periodic=invert(False), KnotStyle=1)  # -> Curve, Length, Domain
intcrv_6 = Interpolate(Vertices=weave, Degree=3, Periodic=invert(False), KnotStyle=1)  # -> Curve, Length, Domain
weave_3 = Weave(Pattern=[0, 1], Stream0=end_5.Start, Stream1=end_5.End, NullGaps=False)
weave_4 = Weave(Pattern=[0, 1], Stream0=end_6.Start, Stream1=end_6.End, NullGaps=False)
intcrv_7 = Interpolate(Vertices=weave_4, Degree=3, Periodic=False, KnotStyle=1)  # -> Curve, Length, Domain
intcrv_8 = Interpolate(Vertices=weave_3, Degree=3, Periodic=False, KnotStyle=1)  # -> Curve, Length, Domain
crv_cp_3 = CurveClosestPoint(Point=weave, Curve=intcrv_6.Curve)  # -> Point, Parameter, Distance
crv_cp_4 = CurveClosestPoint(Point=weave_2, Curve=intcrv_5.Curve)  # -> Point, Parameter, Distance
ext_2 = ExtendCurve(Curve=intcrv_8.Curve, Type=0, Start="15", End="15")
ext_3 = ExtendCurve(Curve=intcrv_7.Curve, Type=0, Start="15", End="15")
shatter_3 = Shatter(Curve=intcrv_6.Curve, Parameters=crv_cp_3.Parameter)
shatter_4 = Shatter(Curve=intcrv_5.Curve, Parameters=crv_cp_4.Parameter)
crv_cp_5 = CurveClosestPoint(Point=weave_4, Curve=ext_3)  # -> Point, Parameter, Distance
crv_cp_6 = CurveClosestPoint(Point=weave_3, Curve=ext_2)  # -> Point, Parameter, Distance
dispatch = Dispatch(List=shatter_3, DispatchPattern=[True, False])  # -> ListA, ListB
shatter_5 = Shatter(Curve=ext_3, Parameters=crv_cp_5.Parameter)
trim_6 = TrimTree(Tree=item.Item, Depth=1)
trim_7 = TrimTree(Tree=item.Item1, Depth=1)
dispatch_2 = Dispatch(List=shatter_4, DispatchPattern=[True, False])  # -> ListA, ListB
shatter_6 = Shatter(Curve=ext_2, Parameters=crv_cp_6.Parameter)
dispatch_3 = Dispatch(List=shatter_5, DispatchPattern=[True, False])  # -> ListA, ListB
dispatch_4 = Dispatch(List=shatter_6, DispatchPattern=[True, False])  # -> ListA, ListB
merge_9 = Merge(Data1=simplify(trim_4), Data2=simplify(dispatch_4.ListA))
merge_10 = Merge(Data1=simplify(trim_5), Data2=simplify(dispatch_3.ListA))
join_2 = JoinCurves(Curves=join, Preserve=False)  # -> graft(Curves)
relay_4 = ClusterInput()
merge_11 = Merge(Data1=simplify(trim_6), Data2=simplify(dispatch.ListB))
merge_12 = Merge(Data1=simplify(trim_7), Data2=simplify(dispatch_2.ListB))
join_3 = JoinCurves(Curves=merge_10, Preserve=False)
join_4 = JoinCurves(Curves=merge_9, Preserve=False)
join_5 = JoinCurves(Curves=merge_7, Preserve=False)  # -> graft(Curves)
join_6 = JoinCurves(Curves=merge_12, Preserve=False)
join_7 = JoinCurves(Curves=merge_11, Preserve=False)
match = MatchTree(Tree=join_2, Guide=join_4)
match_2 = MatchTree(Tree=join_5, Guide=join_6)
merge_13 = Merge(Data1=simplify(graft(join_3)), Data2=simplify(match), Data3=simplify(graft(join_4)))
merge_14 = Merge(Data1=simplify(graft(join_7)), Data2=simplify(match_2), Data3=simplify(graft(join_6)))
loft = Loft(Curves=merge_13, Options={Adjust=False, Closed=False, LoftEnds=0, LoftSimp=0, LoftType=0, Rebuild=10, Refit=0.01})
disc = Discontinuity(Curve=merge_14, Level=1)  # -> Points, Parameters
shatter_7 = Shatter(Curve=graft(merge_14), Parameters=disc.Parameters)
midpt = CurveMiddle(Curve=shatter_7)
mesh = MeshBrep(
    Brep=loft,
    Settings={GridMaxCount=0, GridMinCount=16, JaggedSeams=False, MaxEdgeLength=0, MinEdgeLength=0.0001, MinTolerance=0, Refine=True, RefineAngle=0, RelativeTolerance=0.65, SimplePlanes=True, Tolerance=0})
avr_4 = Average(Input=midpt)
wbjoin = WeaverbirdsJoinMeshesAndWeld(Mesh=mesh, Weld=invert(False))
cir_2 = Circle(Plane=avr_4, Radius=1)
alongcrv_2 = SortAlongCurve(Points=midpt, Curve=cir_2)  # -> Points, Indices
wbthicken = WeaverbirdsMeshThicken(MeshCurves=wbjoin, Distance=relay_4, OffsetType=0)
item_3 = ListItem(List=shatter_7, Index=alongcrv_2.Indices, Wrap=True)  # -> simplify(graft(Item))
relitem = RelativeItem(Tree=item_3, Offset="{+0;+1;+0}", WrapPaths=False, WrapItems=False)  # -> ItemA, ItemB
merge_15 = Merge(Data1=relitem.ItemA, Data2=relitem.ItemB)
loft_2 = Loft(Curves=merge_15, Options={Adjust=False, Closed=False, LoftEnds=0, LoftSimp=0, LoftType=3, Rebuild=10, Refit=0.01})
trim_8 = TrimTree(Tree=loft_2, Depth="2")
join_8 = BrepJoin(Breps=trim_8)  # -> Breps, Closed
mesh_2 = MeshBrep(
    Brep=join_8.Breps,
    Settings={GridMaxCount=0, GridMinCount=16, JaggedSeams=False, MaxEdgeLength=0, MinEdgeLength=0.0001, MinTolerance=0, Refine=True, RefineAngle=0, RelativeTolerance=0.65, SimplePlanes=True, Tolerance=0})
wbjoin_2 = WeaverbirdsJoinMeshesAndWeld(Mesh=mesh_2, Weld=invert(False))
wbthicken_2 = WeaverbirdsMeshThicken(MeshCurves=wbjoin_2, Distance=relay_4, OffsetType=0)
wbcatmullclark = WeaverbirdsCatmullClarkSubdivision(MeshCurves=wbthicken, Level="2", SmoothNakedEdges=1)
wbcatmullclark_2 = WeaverbirdsCatmullClarkSubdivision(MeshCurves=wbthicken_2, Level="2", SmoothNakedEdges=1)
merge_16 = Merge(Data1=wbcatmullclark_2, Data2=wbcatmullclark)
R = ClusterOutput(merge_16)

# ==== cluster Weave2
relay = ClusterInput()
brep = ClusterInput()
T = ClusterInput()
trim = TrimTree(Tree=T, Depth=1)
duppt = RemoveDuplicatePts(Points=trim, Tolerance=0.01)
flip = FlipMatrix(Data=duppt)
flatten = FlattenTree(Tree=flip, Path="{0}")
intcrv = Interpolate(Vertices=duppt, Degree=3, Periodic=invert(False), KnotStyle=1)  # -> Curve, Length, Domain
avr = Average(Input=flatten)
intcrv_2 = Interpolate(Vertices=flip, Degree=3, Periodic=False, KnotStyle=1)  # -> Curve, Length, Domain
area = Area(Geometry=intcrv.Curve)  # -> Area, Centroid
ext = ExtendCurve(Curve=intcrv_2.Curve, Type=0, Start="20", End="20")
sub_segment1 = ClusterInput()
brep_cp = BrepClosestPoint(Point=duppt, Brep=brep)  # -> Point, Normal, Distance
sub_segment2 = ClusterInput()
scale = Scale(Geometry=intcrv.Curve, Center=area.Centroid, Factor="0.97")  # -> Geometry, Transform
brep_cp_2 = BrepClosestPoint(Point=flip, Brep=brep)  # -> Point, Normal, Distance
Z = UnitZ(Factor=1)
crv_cp = CurveClosestPoint(Point=duppt, Curve=scale.Geometry)  # -> Point, Parameter, Distance
scale_nu = ScaleNU(Geometry=ext, Plane=avr, ScaleX="0.98", ScaleY="0.98", ScaleZ=1)  # -> Geometry, Transform
xprod = CrossProduct(VectorA=graft(brep_cp_2.Normal), VectorB=Z, Unitize=False)  # -> Vector, Length
Z_2 = UnitZ(Factor=1)
shatter = Shatter(Curve=scale.Geometry, Parameters=crv_cp.Parameter)
rev = Reverse(Vector=brep_cp.Normal)
avr_2 = Average(Input=brep_cp.Point)
amp = Amplitude(Vector=xprod.Vector, Amplitude="0.5")
multiplication = Multiplication(A=relay, B="0.65")
subtraction = Subtraction(A="1", B=sub_segment1)
crv_cp_2 = CurveClosestPoint(Point=flip, Curve=scale_nu.Geometry)  # -> Point, Parameter, Distance
xprod_2 = CrossProduct(VectorA=brep_cp.Normal, VectorB=Z_2, Unitize=False)  # -> Vector, Length
subtraction_2 = Subtraction(A="1", B=sub_segment2)
amp_2 = Amplitude(Vector=rev, Amplitude=multiplication)
rev_2 = Reverse(Vector=amp)
cir = Circle(Plane=avr_2, Radius=1)
lng = ListLength(List=brep_cp.Point)
dom = ConstructDomain(DomainStart=sub_segment1, DomainEnd=subtraction)
xprod_3 = CrossProduct(VectorA=xprod_2.Vector, VectorB=brep_cp.Normal, Unitize=False)  # -> graft(Vector), Length
shatter_2 = Shatter(Curve=scale_nu.Geometry, Parameters=crv_cp_2.Parameter)
dom_2 = ConstructDomain(DomainStart=sub_segment2, DomainEnd=subtraction_2)
A = ClusterInput()
move = Move(Geometry=crv_cp.Point, Motion=amp_2)  # -> Geometry, Transform
merge = Merge(Data1=amp, Data2=rev_2)
subcrv = SubCurve(BaseCurve=reparameterize(shatter), Domain=dom)
dup = DuplicateData(Data=cir, Number=lng, Order=True)  # -> graft(Data)
amp_3 = Amplitude(Vector=xprod_3.Vector, Amplitude=A)
subcrv_2 = SubCurve(BaseCurve=reparameterize(shatter_2), Domain=dom_2)
rev_3 = Reverse(Vector=brep_cp_2.Normal)
rev_4 = Reverse(Vector=amp_3)
end = EndPoints(Curve=simplify(subcrv))  # -> Start, End
amp_4 = Amplitude(Vector=rev_3, Amplitude=relay)
rotate = Rotate(Geometry=dup, Angle=".1", Plane=PlaneXY(0, 0, 0))  # -> Geometry, Transform
end_2 = EndPoints(Curve=simplify(subcrv_2))  # -> Start, End
merge_2 = Merge(Data1=amp_3, Data2=rev_4)
merge_3 = Merge(Data1=end.Start, Data2=end.End)  # -> flatten(Result)
graft = GraftTree(Tree=move.Geometry, IncludeEmptyLists=True, IncludeNullItems=True)  # -> simplify(Tree)
merge_4 = Merge(Data1=end_2.Start, Data2=end_2.End)  # -> flatten(Result)
move_2 = Move(Geometry=crv_cp_2.Point, Motion=amp_4)  # -> Geometry, Transform
duppt_2 = RemoveDuplicatePts(Points=merge_3, Tolerance=0.01)
duppt_3 = RemoveDuplicatePts(Points=merge_4, Tolerance=0.01)
graft_2 = GraftTree(Tree=move_2.Geometry, IncludeEmptyLists=True, IncludeNullItems=True)  # -> simplify(Tree)
cps = ClosestPoints(Point=graft, Cloud=duppt_2, Count="2")  # -> simplify(ClosestPoint), CPIndex, Distance
cps_2 = ClosestPoints(Point=graft_2, Cloud=duppt_3, Count="2")  # -> simplify(ClosestPoint), CPIndex, Distance
merge_5 = Merge(Data1=graft, Data2=cps.ClosestPoint)
alongcrv = SortAlongCurve(Points=merge_5, Curve=rotate.Geometry)  # -> Points, Indices
merge_6 = Merge(Data1=graft_2, Data2=cps_2.ClosestPoint)
intcrv_3 = Interpolate(Vertices=alongcrv.Points, Degree=3, Periodic=False, KnotStyle=1)  # -> Curve, Length, Domain
pdecon = Deconstruct(Point=merge_6)  # -> XComponent, YComponent, ZComponent
sort = SortList(Keys=pdecon.ZComponent, ValuesA=merge_6)  # -> Keys, ValuesA
merge_7 = Merge(Data1=intcrv_3.Curve, Data2=subcrv)  # -> flatten(Result)
intcrv_4 = Interpolate(Vertices=sort.ValuesA, Degree=3, Periodic=False, KnotStyle=1)  # -> Curve, Length, Domain
move_3 = Move(Geometry=intcrv_3.Curve, Motion=merge_2)  # -> Geometry, Transform
avr_3 = Average(Input=alongcrv.Points)
merge_8 = Merge(Data1=intcrv_4.Curve, Data2=subcrv_2)  # -> flatten(Result)
graft_3 = GraftTree(Tree=flip, IncludeEmptyLists=True, IncludeNullItems=True)
move_4 = Move(Geometry=intcrv_4.Curve, Motion=merge)  # -> Geometry, Transform
scale_2 = Scale(Geometry=move_3.Geometry, Center=avr_3, Factor="1.5")  # -> simplify(Geometry), Transform
scale_3 = Scale(Geometry=move_4.Geometry, Center=graft_3, Factor="1.5")  # -> simplify(Geometry), Transform
item = ListItem(List=scale_2.Geometry, Index=0, Wrap=True)  # -> Item, Item1
join = JoinCurves(Curves=merge_8, Preserve=False)  # -> graft(Curves)
trim_2 = TrimTree(Tree=item.Item, Depth=1)
trim_3 = TrimTree(Tree=item.Item1, Depth=1)
item_2 = ListItem(List=scale_3.Geometry, Index=0, Wrap=True)  # -> Item, Item1
end_3 = EndPoints(Curve=trim_3)  # -> Start, End
end_4 = EndPoints(Curve=trim_2)  # -> Start, End
trim_4 = TrimTree(Tree=item_2.Item1, Depth=1)
trim_5 = TrimTree(Tree=item_2.Item, Depth=1)
weave = Weave(Pattern=[0, 1], Stream0=end_4.Start, Stream1=end_4.End, NullGaps=False)
weave_2 = Weave(Pattern=[0, 1], Stream0=end_3.Start, Stream1=end_3.End, NullGaps=False)
end_5 = EndPoints(Curve=trim_4)  # -> Start, End
end_6 = EndPoints(Curve=trim_5)  # -> Start, End
intcrv_5 = Interpolate(Vertices=weave_2, Degree=3, Periodic=invert(False), KnotStyle=1)  # -> Curve, Length, Domain
intcrv_6 = Interpolate(Vertices=weave, Degree=3, Periodic=invert(False), KnotStyle=1)  # -> Curve, Length, Domain
weave_3 = Weave(Pattern=[0, 1], Stream0=end_5.Start, Stream1=end_5.End, NullGaps=False)
weave_4 = Weave(Pattern=[0, 1], Stream0=end_6.Start, Stream1=end_6.End, NullGaps=False)
intcrv_7 = Interpolate(Vertices=weave_4, Degree=3, Periodic=False, KnotStyle=1)  # -> Curve, Length, Domain
intcrv_8 = Interpolate(Vertices=weave_3, Degree=3, Periodic=False, KnotStyle=1)  # -> Curve, Length, Domain
crv_cp_3 = CurveClosestPoint(Point=weave, Curve=intcrv_6.Curve)  # -> Point, Parameter, Distance
crv_cp_4 = CurveClosestPoint(Point=weave_2, Curve=intcrv_5.Curve)  # -> Point, Parameter, Distance
ext_2 = ExtendCurve(Curve=intcrv_8.Curve, Type=0, Start="15", End="15")
ext_3 = ExtendCurve(Curve=intcrv_7.Curve, Type=0, Start="15", End="15")
shatter_3 = Shatter(Curve=intcrv_6.Curve, Parameters=crv_cp_3.Parameter)
shatter_4 = Shatter(Curve=intcrv_5.Curve, Parameters=crv_cp_4.Parameter)
crv_cp_5 = CurveClosestPoint(Point=weave_4, Curve=ext_3)  # -> Point, Parameter, Distance
crv_cp_6 = CurveClosestPoint(Point=weave_3, Curve=ext_2)  # -> Point, Parameter, Distance
dispatch = Dispatch(List=shatter_3, DispatchPattern=[True, False])  # -> ListA, ListB
shatter_5 = Shatter(Curve=ext_3, Parameters=crv_cp_5.Parameter)
trim_6 = TrimTree(Tree=item.Item, Depth=1)
trim_7 = TrimTree(Tree=item.Item1, Depth=1)
dispatch_2 = Dispatch(List=shatter_4, DispatchPattern=[True, False])  # -> ListA, ListB
shatter_6 = Shatter(Curve=ext_2, Parameters=crv_cp_6.Parameter)
dispatch_3 = Dispatch(List=shatter_5, DispatchPattern=[True, False])  # -> ListA, ListB
dispatch_4 = Dispatch(List=shatter_6, DispatchPattern=[True, False])  # -> ListA, ListB
merge_9 = Merge(Data1=simplify(trim_4), Data2=simplify(dispatch_4.ListA))
merge_10 = Merge(Data1=simplify(trim_5), Data2=simplify(dispatch_3.ListA))
join_2 = JoinCurves(Curves=join, Preserve=False)  # -> graft(Curves)
merge_11 = Merge(Data1=simplify(trim_6), Data2=simplify(dispatch.ListB))
merge_12 = Merge(Data1=simplify(trim_7), Data2=simplify(dispatch_2.ListB))
join_3 = JoinCurves(Curves=merge_10, Preserve=False)
join_4 = JoinCurves(Curves=merge_9, Preserve=False)
join_5 = JoinCurves(Curves=merge_7, Preserve=False)  # -> graft(Curves)
join_6 = JoinCurves(Curves=merge_12, Preserve=False)
join_7 = JoinCurves(Curves=merge_11, Preserve=False)
match = MatchTree(Tree=join_2, Guide=join_4)
match_2 = MatchTree(Tree=join_5, Guide=join_6)
merge_13 = Merge(Data1=simplify(graft(join_3)), Data2=simplify(match), Data3=simplify(graft(join_4)))
merge_14 = Merge(Data1=simplify(graft(join_7)), Data2=simplify(match_2), Data3=simplify(graft(join_6)))
loft = Loft(Curves=merge_13, Options={Adjust=False, Closed=False, LoftEnds=0, LoftSimp=0, LoftType=0, Rebuild=10, Refit=0.01})
disc = Discontinuity(Curve=merge_14, Level=1)  # -> Points, Parameters
shatter_7 = Shatter(Curve=graft(merge_14), Parameters=disc.Parameters)
midpt = CurveMiddle(Curve=shatter_7)
mesh = MeshBrep(
    Brep=loft,
    Settings={GridMaxCount=0, GridMinCount=16, JaggedSeams=False, MaxEdgeLength=0, MinEdgeLength=0.0001, MinTolerance=0, Refine=True, RefineAngle=0, RelativeTolerance=0.65, SimplePlanes=True, Tolerance=0})
avr_4 = Average(Input=midpt)
wbjoin = WeaverbirdsJoinMeshesAndWeld(Mesh=mesh, Weld=invert(False))
cir_2 = Circle(Plane=avr_4, Radius=1)
alongcrv_2 = SortAlongCurve(Points=midpt, Curve=cir_2)  # -> Points, Indices
wbthicken = WeaverbirdsMeshThicken(MeshCurves=wbjoin, Distance="0.2", OffsetType=0)
item_3 = ListItem(List=shatter_7, Index=alongcrv_2.Indices, Wrap=True)  # -> simplify(graft(Item))
relitem = RelativeItem(Tree=item_3, Offset="{+0;+1;+0}", WrapPaths=False, WrapItems=False)  # -> ItemA, ItemB
merge_15 = Merge(Data1=relitem.ItemA, Data2=relitem.ItemB)
loft_2 = Loft(Curves=merge_15, Options={Adjust=False, Closed=False, LoftEnds=0, LoftSimp=0, LoftType=3, Rebuild=10, Refit=0.01})
trim_8 = TrimTree(Tree=loft_2, Depth="2")
join_8 = BrepJoin(Breps=trim_8)  # -> Breps, Closed
mesh_2 = MeshBrep(
    Brep=join_8.Breps,
    Settings={GridMaxCount=0, GridMinCount=16, JaggedSeams=False, MaxEdgeLength=0, MinEdgeLength=0.0001, MinTolerance=0, Refine=True, RefineAngle=0, RelativeTolerance=0.65, SimplePlanes=True, Tolerance=0})
wbjoin_2 = WeaverbirdsJoinMeshesAndWeld(Mesh=mesh_2, Weld=invert(False))
D = ClusterInput()
wbthicken_2 = WeaverbirdsMeshThicken(MeshCurves=wbjoin_2, Distance=D, OffsetType=0)
wbcatmullclark = WeaverbirdsCatmullClarkSubdivision(MeshCurves=wbthicken, Level="2", SmoothNakedEdges=1)
wbcatmullclark_2 = WeaverbirdsCatmullClarkSubdivision(MeshCurves=wbthicken_2, Level="2", SmoothNakedEdges=1)
merge_16 = Merge(Data1=wbcatmullclark_2, Data2=wbcatmullclark)
R = ClusterOutput(merge_16)
