# Grasshopper definition #58_chinese_texture4.gh (Grasshopper 1.0.7)
# plug-ins: Nautilus, Kangaroo2 Components, Pufferfish, Weaverbird

yz_plane = YZPlane(Origin=Point(0, 0, 0))
curve = Curve(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)
project = Project(Geometry=curve, Plane=yz_plane)  # -> Geometry, Transform
division = Division(A="180", B="100")
subtraction = Subtraction(A="100", B="1")
series = Series(Start=0, Step=division, Count="100")
divide_curve = DivideCurve(Curve=project.Geometry, Count=subtraction, Kinks=False)  # -> Points, Tangents, Parameters
divide_curve_2 = DivideCurve(Curve=curve, Count=subtraction, Kinks=False)  # -> Points, Tangents, Parameters
circle = Circle(Plane=PlaneXY(0, 0, 0), Radius="45")
unit_z = UnitZ(Factor=series)
distance = Distance(PointA=divide_curve_2.Points, PointB=divide_curve.Points)
move = Move(Geometry=circle, Motion=unit_z)  # -> Geometry, Transform
reverse_list = ReverseList(List=distance)
construct_domain = ConstructDomain(DomainStart=Slider(0.2, range=0..1), DomainEnd=Slider(0.76, range=0..2))
area = Area(Geometry=move.Geometry)  # -> Area, Centroid
bounds = Bounds(Numbers=reverse_list)
remap_numbers = RemapNumbers(Value=reverse_list, Source=bounds, Target=construct_domain)  # -> Mapped, Clipped
scale = Scale(Geometry=move.Geometry, Center=area.Centroid, Factor=remap_numbers.Mapped)  # -> Geometry, Transform
scale_2 = Scale(Geometry=scale.Geometry, Center=area.Centroid, Factor="0.95")  # -> Geometry, Transform
loft = Loft(Curves=scale.Geometry, Options={Adjust=False, Closed=False, LoftEnds=0, LoftSimp=0, LoftType=0, Rebuild=10, Refit=0.01})
loft_2 = Loft(
    Curves=scale_2.Geometry,
    Options={Adjust=False, Closed=False, LoftEnds=0, LoftSimp=0, LoftType=0, Rebuild=10, Refit=0.01})
surface = Surface(loft)
surface_2 = Surface(loft_2)
surface_3 = Surface(surface_2)
surface_4 = Surface(surface)
hexagon_on_surface = HexagonOnSurface(Surface=surface_4, Number="8", Orientation=Toggle(False))
surface_5 = Surface(surface_4)
partition_list = PartitionList(List=hexagon_on_surface, Size="8")  # -> simplify(Chunks)
tstat = TreeStatistics(Tree=partition_list)  # -> Paths, Length, Count
dom = ConstructDomain(DomainStart="3", DomainEnd="19")
subset = SubList(List=tstat.Paths, Domain=dom, Wrap=True)  # -> List, Index
branch = TreeBranch(Tree=partition_list, Path=subset.List, MaintainPaths=True)
pull = PullCurve(Curve=branch, Surface=surface_5)  # -> flatten(Curve)
srfsplit = SurfaceSplit(Surface=surface_5, Curves=pull)
area_2 = Area(Geometry=srfsplit)  # -> Area, Centroid
sort = SortList(Keys=area_2.Area, ValuesA=srfsplit)  # -> Keys, reverse(ValuesA)
panel = Panel("""0
1""")
cull_i = CullIndex(List=sort.ValuesA, Indices=panel, Wrap=True)
explode = Explode(Curve=cull_i, Recursive=True)  # -> Segments, Vertices
tstat_2 = TreeStatistics(Tree=explode.Segments)  # -> Paths, Length, Count
cset = CreateSet(List=tstat_2.Length)  # -> Set, Map
sort_2 = SortList(Keys=cset.Set)  # -> Keys, ValuesA
item = ListItem(List=sort_2.Keys, Index=0, Wrap=True)
equals = Equality(FirstNumber=item, SecondNumber=tstat_2.Length)  # -> Equality, Inequality
dispatch = Dispatch(List=tstat_2.Paths, DispatchPattern=equals.Equality)  # -> ListA, ListB
branch_2 = TreeBranch(Tree=explode.Segments, Path=dispatch.ListA, MaintainPaths=True)  # -> simplify(flatten(Branch))
branch_3 = TreeBranch(Tree=explode.Vertices, Path=dispatch.ListB, MaintainPaths=True)  # -> simplify(Branch)
surface_6 = Surface(surface_5)
crv = Curve(branch_2)
surface_7 = Surface(surface_3)
pt = Point(branch_3)
num = Number(item)
surface_8 = Surface(surface_7)
num_2 = Number(num)
crv_2 = Curve(crv)
surface_9 = Surface(surface_6)
pt_2 = Point(pt)
multiplication = Multiplication(A=num_2, B="2")
duppt = RemoveDuplicatePts(Points=pt_2, Tolerance=0.01)
partition = PartitionList(List=crv_2, Size=multiplication)  # -> simplify(Chunks)
pline = PolyLine(Vertices=duppt, Closed=invert(False))
explode_2 = Explode(Curve=partition, Recursive=True)  # -> Segments, Vertices
trim = TrimTree(Tree=explode_2.Vertices, Depth=1)
duppt_2 = RemoveDuplicatePts(Points=trim, Tolerance=0.01)
avr = Average(Input=duppt_2)
brep_cp = BrepClosestPoint(Point=avr, Brep=surface_9)  # -> Point, Normal, Distance
pi = Pi(Factor="0.05")
pl = PlaneNormal(Origin=brep_cp.Point, ZAxis=brep_cp.Normal)
prot = RotatePlane(Plane=pl, Angle=pi)
cir = Circle(Plane=prot, Radius=1)
alongcrv = SortAlongCurve(Points=duppt_2, Curve=cir)  # -> Points, Indices
panel_2 = Panel("""3
-1""")
cull_i_2 = CullIndex(List=alongcrv.Points, Indices=panel_2, Wrap=True)
pline_2 = PolyLine(Vertices=cull_i_2, Closed=invert(False))
merge = Merge(Data1=pline_2, Data2=pline)  # -> flatten(Result)
crv_3 = Curve(merge)
srf = Surface(surface_8)
surface_10 = Surface(surface_9)
crv_4 = Curve(crv_3)
srf_2 = Surface(srf)
surface_11 = Surface(surface_10)
explode_3 = Explode(Curve=crv_4, Recursive=True)  # -> Segments, Vertices
midpt = CurveMiddle(Curve=explode_3.Segments)
duppt_3 = RemoveDuplicatePts(Points=explode_3.Vertices, Tolerance=0.01)
avr_2 = Average(Input=midpt)

panel_3 = Panel("""0.98
0.9
0.88
0.8
0.78""")
item_2 = ListItem(List=panel_3, Index=0, Wrap=True)  # -> Item, Item1, Item2, Item3, Item4
scale_3 = Scale(Geometry=graft(crv_4), Center=avr_2, Factor=item_2.Item1)  # -> Geometry, Transform
scale_4 = Scale(Geometry=graft(crv_4), Center=avr_2, Factor=item_2.Item2)  # -> Geometry, Transform
scale_5 = Scale(Geometry=graft(crv_4), Center=avr_2, Factor=item_2.Item3)  # -> Geometry, Transform
scale_6 = Scale(Geometry=graft(crv_4), Center=avr_2, Factor=item_2.Item4)  # -> Geometry, Transform
scale_7 = Scale(Geometry=graft(crv_4), Center=avr_2, Factor=item_2.Item)  # -> Geometry, Transform
graft = GraftTree(Tree=crv_4, IncludeEmptyLists=True, IncludeNullItems=True)
brep_cp_2 = BrepClosestPoint(Point=avr_2, Brep=surface_11)  # -> Point, Normal, Distance
amp = Amplitude(Vector=brep_cp_2.Normal, Amplitude="0.3")
amp_2 = Amplitude(Vector=brep_cp_2.Normal, Amplitude="0.45")
amp_3 = Amplitude(Vector=brep_cp_2.Normal, Amplitude="0.15")
amp_4 = Amplitude(Vector=brep_cp_2.Normal, Amplitude="0.6")
move_2 = Move(Geometry=scale_7.Geometry, Motion=amp_3)  # -> Geometry, Transform
move_3 = Move(Geometry=scale_3.Geometry, Motion=amp_3)  # -> Geometry, Transform
move_4 = Move(Geometry=scale_4.Geometry, Motion=amp)  # -> Geometry, Transform
move_5 = Move(Geometry=scale_3.Geometry, Motion=amp)  # -> Geometry, Transform
move_6 = Move(Geometry=scale_5.Geometry, Motion=amp_2)  # -> Geometry, Transform
move_7 = Move(Geometry=scale_5.Geometry, Motion=amp_4)  # -> Geometry, Transform
move_8 = Move(Geometry=scale_4.Geometry, Motion=amp_2)  # -> Geometry, Transform
move_9 = Move(Geometry=scale_6.Geometry, Motion=amp_4)  # -> Geometry, Transform
loft_3 = Loft(
    Curves=[move_7.Geometry, move_9.Geometry],
    Options={Adjust=False, Closed=False, LoftEnds=0, LoftSimp=0, LoftType=0, Rebuild=10, Refit=0.01})
loft_4 = Loft(
    Curves=[move_6.Geometry, move_7.Geometry],
    Options={Adjust=False, Closed=False, LoftEnds=0, LoftSimp=0, LoftType=0, Rebuild=10, Refit=0.01})
loft_5 = Loft(
    Curves=[scale_7.Geometry, move_2.Geometry],
    Options={Adjust=False, Closed=False, LoftEnds=0, LoftSimp=0, LoftType=0, Rebuild=10, Refit=0.01})
loft_6 = Loft(
    Curves=[move_2.Geometry, move_3.Geometry],
    Options={Adjust=False, Closed=False, LoftEnds=0, LoftSimp=0, LoftType=0, Rebuild=10, Refit=0.01})
loft_7 = Loft(
    Curves=[graft, scale_7.Geometry],
    Options={Adjust=False, Closed=False, LoftEnds=0, LoftSimp=0, LoftType=0, Rebuild=10, Refit=0.01})
loft_8 = Loft(
    Curves=[move_5.Geometry, move_4.Geometry],
    Options={Adjust=False, Closed=False, LoftEnds=0, LoftSimp=0, LoftType=0, Rebuild=10, Refit=0.01})
loft_9 = Loft(
    Curves=[move_6.Geometry, move_8.Geometry],
    Options={Adjust=False, Closed=False, LoftEnds=0, LoftSimp=0, LoftType=0, Rebuild=10, Refit=0.01})
loft_10 = Loft(
    Curves=[move_3.Geometry, move_5.Geometry],
    Options={Adjust=False, Closed=False, LoftEnds=0, LoftSimp=0, LoftType=0, Rebuild=10, Refit=0.01})
loft_11 = Loft(
    Curves=[move_4.Geometry, move_8.Geometry],
    Options={Adjust=False, Closed=False, LoftEnds=0, LoftSimp=0, LoftType=0, Rebuild=10, Refit=0.01})
merge_2 = Merge(Data1=loft_7, Data2=loft_5)
merge_3 = Merge(Data1=loft_9, Data2=loft_4, Data3=loft_3)
merge_4 = Merge(Data1=loft_6, Data2=loft_10, Data3=loft_8, Data4=loft_11)
merge_5 = Merge(Data1=merge_2, Data2=merge_4, Data3=merge_3)

ln = Line(StartPoint=avr_2, EndPoint=duppt_3)  # -> simplify(Line)
graft_2 = GraftTree(Tree=ln, IncludeEmptyLists=True, IncludeNullItems=True)  # -> simplify(Tree)
shift = ShiftList(List=ln, Shift=1, Wrap=True)
graft_3 = GraftTree(Tree=shift, IncludeEmptyLists=True, IncludeNullItems=True)  # -> simplify(Tree)
join = JoinCurves(Curves=[graft_2, graft_3], Preserve=False)
clscrv = CloseCurve(Curve=join, CloseType=0, Bulge=0.5, Tolerance=0)  # -> Closed, R
surface_12 = Surface(srf_2)
pull_2 = PullCurve(Curve=clscrv.Closed, Surface=surface_12)  # -> flatten(Curve)
disc = Discontinuity(Curve=pull_2, Level=1)  # -> Points, Parameters
pline_3 = PolyLine(Vertices=disc.Points, Closed=invert(False))
area_3 = Area(Geometry=pline_3)  # -> flatten(Area), Centroid
explode_4 = Explode(Curve=pline_3, Recursive=True)  # -> simplify(Segments), Vertices
bnd = Bounds(Numbers=area_3.Area)
dom_2 = ConstructDomain(DomainStart="0.7", DomainEnd="0.95")
remap = RemapNumbers(Value=area_3.Area, Source=bnd, Target=dom_2)  # -> graft(Mapped), Clipped
scale_8 = Scale(Geometry=pline_3, Center=area_3.Centroid, Factor=remap.Mapped)  # -> Geometry, Transform
crv_5 = Curve(explode_4.Segments)
crv_6 = Curve(scale_8.Geometry)
surface_13 = Surface(surface_10)
surface_14 = Surface(surface_12)
pt_3 = Point(avr_2)
crv_7 = Curve(explode_3.Segments)
pt_4 = Point(pt_3)
crv_8 = Curve(crv_5)
crv_9 = Curve(crv_6)
surface_15 = Surface(surface_14)
crv_10 = Curve(crv_7)
surface_16 = Surface(surface_13)
dup = DuplicateData(Data=pt_4, Number="6", Order=True)  # -> simplify(Data)
len = Length(Curve=crv_10)
explode_5 = Explode(Curve=crv_9, Recursive=True)  # -> simplify(Segments), Vertices
graft_4 = GraftTree(Tree=dup, IncludeEmptyLists=True, IncludeNullItems=True)
ma = MassAddition(Input=len)  # -> Result, PartialResults
lng = ListLength(List=crv_10)
midpt_2 = CurveMiddle(Curve=explode_5.Segments)
path_mapper = PathMapper(graft_4, source="{A;B}", target="{path_index}")
dup_2 = DuplicateData(Data=ma.Result, Number=lng, Order=True)  # -> flatten(Data)
cps = ClosestPoints(Point=path_mapper, Cloud=midpt_2, Count="3")  # -> reverse(ClosestPoint), reverse(CPIndex), Distance
dom_3 = ConstructDomain(DomainStart="-0.05", DomainEnd="-0.5")
bnd_2 = Bounds(Numbers=dup_2)
item_3 = ListItem(List=cps.CPIndex, Index=0, Wrap=True)
cull_i_3 = CullIndex(List=crv_8, Indices=item_3, Wrap=True)
remap_2 = RemapNumbers(Value=dup_2, Source=bnd_2, Target=dom_3)  # -> graft(Mapped), Clipped
join_2 = JoinCurves(Curves=cull_i_3, Preserve=False)
item_4 = ListItem(List=explode_5.Segments, Index=item_3, Wrap=True)
cull_i_4 = CullIndex(List=explode_5.Segments, Indices=item_3, Wrap=True)
item_5 = ListItem(List=crv_8, Index=item_3, Wrap=True)
disc_2 = Discontinuity(Curve=join_2, Level=1)  # -> Points, Parameters
number_slider = Slider(0.07, range=0..1)
number_slider_2 = Slider(0.07, range=0..1)
join_3 = JoinCurves(Curves=cull_i_4, Preserve=False)
item_6 = ListItem(List=disc_2.Points, Index=0, Wrap=True)  # -> Item, Item1, Item2
brep_cp_3 = BrepClosestPoint(Point=item_6.Item1, Brep=surface_15)  # -> flatten(Point), Normal, Distance
disc_3 = Discontinuity(Curve=join_3, Level=1)  # -> simplify(Points), Parameters
subtraction_2 = Subtraction(A="1", B=number_slider)
subtraction_3 = Subtraction(A="1", B=number_slider_2)
dom_4 = ConstructDomain(DomainStart=number_slider_2, DomainEnd=subtraction_3)
dom_5 = ConstructDomain(DomainStart=subtraction_2, DomainEnd=1)
dom_6 = ConstructDomain(DomainStart=0, DomainEnd=number_slider)
amp_5 = Amplitude(Vector=brep_cp_3.Normal, Amplitude=remap_2.Mapped)
item_7 = ListItem(List=disc_3.Points, Index="1", Wrap=True)
move_10 = Move(Geometry=item_6.Item1, Motion=amp_5)  # -> Geometry, Transform
subcrv = SubCurve(BaseCurve=reparameterize(item_4), Domain=dom_5)
subcrv_2 = SubCurve(BaseCurve=reparameterize(item_4), Domain=dom_6)
subcrv_3 = SubCurve(BaseCurve=reparameterize(item_4), Domain=dom_4)
end = EndPoints(Curve=subcrv_3)  # -> Start, End
subcrv_4 = SubCurve(BaseCurve=reparameterize(item_5), Domain=dom_4)
subcrv_5 = SubCurve(BaseCurve=reparameterize(item_5), Domain=dom_5)
subcrv_6 = SubCurve(BaseCurve=reparameterize(item_5), Domain=dom_6)
merge_6 = Merge(Data1=end.Start, Data2=item_7, Data3=end.End)
merge_7 = Merge(Data1=item_6.Item, Data2=move_10.Geometry, Data3=item_6.Item2)
crv_11 = Curve(subcrv_2)
crv_12 = Curve(subcrv_3)
crv_13 = Curve(subcrv)
crv_14 = Curve(subcrv_4)
pt_5 = Point(merge_6)
crv_15 = Curve(cull_i_4)
crv_16 = Curve(subcrv_6)
surface_17 = Surface(surface_16)
crv_17 = Curve(subcrv_5)
pt_6 = Point(merge_7)
pt_7 = Point(pt_6)
crv_18 = Curve(crv_11)
crv_19 = Curve(crv_12)
crv_20 = Curve(crv_13)
crv_21 = Curve(crv_14)
crv_22 = Curve(crv_15)
crv_23 = Curve(crv_16)
pt_8 = Point(pt_5)
crv_24 = Curve(crv_17)
surface_18 = Surface(surface_17)
nurbs = NurbsCurve(Vertices=pt_8, Degree=2, Periodic=False)  # -> Curve, Length, Domain
multiplication_2 = Multiplication(A="6", B="2")
reb = RebuildCurve(Curve=crv_22, Degree="1", Count="6", Tangents=False)  # -> simplify(Curve)
reb_2 = RebuildCurve(Curve=crv_24, Degree="1", Count="5", Tangents=False)  # -> simplify(Curve)
reb_3 = RebuildCurve(Curve=crv_23, Degree="1", Count="5", Tangents=False)  # -> simplify(Curve)
pline_4 = PolyLine(Vertices=pt_7, Closed=False)  # -> simplify(Polyline)
reb_4 = RebuildCurve(Curve=crv_20, Degree="1", Count="5", Tangents=False)  # -> simplify(Curve)
reb_5 = RebuildCurve(Curve=crv_18, Degree="1", Count="5", Tangents=False)  # -> simplify(Curve)
reb_6 = RebuildCurve(Curve=crv_19, Degree="1", Count="6", Tangents=False)  # -> simplify(Curve)
reb_7 = RebuildCurve(Curve=crv_21, Degree="1", Count="6", Tangents=False)  # -> simplify(Curve)
explode_6 = Explode(Curve=reb, Recursive=True)  # -> simplify(Segments), Vertices
reb_8 = RebuildCurve(Curve=nurbs.Curve, Degree="1", Count=expr("X-1", multiplication_2), Tangents=False)
explode_7 = Explode(Curve=pline_4, Recursive=True)  # -> Segments, Vertices
explode_8 = Explode(Curve=reb_5, Recursive=True)  # -> Segments, Vertices
explode_9 = Explode(Curve=reb_4, Recursive=True)  # -> Segments, Vertices
explode_10 = Explode(Curve=reb_3, Recursive=True)  # -> Segments, Vertices
explode_11 = Explode(Curve=reb_2, Recursive=True)  # -> Segments, Vertices
explode_12 = Explode(Curve=reb_7, Recursive=True)  # -> Segments, Vertices
explode_13 = Explode(Curve=reb_6, Recursive=True)  # -> Segments, Vertices
trim_2 = TrimTree(Tree=explode_6.Segments, Depth=1)
graft_5 = GraftTree(Tree=explode_8.Segments, IncludeEmptyLists=True, IncludeNullItems=True)
graft_6 = GraftTree(Tree=explode_9.Segments, IncludeEmptyLists=True, IncludeNullItems=True)
graft_7 = GraftTree(Tree=explode_10.Segments, IncludeEmptyLists=True, IncludeNullItems=True)
graft_8 = GraftTree(Tree=explode_11.Segments, IncludeEmptyLists=True, IncludeNullItems=True)
reb_9 = RebuildCurve(Curve=explode_7.Segments, Degree="1", Count="6", Tangents=False)  # -> simplify(Curve)
flip = FlipCurve(Curve=reb_8)  # -> Curve, Flag
graft_9 = GraftTree(Tree=explode_12.Segments, IncludeEmptyLists=True, IncludeNullItems=True)
graft_10 = GraftTree(Tree=explode_13.Segments, IncludeEmptyLists=True, IncludeNullItems=True)
graft_11 = GraftTree(Tree=trim_2, IncludeEmptyLists=True, IncludeNullItems=True)
explode_14 = Explode(Curve=flip.Curve, Recursive=True)  # -> simplify(Segments), Vertices
explode_15 = Explode(Curve=reb_9, Recursive=True)  # -> simplify(Segments), Vertices
end_2 = EndPoints(Curve=graft_11)  # -> Start, End
graft_12 = GraftTree(Tree=explode_14.Segments, IncludeEmptyLists=True, IncludeNullItems=True)
loft_12 = Loft(
    Curves=[graft_10, graft_9],
    Options={Adjust=False, Closed=False, LoftEnds=0, LoftSimp=0, LoftType=0, Rebuild=10, Refit=0.01})
loft_13 = Loft(
    Curves=[graft_6, graft_8],
    Options={Adjust=False, Closed=False, LoftEnds=0, LoftSimp=0, LoftType=0, Rebuild=10, Refit=0.01})
loft_14 = Loft(
    Curves=[graft_5, graft_7],
    Options={Adjust=False, Closed=False, LoftEnds=0, LoftSimp=0, LoftType=0, Rebuild=10, Refit=0.01})
graft_13 = GraftTree(Tree=explode_15.Segments, IncludeEmptyLists=True, IncludeNullItems=True)
graft_14 = GraftTree(Tree=explode_6.Segments, IncludeEmptyLists=True, IncludeNullItems=True)
end_3 = EndPoints(Curve=graft_12)  # -> Start, End
smesh = SimpleMesh(Brep=loft_12)
loft_15 = Loft(
    Curves=[graft_13, graft_14],
    Options={Adjust=False, Closed=False, LoftEnds=0, LoftSimp=0, LoftType=0, Rebuild=10, Refit=0.01})
ln_2 = Line(StartPoint=end_2.Start, EndPoint=end_3.Start)
smesh_2 = SimpleMesh(Brep=loft_14)
smesh_3 = SimpleMesh(Brep=loft_13)
ln_3 = Line(StartPoint=end_2.End, EndPoint=end_3.End)
smesh_4 = SimpleMesh(Brep=loft_15)
reb_10 = RebuildCurve(Curve=ln_2, Degree="1", Count="5", Tangents=False)  # -> simplify(Curve)
reb_11 = RebuildCurve(Curve=ln_3, Degree="1", Count="5", Tangents=False)  # -> simplify(Curve)
explode_16 = Explode(Curve=reb_11, Recursive=True)  # -> Segments, Vertices
explode_17 = Explode(Curve=reb_10, Recursive=True)  # -> Segments, Vertices
graft_15 = GraftTree(Tree=explode_17.Segments, IncludeEmptyLists=True, IncludeNullItems=True)
graft_16 = GraftTree(Tree=explode_16.Segments, IncludeEmptyLists=True, IncludeNullItems=True)
loft_16 = Loft(
    Curves=[graft_15, graft_16],
    Options={Adjust=False, Closed=False, LoftEnds=0, LoftSimp=0, LoftType=0, Rebuild=10, Refit=0.01})
smesh_5 = SimpleMesh(Brep=loft_16)
merge_8 = Merge(Data1=smesh_4, Data2=smesh_5, Data3=smesh_2, Data4=smesh_3, Data5=smesh)  # -> flatten(Result)
mesh = Mesh(merge_8)
surface_19 = Surface(surface_18)
mesh_2 = Mesh(mesh)
surface_20 = Surface(surface_19)
wbjoin = WeaverbirdsJoinMeshesAndWeld(Mesh=mesh_2, Weld=invert(False))
unim = UnifyMesh(Mesh=wbjoin)  # -> Result, Count
medges = MeshEdges(Mesh=unim.Result)  # -> NakedEdges, InteriorEdges, NonManifoldEdges
crv_25 = Curve(medges.NakedEdges)
join_4 = JoinCurves(Curves=crv_25, Preserve=False)
len_2 = Length(Curve=join_4)
sort_3 = SortList(Keys=len_2, ValuesA=join_4)  # -> Keys, reverse(ValuesA)
panel_4 = Panel("""0
1""")
cull_i_5 = CullIndex(List=sort_3.ValuesA, Indices=panel_4, Wrap=True)
area_4 = Area(Geometry=cull_i_5)  # -> Area, Centroid
brep_cp_4 = BrepClosestPoint(Point=area_4.Centroid, Brep=surface_20)  # -> Point, Normal, Distance
scale_9 = Scale(Geometry=cull_i_5, Center=area_4.Centroid, Factor="0.8")  # -> Geometry, Transform
amp_6 = Amplitude(Vector=brep_cp_4.Normal, Amplitude="0.1")
amp_7 = Amplitude(Vector=brep_cp_4.Normal, Amplitude="0.2")
scale_10 = Scale(Geometry=cull_i_5, Center=area_4.Centroid, Factor="0.9")  # -> Geometry, Transform
move_11 = Move(Geometry=scale_10.Geometry, Motion=amp_6)  # -> Geometry, Transform
move_12 = Move(Geometry=scale_9.Geometry, Motion=amp_7)  # -> Geometry, Transform
move_13 = Move(Geometry=cull_i_5, Motion=amp_6)  # -> Geometry, Transform
move_14 = Move(Geometry=scale_10.Geometry, Motion=amp_7)  # -> Geometry, Transform
explode_18 = Explode(Curve=move_13.Geometry, Recursive=True)  # -> simplify(Segments), Vertices
explode_19 = Explode(Curve=move_11.Geometry, Recursive=True)  # -> simplify(Segments), Vertices
explode_20 = Explode(Curve=move_12.Geometry, Recursive=True)  # -> simplify(Segments), Vertices
explode_21 = Explode(Curve=move_14.Geometry, Recursive=True)  # -> simplify(Segments), Vertices
graft_17 = GraftTree(Tree=explode_18.Segments, IncludeEmptyLists=True, IncludeNullItems=True)
graft_18 = GraftTree(Tree=explode_19.Segments, IncludeEmptyLists=True, IncludeNullItems=True)
graft_19 = GraftTree(Tree=explode_20.Segments, IncludeEmptyLists=True, IncludeNullItems=True)
graft_20 = GraftTree(Tree=explode_21.Segments, IncludeEmptyLists=True, IncludeNullItems=True)
loft_17 = Loft(
    Curves=[graft_19, graft_20],
    Options={Adjust=False, Closed=False, LoftEnds=0, LoftSimp=0, LoftType=0, Rebuild=10, Refit=0.01})
loft_18 = Loft(
    Curves=[graft_17, graft_18],
    Options={Adjust=False, Closed=False, LoftEnds=0, LoftSimp=0, LoftType=0, Rebuild=10, Refit=0.01})
extr = Extrude(Base=cull_i_5, Direction=amp_6)
loft_19 = Loft(
    Curves=[graft_18, graft_20],
    Options={Adjust=False, Closed=False, LoftEnds=0, LoftSimp=0, LoftType=0, Rebuild=10, Refit=0.01})
debrep = DeconstructBrep(Brep=extr)  # -> Faces, Edges, Vertices
smesh_6 = SimpleMesh(Brep=loft_19)
smesh_7 = SimpleMesh(Brep=loft_17)
smesh_8 = SimpleMesh(Brep=loft_18)
smesh_9 = SimpleMesh(Brep=debrep.Faces)  # -> simplify(Mesh)
trim_3 = TrimTree(Tree=smesh_7, Depth=1)
trim_4 = TrimTree(Tree=smesh_8, Depth=1)
trim_5 = TrimTree(Tree=smesh_6, Depth=1)
merge_9 = Merge(Data1=smesh_9, Data2=trim_4, Data3=trim_5, Data4=trim_3)
wbjoin_2 = WeaverbirdsJoinMeshesAndWeld(Mesh=merge_9, Weld=invert(False))
merge_10 = Merge(Data1=unim.Result, Data2=wbjoin_2)

number_slider_3 = Slider(0.58, range=0.5..1)
subtraction_4 = Subtraction(A="1", B=number_slider_3)
dom_7 = ConstructDomain(DomainStart=number_slider_3, DomainEnd=subtraction_4)
subcrv_7 = SubCurve(BaseCurve=reparameterize(explode_3.Segments), Domain=dom_7)
midpt_3 = CurveMiddle(Curve=subcrv_7)
brep_cp_5 = BrepClosestPoint(Point=midpt_3, Brep=surface_11)  # -> Point, Normal, Distance
len_3 = Length(Curve=explode_3.Segments)
len_4 = Length(Curve=subcrv_7)
neg = Negative(Value="0.5")
division_2 = Division(A=len_4, B=len_3)
amp_8 = Amplitude(Vector=brep_cp_5.Normal, Amplitude=neg)
avr_3 = Average(Input=division_2)  # -> flatten(ArithmeticMean)
scale_11 = Scale(Geometry=crv_4, Center=flatten(avr_2), Factor=avr_3)  # -> Geometry, Transform
brep_cp_6 = BrepClosestPoint(Point=avr_2, Brep=surface_11)  # -> Point, Normal, Distance
move_15 = Move(Geometry=subcrv_7, Motion=amp_8)  # -> Geometry, Transform
explode_22 = Explode(Curve=crv_4, Recursive=True)  # -> Segments, Vertices
amp_9 = Amplitude(Vector=brep_cp_6.Normal, Amplitude="2.5")
move_16 = Move(Geometry=graft(scale_11.Geometry), Motion=amp_9)  # -> Geometry, Transform
explode_23 = Explode(Curve=move_16.Geometry, Recursive=True)  # -> Segments, Vertices
crv_26 = Curve(move_15.Geometry)
crv_27 = Curve(explode_23.Segments)
pt_9 = Point(explode_23.Vertices)
crv_28 = Curve(explode_22.Segments)
srf_3 = Surface(surface_11)
crv_29 = Curve(crv_26)
srf_4 = Surface(srf_3)
crv_30 = Curve(crv_27)
pt_10 = Point(pt_9)
crv_31 = Curve(crv_28)
end_4 = EndPoints(Curve=crv_29)  # -> Start, End
end_5 = EndPoints(Curve=crv_30)  # -> Start, End
lng_2 = ListLength(List=crv_31)
len_5 = Length(Curve=crv_31)
ma_2 = MassAddition(Input=len_5)  # -> flatten(Result), PartialResults
duppt_4 = RemoveDuplicatePts(Points=pt_10, Tolerance=0.01)
ln_4 = Line(StartPoint=end_5.Start, EndPoint=end_4.Start)
ln_5 = Line(StartPoint=end_5.End, EndPoint=end_4.End)
pull_3 = PullCurve(Curve=ln_4, Surface=srf_4)  # -> graft(Curve)
pull_4 = PullCurve(Curve=ln_5, Surface=srf_4)  # -> graft(Curve)
del = DelaunayMesh(Points=duppt_4, Plane=PlaneXY(0, 0, 0))
panel_5 = Panel("""0
1""")
bnd_3 = Bounds(Numbers=ma_2.Result)
dom_8 = ConstructDomain(DomainStart="3", DomainEnd="6")
dom_9 = ConstructDomain(DomainStart="2", DomainEnd="4")
eval = EvaluateCurve(Curve=reparameterize(pull_3), Parameter=panel_5)  # -> Point, Tangent, Angle
eval_2 = EvaluateCurve(Curve=reparameterize(pull_4), Parameter=panel_5)  # -> Point, Tangent, Angle
remap_3 = RemapNumbers(Value=ma_2.Result, Source=bnd_3, Target=dom_9)  # -> graft(Mapped), Clipped
item_8 = ListItem(List=eval.Tangent, Index=0, Wrap=True)  # -> Item, Item1
remap_4 = RemapNumbers(Value=ma_2.Result, Source=bnd_3, Target=dom_8)  # -> graft(Mapped), Clipped
item_9 = ListItem(List=eval_2.Tangent, Index=0, Wrap=True)  # -> Item, Item1
dup_3 = DuplicateData(Data=remap_4.Mapped, Number=lng_2, Order=True)  # -> simplify(graft(Data))
dup_4 = DuplicateData(Data=remap_3.Mapped, Number=lng_2, Order=True)  # -> simplify(graft(Data))
amp_10 = Amplitude(Vector=item_9.Item, Amplitude=dup_3)
amp_11 = Amplitude(Vector=item_8.Item, Amplitude=dup_3)
amp_12 = Amplitude(Vector=item_9.Item1, Amplitude=dup_4)
amp_13 = Amplitude(Vector=item_8.Item1, Amplitude=dup_4)
rev = Reverse(Vector=amp_13)
rev_2 = Reverse(Vector=amp_12)
bzspan = BezierSpan(StartPoint=graft(end_5.Start), StartTangent=amp_11, EndPoint=graft(end_4.Start), EndTangent=rev)  # -> Curve, Length, Domain
bzspan_2 = BezierSpan(StartPoint=graft(end_5.End), StartTangent=amp_10, EndPoint=graft(end_4.End), EndTangent=rev_2)  # -> Curve, Length, Domain
divide = DivideCurve(Curve=bzspan.Curve, Count=10, Kinks=False)  # -> Points, Tangents, Parameters
divide_2 = DivideCurve(Curve=bzspan_2.Curve, Count=10, Kinks=False)  # -> Points, Tangents, Parameters
merge_11 = Merge(Data1=bzspan.Curve, Data2=bzspan_2.Curve)  # -> flatten(Result)
shatter = Shatter(Curve=bzspan.Curve, Parameters=divide.Parameters)
shatter_2 = Shatter(Curve=bzspan_2.Curve, Parameters=divide_2.Parameters)
graft_21 = GraftTree(Tree=shatter, IncludeEmptyLists=True, IncludeNullItems=True)
graft_22 = GraftTree(Tree=shatter_2, IncludeEmptyLists=True, IncludeNullItems=True)
loft_20 = Loft(
    Curves=[graft_21, graft_22],
    Options={Adjust=False, Closed=False, LoftEnds=0, LoftSimp=0, LoftType=0, Rebuild=10, Refit=0.01})  # -> flatten(Loft)
mesh_3 = Mesh(del)
crv_32 = Curve(merge_11)
srf_5 = Surface(loft_20)
srf_6 = Surface(srf_5)
mesh_4 = Mesh(mesh_3)
crv_33 = Curve(crv_32)
smesh_10 = SimpleMesh(Brep=srf_6)
merge_12 = Merge(Data1=mesh_4, Data2=smesh_10)  # -> flatten(Result)
mp = MultiPipe(Curves=crv_33, NodeSize="0.15", EndOffset=1, StrutSize=1, Segment=0, KinkAngle=0.6, CubeFit=0, Caps=0)
wbjoin_3 = WeaverbirdsJoinMeshesAndWeld(Mesh=merge_12, Weld=invert(False))
unim_2 = UnifyMesh(Mesh=wbjoin_3)  # -> Result, Count
meshsubd = MeshFromSubD(SubD=mp, Density=2)
wbthicken = WeaverbirdsMeshThicken(MeshCurves=unim_2.Result, Distance="0.1", OffsetType=0)
