# Grasshopper definition #59_chinese_texture5.gh (Grasshopper 1.0.7)
# plug-ins: Bifocals, Weaverbird, Kangaroo2 Components

yz_plane = YZPlane(Origin=Point(0, 0, 0))
curve = Curve(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)
project = Project(Geometry=curve, Plane=yz_plane)  # -> Geometry, Transform
division = Division(A="140", B="100")
subtraction = Subtraction(A="100", B="1")
series = Series(Start=0, Step=division, Count="100")
divide_curve = DivideCurve(Curve=project.Geometry, Count=subtraction, Kinks=False)  # -> Points, Tangents, Parameters
divide_curve_2 = DivideCurve(Curve=curve, Count=subtraction, Kinks=False)  # -> Points, Tangents, Parameters
circle = Circle(Plane=PlaneXY(0, 0, 0), Radius="50")
unit_z = UnitZ(Factor=series)
distance = Distance(PointA=divide_curve_2.Points, PointB=divide_curve.Points)
move = Move(Geometry=circle, Motion=unit_z)  # -> Geometry, Transform
reverse_list = ReverseList(List=distance)
construct_domain = ConstructDomain(DomainStart=Slider(0.19, range=0..1), DomainEnd=Slider(0.68, range=0..2))
area = Area(Geometry=move.Geometry)  # -> Area, Centroid
bounds = Bounds(Numbers=reverse_list)
remap_numbers = RemapNumbers(Value=reverse_list, Source=bounds, Target=construct_domain)  # -> Mapped, Clipped
scale = Scale(Geometry=move.Geometry, Center=area.Centroid, Factor=remap_numbers.Mapped)  # -> Geometry, Transform
loft = Loft(Curves=scale.Geometry, Options={Adjust=False, Closed=False, LoftEnds=0, LoftSimp=0, LoftType=0, Rebuild=10, Refit=0.01})
surface = Surface(loft)
surface_2 = Surface(surface)
addition = Addition(A="8", B="1")
division_2 = Division(A="1", B="8")
series_2 = Series(Start=0, Step=division_2, Count=addition)
pi = Pi(Factor=Slider(0.15, range=0..1))
pt = ConstructPoint(XCoordinate=series_2, YCoordinate="0", ZCoordinate=0)
series_3 = Series(Start=0, Step=pi, Count=addition)
iso = IsoCurve(Surface=reparameterize(surface_2), UVPoint=pt)  # -> UIsocurve, VIsocurve
neg = Negative(Value=series_3)
crv = Curve(flatten(iso.VIsocurve))
area_2 = Area(Geometry=crv)  # -> Area, Centroid
rotate = Rotate(Geometry=crv, Angle=neg, Plane=area_2.Centroid)  # -> Geometry, Transform
rotate_2 = Rotate(Geometry=crv, Angle=series_3, Plane=area_2.Centroid)  # -> Geometry, Transform
divide = DivideCurve(Curve=rotate_2.Geometry, Count=10, Kinks=False)  # -> simplify(Points), Tangents, Parameters
divide_2 = DivideCurve(Curve=rotate.Geometry, Count=10, Kinks=False)  # -> simplify(Points), Tangents, Parameters
flip = FlipMatrix(Data=divide.Points)
flip_2 = FlipMatrix(Data=divide_2.Points)
intcrv = Interpolate(Vertices=flip, Degree=3, Periodic=False, KnotStyle=1)  # -> Curve, Length, Domain
intcrv_2 = Interpolate(Vertices=flip_2, Degree=3, Periodic=False, KnotStyle=1)  # -> Curve, Length, Domain
merge = Merge(Data1=intcrv.Curve, Data2=intcrv_2.Curve)  # -> flatten(Result)
srfsplit = SurfaceSplit(Surface=surface_2, Curves=merge)  # -> flatten(Fragments)
edges = BrepEdges(Brep=srfsplit)  # -> Naked, Interior, NonManifold
lng = ListLength(List=edges.Naked)
equals = Equality(FirstNumber=lng, SecondNumber="4")  # -> flatten(Equality), Inequality
dispatch = Dispatch(List=srfsplit, DispatchPattern=equals.Equality)  # -> ListA, ListB
brep = Brep(dispatch.ListA)
brep_2 = Brep(dispatch.ListB)
surface_3 = Surface(surface_2)
brep_3 = Brep(brep)
brep_4 = Brep(brep_2)
surface_4 = Surface(surface_3)
area_3 = Area(Geometry=brep_4)  # -> Area, Centroid
pdecon = Deconstruct(Point=area_3.Centroid)  # -> XComponent, YComponent, ZComponent
round = Round(Number=pdecon.ZComponent)  # -> Nearest, Floor, Ceiling
sort = SortList(Keys=round.Nearest, ValuesA=brep_4)  # -> Keys, ValuesA
cset = CreateSet(List=sort.Keys)  # -> Set, Map
mindex = MemberIndex(Set=sort.Keys, Member=cset.Set)  # -> Index, Count
item = ListItem(List=sort.ValuesA, Index=mindex.Index, Wrap=True)  # -> simplify(Item)
tstat = TreeStatistics(Tree=item)  # -> Paths, Length, Count
srf = Surface(brep_3)
panel = Panel("""0
-1""")
item_2 = ListItem(List=tstat.Paths, Index=panel, Wrap=True)
cull_i = CullIndex(List=tstat.Paths, Indices=panel, Wrap=True)
branch = TreeBranch(Tree=item, Path=cull_i, MaintainPaths=True)
join = BrepJoin(Breps=branch)  # -> Breps, Closed
edges_2 = BrepEdges(Brep=join.Breps)  # -> Naked, Interior, NonManifold
item_3 = ListItem(List=edges_2.Naked, Index=0, Wrap=True)  # -> Item, Item1, Item2, Item3
edgesrf = EdgeSurface(CurveA=item_3.Item, CurveB=item_3.Item1, CurveC=item_3.Item2, CurveD=item_3.Item3)
branch_2 = TreeBranch(Tree=item, Path=item_2, MaintainPaths=True)  # -> flatten(Branch)
merge_2 = Merge(Data1=srf, Data2=edgesrf)  # -> flatten(Result)
brep_5 = Brep(merge_2)
brep_6 = Brep(branch_2)
surface_5 = Surface(surface_4)
brep_7 = Brep(brep_6)
brep_8 = Brep(brep_5)
surface_6 = Surface(surface_5)

edges_3 = BrepEdges(Brep=brep_8)  # -> Naked, Interior, NonManifold
pull = PullCurve(Curve=edges_3.Naked, Surface=surface_6)
item_4 = ListItem(List=pull, Index=0, Wrap=True)  # -> Item, Item1, Item2, Item3
edgesrf_2 = EdgeSurface(CurveA=item_4.Item, CurveB=item_4.Item1, CurveC=item_4.Item2, CurveD=item_4.Item3)
graft = GraftTree(Tree=brep_8, IncludeEmptyLists=True, IncludeNullItems=True)
area_4 = Area(Geometry=edgesrf_2)  # -> Area, Centroid
brep_cp = BrepClosestPoint(Point=area_4.Centroid, Brep=edgesrf_2)  # -> Point, Normal, Distance
pl = PlaneNormal(Origin=brep_cp.Point, ZAxis=brep_cp.Normal)
bbox = BoundingBox(Content=edgesrf_2, Plane=pl)  # -> Box, Box_2
edges_4 = BrepEdges(Brep=bbox.Box)  # -> Naked, Interior, NonManifold
Z = UnitZ(Factor=1)
vec = Vector(edges_4.Interior)
dprod = DotProduct(VectorA=vec, VectorB=Z, Unitize=False)
abs = Absolute(Value=dprod)
sort_2 = SortList(Keys=abs, ValuesA=edges_4.Interior)  # -> Keys, ValuesA
item_5 = ListItem(List=sort_2.ValuesA, Index=0, Wrap=True)
len = Length(Curve=item_5)
multiplication = Multiplication(A=len, B="0.2")
cir = Circle(Plane=pl, Radius=multiplication)
pull_2 = PullCurve(Curve=cir, Surface=graft)
srfsplit_2 = SurfaceSplit(Surface=graft, Curves=pull_2)
brep_9 = Brep(brep_7)
brep_10 = Brep(srfsplit_2)
brep_11 = Brep(brep_10)
brep_12 = Brep(brep_9)
area_5 = Area(Geometry=brep_11)  # -> Area, Centroid
sort_3 = SortList(Keys=area_5.Area, ValuesA=brep_11)  # -> Keys, reverse(ValuesA)
item_6 = ListItem(List=sort_3.ValuesA, Index=0, Wrap=True)  # -> flatten(Item)
merge_3 = Merge(Data1=item_6, Data2=brep_12)  # -> flatten(Result)
join_2 = BrepJoin(Breps=merge_3)  # -> Breps, Closed
mesh = MeshBrep(
    Brep=join_2.Breps,
    Settings={GridMaxCount=0, GridMinCount=16, JaggedSeams=False, MaxEdgeLength=0, MinEdgeLength=0.0001, MinTolerance=0, Refine=True, RefineAngle=0, RelativeTolerance=0.65, SimplePlanes=True, Tolerance=0})
wbthicken = WeaverbirdsMeshThicken(MeshCurves=mesh, Distance="1", OffsetType=0)
wbcatmullclark = WeaverbirdsCatmullClarkSubdivision(MeshCurves=wbthicken, Level="2", SmoothNakedEdges=1)

debrep = DeconstructBrep(Brep=brep_8)  # -> Faces, Edges, flatten(Vertices)
duppt = RemoveDuplicatePts(Points=debrep.Vertices, Tolerance=0.01)
crv_2 = Curve(flatten(debrep.Edges))
midpt = CurveMiddle(Curve=crv_2)
pdecon_2 = Deconstruct(Point=duppt)  # -> XComponent, YComponent, ZComponent
duppt_2 = RemoveDuplicatePts(Points=midpt, Tolerance=0.01)
sort_4 = SortList(Keys=pdecon_2.ZComponent, ValuesA=duppt)  # -> Keys, ValuesA
mindex_2 = MemberIndex(Set=midpt, Member=duppt_2)  # -> Index, Count
round_2 = Round(Number=sort_4.Keys)  # -> Nearest, Floor, Ceiling
cset_2 = CreateSet(List=round_2.Nearest)  # -> Set, Map
panel_2 = Panel("""0
-1""")
item_7 = ListItem(List=mindex_2.Index, Index=0, Wrap=True)
mindex_3 = MemberIndex(Set=round_2.Nearest, Member=cset_2.Set)  # -> Index, Count
tstat_2 = TreeStatistics(Tree=mindex_3.Index)  # -> Paths, Length, Count
item_8 = ListItem(List=crv_2, Index=item_7, Wrap=True)
cull_i_2 = CullIndex(List=tstat_2.Paths, Indices=panel_2, Wrap=True)
cull_i_3 = CullIndex(List=cset_2.Set, Indices=panel_2, Wrap=True)
bnd = Bounds(Numbers=cull_i_3)
midpt_2 = CurveMiddle(Curve=flatten(item_8))
neg_2 = Negative(Value="0.3")
remap = RemapNumbers(Value=cull_i_3, Source=bnd, Target=Domain(0, 1))  # -> Mapped, Clipped
offsets = OffsetOnSrf(Curve=item_8, Distance=neg_2, Surface=surface_6)
offsets_2 = OffsetOnSrf(Curve=item_8, Distance="0.3", Surface=surface_6)
branch_3 = TreeBranch(Tree=mindex_3.Index, Path=cull_i_2, MaintainPaths=True)
pdecon_3 = Deconstruct(Point=midpt_2)  # -> XComponent, YComponent, ZComponent
bnd_2 = Bounds(Numbers=pdecon_3.ZComponent)
dom = ConstructDomain(DomainStart="0.1", DomainEnd="0.05")
graph = GraphMapper(
    remap.Mapped,
    x0=0,
    x1=1,
    y0=0,
    y1=1,
    container_name="Bezier",
    cpx=[0, 0.5272623897, 0.6908012033, 1],
    cpy=[0.7377619743, 0.9997938871, 0.3158958554, 0.310320437])
item_9 = ListItem(List=sort_4.ValuesA, Index=branch_3, Wrap=True)
remap_2 = RemapNumbers(Value=pdecon_3.ZComponent, Source=bnd_2, Target=dom)  # -> Mapped, Clipped
subtraction_2 = Subtraction(A="1", B=remap_2.Mapped)
brep_cp_2 = BrepClosestPoint(Point=item_9, Brep=surface_6)  # -> Point, Normal, Distance
graft_2 = GraftTree(Tree=graph, IncludeEmptyLists=True, IncludeNullItems=True)
dom_2 = ConstructDomain(DomainStart=remap_2.Mapped, DomainEnd=subtraction_2)  # -> graft(Domain)
pl_2 = PlaneNormal(Origin=brep_cp_2.Point, ZAxis=brep_cp_2.Normal)
multiplication_2 = Multiplication(A=graft_2, B=Slider(2.87, range=0..10))
subcrv = SubCurve(BaseCurve=reparameterize(offsets_2), Domain=dom_2)
subcrv_2 = SubCurve(BaseCurve=reparameterize(offsets), Domain=dom_2)
cir_2 = Circle(Plane=pl_2, Radius=multiplication_2)
crv_3 = Curve(subcrv_2)
crv_4 = Curve(subcrv)
crv_5 = Curve(crv_3)
crv_6 = Curve(crv_4)
scale_2 = Scale(Geometry=cir_2, Center=pl_2, Factor=0.5)  # -> Geometry, Transform
loft_2 = Loft(Curves=[crv_6, crv_5], Options={Adjust=False, Closed=False, LoftEnds=0, LoftSimp=0, LoftType=0, Rebuild=10, Refit=0.01})  # -> simplify(Loft)
pull_3 = PullCurve(Curve=scale_2.Geometry, Surface=surface_6)
pull_4 = PullCurve(Curve=cir_2, Surface=surface_6)
edges_5 = BrepEdges(Brep=loft_2)  # -> graft(Naked), Interior, NonManifold
offset = OffsetSurface(Surface=loft_2, Distance="-0.75", Retrim=True)  # -> simplify(Surface)
amp = Amplitude(Vector=brep_cp_2.Normal, Amplitude="1")  # -> graft(Vector)
graft_3 = GraftTree(Tree=pull_4, IncludeEmptyLists=True, IncludeNullItems=True)
graft_4 = GraftTree(Tree=pull_3, IncludeEmptyLists=True, IncludeNullItems=True)
edges_6 = BrepEdges(Brep=offset)  # -> graft(Naked), Interior, NonManifold
rev = Reverse(Vector=amp)
loft_3 = Loft(
    Curves=[graft_3, graft_4],
    Options={Adjust=False, Closed=False, LoftEnds=0, LoftSimp=0, LoftType=0, Rebuild=10, Refit=0.01})
loft_4 = Loft(
    Curves=[edges_5.Naked, edges_6.Naked],
    Options={Adjust=False, Closed=False, LoftEnds=0, LoftSimp=0, LoftType=0, Rebuild=10, Refit=0.01})
extr = Extrude(Base=loft_3, Direction=rev)
trim = TrimTree(Tree=loft_4, Depth=1)  # -> simplify(Tree)
mesh_2 = MeshBrep(
    Brep=extr,
    Settings={GridMaxCount=0, GridMinCount=16, JaggedSeams=False, MaxEdgeLength=0, MinEdgeLength=0.0001, MinTolerance=0, Refine=True, RefineAngle=0, RelativeTolerance=0.65, SimplePlanes=True, Tolerance=0})
merge_4 = Merge(Data1=loft_2, Data2=trim, Data3=offset)
join_3 = BrepJoin(Breps=merge_4)  # -> Breps, Closed
mesh_3 = MeshBrep(
    Brep=join_3.Breps,
    Settings={GridMaxCount=0, GridMinCount=16, JaggedSeams=False, MaxEdgeLength=0, MinEdgeLength=0.0001, MinTolerance=0, Refine=True, RefineAngle=0, RelativeTolerance=0.65, SimplePlanes=True, Tolerance=0})
merge_5 = Merge(Data1=mesh_3, Data2=mesh_2)

pt_2 = Point(flatten(area_4.Centroid))
panel_3 = Panel("""0
1
-2
-1""")
cull_i_4 = CullIndex(List=tstat_2.Paths, Indices=panel_3, Wrap=True)
pdecon_4 = Deconstruct(Point=pt_2)  # -> XComponent, YComponent, ZComponent
branch_4 = TreeBranch(Tree=mindex_3.Index, Path=cull_i_4, MaintainPaths=True)
round_3 = Round(Number=pdecon_4.ZComponent)  # -> Nearest, Floor, Ceiling
sort_5 = SortList(Keys=round_3.Ceiling, ValuesA=pt_2)  # -> Keys, ValuesA
item_10 = ListItem(List=sort_4.ValuesA, Index=branch_4, Wrap=True)  # -> simplify(Item)
cset_3 = CreateSet(List=sort_5.Keys)  # -> Set, Map
path_mapper = PathMapper(item_10, source="{A}", target="{path_index}")
mindex_4 = MemberIndex(Set=sort_5.Keys, Member=cset_3.Set)  # -> Index, Count
item_11 = ListItem(List=sort_5.ValuesA, Index=mindex_4.Index, Wrap=True)  # -> simplify(Item)
path_mapper_2 = PathMapper(item_11, source="{A}", target="{path_index}")
avr = Average(Input=path_mapper)
avr_2 = Average(Input=path_mapper_2)
cir_3 = Circle(Plane=avr, Radius=1)
cir_4 = Circle(Plane=avr_2, Radius=1)
rotate_3 = Rotate(Geometry=cir_3, Angle="0.01", Plane=PlaneXY(0, 0, 0))  # -> Geometry, Transform
rotate_4 = Rotate(Geometry=cir_4, Angle="0.01", Plane=PlaneXY(0, 0, 0))  # -> Geometry, Transform
alongcrv = SortAlongCurve(Points=path_mapper, Curve=rotate_3.Geometry)  # -> simplify(graft(Points)), Indices
alongcrv_2 = SortAlongCurve(Points=path_mapper_2, Curve=rotate_4.Geometry)  # -> simplify(graft(Points)), Indices
split = SplitTree(Data=alongcrv_2.Points, Masks=flatten("{0,2,...;*}"))  # -> Positive, Negative
split_2 = SplitTree(Data=alongcrv.Points, Masks=flatten("{0,2,...;*}"))  # -> Positive, Negative
relitem2 = RelativeItems(TreeA=alongcrv.Points, TreeB=alongcrv_2.Points, Offset="{+1;+0}", WrapPaths=invert(False), WrapItems=False)  # -> ItemA, ItemB
relitem2_2 = RelativeItems(TreeA=split_2.Positive, TreeB=split.Negative, Offset="{+1;+1}", WrapPaths=invert(False), WrapItems=False)  # -> ItemA, ItemB
relitem2_3 = RelativeItems(TreeA=split_2.Negative, TreeB=split.Positive, Offset="{+1;-1}", WrapPaths=invert(False), WrapItems=False)  # -> ItemA, ItemB
relitem2_4 = RelativeItems(TreeA=alongcrv.Points, TreeB=alongcrv_2.Points, Offset="{+2;+0}", WrapPaths=False, WrapItems=False)  # -> ItemA, ItemB
relitem2_5 = RelativeItems(TreeA=alongcrv.Points, TreeB=alongcrv_2.Points, Offset="{+0;+0}", WrapPaths=False, WrapItems=False)  # -> ItemA, ItemB
ln = Line(StartPoint=relitem2_2.ItemA, EndPoint=relitem2_2.ItemB)
ln_2 = Line(StartPoint=relitem2_3.ItemA, EndPoint=relitem2_3.ItemB)
ln_3 = Line(StartPoint=relitem2_4.ItemA, EndPoint=relitem2_4.ItemB)
ln_4 = Line(StartPoint=relitem2.ItemA, EndPoint=relitem2.ItemB)
ln_5 = Line(StartPoint=relitem2_5.ItemA, EndPoint=relitem2_5.ItemB)
merge_6 = Merge(Data1=ln, Data2=ln_2)
merge_7 = Merge(Data1=ln_5, Data2=ln_3, Data3=ln_4, Data4=merge_6)
dom_3 = ConstructDomain(DomainStart=0, DomainEnd=Slider(0.75, range=0..1))
subcrv_3 = SubCurve(BaseCurve=reparameterize(merge_7), Domain=dom_3)
end = EndPoints(Curve=subcrv_3)  # -> Start, End
item_12 = ListItem(List=end.Start, Index=0, Wrap=True)
pt_3 = ConstructPoint(XCoordinate=0, YCoordinate=0, ZCoordinate=0)
brep_cp_3 = BrepClosestPoint(Point=item_12, Brep=surface_6)  # -> Point, Normal, Distance
pl_3 = PlaneNormal(Origin=brep_cp_3.Point, ZAxis=brep_cp_3.Normal)
cir_5 = Circle(Plane=pl_3, Radius=1)
crv_cp = CurveClosestPoint(Point=pt_3, Curve=cir_5)  # -> Point, Parameter, Distance
seam = Seam(Curve=cir_5, Seam=crv_cp.Parameter)
pi_2 = Pi(Factor="0.01")
rotate_5 = Rotate(Geometry=seam, Angle=pi_2, Plane=pl_3)  # -> Geometry, Transform
trim_2 = TrimTree(Tree=alongcrv_2.Points, Depth=1)
alongcrv_3 = SortAlongCurve(Points=end.End, Curve=rotate_5.Geometry)  # -> simplify(Points), Indices
tstat_3 = TreeStatistics(Tree=trim_2)  # -> Paths, Length, Count
tstat_4 = TreeStatistics(Tree=branch_4)  # -> Paths, Length, Count
panel_4 = Panel("""0
-1""")
lng_2 = ListLength(List=tstat_4.Paths)
cull_i_5 = CullIndex(List=tstat_3.Paths, Indices=panel_4, Wrap=True)
pline = PolyLine(Vertices=alongcrv_3.Points, Closed=invert(False))
brep_cp_4 = BrepClosestPoint(Point=alongcrv_3.Points, Brep=surface_6)  # -> Point, Normal, Distance
Z_2 = UnitZ(Factor=1)
series_4 = Series(Start=0, Step=1, Count=lng_2)
branch_5 = TreeBranch(Tree=trim_2, Path=cull_i_5, MaintainPaths=True)
explode = Explode(Curve=pline, Recursive=True)  # -> simplify(Segments), Vertices
xprod = CrossProduct(VectorA=brep_cp_4.Point, VectorB=Z_2, Unitize=invert(False))  # -> Vector, Length
bnd_3 = Bounds(Numbers=series_4)
dom_4 = ConstructDomain(DomainStart="2.6", DomainEnd="1")
midpt_3 = CurveMiddle(Curve=explode.Segments)
xprod_2 = CrossProduct(VectorA=xprod.Vector, VectorB=brep_cp_4.Normal, Unitize=False)  # -> Vector, Length
remap_3 = RemapNumbers(Value=series_4, Source=bnd_3, Target=dom_4)  # -> Mapped, Clipped
dispatch_2 = Dispatch(List=xprod_2.Vector, DispatchPattern=[True, False])  # -> ListA, ListB
dispatch_3 = Dispatch(List=xprod.Vector, DispatchPattern=[True, False])  # -> ListA, ListB
dup = DuplicateData(Data=graft(remap_3.Mapped), Number=graft(tstat_4.Length), Order=True)  # -> simplify(graft(Data))
weave = Weave(Pattern=[0, 1], Stream0=dispatch_2.ListB, Stream1=dispatch_3.ListA, NullGaps=False)
rev_2 = Reverse(Vector=weave)
split_3 = SplitList(List=weave, Index="2")  # -> ListA, ListB
split_4 = SplitList(List=rev_2, Index="2")  # -> ListA, ListB
merge_8 = Merge(Data1=split_3.ListA, Data2=split_4.ListB)
amp_2 = Amplitude(Vector=merge_8, Amplitude=dup)
shift = ShiftList(List=amp_2, Shift=1, Wrap=True)
shift_2 = ShiftList(List=midpt_3, Shift="-1", Wrap=True)
rev_3 = Reverse(Vector=amp_2)
bzspan = BezierSpan(StartPoint=alongcrv_3.Points, StartTangent=amp_2, EndPoint=shift_2, EndTangent=shift)  # -> Curve, Length, Domain
bzspan_2 = BezierSpan(StartPoint=alongcrv_3.Points, StartTangent=rev_3, EndPoint=midpt_3, EndTangent=shift)  # -> Curve, Length, Domain
merge_9 = Merge(Data1=bzspan_2.Curve, Data2=bzspan.Curve)
join_4 = JoinCurves(Curves=merge_9, Preserve=False)
offset_2 = OffsetSurface(Surface=surface_6, Distance="-3.5", Retrim=True)
offset_3 = OffsetSurface(Surface=surface_6, Distance="-1.5", Retrim=True)
pull_5 = PullCurve(Curve=join_4, Surface=offset_3)
srfsplit_3 = SurfaceSplit(Surface=offset_3, Curves=flatten(pull_5))
area_6 = Area(Geometry=srfsplit_3)  # -> Area, Centroid
brep_cp_5 = BrepClosestPoint(Point=branch_5, Brep=offset_2)  # -> Point, Normal, Distance
sort_6 = SortList(Keys=area_6.Area, ValuesA=srfsplit_3)  # -> Keys, reverse(ValuesA)
brep_cp_6 = BrepClosestPoint(Point=trim_2, Brep=offset_2)  # -> Point, Normal, Distance
match = MatchTree(Tree=brep_cp_5.Point, Guide=branch_5)
item_13 = ListItem(List=sort_6.ValuesA, Index=0, Wrap=True)
mesh_4 = MeshBrep(
    Brep=item_13,
    Settings={GridMaxCount=0, GridMinCount=16, JaggedSeams=False, MaxEdgeLength=0, MinEdgeLength=0.0001, MinTolerance=0, Refine=True, RefineAngle=0, RelativeTolerance=0.65, SimplePlanes=True, Tolerance=0})
graft_5 = GraftTree(Tree=brep_cp_6.Point, IncludeEmptyLists=True, IncludeNullItems=True)  # -> simplify(Tree)
graft_6 = GraftTree(Tree=match, IncludeEmptyLists=True, IncludeNullItems=True)  # -> simplify(Tree)
split_5 = SplitTree(Data=graft_5, Masks=flatten("{0,2,...;*}"))  # -> Positive, Negative
split_6 = SplitTree(Data=graft_6, Masks=flatten("{0,2,...;*}"))  # -> Positive, Negative
wbthicken_2 = WeaverbirdsMeshThicken(MeshCurves=mesh_4, Distance="-2", OffsetType=0)
relitem2_6 = RelativeItems(TreeA=graft_6, TreeB=graft_5, Offset="{-1;+0}", WrapPaths=invert(False), WrapItems=False)  # -> ItemA, ItemB
relitem2_7 = RelativeItems(TreeA=graft_6, TreeB=graft_5, Offset="{+1;+0}", WrapPaths=invert(False), WrapItems=False)  # -> ItemA, ItemB
relitem2_8 = RelativeItems(TreeA=split_6.Negative, TreeB=split_5.Positive, Offset="{+1;-1}", WrapPaths=invert(False), WrapItems=False)  # -> ItemA, ItemB
relitem2_9 = RelativeItems(TreeA=split_6.Negative, TreeB=split_5.Positive, Offset="{-1;-1}", WrapPaths=invert(False), WrapItems=False)  # -> ItemA, ItemB
relitem2_10 = RelativeItems(TreeA=split_6.Positive, TreeB=split_5.Negative, Offset="{+1;+1}", WrapPaths=invert(False), WrapItems=False)  # -> ItemA, ItemB
relitem2_11 = RelativeItems(TreeA=split_6.Positive, TreeB=split_5.Negative, Offset="{-1;+1}", WrapPaths=invert(False), WrapItems=False)  # -> ItemA, ItemB
ln_6 = Line(StartPoint=relitem2_6.ItemA, EndPoint=relitem2_6.ItemB)
ln_7 = Line(StartPoint=relitem2_7.ItemA, EndPoint=relitem2_7.ItemB)
ln_8 = Line(StartPoint=relitem2_8.ItemA, EndPoint=relitem2_8.ItemB)
ln_9 = Line(StartPoint=relitem2_9.ItemA, EndPoint=relitem2_9.ItemB)
ln_10 = Line(StartPoint=relitem2_10.ItemA, EndPoint=relitem2_10.ItemB)
ln_11 = Line(StartPoint=relitem2_11.ItemA, EndPoint=relitem2_11.ItemB)
merge_10 = Merge(Data1=ln_7, Data2=ln_6, Data3=ln_8, Data4=ln_9, Data5=ln_11, Data6=ln_10)
dom_5 = ConstructDomain(DomainStart=0, DomainEnd=Slider(0.25, range=0..1))
subcrv_4 = SubCurve(BaseCurve=reparameterize(merge_10), Domain=dom_5)
pull_6 = PullCurve(Curve=subcrv_4, Surface=offset_2)
end_2 = EndPoints(Curve=pull_6)  # -> Start, End
brep_cp_7 = BrepClosestPoint(Point=end_2.Start, Brep=offset_2)  # -> Point, Normal, Distance
pl_4 = PlaneNormal(Origin=brep_cp_7.Point, ZAxis=brep_cp_7.Normal)
item_14 = ListItem(List=pl_4, Index=0, Wrap=True)
cir_6 = Circle(Plane=item_14, Radius=1)
pt_4 = ConstructPoint(XCoordinate=0, YCoordinate=0, ZCoordinate=0)
pi_3 = Pi(Factor="0.01")
crv_cp_2 = CurveClosestPoint(Point=pt_4, Curve=cir_6)  # -> Point, Parameter, Distance
seam_2 = Seam(Curve=cir_6, Seam=crv_cp_2.Parameter)
rotate_6 = Rotate(Geometry=seam_2, Angle=pi_3, Plane=pl_3)  # -> Geometry, Transform
alongcrv_4 = SortAlongCurve(Points=end_2.End, Curve=rotate_6.Geometry)  # -> Points, Indices
item_15 = ListItem(List=brep_cp_7.Point, Index=alongcrv_4.Indices, Wrap=True)
item_16 = ListItem(List=brep_cp_7.Normal, Index=alongcrv_4.Indices, Wrap=True)
item_17 = ListItem(List=pull_6, Index=alongcrv_4.Indices, Wrap=True)
end_3 = EndPoints(Curve=item_17)  # -> Start, End
amp_3 = Amplitude(Vector=item_16, Amplitude=Slider(0.6, range=0..1))
rev_4 = Reverse(Vector=amp_3)
pline_2 = PolyLine(Vertices=end_3.End, Closed=invert(False))
item_18 = ListItem(List=end_3.Start, Index=0, Wrap=True)
vec2pt = Vector2Pt(PointA=end_3.Start, PointB=end_3.End, Unitize=False)  # -> Vector, Length
explode_2 = Explode(Curve=pline_2, Recursive=True)  # -> Segments, Vertices
move_2 = Move(Geometry=item_15, Motion=rev_4)  # -> Geometry, Transform
amp_4 = Amplitude(Vector=vec2pt.Vector, Amplitude=Slider(0.9, range=0..1))
amp_5 = Amplitude(Vector=item_16, Amplitude=Slider(0.34, range=0..1))
midpt_4 = CurveMiddle(Curve=explode_2.Segments)
rev_5 = Reverse(Vector=amp_5)
scale_3 = Scale(Geometry=midpt_4, Center=item_18, Factor=Slider(0.4, range=0..1))  # -> Geometry, Transform
weave_2 = Weave(Pattern=[0, 1], Stream0=end_3.End, Stream1=scale_3.Geometry, NullGaps=False)
pline_3 = PolyLine(Vertices=weave_2, Closed=invert(False))
bzspan_3 = BezierSpan(StartPoint=move_2.Geometry, StartTangent=amp_4, EndPoint=end_3.End, EndTangent=rev_5)  # -> Curve, Length, Domain
pull_7 = PullCurve(Curve=pline_3, Surface=offset_2)
explode_3 = Explode(Curve=pull_7, Recursive=True)  # -> Segments, Vertices
graft_7 = GraftTree(Tree=bzspan_3.Curve, IncludeEmptyLists=True, IncludeNullItems=True)
shift_3 = ShiftList(List=explode_3.Segments, Shift="-1", Wrap=True)
partition = PartitionList(List=shift_3, Size="2")  # -> simplify(Chunks)
item_19 = ListItem(List=partition, Index=0, Wrap=True)
flip_3 = FlipCurve(Curve=partition, Guide=item_19)  # -> Curve, Flag
ins = InsertItems(List=flip_3.Curve, Item=graft_7, Indices="1", Wrap=True)
loft_5 = Loft(Curves=ins, Options={Adjust=False, Closed=False, LoftEnds=0, LoftSimp=0, LoftType=3, Rebuild=10, Refit=0.01})
