# Grasshopper definition #5_Anna_plus_serier.gh (Grasshopper 1.0.7)
# plug-ins: Bifocals

number_slider = Slider(40, range=0..100)
sy = SizeY(1)
division = Division(A=number_slider, B="6")
recgrid = Rectangular(Plane=PlaneXY(0, 0, 0), SizeX=expr("3", 1), SizeY=sy, ExtentX=division, ExtentY=number_slider)  # -> Cells, Points
area = Area(Geometry=recgrid.Cells)  # -> Area, Centroid
pdecon = Deconstruct(Point=area.Centroid)  # -> XComponent, YComponent, ZComponent
bnd = Bounds(Numbers=pdecon.YComponent)
remap = RemapNumbers(Value=pdecon.YComponent, Source=bnd, Target=Domain(0, 1))  # -> Mapped, Clipped
graph = GraphMapper(remap.Mapped, x0=0, x1=1, y0=0, y1=1, container_name="Sine", Equation_px=[0, 0.2477930039], Equation_py=[0, 1])

# ---- group: shifting in x
number_slider_2 = Slider(23, range=0..53)
tstat = TreeStatistics(Tree=graph)  # -> Paths, Length, Count
dom = ConstructDomain(DomainStart="-2.5", DomainEnd="2.5")
series = Series(Start=number_slider_2, Step=number_slider_2, Count=tstat.Count)
remap_2 = RemapNumbers(Value=graph, Source=Domain(0, 1), Target=dom)  # -> Mapped, Clipped
shift = ShiftList(List=remap_2.Mapped, Shift=graft(series), Wrap=True)

# ----
item = ListItem(List=tstat.Length, Index=0, Wrap=True)
random = Random(Range=Domain(0, 1), Number=tstat.Count, Seed=Slider(26, range=0..100))
dom_2 = ConstructDomain(DomainStart="0", DomainEnd=item)
remap_3 = RemapNumbers(Value=random, Source=Domain(0, 1), Target=dom_2)  # -> Mapped, Clipped

# ---- group: shifting in z
dom_3 = ConstructDomain(DomainStart="1.5", DomainEnd="2")
bnd_2 = Bounds(Numbers=shift)
remap_4 = RemapNumbers(Value=shift, Source=bnd_2, Target=dom_3)  # -> Mapped, Clipped
Z = UnitZ(Factor=remap_4.Mapped)

# ----
X = UnitX(Factor=shift)
pt = Point(area.Centroid)
move = Move(Geometry=pt, Motion=X)  # -> Geometry, Transform
panel = Panel("""1
3""")
bnd_3 = Bounds(Numbers=remap_4.Mapped)
explode = Explode(Curve=recgrid.Cells, Recursive=True)  # -> Segments, Vertices
move_2 = Move(Geometry=move.Geometry, Motion=Z)  # -> Geometry, Transform
item_2 = ListItem(List=explode.Segments, Index=panel, Wrap=True)
division_2 = Division(A=sy, B="2")
Y = UnitY(Factor=1)
line = LineSDL(Start=move_2.Geometry, Direction=Y, Length=expr("-x", division_2))  # -> graft(Line)
line_2 = LineSDL(Start=move_2.Geometry, Direction=Y, Length=division_2)  # -> graft(Line)
dedomain = DeconstructDomain(Domain=bnd_3)  # -> Start, End
join = JoinCurves(Curves=[line, line_2], Preserve=False)
ins = InsertItems(List=item_2, Item=join, Indices="1", Wrap=True)  # -> simplify(List)
item_3 = ListItem(List=ins, Index=0, Wrap=True)
gradient = Gradient(
    LowerLimit=dedomain.Start,
    UpperLimit=dedomain.End,
    Parameter=remap_4.Mapped,
    stops=[0.15: RGB(0, 128, 128), 0.85: RGB(192, 255, 255)])
flip = FlipCurve(Curve=ins, Guide=item_3)  # -> Curve, Flag
loft = Loft(Curves=flip.Curve, Options={Adjust=False, Closed=True, LoftEnds=0, LoftSimp=0, LoftType=3, Rebuild=10, Refit=0.01})
cap = CapHoles(Brep=loft)
trim = TrimTree(Tree=cap, Depth=1)
preview = CustomPreview(Geometry=trim, Material=gradient)
