# Grasshopper definition #60_chinese_texture6real.gh (Grasshopper 1.0.7)
# plug-ins: Kangaroo2 Components, Pufferfish, Bifocals

Z = UnitZ(Factor=1)
pt = ConstructPoint(XCoordinate=0, YCoordinate=0, ZCoordinate=0)
division = Division(A="1", B="8")
addition = Addition(A="8", B="1")
line = LineSDL(Start=pt, Direction=Z, Length=1)
crv = Curve(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)
series = Series(Start=0, Step=division, Count=addition)
pt_2 = ConstructPoint(XCoordinate=0, YCoordinate=series, ZCoordinate=0)
revsrf = Revolution(Curve=crv, Axis=line, Domain=Domain(0, 6.283185307))
pi = Pi(Factor=Slider(0.15, range=0..1))
iso = IsoCurve(Surface=reparameterize(revsrf), UVPoint=pt_2)  # -> UIsocurve, VIsocurve
series_2 = Series(Start=0, Step=pi, Count=addition)
crv_2 = Curve(flatten(iso.UIsocurve))
neg = Negative(Value=series_2)
area = Area(Geometry=crv_2)  # -> Area, Centroid
rotate = Rotate(Geometry=crv_2, Angle=series_2, Plane=area.Centroid)  # -> Geometry, Transform
rotate_2 = Rotate(Geometry=crv_2, Angle=neg, Plane=area.Centroid)  # -> Geometry, Transform
divide = DivideCurve(Curve=rotate.Geometry, Count=10, Kinks=False)  # -> simplify(Points), Tangents, Parameters
divide_2 = DivideCurve(Curve=rotate_2.Geometry, Count=10, Kinks=False)  # -> simplify(Points), Tangents, Parameters
flip = FlipMatrix(Data=divide.Points)
flip_2 = FlipMatrix(Data=divide_2.Points)
intcrv = Interpolate(Vertices=flip, Degree=3, Periodic=False, KnotStyle=1)  # -> Curve, Length, Domain
intcrv_2 = Interpolate(Vertices=flip_2, Degree=3, Periodic=False, KnotStyle=1)  # -> Curve, Length, Domain
merge = Merge(Data1=intcrv.Curve, Data2=intcrv_2.Curve)  # -> flatten(Result)
srfsplit = SurfaceSplit(Surface=revsrf, Curves=merge)  # -> flatten(Fragments)
edges = BrepEdges(Brep=srfsplit)  # -> Naked, Interior, NonManifold
lng = ListLength(List=edges.Naked)
equals = Equality(FirstNumber=lng, SecondNumber="4")  # -> flatten(Equality), Inequality
dispatch = Dispatch(List=srfsplit, DispatchPattern=equals.Equality)  # -> ListA, ListB
brep = Brep(dispatch.ListA)
brep_2 = Brep(dispatch.ListB)
surface = Surface(revsrf)
brep_3 = Brep(brep_2)
surface_2 = Surface(surface)
brep_4 = Brep(brep)
area_2 = Area(Geometry=brep_3)  # -> Area, Centroid
pdecon = Deconstruct(Point=area_2.Centroid)  # -> XComponent, YComponent, ZComponent
round = Round(Number=pdecon.ZComponent)  # -> Nearest, Floor, Ceiling
sort = SortList(Keys=round.Nearest, ValuesA=brep_3)  # -> Keys, ValuesA
cset = CreateSet(List=sort.Keys)  # -> Set, Map
mindex = MemberIndex(Set=sort.Keys, Member=cset.Set)  # -> Index, Count
item = ListItem(List=sort.ValuesA, Index=mindex.Index, Wrap=True)  # -> simplify(Item)
tstat = TreeStatistics(Tree=item)  # -> Paths, Length, Count
panel = Panel("""0
-1""")
item_2 = ListItem(List=tstat.Paths, Index=panel, Wrap=True)
cull_i = CullIndex(List=tstat.Paths, Indices=panel, Wrap=True)
srf = Surface(brep_4)
branch = TreeBranch(Tree=item, Path=item_2, MaintainPaths=True)  # -> flatten(Branch)
branch_2 = TreeBranch(Tree=item, Path=cull_i, MaintainPaths=True)
join = BrepJoin(Breps=branch_2)  # -> Breps, Closed
edges_2 = BrepEdges(Brep=join.Breps)  # -> Naked, Interior, NonManifold
item_3 = ListItem(List=edges_2.Naked, Index=0, Wrap=True)  # -> Item, Item1, Item2, Item3
edgesrf = EdgeSurface(CurveA=item_3.Item, CurveB=item_3.Item1, CurveC=item_3.Item2, CurveD=item_3.Item3)
merge_2 = Merge(Data1=srf, Data2=edgesrf)  # -> flatten(Result)
debrep = DeconstructBrep(Brep=merge_2)  # -> Faces, Edges, Vertices
avr = Average(Input=debrep.Vertices)
brep_5 = Brep(merge_2)
brep_cp = BrepClosestPoint(Point=avr, Brep=graft(merge_2))  # -> Point, Normal, Distance
pl = PlaneNormal(Origin=brep_cp.Point, ZAxis=brep_cp.Normal)
cir = Circle(Plane=pl, Radius=1)
surface_3 = Surface(surface_2)
crv_3 = Curve(debrep.Edges)
pt_3 = Point(debrep.Vertices)
pt_4 = Point(avr)
crv_4 = Curve(cir)
crv_5 = Curve(crv_4)
number_slider = Slider(0.55, range=0..1)
brep_6 = Brep(brep_5)
pt_5 = Point(pt_3)
pt_6 = Point(pt_4)
surface_4 = Surface(surface_3)
crv_6 = Curve(crv_3)
alongcrv = SortAlongCurve(Points=pt_5, Curve=crv_5)  # -> Points, Indices
graft = GraftTree(Tree=alongcrv.Points, IncludeEmptyLists=True, IncludeNullItems=True)
shift = ShiftList(List=alongcrv.Points, Shift=1, Wrap=True)
vec2pt = Vector2Pt(PointA=shift, PointB=pt_6, Unitize=False)  # -> Vector, Length
vec2pt_2 = Vector2Pt(PointA=alongcrv.Points, PointB=pt_6, Unitize=False)  # -> Vector, Length
graft_2 = GraftTree(Tree=shift, IncludeEmptyLists=True, IncludeNullItems=True)
multiplication = Multiplication(A=vec2pt.Vector, B=number_slider)
multiplication_2 = Multiplication(A=vec2pt_2.Vector, B=number_slider)
graft_3 = GraftTree(Tree=multiplication_2, IncludeEmptyLists=True, IncludeNullItems=True)
graft_4 = GraftTree(Tree=multiplication, IncludeEmptyLists=True, IncludeNullItems=True)
bzspan = BezierSpan(StartPoint=graft, StartTangent=graft_3, EndPoint=graft_2, EndTangent=graft_4)  # -> flatten(Curve), Length, Domain
midpt = CurveMiddle(Curve=crv_6)  # -> flatten(Midpoint)
midpt_2 = CurveMiddle(Curve=bzspan.Curve)
duppt = RemoveDuplicatePts(Points=midpt, Tolerance=0.01)  # -> graft(UniquePoints)
cps = ClosestPoints(Point=duppt, Cloud=midpt_2, Count="2")  # -> ClosestPoint, CPIndex, Distance
item_4 = ListItem(List=bzspan.Curve, Index=cps.CPIndex, Wrap=True)  # -> simplify(Item)
pull = PullCurve(Curve=item_4, Surface=surface_4)
midpt_3 = CurveMiddle(Curve=pull)
tstat_2 = TreeStatistics(Tree=midpt_3)  # -> Paths, Length, Count
avr_2 = Average(Input=midpt_3)  # -> flatten(ArithmeticMean)
pdecon_2 = Deconstruct(Point=avr_2)  # -> XComponent, YComponent, ZComponent
sort_2 = SortList(Keys=pdecon_2.ZComponent, ValuesA=tstat_2.Paths)  # -> Keys, ValuesA
multiplication_3 = Multiplication(A=sort_2.Keys, B="100")
round_2 = Round(Number=multiplication_3)  # -> Nearest, Floor, Ceiling
surface_5 = Surface(surface_4)
int = Integer(round_2.Nearest)
brep_7 = Brep(brep_6)
data = Data(sort_2.ValuesA)
crv_7 = Curve(pull)
brep_8 = Brep(brep_7)
crv_8 = Curve(crv_7)
data_2 = Data(data)
int_2 = Integer(int)
surface_6 = Surface(surface_5)
cset_2 = CreateSet(List=int_2)  # -> Set, Map
mindex_2 = MemberIndex(Set=int_2, Member=cset_2.Set)  # -> Index, Count
tstat_3 = TreeStatistics(Tree=mindex_2.Index)  # -> Paths, Length, Count
panel_2 = Panel("""0
-1""")
cull_i_2 = CullIndex(List=tstat_3.Paths, Indices=panel_2, Wrap=True)
branch_3 = TreeBranch(Tree=mindex_2.Index, Path=cull_i_2, MaintainPaths=True)
item_5 = ListItem(List=data_2, Index=branch_3, Wrap=True)  # -> flatten(Item)
branch_4 = TreeBranch(Tree=crv_8, Path=item_5, MaintainPaths=True)
end = EndPoints(Curve=branch_4)  # -> Start, End
pdecon_3 = Deconstruct(Point=end.Start)  # -> XComponent, YComponent, ZComponent
pdecon_4 = Deconstruct(Point=end.End)  # -> XComponent, YComponent, ZComponent
larger = LargerThan(FirstNumber=pdecon_4.ZComponent, SecondNumber=pdecon_3.ZComponent)  # -> LargerThan, OrEqualTo
dispatch_2 = Dispatch(List=branch_4, DispatchPattern=larger.LargerThan)  # -> ListA, ListB
flip_3 = FlipCurve(Curve=dispatch_2.ListB)  # -> Curve, Flag
merge_3 = Merge(Data1=dispatch_2.ListA, Data2=flip_3.Curve)
midpt_4 = CurveMiddle(Curve=merge_3)
pdecon_5 = Deconstruct(Point=midpt_4)  # -> XComponent, YComponent, ZComponent
sort_3 = SortList(Keys=pdecon_5.ZComponent, ValuesA=merge_3)  # -> Keys, ValuesA
rebcrv = RebuildCurve(Curve=sort_3.ValuesA, Count="5", Degree="2", EndTangents=False)
crv_9 = Curve(rebcrv)
surface_7 = Surface(surface_6)
brep_9 = Brep(brep_8)
surface_8 = Surface(surface_7)
crv_10 = Curve(crv_9)
brep_10 = Brep(brep_9)
panel_3 = Panel("""0
1
-1
-2""")
cp = ControlPoints(Curve=crv_10)  # -> Points, Weights, Knots
item_6 = ListItem(List=cp.Points, Index=0, Wrap=True)  # -> Item2, Item1, Item, Item1_2
cull_i_3 = CullIndex(List=cp.Points, Indices=panel_3, Wrap=True)
brep_cp_2 = BrepClosestPoint(Point=item_6.Item2, Brep=surface_8)  # -> Point, Normal, Distance
brep_cp_3 = BrepClosestPoint(Point=item_6.Item1_2, Brep=surface_8)  # -> Point, Normal, Distance
brep_cp_4 = BrepClosestPoint(Point=item_6.Item1, Brep=surface_8)  # -> Point, Normal, Distance
brep_cp_5 = BrepClosestPoint(Point=item_6.Item, Brep=surface_8)  # -> Point, Normal, Distance
surface_9 = Surface(surface_8)
tstat_4 = TreeStatistics(Tree=brep_cp_2.Point)  # -> Paths, Length, Count
lng_2 = ListLength(List=tstat_4.Length)
ma = MassAddition(Input=tstat_4.Length)  # -> Result, PartialResults
pow = Power(A="-1", B=ma.PartialResults)
dup = DuplicateData(Data="2", Number=lng_2, Order=True)
multiplication_4 = Multiplication(A=dup, B=pow)  # -> simplify(graft(Result))
neg_2 = Negative(Value=multiplication_4)
amp = Amplitude(Vector=brep_cp_5.Normal, Amplitude=multiplication_4)
amp_2 = Amplitude(Vector=brep_cp_3.Normal, Amplitude=multiplication_4)
amp_3 = Amplitude(Vector=brep_cp_4.Normal, Amplitude=neg_2)
move = Move(Geometry=brep_cp_3.Point, Motion=amp_2)  # -> Geometry, Transform
move_2 = Move(Geometry=brep_cp_5.Point, Motion=amp)  # -> Geometry, Transform
move_3 = Move(Geometry=brep_cp_2.Point, Motion=amp_3)  # -> Geometry, Transform
move_4 = Move(Geometry=brep_cp_4.Point, Motion=amp_3)  # -> Geometry, Transform
number_slider_2 = Slider(0.59, range=0..5)
vec2pt_3 = Vector2Pt(PointA=move_2.Geometry, PointB=move.Geometry, Unitize=False)  # -> Vector, Length
vec2pt_4 = Vector2Pt(PointA=move_4.Geometry, PointB=move_3.Geometry, Unitize=False)  # -> Vector, Length
amp_4 = Amplitude(Vector=vec2pt_4.Vector, Amplitude=number_slider_2)
amp_5 = Amplitude(Vector=vec2pt_3.Vector, Amplitude=number_slider_2)
move_5 = Move(Geometry=move_3.Geometry, Motion=amp_4)  # -> Geometry, Transform
move_6 = Move(Geometry=move.Geometry, Motion=amp_5)  # -> Geometry, Transform
merge_4 = Merge(Data1=move_2.Geometry, Data2=move_6.Geometry, Data3=simplify(cull_i_3), Data4=move_5.Geometry, Data5=move_4.Geometry)
pt_7 = Point(merge_4)
surface_10 = Surface(surface_9)
brep_11 = Brep(brep_10)
pt_8 = Point(pt_7)
surface_11 = Surface(surface_10)
brep_12 = Brep(brep_11)
nurbs = NurbsCurve(Vertices=pt_8, Degree="2", Periodic=False)  # -> flatten(Curve), Length, Domain
area_3 = Area(Geometry=brep_12)  # -> Area, graft(Centroid)
midpt_5 = CurveMiddle(Curve=nurbs.Curve)  # -> flatten(Midpoint)
cps_2 = ClosestPoints(Point=area_3.Centroid, Cloud=midpt_5, Count="8")  # -> ClosestPoint, CPIndex, Distance
item_7 = ListItem(List=nurbs.Curve, Index=cps_2.CPIndex, Wrap=True)  # -> simplify(Item)
panel_4 = Panel("""0
1
2
3""")
cull_i_4 = CullIndex(List=item_7, Indices=panel_4, Wrap=True)
brep_13 = Brep(surface_11)
brep_14 = Brep(brep_13)

join_2 = JoinCurves(Curves=cull_i_4, Preserve=False)  # -> flatten(Curves)
panel_5 = Panel("""3
0.75
2.25""")
cls = Closed(Curve=join_2)  # -> Closed, Periodic
dispatch_3 = Dispatch(List=join_2, DispatchPattern=cls.Closed)  # -> ListA, ListB
lng_3 = ListLength(List=panel_5)
neg_3 = Negative(Value=panel_5)
crv_11 = Curve(simplify(dispatch_3.ListA))
merge_5 = Merge(Data1=panel_5, Data2=neg_3)
cpoly = ControlPolygon(Curve=crv_11)  # -> Polygon, Points
graft_5 = GraftTree(Tree=crv_11, IncludeEmptyLists=True, IncludeNullItems=True)
avr_3 = Average(Input=cpoly.Points)
brep_cp_6 = BrepClosestPoint(Point=avr_3, Brep=surface_11)  # -> Point, Normal, Distance
pl_2 = PlaneNormal(Origin=brep_cp_6.Point, ZAxis=brep_cp_6.Normal)
offset = OffsetCurve(Curve=graft_5, Distance=merge_5, Plane=pl_2, Corners=1)
trim = TrimTree(Tree=offset, Depth=1)
disc = Discontinuity(Curve=graft_5, Level=1)  # -> Points, Parameters
len = Length(Curve=trim)
sort_4 = SortList(Keys=len, ValuesA=trim)  # -> Keys, ValuesA
partition = PartitionList(List=sort_4.ValuesA, Size=lng_3)  # -> simplify(Chunks)
split = SplitTree(Data=partition, Masks=flatten("{*;0}"))  # -> Positive, Negative
pt_9 = ConstructPoint(XCoordinate=0, YCoordinate=0, ZCoordinate=0)

pt_10 = Point(disc.Points)
crv_12 = Curve(graft_5)
num = Number(disc.Parameters)
crv_13 = Curve(split.Positive)
pt_11 = Point(pt_10)
crv_14 = Curve(crv_12)
num_2 = Number(num)
crv_15 = Curve(crv_13)

item_8 = ListItem(List=crv_15, Index=0, Wrap=True)  # -> Item, Item1, Item2
crv_cp = CurveClosestPoint(Point=pt_11, Curve=item_8.Item1)  # -> Point, Parameter, Distance
shatter = Shatter(Curve=crv_14, Parameters=num_2)  # -> simplify(graft(Segments))
crv_cp_2 = CurveClosestPoint(Point=pt_11, Curve=item_8.Item2)  # -> Point, Parameter, Distance
crv_cp_3 = CurveClosestPoint(Point=pt_11, Curve=item_8.Item)  # -> Point, Parameter, Distance
shatter_2 = Shatter(Curve=item_8.Item1, Parameters=crv_cp.Parameter)  # -> simplify(Segments)
shatter_3 = Shatter(Curve=item_8.Item2, Parameters=crv_cp_2.Parameter)  # -> simplify(Segments)
shatter_4 = Shatter(Curve=item_8.Item, Parameters=crv_cp_3.Parameter)
trim_2 = TrimTree(Tree=shatter, Depth=1)
rebcrv_2 = RebuildCurve(Curve=shatter_4, Count="5", Degree="3", EndTangents=False)  # -> simplify(graft(Rebuilt))
rebcrv_3 = RebuildCurve(Curve=shatter_2, Count="5", Degree="3", EndTangents=False)  # -> simplify(Rebuilt)
rebcrv_4 = RebuildCurve(Curve=shatter_3, Count="5", Degree="3", EndTangents=False)  # -> simplify(Rebuilt)
join_3 = JoinCurves(Curves=trim_2, Preserve=False)
trim_3 = TrimTree(Tree=rebcrv_2, Depth=1)
join_4 = JoinCurves(Curves=rebcrv_3, Preserve=False)
join_5 = JoinCurves(Curves=rebcrv_4, Preserve=False)
end_2 = EndPoints(Curve=join_3)  # -> Start, End
join_6 = JoinCurves(Curves=trim_3, Preserve=False)
end_3 = EndPoints(Curve=join_4)  # -> Start, End
crv_cp_4 = CurveClosestPoint(Point=end_2.Start, Curve=join_6)  # -> Point, Parameter, Distance
crv_cp_5 = CurveClosestPoint(Point=end_3.End, Curve=join_5)  # -> Point, Parameter, Distance
seam = Seam(Curve=join_6, Seam=crv_cp_4.Parameter)
seam_2 = Seam(Curve=join_5, Seam=crv_cp_5.Parameter)
loft = Loft(Curves=[seam, join_3], Options={Adjust=False, Closed=False, LoftEnds=0, LoftSimp=0, LoftType=0, Rebuild=10, Refit=0.01})
loft_2 = Loft(
    Curves=[seam_2, join_4],
    Options={Adjust=False, Closed=False, LoftEnds=0, LoftSimp=0, LoftType=0, Rebuild=10, Refit=0.01})
brep_cp_7 = BrepClosestPoint(Point=end_2.Start, Brep=loft)  # -> Point, Normal, Distance
brep_cp_8 = BrepClosestPoint(Point=end_3.End, Brep=loft_2)  # -> Point, Normal, Distance
vec2pt_5 = Vector2Pt(PointA=pt_9, PointB=brep_cp_7.Point, Unitize=False)  # -> Vector, Length
dprod = DotProduct(VectorA=vec2pt_5.Vector, VectorB=brep_cp_7.Normal, Unitize=False)
dprod_2 = DotProduct(VectorA=vec2pt_5.Vector, VectorB=brep_cp_8.Normal, Unitize=False)
larger_2 = LargerThan(FirstNumber=dprod, SecondNumber="0")  # -> LargerThan, OrEqualTo
multiplication_5 = Multiplication(A=dprod_2, B=brep_cp_8.Normal)
larger_3 = LargerThan(FirstNumber=dprod_2, SecondNumber="0")  # -> LargerThan, OrEqualTo
dispatch_4 = Dispatch(List=loft, DispatchPattern=larger_2.LargerThan)  # -> ListA, ListB
amp_6 = Amplitude(Vector=multiplication_5, Amplitude=1)
flippsrf = FlipPolysurface(Polysurface=dispatch_4.ListA)  # -> Flipped, R
dispatch_5 = Dispatch(List=loft_2, DispatchPattern=larger_3.LargerThan)  # -> ListA, ListB
merge_6 = Merge(Data1=flippsrf.Flipped, Data2=dispatch_4.ListB)
flippsrf_2 = FlipPolysurface(Polysurface=dispatch_5.ListB)  # -> Flipped, R
merge_7 = Merge(Data1=flippsrf_2.Flipped, Data2=dispatch_5.ListA)
offsrf = OffsetSurface(Surface=merge_6, Distance="2", BothSides=0, CreateSolid=True)
extr = Extrude(Base=merge_7, Direction=amp_6)

item_9 = ListItem(List=item_7, Index=panel_4, Wrap=True)
join_7 = JoinCurves(Curves=item_9, Preserve=False)
cls_2 = Closed(Curve=join_7)  # -> Closed, Periodic
dispatch_6 = Dispatch(List=join_7, DispatchPattern=cls_2.Closed)  # -> flatten(ListA), ListB
explode = Explode(Curve=dispatch_6.ListA, Recursive=True)  # -> Segments, Vertices
midpt_6 = CurveMiddle(Curve=explode.Segments)
avr_4 = Average(Input=midpt_6)
brep_cp_9 = BrepClosestPoint(Point=avr_4, Brep=surface_11)  # -> Point, Normal, Distance
pt_12 = ConstructPoint(XCoordinate=0, YCoordinate=0, ZCoordinate=0)
pl_3 = PlaneNormal(Origin=brep_cp_9.Point, ZAxis=brep_cp_9.Normal)
cir_2 = Circle(Plane=pl_3, Radius=1)
crv_cp_6 = CurveClosestPoint(Point=pt_12, Curve=cir_2)  # -> Point, Parameter, Distance
seam_3 = Seam(Curve=cir_2, Seam=crv_cp_6.Parameter)
alongcrv_2 = SortAlongCurve(Points=midpt_6, Curve=seam_3)  # -> Points, Indices
item_10 = ListItem(List=explode.Segments, Index=alongcrv_2.Indices, Wrap=True)

crv_16 = Curve(item_10)

join_8 = JoinCurves(Curves=cull_i_4, Preserve=False)  # -> flatten(Curves)
cls_3 = Closed(Curve=join_8)  # -> Closed, Periodic
dispatch_7 = Dispatch(List=join_8, DispatchPattern=cls_3.Closed)  # -> ListA, ListB
explode_2 = Explode(Curve=dispatch_7.ListA, Recursive=True)  # -> Segments, Vertices
end_4 = EndPoints(Curve=explode_2.Segments)  # -> Start, End
ln = Line(StartPoint=end_4.Start, EndPoint=end_4.End)
midpt_7 = CurveMiddle(Curve=ln)  # -> flatten(Midpoint)
graft_6 = GraftTree(Tree=midpt_7, IncludeEmptyLists=True, IncludeNullItems=True)
cp_2 = ClosestPoint(Point=graft_6, Cloud=midpt_7)  # -> simplify(ClosestPoint), CPIndex, Distance
cps_3 = ClosestPoints(Point=graft_6, Cloud=midpt_7, Count="2")  # -> ClosestPoint, CPIndex, Distance
item_11 = ListItem(List=midpt_7, Index=cps_3.CPIndex, Wrap=True)  # -> reverse(Item)
item_12 = ListItem(List=item_11, Index=0, Wrap=True)  # -> simplify(Item)
merge_8 = Merge(Data1=cp_2.ClosestPoint, Data2=item_12)
crv_17 = Curve(item_7)

pt_13 = Point(merge_8)
pt_14 = Point(pt_13)
crv_18 = Curve(crv_17)

avr_5 = Average(Input=pt_14)  # -> flatten(ArithmeticMean)
midpt_8 = CurveMiddle(Curve=crv_18)  # -> flatten(Midpoint)
duppt_2 = RemoveDuplicatePts(Points=avr_5, Tolerance=0.01)  # -> graft(UniquePoints)
cps_4 = ClosestPoints(Point=duppt_2, Cloud=midpt_8, Count="4")  # -> ClosestPoint, CPIndex, Distance
item_13 = ListItem(List=flatten(crv_18), Index=cps_4.CPIndex, Wrap=True)
midpt_9 = CurveMiddle(Curve=item_13)
ln_2 = Line(StartPoint=duppt_2, EndPoint=midpt_9)
dupln = RemoveDuplicateLines(Lines=ln_2, Tolerance=0.01)

crv_19 = Curve(simplify(graft(crv_16)))
midpt_10 = CurveMiddle(Curve=crv_19)
trim_4 = TrimTree(Tree=midpt_10, Depth=1)
avr_6 = Average(Input=trim_4)
ln_3 = Line(StartPoint=trim_4, EndPoint=avr_6)  # -> graft(Line)
ext = ExtendCurve(Curve=ln_3, Type=0, Start="0.5", End="0.25")
eval = EvaluateCurve(Curve=reparameterize(ext), Parameter="0.5")  # -> Point, Tangent, Angle
brep_cp_10 = BrepClosestPoint(Point=eval.Point, Brep=brep_14)  # -> Point, Normal, Distance
xprod = CrossProduct(VectorA=brep_cp_10.Normal, VectorB=eval.Tangent, Unitize=False)  # -> Vector, Length
end_5 = EndPoints(Curve=ext)  # -> Start, End
amp_7 = Amplitude(Vector=xprod.Vector, Amplitude="1.25")
rev = Reverse(Vector=amp_7)
move_7 = Move(Geometry=eval.Point, Motion=rev)  # -> Geometry, Transform
move_8 = Move(Geometry=eval.Point, Motion=amp_7)  # -> Geometry, Transform
merge_9 = Merge(Data1=end_5.Start, Data2=move_7.Geometry, Data3=end_5.End)
merge_10 = Merge(Data1=end_5.Start, Data2=move_8.Geometry, Data3=end_5.End)
intcrv_3 = Interpolate(Vertices=merge_9, Degree=3, Periodic=False, KnotStyle=1)  # -> Curve, Length, Domain
intcrv_4 = Interpolate(Vertices=merge_10, Degree=3, Periodic=False, KnotStyle=1)  # -> Curve, Length, Domain
merge_11 = Merge(Data1=intcrv_4.Curve, Data2=intcrv_3.Curve)
join_9 = JoinCurves(Curves=merge_11, Preserve=False)

crv_20 = Curve(join_9)
crv_21 = Curve(crv_20)

area_4 = Area(Geometry=crv_21)  # -> Area, Centroid
scale = Scale(Geometry=crv_21, Center=area_4.Centroid, Factor=0.5)  # -> Geometry, Transform
loft_3 = Loft(
    Curves=[crv_21, scale.Geometry],
    Options={Adjust=False, Closed=False, LoftEnds=0, LoftSimp=0, LoftType=0, Rebuild=10, Refit=0.01})
offsrf_2 = OffsetSurface(Surface=loft_3, Distance="-0.25", BothSides=0, CreateSolid=invert(True))
offsrf_3 = OffsetSurface(Surface=offsrf_2, Distance="-1.75", BothSides=0, CreateSolid=True)
