# Grasshopper definition #6_Perlin_noise_modeling.gh (Grasshopper 1.0.7)
# plug-ins: Bifocals, MeshEdit Components, Noise, Weaverbird

cir = Circle(Plane=PlaneXY(0, 0, 0), Radius="50")
pframes = PerpFrames(Curve=cir, Count="20", Align=True)  # -> Frames, Parameters
cir_2 = Circle(Plane=pframes.Frames, Radius="20")
loft = Loft(Curves=cir_2, Options={Adjust=False, Closed=True, LoftEnds=0, LoftSimp=0, LoftType=0, Rebuild=10, Refit=0.01})
sdivide = DivideSurface(Surface=loft, UCount="200", VCount="60")  # -> flatten(Points), Normals, Parameters
frompoints = MeshFromPoints(Points=sdivide.Points, UDirection=expr("x+1", "200"), VDirection=expr("x+1", "60"))
number_slider = Slider(4.29, range=0..10)
number_slider_2 = Slider(2.37, range=0..10)
demesh = DeconstructMesh(Mesh=frompoints)  # -> Vertices, Faces, Colours, Normals
pn = PerlinNoise(
    Points=demesh.Vertices,
    Seed="5",
    Amplitude=1,
    SmoothStep=0,
    FrequecyX=number_slider,
    FrequecyY=number_slider,
    FrequecyZ=number_slider,
    Jitter=0,
    AlignVector=Vector(1, 0, 0))
pn_2 = PerlinNoise(
    Points=demesh.Vertices,
    Seed="53",
    Amplitude=1,
    SmoothStep=0,
    FrequecyX=number_slider_2,
    FrequecyY=number_slider_2,
    FrequecyZ=number_slider_2,
    Jitter=0,
    AlignVector=Vector(1, 0, 0))
multiplication = Multiplication(A=pn, B=Slider(0.3, range=0..1))
addition = Addition(A=multiplication, B=pn_2)
pi = Pi(Factor=1)
multiplication_2 = Multiplication(A=pn_2, B=Slider(10, range=1..10), C=pi)
sin = Sine(Value=multiplication_2)
neg = Negative(Value="5")
graph = GraphMapper(sin, x0=-1, x1=1, y0=0, y1=1, container_name="Bezier", cpx=[0, 0.8112642765, 0.2907714844, 1], cpy=[0, 0, 1, 1])
dom = ConstructDomain(DomainStart=neg, DomainEnd="5")
bnd = Bounds(Numbers=sin)
remap = RemapNumbers(Value=sin, Source=bnd, Target=dom)  # -> Mapped, Clipped
bnd_2 = Bounds(Numbers=remap.Mapped)
amp = Amplitude(Vector=demesh.Normals, Amplitude=remap.Mapped)
dedomain = DeconstructDomain(Domain=bnd_2)  # -> Start, End
move = Move(Geometry=demesh.Vertices, Motion=amp)  # -> Geometry, Transform
gradient = Gradient(
    LowerLimit=dedomain.Start,
    UpperLimit=dedomain.End,
    Parameter=remap.Mapped,
    stops=[0.15: RGB(255, 192, 192), 0.499: RGB(255, 130, 160), 0.85: RGB(220, 0, 40)])
conmesh = ConstructMesh(Vertices=move.Geometry, Faces=demesh.Faces, Colours=gradient)
wbcatmullclark = WeaverbirdsCatmullClarkSubdivision(MeshCurves=conmesh, Level="2", SmoothNakedEdges=1)
