# Grasshopper definition #7_String_art.gh (Grasshopper 1.0.7)
# plug-ins: Bifocals, Kangaroo2 Components

circle_radius = Slider(0.15, range=0..1)
orange = Slider(0, range=0..1)
white = Slider(0, range=0..1)
white_count = Slider(10, range=3..20)
orange_count = Slider(10, range=3..20)
size = Slider(6, range=5..20)
t = Slider(0.61, range=0..1)
gap = Slider(3, range=1..20)
multiplication = Multiplication(A=size, B=2)
neg = Negative(Value=size)
addition = Addition(A=multiplication, B=gap)
dom = ConstructDomain(DomainStart=neg, DomainEnd=size)
series = Series(Start=0, Step=addition, Count="2")
pt = ConstructPoint(XCoordinate=series, YCoordinate=graft(series), ZCoordinate=0)  # -> flatten(Point)
rectangle = Rectangle(Plane=pt, XSize=dom, YSize=dom, Radius=0)  # -> Rectangle, Length
avr = Average(Input=pt)

area = Area(Geometry=rectangle.Rectangle)  # -> Area, Centroid
points = PointList(Points=area.Centroid, Size="5")

cir = Circle(Plane=avr, Radius=1)
crv_cp = CurveClosestPoint(Point=pt, Curve=cir)  # -> Point, Parameter, Distance
sort = SortList(Keys=crv_cp.Parameter, ValuesA=rectangle.Rectangle, ValuesB=pt)  # -> Keys, ValuesA, ValuesB

area_2 = Area(Geometry=sort.ValuesA)  # -> Area, Centroid
points_2 = PointList(Points=area_2.Centroid, Size="5")

explode = Explode(Curve=sort.ValuesA, Recursive=True)  # -> Segments, Vertices
duppt = RemoveDuplicatePts(Points=explode.Vertices, Tolerance=0.01)
ln = Line(StartPoint=duppt, EndPoint=graft(sort.ValuesB))
shatter = Shatter(Curve=reparameterize(ln), Parameters=t)
item = ListItem(List=shatter, Index=0, Wrap=True)
trim = TrimTree(Tree=item, Depth=1)  # -> simplify(Tree)

panel = Panel("""2
1
0
3""")
item_2 = ListItem(List=trim, Index=graft(panel), Wrap=True)
divide = DivideCurve(Curve=item_2, Count=orange_count, Kinks=False)  # -> Points, Tangents, Parameters
flip = FlipMatrix(Data=divide.Points)
pline = PolyLine(Vertices=flip, Closed=invert(False))

panel_2 = Panel("""0
3
2
1""")
item_3 = ListItem(List=trim, Index=graft(panel_2), Wrap=True)  # -> flatten(Item)
divide_2 = DivideCurve(Curve=item_3, Count=orange_count, Kinks=False)  # -> Points, Tangents, Parameters
flip_2 = FlipMatrix(Data=divide_2.Points)
pline_2 = PolyLine(Vertices=flip_2, Closed=invert(False))

tstat = TreeStatistics(Tree=trim)  # -> Paths, Length, Count
series_2 = Series(Start=0, Step=1, Count=tstat.Count)
item_4 = ListItem(List=trim, Index=graft(series_2), Wrap=True)
dispatch = Dispatch(List=flatten(item_4), DispatchPattern=[True, False])  # -> ListA, ListB
flip_3 = FlipCurve(Curve=dispatch.ListB)  # -> Curve, Flag
weave = Weave(Pattern=[0, 1], Stream0=dispatch.ListA, Stream1=flip_3.Curve, NullGaps=False)
divide_3 = DivideCurve(Curve=weave, Count=white_count, Kinks=False)  # -> Points, Tangents, Parameters
flip_4 = FlipMatrix(Data=divide_3.Points)
pline_3 = PolyLine(Vertices=flip_4, Closed=invert(False))

panel_3 = Panel("""1
3""")
panel_4 = Panel("""0
2""")
relitem = RelativeItem(Tree=trim, Offset="{+2}", WrapPaths=invert(False), WrapItems=invert(False))  # -> ItemA, ItemB
entwine = Entwine(Branch00=panel_3, Branch01=panel_4, Branch02=panel_3, Branch03=panel_4, FlattenInputs=True)
int = Integer(series_2)
item_5 = ListItem(List=relitem.ItemA, Index=graft(int), Wrap=True)  # -> simplify(Item)
item_6 = ListItem(List=relitem.ItemB, Index=entwine, Wrap=True)  # -> simplify(Item)
ins = InsertItems(List=item_6, Item=item_5, Indices="1", Wrap=True)  # -> simplify(List)
divide_4 = DivideCurve(Curve=ins, Count=orange_count, Kinks=False)  # -> Points, Tangents, Parameters
split = SplitTree(Data=divide_4.Points, Masks=flatten("{*;0}"))  # -> Positive, Negative
trim_2 = TrimTree(Tree=split.Negative, Depth=1)
shift = ShiftList(List=trim_2, Shift=expr("x+1", orange_count), Wrap=True)
short = ShortestList(ListA=split.Positive, ListB=trim_2, TrimMode=2)  # -> ListA, ListB
short_2 = ShortestList(ListA=split.Positive, ListB=shift, TrimMode=2)  # -> ListA, ListB
merge = Merge(Data1=graft(short.ListA), Data2=graft(short.ListB), Data3=graft(short_2.ListB))
pline_4 = PolyLine(Vertices=merge, Closed=False)
trim_3 = TrimTree(Tree=pline_4, Depth=1)

shift_2 = ShiftList(List=trim, Shift=1, Wrap=True)
crv = Curve(trim)
flip_5 = FlipCurve(Curve=shift_2)  # -> Curve, Flag
divide_5 = DivideCurve(Curve=crv, Count=white_count, Kinks=False)  # -> Points, Tangents, Parameters
divide_6 = DivideCurve(Curve=flip_5.Curve, Count=white_count, Kinks=False)  # -> Points, Tangents, Parameters
ln_2 = Line(StartPoint=divide_5.Points, EndPoint=divide_6.Points)
trim_4 = TrimTree(Tree=ln_2, Depth=1)
join = JoinCurves(Curves=trim_4, Preserve=False)

merge_2 = Merge(Data1=divide_5.Points)
cir_2 = Circle(Plane=merge_2, Radius=circle_radius)
boundary = BoundarySurfaces(Edges=cir_2)
preview = CustomPreview(Geometry=boundary, Material=ColourSwatch(SwatchColor=RGB(115, 0, 0)))

merge_3 = Merge(Data1=join, Data2=pline_3)

fillet = Fillet(Curve=merge_3, Radius=white)

preview_2 = CustomPreview(Geometry=fillet, Material=ColourSwatch(SwatchColor=RGB(255, 255, 255)))

merge_4 = Merge(Data1=pline, Data2=pline_2, Data3=trim_3)

fillet_2 = Fillet(Curve=merge_4, Radius=orange)

preview_3 = CustomPreview(Geometry=fillet_2, Material=ColourSwatch(SwatchColor=RGB(255, 166, 0)))
