# Grasshopper definition #8_arch_hot_wire_cutting.gh (Grasshopper 1.0.7)
# plug-ins: Bifocals, Kangaroo2 Components, Human

pt = ConstructPoint(XCoordinate="1600", YCoordinate=0, ZCoordinate=0)
pt_2 = ConstructPoint(XCoordinate=0, YCoordinate=0, ZCoordinate=0)
ln = Line(StartPoint=pt_2, EndPoint=pt)
merge = Merge(Data1=pt_2, Data2=pt)
divide = DivideCurve(Curve=ln, Count="19", Kinks=False)  # -> Points, Tangents, Parameters
shatter = Shatter(Curve=ln, Parameters=divide.Parameters)
anchor = Anchor(Point=merge, Strength=10000)
length_line = LengthLine(Line=shatter, Strength=10)
load = Load(Point=divide.Points, ForceVector=Vector(0, 0, 1), Weighting=Slider(39.32, range=0..50))
entwine = Entwine(Branch00=length_line, Branch01=anchor, Branch02=load, FlattenInputs=True)
solver = Solver(GoalObjects=entwine, Reset=Button(), Threshold=1e-15, Tolerance=0.0001, On=True)  # -> I, V, O

bang = ExplodeTree(Data=solver.O)
shift = ShiftList(List=bang, Shift=1, Wrap=invert(True))
join = JoinCurves(Curves=bang, Preserve=False)
explode = Explode(Curve=join, Recursive=True)  # -> Segments, Vertices
short = ShortestList(ListA=bang, ListB=shift, TrimMode=2)  # -> ListA, ListB
vec = Vector(short.ListB)
vec_2 = Vector(short.ListA)
pdecon = Deconstruct(Point=explode.Vertices)  # -> XComponent, YComponent, ZComponent
rev = Reverse(Vector=vec)
bnd = Bounds(Numbers=pdecon.ZComponent)
unit = UnitVector(Vector=vec_2)
unit_2 = UnitVector(Vector=rev)
X = UnitX(Factor=1)
remap = RemapNumbers(Value=pdecon.ZComponent, Source=bnd, Target=Domain(0, 1))  # -> Mapped, Clipped
rev_2 = Reverse(Vector=X)
addition = Addition(A=unit, B=unit_2)
graph = GraphMapper(
    remap.Mapped,
    x0=0,
    x1=1,
    y0=0,
    y1=1,
    A=-1.014978636,
    B=0.9620774352,
    container_name="Linear",
    Graph_x0=0.1071954221,
    Graph_x1=0.9478794932,
    Graph_y0=0.853276372,
    Graph_y1=0)
entwine_2 = Entwine(Branch00=rev_2, Branch01=addition, Branch02=X, FlattenInputs=True)  # -> flatten(Result)
dom = ConstructDomain(DomainStart="25", DomainEnd="120")
remap_2 = RemapNumbers(Value=graph, Source=Domain(0, 1), Target=dom)  # -> Mapped, Clipped
panel = Panel("""0
19""")
replace = ReplaceItems(List=remap_2.Mapped, Item="140", Indices=panel, Wrap=False)
amp = Amplitude(Vector=entwine_2, Amplitude=replace)
move = Move(Geometry=explode.Vertices, Motion=amp)  # -> Geometry, Transform
pt_3 = Point(explode.Vertices)

# ---- group: Internal
Y = UnitY(Factor=1)
line = LineSDL(Start=move.Geometry, Direction=Y, Length="120")  # -> simplify(Line)
line_2 = LineSDL(Start=pt_3, Direction=Y, Length="120")  # -> simplify(Line)
graft = GraftTree(Tree=line_2, IncludeEmptyLists=True, IncludeNullItems=True)  # -> simplify(Tree)
graft_2 = GraftTree(Tree=line, IncludeEmptyLists=True, IncludeNullItems=True)  # -> simplify(Tree)
loft = Loft(
    Curves=[graft_2, graft],
    Options={Adjust=False, Closed=False, LoftEnds=0, LoftSimp=0, LoftType=0, Rebuild=10, Refit=0.01})
area = Area(Geometry=loft)  # -> Area, Centroid
srf_cp = SurfaceClosestPoint(Point=area.Centroid, Surface=loft)  # -> Point, UVPoint, Distance
vec_3 = Vector(graft(line_2))
evalsrf = EvaluateSurface(Surface=loft, Point=srf_cp.UVPoint)  # -> Point, Normal, UDirection, VDirection, Frame
midpt = CurveMiddle(Curve=line_2)
xprod = CrossProduct(VectorA=evalsrf.Normal, VectorB=vec_3, Unitize=False)  # -> Vector, Length
pdecon_2 = Deconstruct(Point=midpt)  # -> XComponent, YComponent, ZComponent
pl = ConstructPlane(Origin=midpt, XAxis=flatten(vec_3), YAxis=flatten(xprod.Vector))
lng = ListLength(List=pdecon_2.ZComponent)
maxangle = Slider(25, range=10..50)
bnd_2 = Bounds(Numbers=pdecon_2.ZComponent)
series = Series(Start=0, Step=1, Count=lng)
remap_3 = RemapNumbers(Value=pdecon_2.ZComponent, Source=bnd_2, Target=Domain(0, 1))  # -> Mapped, Clipped
pow = Power(A="-1", B=series)
graph_2 = GraphMapper(
    remap_3.Mapped,
    x0=0,
    x1=1,
    y0=0,
    y1=1,
    container_name="Bezier",
    cpx=[0, 0.4920141101, 0.7051029205, 1],
    cpy=[0.7972801328, 0.7879877687, 0.09830993414, 0.1063661575])
multiplication = Multiplication(A=graph_2, B=pow, C=maxangle)
rotate = Rotate(Geometry=line_2, Angle=degrees(multiplication), Plane=pl)  # -> Geometry, Transform
midpt_2 = CurveMiddle(Curve=rotate.Geometry)
scale = Scale(Geometry=rotate.Geometry, Center=midpt_2, Factor="1.5")  # -> graft(Geometry), Transform

# ---- group: display plane
pt_4 = Point(flatten(area.Centroid))
deplane = DeconstructPlane(Plane=pl)  # -> Origin, XAxis, YAxis, ZAxis
multiplication_2 = Multiplication(A=deplane.YAxis, B="25")
multiplication_3 = Multiplication(A=deplane.ZAxis, B="25")
multiplication_4 = Multiplication(A=deplane.XAxis, B="25")
vdisex = VectorDisplayEx(Point=pt_4, Vector=multiplication_4, Colour=ColourSwatch(SwatchColor=RGB(255, 0, 0)), Width=2)
vdisex_2 = VectorDisplayEx(Point=pt_4, Vector=multiplication_3, Colour=ColourSwatch(SwatchColor=RGB(0, 128, 255)), Width=2)
vdisex_3 = VectorDisplayEx(Point=pt_4, Vector=multiplication_2, Colour=ColourSwatch(SwatchColor=RGB(68, 255, 0)), Width=2)

# ----
end = EndPoints(Curve=line)  # -> Start, End
end_2 = EndPoints(Curve=line_2)  # -> Start, End
ln_2 = Line(StartPoint=end.Start, EndPoint=end_2.Start)
ln_3 = Line(StartPoint=end.End, EndPoint=end_2.End)
merge_2 = Merge(Data1=ln_2, Data2=ln_3)
midpt_3 = CurveMiddle(Curve=merge_2)
scale_2 = Scale(Geometry=merge_2, Center=midpt_3, Factor="2")  # -> Geometry, Transform

# ---- group: Outter
crv = Curve(line)
midpt_4 = CurveMiddle(Curve=crv)
pl_2 = ConstructPlane(Origin=midpt_4, XAxis=flatten(vec_3), YAxis=flatten(xprod.Vector))
rotate_2 = Rotate(Geometry=crv, Angle=degrees(multiplication), Plane=pl_2)  # -> Geometry, Transform
midpt_5 = CurveMiddle(Curve=rotate_2.Geometry)
scale_3 = Scale(Geometry=rotate_2.Geometry, Center=midpt_5, Factor="1.5")  # -> graft(Geometry), Transform
crv_2 = Curve(scale_2.Geometry)
ccx = CurveCurve(CurveA=scale_3.Geometry, CurveB=crv_2)  # -> Points, ParamsA, ParamsB
trim = TrimTree(Tree=ccx.ParamsA, Depth=1)
shatter_2 = Shatter(Curve=scale_3.Geometry, Parameters=trim)
item = ListItem(List=shatter_2, Index="1", Wrap=True)  # -> flatten(Item)
divide_2 = DivideCurve(Curve=item, Count="50", Kinks=False)  # -> Points, Tangents, Parameters
lng_2 = ListLength(List=divide_2.Points)
series_2 = Series(Start=0, Step=1, Count=lng_2)
bnd_3 = Bounds(Numbers=series_2)
remap_4 = RemapNumbers(Value=series_2, Source=bnd_3, Target=Domain(0, 1))  # -> Mapped, Clipped
graph_3 = GraphMapper(remap_4.Mapped, x0=0, x1=1, y0=0, y1=1, container_name="Sine", Equation_px=[0, 0.1247204766], Equation_py=[0, 1])
replace_2 = ReplaceItems(List=graph_3, Item="0", Indices="50", Wrap=False)
num = Number(graph_2)
vec_4 = Vector(deplane.YAxis)
multiplication_5 = Multiplication(A=replace_2, B=graft(num), C=Slider(10, range=0..10))
amp_2 = Amplitude(Vector=graft(vec_4), Amplitude=multiplication_5)
move_2 = Move(Geometry=divide_2.Points, Motion=amp_2)  # -> Geometry, Transform
intcrv = Interpolate(Vertices=move_2.Geometry, Degree=3, Periodic=False, KnotStyle=1)  # -> flatten(Curve), Length, Domain
shift_2 = ShiftList(List=intcrv.Curve, Shift=1, Wrap=invert(True))
short_2 = ShortestList(ListA=intcrv.Curve, ListB=shift_2, TrimMode=2)  # -> graft(ListA), graft(ListB)
loft_2 = Loft(
    Curves=[short_2.ListA, short_2.ListB],
    Options={Adjust=False, Closed=False, LoftEnds=0, LoftSimp=0, LoftType=0, Rebuild=10, Refit=0.01})

# ---- group: Internal (continued)
crv_3 = Curve(scale_2.Geometry)
ccx_2 = CurveCurve(CurveA=scale.Geometry, CurveB=crv_3)  # -> Points, ParamsA, ParamsB
trim_2 = TrimTree(Tree=ccx_2.ParamsA, Depth=1)
shatter_3 = Shatter(Curve=scale.Geometry, Parameters=trim_2)
item_2 = ListItem(List=shatter_3, Index="1", Wrap=True)  # -> flatten(Item)
shift_3 = ShiftList(List=item_2, Shift=1, Wrap=invert(True))
short_3 = ShortestList(ListA=item_2, ListB=shift_3, TrimMode=2)  # -> graft(ListA), graft(ListB)
loft_3 = Loft(
    Curves=[short_3.ListA, short_3.ListB],
    Options={Adjust=False, Closed=False, LoftEnds=0, LoftSimp=0, LoftType=0, Rebuild=10, Refit=0.01})

# ---- group: Interlock
end_3 = EndPoints(Curve=item_2)  # -> Start, End
end_4 = EndPoints(Curve=intcrv.Curve)  # -> Start, End
ln_4 = Line(StartPoint=end_3.Start, EndPoint=end_4.Start)
ln_5 = Line(StartPoint=end_3.End, EndPoint=end_4.End)
graft_3 = GraftTree(Tree=ln_5, IncludeEmptyLists=True, IncludeNullItems=True)
graft_4 = GraftTree(Tree=ln_4, IncludeEmptyLists=True, IncludeNullItems=True)
panel_2 = Panel("""0.1
0.9""")
merge_3 = Merge(Data1=graft_4, Data2=graft_3)  # -> simplify(Result)
shatter_4 = Shatter(Curve=reparameterize(merge_3), Parameters=panel_2)
item_3 = ListItem(List=shatter_4, Index="1", Wrap=True)
divide_3 = DivideCurve(Curve=item_3, Count="50", Kinks=False)  # -> Points, Tangents, Parameters
lng_3 = ListLength(List=divide_3.Points)
series_3 = Series(Start=0, Step=1, Count=lng_3)
bnd_4 = Bounds(Numbers=series_3)
remap_5 = RemapNumbers(Value=series_3, Source=bnd_4, Target=Domain(0, 1))  # -> Mapped, Clipped
graph_4 = GraphMapper(remap_5.Mapped, x0=0, x1=1, y0=0, y1=1, container_name="Sine", Equation_px=[0, 0.2509058118], Equation_py=[0, 1])
num_2 = Number(graph_2)
dup = DuplicateData(Data=num_2, Number=2, Order=invert(True))  # -> graft(Data)
dup_2 = DuplicateData(Data=deplane.ZAxis, Number=2, Order=invert(True))
multiplication_6 = Multiplication(A=graph_4, B=Slider(17.27, range=0..20), C=dup)
replace_3 = ReplaceItems(List=multiplication_6, Item="0", Indices="50", Wrap=False)
amp_3 = Amplitude(Vector=graft(dup_2), Amplitude=replace_3)
move_3 = Move(Geometry=divide_3.Points, Motion=amp_3)  # -> Geometry, Transform
cull_i = CullIndex(List=shatter_4, Indices="1", Wrap=True)
intcrv_2 = Interpolate(Vertices=move_3.Geometry, Degree=3, Periodic=False, KnotStyle=1)  # -> Curve, Length, Domain
match = MatchTree(Tree=intcrv_2.Curve, Guide=cull_i)
join_2 = JoinCurves(Curves=[match, cull_i], Preserve=False)
reb = RebuildCurve(Curve=join_2, Count="50", Tangents=False)  # -> simplify(Curve)
trim_3 = TrimTree(Tree=reb, Depth=1)
crv_4 = Curve(item_2)
crv_5 = Curve(intcrv.Curve)
panel_3 = Panel("""0
-1""")
item_4 = ListItem(List=crv_4, Index=panel_3, Wrap=True)  # -> graft(Item)
item_5 = ListItem(List=crv_5, Index=panel_3, Wrap=True)  # -> graft(Item)
swp2 = Sweep2(Rail1=graft(crv_4), Rail2=graft(crv_5), Sections=trim_3, SameHeight=False)  # -> flatten(Brep)
merge_4 = Merge(Data1=item_4, Data2=item_5)
loft_4 = Loft(Curves=merge_4, Options={Adjust=False, Closed=False, LoftEnds=0, LoftSimp=0, LoftType=0, Rebuild=10, Refit=0.01})  # -> flatten(Loft)
panel_4 = Panel("""0
19""")
replace_4 = ReplaceItems(List=swp2, Item=loft_4, Indices=panel_4, Wrap=False)
shift_4 = ShiftList(List=replace_4, Shift=1, Wrap=invert(True))
short_4 = ShortestList(ListA=replace_4, ListB=shift_4, TrimMode=2)  # -> graft(ListA), graft(ListB)

# ---- group: label
merge_5 = Merge(Data1=simplify(loft_3), Data2=simplify(loft_2), Data3=simplify(short_4.ListA), Data4=simplify(short_4.ListB))
join_3 = BrepJoin(Breps=merge_5)  # -> Breps, Closed
cap = CapHoles(Brep=join_3.Breps)
area_2 = Area(Geometry=cap)  # -> Area, Centroid
tstat = TreeStatistics(Tree=area_2.Centroid)  # -> Paths, Length, Count
series_4 = Series(Start=0, Step="250", Count=tstat.Count)  # -> graft(Series)
series_5 = Series(Start=0, Step=1, Count=tstat.Count)  # -> graft(Series)
pdecon_3 = Deconstruct(Point=area_2.Centroid)  # -> XComponent, YComponent, ZComponent
pt_5 = ConstructPoint(XCoordinate=pdecon_3.XComponent, YCoordinate=0, ZCoordinate=pdecon_3.ZComponent)
pt_6 = ConstructPoint(XCoordinate=series_4, YCoordinate="350", ZCoordinate=0)
concat = Concatenate(FragmentA="A", FragmentB=series_5)
pt_7 = ConstructPoint(XCoordinate=series_4, YCoordinate="500", ZCoordinate=0)
xz = XZPlane(Origin=pt_5)
pflip = FlipPlane(Plane=xz, ReverseX=False, ReverseY=False, SwapAxes=True)
orient = Orient(Geometry=cap, Source=pflip, Target=pt_7)  # -> Geometry, Transform
justified_text = JustifiedText3d(Location=pt_6, Text=concat, Size="50", HorizontalAlignment=1, VerticalAlginment=1, UseMeshes=False, Bake=False)
