# Grasshopper definition #9_six_facade.gh (Grasshopper 1.0.7)
# plug-ins: LunchBox, Kangaroo2 Components, Noise, MeshEdit Components, Weaverbird

division = Division(A="90", B="10")
series = Series(Start=0, Step=division, Count="10")
bnd = Bounds(Numbers=series)
cir = Circle(Plane=PlaneXY(0, 0, 0), Radius="37.5")
remap = RemapNumbers(Value=series, Source=bnd, Target=Domain(0, 1))  # -> Mapped, Clipped
Z = UnitZ(Factor=series)
move = Move(Geometry=cir, Motion=Z)  # -> Geometry, Transform
graph = GraphMapper(
    remap.Mapped,
    x0=0,
    x1=1,
    y0=0,
    y1=1,
    container_name="Bezier2",
    pt=[Point(0, 0.7635241747, 0), Point(0.2155852616, 0.9930933118, 0), Point(0.3816438219, 0.94488203, 0), Point(0.5022485256, 0.891284883, 0), Point(0.6479850411, 0.8265190721, 0), Point(0.7104435563, 0.7901870012, 0), Point(1, 0.6301552653, 0)])
area = Area(Geometry=move.Geometry)  # -> Area, Centroid
scale = Scale(Geometry=move.Geometry, Center=area.Centroid, Factor=graph)  # -> Geometry, Transform
loft = Loft(Curves=scale.Geometry, Options={Adjust=False, Closed=False, LoftEnds=0, LoftSimp=0, LoftType=0, Rebuild=10, Refit=0.01})
contour = Contour(Shape=loft, Point=Point(0, 0, 0), Direction=Vector(0, 0, 1), Distance="1.25")

sframes = SurfaceFrames(Surface=loft, UCount="30", VCount="30")  # -> Frames, Parameters
flip = FlipMatrix(Data=sframes.Frames)
deplane = DeconstructPlane(Plane=flip)  # -> Origin, XAxis, YAxis, ZAxis
pdecon = Deconstruct(Point=deplane.Origin)  # -> XComponent, YComponent, ZComponent
bnd_2 = Bounds(Numbers=pdecon.ZComponent)
remap_2 = RemapNumbers(Value=pdecon.ZComponent, Source=bnd_2, Target=Domain(0, 1))  # -> Mapped, Clipped
pi = Pi(Factor=1)
multiplication = Multiplication(A=remap_2.Mapped, B=pi, C=Slider(5, range=1..5))
tstat = TreeStatistics(Tree=multiplication)  # -> Paths, Length, Count
sin = Sine(Value=multiplication)
series_2 = Series(Start=0, Step=1, Count=tstat.Count)
pow = Power(A="-1", B=series_2)
multiplication_2 = Multiplication(A=sin, B=Slider(1, range=0..10), C=graft(pow))
amp = Amplitude(Vector=deplane.YAxis, Amplitude=multiplication_2)
move_2 = Move(Geometry=deplane.Origin, Motion=amp)  # -> Geometry, Transform
flip_2 = FlipMatrix(Data=move_2.Geometry)
shift = ShiftList(List=flip_2, Shift=1, Wrap=True)
graft = GraftTree(Tree=flip_2, IncludeEmptyLists=True, IncludeNullItems=True)
graft_2 = GraftTree(Tree=shift, IncludeEmptyLists=True, IncludeNullItems=True)
merge = Merge(Data1=simplify(graft_2), Data2=simplify(graft))
avr = Average(Input=merge)
trim = TrimTree(Tree=avr, Depth=1)
brep = Brep(loft)
srf_cp = SurfaceClosestPoint(Point=trim, Surface=brep)  # -> Point, UVPoint, Distance
evalsrf = EvaluateSurface(Surface=brep, Point=srf_cp.UVPoint)  # -> Point, Normal, UDirection, VDirection, Frame
devec = DeconstructVector(Vector=evalsrf.Normal)  # -> XComponent, YComponent, ZComponent
vec = VectorXYZ(XComponent=devec.XComponent, YComponent=devec.YComponent, ZComponent=0)  # -> Vector, Length
amp_2 = Amplitude(Vector=vec.Vector, Amplitude=Slider(1.51, range=0..10))
pt = Point(simplify(flip_2))
move_3 = Move(Geometry=trim, Motion=amp_2)  # -> simplify(Geometry), Transform
merge_2 = Merge(Data1=move_3.Geometry, Data2=pt)
avr_2 = Average(Input=merge_2)
cir_2 = Circle(Plane=avr_2, Radius=1)
crv_cp = CurveClosestPoint(Point=merge_2, Curve=cir_2)  # -> Point, Parameter, Distance
sort = SortList(Keys=crv_cp.Parameter, ValuesA=merge_2)  # -> Keys, ValuesA
intcrv = Interpolate(Vertices=sort.ValuesA, Degree=3, Periodic=invert(False), KnotStyle=0)  # -> flatten(Curve), Length, Domain
pt_2 = ConstructPoint(XCoordinate="100", YCoordinate="100", ZCoordinate=0)
crv_cp_2 = CurveClosestPoint(Point=pt_2, Curve=intcrv.Curve)  # -> Point, Parameter, Distance
seam = Seam(Curve=intcrv.Curve, Seam=crv_cp_2.Parameter)
loft_2 = Loft(Curves=seam, Options={Adjust=False, Closed=False, LoftEnds=0, LoftSimp=0, LoftType=0, Rebuild=10, Refit=0.01})

number_slider = Slider(8, range=5..20)
trib = TrianglePanelsB(Surface=loft, UDivisions=number_slider, VDivisions=Slider(22, range=10..50))
multiplication_3 = Multiplication(A=number_slider, B=2)
series_3 = Series(Start=0, Step=1, Count=multiplication_3)
area_2 = Area(Geometry=trib)  # -> Area, Centroid
sort_2 = SortList(Keys=area_2.Area, ValuesA=trib)  # -> Keys, ValuesA
cull_i = CullIndex(List=sort_2.ValuesA, Indices=series_3, Wrap=True)
item = ListItem(List=sort_2.ValuesA, Index=series_3, Wrap=True)
area_3 = Area(Geometry=item)  # -> Area, Centroid
pdecon_2 = Deconstruct(Point=area_3.Centroid)  # -> XComponent, YComponent, ZComponent
sort_3 = SortList(Keys=pdecon_2.ZComponent, ValuesA=item)  # -> Keys, ValuesA
partition = PartitionList(List=sort_3.ValuesA, Size="2")
debrep = DeconstructBrep(Brep=partition)  # -> Faces, Edges, Vertices
trim_2 = TrimTree(Tree=debrep.Vertices, Depth=1)
duppt = RemoveDuplicatePts(Points=trim_2, Tolerance=0.01)
avr_3 = Average(Input=duppt)
brep_cp = BrepClosestPoint(Point=avr_3, Brep=loft)  # -> Point, Normal, Distance
pl = PlaneNormal(Origin=avr_3, ZAxis=brep_cp.Normal)
cir_3 = Circle(Plane=pl, Radius=1)
crv_cp_3 = CurveClosestPoint(Point=duppt, Curve=cir_3)  # -> Point, Parameter, Distance
sort_4 = SortList(Keys=crv_cp_3.Parameter, ValuesA=duppt)  # -> Keys, ValuesA
shift_2 = ShiftList(List=sort_4.ValuesA, Shift=1, Wrap=True)
ln = Line(StartPoint=sort_4.ValuesA, EndPoint=shift_2)
shift_3 = ShiftList(List=ln, Shift=1, Wrap=True)
angle = Angle(VectorA=ln, VectorB=shift_3)  # -> Angle, Reflex
deg = Degrees(Radians=angle.Angle)
smaller = SmallerThan(FirstNumber=deg, SecondNumber=50)  # -> SmallerThan, OrEqualTo
dispatch = Dispatch(List=shift_2, DispatchPattern=smaller.SmallerThan)  # -> ListA, ListB
pline = PolyLine(Vertices=dispatch.ListB, Closed=invert(False))  # -> flatten(Polyline)
boundary = BoundarySurfaces(Edges=pline)
merge_3 = Merge(Data1=boundary, Data2=cull_i)  # -> flatten(Result)
area_4 = Area(Geometry=merge_3)  # -> Area, Centroid
srf_cp_2 = SurfaceClosestPoint(Point=area_4.Centroid, Surface=merge_3)  # -> Point, UVPoint, Distance
evalsrf_2 = EvaluateSurface(Surface=merge_3, Point=srf_cp_2.UVPoint)  # -> Point, Normal, UDirection, VDirection, Frame
graft_3 = GraftTree(Tree=merge_3, IncludeEmptyLists=True, IncludeNullItems=True)
pdecon_3 = Deconstruct(Point=evalsrf_2.Point)  # -> XComponent, YComponent, ZComponent
bnd_3 = Bounds(Numbers=pdecon_3.ZComponent)
devec_2 = DeconstructVector(Vector=evalsrf_2.Normal)  # -> XComponent, YComponent, ZComponent
remap_3 = RemapNumbers(Value=pdecon_3.ZComponent, Source=bnd_3, Target=Domain(0, 1))  # -> Mapped, Clipped
vec_2 = VectorXYZ(XComponent=devec_2.XComponent, YComponent=devec_2.YComponent, ZComponent=0)  # -> Vector, Length
graph_2 = GraphMapper(
    remap_3.Mapped,
    x0=0,
    x1=1,
    y0=0,
    y1=1,
    container_name="Bezier",
    cpx=[0, 0.4805696011, 0.6580863595, 1],
    cpy=[1, 0.3586390615, 0, 0])
multiplication_4 = Multiplication(A=graph_2, B=Slider(4, range=0..10))
amp_3 = Amplitude(Vector=vec_2.Vector, Amplitude=expr("-x", multiplication_4))
move_4 = Move(Geometry=evalsrf_2.Point, Motion=amp_3)  # -> simplify(graft(Geometry)), Transform
debrep_2 = DeconstructBrep(Brep=graft_3)  # -> Faces, Edges, simplify(Vertices)
merge_4 = Merge(Data1=debrep_2.Vertices, Data2=move_4.Geometry)
item_2 = ListItem(List=merge_4, Index=0, Wrap=True)  # -> Item, Item1, Item2, Item3
srf4pt = _4PointSurface(CornerA=item_2.Item, CornerB=item_2.Item1, CornerC=item_2.Item3)
srf4pt_2 = _4PointSurface(CornerA=item_2.Item1, CornerB=item_2.Item2, CornerC=item_2.Item3)
srf4pt_3 = _4PointSurface(CornerA=item_2.Item2, CornerB=item_2.Item3, CornerC=item_2.Item)
merge_5 = Merge(Data1=srf4pt_3, Data2=srf4pt, Data3=srf4pt_2)  # -> flatten(Result)
join = BrepJoin(Breps=merge_5)  # -> Breps, Closed
contour_2 = Contour(Shape=join.Breps, Point=Point(0, 0, 0), Direction=Vector(0, 0, 1), Distance="1.1")

tstat_2 = TreeStatistics(Tree=contour)  # -> Paths, Length, Count
series_4 = Series(Start=0, Step=1, Count=tstat_2.Count)
bnd_4 = Bounds(Numbers=series_4)
remap_4 = RemapNumbers(Value=series_4, Source=bnd_4, Target=Domain(0, 1))  # -> Mapped, Clipped
neg = Negative(Value="5")
graph_3 = GraphMapper(remap_4.Mapped, x0=0, x1=1, y0=0, y1=1, container_name="Sine", Equation_px=[0, 0.2534195483], Equation_py=[0, 1])
area_5 = Area(Geometry=contour)  # -> Area, Centroid
dom = ConstructDomain(DomainStart=neg, DomainEnd="5")
remap_5 = RemapNumbers(Value=graph_3, Source=Domain(0, 1), Target=dom)  # -> graft(Mapped), Clipped
rotate = Rotate(Geometry=contour, Angle=degrees(remap_5.Mapped), Plane=area_5.Centroid)  # -> Geometry, Transform
divide = DivideCurve(Curve=rotate.Geometry, Count="120", Kinks=False)  # -> Points, Tangents, Parameters
panel = Panel("""0
1
2""")
partition_2 = PartitionList(List=divide.Points, Size="4")
item_3 = ListItem(List=partition_2, Index=panel, Wrap=True)
cull_i_2 = CullIndex(List=partition_2, Indices=panel, Wrap=True)
pt_3 = Point(item_3)
item_4 = ListItem(List=item_3, Index=0, Wrap=True)  # -> Item1, Item
srf_cp_3 = SurfaceClosestPoint(Point=pt_3, Surface=loft)  # -> Point, UVPoint, Distance
evalsrf_3 = EvaluateSurface(Surface=loft, Point=srf_cp_3.UVPoint)  # -> Point, Normal, UDirection, VDirection, Frame
merge_6 = Merge(Data1=item_4.Item, Data2=item_4.Item1)
pt_4 = Point(evalsrf_3.Point)
devec_3 = DeconstructVector(Vector=evalsrf_3.Normal)  # -> XComponent, YComponent, ZComponent
avr_4 = Average(Input=pt_4)  # -> flatten(ArithmeticMean)
crv = Curve(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)
vec_3 = VectorXYZ(XComponent=devec_3.XComponent, YComponent=devec_3.YComponent, ZComponent=0)  # -> Vector, Length
crv_cp_4 = CurveClosestPoint(Point=avr_4, Curve=crv)  # -> Point, Parameter, Distance
bnd_5 = Bounds(Numbers=crv_cp_4.Distance)
remap_6 = RemapNumbers(Value=crv_cp_4.Distance, Source=bnd_5, Target=Domain(0, 1))  # -> Mapped, Clipped
neg_2 = Negative(Value="2")
graph_4 = GraphMapper(
    remap_6.Mapped,
    x0=0,
    x1=1,
    y0=0,
    y1=1,
    container_name="Bezier2",
    pt=[Point(0, 0, 0), Point(0.09248585999, 0.001136958599, 0), Point(0.3537867367, 0.08325815201, 0), Point(0.5228773355, 0.4049265981, 0), Point(0.7040721076, 0.7496213425, 0), Point(0.6868320107, 1, 0), Point(1, 1, 0)])
dom_2 = ConstructDomain(DomainStart="0.01", DomainEnd=neg_2)
remap_7 = RemapNumbers(Value=graph_4, Source=Domain(0, 1), Target=dom_2)  # -> Mapped, Clipped
panel_2 = Panel(graph_4)
match = MatchTree(Tree=graft(remap_7.Mapped), Guide=evalsrf_3.Point)
amp_4 = Amplitude(Vector=vec_3.Vector, Amplitude=match)
move_5 = Move(Geometry=evalsrf_3.Point, Motion=amp_4)  # -> Geometry, Transform
ins = InsertItems(List=merge_6, Item=move_5.Geometry, Indices="1", Wrap=True)
merge_7 = Merge(Data1=simplify(ins), Data2=simplify(cull_i_2))  # -> simplify(Result)
trim_3 = TrimTree(Tree=merge_7, Depth=1)
pline_2 = PolyLine(Vertices=trim_3, Closed=invert(False))  # -> flatten(Polyline)
loft_3 = Loft(Curves=pline_2, Options={Adjust=False, Closed=False, LoftEnds=0, LoftSimp=0, LoftType=0, Rebuild=10, Refit=0.01})

neg_3 = Negative(Value="20")
dom_3 = ConstructDomain(DomainStart=neg_3, DomainEnd="20")
remap_8 = RemapNumbers(Value=graph_3, Source=Domain(0, 1), Target=dom_3)  # -> graft(Mapped), Clipped
rotate_2 = Rotate(Geometry=contour, Angle=degrees(remap_8.Mapped), Plane=area_5.Centroid)  # -> Geometry, Transform
divide_2 = DivideCurve(Curve=rotate_2.Geometry, Count="20", Kinks=False)  # -> Points, Tangents, Parameters
dispatch_2 = Dispatch(List=divide_2.Points, DispatchPattern=[True, False])  # -> ListA, ListB
srf_cp_4 = SurfaceClosestPoint(Point=dispatch_2.ListA, Surface=loft)  # -> Point, UVPoint, Distance
evalsrf_4 = EvaluateSurface(Surface=loft, Point=srf_cp_4.UVPoint)  # -> Point, Normal, UDirection, VDirection, Frame
tstat_3 = TreeStatistics(Tree=evalsrf_4.Normal)  # -> Paths, Length, Count
devec_4 = DeconstructVector(Vector=evalsrf_4.Normal)  # -> XComponent, YComponent, ZComponent
series_5 = Series(Start=0, Step=1, Count=tstat_3.Count)
vec_4 = VectorXYZ(XComponent=devec_4.XComponent, YComponent=devec_4.YComponent, ZComponent=0)  # -> Vector, Length
bnd_6 = Bounds(Numbers=series_5)
remap_9 = RemapNumbers(Value=series_5, Source=bnd_6, Target=Domain(0, 1))  # -> Mapped, Clipped
graph_5 = GraphMapper(remap_9.Mapped, x0=0, x1=1, y0=0, y1=1, container_name="Bezier", cpx=[0, 1, 0.3059979379, 1], cpy=[0, 0, 1, 1])
multiplication_5 = Multiplication(A="-3", B=graph_5)  # -> reverse(graft(Result))
amp_5 = Amplitude(Vector=vec_4.Vector, Amplitude=multiplication_5)
bnd_7 = Bounds(Numbers=multiplication_5)  # -> flatten(Domain)
move_6 = Move(Geometry=dispatch_2.ListA, Motion=amp_5)  # -> Geometry, Transform
weave = Weave(Pattern=[0, 1], Stream0=move_6.Geometry, Stream1=dispatch_2.ListB, NullGaps=False)
pline_3 = PolyLine(Vertices=weave, Closed=invert(False))  # -> flatten(Polyline)
loft_4 = Loft(Curves=pline_3, Options={Adjust=False, Closed=False, LoftEnds=0, LoftSimp=0, LoftType=0, Rebuild=10, Refit=0.01})

vec_5 = VectorXYZ(XComponent="-0.5", YComponent="-0.5", ZComponent="-0.5")  # -> Vector, Length
pi_2 = Pi(Factor=1)
neg_4 = Negative(Value="2.5")
dom_4 = ConstructDomain(DomainStart=neg_4, DomainEnd="2.5")

sdivide = DivideSurface(Surface=loft, UCount="50", VCount="80")  # -> flatten(Points), flatten(Normals), Parameters
bbox = BoundingBox(Content=sdivide.Points, Plane=PlaneXY(0, 0, 0), UnionBox=True)  # -> Box, Box_2
pop3d = Populate3D(Region=bbox.Box, Count="100", Seed=1)
pn = PerlinNoise(
    Points=sdivide.Points,
    Seed="500",
    Amplitude=1,
    SmoothStep=0,
    FrequecyX="2",
    FrequecyY="2",
    FrequecyZ="2",
    Jitter=0,
    AlignVector=Vector(1, 0, 0))
wn = WorleyNoise(Points=sdivide.Points, Centers=pop3d, DistanceMetric=0, Seed=0)  # -> F1, F2, F3, F4
subtraction = Subtraction()
graph_6 = GraphMapper(
    pn,
    x0=0,
    x1=1,
    y0=0,
    y1=1,
    container_name="Polyline",
    pt=[Point(0, 0, 0), Point(0.1825687587, 0, 0), Point(0.3052244186, 0, 0), Point(0.6081465483, 1, 0), Point(1, 1, 0)])
devec_5 = DeconstructVector(Vector=sdivide.Normals)  # -> XComponent, YComponent, ZComponent
neg_5 = Negative(Value="5")
dom_5 = ConstructDomain(DomainStart=neg_5, DomainEnd="5")
vec_6 = VectorXYZ(XComponent=devec_5.XComponent, YComponent=devec_5.YComponent, ZComponent=0)  # -> Vector, Length

pn_2 = PerlinNoise(
    Points=sdivide.Points,
    Seed="499",
    Amplitude=1,
    SmoothStep=0,
    FrequecyX="1.5",
    FrequecyY="1.5",
    FrequecyZ="1.5",
    Jitter=0,
    AlignVector=Vector(1, 0, 0))
pn_3 = PerlinNoise(
    Points=sdivide.Points,
    Seed="500",
    Amplitude=1,
    SmoothStep=0,
    FrequecyX="3.5",
    FrequecyY="3.5",
    FrequecyZ="3.5",
    Jitter="1",
    AlignVector=vec_5.Vector)
graph_7 = GraphMapper(
    pn_2,
    x0=0,
    x1=1,
    y0=0,
    y1=1,
    container_name="Polyline",
    pt=[Point(0, 0, 0), Point(0.1825687587, 0, 0), Point(0.4715943336, 0, 0), Point(0.6081465483, 1, 0), Point(1, 1, 0)])
multiplication_6 = Multiplication(A=pn_3, B=pi_2, C=Slider(3, range=1..10))
sin_2 = Sine(Value=multiplication_6)
bnd_8 = Bounds(Numbers=sin_2)
remap_10 = RemapNumbers(Value=sin_2, Source=bnd_8, Target=dom_4)  # -> Mapped, Clipped
multiplication_7 = Multiplication(A=remap_10.Mapped, B=graph_7)
amp_6 = Amplitude(Vector=vec_6.Vector, Amplitude=multiplication_7)
move_7 = Move(Geometry=sdivide.Points, Motion=amp_6)  # -> Geometry, Transform
frompoints = MeshFromPoints(Points=move_7.Geometry, UDirection=expr("x+1", "50"), VDirection=expr("x+1", "80"))
wbcatmullclark = WeaverbirdsCatmullClarkSubdivision(MeshCurves=frompoints, Level="2", SmoothNakedEdges=1)

addition = Addition(A=wn.F1, B=wn.F2, C=wn.F3, D=wn.F4)

bnd_9 = Bounds(Numbers=addition)
remap_11 = RemapNumbers(Value=addition, Source=bnd_9, Target=dom_5)  # -> Mapped, Clipped
multiplication_8 = Multiplication(A=remap_11.Mapped, B=graph_6)
amp_7 = Amplitude(Vector=vec_6.Vector, Amplitude=multiplication_8)
move_8 = Move(Geometry=sdivide.Points, Motion=amp_7)  # -> Geometry, Transform
frompoints_2 = MeshFromPoints(Points=move_8.Geometry, UDirection=expr("x+1", "50"), VDirection=expr("x+1", "80"))
wbcatmullclark_2 = WeaverbirdsCatmullClarkSubdivision(MeshCurves=frompoints_2, Level="2", SmoothNakedEdges=1)
